# Grasshopper definition assembly_example.ghx (Grasshopper 1.0.7)

# ----
# Assembly
bang = Button()
panel = Panel("Unload libraries")
unload = PythonScript(bang=bang)
# ---------- unload: Python ----------
from compas_rhino.utilities.misc import get_tolerance
from compas_rhino.utilities.misc import unload_modules

unload_modules("compas")
unload_modules("compas_fab")
unload_modules("ur_online_control")
# ---------- end unload ----------

show = BooleanToggle(True)
# Elements
panel_2 = Panel("Define two elements")
block_def = GhPythonScript()  # -> out, block, block_l
# ---------- block_def: Python ----------
import os
import sys
import json

from compas.geometry import Frame
from compas.geometry import Vector
from compas.geometry import Box
from compas_fab.robots import Configuration

from ur_online_control.assembly import Element

#box = Box(Frame.worldXY(), 4, 4, 4)

#block_definition
width = 20.
length = 230.
length_l = length - width
height = 5.

#tolerance_vector = Vector(0, 0, 1.)
#savelevel_vector = Vector(0, 0, 50.)

#picking_frame = Frame([-0.43, 0, height], [1, 0, 0], [0, 1, 0])
#picking_configuration = Configuration.from_revolute_values([-6.027, 4.443, -2.313, 5.724, 1.571, -2.885])


# block long
box_frame = Frame([-length, -width, 0.], [1, 0, 0], [0, 1, 0])
box = Box(box_frame, length, width, height)
gripping_frame = Frame([0, 0, height], [1, 0, 0], [0, -1, 0])
block = Element.from_shape(box, gripping_frame)
block.id = "long"


# block short
box_frame_l = Frame([-length_l, -width, 0.], [1, 0, 0], [0, 1, 0])
box_l = Box(box_frame, length_l, width, height)
gripping_frame = Frame([0, 0, height], [1, 0, 0], [0, -1, 0])
block_l = Element.from_shape(box, gripping_frame)
block_l.id = "short"
# ---------- end block_def ----------
draw = PythonScript(block=block_def.block, block_l=block_def.block_l, show=show)  # -> M, F, S
# ---------- draw: Python ----------
from compas.geometry import Transformation
from compas.geometry import Frame
from compas.datastructures import mesh_transformed
from compas_ghpython.artists import MeshArtist
from compas_ghpython import draw_frame

if show:
    artist = MeshArtist(block.mesh)
    M = artist.draw_mesh()
    F = draw_frame(block.frame)
    S = draw_frame(block._source.frame)
# ---------- end draw ----------

# ----
# Define an element and its dimensions
# Visualise the defined element
show_2 = BooleanToggle(False)
block_def_2 = GhPythonScript()  # -> out, block
# ---------- block_def_2: Python ----------
import os
import sys
import json

from compas.geometry import Frame
from compas.geometry import Vector
from compas.geometry import Box
from compas_fab.robots import Configuration

from ur_online_control.assembly import Element


# 
width = 20.
length = 230.
height = 5.

#tolerance_vector = Vector(0, 0, 1.)
#savelevel_vector = Vector(0, 0, 50.)

#picking_frame = Frame([-0.43, 0, height], [1, 0, 0], [0, 1, 0])
#picking_configuration = Configuration.from_revolute_values([-6.027, 4.443, -2.313, 5.724, 1.571, -2.885])

# block
box_frame = Frame([-length/2., -width/2., 0.], [1, 0, 0], [0, 1, 0]) #center of the box frame 
box = Box(box_frame, length, width, height) 
gripping_frame = Frame([0, 0, height], [1, 0, 0], [0, -1, 0])
block = Element.from_shape(box, gripping_frame)
block.id = "short"
# ---------- end block_def_2 ----------
draw_2 = PythonScript(block=block_def_2.block, show=show_2)  # -> M, F, S; same code as draw

show_3 = BooleanToggle(True)
show_4 = BooleanToggle(True)
panel_3 = Panel("Define two elements")
block_short = GhPythonScript()  # -> out, block
# ---------- block_short: Python ----------
import os
import sys
import json

from compas.geometry import Frame
from compas.geometry import Vector
from compas.geometry import Box
from compas_fab.robots import Configuration

from ur_online_control.assembly import Element

#box = Box(Frame.worldXY(), 4, 4, 4)

#block_short
width = 20.
length = 200.
length_l = length - width
height = 5.

#tolerance_vector = Vector(0, 0, 1.)
#savelevel_vector = Vector(0, 0, 50.)

#picking_frame = Frame([-0.43, 0, height], [1, 0, 0], [0, 1, 0])
#picking_configuration = Configuration.from_revolute_values([-6.027, 4.443, -2.313, 5.724, 1.571, -2.885])


# block_short
box_frame = Frame([-length_l, -width, 0.], [1, 0, 0], [0, 1, 0])
box = Box(box_frame, length_l, width, height)
gripping_frame = Frame([0, 0, height], [1, 0, 0], [0, -1, 0])
block = Element.from_shape(box, gripping_frame)
block.id = "short"
# ---------- end block_short ----------
draw_3 = PythonScript(block=block_short.block, show=show_4)  # -> M, F, S; same code as draw
block_long = GhPythonScript()  # -> out, block
# ---------- block_long: Python ----------
import os
import sys
import json

from compas.geometry import Frame
from compas.geometry import Vector
from compas.geometry import Box
from compas_fab.robots import Configuration

from ur_online_control.assembly import Element

#box = Box(Frame.worldXY(), 4, 4, 4)

#block_long
width = 20.
length = 200.
length_l = length - width
height = 5.

#tolerance_vector = Vector(0, 0, 1.)
#savelevel_vector = Vector(0, 0, 50.)

#picking_frame = Frame([-0.43, 0, height], [1, 0, 0], [0, 1, 0])
#picking_configuration = Configuration.from_revolute_values([-6.027, 4.443, -2.313, 5.724, 1.571, -2.885])


# block long
box_frame = Frame([-length, -width, 0.], [1, 0, 0], [0, 1, 0])
box = Box(box_frame, length, width, height)
gripping_frame = Frame([0, 0, height], [1, 0, 0], [0, -1, 0])
block = Element.from_shape(box, gripping_frame)
block.id = "long"
# ---------- end block_long ----------
draw_4 = PythonScript(block=block_long.block, show=show_3)  # -> M, F, S; same code as draw

# ----
# 1. Generate an assembly containing the trasformed planes of the elements
# 2. Position your assebly:
#    Choose between a center plane (placed in the middle of the table) and a custom "cp_new" plane.
cp = Plane(PlaneXY(707.5, 0.9999999975, -4.999999993))
cp_new = Plane(PlaneXY(800, 0, 0))
generate_assembly = GhPythonScript(centerplane=cp, block=block_def_2.block, transform=Toggle(False), ptransf=cp_new)  # -> assembly, planes; inputs ptransf: Plane
# ---------- generate_assembly: Python ----------
import Rhino.Geometry as rg
import math
from scriptcontext import sticky as st


from compas.geometry import Frame
from compas.geometry import Transformation
from compas.geometry import Rotation
from compas.geometry import Translation
from compas.geometry import Point

from compas_ghpython.geometry import xtransformed
from compas_ghpython import draw_frame

from ur_online_control.assembly import Assembly
from ur_online_control.assembly import Element

import Rhino.Geometry as rg






# initialize an empty assembly class
assembly = Assembly()

planes = [] # just for vizualisation


#cp.Rotate(math.radians(90), cp.ZAxis, cp.Origin)
#cp.Translate(rg.Vector3d(0,0,1))
cp = centerplane
cf = Frame(cp.Origin, cp.XAxis, cp.YAxis)


for i in range(25): # loop through the number of layers i
    
    axis = cf.zaxis
    angle = math.radians(i*3)
    
    R = Rotation.from_axis_and_angle(axis, angle, point=cp.Origin) #Calculates a ``Rotation`` from a rotation axis and an angle and an optional point of rotation.
    T = Translation([0,0,5*i])
   

    cft = cf.transformed(R * T) #transforms the origin plane

    if i%2 == 0: 
        R = Rotation.from_axis_and_angle(cft.zaxis, math.radians(90), point=cft.point)
        cft = cft.transformed(R)
       
    add = math.sin(i/5)*15
    #print(add)
    
    o1 = cft.point + cft.yaxis*(75+add)
    o2 = cft.point - cft.yaxis*(75+add)
    
    f1 = Frame(o1, cft.xaxis, cft.yaxis)
    f2 = Frame(o2, cft.xaxis, cft.yaxis)
    
    planes.append(draw_frame(f1))
    planes.append(draw_frame(f2))
    
    T1 = Transformation.from_frame_to_frame(Frame.worldXY(), f1)
    T2 = Transformation.from_frame_to_frame(Frame.worldXY(), f2)
    
    #T1 = Translation([10,2,3])
    
    # create new instances of the element
    new_block_1 = block.transformed(T1) #returns a deep copy of the initial element at the new location of the frame
    new_block_2 = block.transformed(T2)

    assembly.add_element(new_block_1)
    assembly.add_element(new_block_2)


if transform:
    T = Transformation.from_frame_to_frame(cf, Frame(ptransf.Origin, ptransf.XAxis, ptransf.YAxis))
    assembly.transform(T)
# ---------- end generate_assembly ----------
pln = Plane(generate_assembly.planes)

reset = Button()
run = BooleanToggle(False)
list = ValueList({"100", "200", "500"}, selected="100")
list_2 = ValueList({"20", "50", "100", "500"}, selected="500")
python = PythonScript(run=run, reset=reset, count=list, timer_speed=list_2)  # -> C; inputs count: Int32, timer_speed: Int32
# ---------- python: Python ----------
from scriptcontext import sticky as st
import Grasshopper as gh

guid = str(ghenv.Component.InstanceGuid)

counter_key = "counter_" + guid
anchors = "anchors_" + guid
length = count


def ghComponentTimer(run,interval):
    """ Update the component at the interval like using a GH timer """
    
    # Ensure interval is larger than zero
    if interval <= 0:
        interval = 1
        
    # Get the Grasshopper document and component that owns this script
    ghComp = ghenv.Component
    ghDoc = ghComp.OnPingDocument()
    
    # Define the callback function
    def callBack(ghDoc):
        ghComp.ExpireSolution(False)
        
    # Update the solution
    if run:
        ghDoc.ScheduleSolution(interval, gh.Kernel.GH_Document.GH_ScheduleDelegate(callBack))


if reset or counter_key not in st:
    st[counter_key] = 0

else:
    if run:
        if st[counter_key] < length - 1:
            ghComponentTimer(run, timer_speed)
            st[counter_key] += 1
        else:
            st[counter_key] = 0
            ghComponentTimer(run, timer_speed)
            

C = st[counter_key]
# ---------- end python ----------
show_5 = BooleanToggle(True)
show_6 = BooleanToggle(True)
idx = Panel(python)
# 1. Visualise the entire assembly.
# 2. Visualise the assembly process by setting a counter and a speed.
draw_5 = PythonScript(assembly=generate_assembly.assembly, show_all=show_5, show_counter=show_6, counter=idx)  # -> G, gripping_planes_WCS; inputs counter: Int32
# ---------- draw_5: Python ----------
import os
import sys
from compas_ghpython.artists import MeshArtist

from ur_online_control.assembly import AssemblyArtist
from compas_ghpython import draw_frame

gripping_planes_WCS = []

G = []

if show_all and not show_counter:
    artist = AssemblyArtist(assembly)
    G = artist.draw()

if show_counter:
    for entry in list(assembly.elements())[:counter+1]:
        element = entry[1]
        #print(element)
        artist = MeshArtist(element.mesh)
        mesh = artist.draw_mesh()
        G.append(mesh)
    
    for entry in assembly.elements(data=True):
        print(entry)
        element = entry[1]
        print(element.gripping_frame)
        print element.id
        gripping_planes_WCS.append(draw_frame(entry[1].gripping_frame))
        
    
#print list(assembly.elements())
# ---------- end draw_5 ----------
geo = Geometry(draw_5.G)
pln_2 = Plane(draw_5.gripping_planes_WCS)
preview = CustomPreview(Geometry=geo, Shader=ColourSwatch(SwatchColor=RGBA(255, 186, 186, 146)))
