# Grasshopper definition assembly_example_mesh.ghx (Grasshopper 1.0.7)

brep = Brep(<brep referenced from the Rhino model>)
pln = Plane(Plane(origin=(-9.575426996, -3.724901834, 11.12857784), x=(0, 1, 0), y=(0.9998666441, 0, -0.0163307661)))
mesh = Mesh(brep)
python = GhPythonScript(rmesh=mesh, gripping_plane=pln)  # -> out, rmesh, my_element; inputs rmesh: Mesh
# ---------- python: Python ----------
from compas_rhino.helpers import mesh_from_guid
from compas.datastructures import Mesh

from compas_ghpython.artists import MeshArtist

from ur_online_control.assembly import Element
from compas.geometry import Frame





cmesh = mesh_from_guid(Mesh, rmesh)


artist = MeshArtist(cmesh)
rmesh = artist.draw_mesh()

#draw_mesh()

gripping_frame = Frame(gripping_plane.Origin, gripping_plane.XAxis, gripping_plane.YAxis)
my_element = Element.from_mesh(cmesh, gripping_frame)
# ---------- end python ----------
python_2 = GhPythonScript(my_element=python.my_element)  # -> out, my_assembly
# ---------- python_2: Python ----------
from ur_online_control.assembly import Assembly
from compas.geometry import Frame, Transformation


my_assembly = Assembly()

frames = []

for i in range(5):
    
    frame = Frame((i*100, 0, 0), (1,0,0), (0,1,0))
    
    element = my_element.copy()
    element.transform(Transformation.from_frame(frame))
    
    my_assembly.add_element(element)
# ---------- end python_2 ----------
mesh_2 = Mesh(python.rmesh)

reset = Button()
run = BooleanToggle(False)
list = ValueList({"100", "200", "500"}, selected="100")
list_2 = ValueList({"20", "50", "100", "500"}, selected="500")
python_3 = PythonScript(run=run, reset=reset, count=list, timer_speed=list_2)  # -> C; inputs count: Int32, timer_speed: Int32
# ---------- python_3: Python ----------
from scriptcontext import sticky as st
import Grasshopper as gh

guid = str(ghenv.Component.InstanceGuid)

counter_key = "counter_" + guid
anchors = "anchors_" + guid
length = count


def ghComponentTimer(run,interval):
    """ Update the component at the interval like using a GH timer """
    
    # Ensure interval is larger than zero
    if interval <= 0:
        interval = 1
        
    # Get the Grasshopper document and component that owns this script
    ghComp = ghenv.Component
    ghDoc = ghComp.OnPingDocument()
    
    # Define the callback function
    def callBack(ghDoc):
        ghComp.ExpireSolution(False)
        
    # Update the solution
    if run:
        ghDoc.ScheduleSolution(interval, gh.Kernel.GH_Document.GH_ScheduleDelegate(callBack))


if reset or counter_key not in st:
    st[counter_key] = 0

else:
    if run:
        if st[counter_key] < length - 1:
            ghComponentTimer(run, timer_speed)
            st[counter_key] += 1
        else:
            st[counter_key] = 0
            ghComponentTimer(run, timer_speed)
            

C = st[counter_key]
# ---------- end python_3 ----------
show = BooleanToggle(True)
show_2 = BooleanToggle(False)
idx = Panel(python_3)
draw = PythonScript(assembly=python_2.my_assembly, show_all=show, show_counter=show_2, counter=idx)  # -> G, gripping_planes_WCS; inputs counter: Int32
# ---------- draw: Python ----------
import os
import sys
from compas_ghpython.artists import MeshArtist

from ur_online_control.assembly import AssemblyArtist
from compas_ghpython import draw_frame

gripping_planes_WCS = []

G = []

if show_all and not show_counter:
    artist = AssemblyArtist(assembly)
    G = artist.draw()

if show_counter:
    for entry in list(assembly.elements())[:counter+1]:
        element = entry[1]
        #print(element)
        artist = MeshArtist(element.mesh)
        mesh = artist.draw_mesh()
        G.append(mesh)
    
    for entry in assembly.elements(data=True):
        print(entry)
        element = entry[1]
        print(element.gripping_frame)
        print element.id
        gripping_planes_WCS.append(draw_frame(entry[1].gripping_frame))
        
    
#print list(assembly.elements())
# ---------- end draw ----------
geo = Geometry(draw.G)
pln_2 = Plane(draw.gripping_planes_WCS)
preview = CustomPreview(Geometry=geo, Shader=ColourSwatch(SwatchColor=RGBA(255, 186, 186, 146)))
