# Grasshopper definition assembly_export_test.ghx (Grasshopper 1.0.7)

# ----
# Ex1
bang = Button()
panel = Panel("Unload libraries")
unload = PythonScript(bang=bang)
# ---------- unload: Python ----------
from compas_rhino.utilities.misc import get_tolerance
from compas_rhino.utilities.misc import unload_modules

unload_modules("compas")
unload_modules("compas_fab")
unload_modules("ur_online_control")
# ---------- end unload ----------

# ----
# Ex2
pln = Plane(Plane(origin=(-50, 0, 50), x=(0, 1, 0), y=(1, 0, 0)))
brep = Brep(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)
mesh = Mesh(brep)
python = GhPythonScript(rmesh=mesh, gripping_plane=pln)  # -> out, elem; inputs rmesh: Mesh
# ---------- python: Python ----------
from compas_rhino.helpers import mesh_from_guid
from compas.datastructures import Mesh

from compas_ghpython.artists import MeshArtist

from ur_online_control.assembly import Element
from compas.geometry import Frame



cmesh = mesh_from_guid(Mesh, rmesh)


gripping_frame = Frame(gripping_plane.Origin, gripping_plane.XAxis, gripping_plane.YAxis)
elem = Element.from_mesh(cmesh, gripping_frame)
# ---------- end python ----------

# ----
# Element
# Predefine an element and its dimensions
# Visualise the defined element
show = BooleanToggle(True)
elem_def = GhPythonScript()  # -> out, elem
# ---------- elem_def: Python ----------
import os
import sys
import json

from compas.geometry import Frame
from compas.geometry import Vector
from compas.geometry import Box
from compas_fab.robots import Configuration

from ur_online_control.assembly import Element


# 
width = 20.
length = 230.
height = 5.

#tolerance_vector = Vector(0, 0, 1.)
#savelevel_vector = Vector(0, 0, 50.)

#picking_frame = Frame([-0.43, 0, height], [1, 0, 0], [0, 1, 0])
#picking_configuration = Configuration.from_revolute_values([-6.027, 4.443, -2.313, 5.724, 1.571, -2.885])

# block
box_frame = Frame([-length/2., -width/2., 0.], [1, 0, 0], [0, 1, 0]) #center of the box frame 
box = Box(box_frame, length, width, height) 
gripping_frame = Frame([0, 0, height], [1, 0, 0], [0, -1, 0])
elem = Element.from_shape(box, gripping_frame)
elem.id = "short"
# ---------- end elem_def ----------
draw = PythonScript(elem=elem_def.elem, show=show)  # -> M, F, S
# ---------- draw: Python ----------
from compas.geometry import Transformation
from compas.geometry import Frame
from compas.datastructures import mesh_transformed
from compas_ghpython.artists import MeshArtist
from compas_ghpython import draw_frame

if show:
    artist = MeshArtist(elem.mesh)
    M = artist.draw_mesh()
    F = draw_frame(elem.frame)
    S = draw_frame(elem._source.frame)
# ---------- end draw ----------

# ----
# Element
# Visualise the defined element
show_2 = BooleanToggle(True)
draw_2 = PythonScript(elem=python.elem, show=show_2)  # -> M, F, S
# ---------- draw_2: Python ----------
from compas.geometry import Transformation
from compas.geometry import Frame
from compas.datastructures import mesh_transformed
from compas_ghpython.artists import MeshArtist
from compas_ghpython import draw_frame

if show:
    artist = MeshArtist(elem.mesh)
    M = artist.draw_mesh()
    F = draw_frame(elem.gripping_frame)
    #S = draw_frame(elem._source.frame)
# ---------- end draw_2 ----------

# ----
# Assembly
toggle = BooleanToggle(False)
cp = Plane(PlaneXY(400, 400, 0))
cp_new = Plane(Plane(origin=(800, 400, 0), x=(-0.7071067812, 0.7071067812, 0), y=(-0.7071067812, -0.7071067812, 0)))
generate_assembly = GhPythonScript(centerplane=cp, elem=elem_def.elem, transform=toggle, ptransf=cp_new)  # -> assembly, planes; inputs ptransf: Plane
# ---------- generate_assembly: Python ----------
import Rhino.Geometry as rg
import math
from scriptcontext import sticky as st


from compas.geometry import Frame
from compas.geometry import Transformation
from compas.geometry import Rotation
from compas.geometry import Translation
from compas.geometry import Point

from compas_ghpython.geometry import xtransformed
from compas_ghpython import draw_frame

from ur_online_control.assembly import Assembly
from ur_online_control.assembly import Element

import Rhino.Geometry as rg






# initialize an empty assembly class
assembly = Assembly()

planes = [] # just for vizualisation


#cp.Rotate(math.radians(90), cp.ZAxis, cp.Origin)
#cp.Translate(rg.Vector3d(0,0,1))
cp = centerplane
cf = Frame(cp.Origin, cp.XAxis, cp.YAxis)


for i in range(25): # loop through the number of layers i
    
    axis = cf.zaxis
    angle = math.radians(i*3)
    
    R = Rotation.from_axis_and_angle(axis, angle, point=cp.Origin) #Calculates a ``Rotation`` from a rotation axis and an angle and an optional point of rotation.
    T = Translation([0,0,5*i])
   

    cft = cf.transformed(R * T) #transforms the origin plane

    if i%2 == 0: 
        R = Rotation.from_axis_and_angle(cft.zaxis, math.radians(90), point=cft.point)
        cft = cft.transformed(R)
       
    add = math.sin(i/5)*15
    #print(add)
    
    o1 = cft.point + cft.yaxis*(75+add)
    o2 = cft.point - cft.yaxis*(75+add)
    
    f1 = Frame(o1, cft.xaxis, cft.yaxis)
    f2 = Frame(o2, cft.xaxis, cft.yaxis)
    
    planes.append(draw_frame(f1))
    planes.append(draw_frame(f2))
    
    T1 = Transformation.from_frame_to_frame(Frame.worldXY(), f1)
    T2 = Transformation.from_frame_to_frame(Frame.worldXY(), f2)
    
    #T1 = Translation([10,2,3])
    
    # create new instances of the element
    new_elem_1 = elem.transformed(T1) #returns a deep copy of the initial element at the new location of the frame
    new_elem_2 = elem.transformed(T2)

    assembly.add_element(new_elem_1)
    assembly.add_element(new_elem_2)


if transform:
    T = Transformation.from_frame_to_frame(cf, Frame(ptransf.Origin, ptransf.XAxis, ptransf.YAxis))
    assembly.transform(T)
# ---------- end generate_assembly ----------
pln_2 = Plane(generate_assembly.planes)

# ----
# Assembly
toggle_2 = BooleanToggle(False)
cp_new_2 = Plane(Plane(origin=(800, 400, 0), x=(-0.7071067812, 0.7071067812, 0), y=(-0.7071067812, -0.7071067812, 0)))
cp_2 = Plane(PlaneXY(400, 0, 0))
generate_assembly_2 = GhPythonScript(centerplane=cp_2, elem=python.elem, transform=toggle_2, ptransf=cp_new_2)  # -> assembly, planes; inputs ptransf: Plane
# ---------- generate_assembly_2: Python ----------
import Rhino.Geometry as rg
import math
from scriptcontext import sticky as st


from compas.geometry import Frame
from compas.geometry import Transformation
from compas.geometry import Rotation
from compas.geometry import Translation
from compas.geometry import Point

from compas_ghpython.geometry import xtransformed
from compas_ghpython import draw_frame

from ur_online_control.assembly import Assembly
from ur_online_control.assembly import Element

import Rhino.Geometry as rg



# initialize an empty assembly class
assembly = Assembly()

planes = [] # just for vizualisation

cp = centerplane
cf = Frame(cp.Origin, cp.XAxis, cp.YAxis)

frames = []
for i in range(5):
    
    #frame = Frame((i*100, 0, 0), (1,0,0), (0,1,0))
    T = Translation(cf.xaxis*i*100)
    my_frame = cf.transformed(T)
    
    my_elem = elem.copy()
    my_elem.transform(Transformation.from_frame(my_frame))
    
    assembly.add_element(my_elem)
    


if transform:
    T = Transformation.from_frame_to_frame(cf, Frame(ptransf.Origin, ptransf.XAxis, ptransf.YAxis))
    assembly.transform(T)
# ---------- end generate_assembly_2 ----------
pln_3 = Plane(generate_assembly_2.planes)

list = ValueList({"20", "50", "100", "500", "1000", "5000"}, selected="50")
back = Button()
reset = Button()
start = Button()
stop = Button()
step = Button()
full = Button()

list_2 = ValueList({"20", "50", "100", "500", "1000", "5000"}, selected="50")
back_2 = Button()
reset_2 = Button()
start_2 = Button()
stop_2 = Button()
step_2 = Button()
full_2 = Button()

# ----
# Draw
counter = CountThroughList(
    assembly=generate_assembly.assembly,
    start=start,
    stop=stop,
    step=step,
    step_back=back,
    reset=reset,
    full=full,
    interval=list)  # -> item, counter; inputs start: Boolean, stop: Boolean, step_back: Boolean
# ---------- counter: Python ----------
from scriptcontext import sticky as st
from compas_ghpython import update_component


L = list(assembly.elements())
# store data in component
guid = str(ghenv.Component.InstanceGuid)
counter_key = "counter_" + guid
running_key = "running_" + guid

if counter_key not in st:
    st[counter_key] = 0

if running_key not in st:
    st[running_key] = False
    

if st[running_key]:
    if st[counter_key] < len(L) - 1:
        st[counter_key] += 1
        update_component(ghenv, interval)
    else:
        st[counter_key] = 0
        st[running_key] = False
    
    
if start:
    st[running_key] = True

if stop:
    st[running_key] = False

if step:
    if st[counter_key] < len(L) - 1:
        st[counter_key] += 1

if step_back:
    if st[counter_key] < len(L) - 1:
        st[counter_key] -= 1

if reset:
    st[counter_key] = 0

if full:
    st[counter_key] = len(L)-1

if len(L):
    item = L[st[counter_key]]



#st["visualisation_counter"] = st[counter_key]
counter = st[counter_key]
# ---------- end counter ----------
show_3 = BooleanToggle(True)
show_4 = BooleanToggle(False)
draw_3 = PythonScript(assembly=generate_assembly.assembly, show_all=show_3, show_counter=show_4, counter=counter.counter)  # -> G, gripping_planes_WCS; inputs counter: Int32
# ---------- draw_3: Python ----------
import os
import sys
from compas_ghpython.artists import MeshArtist

from ur_online_control.assembly import AssemblyArtist
from compas_ghpython import draw_frame

gripping_planes_WCS = []

G = []

if show_all and not show_counter:
    artist = AssemblyArtist(assembly)
    G = artist.draw()

if show_counter:
    for entry in list(assembly.elements())[:counter+1]:
        element = entry[1]
        #print(element)
        artist = MeshArtist(element.mesh)
        mesh = artist.draw_mesh()
        G.append(mesh)
    
    for entry in assembly.elements(data=True):
        print(entry)
        element = entry[1]
        print(element.gripping_frame)
        print element.id
        gripping_planes_WCS.append(draw_frame(entry[1].gripping_frame))
        
    
#print list(assembly.elements())
# ---------- end draw_3 ----------
idx = Panel(counter.counter)
geo = Geometry(draw_3.G)
pln_4 = Plane(draw_3.gripping_planes_WCS)
preview = CustomPreview(Geometry=geo, Shader=ColourSwatch(SwatchColor=RGBA(255, 186, 186, 146)))
preview_2 = CustomPreview(Geometry=pln_4, Shader=ColourSwatch(SwatchColor=RGBA(209, 27, 27, 178)))

# ----
# Draw
counter_2 = CountThroughList(
    assembly=generate_assembly_2.assembly,
    start=start_2,
    stop=stop_2,
    step=step_2,
    step_back=back_2,
    reset=reset_2,
    full=full_2,
    interval=list_2)  # -> item, counter; inputs start: Boolean, stop: Boolean, step_back: Boolean; same code as counter
show_5 = BooleanToggle(False)
show_6 = BooleanToggle(True)
draw_4 = PythonScript(assembly=generate_assembly_2.assembly, show_all=show_5, show_counter=show_6, counter=counter_2.counter)  # -> G, gripping_planes_WCS; inputs counter: Int32; same code as draw_3
idx_2 = Panel(counter_2.counter)
geo_2 = Geometry(draw_4.G)
pln_5 = Plane(draw_4.gripping_planes_WCS)
preview_3 = CustomPreview(Geometry=pln_5, Shader=ColourSwatch(SwatchColor=RGBA(209, 27, 27, 178)))
preview_4 = CustomPreview(Geometry=geo_2, Shader=ColourSwatch(SwatchColor=RGBA(255, 186, 186, 146)))

path = FilePath("C:\Users\Gido\Documents\workspace\development\ur_online_control\assembly\export\test.json")
python_2 = GhPythonScript(assembly=generate_assembly.assembly, file_path=path)  # -> out, a
# ---------- python_2: Python ----------
import ur_online_control.assembly.utilities as ut


print assembly.element(0).data

ut.to_json(assembly, file_path)
#assembly.network.to_json(file_path)

#print assembly.network
# ---------- end python_2 ----------
panel_2 = Panel(python_2.out)
