# Grasshopper definition fabrication_process_example.ghx (Grasshopper 1.0.7)

# ----
# angleB
# speed
# data for further calculation
# set path
# set path
# set path
# set path
# set path
# set path
# set path
# force
# force
# force
# force
# force
# force
# angleA
# angleA
# angleA
# angleA
# angleA
# angleA
# angleB
# angleB
# angleB
# angleB
# angleB
# angleB
# speed
# speed
# speed
# speed
# speed
# speed
# force
# force
# force
# force
# force
# force
# angleA
# angleA
# angleA
# angleA
# angleA
# angleA
# angleA
# angleA
# angleA
# angleA
# angleA
# angleA
# angleA
# angleB
# angleB
# angleB
# angleB
# angleB
# angleB
# speed
# speed
# speed
# speed
# speed
# speed
# speed
# speed
# speed
# speed
# speed
# speed
# speed
# data for further calculation
# data for further calculation
# data for further calculation
# data for further calculation
# data for further calculation
# data for further calculation
# Assembly
bang = Button()
panel = Panel("Unload libraries")
unload = PythonScript(bang=bang)
# ---------- unload: Python ----------
from compas_rhino.utilities.misc import get_tolerance
from compas_rhino.utilities.misc import unload_modules

unload_modules("compas")
unload_modules("compas_fab")
unload_modules("ur_online_control")
# ---------- end unload ----------

# ----
# material resistance
# force
# angleA
# angleB
# speed
# force
# angleA
# angleB
# speed
# material resistance
# force
# angleA
# angleB
# speed
# force
# angleA
# angleB
# speed
# material resistance
# material resistance
# material resistance
# force
# force
# force
# angleA
# angleA
# angleA
# angleB
# angleB
# angleB
# speed
# speed
# speed
# force
# force
# force
# angleA
# angleA
# angleA
# angleB
# angleB
# angleB
# speed
# speed
# speed
show = BooleanToggle(True)
# Elements
panel_2 = Panel("Define two elements")
block_def = GhPythonScript()  # -> out, block, block_l
# ---------- block_def: Python ----------
import os
import sys
import json

from compas.geometry import Frame
from compas.geometry import Vector
from compas.geometry import Box
from compas_fab.robots import Configuration

from ur_online_control.assembly import Element

#box = Box(Frame.worldXY(), 4, 4, 4)

#block_definition
width = 20.
length = 230.
length_l = length - width
height = 5.

#tolerance_vector = Vector(0, 0, 1.)
#savelevel_vector = Vector(0, 0, 50.)

#picking_frame = Frame([-0.43, 0, height], [1, 0, 0], [0, 1, 0])
#picking_configuration = Configuration.from_revolute_values([-6.027, 4.443, -2.313, 5.724, 1.571, -2.885])


# block long
box_frame = Frame([-length, -width, 0.], [1, 0, 0], [0, 1, 0])
box = Box(box_frame, length, width, height)
gripping_frame = Frame([0, 0, height], [1, 0, 0], [0, -1, 0])
block = Element.from_shape(box, gripping_frame)
block.id = "long"


# block short
box_frame_l = Frame([-length_l, -width, 0.], [1, 0, 0], [0, 1, 0])
box_l = Box(box_frame, length_l, width, height)
gripping_frame = Frame([0, 0, height], [1, 0, 0], [0, -1, 0])
block_l = Element.from_shape(box, gripping_frame)
block_l.id = "short"
# ---------- end block_def ----------
draw = PythonScript(block=block_def.block, block_l=block_def.block_l, show=show)  # -> M, F, S
# ---------- draw: Python ----------
from compas.geometry import Transformation
from compas.geometry import Frame
from compas.datastructures import mesh_transformed
from compas_ghpython.artists import MeshArtist
from compas_ghpython import draw_frame

if show:
    artist = MeshArtist(block.mesh)
    M = artist.draw_mesh()
    F = draw_frame(block.frame)
    S = draw_frame(block._source.frame)
# ---------- end draw ----------

# ----
# Define an element and its dimensions
# Visualise the defined element
show_2 = BooleanToggle(False)
block_def_2 = GhPythonScript()  # -> out, block
# ---------- block_def_2: Python ----------
import os
import sys
import json

from compas.geometry import Frame
from compas.geometry import Vector
from compas.geometry import Box
from compas_fab.robots import Configuration

from ur_online_control.assembly import Element


# 
width = 20.
length = 230.
height = 5.

#tolerance_vector = Vector(0, 0, 1.)
#savelevel_vector = Vector(0, 0, 50.)

#picking_frame = Frame([-0.43, 0, height], [1, 0, 0], [0, 1, 0])
#picking_configuration = Configuration.from_revolute_values([-6.027, 4.443, -2.313, 5.724, 1.571, -2.885])

# block
box_frame = Frame([-length/2., -width/2., 0.], [1, 0, 0], [0, 1, 0]) #center of the box frame 
box = Box(box_frame, length, width, height) 
gripping_frame = Frame([0, 0, height], [1, 0, 0], [0, -1, 0])
block = Element.from_shape(box, gripping_frame)
block.id = "short"
# ---------- end block_def_2 ----------
draw_2 = PythonScript(block=block_def_2.block, show=show_2)  # -> M, F, S; same code as draw

show_3 = BooleanToggle(True)
show_4 = BooleanToggle(True)
panel_3 = Panel("Define two elements")
block_short = GhPythonScript()  # -> out, block
# ---------- block_short: Python ----------
import os
import sys
import json

from compas.geometry import Frame
from compas.geometry import Vector
from compas.geometry import Box
from compas_fab.robots import Configuration

from ur_online_control.assembly import Element

#box = Box(Frame.worldXY(), 4, 4, 4)

#block_short
width = 20.
length = 200.
length_l = length - width
height = 5.

#tolerance_vector = Vector(0, 0, 1.)
#savelevel_vector = Vector(0, 0, 50.)

#picking_frame = Frame([-0.43, 0, height], [1, 0, 0], [0, 1, 0])
#picking_configuration = Configuration.from_revolute_values([-6.027, 4.443, -2.313, 5.724, 1.571, -2.885])


# block_short
box_frame = Frame([-length_l, -width, 0.], [1, 0, 0], [0, 1, 0])
box = Box(box_frame, length_l, width, height)
gripping_frame = Frame([0, 0, height], [1, 0, 0], [0, -1, 0])
block = Element.from_shape(box, gripping_frame)
block.id = "short"
# ---------- end block_short ----------
draw_3 = PythonScript(block=block_short.block, show=show_4)  # -> M, F, S; same code as draw
block_long = GhPythonScript()  # -> out, block
# ---------- block_long: Python ----------
import os
import sys
import json

from compas.geometry import Frame
from compas.geometry import Vector
from compas.geometry import Box
from compas_fab.robots import Configuration

from ur_online_control.assembly import Element

#box = Box(Frame.worldXY(), 4, 4, 4)

#block_long
width = 20.
length = 200.
length_l = length - width
height = 5.

#tolerance_vector = Vector(0, 0, 1.)
#savelevel_vector = Vector(0, 0, 50.)

#picking_frame = Frame([-0.43, 0, height], [1, 0, 0], [0, 1, 0])
#picking_configuration = Configuration.from_revolute_values([-6.027, 4.443, -2.313, 5.724, 1.571, -2.885])


# block long
box_frame = Frame([-length, -width, 0.], [1, 0, 0], [0, 1, 0])
box = Box(box_frame, length, width, height)
gripping_frame = Frame([0, 0, height], [1, 0, 0], [0, -1, 0])
block = Element.from_shape(box, gripping_frame)
block.id = "long"
# ---------- end block_long ----------
draw_4 = PythonScript(block=block_long.block, show=show_3)  # -> M, F, S; same code as draw

# ----
# 1. Generate an assembly containing the trasformed planes of the elements
# 2. Position your assebly:
#    Choose between a center plane (placed in the middle of the table) and a custom "cp_new" plane.
cp = Plane(PlaneXY(707.5, 0.9999999975, -4.999999993))
cp_new = Plane(PlaneXY(800, 0, 0))
generate_assembly = GhPythonScript(centerplane=cp, block=block_def_2.block, transform=Toggle(False), ptransf=cp_new)  # -> assembly, planes; inputs ptransf: Plane
# ---------- generate_assembly: Python ----------
import Rhino.Geometry as rg
import math
from scriptcontext import sticky as st


from compas.geometry import Frame
from compas.geometry import Transformation
from compas.geometry import Rotation
from compas.geometry import Translation
from compas.geometry import Point

from compas_ghpython.geometry import xtransformed
from compas_ghpython import draw_frame

from ur_online_control.assembly import Assembly
from ur_online_control.assembly import Element

import Rhino.Geometry as rg






# initialize an empty assembly class
assembly = Assembly()

planes = [] # just for vizualisation


#cp.Rotate(math.radians(90), cp.ZAxis, cp.Origin)
#cp.Translate(rg.Vector3d(0,0,1))
cp = centerplane
cf = Frame(cp.Origin, cp.XAxis, cp.YAxis)


for i in range(25): # loop through the number of layers i
    
    axis = cf.zaxis
    angle = math.radians(i*3)
    
    R = Rotation.from_axis_and_angle(axis, angle, point=cp.Origin) #Calculates a ``Rotation`` from a rotation axis and an angle and an optional point of rotation.
    T = Translation([0,0,5*i])
   

    cft = cf.transformed(R * T) #transforms the origin plane

    if i%2 == 0: 
        R = Rotation.from_axis_and_angle(cft.zaxis, math.radians(90), point=cft.point)
        cft = cft.transformed(R)
       
    add = math.sin(i/5)*15
    #print(add)
    
    o1 = cft.point + cft.yaxis*(75+add)
    o2 = cft.point - cft.yaxis*(75+add)
    
    f1 = Frame(o1, cft.xaxis, cft.yaxis)
    f2 = Frame(o2, cft.xaxis, cft.yaxis)
    
    planes.append(draw_frame(f1))
    planes.append(draw_frame(f2))
    
    T1 = Transformation.from_frame_to_frame(Frame.worldXY(), f1)
    T2 = Transformation.from_frame_to_frame(Frame.worldXY(), f2)
    
    #T1 = Translation([10,2,3])
    
    # create new instances of the element
    new_block_1 = block.transformed(T1) #returns a deep copy of the initial element at the new location of the frame
    new_block_2 = block.transformed(T2)

    assembly.add_element(new_block_1)
    assembly.add_element(new_block_2)


if transform:
    T = Transformation.from_frame_to_frame(cf, Frame(ptransf.Origin, ptransf.XAxis, ptransf.YAxis))
    assembly.transform(T)
# ---------- end generate_assembly ----------
pln = Plane(generate_assembly.planes)

reset = Button()
run = BooleanToggle(False)
list = ValueList({"100", "200", "500"}, selected="100")
list_2 = ValueList({"20", "50", "100", "500"}, selected="500")
python = PythonScript(run=run, reset=reset, count=list, timer_speed=list_2)  # -> C; inputs count: Int32, timer_speed: Int32
# ---------- python: Python ----------
from scriptcontext import sticky as st
import Grasshopper as gh

guid = str(ghenv.Component.InstanceGuid)

counter_key = "counter_" + guid
anchors = "anchors_" + guid
length = count


def ghComponentTimer(run,interval):
    """ Update the component at the interval like using a GH timer """
    
    # Ensure interval is larger than zero
    if interval <= 0:
        interval = 1
        
    # Get the Grasshopper document and component that owns this script
    ghComp = ghenv.Component
    ghDoc = ghComp.OnPingDocument()
    
    # Define the callback function
    def callBack(ghDoc):
        ghComp.ExpireSolution(False)
        
    # Update the solution
    if run:
        ghDoc.ScheduleSolution(interval, gh.Kernel.GH_Document.GH_ScheduleDelegate(callBack))


if reset or counter_key not in st:
    st[counter_key] = 0

else:
    if run:
        if st[counter_key] < length - 1:
            ghComponentTimer(run, timer_speed)
            st[counter_key] += 1
        else:
            st[counter_key] = 0
            ghComponentTimer(run, timer_speed)
            

C = st[counter_key]
# ---------- end python ----------
show_5 = BooleanToggle(True)
show_6 = BooleanToggle(True)
idx = Panel(python)
# 1. Visualise the entire assembly.
# 2. Visualise the assembly process by setting a counter and a speed.
draw_5 = PythonScript(assembly=generate_assembly.assembly, show_all=show_5, show_counter=show_6, counter=idx)  # -> G, gripping_planes_WCS; inputs counter: Int32
# ---------- draw_5: Python ----------
import os
import sys
from compas_ghpython.artists import MeshArtist

from ur_online_control.assembly import AssemblyArtist
from compas_ghpython import draw_frame

gripping_planes_WCS = []

G = []

if show_all and not show_counter:
    artist = AssemblyArtist(assembly)
    G = artist.draw()

if show_counter:
    for entry in list(assembly.elements())[:counter+1]:
        element = entry[1]
        #print(element)
        artist = MeshArtist(element.mesh)
        mesh = artist.draw_mesh()
        G.append(mesh)
    
    for entry in assembly.elements(data=True):
        print(entry)
        element = entry[1]
        print(element.gripping_frame)
        print element.id
        gripping_planes_WCS.append(draw_frame(entry[1].gripping_frame))
        
    
#print list(assembly.elements())
# ---------- end draw_5 ----------
geo = Geometry(draw_5.G)
pln_2 = Plane(draw_5.gripping_planes_WCS)
preview = CustomPreview(Geometry=geo, Shader=ColourSwatch(SwatchColor=RGBA(255, 186, 186, 146)))

# ----
# FABRICATION
init = Button()
fabrication = PythonScript(init=init)  # -> out, fabrication
# ---------- fabrication: Python ----------
from scriptcontext import sticky as st
from ur_online_control.fabrication_process import Fabrication
import time
import Rhino.Geometry as rg
import ghpythonlib.components as ghcomp
import math as m

arduino = st["arduino"]
rvision = st["robot_vision"]
robot = st["if_robot"]
mesh = st["mymesh"]

#print robot.comm.wait_for_state_ready(delay = 0.2)
#print mesh.current_corr_vals

class FabricationGH(Fabrication):
    
    def perform_task(self, element):
        """ this method controls the execution of one task in a list of the set tasks of the fabrication.
        --> it has to be filled in with your task routines """

        self.log("NODE FABRICATION START: ---->>>>>")
        ok = False
        
        #robot.comm.set_tool_meshmould() # set the meshmould_tool
        #robot.comm.set_tool0()
        robot.comm.set_tool_meshmould()
        robot.comm.set_speed_slow()

        
        # ----------------------------------------------------------------------------
        # 1 -------------------------------------------------------------------------
        # check if node has a plane to drive to, otherwise get out of the loops
        # ----------------------------------------------------------------------------
        if not node.plane_wrist or node.index_col == 0:
            return True
        
        self.log("WAIT FOR STATE READY")
        ok = robot.comm.wait_for_state_ready(delay = 0.01)
        if not ok: return False # if not OK, exit rountine
        
        robot.comm.set_speed_slow() if self.robot_speed == 1 else robot.comm.set_speed_mid()
        
        
        if node.index_col == 1 and self.line_est_toggle == False:
            
            if self.unroll == True:
                current_pose_joint = robot.comm.get_current_pose_joint()
                if current_pose_joint[3] > 150 or current_pose_joint[3] < -150:
                    joints_abb_list = [-48.6, 11.4, 0., 262.4, 0., -337.1]
                    robot.comm.send_axes_absolute(joints_abb_list, int_arr = None)
                    joints_abb_list = [-48.6, 11.4, 0., 0., 0., -60.]
                    robot.comm.send_axes_absolute(joints_abb_list, int_arr = None)
                
            
            node_plane_tilted_WCS_offs = rg.Plane(node.plane_for_inserting)
            node_plane_tilted_WCS_offs.Translate(node_plane_tilted_WCS_offs.ZAxis*60)
            node_plane_tilted_RCS_offs = robot.get_tool_plane_in_RCS(node_plane_tilted_WCS_offs)
            robot.comm.send_pose_cartesian(node_plane_tilted_RCS_offs)
        
        # ----------------------------------------------------------------------------
        # 2 -------------------------------------------------------------------------
        # if pose estimation is on, correct the base pose, based on the base camera estimation
        # ----------------------------------------------------------------------------
        if self.base_pose_est_toggle == True:
            self.log("GET BASE POSE ESTIMATION")
            ok = robot.comm.wait_for_state_ready(delay = 0.2)
            if not ok: return False # if not OK, exit rountine
                
            if rvision.is_connected():
                
                msg_type, pose, ok = rvision.get_current_base_pose()
                #self.log("BASE POSE ESTIMATION FROM VISION: " + str(pose)) 
                if not ok: return False

                self.log("BASE POSE ESTIMATION FROM VISION: " + str(pose)) 
                # set the base to the measured tags pose by the base cams
                robot.set_robot_origin_with_pose(pose)
                self.log("BASE POSE ESTIMATION 1")
                robot.current_T_W_R_basecam = pose
                self.current_base_pose_cartesian = pose
                current_base_plane = rg.Plane(robot.origin_plane)
                node.base_state_estimation_plane = current_base_plane
                self.log("BASE POSE ESTIMATION 2")
                if not self.check_base_estimation(current_base_plane):
                    return False
                self.log("BASE POSE ESTIMATION 3")
                self.current_base_plane = current_base_plane
                #diff_len_pose = rg.Vector3d(i_f_.get_base_frame().get_plane().Origin - rg.Point3d(mtip_base_pose[0], mtip_base_pose[1], mtip_base_pose[2])).Length
                self.log("BASE POSE ESTIMATION 4")
        # ----------------------------------------------------------------------------
        # 3 -------------------------------------------------------------------------
        # unwinding: try preventing that axis 6 goes into joint limits: 
        # strategy 1: rotate axes 6 to zero after every layer
        # ----------------------------------------------------------------------------
        # -- still missing
        
        # ----------------------------------------------------------------------------
        # 4 ------------------------------------------------------------------------
        # check the node, first: if the node is for bending, then, if a vertical is inserted or not
        # ----------------------------------------------------------------------------
        
        # ----------------------------------------------------------------------------
        if node.insert_discrete_element and node.collision == False:
            # --------------------------------------------------------------------------
            # 4.1 move the arm to the position for inserting the discrete element
            # --------------------------------------------------------------------------
            self.log("GET NODE PLANE FOR INSERTING TILTED AND SEND TO ABB ARM")
            
            #node_plane_tilted_WCS = node.wrist_plane_for_inserting_tilted
            
            if self.correction_toggle == True and mesh.current_corr_vals and node.index_col < 34:#and len(node.estimated_lines_WCS):
                corr_val = mesh.current_corr_vals[node.index_col-1]
                #corr_val, l_proj, l_in_zero = node.get_corr_val()
                
                #plane_for_inserting_corr, plane_for_bending_corr = node.get_corr_planes(corr_val)
                #node_plane_tilted_WCS = plane_for_inserting_corr
                
                corr_angle = m.atan(corr_val/40)
                node_plane_tilted_WCS = rg.Plane(node.plane_for_inserting)  
                node_plane_tilted_WCS.Rotate(-corr_angle*self.corr_val_percentage, node_plane_tilted_WCS.XAxis, node_plane_tilted_WCS.Origin)
                
                self.log("corrected insertion plane")
                self.log(str(corr_val))
            else:
                node_plane_tilted_WCS = node.plane_for_inserting       
            node_plane_tilted_RCS = robot.get_tool_plane_in_RCS(node_plane_tilted_WCS)
            
            robot.comm.send_pose_cartesian(node_plane_tilted_RCS)
            
            #node_plane_tilted_WCS_for_feed = rg.Plane(node_plane_tilted_WCS)
            #node_plane_tilted_WCS_for_feed.Rotate(m.radians(-self.feed_tilt), node_plane_tilted_WCS_for_feed.XAxis)
            #node_plane_tilted_RCS_for_feed = robot.get_tool_plane_in_RCS(node_plane_tilted_WCS_for_feed)
            #robot.comm.send_pose_cartesian(node_plane_tilted_RCS_for_feed)
            
            if self.wait_for_feed or node.index_col == 1:
                ok = robot.comm.wait_for_state_ready(delay = 0.01)
                if not ok: return False # if not OK, exit routine
                self.log("ROBOT AT INSERTION POSE")
            else:
                time.sleep(0.2)
            
            
            # --------------------------------------------------------------------------
            # 4.2 estimation of lines by the endeffector cams
            # --------------------------------------------------------------------------
            
            if self.line_est_toggle == True and node.estimate_with_eeff_cam and rvision.is_connected():
                self.log("LINE ESTIMATION FROM VISION ENDEFF")
                self.log("NODE ESTIMATION TYPE: " + str(node.estimation_type))
                
                # get the end effector position
                T = rg.Transform.PlaneToPlane(rg.Plane.WorldXY, node_plane_tilted_WCS)
                cam_plane_trfd = robot.tool.get_cam_plane_with_tool_rot_WCS(0)
                cam_plane_trfd_WCS = ghcomp.Transform(cam_plane_trfd, T)

                lines_for_est_CCS_values = node.get_lines_for_estimation_CCS(cam_plane_trfd_WCS, return_as_lines = False)
                self.log("LINES FOR EST VALS: " + str(lines_for_est_CCS_values))
                
                ok = robot.comm.wait_for_state_ready(delay = 0.01)
                if not ok: return False # if not OK, exit rountine
                time.sleep(1.0)
                
                msg_type, msg, ok = rvision.get_current_line_estimation_3lineinput(lines_for_est_CCS_values, node.estimation_type)
                
                if not ok: 
                    return False # if not OK, exit routine
                else:
                    if msg[0] == -1000:
                        return False
                    else:
                        rvision.current_line_est_values = msg
                        current_estimated_lines_CCS = node.get_lines_from_estimation_values_CCS(rvision.current_line_est_values)
                        current_estimated_lines_WCS = node.get_lines_from_estimation_values_WCS(rvision.current_line_est_values, cam_plane_trfd_WCS)
                self.log("NODE ESTIMATION DONE")
                
                
            """"
            if self.correction_toggle == True:
                self.log("DO THE CORRECTION STEP")
                # -- still missing
            """
            
            # --------------------------------------------------------------------------
            # 4.3 now send insert vertical to arduino
            # --------------------------------------------------------------------------
            if arduino.is_connected() and self.line_est_toggle == False:

                self.log("SENDING INSERT VERTICAL COMMAND TO ARDUINO")
                feed_len = node.line_discrete_element.Length + self.feed_len_add
                self.log("FEED LENGTH: " + str(feed_len))
                
                msg_id, msg_counter, ok = arduino.send_cmd_feed_wire(feed_len, wait_for_response = True)
                if not msg_counter: return False
                
                #untilt the feeding pose
                #robot.comm.send_pose_cartesian(node_plane_tilted_RCS)
            
                ok = robot.comm.wait_for_state_ready(delay = 0.01)
                if not ok: return False # if not OK, exit rountine
                self.log("ROBOT AT WELDING POSE")

                # 4.3.1 --> feed, cut, weld discrete wire
                #msg_id, msg_counter, ok = arduino.send_cmd_feed_cut_weld(feed_len, wait_for_response = True)
                msg_id, msg_counter, ok = arduino.send_cmd_feed_cut_weld(0, wait_for_response = True)
                if not msg_counter: return False
                self.log("MSG " +  str(msg_counter) + "FROM ARDUINO: INSERT VERTICAL EXECUTED")
                
                
                if self.with_wiggle == True:
                    self.log("----> ROBOT AT WIGGLE BENDING POSE")
                    node_plane_tilted_WCS = node.plane_for_bending if node.plane_for_bending else node.plane_wrist            
                    node_plane_tilted_RCS = robot.get_tool_plane_in_RCS(node_plane_tilted_WCS)
                    robot.comm.send_pose_cartesian(node_plane_tilted_RCS)
                    
                
                # test test test
                ok = robot.comm.wait_for_state_ready(delay = 0.01)
                if not ok: return False # if not OK, exit routine
            
            
                # --------------------------------------------------------------------------
                # 4.5 bend the wire and rotate the back part aligned with the front
                # --------------------------------------------------------------------------
                """
                if self.correction_toggle == True and mesh.current_corr_vals:
                    corr_val = mesh.current_corr_vals[node.index_col-1]
                    #corr_val, l_proj, l_in_zero = node.get_corr_val()
                    
                    #plane_for_inserting_corr, plane_for_bending_corr = node.get_corr_planes(corr_val)
                    #node_plane_tilted_WCS = plane_for_bending_corr
                    node_plane_tilted_WCS = node.plane_for_bending if node.plane_for_bending else node.plane_wrist            
                    self.log("corrected bending plane")
                else:
                    node_plane_tilted_WCS = node.plane_for_bending if node.plane_for_bending else node.plane_wrist            
                """
                
                
        
        else:
            self.log("----<<<<< GO TO BENDING PLANE")
            node_plane_tilted_WCS = node.plane_for_bending if node.plane_for_bending else node.plane_wrist
            node_plane_tilted_RCS = robot.get_tool_plane_in_RCS(node_plane_tilted_WCS)
            robot.comm.send_pose_cartesian(node_plane_tilted_RCS)
            
            ok = robot.comm.wait_for_state_ready(delay = 0.01)
            if not ok: return False # if not OK, exit rountine
        

        self.log("----<<<<< TASK FINISHED")
        return True

fabrication = FabricationGH()
st["fabrication"] = fabrication
# ---------- end fabrication ----------
reset_built_state_from_idx = Button()
reset_built_state = Button()
set_fab_params = PythonScript(
    fabrication=fabrication.fabrication,
    assembly=generate_assembly.assembly,
    reset_built_state=reset_built_state,
    reset_built_state_idx=reset_built_state_from_idx,
    element_index=idx)  # -> out, fabrication; inputs reset_built_state: Boolean, reset_built_state_idx: Boolean, element_index: Int32
# ---------- set_fab_params: Python ----------
from scriptcontext import sticky as st
import Rhino.Geometry as rg

guid = str(ghenv.Component.InstanceGuid)
tasks_set_key = "tasks_set" + guid

if not tasks_set_key in st or len(fabrication.tasks) == 0:
    [n.set_built_state(False) for n in mesh.nodes]
    [n.set_built_state(True) for n in mesh.nodes[:min(node_index, len(mesh.nodes) - 1)]]
    st[tasks_set_key] = False
    

fabrication.robot_speed = 1

if reset_built_state:
    [n.set_built_state(False) for n in mesh.nodes]
    st[tasks_set_key] = False
    
if start_from_index:
    [n.set_built_state(False) for n in mesh.nodes]
    [n.set_built_state(True) for n in mesh.nodes[:min(node_index, len(mesh.nodes) - 1)]]
    st[tasks_set_key] = False
    
if st[tasks_set_key] == False:
    print "setting tasks"    
    built_idx = len([n for n in mesh.nodes if n.is_built])
    fabrication.clear_tasks()
    fabrication.set_tasks(mesh.nodes[built_idx:])
    st[tasks_set_key] = True

print "nodes finished: ", built_idx
print "nodes to be built: ", len([n for n in mesh.nodes if n.is_built == False]) #, len(fabrication.tasks)
# ---------- end set_fab_params ----------

pause_fabrication = Button()
start_fabrication = Button()
stop_fabrication = Button()
refresh = Button()
fabrication_2 = PythonScript(
    fabrication=set_fab_params.fabrication,
    start=start_fabrication,
    stop=stop_fabrication,
    pause=pause_fabrication,
    refresh=refresh)  # -> out, flatten(bang)
# ---------- fabrication_2: Python ----------
from scriptcontext import sticky as st
import time
import ghpythonlib.components as ghcomp
import Rhino.Geometry as rg
import Grasshopper as gh
import math as m

bang = True

if start:
    fabrication.start()

if stop:
    if fabrication.is_alive():
        
        if fabrication.is_paused():
            fabrication.resume()
            
        fabrication.run_fabrication_flag = False
        
        try:
            fabrication.join()
        except:
            pass
        
        # please insert stop script to UR 
        

if pause:
    fabrication.pause()

if resume:
    fabrication.resume()
# ---------- end fabrication_2 ----------
# Calculate edge curves
panel_4 = Panel(fabrication_2.out)
