# Grasshopper definition ur_online_control_simple_setup_assembly.ghx (Grasshopper 1.0.7)

# ---- group: Element
# Define an element and its dimensions
# Visualise the defined element
show = BooleanToggle(False)
block_def = GhPythonScript()  # -> out, block
# ---------- block_def: Python ----------
import os
import sys
import json

from compas.geometry import Frame
from compas.geometry import Vector
from compas.geometry import Box
from compas_fab.robots import Configuration

from ur_online_control.assembly import Element


#definition
width = 20.
length = 230.
height = 5.

#tolerance_vector = Vector(0, 0, 1.)
#savelevel_vector = Vector(0, 0, 50.)

#picking_frame = Frame([-0.43, 0, height], [1, 0, 0], [0, 1, 0])
#picking_configuration = Configuration.from_revolute_values([-6.027, 4.443, -2.313, 5.724, 1.571, -2.885])

# block
box_frame = Frame([-length/2., -width/2., 0.], [1, 0, 0], [0, 1, 0]) #center of the box frame 
box = Box(box_frame, length, width, height) 
gripping_frame = Frame([0, 0, height], [1, 0, 0], [0, -1, 0])
block = Element.from_shape(box, gripping_frame)
block.id = "short"
# ---------- end block_def ----------
draw = PythonScript(block=block_def.block, show=show)  # -> M, F, S
# ---------- draw: Python ----------
from compas.geometry import Transformation
from compas.geometry import Frame
from compas.datastructures import mesh_transformed
from compas_ghpython.artists import MeshArtist
from compas_ghpython import draw_frame

if show:
    artist = MeshArtist(block.mesh)
    M = artist.draw_mesh()
    F = draw_frame(block.frame)
    S = draw_frame(block._source.frame)
# ---------- end draw ----------

# ----
# 1.
# Settings
# --> Set your IP address
# --> Set robot IP address
server_ip = ValueList({"192.168.10.44", "192.168.10.12", "192.168.10.11", "192.168.10.10", "192.168.10.2", "127.0.0.1", "192.168.10.111"}, selected="192.168.10.11")
ur_ip = ValueList({"192.168.10.10", "192.168.10.20", "192.168.10.11", "192.168.10.12", "127.0.0.1", "192.168.10.111"}, selected="192.168.10.10")
server_port = Integer(30003)
globals = PythonScript(server_address=server_ip, server_port=server_port, ur_ip=ur_ip)  # inputs server_port: Int32
# ---------- globals: Python ----------
from scriptcontext import sticky as st

st["server_address"] = server_address
st["server_port"] = server_port

st["ur_ip"] = ur_ip
print st["ur_ip"]
# ---------- end globals ----------

# ----
# Check if UR is available
ping = Button()
py = PythonScript(ip=ur_ip, ping=ping)  # -> out, trigger
# ---------- py: Python ----------
from scriptcontext import sticky as st
from ur_online_control.communication import is_available

guid = str(ghenv.Component.InstanceGuid)
txt_key = "txt_" + guid
if txt_key not in st:
    st[txt_key] = ""

if ping:
    
    available = is_available(ip)
    
    if available:
        st[txt_key] = "%s is up!" % ip
        trigger = True
    else:
        st[txt_key] = "%s is down!" % ip
        trigger = False

print(st[txt_key])
# ---------- end py ----------
panel = Panel(py.out)

bang = Button()
panel_2 = Panel("Unload libraries")
unload = PythonScript(bang=bang)
# ---------- unload: Python ----------
from compas_rhino.utilities.misc import get_tolerance
from compas_rhino.utilities.misc import unload_modules

unload_modules("compas")
unload_modules("compas_fab")
unload_modules("ur_online_control")
# ---------- end unload ----------

# ---- group: Robot
# 1. load robot model
# 2. set tool
# 3. set basis
# Here, you can set the basis for your robot
list = ValueList({"no_tool": 0, "measurement_tool": 1, "air_pick 2 cups 40mm": 2, "air_pick 2 cups 15mm": 3, "air_pick 1 cup 40mm": 4, "air_pick 1 cup 15mm": 5}, selected="air_pick 1 cup 15mm")
tools = Tools(tool_id=list)
list_2 = ValueList({"UR10e"}, selected="UR10e")
robot = PythonScript(model=list_2)  # -> robot
# ---------- robot: Python ----------
from ur_online_control.ur.ur10e import UR10e
from scriptcontext import sticky as st

if model == "UR10e":
    robot = UR10e()
# ---------- end robot ----------
base = PythonScript()  # -> base_frame
# ---------- base: Python ----------
from compas.geometry import Frame
#from compas.geometry import Transformation, Rotation
#from compas_ghpython import xdraw_frame
#import math
#import Rhino.Geometry as rg


origin = [0,0,0]
xaxis = [1,0,0]
yaxis = [0,1,0]


base_frame = Frame(list(origin), list(xaxis), list(yaxis))
# ---------- end base ----------
set_params = PythonScript(robot=robot, tool=tools, base_frame=base)  # -> robot
# ---------- set_params: Python ----------
from ur_online_control.ur.ur10e import UR10e
from scriptcontext import sticky as st
from ur_online_control.ur.tool import Tool
from compas.geometry import Frame


if tool:
    robot.set_tool(tool)
else:
    robot.set_tool(Tool(Frame.worldXY()))  
if base_frame:
    robot.set_base(base_frame)

st["robot"] = robot
# ---------- end set_params ----------

# ----
get = Button()
pose = PythonScript(get=get)  # -> pose_cartesian
# ---------- pose: Python ----------
from scriptcontext import sticky as st
from ur_online_control.ur_direct import get_current_pose_cartesian

server_address = st["server_address"]
server_port = 30005
ur_ip = st["ur_ip"]
robot = st["robot"]
tool_angle_axis = list(robot.tool.tcp_frame.point) + list(robot.tool.tcp_frame.axis_angle_vector)
print(tool_angle_axis)

guid = str(ghenv.Component.InstanceGuid)
pose_cartesian_key = "pose_cartesian" + guid


if get:
    st[pose_cartesian_key] = get_current_pose_cartesian(server_address, server_port, ur_ip, tool_angle_axis)

if pose_cartesian_key not in st:
    pose_cartesian = []
else:
    pose_cartesian = st[pose_cartesian_key]
# ---------- end pose ----------
panel_3 = Panel("get pose cartesian")
py_2 = PythonScript(pose_cartesian=pose)  # -> frame_WCS; inputs pose_cartesian: list
# ---------- py_2: Python ----------
import Rhino.Geometry as rg
from scriptcontext import sticky as st
from compas.geometry import Frame
from compas.geometry.xforms import Transformation

robot = st["robot"]

print pose_cartesian
if pose_cartesian:
    #frame_RCS = Frame.from_pose_axis_angle_vector(pose_cartesian)
    frame_RCS = Frame.from_axis_angle_vector(axis_angle_vector=pose_cartesian[3:], point=pose_cartesian[:3])
    frame_WCS = robot.get_frame_in_WCS(frame_RCS)
    
    print frame_RCS
# ---------- end py_2 ----------
panel_4 = Panel(pose)
draw_2 = Draw(frame=py_2)  # -> G, C
preview = CustomPreview(Geometry=draw_2.G, Shader=draw_2.C)

get_2 = Button()
pose_2 = PythonScript(get=get_2)  # -> configuration, pose_joints
# ---------- pose_2: Python ----------
from scriptcontext import sticky as st
from ur_online_control.ur_direct import get_current_pose_joints
from compas_fab.robots import Configuration


server_address = st["server_address"]
server_port = 30005
ur_ip = st["ur_ip"]
robot = st["robot"]
tool_angle_axis = list(robot.tool.tcp_frame.point) + list(robot.tool.tcp_frame.axis_angle_vector)


guid = str(ghenv.Component.InstanceGuid)
pose_joints_key = "pose_joints" + guid


if get:
    st[pose_joints_key] = get_current_pose_joints(server_address, server_port, ur_ip, tool_angle_axis)
    
if pose_joints_key not in st:
    #pose_joints = Configuration.from_revolute_values([0,0,0,0,0,0])
    configuration = Configuration.from_revolute_values([0,0,0,0,0,0])
else:
    #pose_joints = Configuration.from_revolute_values(st[pose_joints_key])
    configuration = Configuration.from_revolute_values(st[pose_joints_key])

pose_joints = configuration.values
# ---------- end pose_2 ----------
panel_5 = Panel("get pose joint")

stop = Button()
stop_2 = PythonScript(stop=stop)
# ---------- stop_2: Python ----------
from scriptcontext import sticky as st
from ur_online_control.ur_direct import stop as stop_robot

ur_ip = st["ur_ip"]

if stop:
    stop_robot(ur_ip)
# ---------- end stop_2 ----------

# ----
# Direct UR control
panel_6 = Panel("stop")
panel_7 = Panel(pose_2.pose_joints)

# ---- group: forward kinematics
a1 = Slider(180, range=-360..360)
a2 = Slider(-90, range=-360..360)
a3 = Slider(90, range=-360..360)
a4 = Slider(-90, range=-360..360)
a5 = Slider(-90, range=-360..360)
a6 = Slider(90, range=-360..360)
set_joint_values = BooleanToggle(True)
jp = GhPythonScript()  # -> joint_values
# ---------- jp: Python ----------
import math
joint_values = [-3.136, -0.328, -1.218, 3.129, 0.852, 0.008]
#joint_positions = [0] * 6

joint_values = [180,-90,90,-90,-90,90]
joint_values = [math.radians(a) for a in joint_values]
print joint_values
# ---------- end jp ----------
forward_kinematics = PythonScript(set_joint_vals=set_joint_values, joint_values=jp, a1=a1, a2=a2, a3=a3, a4=a4, a5=a5, a6=a6)  # -> configuration; inputs joint_values: list
# ---------- forward_kinematics: Python ----------
import math
import Grasshopper
from compas_fab.robots import Configuration

if set_joint_vals:

    j = 0
    for i in range(ghenv.Component.Params.Input.Count):
        nslider = ghenv.Component.Params.Input[i].Sources[0]
        if nslider.GetType() == Grasshopper.Kernel.Special.GH_NumberSlider:
            nslider.TrySetSliderValue(math.degrees(joint_values[j]))
            j += 1


joint_values = [a1, a2, a3, a4, a5, a6]
configuration = Configuration.from_revolute_values([math.radians(d) for d in joint_values])
# ---------- end forward_kinematics ----------

# ----
full = Button()

# ----
# Calculate basis
# Measure basis:
# 1. Clear the recorded poses
# 2. Move robot to origin and press "get pose"
# 3. Move robot to point in positive x-axis and press "get pose"
# 4. Move robot to an other point in your basis and press "get pose"
# (The further away these positions are, the better)
# 
# 5. Alternatively change the order in the component calc base
# 6. Copy output into base component
list_3 = ValueList({"origin, pt on positive x-axis, pt in xy plane": 0, "origin, pt on positive y-axis, pt in xy plane": 1}, selected="origin, pt on positive x-axis, pt in xy plane")
clear = Button()
rec = PythonScript(msg=pose, rec=get, clear=clear)  # -> rec; inputs msg: list
# ---------- rec: Python ----------
from scriptcontext import sticky as st

guid = str(ghenv.Component.InstanceGuid)
recorded_key =  "recorded_" + guid
just_cleared_key = "just_cleared_" + guid


if recorded_key not in st:
    st[recorded_key] = []

if just_cleared_key not in st:
    st[just_cleared_key] = False

if clear:
    st[recorded_key] = []
    st[just_cleared_key] = True
else:
    if len(msg):
        if msg != [None] and not st[just_cleared_key] and rec:
            st[recorded_key].append(msg)
    st[just_cleared_key] = False
        


rec = st[recorded_key]

print rec
# ---------- end rec ----------
calc_base = PythonScript(poses=rec, input_type=list_3)  # -> out; inputs poses: list
# ---------- calc_base: Python ----------
import Rhino.Geometry as rg
import math


if len(poses) > 2:
    
    O = poses[0]
    P1 = poses[1]
    P2 = poses[2]
    
    if input_type == 0:
        # origin, pt on positive x-axis, pt in xy plane
        origin = rg.Point3d(O[0], O[1], O[2])
        pt_on_xaxis = rg.Point3d(P1[0], P1[1], P1[2])
        pt_in_xyplane = rg.Point3d(P2[0], P2[1], P2[2])
        
        xaxis = pt_on_xaxis - origin
        xaxis.Unitize()
        
        v = pt_in_xyplane - origin
        zaxis = rg.Vector3d.CrossProduct(v, xaxis)
        zaxis.Unitize()
        
        # zaxis must look up!
        if math.acos(rg.Vector3d.ZAxis * zaxis) > math.acos(rg.Vector3d.ZAxis * -zaxis):
            zaxis = -zaxis
        
        yaxis = rg.Vector3d.CrossProduct(zaxis, xaxis)
    
    elif input_type == 1:
        # origin, pt on positive y-axis, pt in xy plane
        origin = rg.Point3d(O[0], O[1], O[2])
        pt_on_yaxis = rg.Point3d(P1[0], P1[1], P1[2])
        pt_in_xyplane = rg.Point3d(P2[0], P2[1], P2[2])
        
        yaxis = pt_on_yaxis - origin
        yaxis.Unitize()
        
        v = pt_in_xyplane - origin
        zaxis = rg.Vector3d.CrossProduct(v, yaxis)
        zaxis.Unitize()
        
        # zaxis must look up!
        if math.acos(rg.Vector3d.ZAxis * zaxis) > math.acos(rg.Vector3d.ZAxis * -zaxis):
            zaxis = -zaxis
        
        xaxis = rg.Vector3d.CrossProduct(yaxis, zaxis)
        
        
    print "Copy the following into base component:"
    print " "
    print "origin = [%.2f, %.2f, %.2f]" % tuple(list(origin))
    print "xaxis = [%.5f, %.5f, %.5f]" % tuple(list(xaxis))
    print "yaxis = [%.5f, %.5f, %.5f]" % tuple(list(yaxis))
    

#print rg.Vector3d.CrossProduct(rg.Vector3d.YAxis, rg.Vector3d.ZAxis)
#print rg.Vector3d.CrossProduct(rg.Vector3d.ZAxis, rg.Vector3d.XAxis)
# ---------- end calc_base ----------
panel_8 = Panel(calc_base)
panel_9 = Panel(rec)

show_2 = BooleanToggle(False)

# ---- group: Visualise / robot geometry
show_brep = BooleanToggle(True)
ur10e_brep = UR10Brep([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])
ur10e_mesh = Mesh(ur10e_brep)

# ----
number = Slider(1, range=0..10)
panel_10 = Panel("set digital out")
value = BooleanToggle(True)
digital_out = PythonScript(number=number, value=value)  # -> script; inputs number: Int32, value: Boolean
# ---------- digital_out: Python ----------
script = "def prog():\n"
script += "\ttextmsg(\">> program start\")\n"
script += "\tset_digital_out(%i, %s)\n" % (int(number), str(value))
script += "\ttextmsg(\"<< program end\")\n"
script += "end\n"
script += "prog()\n\n"

print(script)
# ---------- end digital_out ----------
send = Button()
send_2 = GhPythonScript(script=digital_out, send=send)  # -> out; inputs send: Boolean
# ---------- send_2: Python ----------
from scriptcontext import sticky as st
from ur_online_control.ur_direct.utilities import send_script

server_address = st["server_address"]
server_port = 30005
ur_ip = st["ur_ip"]
robot = st["robot"]

if send:
    send_script(ur_ip, script, port=server_port)
# ---------- end send_2 ----------
panel_11 = Panel(send_2)

# ----
# send airpick vacuum scripts
send_3 = Button()
send_4 = Button()
airpick = GhPythonScript(send_script_airpick_on=send_3, send_script_airpick_off=send_4)  # -> out; inputs send_script_airpick_on: Boolean
# ---------- airpick: Python ----------
from scriptcontext import sticky as st
from ur_online_control.ur_direct import generate_script_airpick_on, generate_script_airpick_off
from ur_online_control.ur_direct import get_airpick_on_script, get_airpick_off_script
from ur_online_control.ur_direct.utilities import send_script


server_address = st["server_address"]
server_port = 30005
ur_ip = st["ur_ip"]
robot = st["robot"]

#script_on = get_airpick_on_script()
#script_off = get_airpick_off_script()

script_on = generate_script_airpick_on()
script_off = generate_script_airpick_off()



if send_script_airpick_on:
    send_script(ur_ip, script_on, port=server_port)
    
if send_script_airpick_off:
    send_script(ur_ip, script_off, port=server_port)
# ---------- end airpick ----------
panel_12 = Panel(airpick)

# ----
# move incremental in WCS
number_slider = Slider(5, range=-10..10)
list_4 = ValueList({"xaxis", "yaxis", "zaxis"}, selected="zaxis")
movel = PythonScript(step_size=number_slider, direction=list_4)  # -> script
# ---------- movel: Python ----------
from scriptcontext import sticky as st

robot = st["robot"]
tool_angle_axis = list(robot.tool.tcp_frame.point) + list(robot.tool.tcp_frame.axis_angle_vector)
x, y, z, ax, ay, az = tool_angle_axis

script = "def prog():\n"
script += "\ttextmsg(\">> program start\")\n"
script += "\tset_tcp(p%s)\n" % str([x/1000., y/1000., z/1000, ax, ay, az])
script += "\tcurrent_pose = get_forward_kin()\n"


if direction == "xaxis":
    script += "\tmovel(p[current_pose[0] + %f, current_pose[1], current_pose[2], current_pose[3], current_pose[4], current_pose[5]], t=%f)\n" % (step_size/1000., step_size * 0.1)

elif direction == "yaxis":
    script += "\tmovel(p[current_pose[0], current_pose[1] + %f, current_pose[2], current_pose[3], current_pose[4], current_pose[5]], t=%f)\n" % (step_size/1000., step_size * 0.1)

else: # direction == "zaxis":
    script += "\tmovel(p[current_pose[0], current_pose[1], current_pose[2] + %f, current_pose[3], current_pose[4], current_pose[5]], t=%f)\n" % (step_size/1000., step_size * 0.1)

script += "\ttextmsg(\"<< program end\")\n"
script += "end\n"
script += "prog()\n\n"

print(script)
# ---------- end movel ----------
send_5 = Button()
send_6 = GhPythonScript(script=movel, send=send_5)  # -> out; inputs send: Boolean; same code as send_2
panel_13 = Panel(send_6)

panel_14 = Panel("reorient tool vertical")
movel_2 = PythonScript()  # -> script
# ---------- movel_2: Python ----------
from scriptcontext import sticky as st

robot = st["robot"]
tool_angle_axis = list(robot.tool.tcp_frame.point) + list(robot.tool.tcp_frame.axis_angle_vector)
x, y, z, ax, ay, az = tool_angle_axis

script = "def prog():\n"
script += "\ttextmsg(\">> program start\")\n"
script += "\tset_tcp(p%s)\n" % str([x/1000., y/1000., z/1000, ax, ay, az])
script += "\tcurrent_pose = get_forward_kin()\n"
script += "\tmovel(p[current_pose[0], current_pose[1], current_pose[2], 0, 0, 0], a=0.1, v=0.1)\n"
script += "\ttextmsg(\"<< program end\")\n"
script += "end\n"
script += "prog()\n\n"

print(script)
# ---------- end movel_2 ----------
send_7 = Button()
send_8 = GhPythonScript(script=movel_2, send=send_7)  # -> out; inputs send: Boolean; same code as send_2
panel_15 = Panel(send_8)

# ----
# move incremental in TCS
number_slider_2 = Slider(5, range=-10..10)
get_current_pose = Button()
list_5 = ValueList({"xaxis", "yaxis", "zaxis"}, selected="yaxis")
movel_3 = PythonScript(get=get_current_pose, step_size=number_slider_2, direction=list_5)  # -> script
# ---------- movel_3: Python ----------
from scriptcontext import sticky as st
from compas.geometry import Frame
from compas.geometry import Point, Vector
from ur_online_control.ur_direct import get_current_pose_cartesian

server_address = st["server_address"]
server_port = 30005
ur_ip = st["ur_ip"]
robot = st["robot"]
tool_angle_axis = list(robot.tool.tcp_frame.point) + list(robot.tool.tcp_frame.axis_angle_vector)
print(tool_angle_axis)

guid = str(ghenv.Component.InstanceGuid)
pose_cartesian_key = "pose_cartesian" + guid


if get:
    
    st[pose_cartesian_key] = get_current_pose_cartesian(server_address, server_port, ur_ip, tool_angle_axis)

if pose_cartesian_key not in st:
    pose_cartesian = []
    script = ""
else:
    pose_cartesian = st[pose_cartesian_key]

    robot = st["robot"]
    tool_angle_axis = list(robot.tool.tcp_frame.point) + list(robot.tool.tcp_frame.axis_angle_vector)
    x, y, z, ax, ay, az = tool_angle_axis
    
    script = "def prog():\n"
    script += "\ttextmsg(\">> program start\")\n"
    script += "\tset_tcp(p%s)\n" % str([x/1000., y/1000., z/1000, ax, ay, az])
    script += "\tcurrent_pose = get_forward_kin()\n"
    
#    frame = Frame.from_pose_axis_angle_vector(pose_cartesian)
    frame = Frame.from_axis_angle_vector([ax, ay, az])
    frame.point = [x, y, z]

    if direction == "xaxis":
        next_vector = Vector(*frame.xaxis) * step_size
    elif direction == "yaxis":
        next_vector = Vector(*frame.yaxis) * step_size
    else: # direction == "zaxis":
        next_vector = Vector(*frame.zaxis) * step_size
    
    x, y, z = next_vector
    script += "\tmovel(p[current_pose[0] + %f, current_pose[1] + %f, current_pose[2] + %f, current_pose[3], current_pose[4], current_pose[5]], t=%f)\n" % (x/1000., y/1000., z/1000., step_size * 0.1)
    
    script += "\ttextmsg(\"<< program end\")\n"
    script += "end\n"
    script += "prog()\n\n"
    
    print(script)
# ---------- end movel_3 ----------
send_9 = Button()
send_10 = GhPythonScript(script=movel_3, send=send_9)  # -> out; inputs send: Boolean; same code as send_2
panel_16 = Panel(send_10)

# ---- group: Assembly
toggle = BooleanToggle(False)
cp = Plane(PlaneXY(707.5, 0.9999999975, -4.999999993))
cp_new = Plane(PlaneXY(1006.172896, -192.3964844, 0))

# ----
# Assembly
# 1. Generate an assembly containing the trasformed planes of the elements
# 2. Position your assebly:
#    Choose between a center plane (placed in the middle of the table) and a custom "cp_new" plane.
# 1. Visualise the entire assembly.
# 2. Visualise the assembly process by setting a counter and a speed.
generate_assembly = GhPythonScript(centerplane=cp, block=block_def.block, transform=toggle, ptransf=cp_new)  # -> assembly, planes; inputs ptransf: Plane
# ---------- generate_assembly: Python ----------
import Rhino.Geometry as rg
import math
from scriptcontext import sticky as st


from compas.geometry import Frame
from compas.geometry import Transformation
from compas.geometry import Rotation
from compas.geometry import Translation
from compas.geometry import Point

from compas_ghpython.geometry import xtransformed
from compas_ghpython import draw_frame

from ur_online_control.assembly import Assembly
from ur_online_control.assembly import Element

import Rhino.Geometry as rg


# initialize an empty assembly class
assembly = Assembly()

planes = [] # just for vizualisation


#cp.Rotate(math.radians(90), cp.ZAxis, cp.Origin)
#cp.Translate(rg.Vector3d(0,0,1))
cp = centerplane
cf = Frame(cp.Origin, cp.XAxis, cp.YAxis)


for i in range(25): # loop through the number of layers i
    
    axis = cf.zaxis
    angle = math.radians(i*3)
    
    R = Rotation.from_axis_and_angle(axis, angle, point=cp.Origin) #Calculates a ``Rotation`` from a rotation axis and an angle and an optional point of rotation.
    T = Translation([0,0,5*i])
   

    cft = cf.transformed(R * T) #transforms the origin plane

    if i%2 == 0: 
        R = Rotation.from_axis_and_angle(cft.zaxis, math.radians(90), point=cft.point)
        cft = cft.transformed(R)
       
    add = math.sin(i/5)*15
    #print(add)
    
    o1 = cft.point + cft.yaxis*(75+add)
    o2 = cft.point - cft.yaxis*(75+add)
    
    f1 = Frame(o1, cft.xaxis, cft.yaxis)
    f2 = Frame(o2, cft.xaxis, cft.yaxis)
    
    planes.append(draw_frame(f1))
    planes.append(draw_frame(f2))
    
    T1 = Transformation.from_frame_to_frame(Frame.worldXY(), f1)
    T2 = Transformation.from_frame_to_frame(Frame.worldXY(), f2)
    
    #T1 = Translation([10,2,3])
    
    # create new instances of the element
    new_block_1 = block.transformed(T1) #returns a deep copy of the initial element at the new location of the frame
    new_block_2 = block.transformed(T2)

    assembly.add_element(new_block_1)
    assembly.add_element(new_block_2)


if transform:
    T = Transformation.from_frame_to_frame(cf, Frame(ptransf.Origin, ptransf.XAxis, ptransf.YAxis))
    assembly.transform(T)
# ---------- end generate_assembly ----------

# ---- group: Visualise
reset = Button()
run = BooleanToggle(False)
list_6 = ValueList({"100", "200", "500"}, selected="100")
list_7 = ValueList({"20", "50", "100", "500"}, selected="500")
python = PythonScript(run=run, reset=reset, count=list_6, timer_speed=list_7)  # -> C; inputs count: Int32, timer_speed: Int32
# ---------- python: Python ----------
from scriptcontext import sticky as st
import Grasshopper as gh

guid = str(ghenv.Component.InstanceGuid)

counter_key = "counter_" + guid
anchors = "anchors_" + guid
length = count


def ghComponentTimer(run,interval):
    """ Update the component at the interval like using a GH timer """
    
    # Ensure interval is larger than zero
    if interval <= 0:
        interval = 1
        
    # Get the Grasshopper document and component that owns this script
    ghComp = ghenv.Component
    ghDoc = ghComp.OnPingDocument()
    
    # Define the callback function
    def callBack(ghDoc):
        ghComp.ExpireSolution(False)
        
    # Update the solution
    if run:
        ghDoc.ScheduleSolution(interval, gh.Kernel.GH_Document.GH_ScheduleDelegate(callBack))


if reset or counter_key not in st:
    st[counter_key] = 0

else:
    if run:
        if st[counter_key] < length - 1:
            ghComponentTimer(run, timer_speed)
            st[counter_key] += 1
        else:
            st[counter_key] = 0
            ghComponentTimer(run, timer_speed)
            

C = st[counter_key]
# ---------- end python ----------
show_3 = BooleanToggle(True)
show_4 = BooleanToggle(True)
idx = Panel(python)
draw_3 = PythonScript(assembly=generate_assembly.assembly, show_all=show_3, show_counter=show_4, counter=idx)  # -> G, gripping_planes_WCS; inputs counter: Int32
# ---------- draw_3: Python ----------
import os
import sys
from compas_ghpython.artists import MeshArtist

from ur_online_control.assembly import AssemblyArtist
from compas_ghpython import draw_frame

gripping_planes_WCS = []

G = []

if show_all and not show_counter:
    artist = AssemblyArtist(assembly)
    G = artist.draw()

if show_counter:
    for entry in list(assembly.elements())[:counter+1]:
        element = entry[1]
        #print(element)
        artist = MeshArtist(element.mesh)
        mesh = artist.draw_mesh()
        G.append(mesh)
    
    for entry in assembly.elements(data=True):
        print(entry)
        element = entry[1]
        print(element.gripping_frame)
        print element.id
        gripping_planes_WCS.append(draw_frame(entry[1].gripping_frame))
        
    
#print list(assembly.elements())
# ---------- end draw_3 ----------
geo = Geometry(draw_3.G)
pln = Plane(draw_3.gripping_planes_WCS)
preview_2 = CustomPreview(Geometry=geo, Shader=ColourSwatch(SwatchColor=RGBA(255, 186, 186, 146)))

# ---- group: Assembly (continued)
pln_2 = Plane(generate_assembly.planes)

# ----
# Visualisation
# Choose from different options, which robot configuration to visualise
planes_wcs = Plane(pln)
pose_joints = Data(pose_2.configuration)
robot_2 = Data(set_params)
reset_2 = Button()
back = Button()

# ---- group: Calculate joint positions for path
# Add init joint states
joint_states = Data([-0.1728179112, -1.415058186, 1.813991282, -1.971940356, -1.571654205, -3.308720436])
init_configuration = Slider(5, range=0..7)
py_3 = PythonScript(robot=robot_2, planes_WCS=planes_wcs, configuration_idx=init_configuration, init_configuration=pose_2.pose_joints)  # -> configurations; inputs planes_WCS: list, configuration_idx: Int32, init_configuration: list
# ---------- py_3: Python ----------
from compas_ghpython import unload_modules
unload_modules('ur_online_control')

import Rhino.Geometry as rg
from compas.geometry import Frame 
from compas.geometry.xforms import Transformation
from compas_ghpython import draw_frame
from ur_online_control.ur.kinematics import calculate_configurations_for_path, format_joint_positions


print init_configuration

# TODO this must be optimized! matrix multiplication!
frames_tool0_RCS = []
for plane_WCS in planes_WCS:
    tcp_WCS = Frame(plane_WCS.Origin, plane_WCS.XAxis, plane_WCS.YAxis)
    tcp_RCS = robot.get_frame_in_RCS(tcp_WCS)
    frames_tool0_RCS.append(robot.get_tool0_frame_from_tcp_frame(tcp_RCS))
    

#configurations = calculate_configurations_for_path(frames_tool0_RCS, robot.params, init_configuration)
configurations = calculate_configurations_for_path(frames_tool0_RCS, robot, init_configuration)
#print configurations
configurations = configurations[min([configuration_idx, len(configurations) - 1])]

def format(numbers, k=4):
    #numbers = format_joint_positions(numbers)
    return "[" + ", ".join([("%." + str(k) + "f") % n for n in numbers]) + "]"
# ---------- end py_3 ----------
step = Button()
start = Button()
stop_3 = Button()
counter = CountThroughList(L=py_3, start=start, stop=stop_3, step=step, step_back=back, reset=reset_2, full=full, interval=100)  # -> item, counter; inputs L: list, start: Boolean, stop: Boolean, step_back: Boolean
# ---------- counter: Python ----------
from scriptcontext import sticky as st
from compas_ghpython import update_component


# store data in component
guid = str(ghenv.Component.InstanceGuid)
counter_key = "counter_" + guid
running_key = "running_" + guid

if counter_key not in st:
    st[counter_key] = 0

if running_key not in st:
    st[running_key] = False

if start:
    st[running_key] = True

if stop:
    st[running_key] = False

if step:
    if st[counter_key] < len(L) - 1:
        st[counter_key] += 1

if step_back:
    if st[counter_key] < len(L) - 1:
        st[counter_key] -= 1

if reset:
    st[counter_key] = 0

if full:
    st[counter_key] = len(L)-1

if len(L):
    item = L[st[counter_key]]

if st[running_key]:
    if st[counter_key] < len(L) - 1:
        st[counter_key] += 1
        update_component(ghenv, interval)
    else:
        st[counter_key] = 0
        st[running_key] = False

#st["visualisation_counter"] = st[counter_key]
counter = st[counter_key]
# ---------- end counter ----------

# ---- group: Define plane in WCS, calculate joint positions
select_configuration = Slider(5, range=0..7)
pt = Point(Point(579.4906103, -358.3963722, 275.0703081))
xy = XYPlane(Origin=pt)
plane_wcs = Plane(xy)
inverse = PythonScript(robot=robot_2, plane_WCS=plane_wcs, idx=select_configuration)  # -> configuration, plane_WCS; inputs plane_WCS: Plane, idx: Int32
# ---------- inverse: Python ----------
import Rhino.Geometry as rg
from compas.geometry import Frame, Transformation
from compas_ghpython import draw_frame
import math


#plane_WCS.Rotate(math.radians(-10), plane_WCS.YAxis, plane_WCS.Origin)
#plane_WCS.Rotate(math.radians(-10), plane_WCS.ZAxis, plane_WCS.Origin)

plane_WCS.Rotate(math.radians(90), plane_WCS.ZAxis, plane_WCS.Origin)
plane_WCS.Rotate(math.radians(180), plane_WCS.XAxis, plane_WCS.Origin)

tcp_WCS = Frame(plane_WCS.Origin, plane_WCS.XAxis, plane_WCS.YAxis)
#print tcp_WCS

# transform frame to robot coordinate system
#tool_plane_in_RCS = self.get_tool_plane_in_RCS(tp_WCS)
tcp_RCS = robot.get_frame_in_RCS(tcp_WCS)

tool0_RCS = robot.get_tool0_frame_from_tcp_frame(tcp_RCS)

# calculate solutions to frame
solutions = robot.inverse_kinematics(tool0_RCS)

if not len(solutions):
    q = [0,0,0,0,0,0]
else:
    idx = min(len(solutions) - 1, idx)
    q = solutions[idx]
    
#print q

configuration = q
print(configuration)
# ---------- end inverse ----------

# ---- group: Calculate joint positions for path / Shows joint positions along path
flip = BooleanToggle(True)
l2t = PythonScript(L=py_3, flip=flip)  # -> T; inputs L: list, flip: Boolean
# ---------- l2t: Python ----------
from compas_ghpython import list_to_ghtree
L = [l.values for l in L]

if flip:
    L = zip(*L)
T = list_to_ghtree(L)
# ---------- end l2t ----------
graph = QuickGraph(l2t, SortOrder=0)

# ----
show_5 = BooleanToggle(True)
visualize = GhPythonScript(counter=counter.counter, show=show_5, from_online_robot=show_2, assembly=generate_assembly.assembly)  # -> out, blocks_vis
# ---------- visualize: Python ----------
from scriptcontext import sticky as st
from compas_ghpython.artists import MeshArtist

blocks_vis = []

if from_online_robot:
    c = st["current_number"]
else:
    c = counter
    
if show:
    for entry in list(assembly.elements())[:counter+1]:
        element = entry[1]
        print element
        artist = MeshArtist(element.mesh)
        mesh = artist.draw_mesh()
        blocks_vis.append(mesh)
# ---------- end visualize ----------
geo_2 = Geometry(visualize.blocks_vis)
preview_3 = CustomPreview(Geometry=geo_2, Shader=ColourSwatch(SwatchColor=RGBA(255, 161, 161, 188)))

# ---- group: Visualise
list_8 = ValueList({"0 forward, from angles": 0, "1 inverse, from one plane": 1, "2 inverse, from multiple planes": 2, "3 forward, from robot": 3}, selected="2 inverse, from multiple planes")
filter = StreamFilter(Gate=list_8, Stream0=forward_kinematics, Stream1=inverse.configuration, Stream2=counter.item, Stream3=pose_joints)
draw_4 = PythonScript(robot=robot_2, configuration=filter, meshes=ur10e_mesh, breps=ur10e_brep, show_brep=show_brep)  # -> robot_mesh, tool_mesh, robot_brep, tool_brep, tool0_plane, tcp_plane; inputs meshes: list of Mesh, breps: list of Brep
# ---------- draw_4: Python ----------
from compas_ghpython import draw_frame


if configuration:
    if len(robot.model) == 0:
        robot.model = meshes
        robot.model_breps = breps
        robot_brep, tool_brep, robot_mesh, tool_mesh = []
    
    tmodel = robot.xdraw(configuration)
    robot_mesh = tmodel[:6]
    tool_mesh = tmodel[6]
    
    if show_brep:
        tmodel = robot.xdraw_brep(configuration)
        robot_brep = tmodel[:6]
        tool_brep = tmodel[6]
    
    T0, T1, T2, T3, T4, T5 = robot.get_forward_transformations(configuration)

    tool0_frame, tcp_frame = robot.get_transformed_tool_frames(T5)
    tool0_plane = draw_frame(tool0_frame)
    tcp_plane = draw_frame(tcp_frame)
# ---------- end draw_4 ----------
tool0_plane = Plane(draw_4.tool0_plane)
tcp_plane = Plane(draw_4.tcp_plane)
draw_5 = RepresentPlaneAsLines(plane=[tcp_plane, tool0_plane], size=100)  # -> G, C
# ---------- draw_5: Python ----------
import Rhino.Geometry as rg
from System.Drawing import Color

if plane:

    G = []
    G.append(rg.Line(plane.Origin, size * plane.XAxis))
    G.append(rg.Line(plane.Origin, size * plane.YAxis))
    G.append(rg.Line(plane.Origin, size * plane.ZAxis))
    
    C = []
    C.append(Color.FromArgb(255, 0, 0))
    C.append(Color.FromArgb(0, 255, 0))
    C.append(Color.FromArgb(0, 0, 255))
# ---------- end draw_5 ----------
preview_4 = CustomPreview(Geometry=draw_5.G, Shader=draw_5.C)
mesh = Mesh(draw_4.robot_mesh)

# ----
idx_2 = Slider(0, range=0..100)
panel_17 = Panel("move joints")
joint_configurations = Data(filter)
list_9 = ValueList({"send all positions": 0, "send only one position": 1}, selected="send only one position")
item = ListItem(List=joint_configurations, Index=idx_2, Wrap=True)
filter_2 = StreamFilter(Gate=list_9, Stream0=joint_configurations, Stream1=item)
movej = PythonScript(joint_configurations=filter_2, velocity=Slider(50, range=0..200))  # -> script, values; inputs joint_configurations: list
# ---------- movej: Python ----------
script_lines = []

for configuration in joint_configurations:
    #print configuration.joint_values
    print(str(configuration.values))
    script_lines.append("movej(%s, v=%f)" % (str(configuration.values), velocity/1000.))


script = "def prog():\n"
script += "\ttextmsg(\">> program start\")\n"
script += "".join(["\t%s\n" % line for line in script_lines])
script += "\ttextmsg(\"<< program end\")\n"
script += "end\n"
script += "prog()\n\n"


values = joint_configurations[0].values
# ---------- end movej ----------
panel_18 = Panel(movej.values)
send_11 = Button()
send_12 = GhPythonScript(script=movej.script, send=send_11)  # -> out; inputs send: Boolean; same code as send_2
panel_19 = Panel(send_12)

brep = Brep(draw_4.robot_brep)
brep_2 = Brep(draw_4.tool_brep)
mesh_2 = Mesh(draw_4.tool_mesh)

# ---- group: Visualise (continued)
preview_5 = CustomPreview(Geometry=[mesh, brep], Shader=ColourSwatch(SwatchColor=RGBA(99, 94, 94, 96)))

# ----
preview_6 = CustomPreview(Geometry=[mesh_2, brep_2], Shader=ColourSwatch(SwatchColor=RGBA(204, 78, 78, 96)))

panel_20 = Panel("move cartesian")
idx_3 = Slider(0, range=0..100)
list_10 = ValueList({"send all positions": 0, "send only one position": 1}, selected="send only one position")
send_13 = Button()

panel_21 = Panel("move cartesian single")
send_14 = Button()

# ----
# Direct UR control: Pick and Place Routine
number_slider_3 = Slider(150, range=0..300)
pick_up_plane = Plane(Plane(origin=(707.5, -539, 18.00000001), x=(1, 0, 0), y=(0, -1, 0)))
pick_and_place = GhPythonScript(
    counter=counter.counter,
    assembly=generate_assembly.assembly,
    pick_up_plane_WCS=pick_up_plane,
    dfillet=Slider(20, range=0..100),
    speed=number_slider_3)  # -> out, pick_up_plane_safe_level_WCS, pick_up_plane_WCS, current_plane_WCS, movel_commands, script; inputs pick_up_plane_WCS: Plane
# ---------- pick_and_place: Python ----------
from scriptcontext import sticky as st
from ur_online_control.ur_direct import generate_script_pick_and_place_block
from compas.geometry import Frame
from compas_ghpython import draw_frame

import Rhino.Geometry as rg


server_address = st["server_address"]
server_port = 30005
ur_ip = st["ur_ip"]
robot = st["robot"]

current_frame_WCS = assembly.element(counter).gripping_frame
current_plane_WCS = draw_frame(current_frame_WCS)

safe_level_dist = 120
pick_up_plane_WCS = rg.Plane(pick_up_plane_WCS)
pick_up_plane_WCS.Translate(pick_up_plane_WCS.ZAxis*10)

pick_up_plane_safe_level_WCS = rg.Plane(pick_up_plane_WCS)
pick_up_plane_safe_level_WCS.OriginZ = current_plane_WCS.OriginZ
pick_up_plane_safe_level_WCS.Translate(pick_up_plane_safe_level_WCS.ZAxis*-safe_level_dist)


current_plane_WCS = rg.Plane(current_plane_WCS)
#current_plane_WCS.Translate(current_plane_WCS.ZAxis*18)
current_plane_safe_level_WCS = rg.Plane(current_plane_WCS)
current_plane_safe_level_WCS.Translate(current_plane_WCS.ZAxis*-safe_level_dist)

planes_WCS = [pick_up_plane_safe_level_WCS, pick_up_plane_WCS, pick_up_plane_safe_level_WCS, current_plane_safe_level_WCS, current_plane_WCS, current_plane_safe_level_WCS]

# calc movel commands from planes
buffer = 0.7
movel_commands = []
for i, plane in enumerate(planes_WCS):
    
    frame_WCS = Frame(plane.Origin, plane.XAxis, plane.YAxis) #Frame from Rhino plane
    frame_RCS = robot.get_frame_in_RCS(frame_WCS)
    
    # calc radius
    if i == 1 or i == len(planes_WCS) - 2 or i == len(planes_WCS) - 1:
        radius = 0.
    else:
        # calculate blend radius
        prev, current, next = planes_WCS[i-1].Origin, planes_WCS[i].Origin, planes_WCS[i+1].Origin
        radius = min((prev - current).Length/2 * buffer, (next - current).Length/2 * buffer, dfillet)
    
    # cmd = [x, y, z, ax, ay, az, speed, radius]
    
    if i == len(planes_WCS) - 2:
        speedval = speed/2
    else:
        speedval = speed
        
    cmd = list(frame_RCS.point) + list(frame_RCS.axis_angle_vector) + [speedval, radius]
    movel_commands.append(cmd)


tool_angle_axis = list(robot.tool.tcp_frame.point) + list(robot.tool.tcp_frame.axis_angle_vector)
script  = generate_script_pick_and_place_block(tool_angle_axis, movel_commands)

#print script
# ---------- end pick_and_place ----------
pln_3 = Plane(pick_and_place.current_plane_WCS)
pln_4 = Plane(pick_and_place.pick_up_plane_safe_level_WCS)
pln_5 = Plane(pick_and_place.pick_up_plane_WCS)
preview_7 = CustomPreview(Geometry=pln_3, Shader=ColourSwatch(SwatchColor=RGBA(255, 186, 186, 146)))

commands = Data(pick_and_place.movel_commands)
item_2 = ListItem(List=commands, Index=idx_3, Wrap=True)
filter_3 = StreamFilter(Gate=list_10, Stream0=commands, Stream1=item_2)
movel_4 = PythonScript(commands=filter_3)  # -> script; inputs commands: list
# ---------- movel_4: Python ----------
from scriptcontext import sticky as st

script_lines = []
for cmd in commands:
    #q, a=1.4, v=1.05, t=0, r=0)
    x, y, z, ax, ay, az, speed, radius = cmd
    script_lines.append("movel(p%s, v=%f, r=%f)" % (str([x/1000., y/1000., z/1000, ax, ay, az]), speed/1000., radius/1000.))

robot = st["robot"]
tool_angle_axis = list(robot.tool.tcp_frame.point) + list(robot.tool.tcp_frame.axis_angle_vector)
x, y, z, ax, ay, az = tool_angle_axis

script = "def prog():\n"
script += "\ttextmsg(\">> program start\")\n"
script += "\tset_tcp(p%s)\n" % str([x/1000., y/1000., z/1000, ax, ay, az])
script += "".join(["\t%s\n" % line for line in script_lines])
script += "\ttextmsg(\"<< program end\")\n"
script += "end\n"
script += "prog()\n\n"

print(script)
# ---------- end movel_4 ----------
send_15 = GhPythonScript(script=movel_4, send=send_13)  # -> out; inputs send: Boolean; same code as send_2
panel_22 = Panel(send_15)

movel_5 = PythonScript(plane_WCS=pick_and_place.pick_up_plane_WCS)  # -> script; inputs plane_WCS: Plane
# ---------- movel_5: Python ----------
import Rhino.Geometry as rg
from compas.geometry import Frame
from compas.geometry import Transformation
from compas_ghpython import draw_frame
from scriptcontext import sticky as st

robot = st["robot"]


frame_WCS = Frame(plane_WCS.Origin, plane_WCS.XAxis, plane_WCS.YAxis)
frame_RCS = robot.get_frame_in_RCS(frame_WCS)
cmd = list(frame_RCS.point) + list(frame_RCS.axis_angle_vector) + [20, 0]
cmdx, cmdy, cmdz, cmdax, cmday, cmdaz, cmdspeed, cmdradius = cmd

tool_angle_axis = list(robot.tool.tcp_frame.point) + list(robot.tool.tcp_frame.axis_angle_vector)
x, y, z, ax, ay, az = tool_angle_axis

script = "def prog():\n"
script += "\ttextmsg(\">> program start\")\n"
script += "\tset_tcp(p%s)\n" % str([x/1000., y/1000., z/1000, ax, ay, az])
script += "\tmovel(p%s, v=%f, r=%f)" % (str([cmdx/1000., cmdy/1000., cmdz/1000, cmdax, cmday, cmdaz]), cmdspeed/1000., cmdradius/1000.)
script += "\ttextmsg(\"<< program end\")\n"
script += "end\n"
script += "prog()\n\n"

print(script)
# ---------- end movel_5 ----------
send_16 = GhPythonScript(script=movel_5, send=send_14)  # -> out; inputs send: Boolean; same code as send_2
panel_23 = Panel(send_16)

send_pick_and_place = Button()
send_17 = GhPythonScript(script=pick_and_place.script, send=send_pick_and_place)  # -> out; inputs send: Boolean; same code as send_2

panel_24 = Panel(send_17)

# ==== cluster Tools

# ---- group: air pick 2 cups 15mm
geo = Geometry(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)
mesh = Mesh(geo)
brep = Brep(geo)
mjoin = MeshJoin(Meshes=mesh)
xaxis_line = Curve(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)
yaxis_line = Curve(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)
tool = PythonScript(meshes=mjoin, breps=brep, xline=xaxis_line, yline=yaxis_line)  # -> tool; inputs meshes: list of Mesh, breps: list of Brep
# ---------- tool: Python ----------
import Rhino.Geometry as rg
from compas.geometry import Frame
from ur_online_control.ur.tool import Tool

xaxis = rg.Line(xline.PointAtStart, xline.PointAtEnd)
yaxis = rg.Line(yline.PointAtStart, yline.PointAtEnd)

if xaxis.From.DistanceTo(yaxis.From) < 0.01:
    origin = xaxis.From
    xaxis = xaxis.Direction
    yaxis = yaxis.Direction
elif xaxis.To.DistanceTo(yaxis.To) < 0.01:
    origin = xaxis.To
    xaxis = -xaxis.Direction
    yaxis = -yaxis.Direction
elif xaxis.From.DistanceTo(yaxis.To) < 0.01:
    origin = xaxis.From
    xaxis = xaxis.Direction
    yaxis = -yaxis.Direction
elif xaxis.To.DistanceTo(yaxis.From) < 0.01:
    origin = xaxis.To
    xaxis = -xaxis.Direction
    yaxis = yaxis.Direction

xaxis.Unitize()
yaxis.Unitize()

print origin
print xaxis
print yaxis

tcp_frame = Frame(origin, xaxis, yaxis)

tool = Tool(tcp_frame)
tool.model = meshes
tool.model_breps = breps
# ---------- end tool ----------

# ---- group: air pick 2 cups 40mm
geo_2 = Geometry(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)
mesh_2 = Mesh(geo_2)
brep_2 = Brep(geo_2)
mjoin_2 = MeshJoin(Meshes=mesh_2)
xaxis_line_2 = Curve(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)
yaxis_line_2 = Curve(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)
tool_2 = PythonScript(meshes=mjoin_2, breps=brep_2, xline=xaxis_line_2, yline=yaxis_line_2)  # -> tool; inputs meshes: list of Mesh, breps: list of Brep; same code as tool

# ---- group: air pick 1 cup 40mm
geo_3 = Geometry(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)
mesh_3 = Mesh(geo_3)
brep_3 = Brep(geo_3)
mjoin_3 = MeshJoin(Meshes=mesh_3)
xaxis_line_3 = Curve(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)
yaxis_line_3 = Curve(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)
tool_3 = PythonScript(meshes=mjoin_3, breps=brep_3, xline=xaxis_line_3, yline=yaxis_line_3)  # -> tool; inputs meshes: list of Mesh, breps: list of Brep; same code as tool

# ---- group: air pick 1 cup 15mm
geo_4 = Geometry(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)
mesh_4 = Mesh(geo_4)
brep_4 = Brep(geo_4)
mjoin_4 = MeshJoin(Meshes=mesh_4)
xaxis_line_4 = Curve(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)
yaxis_line_4 = Curve(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)
tool_4 = PythonScript(meshes=mjoin_4, breps=brep_4, xline=xaxis_line_4, yline=yaxis_line_4)  # -> tool; inputs meshes: list of Mesh, breps: list of Brep; same code as tool

# ----
tool_id = ClusterInput()
tool_id_2 = Integer(tool_id)
filter = StreamFilter(Gate=tool_id_2, Stream2=tool_2, Stream3=tool, Stream4=tool_3, Stream5=tool_4)
py = PythonScript(tool=filter)  # -> tcp_frame, model
# ---------- py: Python ----------
from compas_ghpython import mesh_draw 

if tool:
    tcp_frame = tool.tcp_frame
    model = tool.model
# ---------- end py ----------
tool_5 = Data(filter)
draw = PythonScript(frame=py.tcp_frame)  # -> G, C
# ---------- draw: Python ----------
import Rhino.Geometry as rg
from System.Drawing import Color

if not size:
    size = 100

if frame:
    plane = rg.Plane(rg.Point3d(*list(frame.point)), rg.Vector3d(*list(frame.xaxis)), rg.Vector3d(*list(frame.yaxis)))

    G = []
    G.append(rg.Line(plane.Origin, size * plane.XAxis))
    G.append(rg.Line(plane.Origin, size * plane.YAxis))
    G.append(rg.Line(plane.Origin, size * plane.ZAxis))
    
    C = []
    C.append(Color.FromArgb(255, 0, 0))
    C.append(Color.FromArgb(0, 255, 0))
    C.append(Color.FromArgb(0, 0, 255))
# ---------- end draw ----------
tool_6 = ClusterOutput(tool_5)
preview = CustomPreview(Geometry=py.model, Shader=ColourSwatch(SwatchColor=RGBA(141, 170, 178, 150)))
preview_2 = CustomPreview(Geometry=draw.G, Shader=draw.C)

# ==== cluster Draw
frame = ClusterInput()
size = ClusterInput()
draw = PythonScript(frame=frame, size=size)  # -> G, C
# ---------- draw: Python ----------
import Rhino.Geometry as rg
from System.Drawing import Color

if not size:
    size = 100

if frame:
    
    plane = rg.Plane(rg.Point3d(*list(frame.point)), rg.Vector3d(*list(frame.xaxis)), rg.Vector3d(*list(frame.yaxis)))

    G = []
    G.append(rg.Line(plane.Origin, size * plane.XAxis))
    G.append(rg.Line(plane.Origin, size * plane.YAxis))
    G.append(rg.Line(plane.Origin, size * plane.ZAxis))
    
    C = []
    C.append(Color.FromArgb(255, 0, 0))
    C.append(Color.FromArgb(0, 255, 0))
    C.append(Color.FromArgb(0, 0, 255))
# ---------- end draw ----------
G = ClusterOutput(draw.G)
C = ClusterOutput(draw.C)
