# Grasshopper definition 181109_linear_axis_setup_updated_190410.gh (Grasshopper 1.0.7)

# ---- group: BASE POINTS / Ref surface circle
crv = Curve(<curve referenced from the Rhino model>)

# ----
# 0a
# Settings
# Check your IP address and set UR IP address
server_address = ValueList({"192.168.10.2", "192.168.10.11", "127.0.0.1"}, selected="192.168.10.2")
ur_ip = ValueList({"192.168.10.13", "192.168.10.11", "192.168.10.10", "127.0.0.1"}, selected="192.168.10.13")
server_port = Integer(30003)
globals = PythonScript(server_address=server_address, server_port=server_port, ur_ip=ur_ip)  # inputs server_port: Int32
# ---------- globals: Python ----------
from scriptcontext import sticky as st

st["server_address"] = server_address
st["server_port"] = server_port

st["ur_ip"] = ur_ip
# ---------- end globals ----------

# ---- group: Scale factor
# original curve control points 0,13
# curve interpolated points -0.5,11.5
minimum_radius = Slider(330, range=0..1000)
subtraction = Subtraction(A="1000", B=minimum_radius)
division = Division(A=subtraction, B=2)
dom = ConstructDomain(DomainStart=division, DomainEnd="0")

# ----
# Check if UR is available
ping = Button()
py = PythonScript(ip=ur_ip, ping=ping)  # -> out
# ---------- py: Python ----------
from scriptcontext import sticky as st
from ur_online_control.communication import is_available


guid = str(ghenv.Component.InstanceGuid)
txt_key = "txt_" + guid
if txt_key not in st:
    st[txt_key] = ""

if ping:
    
    available = is_available(ip)
    
    if available:
        st[txt_key] = "%s is up!" % ip
    else:
        st[txt_key] = "%s is down!" % ip

print st[txt_key]
# ---------- end py ----------
panel = Panel(py)

# ----
# original curve control points 0-25
# curve interpolated points 0-23
tangent_rotation_start_height = Slider(600, range=0..2010)

times_pattern_is_repeated = Slider(14, range=0..100)

# ---- group: Curve offset
# original curve control points 265,400
# curve interpolated points 273,320
number_slider = Slider(259, range=-300..500)
amount_not_affected_layers = Slider(0, range=0..120)
list = ValueList({"Control point curve": 0, "Interpolated curve": 1, "Blend curve": 2}, selected="Control point curve")
dom_2 = ConstructDomain(DomainStart=number_slider, DomainEnd=Slider(420, range=0..500))

# ---- group: short_edge (timber190311
crv_2 = Curve([<curve referenced from the Rhino model> x8])

# ---- group: crown_beams (timber 190311)
brep = Brep([<brep referenced from the Rhino model> x8])

# ---- group: Undulations style
# original column 20, new 22
list_2 = ValueList({"Curve undulations original": 0, "Curve undulations grid": 1}, selected="Curve undulations grid")
number_slider_2 = Slider(20, range=0..100)

# ---- group: Layers
layer_selection_end = Slider(1399, range=0..2011)
# original column 1800, new 2011
# for total height of 2110 (2010 + 100)
layer_count = Slider(2011, range=0..2011)
layer_selection_start = Slider(800, range=0..2100)
layer_height = Slider(1, range=0..100)

# ---- group: Div point offset
dom_3 = ConstructDomain(DomainStart=Slider(0, range=-30..30), DomainEnd=Slider(15, range=0..100))

# ---- group: orient_pt
orientpt = Point(<point referenced from the Rhino model>)

# ---- group: Rib offset
dom_4 = ConstructDomain(DomainStart=Slider(0, range=0..30), DomainEnd=Slider(23, range=0..100))

# ---- group: crv_interpolated_tangent_rotation_angle
dom_5 = ConstructDomain(DomainStart=Slider(0, range=0..90), DomainEnd=Slider(90, range=0..90))

# ----
top_extra_layers = Slider(100, range=0..200)

panel_2 = Panel("Unload libraries")
bang = Button()
unload = PythonScript(bang=bang)
# ---------- unload: Python ----------
from compas_ghpython import unload_modules

unload_modules("compas")
unload_modules("ur_online_control")
# ---------- end unload ----------

move_to_pos = Button()
number_slider_3 = Slider(600, range=0..1000)
pos_z = Slider(800, range=0..1500)
get_pos = Button()
# Disconnect planes_wcs input after moving axis!
# [to make sure robot base is updated within gh]
close = Button()

panel_3 = Panel("ORIGIN")

# ---- group: Create centroid
pt = Point(<point referenced from the Rhino model>)
pdecon = Deconstruct(Point=pt)  # -> XComponent, YComponent, ZComponent
pt_2 = ConstructPoint(XCoordinate=pdecon.XComponent, YCoordinate=pdecon.YComponent, ZCoordinate="1800")

# ---- group: Equalize height of all short_edges (0.3mm tolerance)
end = EndPoints(Curve=crv_2)  # -> Start, End
pdecon_2 = Deconstruct(Point=end.End)  # -> XComponent, YComponent, ZComponent
pdecon_3 = Deconstruct(Point=end.Start)  # -> XComponent, YComponent, ZComponent
pt_3 = ConstructPoint(XCoordinate=pdecon_3.XComponent, YCoordinate=pdecon_3.YComponent, ZCoordinate="1800")
pt_4 = ConstructPoint(XCoordinate=pdecon_2.XComponent, YCoordinate=pdecon_2.YComponent, ZCoordinate="1800")
ln = Line(StartPoint=pt_3, EndPoint=pt_4)

# ----
subtraction_2 = Subtraction(A=number_slider_3, B="500")
subtraction_3 = Subtraction(A="750", B=pos_z)
neg = Negative(Value=subtraction_2)
neg_2 = Negative(Value=subtraction_3)
linear_axis_x_axis = Brep(<brep referenced from the Rhino model>)
linear_axis_plates = Brep([<brep referenced from the Rhino model> x2])
X = UnitX(Factor=neg)
Z = UnitZ(Factor=neg_2)
move = Move(Geometry=linear_axis_x_axis, Motion=X)  # -> Geometry, Transform
move_2 = Move(Geometry=[move.Geometry, linear_axis_plates], Motion=Z)  # -> Geometry, Transform
preview = CustomPreview(Geometry=move_2.Geometry, Shader=ColourSwatch(SwatchColor=RGBA(99, 94, 94, 96)))

# ---- group: Robot
# 1. load robot model
# 2. set tool
# 3. set basis
list_3 = ValueList({"no_tool": 0, "measurement_tool": 1, "extruder": 2}, selected="extruder")
base = PythonScript(x=subtraction_2, z=subtraction_3)  # -> base_frame
# ---------- base: Python ----------
from compas.geometry import Frame

"""
origin = [0, 0, 0]
xaxis = [1, 0, 0]
yaxis = [0, 1, 0]


origin = [-313.92, -147.58, 13.79]
xaxis = [0.00000, -1.00000, 0.00000]
yaxis = [1.00000, 0.00000, 0.00000]
"""


linear_axis_x = x
linear_axis_z = z 
#axis    Y         Z                        X
origin = [155.98, -806.21 + linear_axis_z, 343.76 + linear_axis_x]
xaxis = [0, 0, 1]
yaxis = [1, 0, 0]

base_frame = Frame(list(origin), list(xaxis), list(yaxis))
# ---------- end base ----------
tools = Tools(tool_id=list_3)
list_4 = ValueList({"UR5", "UR10"}, selected="UR10")
robot = PythonScript(model=list_4, tool=tools, base_frame=base)  # -> robot
# ---------- robot: Python ----------
from ur_online_control.ur.ur10 import UR10
from ur_online_control.ur.ur5 import UR5
from scriptcontext import sticky as st

if model == "UR5":
    robot = UR5()
elif model == "UR10":
    robot = UR10()

if tool:
    robot.set_tool(tool)
if base_frame:
    robot.set_base(base_frame)

st["robot"] = robot
# ---------- end robot ----------

# ----
python = GhPythonScript(pattern_repetition=times_pattern_is_repeated, amount_of_steps=Slider(6, range=0..100))  # -> out, value_list; inputs pattern_repetition: Int32, amount_of_steps: Int32
# ---------- python: Python ----------
__author__ = "Joris"
__version__ = "2018.10.19"

value_list = []

max_value = 2

for i in range(int(pattern_repetition)):
    if i != 0 and i != 1 and i != 2:
        # calculate amount of steps based on i
        step_amount = amount_of_steps * i * 2
        print "Height of one pattern repetition", step_amount * 2, "mm"
        print i
        # calculate step size
        step_size = max_value / step_amount
        for j in range(int(2/step_size*2)):
            if step_size*j < 2:
                value = j * step_size
            else:
                value = max_value*2 - j*step_size
            value_list.append(value)
# ---------- end python ----------
linear_axis = GhPythonScript(move_to_pos=move_to_pos, pos_x=number_slider_3, pos_z=pos_z, get_pos=get_pos, close=close)  # -> out
# ---------- linear_axis: Python ----------
__author__ = "joburger"
__version__ = "2018.09.20"

from linear_axis import siemens as s

if move_to_pos:
    p = s.SiemensPortal(1)
    
    try:
         p.set_x(pos_x)
         p.set_z(pos_z)
         # p.wait_ext_axis()
    
    finally:
         p.close()

if close:
    try:
        p.close()
        p = s.SiemensPortal(1)
    finally:
        p.close()

#position_data = None

if get_pos:
    try:
        p = s.SiemensPortal(1)
        position_data = "NO DATA"
        position_data = "AXIS POSITION \nX:" + str(p.get_x()) + " Z:" + str(p.get_z())
        print "hmm"
    finally:
        p.close()

try:
    print position_data
except RuntimeError:
    print "Something did not work"
# ---------- end linear_axis ----------
addition = Addition(A=layer_selection_end, B=top_extra_layers)
list_5 = ValueList({"no_tool": 0, "spray_gun": 1, "extruder": 2}, selected="extruder")
layer_count_2 = Number(layer_count)
subtraction_4 = Subtraction(A=addition, B=tangent_rotation_start_height)
panel_4 = Panel(linear_axis)
tools_2 = Tools_2(tool_id=list_5)
lng = ListLength(List=python.value_list)

# ---- group: Scale factor
range = Range(Domain=Domain(0, 1), Steps=expr("x-1", layer_count_2))
graph = GraphMapper(
    range,
    x0=0,
    x1=1,
    y0=0,
    y1=1,
    container_name="Bezier",
    cpx=[0, 0.2461866289, 0.5236688256, 1],
    cpy=[0.7384505868, 0.1078018546, 0.01457560062, 0.1922056079])
bnd = Bounds(Numbers=graph)
remap = RemapNumbers(Value=graph, Source=bnd, Target=dom)  # -> Mapped, Clipped

# ---- group: Div point offset
range_2 = Range(Domain=Domain(0, 1), Steps=expr("x-1", layer_count_2))
graph_2 = GraphMapper(
    range_2,
    x0=0,
    x1=1,
    y0=0,
    y1=1,
    container_name="Bezier",
    cpx=[0, 0.5091154575, 0.05710413679, 1],
    cpy=[0.2446190715, 0.4540976286, 0.07733350992, 0])
bnd_2 = Bounds(Numbers=graph_2)
remap_2 = RemapNumbers(Value=graph_2, Source=bnd_2, Target=dom_3)  # -> Mapped, Clipped

# ---- group: Rib offset
range_3 = Range(Domain=dom_4, Steps=expr("x-1", layer_count_2))

# ---- group: tangent_rotation_angle
range_4 = Range(Domain=dom_5, Steps=expr("x-1", subtraction_4))

# ----
graph_3 = GraphMapper(
    range_2,
    x0=0,
    x1=1,
    y0=0,
    y1=1,
    A=-1.006428972,
    B=1.006428972,
    container_name="Linear",
    Graph_x0=0.006387904286,
    Graph_x1=1,
    Graph_y0=1,
    Graph_y1=0)
panel_5 = Panel(lng)
addition_2 = Addition(A=layer_count_2, B=top_extra_layers)

# ---- group: Curve offset
data = Data(graph_3)
bnd_3 = Bounds(Numbers=data)
subtraction_5 = Subtraction(A=layer_count_2, B=amount_not_affected_layers)
range_5 = Range(Domain=Domain(0, 1), Steps=expr("x-1", subtraction_5))
remap_3 = RemapNumbers(Value=data, Source=bnd_3, Target=dom_2)  # -> Mapped, Clipped
dup = DuplicateData(Data=number_slider, Number=amount_not_affected_layers, Order=True)
ins = InsertItems(List=remap_3.Mapped, Item=dup, Indices=subtraction_5, Wrap=False)

# ----
subtraction_6 = Subtraction(A=lng, B=addition_2)
dom_6 = ConstructDomain(DomainStart=expr("x+1", subtraction_6), DomainEnd=lng)

start = Button()
py_2 = PythonScript()  # -> path
# ---------- py_2: Python ----------
import sys
import os

ghComp = ghenv.Component
ghDoc = ghComp.OnPingDocument()

# the full path of the gh file
path = ghDoc.FilePath
# the directory of the gh file
path = os.path.dirname(path)

path = os.path.abspath(os.path.join(path, ".."))

print path
# ---------- end py_2 ----------
# 1
# Executing
panel_6 = Panel("Start communication server")
panel_7 = Panel(py_2)
server = PythonScript(path=panel_7, start=start)
# ---------- server: Python ----------
import os
import threading
from scriptcontext import sticky as st

server_address = st["server_address"]
server_port = st["server_port"]
ur_ip = st["ur_ip"]

"""
Change main!!!!
"""
main = os.path.join(path, "communication", "main_old.py")

if os.path.isfile(main):
        
    def myfunc():
        syscall = "python %s %s %s %s" % (main, server_address, server_port, ur_ip)
        os.system(syscall)
    
    if start:
        t = threading.Thread(target=myfunc)
        t.start()
# ---------- end server ----------

subset = SubList(List=python.value_list, Domain=dom_6, Wrap=True)  # -> List, Index

# ---- group: safe_pt
pt_5 = Point(<point referenced from the Rhino model>)
xy = XYPlane(Origin=pt_5)
rotate = Rotate(Geometry=xy, Angle=-1.570796327, Plane=xy)  # -> Geometry, Transform

# ---- group: test_pt
pt_6 = Point(<point referenced from the Rhino model>)
xy_2 = XYPlane(Origin=pt_6)
rotate_2 = Rotate(Geometry=xy_2, Angle=-1.570796327, Plane=xy_2)  # -> Geometry, Transform

# ----
panel_8 = Panel("Get UR connected")
ur = PythonScript(send=start)
# ---------- ur: Python ----------
from scriptcontext import sticky as st
from ur_online_control.ur_driver import URDriver

server_address = st["server_address"]
server_port = st["server_port"]
ur_ip = st["ur_ip"]
robot = st["robot"]

tool_angle_axis = list(robot.tool.tcp_frame.point) + robot.tool.tcp_frame.axis_angle_vector
#robot.tool.tcp_frame.pose_axis_angle_vector
print tool_angle_axis

ur_driver = URDriver(server_address, server_port, tool_angle_axis, ur_ip, "UR")
print ur_driver

if send:
    ur_driver.send()
# ---------- end ur ----------

panel_9 = Panel(remap_2.Mapped)

disconnect = Button()
panel_10 = Panel("Get Grasshopper connected")
client = PythonScript(connect=start, disconnect=disconnect)  # -> connected, client
# ---------- client: Python ----------
import time
from scriptcontext import sticky as st
from Rhino.RhinoApp import WriteLine
from ur_online_control.grasshopper import GHClient, gh_component_timer
import time

server_address = st["server_address"]
server_port = st["server_port"]

guid = str(ghenv.Component.InstanceGuid)

client_key = "client_" + guid
run_key = "run_" + guid

if connect:
    if client_key not in st:
        st[client_key] = GHClient(server_address, server_port)
        client = st[client_key]
        client.connect_to_server()
        client.start()
        
    else:
        if st[client_key].running:
            WriteLine("Client is already connected.")
            
        else:
            st[client_key] = GHClient(server_address, server_port)
            client = st[client_key]
            client.connect_to_server()
            client.start()
"""
else:
    if client_key in st:
        # we need a timer to ask if we have something on the rcv queue
        client = st[client_key]
        #if client.running:
        #    #client.run_inner_while()
        #    gh_component_timer(ghenv, True, 1000)
"""

if disconnect:
    if client_key in st:
        client = st[client_key]
        if client.running:
            client.close()

if client_key in st:
    connected =  st[client_key].running
    client = st[client_key]
    print st[client_key].rcv_queue.qsize()
    print st[client_key].snd_queue.qsize()
else:
    connected = False
# ---------- end client ----------
panel_11 = Panel(client.connected)

python_2 = GhPythonScript(
    short_edges=ln,
    centroid=pt_2,
    curve_offset=remap_3.Mapped,
    tan_rot_angle=range_4,
    tan_rot_start_layer=tangent_rotation_start_height,
    rib_offset=range_3,
    layer_height=layer_height,
    div_pt_count=number_slider_2,
    div_pt_offset=remap_2.Mapped,
    scale_factor=remap.Mapped,
    layer_selection_start=layer_selection_start,
    layer_selection_end=layer_selection_end,
    offset_x=subset.List,
    undulations_type=list_2,
    curve_type=list,
    extra_layers=top_extra_layers)  # -> out, total_curves, polyline_layers, flat_pt_list, angle_lines, axis_moving_pts, axis_moving_pts_indices, lines, curves, crown_short_edges_pts; inputs short_edges: list of Curve, centroid: Point3d, curve_offset: list, tan_rot_angle: list, rib_offset: list, div_pt_count: Int32, div_pt_offset: list, scale_factor: list, layer_selection_start: Int32, layer_selection_end: Int32, offset_x: list, extra_layers: Int32
# ---------- python_2: Python ----------
__author__ = "joburger&niztaha"
__version__ = "2019.02.27"

import Rhino.Geometry as rg
import math
import imp

from design import curve_undulation as cu
from design import generate_column as gc

imp.reload(cu)
imp.reload(gc)

curves = []
total_curves = []
pt_list = []
angle_lines = []
polyline_layers = []
lines = []
line1 = []
line2 = []
curve_list = []
polyline_pt_list = []
lAxis_pt_list = []
crown_short_edges_pts = []

axis_moving_pts_indices = []

div_pt_offset_at_column_top = div_pt_offset[100]

# Column top crown addition
if layer_selection_start == 0 :
    layer_selection_end = layer_selection_end + extra_layers
    # move initial edges as much as the extra layers
    
    for i in range(len(short_edges)):
        short_edges[i].Transform(rg.Transform.Translation(rg.Vector3d(0,0,extra_layers)))

    curve_offset = gc.reverse_extend_list_at_index(curve_offset,extra_layers,1)

    # rib_offset = gc.reverse_extend_list_at_index(rib_offset,extra_layers,1)
    rib_offset_0 = [0 for i in range (extra_layers)]
    rib_offset_0.reverse()
    rib_offset[0:0] = rib_offset_0

    div_pt_offset = gc.reverse_extend_list_at_index(div_pt_offset,extra_layers,1)

    scale_45 = [i+1 for i in range (extra_layers)]
    scale_45.reverse()
    scale_factor[0:0] = scale_45

"""
# generate tangent rotation from column shortest curves
shortest_tan_rot_angles = gc.generate_increment_from_shortest_curve(scale_factor, 10)
# reduce bump starting from column shortest curves
shortest_curve_offsets = gc.generate_increment_from_shortest_curve(scale_factor, 25)
new_curve_offset = []
for i in range(len(curve_offset)-1):
    crvOff = curve_offset[i] + shortest_curve_offsets[i]
    new_curve_offset.append(crvOff)
# reduce pattern div pt offset from top
longest_div_pt_offset = gc.generate_increment_from_shortest_curve(scale_factor, -9, "top")

for i in range(len(div_pt_offset)):
    divPtOff = div_pt_offset[i] + longest_div_pt_offset[i]
    new_div_pt_offset.append(divPtOff)
"""
new_div_pt_offset = []

# column generation
n = len(short_edges)
for i in range(layer_selection_start, layer_selection_end):
    for j in range(n):
        pt1, moved_pt1 = gc.create_rib(short_edges,i,j, rib_offset, -1, scale_factor, centroid)
        pt2, moved_pt2 = gc.create_rib(short_edges,i,(j-(n-1)), rib_offset, 1, scale_factor, centroid)
        # create curve
        if curve_type == 0:
            # OPTION 1: create control point curve
            curve, curve_list = gc.create_cp_crv(curve_offset, i, pt1, pt2, moved_pt1, moved_pt2)
        elif curve_type == 1:
            # OPTION 2: create interpolated curve
            vect_tangent_1 = gc.get_edge_tanget(short_edges,i,j, -1)
            vect_tangent_2 = gc.get_edge_tanget(short_edges,i,(j-(n-1)), 1)
            vect_tan_Tr_10 = gc.transform_edge_tangent(vect_tangent_1, i, tan_rot_angle, -1, tan_rot_start_layer)
            vect_tan_Tr_20 = gc.transform_edge_tangent(vect_tangent_2, i, tan_rot_angle, 1, tan_rot_start_layer)
            # if above generate_increment_from_shortest_curve is used
            vect_tan_Tr_11 = gc.transform_edge_tangent(vect_tan_Tr_10, i, shortest_tan_rot_angles, -1)
            vect_tan_Tr_21 = gc.transform_edge_tangent(vect_tan_Tr_20, i, shortest_tan_rot_angles, 1)

            curve, curve_list = gc.create_inter_crv(new_curve_offset, i, pt1, pt2, moved_pt1, moved_pt2, vect_tan_Tr_11, vect_tan_Tr_21)
        
        elif curve_type == 2:
            # OPTION 3: create blend curve
            curve, curve_list = gc.create_blend_crv(short_edges,j, curve_offset, i, pt1, pt2, moved_pt1, moved_pt2, 200)

        copy_curve = gc.create_column(layer_height, curve, i)

        # append curves
        curves.append(copy_curve)

        # connect curves with straight lines and append
        line_pt1 = copy_curve.PointAtEnd
        line_pt2 = copy_curve.PointAtStart
        line1.append(line_pt1)
        line2.append(line_pt2)


        if j > 0:
            line = rg.Line(line1[j-1], line2[j])
            lines.append(line)
            if i == 0:
                crown_short_edges_pts.append(line1[j-1])
                crown_short_edges_pts.append(line2[j])
        if j == n-1:
            line = rg.Line(line1[-1], line2[0])
            lines.append(line)
            if i == 0:
                crown_short_edges_pts.append(line1[-1])
                crown_short_edges_pts.append(line2[0])
                
        # create undulations
        if undulations_type == 0:
            unds = cu.Curve_undulation(copy_curve, div_pt_count, div_pt_offset[i])
            undulated_divpts = unds.curve_undulation_original()
        else:
            unds = cu.Curve_undulation(i, copy_curve, div_pt_count, div_pt_offset[i], div_pt_offset_at_column_top, offset_x[i])
            undulated_divpts = unds.curve_undulation_grid()

        # append to lists
        pt_list.append(undulated_divpts)
        polyline_pt_list.append(undulated_divpts)


    # flatten list and create polyline per layer
    flat_polyline_list = gc.flatten_list(polyline_pt_list)
    polyline_layer = rg.PolylineCurve(flat_polyline_list + [flat_polyline_list[0]])
    polyline_layers.append(polyline_layer)

    angle_lines = gc.create_angleLines(pt_list, flat_polyline_list, div_pt_count, n)

    # first pt in every layer for axis movement WIP
    flat_lAxis_pt_list = gc.flatten_list(pt_list)
    axis_moving_pts_indices.append(len(flat_lAxis_pt_list))

    #visualize axis moving pts
    lAxis_pt_list.append(flat_lAxis_pt_list[-1])

    # reset lists
    polyline_pt_list = []
    line1 = []
    line2 = []


flat_pt_list = gc.flatten_list(pt_list)

axis_moving_pts = set(flat_pt_list).intersection(lAxis_pt_list)

total_curves = gc.flatten_list([curves, lines])
# ---------- end python_2 ----------

bang_2 = Button()
receive = PythonScript(client=client.client, bang=bang_2)  # -> qsize, client
# ---------- receive: Python ----------
from ur_online_control.communication.msg_identifiers import *
from ur_online_control.utilities.lists import flatten_list
from Rhino.RhinoApp import WriteLine


if client:
    if not client.ghenv:
        client.ghenv = ghenv
    qsize = client.rcv_queue.qsize()
# ---------- end receive ----------
panel_12 = Panel(receive.qsize)

join = JoinCurves(Curves=python_2.total_curves, Preserve=False)
sort_on_z = SortOnZ(A=join)
crv_3 = Curve(python_2.curves)
polyline_layers = Curve(python_2.polyline_layers)
flat_pt_list = Point(python_2.flat_pt_list)

# ---- group: axis_moving_pts
pt_7 = Point(python_2.axis_moving_pts)

# ----
crv_4 = Curve(python_2.lines)
curves = Curve(sort_on_z)

# ---- group: Simplify column for baking
dom_7 = ConstructDomain(DomainStart=expr("x+1", layer_selection_start), DomainEnd=layer_selection_end)
num = Number(expr("x+99", layer_selection_end))
range_6 = Range(Domain=dom_7, Steps=Slider(10, range=0..10))
item = ListItem(List=curves, Index=range_6, Wrap=True)
item_2 = ListItem(List=curves, Index=[layer_selection_end, num], Wrap=True)
loft = Loft(Curves=item_2, Options={Adjust=False, Closed=False, LoftEnds=0, LoftSimp=0, LoftType=0, Rebuild=10, Refit=0.01})
loft_2 = Loft(Curves=item, Options={Adjust=False, Closed=False, LoftEnds=0, LoftSimp=0, LoftType=0, Rebuild=10, Refit=0.01})
join_2 = BrepJoin(Breps=[loft_2, loft])  # -> Breps, Closed

# ----
send = PythonScript(client=receive.client)  # -> out
# ---------- send: Python ----------
from ur_online_control.communication.msg_identifiers import *
from ur_online_control.utilities.lists import flatten_list

if client:
    qsize = client.rcv_queue.qsize()
    if qsize:
        msg = client.rcv_queue.get()
        print msg
# ---------- end send ----------
item_3 = ListItem(List=polyline_layers, Index=Slider(0, range=0..100), Wrap=True)
item_4 = ListItem(List=item, Index=Slider(10, range=0..10), Wrap=True)
loft_3 = Loft(Curves=curves, Options={Adjust=False, Closed=False, LoftEnds=0, LoftSimp=0, LoftType=0, Rebuild=18, Refit=0.01})
panel_13 = Panel(send)
python_3 = GhPythonScript()  # -> out, a
# ---------- python_3: Python ----------
__author__ = "Joris"
__version__ = "2019.03.18"

import rhinoscriptsyntax as rs

a = 6
b = 12.89

c = b * (a/100)

print c
# ---------- end python_3 ----------

# ---- group: Printing time
len = Length(Curve=polyline_layers)
ma = MassAddition(Input=len)  # -> Result, PartialResults
python_4 = GhPythonScript(tot_length=ma.Result, print_speed=Slider(40, range=0..100))  # -> simplify(out), a
# ---------- python_4: Python ----------
__author__ = "joburger"
__version__ = "2018.09.06"

import imp
from design import generate_column as gc

imp.reload(gc)

gc.calculate_weight(tot_length, print_speed)
# ---------- end python_4 ----------

# ----
crv_5 = Curve(python_2.angle_lines)
null = NullItem(Item=crv_5)  # -> NullFlags, InvalidFlags, Description
not = GateNot(A=null.InvalidFlags)
cull = CullPattern(List=crv_5, CullPattern=not)
len_2 = Length(Curve=cull)
division_2 = Division(A=layer_height, B=len_2)
list_6 = ValueList({"Show curve gradient": "gradient", "Show invalid curves": "invalid"}, selected="Show invalid curves")
acos = ArcCosine(Value=division_2)
deg = Degrees(Radians=acos)
python_5 = GhPythonScript(deg=deg, show_curve_type=list_6, max_angle=Slider(43, range=0..100))  # -> out, a, b; inputs deg: list
# ---------- python_5: Python ----------
__author__ = "Joris"
__version__ = "2018.10.31"

import rhinoscriptsyntax as rs

a = []
highest = max(deg)

if show_curve_type == "gradient":
    for i in range(len(deg)):
        if deg[i] < 400:
            red = deg[i] * (255/highest)
            green = 0
            blue = 0
            colour = rs.CreateColor(red, green, blue)
            a.append(colour)
elif show_curve_type == "invalid":
    for i in range(len(deg)):
        if deg[i] > max_angle:
            red = 200
            green = 0
            blue = 0
        else:
            red = 0
            green = 175
            blue = 0
        colour = rs.CreateColor(red, green, blue)
        a.append(colour)
# ---------- end python_5 ----------
panel_14 = Panel(deg)
preview_2 = CustomPreview(Geometry=polyline_layers, Material=python_5.a)

# ---- group: Orient for printing
item_5 = ListItem(List=polyline_layers, Index=-1, Wrap=True)
area = Area(Geometry=item_5)  # -> Area, Centroid
xy_3 = XYPlane(Origin=orientpt)
xy_4 = XYPlane(Origin=area.Centroid)
orient = Orient(Geometry=polyline_layers, Source=xy_4, Target=xy_3)  # -> Geometry, Transform
orient_2 = Orient(Geometry=flat_pt_list, Source=xy_4, Target=xy_3)  # -> Geometry, Transform

# ----
# Direct UR control
get = Button()
get_2 = Button()
pose = PythonScript(get=get_2)  # -> pose_joints
# ---------- pose: Python ----------
from scriptcontext import sticky as st
from ur_online_control.ur_direct import get_current_pose_joints
from ur_online_control.ur.robot import BaseConfiguration

server_address = st["server_address"]
server_port = 30005
ur_ip = st["ur_ip"]
robot = st["robot"]
tool_angle_axis = list(robot.tool.tcp_frame.point) + robot.tool.tcp_frame.axis_angle_vector
print tool_angle_axis

guid = str(ghenv.Component.InstanceGuid)
pose_joints_key = "pose_joints" + guid


if get:
    st[pose_joints_key] = get_current_pose_joints(server_address, server_port, ur_ip, tool_angle_axis)
    
if pose_joints_key not in st:
    pose_joints = []
else:
    pose_joints = BaseConfiguration.from_joints(st[pose_joints_key])
# ---------- end pose ----------
pose_2 = PythonScript(get=get)  # -> pose_cartesian
# ---------- pose_2: Python ----------
from scriptcontext import sticky as st
from ur_online_control.ur_direct import get_current_pose_cartesian

server_address = st["server_address"]
server_port = 30005
ur_ip = st["ur_ip"]
robot = st["robot"]
tool_angle_axis = list(robot.tool.tcp_frame.point) + robot.tool.tcp_frame.axis_angle_vector
print tool_angle_axis

guid = str(ghenv.Component.InstanceGuid)
pose_cartesian_key = "pose_cartesian" + guid


if get:
    st[pose_cartesian_key] = get_current_pose_cartesian(server_address, server_port, ur_ip, tool_angle_axis)

if pose_cartesian_key not in st:
    pose_cartesian = []
else:
    pose_cartesian = st[pose_cartesian_key]
# ---------- end pose_2 ----------
stop = Button()
stop_2 = PythonScript(stop=stop)
# ---------- stop_2: Python ----------
from scriptcontext import sticky as st
from ur_online_control.ur_direct import stop as stop_robot

ur_ip = st["ur_ip"]

if stop:
    stop_robot(ur_ip)
# ---------- end stop_2 ----------
panel_15 = Panel(pose)
panel_16 = Panel(pose_2)

vertical_pose = Number([-152.427, -780.635, 855.229, -1.1958, -1.22046, -1.20201])
panel_17 = Panel(python_4.out)
back = Button()
reset = Button()

# ---- group: Define joint positions
base_2 = Slider(90.163, range=-360..360)
elbow = Slider(-102.857, range=-360..360)
wrist2 = Slider(0, range=-360..360)
wrist3 = Slider(0, range=-360..360)
shoulder = Slider(0, range=-360..360)
wrist1 = Slider(0, range=-360..360)
ur1_q1_q6 = Data([base_2, shoulder, elbow, wrist1, wrist2, wrist3])

# ----
py_3 = GhPythonScript(joint_values=ur1_q1_q6)  # -> configuration; inputs joint_values: list
# ---------- py_3: Python ----------
import math
from ur_online_control.ur.robot import BaseConfiguration

configuration = BaseConfiguration.from_joints([math.radians(d) for d in joint_values])
# ---------- end py_3 ----------

# ----
# Calculate basis
# Measure basis:
# 1. Clear the recorded poses
# 2. Move robot to origin and press "get pose"
# 3. Move robot to point in positive x-axis and press "get pose"
# 4. Move robot to an other point in your basis and press "get pose"
# (The farer away these positions are, the better)
# 
# 5. Alternatively change the order in the component calc base
# 6. Copy output into base component
list_7 = ValueList({"origin, pt on positive x-axis, pt in xy plane": 0, "origin, pt on positive y-axis, pt in xy plane": 1}, selected="origin, pt on positive x-axis, pt in xy plane")
clear = Button()
rec = PythonScript(msg=pose_2, rec=get, clear=clear)  # -> rec; inputs msg: list
# ---------- rec: Python ----------
from scriptcontext import sticky as st

guid = str(ghenv.Component.InstanceGuid)
recorded_key =  "recorded_" + guid
just_cleared_key = "just_cleared_" + guid

if recorded_key not in st:
    st[recorded_key] = []

if just_cleared_key not in st:
    st[just_cleared_key] = False

if clear:
    st[recorded_key] = []
    st[just_cleared_key] = True
else:
    if len(msg):
        if msg != [None] and not st[just_cleared_key] and rec:
            st[recorded_key].append(msg)
    st[just_cleared_key] = False
        


rec = st[recorded_key]

print rec
# ---------- end rec ----------
calc_base = PythonScript(poses=rec, input_type=list_7)  # -> out; inputs poses: list
# ---------- calc_base: Python ----------
import Rhino.Geometry as rg
import math


if len(poses) > 2:
    
    O = poses[0]
    P1 = poses[1]
    P2 = poses[2]
    
    if input_type == 0:
        # origin, pt on positive x-axis, pt in xy plane
        origin = rg.Point3d(O[0], O[1], O[2])
        pt_on_xaxis = rg.Point3d(P1[0], P1[1], P1[2])
        pt_in_xyplane = rg.Point3d(P2[0], P2[1], P2[2])
        
        xaxis = pt_on_xaxis - origin
        xaxis.Unitize()
        
        v = pt_in_xyplane - origin
        zaxis = rg.Vector3d.CrossProduct(v, xaxis)
        zaxis.Unitize()
        
        # zaxis must look up!
        if math.acos(rg.Vector3d.ZAxis * zaxis) > math.acos(rg.Vector3d.ZAxis * -zaxis):
            zaxis = -zaxis
        
        yaxis = rg.Vector3d.CrossProduct(zaxis, xaxis)
    
    elif input_type == 1:
        # origin, pt on positive y-axis, pt in xy plane
        origin = rg.Point3d(O[0], O[1], O[2])
        pt_on_yaxis = rg.Point3d(P1[0], P1[1], P1[2])
        pt_in_xyplane = rg.Point3d(P2[0], P2[1], P2[2])
        
        yaxis = pt_on_yaxis - origin
        yaxis.Unitize()
        
        v = pt_in_xyplane - origin
        zaxis = rg.Vector3d.CrossProduct(v, yaxis)
        zaxis.Unitize()
        
        # zaxis must look up!
        if math.acos(rg.Vector3d.ZAxis * zaxis) > math.acos(rg.Vector3d.ZAxis * -zaxis):
            zaxis = -zaxis
        
        xaxis = rg.Vector3d.CrossProduct(yaxis, zaxis)
        
        
    print "Copy the following into base component:"
    print " "
    print "origin = [%.2f, %.2f, %.2f]" % tuple(list(origin))
    print "xaxis = [%.5f, %.5f, %.5f]" % tuple(list(xaxis))
    print "yaxis = [%.5f, %.5f, %.5f]" % tuple(list(yaxis))
    

#print rg.Vector3d.CrossProduct(rg.Vector3d.YAxis, rg.Vector3d.ZAxis)
#print rg.Vector3d.CrossProduct(rg.Vector3d.ZAxis, rg.Vector3d.XAxis)
# ---------- end calc_base ----------
panel_18 = Panel(rec)
panel_19 = Panel(calc_base)

# ---- group: Oriented curves
crv_6 = Curve(orient.Geometry)

# ---- group: Oriented points
pt_8 = Point(orient_2.Geometry)

# ---- group: Visualise / robot model brep
py_4 = PythonScript(model=list_4)  # -> n
# ---------- py_4: Python ----------
if model == "UR5":
    n = 0
if model == "UR10":
    n = 1

print n
# ---------- end py_4 ----------
ur10_brep = UR10Brep([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])
ur5_brep = UR5Brep([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])
show_brep = BooleanToggle(False)
filter = StreamFilter(Gate=py_4, Stream0=ur5_brep, Stream1=ur10_brep)

# ----
loft_4 = Loft(Curves=crv_6, Options={Adjust=False, Closed=False, LoftEnds=0, LoftSimp=0, LoftType=0, Rebuild=10, Refit=0.01})  # disabled
list_8 = ValueList({"Print with UR": 0, "Print with Linear Axis": 1}, selected="Print with UR")
pdecon_4 = Deconstruct(Point=pt_8)  # -> XComponent, YComponent, ZComponent
pdecon_5 = Deconstruct(Point=orientpt)  # -> XComponent, YComponent, ZComponent
filter_2 = StreamFilter(Gate=list_8, Stream0=pdecon_4.ZComponent, Stream1=pdecon_5.ZComponent)
pt_9 = ConstructPoint(XCoordinate=pdecon_4.XComponent, YCoordinate=pdecon_4.YComponent, ZCoordinate=filter_2)
xy_5 = XYPlane(Origin=pt_9)
pln = Plane(flatten(xy_5))
data_2 = Data(python_2.axis_moving_pts_indices)

# ---- group: Fabrication planes
rev = ReverseList(List=pln)

# ----
pln_2 = Plane(flatten(rev))
rotate_3 = Rotate(Geometry=pln_2, Angle=-1.570796327, Plane=pln_2)  # -> Geometry, Transform

# ---- group: Define commands
safe_speed = Slider(25, range=0..300)
# 2
number_slider_4 = Slider(4, range=0..100)
speed = Slider(45, range=0..300)
planes_wcs = Plane(rotate_3.Geometry)
python_6 = PythonScript(planes_WCS=planes_wcs, dfillet=number_slider_4, speed=speed, safe_speed=safe_speed, safe_pt=rotate.Geometry)  # -> commands; inputs planes_WCS: list of Plane, speed: Int32, safe_pt: Plane
# ---------- python_6: Python ----------
import Rhino.Geometry as rg
from compas.geometry import Frame
from compas.geometry import Transformation
from compas_ghpython import xdraw_frame
from scriptcontext import sticky as st

robot = st["robot"]
buffer = 0.7

commands = []

# add safe_pt as a starting point
tcp_WCS_safe_pt = Frame(safe_pt.Origin, safe_pt.XAxis, safe_pt.YAxis)

tcp_RCS_safe_pt = robot.get_frame_in_RCS(tcp_WCS_safe_pt)
cmd_safe_pt = list(tcp_RCS_safe_pt.point) + tcp_RCS_safe_pt.axis_angle_vector + [safe_speed, 0]
print cmd_safe_pt
commands.append(cmd_safe_pt)

# TODO this must be optimized! matrix multiplication!

for i, plane_WCS in enumerate(planes_WCS):
    tcp_WCS = Frame(plane_WCS.Origin, plane_WCS.XAxis, plane_WCS.YAxis)
    if i == 0 or i == len(planes_WCS) - 1:
        radius = 0.
        
    else:
        # calculate blend radius
        prev, current, next = planes_WCS[i-1].Origin, planes_WCS[i].Origin, planes_WCS[i+1].Origin
        radius = min((prev - current).Length/2 * buffer, (next - current).Length/2 * buffer, dfillet)
    
    tcp_RCS = robot.get_frame_in_RCS(tcp_WCS)
    cmd = list(tcp_RCS.point) + tcp_RCS.axis_angle_vector + [speed, radius]
    commands.append(cmd)


# add safe_pt as an end point
commands.append(cmd_safe_pt)
print (commands)
# ---------- end python_6 ----------

# ----
python_7 = PythonScript(planes_WCS=rotate_2.Geometry, dfillet=number_slider_4, speed=speed, safe_speed=safe_speed, safe_pt=rotate.Geometry)  # -> commands; inputs planes_WCS: list of Plane, speed: Int32, safe_pt: Plane; same code as python_6

commands = Data(python_6)
continue_fabrication = BooleanToggle(True)
# 3
panel_20 = Panel("Send a message")
move_safe_pt = BooleanToggle(True)
send_2 = Button()
send_3 = PythonScript(
    client=client.client,
    send=send_2,
    continue_fabrication=continue_fabrication,
    commands=commands,
    move_safe_pt=move_safe_pt)  # -> out; inputs continue_fabrication: Int32, commands: list, move_safe_pt: Boolean
# ---------- send_3: Python ----------
from ur_online_control.communication.msg_identifiers import *
from ur_online_control.utilities.lists import flatten_list

len_command = len(commands[0])
commands_flattened = flatten_list(commands)

print len(commands_flattened)/8, "commands"
if move_safe_pt:
    print "Moving to safe point"
else:
    print "Skipping safe point"

#picking_pose_cmd, savety_pose_cmd = picking_commands

#print picking_pose_cmd
#print savety_pose_cmd

if send and client:
    client.send(MSG_INT, int(continue_fabrication))
 #   client.send(MSG_FLOAT_LIST, picking_pose_cmd)
 #   client.send(MSG_FLOAT_LIST, savety_pose_cmd)
    client.send(MSG_INT, len_command)
    client.send(MSG_FLOAT_LIST, commands_flattened)
    client.send(MSG_INT, move_safe_pt)
# ---------- end send_3 ----------

panel_21 = Panel(send_3)
item_6 = ListItem(List=planes_wcs, Index=0, Wrap=True)  # -> Item1, Item
pln_3 = Plane([item_6.Item1, item_6.Item])

# ----
# Visualisation
robot_2 = Data(robot)
pose_joints = Data(pose)
planes_wcs_2 = Plane(planes_wcs)

# ---- group: Calculate joint positions for path
# Add init joint states
joint_states = Data([-0.1728179112, -1.415058186, 1.813991282, -1.971940356, -1.571654205, -3.308720436])
init_configuration = Slider(0, range=0..7)
py_5 = PythonScript(robot=robot_2, planes_WCS=pln_3, configuration_idx=init_configuration, init_configuration=joint_states)  # -> configurations; inputs planes_WCS: list, configuration_idx: Int32, init_configuration: list
# ---------- py_5: Python ----------
from compas_ghpython import unload_modules
unload_modules('ur_online_control')
import Rhino.Geometry as rg
from compas.geometry import Frame 
from compas.geometry.xforms import Transformation
from compas_ghpython import xdraw_frame
from ur_online_control.ur.kinematics import calculate_configurations_for_path, format_joint_positions


# TODO this must be optimized! matrix multiplication!
frames_tool0_RCS = []
for plane_WCS in planes_WCS:
    tcp_WCS = Frame(plane_WCS.Origin, plane_WCS.XAxis, plane_WCS.YAxis)
    tcp_RCS = robot.get_frame_in_RCS(tcp_WCS)
    frames_tool0_RCS.append(robot.get_tool0_frame_from_tcp_frame(tcp_RCS))
    

#configurations = calculate_configurations_for_path(frames_tool0_RCS, robot.params, init_configuration)
configurations = calculate_configurations_for_path(frames_tool0_RCS, robot, init_configuration)
print configurations
configurations = configurations[min([configuration_idx, len(configurations) - 1])]

def format(numbers, k=4):
    #numbers = format_joint_positions(numbers)
    return "[" + ", ".join([("%." + str(k) + "f") % n for n in numbers]) + "]"
# ---------- end py_5 ----------
start_2 = Button()
stop_3 = Button()
step = Button()
counter = CountThroughList(L=py_5, start=start_2, stop=stop_3, step=step, step_back=back, reset=reset, interval=50)  # -> item; inputs L: list, start: Boolean, stop: Boolean, step_back: Boolean
# ---------- counter: Python ----------
from scriptcontext import sticky as st
from compas_ghpython import update_component


# store data in component
guid = str(ghenv.Component.InstanceGuid)
counter_key = "counter_" + guid
running_key = "running_" + guid

if counter_key not in st:
    st[counter_key] = 0

if running_key not in st:
    st[running_key] = False

if start:
    st[running_key] = True

if stop:
    st[running_key] = False

if step:
    if st[counter_key] < len(L) - 1:
        st[counter_key] += 1

if step_back:
    if st[counter_key] < len(L) - 1:
        st[counter_key] -= 1

if reset:
    st[counter_key] = 0

if len(L):
    item = L[st[counter_key]]

if st[running_key]:
    if st[counter_key] < len(L) - 1:
        st[counter_key] += 1
        update_component(ghenv, interval)
    else:
        st[counter_key] = 0
        st[running_key] = False
# ---------- end counter ----------

# ---- group: Define plane in WCS, calculate joint positions
pt_10 = Point(Point(-283.8412985, -342.877576, 297.4189147))
select_configuration = Slider(1, range=0..7)
xy_6 = XYPlane(Origin=pt_10)
plane_wcs = Plane(xy_6)
inverse = PythonScript(robot=robot_2, plane_WCS=plane_wcs, idx=select_configuration)  # -> configuration; inputs plane_WCS: Plane, idx: Int32
# ---------- inverse: Python ----------
import Rhino.Geometry as rg
from compas.geometry import Frame, Transformation
from compas_ghpython import xdraw_frame

tcp_WCS = Frame(plane_WCS.Origin, plane_WCS.XAxis, plane_WCS.YAxis)

# transform frame to robot coordinate system
tcp_RCS = robot.get_frame_in_RCS(tcp_WCS)

# get the frame of tool0
tool0_RCS = robot.get_tool0_frame_from_tcp_frame(tcp_RCS)

# calculate solutions to frame
solutions = robot.inverse_kinematics(tool0_RCS)

if not len(solutions):
    q = [0,0,0,0,0,0]
else:
    idx = min(len(solutions) - 1, idx)
    q = solutions[idx]
    
print q

configuration = q
# ---------- end inverse ----------

# ---- group: Calculate joint positions for path / Shows joint positions along path
flip = BooleanToggle(True)
l2t = PythonScript(L=py_5, flip=flip)  # -> T; inputs L: list, flip: Boolean
# ---------- l2t: Python ----------
from compas_ghpython import list_to_ghtree
L = [l.joint_values for l in L]

if flip:
    L = zip(*L)
T = list_to_ghtree(L)
# ---------- end l2t ----------
graph_4 = QuickGraph(l2t, SortOrder=0)

# ---- group: Visualise
list_9 = ValueList({"0 forward, from angles": 0, "1 inverse, from one plane": 1, "2 inverse, from multiple planes": 2, "3 forward, from robot": 3}, selected="2 inverse, from multiple planes")
filter_3 = StreamFilter(Gate=list_9, Stream0=py_3, Stream1=inverse, Stream2=counter, Stream3=pose_joints)
configuration = Panel(filter_3)
mesh = Mesh(filter)
draw = PythonScript(robot=robot_2, configuration=filter_3, mesh=mesh, brep=filter, show_brep=show_brep)  # -> meshes, tool0_plane, tcp_plane, robot_brep; inputs mesh: list, brep: list
# ---------- draw: Python ----------
from compas_ghpython import unload_modules
unload_modules("ur_online_control")

from compas_ghpython import xdraw_frame
from compas_ghpython import mesh_draw
from compas_ghpython.geometry.xforms import xform_from_transformation
from compas.geometry import Frame
from compas.geometry.xforms import Transformation
from ur_online_control.ur.robot import BaseConfiguration

import Rhino.Geometry as rg
import Rhino

def mesh_update_vertices(mesh, vertices):
    for i in range(len(vertices)):
        mesh.vertex[i].update({'x': vertices[i][0], 'y': vertices[i][1], 'z': vertices[i][2]})

if configuration:
    #print configuration
    #q = BaseConfiguration.from_joints(configuration)
    q = configuration
    print q
    print q.joint_values
    
    print robot.get_forward_transformations(q)
    R0, R1, R2, R3, R4, R5 = robot.get_forward_transformations(q)
    
    tool0_frame2 = robot.tool0_frame.transformed(R5)
    tcp_frame2 = Frame.from_transformation(Transformation.from_frame(tool0_frame2) * robot.transformation_tool0_tcp)
    
    print robot.transformation_tool0_tcp
    print robot.transformation_tcp_tool0
    print robot.transformation_tool0_tcp * robot.transformation_tcp_tool0
    print tcp_frame2
    tcp_frame2 = Frame.from_transformation(Transformation.from_frame(tool0_frame2) * robot.transformation_tcp_tool0)
    print tcp_frame2
    
    tool0_frame, tcp_frame = robot.get_transformed_tool_frames(R5)
    
    tool0_frame = tool0_frame2
    tcp_frame = tcp_frame2
    
    m0, m1, m2, m3, m4, m5 = mesh
    for i in range(6):
        exec("R%drg = xform_from_transformation(R%d)" % (i, i))
        exec("m%d.Transform(R%drg)" % (i, i))
    meshes = [m0, m1, m2, m3, m4, m5]
    print meshes
    mt = robot.tool.get_transformed_model(Transformation.from_frame(tool0_frame))
    
    if mt:
        meshes.extend(map(mesh_draw, mt))
    
    """
    m0, m1, m2, m3, m4, m5, tool0_frame, tcp_frame = robot.get_transformed_model(q)
    mt = robot.get_transformed_tool_model(tcp_frame)
    
    meshes = []
    meshes.append(mesh_draw(m0))
    meshes.append(mesh_draw(m1))
    meshes.append(mesh_draw(m2))
    meshes.append(mesh_draw(m3))
    meshes.append(mesh_draw(m4))
    meshes.append(mesh_draw(m5))
    if mt:
        meshes.append(mesh_draw(mt))
    
    """
    
    tool0_plane = xdraw_frame(tool0_frame)
    tcp_plane = xdraw_frame(tcp_frame)
    
    if show_brep:
        
        b0, b1, b2, b3, b4, b5 = brep
        
        b0.Transform(R0rg)
        b1.Transform(R1rg)
        b2.Transform(R2rg)
        b3.Transform(R3rg)
        b4.Transform(R4rg)
        b5.Transform(R5rg)
        
        robot_brep = [b0, b1, b2, b3, b4, b5]
# ---------- end draw ----------
tcp_plane = Plane(draw.tcp_plane)
robot_brep = Brep(draw.robot_brep)
tool0_plane = Plane(draw.tool0_plane)
draw_2 = RepresentPlaneAsLines(plane=tcp_plane, size=100)  # -> G, C
# ---------- draw_2: Python ----------
import Rhino.Geometry as rg
from System.Drawing import Color

if plane:

    G = []
    G.append(rg.Line(plane.Origin, size * plane.XAxis))
    G.append(rg.Line(plane.Origin, size * plane.YAxis))
    G.append(rg.Line(plane.Origin, size * plane.ZAxis))
    
    C = []
    C.append(Color.FromArgb(255, 0, 0))
    C.append(Color.FromArgb(0, 255, 0))
    C.append(Color.FromArgb(0, 0, 255))
# ---------- end draw_2 ----------
preview_3 = CustomPreview(Geometry=draw.meshes, Shader=ColourSwatch(SwatchColor=RGBA(99, 94, 94, 96)))
preview_4 = CustomPreview(Geometry=draw_2.G, Shader=draw_2.C)

# ---- group: Linear axis indices
rev_2 = ReverseList(List=data_2)

# ---- group: Send joint position directly to robot
panel_22 = Panel("move cartesian")
idx = Slider(0, range=0..100)
commands_2 = Data(python_6)
item_7 = ListItem(List=commands_2, Index=idx, Wrap=True)
list_10 = ValueList({"send all positions": 0, "send only one position": 1}, selected="send only one position")
filter_4 = StreamFilter(Gate=list_10, Stream0=commands_2, Stream1=item_7)
movel = PythonScript(commands=filter_4, velocity=Slider(100, range=0..100))  # -> script; inputs commands: list
# ---------- movel: Python ----------
from scriptcontext import sticky as st

script_lines = []
for cmd in commands:
    #q, a=1.4, v=1.05, t=0, r=0)
    x, y, z, ax, ay, az, speed, radius = cmd
    script_lines.append("movel(p%s, v=%f, r=%f)" % (str([x/1000., y/1000., z/1000, ax, ay, az]), speed/1000., radius/1000.))

robot = st["robot"]
tool_angle_axis = list(robot.tool.tcp_frame.point) + robot.tool.tcp_frame.axis_angle_vector
x, y, z, ax, ay, az = tool_angle_axis

script = "def prog():\n"
script += "\ttextmsg(\">> program start\")\n"
script += "\tset_tcp(p%s)\n" % str([x/1000., y/1000., z/1000, ax, ay, az])
script += "".join(["\t%s\n" % line for line in script_lines])
script += "\ttextmsg(\"<< program end\")\n"
script += "end\n"
script += "prog()\n\n"

print script
# ---------- end movel ----------
send_4 = Button()
send_5 = Send(script=movel, send=send_4)
panel_23 = Panel(send_5)

# ----
panel_24 = Panel("move vertical")
movel_2 = PythonScript()  # -> script
# ---------- movel_2: Python ----------
from scriptcontext import sticky as st

robot = st["robot"]
tool_angle_axis = list(robot.tool.tcp_frame.point) + robot.tool.tcp_frame.axis_angle_vector
x, y, z, ax, ay, az = tool_angle_axis

script = "def prog():\n"
script += "\ttextmsg(\">> program start\")\n"
script += "\tset_tcp(p%s)\n" % str([x/1000., y/1000., z/1000, ax, ay, az])
script += "\tcurrent_pose = get_forward_kin()\n"
script += "\tmovel(p[current_pose[0], current_pose[1], current_pose[2], 0, 0, 0], a=0.1, v=0.1)\n"
script += "\ttextmsg(\"<< program end\")\n"
script += "end\n"
script += "prog()\n\n"

print script
# ---------- end movel_2 ----------
send_6 = Button()
send_7 = Send(script=movel_2, send=send_6)
panel_25 = Panel(send_7)

panel_26 = Panel("set digital out")
number = Slider(2, range=0..10)
value = BooleanToggle(False)
digital_out = PythonScript(number=number, value=value)  # -> script; inputs number: Int32, value: Boolean
# ---------- digital_out: Python ----------
script = "def prog():\n"
script += "\ttextmsg(\">> program start\")\n"
script += "\tset_digital_out(%i, %s)\n" % (int(number), str(value))
script += "\ttextmsg(\"<< program end\")\n"
script += "end\n"
script += "prog()\n\n"

print script
# ---------- end digital_out ----------
send_8 = Button()
send_9 = Send(script=digital_out, send=send_8)
panel_27 = Panel(send_9)

# ----
# move incremental in WCS
number_slider_5 = Slider(5, range=-10..10)
list_11 = ValueList({"xaxis", "yaxis", "zaxis"}, selected="zaxis")
movel_3 = PythonScript(step_size=number_slider_5, direction=list_11)  # -> script
# ---------- movel_3: Python ----------
from scriptcontext import sticky as st

robot = st["robot"]
tool_angle_axis = list(robot.tool.tcp_frame.point) + robot.tool.tcp_frame.axis_angle_vector
x, y, z, ax, ay, az = tool_angle_axis

script = "def prog():\n"
script += "\ttextmsg(\">> program start\")\n"
script += "\tset_tcp(p%s)\n" % str([x/1000., y/1000., z/1000, ax, ay, az])
script += "\tcurrent_pose = get_forward_kin()\n"


if direction == "xaxis":
    script += "\tmovel(p[current_pose[0] + %f, current_pose[1], current_pose[2], current_pose[3], current_pose[4], current_pose[5]], t=%f)\n" % (step_size/1000., step_size * 0.1)

elif direction == "yaxis":
    script += "\tmovel(p[current_pose[0], current_pose[1] + %f, current_pose[2], current_pose[3], current_pose[4], current_pose[5]], t=%f)\n" % (step_size/1000., step_size * 0.1)

else: # direction == "zaxis":
    script += "\tmovel(p[current_pose[0], current_pose[1], current_pose[2] + %f, current_pose[3], current_pose[4], current_pose[5]], t=%f)\n" % (step_size/1000., step_size * 0.1)

script += "\ttextmsg(\"<< program end\")\n"
script += "end\n"
script += "prog()\n\n"

print script
# ---------- end movel_3 ----------
send_10 = Button()
send_11 = Send(script=movel_3, send=send_10)
panel_28 = Panel(send_11)

# ----
# move incremental in TCS
get_current_pose = Button()
list_12 = ValueList({"xaxis", "yaxis", "zaxis"}, selected="zaxis")
movel_4 = PythonScript(get=get_current_pose, step_size=Slider(5, range=-10..10), direction=list_12)  # -> script; inputs get: list
# ---------- movel_4: Python ----------
from scriptcontext import sticky as st
from compas.geometry import Frame
from compas.geometry import Point, Vector
from ur_online_control.ur_direct import get_current_pose_cartesian

server_address = st["server_address"]
server_port = 30005
ur_ip = st["ur_ip"]
robot = st["robot"]
tool_angle_axis = list(robot.tool.tcp_frame.point) + robot.tool.tcp_frame.axis_angle_vector
print tool_angle_axis

guid = str(ghenv.Component.InstanceGuid)
pose_cartesian_key = "pose_cartesian" + guid

if get:
    st[pose_cartesian_key] = get_current_pose_cartesian(server_address, server_port, ur_ip, tool_angle_axis)

if pose_cartesian_key not in st:
    pose_cartesian = []
    script = ""
else:
    pose_cartesian = st[pose_cartesian_key]

    robot = st["robot"]
    tool_angle_axis = list(robot.tool.tcp_frame.point) + robot.tool.tcp_frame.axis_angle_vector
    x, y, z, ax, ay, az = tool_angle_axis
    
    script = "def prog():\n"
    script += "\ttextmsg(\">> program start\")\n"
    script += "\tset_tcp(p%s)\n" % str([x/1000., y/1000., z/1000, ax, ay, az])
    script += "\tcurrent_pose = get_forward_kin()\n"
    
#    frame = Frame.from_pose_axis_angle_vector(pose_cartesian)
    frame = Frame.from_axis_angle_vector([ax, ay, az])
    frame.point = [x, y, z]

    if direction == "xaxis":
        next_vector = Vector(*frame.xaxis) * step_size
    elif direction == "yaxis":
        next_vector = Vector(*frame.yaxis) * step_size
    else: # direction == "zaxis":
        next_vector = Vector(*frame.zaxis) * step_size
    
    x, y, z = next_vector
    script += "\tmovel(p[current_pose[0] + %f, current_pose[1] + %f, current_pose[2] + %f, current_pose[3], current_pose[4], current_pose[5]], t=%f)\n" % (x/1000., y/1000., z/1000., step_size * 0.1)
    
    script += "\ttextmsg(\"<< program end\")\n"
    script += "end\n"
    script += "prog()\n\n"
    
    print script
# ---------- end movel_4 ----------
send_12 = Button()
send_13 = Send(script=movel_4, send=send_12)
panel_29 = Panel(send_13)

# ---- group: BASE POINTS
area_2 = Area(Geometry=crv)  # -> Area, Centroid

# ---- group: BASE POINTS / midPt setout top
pt_11 = Point(area_2.Centroid)

# ---- group: BASE POINTS (continued)
pdecon_6 = Deconstruct(Point=pt_11)  # -> XComponent, YComponent, ZComponent

# ---- group: BASE POINTS / MID TOP SECTION
panel_30 = Panel(pdecon_6.ZComponent)
pt_12 = Point(pt_11)

# ---- group: BASE POINTS / TOP COLUMN
panel_31 = Panel("1900")

# ---- group: BASE POINTS (continued)
pt_13 = ConstructPoint(XCoordinate=pdecon_6.XComponent, YCoordinate=pdecon_6.YComponent, ZCoordinate=panel_31)

# ---- group: BASE POINTS / TOP COLUMN (continued)
pt_14 = Point(pt_13)

# ---- group: BASE POINTS / BOTTOM COLUMN
panel_32 = Panel("-210")

# ---- group: BASE POINTS (continued)
pt_15 = ConstructPoint(XCoordinate=pdecon_6.XComponent, YCoordinate=pdecon_6.YComponent, ZCoordinate=panel_32)

# ---- group: BASE POINTS / BOTTOM COLUMN (continued)
pt_16 = Point(pt_15)

# ----
addition_3 = Addition(A=layer_count, B=top_extra_layers)
Z_2 = UnitZ(Factor=1)
pt_17 = Point(pt_16)
_110_pipe_radius = Slider(55, range=0..100)
line = LineSDL(Start=pt_17, Direction=Z_2, Length=addition_3)

# ---- group: waterPipe
pipe = Pipe(Curve=line, Radius=_110_pipe_radius, Caps=0)

# ---- group: BASE POINTS / POINT 0
panel_33 = Panel("0")

# ---- group: BASE POINTS (continued)
pt_18 = ConstructPoint(XCoordinate=pdecon_6.XComponent, YCoordinate=pdecon_6.YComponent, ZCoordinate=panel_33)

# ---- group: BASE POINTS / POINT 0 (continued)
pt_19 = Point(pt_18)

# ---- group: BASE POINTS / TOP OF ORIGINAL COLUMN
panel_34 = Panel("1800")

# ---- group: BASE POINTS (continued)
pt_20 = ConstructPoint(XCoordinate=pdecon_6.XComponent, YCoordinate=pdecon_6.YComponent, ZCoordinate=panel_34)

# ---- group: BASE POINTS / TOP OF ORIGINAL COLUMN (continued)
pt_21 = Point(pt_20)

# ---- group: Send joint position directly to robot
idx_2 = Slider(0, range=0..100)
panel_35 = Panel("move joints")
joint_positions = Data(py_5)
item_8 = ListItem(List=joint_positions, Index=idx_2, Wrap=True)
list_13 = ValueList({"send all positions": 0, "send only one position": 1}, selected="send only one position")
filter_5 = StreamFilter(Gate=list_13, Stream0=joint_positions, Stream1=item_8)
movej = PythonScript(joint_positions=filter_5, velocity=Slider(153, range=0..200))  # -> script; inputs joint_positions: list
# ---------- movej: Python ----------
script_lines = []

for position in joint_positions:
    script_lines.append("movej(%s, v=%f)" % (str(position), velocity/1000.))


script = "def prog():\n"
script += "\ttextmsg(\">> program start\")\n"
script += "".join(["\t%s\n" % line for line in script_lines])
script += "\ttextmsg(\"<< program end\")\n"
script += "end\n"
script += "prog()\n\n"


print script

#script = ""
# ---------- end movej ----------
send_14 = Button()

# ----
send_15 = Send(script=movej, send=send_14)

# ---- group: Send joint position directly to robot (continued)
panel_36 = Panel(send_15)

# ==== cluster Tools
brep = Brep([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])
tool_id = ClusterInput()

# ---- group: extruder
yaxis_line = Curve(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)
xaxis_line = Curve(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)
test_geometry = Geometry(brep)
brep_2 = Brep(test_geometry)
mesh = Mesh(test_geometry)
tool = Tool(meshes=mesh, breps=brep_2, xline=xaxis_line, yline=yaxis_line)

# ---- group: measurement tool
measurement_tool_geo = Geometry([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])
mesh_2 = Mesh(measurement_tool_geo)
mjoin = MeshJoin(Meshes=mesh_2)
tool_2 = PythonScript(meshes=mjoin, brep=measurement_tool_geo)  # -> tool; inputs meshes: list, brep: list
# ---------- tool_2: Python ----------
from ur_online_control.ur.tools import MeasurementTool
from compas.datastructures import Mesh
from compas_rhino.helpers import mesh_from_guid


tool = MeasurementTool()
tool.model = [mesh_from_guid(Mesh, mesh) for mesh in meshes]
#tool.model_xyz = tool.model.xyz
tool.brep = brep
# ---------- end tool_2 ----------

# ----
tool_id_2 = Integer(tool_id)
filter = StreamFilter(Gate=tool_id_2, Stream1=tool_2, Stream2=tool)
py = PythonScript(tool=filter)  # -> tcp_frame, model
# ---------- py: Python ----------
from compas_ghpython import mesh_draw 

tcp_frame = tool.tcp_frame
model = map(mesh_draw, tool.model)
# ---------- end py ----------
tool_3 = Data(filter)
draw = PythonScript(frame=py.tcp_frame)  # -> G, C
# ---------- draw: Python ----------
import Rhino.Geometry as rg
from System.Drawing import Color

if not size:
    size = 100

if frame:
    plane = rg.Plane(rg.Point3d(*list(frame.point)), rg.Vector3d(*list(frame.xaxis)), rg.Vector3d(*list(frame.yaxis)))

    G = []
    G.append(rg.Line(plane.Origin, size * plane.XAxis))
    G.append(rg.Line(plane.Origin, size * plane.YAxis))
    G.append(rg.Line(plane.Origin, size * plane.ZAxis))
    
    C = []
    C.append(Color.FromArgb(255, 0, 0))
    C.append(Color.FromArgb(0, 255, 0))
    C.append(Color.FromArgb(0, 0, 255))
# ---------- end draw ----------
tool_4 = ClusterOutput(tool_3)
preview = CustomPreview(Geometry=draw.G, Shader=draw.C)
preview_2 = CustomPreview(Geometry=py.model, Shader=ColourSwatch(SwatchColor=RGB(141, 170, 178)))

# ==== cluster Send
script = ClusterInput()
send = ClusterInput()
send_2 = PythonScript(script=script, send=send)  # -> out
# ---------- send_2: Python ----------
import socket
from scriptcontext import sticky as st

ur_ip = st["ur_ip"]
ur_port = 30002

if send:
    s = socket.create_connection((ur_ip, ur_port), timeout=0.5) 
    s.send(script)
    s.close()
# ---------- end send_2 ----------
out = ClusterOutput(send_2)

# ==== cluster Tools_2

# ---- group: spray_gun
brep = Brep([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])
yaxis_line = Curve(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)
xaxis_line = Curve(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)
test_geometry = Geometry(brep)
mesh = Mesh(test_geometry)
brep_2 = Brep(test_geometry)
tool = Tool_2(meshes=mesh, breps=brep_2, xline=xaxis_line, yline=yaxis_line)

# ----
brep_3 = Brep([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])
tool_id = ClusterInput()
yaxis_line_2 = Curve(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)
xaxis_line_2 = Curve(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)

# ---- group: extruder
test_geometry_2 = Geometry(brep_3)
mesh_2 = Mesh(test_geometry_2)
brep_4 = Brep(test_geometry_2)
tool_2 = Tool_2(meshes=mesh_2, breps=brep_4, xline=xaxis_line_2, yline=yaxis_line_2)

# ----
tool_id_2 = Integer(tool_id)
tool_3 = PythonScript()  # -> tool
# ---------- tool_3: Python ----------
from compas_fab.fab.geometry import Frame
from compas_fab.fab.robots import Tool
import Rhino.Geometry as rg
import math

startPlane = rg.Plane.WorldXY
startPlane2 = rg.Plane.WorldXY
rg.Plane.Rotate(startPlane2, math.radians(180), rg.Vector3d.XAxis, rg.Point3d(0.0, 0.0, 0.0))

xform = rg.Transform.ChangeBasis(startPlane, startPlane2)

print startPlane
print startPlane2
Frame([0,0,0],[1,0,0],[0,-1,0])
#tcp_frame = Frame.worldXY()
tcp_frame = Frame([0,0,0],[1,0,0],[0,-1,0])

tool = Tool(tcp_frame)
tool.model = []
tool.breps = []
# ---------- end tool_3 ----------
filter = StreamFilter(Gate=tool_id_2, Stream0=tool_3, Stream1=tool, Stream2=tool_2)
py = PythonScript(tool=filter)  # -> tcp_frame, model
# ---------- py: Python ----------
tcp_frame = tool.tcp_frame
model = tool.model
# ---------- end py ----------
draw = PythonScript(frame=py.tcp_frame)  # -> G, C
# ---------- draw: Python ----------
import Rhino.Geometry as rg
from System.Drawing import Color

if not size:
    size = 100

if frame:
    
    plane = rg.Plane(rg.Point3d(*frame.point), rg.Vector3d(*frame.xaxis), rg.Vector3d(*frame.yaxis))

    G = []
    G.append(rg.Line(plane.Origin, size * plane.XAxis))
    G.append(rg.Line(plane.Origin, size * plane.YAxis))
    G.append(rg.Line(plane.Origin, size * plane.ZAxis))
    
    C = []
    C.append(Color.FromArgb(255, 0, 0))
    C.append(Color.FromArgb(0, 255, 0))
    C.append(Color.FromArgb(0, 0, 255))
# ---------- end draw ----------
tool_4 = Data(filter)
tool_5 = ClusterOutput(tool_4)
preview = CustomPreview(Geometry=draw.G, Shader=draw.C)
preview_2 = CustomPreview(Geometry=py.model, Shader=ColourSwatch(SwatchColor=RGB(141, 170, 178)))

# ==== cluster SortOnZ
A = ClusterInput()
curvepoint = PointOnCurve(A, parameter=0)
pdecon = Deconstruct(Point=curvepoint)  # -> XComponent, YComponent, ZComponent
sort = SortList(Keys=pdecon.ZComponent, ValuesA=A)  # -> Keys, ValuesA
A_2 = ClusterOutput(sort.ValuesA)

# ==== cluster Tool
breps = ClusterInput()
meshes = ClusterInput()
meshes_2 = Mesh(meshes)
mjoin = MeshJoin(Meshes=meshes_2)
xline = ClusterInput()
yline = ClusterInput()
tool = PythonScript(meshes=mjoin, breps=breps, xline=xline, yline=yline)  # -> tool; inputs meshes: list of Mesh, breps: list of Brep
# ---------- tool: Python ----------
import Rhino.Geometry as rg
from compas.geometry import Frame
from ur_online_control.ur.tool import Tool
from compas.datastructures import Mesh
from compas_rhino.helpers import mesh_from_guid

xaxis = rg.Line(xline.PointAtStart, xline.PointAtEnd)
yaxis = rg.Line(yline.PointAtStart, yline.PointAtEnd)

if xaxis.From.DistanceTo(yaxis.From) < 0.01:
    origin = xaxis.From
    xaxis = xaxis.Direction
    yaxis = yaxis.Direction
elif xaxis.To.DistanceTo(yaxis.To) < 0.01:
    origin = xaxis.To
    xaxis = -xaxis.Direction
    yaxis = -yaxis.Direction
elif xaxis.From.DistanceTo(yaxis.To) < 0.01:
    origin = xaxis.From
    xaxis = xaxis.Direction
    yaxis = -yaxis.Direction
elif xaxis.To.DistanceTo(yaxis.From) < 0.01:
    origin = xaxis.To
    xaxis = -xaxis.Direction
    yaxis = yaxis.Direction

xaxis.Unitize()
yaxis.Unitize()

print origin
print xaxis
print yaxis

tcp_frame = Frame(origin, xaxis, yaxis)

tool = Tool(tcp_frame)
tool.model = [mesh_from_guid(Mesh, mesh) for mesh in meshes]
#tool.model_xyz = tool.model.xyz
tool.breps = breps
# ---------- end tool ----------
tool_2 = ClusterOutput(tool)

# ==== cluster Tool_2
breps = ClusterInput()
meshes = ClusterInput()
meshes_2 = Mesh(meshes)
mjoin = MeshJoin(Meshes=meshes_2)
xline = ClusterInput()
yline = ClusterInput()
tool = PythonScript(meshes=mjoin, breps=breps, xline=xline, yline=yline)  # -> tool; inputs meshes: list of Mesh, breps: list of Brep
# ---------- tool: Python ----------
import Rhino.Geometry as rg
from compas_fab.fab.geometry import Frame
from compas_fab.fab.robots import Tool
from compas.datastructures.mesh import Mesh

xaxis = rg.Line(xline.PointAtStart, xline.PointAtEnd)
yaxis = rg.Line(yline.PointAtStart, yline.PointAtEnd)

if xaxis.From.DistanceTo(yaxis.From) < 0.01:
    origin = xaxis.From
    xaxis = xaxis.Direction
    yaxis = yaxis.Direction
elif xaxis.To.DistanceTo(yaxis.To) < 0.01:
    origin = xaxis.To
    xaxis = -xaxis.Direction
    yaxis = -yaxis.Direction
elif xaxis.From.DistanceTo(yaxis.To) < 0.01:
    origin = xaxis.From
    xaxis = xaxis.Direction
    yaxis = -yaxis.Direction
elif xaxis.To.DistanceTo(yaxis.From) < 0.01:
    origin = xaxis.To
    xaxis = -xaxis.Direction
    yaxis = yaxis.Direction

xaxis.Unitize()
yaxis.Unitize()

print origin
print xaxis
print yaxis

tcp_frame = Frame(origin, xaxis, yaxis)

tool = Tool(tcp_frame)
tool.model = meshes
tool.breps = breps
# ---------- end tool ----------
tool_2 = ClusterOutput(tool)
