# Grasshopper definition 181116_linear_axis_setup.gh (Grasshopper 1.0.7)

times_pattern_is_repeated = Slider(14, range=0..100)

python = GhPythonScript()  # -> flippedCrvs; inputs crvs: list
# ---------- python: Python ----------
__author__ = "nizta"
__version__ = "2018.08.19"

import rhinoscriptsyntax as rs


flippedCrvs = []
for i in range(len(crvs)-1):
    if crvs[i] not in flippedCrvs:
        if reverse_firstCrv_direction == 0:
            rs.ReverseCurve(crvs[i])
        flippedCrvs.append(crvs[i])
    checkDir = rs.CurveDirectionsMatch(crvs[i], crvs[i+1])
    if checkDir:
        if crvs[i+1] not in flippedCrvs:
            flippedCrvs.append(crvs[i+1])
    else:
        rs.ReverseCurve(crvs[i+1])
        if crvs[i+1] not in flippedCrvs:
            flippedCrvs.append(crvs[i+1])
# ---------- end python ----------
python_2 = GhPythonScript()  # -> flippedCrvs; inputs crvs: list
# ---------- python_2: Python ----------
__author__ = "nizta"
__version__ = "2018.08.19"

import rhinoscriptsyntax as rs


flippedCrvs = []
for i in range(len(crvs)-1):
    if crvs[i] not in flippedCrvs:
        flippedCrvs.append(crvs[i])
    checkDir = rs.CurveDirectionsMatch(crvs[i], crvs[i+1])
    if checkDir:
        if crvs[i+1] not in flippedCrvs:
            flippedCrvs.append(crvs[i+1])
    else:
        rs.ReverseCurve(crvs[i+1])
        if crvs[i+1] not in flippedCrvs:
            flippedCrvs.append(crvs[i+1])
# ---------- end python_2 ----------

# ---- group: Robot
# 0a
# Settings
# Check your IP address and set UR IP address
server_address = ValueList({"192.168.10.2", "192.168.10.11", "127.0.0.1"}, selected="192.168.10.2")
ur_ip = ValueList({"192.168.10.13", "192.168.10.11", "192.168.10.10", "127.0.0.1"}, selected="192.168.10.13")
server_port = Integer(30003)
globals = PythonScript(server_address=server_address, server_port=server_port, ur_ip=ur_ip)  # inputs server_port: Int32
# ---------- globals: Python ----------
from scriptcontext import sticky as st

st["server_address"] = server_address
st["server_port"] = server_port

st["ur_ip"] = ur_ip
# ---------- end globals ----------

# Check if UR is available
ping = Button()
py = PythonScript(ip=ur_ip, ping=ping)  # -> out
# ---------- py: Python ----------
from scriptcontext import sticky as st
from ur_online_control.communication import is_available


guid = str(ghenv.Component.InstanceGuid)
txt_key = "txt_" + guid
if txt_key not in st:
    st[txt_key] = ""

if ping:
    
    available = is_available(ip)
    
    if available:
        st[txt_key] = "%s is up!" % ip
    else:
        st[txt_key] = "%s is down!" % ip

print st[txt_key]
# ---------- end py ----------
panel = Panel(py)

# ----
enable_tie_support = BooleanToggle(False)
tie_offset = Slider(3, range=0..100)

# ---- group: Undulations style
list = ValueList({"Curve undulations original": 0, "Curve undulations grid": 1}, selected="Curve undulations grid")
number_slider = Slider(20, range=0..100)

# ---- group: Layers
layer_count = Slider(180, range=0..2000)
layer_selection_start = Slider(0, range=0..2000)
layer_selection_end = Slider(180, range=0..2000)
layer_height = Slider(10, range=0..100)

# ---- group: Rotation
dom = ConstructDomain(DomainStart=Slider(0, range=0..100), DomainEnd=Slider(0, range=0..100))

# ---- group: Curve offset
amount_not_affected_layers = Slider(10, range=0..120)
number_slider_2 = Slider(-65, range=-300..301)
dom_2 = ConstructDomain(DomainStart=number_slider_2, DomainEnd=Slider(300, range=0..500))

# ---- group: Rib offset
dom_3 = ConstructDomain(DomainStart=Slider(0, range=0..30), DomainEnd=Slider(25, range=0..100))

# ---- group: Div point offset
dom_4 = ConstructDomain(DomainStart=Slider(0, range=-30..30), DomainEnd=Slider(10, range=0..100))

# ---- group: Scale factor
number_slider_3 = Slider(0.32, range=0..2)
dom_5 = ConstructDomain(DomainStart=number_slider_3, DomainEnd=Slider(1, range=0..2))

# ----
short_edge = Curve([<curve referenced from the Rhino model> x8])
centroid = Point(<point referenced from the Rhino model>)

orientpt = Point(<point referenced from the Rhino model>)
multiplication = Multiplication(A=number_slider_3, B=1100)
move_to_pos = Button()
get_pos = Button()
# Disconnect planes_wcs input after moving axis!
# [to make sure robot base is updated within gh]
close = Button()
number_slider_4 = Slider(650, range=0..1000)
pos_z = Slider(850, range=0..1500)
python_3 = GhPythonScript(pattern_repetition=times_pattern_is_repeated, amount_of_steps=Slider(6, range=0..100))  # -> out, value_list; inputs pattern_repetition: Int32, amount_of_steps: Int32
# ---------- python_3: Python ----------
__author__ = "Joris"
__version__ = "2018.10.19"

value_list = []

max_value = 2

for i in range(int(pattern_repetition)):
    if i != 0 and i != 1 and i != 2:
        # calculate amount of steps based on i
        step_amount = amount_of_steps * i * 2
        print "Height of one pattern repetition", step_amount * 2, "mm"
        print i
        # calculate step size
        step_size = max_value / step_amount
        for j in range(int(2/step_size*2)):
            if step_size*j < 2:
                value = j * step_size
            else:
                value = max_value*2 - j*step_size
            value_list.append(value)
# ---------- end python_3 ----------
panel_2 = Panel(python_3.out)
offset = OffsetCurve(Curve=short_edge, Distance=Slider(-100, range=-100..100), Plane=PlaneXY(0, 0, 0), Corners=1)  # -> flatten(Curve)
offset_2 = OffsetCurve(Curve=short_edge, Distance=Slider(-50, range=-100..100), Plane=PlaneXY(0, 0, 0), Corners=1)  # -> flatten(Curve)

# ---- group: Robot
panel_3 = Panel("Unload libraries")
bang = Button()
unload = PythonScript(bang=bang)
# ---------- unload: Python ----------
from compas_ghpython import unload_modules

unload_modules("compas")
unload_modules("ur_online_control")
# ---------- end unload ----------

# ----
panel_4 = Panel(multiplication)

panel_5 = Panel("ORIGIN")

orient_pt = Point(orientpt)
linear_axis = GhPythonScript(move_to_pos=move_to_pos, pos_x=number_slider_4, pos_z=pos_z, get_pos=get_pos, close=close)  # -> out
# ---------- linear_axis: Python ----------
__author__ = "joburger"
__version__ = "2018.09.20"

from linear_axis import siemens as s

if move_to_pos:
    p = s.SiemensPortal(1)
    
    try:
         p.set_x(pos_x)
         p.set_z(pos_z)
         # p.wait_ext_axis()
    
    finally:
         p.close()

if close:
    try:
        p.close()
        p = s.SiemensPortal(1)
    finally:
        p.close()

#position_data = None

if get_pos:
    try:
        p = s.SiemensPortal(1)
        position_data = "NO DATA"
        position_data = "AXIS POSITION \nX:" + str(p.get_x()) + " Z:" + str(p.get_z())
        print "hmm"
    finally:
        p.close()

try:
    print position_data
except RuntimeError:
    print "Something did not work"
# ---------- end linear_axis ----------
layer_count_2 = Number(layer_count)

subtraction = Subtraction(A=number_slider_4, B="500")
subtraction_2 = Subtraction(A="750", B=pos_z)
neg = Negative(Value=subtraction)
neg_2 = Negative(Value=subtraction_2)
linear_axis_x_axis = Brep(<brep referenced from the Rhino model>)
linear_axis_plates = Brep([<brep referenced from the Rhino model> x2])
X = UnitX(Factor=neg)
Z = UnitZ(Factor=neg_2)
move = Move(Geometry=linear_axis_x_axis, Motion=X)  # -> Geometry, Transform
move_2 = Move(Geometry=[move.Geometry, linear_axis_plates], Motion=Z)  # -> Geometry, Transform
preview = CustomPreview(Geometry=move_2.Geometry, Shader=ColourSwatch(SwatchColor=RGBA(99, 94, 94, 96)))

# ---- group: Robot
# 1. load robot model
# 2. set tool
# 3. set basis
# 1. load robot model
# 2. set tool
# 3. set basis
list_2 = ValueList({"no_tool": 0, "measurement_tool": 1, "extruder": 2}, selected="extruder")
base = PythonScript(x=subtraction, z=subtraction_2)  # -> base_frame, base
# ---------- base: Python ----------
from compas.geometry import Frame

"""
origin = [0, 0, 0]
xaxis = [1, 0, 0]
yaxis = [0, 1, 0]


origin = [-313.92, -147.58, 13.79]
xaxis = [0.00000, -1.00000, 0.00000]
yaxis = [1.00000, 0.00000, 0.00000]
"""


linear_axis_x = x
linear_axis_z = z 
#axis    Y         Z                        X
origin = [155.98, -806.21 + linear_axis_z, 343.76 + linear_axis_x]
xaxis = [0, 0, 1]
yaxis = [1, 0, 0]

base_frame = Frame(list(origin), list(xaxis), list(yaxis))

base = "base = " + str(origin) + "\n" + "change in linear_axis_x = " + str(linear_axis_x) + "\n" + "change in linear_axis_z = " + str(linear_axis_z)
# ---------- end base ----------
tools = Tools(tool_id=list_2)
list_3 = ValueList({"UR5", "UR10"}, selected="UR10")
robot = PythonScript(model=list_3, tool=tools, base_frame=base.base_frame)  # -> robot
# ---------- robot: Python ----------
from ur_online_control.ur.ur10 import UR10
from ur_online_control.ur.ur5 import UR5
from scriptcontext import sticky as st

if model == "UR5":
    robot = UR5()
elif model == "UR10":
    robot = UR10()

if tool:
    robot.set_tool(tool)
if base_frame:
    robot.set_base(base_frame)

st["robot"] = robot
# ---------- end robot ----------

# ----
lng = ListLength(List=python_3.value_list)
list_4 = ValueList({"no_tool": 0, "spray_gun": 1, "extruder": 2}, selected="extruder")
range = Range(Domain=dom_3, Steps=layer_count_2)
range_2 = Range(Domain=Domain(0, 1), Steps=layer_count_2)
range_3 = Range(Domain=Domain(0, 1), Steps=layer_count_2)
range_4 = Range(Domain=Domain(0, 1), Steps=layer_count_2)
panel_6 = Panel(linear_axis)
panel_7 = Panel(lng)
number_slider_5 = Slider(125, range=0..200)
number_slider_6 = Slider(550, range=0..10000)
graph = GraphMapper(
    range_2,
    x0=0,
    x1=1,
    y0=0,
    y1=1,
    container_name="Bezier",
    cpx=[0, 0.5091154575, 0, 1],
    cpy=[0.5468001962, 0.4540976286, 0, 0])
graph_2 = GraphMapper(
    range_3,
    x0=0,
    x1=1,
    y0=0,
    y1=1,
    container_name="Bezier",
    cpx=[0, 0.126166299, 0.7330198288, 1],
    cpy=[0.7384505868, 0.2138258219, 0, 0.1716426611])
graph_3 = GraphMapper(range_4, x0=0, x1=1, y0=0, y1=1, container_name="Sine", Equation_px=[0, 0.2981877029], Equation_py=[0, 0.5608855486])
number_slider_7 = Slider(1, range=0..10)
number_slider_8 = Slider(1800, range=0..10000)
tools_2 = Tools_2(tool_id=list_4)
pt = Point(<point referenced from the Rhino model>)
panel_8 = Panel(base.base)
subtraction_3 = Subtraction(A=lng, B=layer_count_2)

curvepoint = PointOnCurve(short_edge, parameter=0.5)
end = EndPoints(Curve=short_edge)  # -> Start, End
line = LineSDL(Start=curvepoint, Direction=Vector(0, 0, 1), Length=Slider(42, range=0..100))
vec2pt = Vector2Pt(PointA=end.Start, PointB=end.End, Unitize=False)  # -> Vector, Length
unit = UnitVector(Vector=vec2pt.Vector)
vrot = Rotate(Vector=unit, Axis=line, Angle=degrees(Slider(90, range=0..1000)))
vdis = VectorDisplay(Anchor=curvepoint, Vector=vrot)
pl = ConstructPlane(Origin=curvepoint, XAxis=unit, YAxis=vrot)
number_slider_9 = Slider(5, range=0..1000)
dom_6 = ConstructDomain(DomainStart=expr("-x", number_slider_9), DomainEnd=number_slider_9)
dom_7 = ConstructDomain(DomainStart=expr("-x", Slider(0, range=0..1000)), DomainEnd=Slider(204, range=0..1000))
rectangle = Rectangle(Plane=pl, XSize=dom_6, YSize=dom_7, Radius=0)  # -> Rectangle, Length
vrot_2 = Rotate(Vector=vrot, Axis=unit, Angle=degrees(Slider(141, range=0..200)))
multiplication_2 = Multiplication(A=vrot_2, B=Slider(150, range=0..1000))
vdis_2 = VectorDisplay(Anchor=curvepoint, Vector=vrot_2)
extr = Extrude(Base=rectangle.Rectangle, Direction=multiplication_2)

rectangle_2 = Rectangle(Plane=pt, XSize=number_slider_6, YSize=number_slider_6, Radius=0)  # -> Rectangle, Length
cir = Circle(Plane=pt, Radius=number_slider_6)
bnd = Bounds(Numbers=graph)
bnd_2 = Bounds(Numbers=graph_2)
bnd_3 = Bounds(Numbers=graph_3)
series = Series(Start=0, Step=Slider(100, range=0..100), Count=Slider(18, range=0..50))
remap = RemapNumbers(Value=graph, Source=bnd, Target=dom_4)  # -> Mapped, Clipped
remap_2 = RemapNumbers(Value=graph_2, Source=bnd_2, Target=dom_5)  # -> Mapped, Clipped
dom_8 = ConstructDomain(DomainStart=expr("x+1", subtraction_3), DomainEnd=lng)
remap_3 = RemapNumbers(Value=graph_3, Source=bnd_3, Target=dom)  # -> Mapped, Clipped
subtraction_4 = Subtraction(A=layer_count_2, B=amount_not_affected_layers)
range_5 = Range(Domain=Domain(0, 1), Steps=subtraction_4)
graph_4 = GraphMapper(range_5, x0=0, x1=1, y0=0, y1=1, container_name="Sine", Equation_px=[0, 1], Equation_py=[1, 0])
bnd_4 = Bounds(Numbers=graph_4)
remap_4 = RemapNumbers(Value=graph_4, Source=bnd_4, Target=dom_2)  # -> Mapped, Clipped
Z_2 = UnitZ(Factor=series)
move_3 = Move(Geometry=cir, Motion=Z_2)  # -> Geometry, Transform
move_4 = Move(Geometry=rectangle_2.Rectangle, Motion=Z_2)  # -> Geometry, Transform
disc = Discontinuity(Curve=move_4.Geometry, Level=1)  # -> Points, Parameters
dup = DuplicateData(Data=number_slider_2, Number=amount_not_affected_layers, Order=True)
subset = SubList(List=python_3.value_list, Domain=dom_8, Wrap=True)  # -> List, Index
panel_9 = Panel(python_3.value_list)
divide = DivideCurve(Curve=move_3.Geometry, Count="16", Kinks=False)  # -> Points, Tangents, Parameters
xy = XYPlane(Origin=divide.Points)
pln = Plane(flatten(xy))
ins = InsertItems(List=remap_4.Mapped, Item=dup, Indices=subtraction_4, Wrap=False)
rotate = Rotate(Geometry=pln, Angle=-1.570796327, Plane=pln)  # -> Geometry, Transform

start = Button()
py_2 = PythonScript()  # -> path
# ---------- py_2: Python ----------
import sys
import os

ghComp = ghenv.Component
ghDoc = ghComp.OnPingDocument()

# the full path of the gh file
path = ghDoc.FilePath
# the directory of the gh file
path = os.path.dirname(path)

path = os.path.abspath(os.path.join(path, ".."))

print path
# ---------- end py_2 ----------
# 1
# Executing
panel_10 = Panel("Start communication server")
panel_11 = Panel(py_2)
server = PythonScript(path=panel_11, start=start)
# ---------- server: Python ----------
import os
import threading
from scriptcontext import sticky as st

server_address = st["server_address"]
server_port = st["server_port"]
ur_ip = st["ur_ip"]

"""
Change main!!!!
"""
main = os.path.join(path, "communication", "main.py")

if os.path.isfile(main):
        
    def myfunc():
        syscall = "python %s %s %s %s" % (main, server_address, server_port, ur_ip)
        os.system(syscall)
    
    if start:
        t = threading.Thread(target=myfunc)
        t.start()
# ---------- end server ----------

graph_5 = QuickGraph(python_3.value_list, SortOrder=0)

# ---- group: filament_loading_pt
pt_2 = Point(<point referenced from the Rhino model>)
xy_2 = XYPlane(Origin=pt_2)
rotate_2 = Rotate(Geometry=xy_2, Angle=-1.570796327, Plane=xy_2)  # -> Geometry, Transform

# ---- group: Define commands
safe_speed = Slider(25, range=0..300)
# 2
number_slider_10 = Slider(8, range=0..100)
speed = Slider(45, range=0..300)
planes_wcs = Plane(rotate.Geometry)
python_4 = PythonScript(planes_WCS=planes_wcs, dfillet=number_slider_10, speed=speed, safe_speed=safe_speed, safe_pt=rotate_2.Geometry)  # -> commands; inputs planes_WCS: list of Plane, speed: Int32, safe_pt: Plane
# ---------- python_4: Python ----------
import Rhino.Geometry as rg
from compas.geometry import Frame
from compas.geometry import Transformation
from compas_ghpython import xdraw_frame
from scriptcontext import sticky as st

robot = st["robot"]
buffer = 0.7

commands = []

# add safe_pt as a starting point
tcp_WCS_safe_pt = Frame(safe_pt.Origin, safe_pt.XAxis, safe_pt.YAxis)

tcp_RCS_safe_pt = robot.get_frame_in_RCS(tcp_WCS_safe_pt)
cmd_safe_pt = list(tcp_RCS_safe_pt.point) + tcp_RCS_safe_pt.axis_angle_vector + [safe_speed, 0]
print cmd_safe_pt
commands.append(cmd_safe_pt)

# TODO this must be optimized! matrix multiplication!

for i, plane_WCS in enumerate(planes_WCS):
    tcp_WCS = Frame(plane_WCS.Origin, plane_WCS.XAxis, plane_WCS.YAxis)
    if i == 0 or i == len(planes_WCS) - 1:
        radius = 0.
        
    else:
        # calculate blend radius
        prev, current, next = planes_WCS[i-1].Origin, planes_WCS[i].Origin, planes_WCS[i+1].Origin
        radius = min((prev - current).Length/2 * buffer, (next - current).Length/2 * buffer, dfillet)
    
    tcp_RCS = robot.get_frame_in_RCS(tcp_WCS)
    cmd = list(tcp_RCS.point) + tcp_RCS.axis_angle_vector + [speed, radius]
    commands.append(cmd)


# add safe_pt as an end point
commands.append(cmd_safe_pt)
print (commands)
# ---------- end python_4 ----------

# ---- group: test_pt
pt_3 = Point(<point referenced from the Rhino model>)
xy_3 = XYPlane(Origin=pt_3)
rotate_3 = Rotate(Geometry=xy_3, Angle=-1.570796327, Plane=xy_3)  # -> Geometry, Transform

# ----
python_5 = GhPythonScript(
    short_edge=short_edge,
    centroid=centroid,
    curve_offset=ins,
    rib_offset=range,
    layer_count=layer_count,
    layer_height=layer_height,
    div_pt_count=number_slider,
    div_pt_offset=remap.Mapped,
    scale_factor=remap_2.Clipped,
    rotation=remap_3.Mapped,
    layer_selection_start=layer_selection_start,
    layer_selection_end=layer_selection_end,
    offset_x=subset.List,
    undulations_type=list,
    tie_support=enable_tie_support,
    tie_support_offset=tie_offset)  # -> out, curves, polyline_full, polyline_layers, flat_pt_list, interp_layers, flat_polyline_list, pt_list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; inputs short_edge: list of Curve, centroid: Point3d, curve_offset: list, rib_offset: list, layer_count: Int32, div_pt_count: Int32, div_pt_offset: list, scale_factor: list, rotation: list, layer_selection_start: Int32, layer_selection_end: Int32, offset_x: list
# ---------- python_5: Python ----------
__author__ = "joburger"
__version__ = "2018.08.15"

import Rhino.Geometry as rg
import rhinoscriptsyntax as rs
import math


def flatten_list(array):
    return [item for sublist in array for item in sublist]

def curve_undulation_original(curve, div_pt_count, div_pt_offset):
    pt_list = []
    moved_pt_list = []
    test_list = []
    vect_tan_list = []
    div_params = rg.Curve.DivideByCount(curve, div_pt_count, True)
    
    for param in div_params:
        # create division points
        temp_div_pt = rg.Curve.PointAt(curve, param)
        pt_list.append(temp_div_pt)
        # get tangent vectors
        vect_tan = rg.Curve.TangentAt(curve, param)
        vect_tan_list.append(vect_tan)
    
    for i in range(len(pt_list)):
        # define vector1
        if i == 0 or i == len(pt_list)-1:
            vect1 = rg.Vector3d(0.0, 0.0, 0.0)
        else:
            vect1 = vect_tan_list[i]
            # vect2 = pt_list[i+1] - pt_list[i+2]
            rg.Vector3d.Rotate(vect1, math.radians(90), rg.Vector3d.ZAxis)
            # rg.Vector3d.Rotate(vect2, math.radians(90), rg.Vector3d.ZAxis) 
            # vect3 = vect1 + vect2
            rg.Vector3d.Unitize(vect1)
        
         # select half of points
        if i % 2 == 0:
            xform = rg.Transform.Translation(vect1 * div_pt_offset)
            pt_list[i].Transform(xform)
            moved_pt_list.append(pt_list[i])
        else:
            xform = rg.Transform.Translation(vect1 * -div_pt_offset)
            pt_list[i].Transform(xform)
            moved_pt_list.append(pt_list[i])
        
        
    return moved_pt_list

def curve_undulation_grid(curve, div_pt_count, div_pt_offset, offset_x):
    pt_list = []
    vect_tan_list = []
    moved_pts = []
    
    div_params = rg.Curve.DivideByCount(curve, div_pt_count, True)
    for param in div_params:
        # create division points
        temp_div_pt = rg.Curve.PointAt(curve, param)
        pt_list.append(temp_div_pt)
        # get tangent vectors
        vect_tan = rg.Curve.TangentAt(curve, param)
        vect_tan_list.append(vect_tan) 
    
    for i in range(len(pt_list)):
        if i < len(pt_list) / 2:
            distance_offset = i / (len(pt_list) / 2)
        else:
            distance_offset = (len(pt_list) - i) / (len(pt_list) / 2)
        if i == 0 or i == len(pt_list)-1:
            moved_pts.append(pt_list[i])
        else:
            vect_tan = rg.Vector3d(vect_tan_list[i])
            rg.Vector3d.Unitize(vect_tan)
            
            vect_perp = rg.Vector3d(vect_tan_list[i])
            rg.Vector3d.Rotate(vect_perp, math.radians(90), rg.Vector3d.ZAxis)
            rg.Vector3d.Unitize(vect_perp)
            
            if offset_x < 0.01:
#                print "Under 0.1"
                
                if i % 2 != 0:
                    xform = rg.Transform.Translation(vect_perp * -div_pt_offset * distance_offset)
                    pt_list[i].Transform(xform)
                    moved_pts.append(pt_list[i])
                else:
                    xform = rg.Transform.Translation(vect_perp * div_pt_offset * distance_offset)
                    pt_list[i].Transform(xform)
                    moved_pts.append(pt_list[i])
            else:
#                print "Normal layer"
                # select half of points
                if i % 2 != 0:
                    xform = rg.Transform.Translation(vect_perp * -div_pt_offset * distance_offset)
                    pt_list[i].Transform(xform)
                    
                    if i > 1:
                        measure_line = rg.Line(pt_list[i], pt_list[i-2])
                    else:
                        measure_line = rg.Line(pt_list[5], pt_list[3])
                    
                    pt1_left = pt_list[i] + vect_tan * (measure_line.Length * 0.25 * offset_x)
                    pt1_right = pt_list[i] + vect_tan * -(measure_line.Length * 0.25 * offset_x) 
                    pt1_perp = pt_list[i] + vect_perp * (div_pt_offset * offset_x * distance_offset) 
                    
                    moved_pts.append(pt1_right)
                    moved_pts.append(pt1_perp)
                    moved_pts.append(pt1_left)
                else:
                    pt2_perp = pt_list[i] - vect_perp * -div_pt_offset * distance_offset
                    pt2_perp_moved = pt2_perp - vect_perp * (div_pt_offset * offset_x) * distance_offset
                    moved_pts.append(pt2_perp_moved)
    return moved_pts


#delete later
c = []
d = []

n = len(short_edge)
vect_z = rg.Vector3d(0,0,1)

lines = []
curves = []
polylines = []

line1 = []
line2 = []
pt_list = []
curve_list = []

polyline_layers = []
polyline_pt_list = []

interp_layers = []
offset_layers = []

test_list = []
moved_centroid = []

extra_div_pts = []
extra_div_pt_lines = []

tie_support_list = []

for i in range(layer_selection_start, layer_selection_end):
    for j in range(n):
        pt1 = short_edge[j].PointAtEnd
        pt2 = short_edge[j-(n-1)].PointAtStart

        # get vector for pt1
        pt1_vect_ptA = short_edge[j].PointAtEnd
        pt1_vect_ptB = short_edge[j].PointAtStart
        pt1_vect = pt1_vect_ptA - pt1_vect_ptB
        pt1_vect_line = rg.Line(pt1_vect_ptA, pt1_vect_ptB)
        pt1_vect.Unitize()
        
        # get vector for pt2
        pt2_vect_ptA = short_edge[j-(n-1)].PointAtEnd
        pt2_vect_ptB = short_edge[j-(n-1)].PointAtStart
        pt2_vect = pt2_vect_ptA - pt2_vect_ptB
        pt2_vect_line = rg.Line(pt2_vect_ptA, pt2_vect_ptB)
        pt2_vect.Unitize()
        
        # create rib offset
        if rib_offset[i]*2 > pt1_vect_line.Length/2: 
            moved_pt1 = pt1 + -pt1_vect * pt1_vect_line.Length/2 * 0.9999
            moved_pt2 = pt2 + pt2_vect * pt2_vect_line.Length/2 * 0.9999
        else:
            if j % 2 == 0:
                moved_pt1 = pt1 + -pt1_vect * rib_offset[i]*2
                moved_pt2 = pt2 + pt2_vect * rib_offset[i]*2
            else:
                moved_pt1 = pt1 + -pt1_vect * rib_offset[i]*2
                moved_pt2 = pt2 + pt2_vect * rib_offset[i]*2
        
        # draw line
        a = rg.Line(pt1, pt2)
        
        # create midpoint and draw vector
        mid_pt = (pt1+pt2)/2
        vect = pt2-pt1
        vect_perp = rg.Vector3d.CrossProduct(vect_z, vect)
        vect_perp.Unitize()
        # move midpoint and create curve
        moved_mid = mid_pt + vect_perp * (curve_offset[i])
        curve = rg.Curve.CreateControlPointCurve([moved_pt1, moved_mid, moved_pt2], 2)
        curve_list.append(curve)
        
        # Create down translation
        move_vect = rg.Vector3d(0.0, 0.0, -layer_height*i)
        move_xform = rg.Transform.Translation(move_vect)
        
        # copy and move curve
        copy_curve = rg.Curve.Duplicate(curve)
        copy_curve.Transform(move_xform)
        
        # duplicate centroid (midpoint of column) and move
        copy_centroid = rg.Point3d(centroid)
        copy_centroid.Transform(move_xform)
        
        # scale curve
        scale_xform = rg.Transform.Scale(copy_centroid, scale_factor[i])
        copy_curve.Transform(scale_xform)
        
        # rotate curve
        rot_xform = rg.Transform.Rotation(math.radians(rotation[i]), copy_centroid) 
        copy_curve.Transform(rot_xform)
        
        # create straight lines and append
        line_pt1 = copy_curve.PointAtEnd
        line_pt2 = copy_curve.PointAtStart
        line1.append(line_pt1)
        line2.append(line_pt2)
        
        
        # create supporting outside lines
        support_pt1 = copy_curve.PointAtEnd
        support_pt2 = copy_curve.PointAtStart
        centroid_vect1 = copy_centroid - support_pt1
        centroid_vect2 = copy_centroid - support_pt2
        rg.Vector3d.Unitize(centroid_vect1)
        rg.Vector3d.Unitize(centroid_vect2)
        
        support_pt1 = support_pt1 - tie_support_offset * centroid_vect1
        support_pt2 = support_pt2 - tie_support_offset * centroid_vect2
        
        d.append(support_pt2)
        d.append(support_pt1)
        
        # create undulations
        if undulations_type == 0:
            undulated_divpts = curve_undulation_original(copy_curve, div_pt_count, div_pt_offset[i])
        else:
            undulated_divpts = curve_undulation_grid(copy_curve, div_pt_count, div_pt_offset[i], offset_x[i])
        
        
        
        # append to lists
        pt_list.append(undulated_divpts)
        polyline_pt_list.append(undulated_divpts)
        curves.append(copy_curve)
        
        test_list = undulated_divpts
        
    

    
    # flatten list and create polyline per layer
    flat_polyline_list = flatten_list(polyline_pt_list)
    polyline_layer = rg.PolylineCurve(flat_polyline_list + [flat_polyline_list[0]]) 
    
    interp_layer = rg.Curve.CreateInterpolatedCurve(flat_polyline_list + [flat_polyline_list[0]], 3)
    interp_layers.append(interp_layer)
    
    if tie_support:
            tie_support_list.append(d)
            tie_support_list.append(flat_polyline_list)

            d = []
    
    # measure angle
    flat_pt_list_angle = flatten_list(pt_list)
    
    no_pts_until_now = len(flat_pt_list_angle)
    pts_per_layer = len(flat_polyline_list)
    print no_pts_until_now, pts_per_layer
    
    if pts_per_layer == 2*n*div_pt_count+n:
        pt1_angle = flat_pt_list_angle[no_pts_until_now-div_pt_count-1]
        pt2_angle = flat_pt_list_angle[no_pts_until_now - pts_per_layer-div_pt_count-1]
        angle_line = rg.Line(pt1_angle, pt2_angle)
        c.append(angle_line)
    
    """
    if i in range(3,10):
        #print polyline_layer
        for j in range(len(flat_polyline_list)):
            pt1 = flat_polyline_list[j-2]
            pt2 = flat_polyline_list[j-1]
            pt3 = flat_polyline_list[j]
            
            vect_previous = pt1 - pt2
            vect_next = pt3 - pt2
            vect_res =  vect_previous + vect_next
            rg.Vector3d.Unitize(vect_res)
            #abs_vect_res = rg.Vector3d(abs(vect_res[0]), abs(vect_res[1]), abs(vect_res[2]))
            pt_moved = pt2 + vect_res * 2
            offset_layers.append(pt_moved)
    """
    polyline_layers.append(polyline_layer)
    polyline_pt_list = [] 
    
    
    # create straight lines
    for k in range(n):
        line = rg.Line(line1[k-1], line2[k])
        lines.append(line)
    line1 = []
    line2 = []
    


flat_pt_list = flatten_list(pt_list)
tie_support_list = flatten_list(tie_support_list)

polyline_full = rg.PolylineCurve(flat_pt_list)
curves = flatten_list([curves, lines])

a = extra_div_pts
b = extra_div_pt_lines


return_list = flatten_list(pt_list)
# ---------- end python_5 ----------
list_5 = ValueList({"Show curve gradient": "gradient", "Show invalid curves": "invalid"}, selected="Show invalid curves")
crv = Curve(python_5.c)
null = NullItem(Item=crv)  # -> NullFlags, InvalidFlags, Description
not = GateNot(A=null.InvalidFlags)

panel_12 = Panel("Get UR connected")
ur = PythonScript(send=start)
# ---------- ur: Python ----------
from scriptcontext import sticky as st
from ur_online_control.ur_driver import URDriver

server_address = st["server_address"]
server_port = st["server_port"]
ur_ip = st["ur_ip"]
robot = st["robot"]

tool_angle_axis = list(robot.tool.tcp_frame.point) + robot.tool.tcp_frame.axis_angle_vector
#robot.tool.tcp_frame.pose_axis_angle_vector
print tool_angle_axis

ur_driver = URDriver(server_address, server_port, tool_angle_axis, ur_ip, "UR")
print ur_driver

if send:
    ur_driver.send()
# ---------- end ur ----------

join = JoinCurves(Curves=python_5.curves, Preserve=False)
cull = CullPattern(List=crv, CullPattern=not)
sort_on_z = SortOnZ(A=join)
len = Length(Curve=cull)

disconnect = Button()
panel_13 = Panel("Get Grasshopper connected")
client = PythonScript(connect=start, disconnect=disconnect)  # -> connected, client
# ---------- client: Python ----------
import time
from scriptcontext import sticky as st
from Rhino.RhinoApp import WriteLine
from ur_online_control.grasshopper import GHClient, gh_component_timer
import time

server_address = st["server_address"]
server_port = st["server_port"]

guid = str(ghenv.Component.InstanceGuid)

client_key = "client_" + guid
run_key = "run_" + guid

if connect:
    if client_key not in st:
        st[client_key] = GHClient(server_address, server_port)
        client = st[client_key]
        client.connect_to_server()
        client.start()
        
    else:
        if st[client_key].running:
            WriteLine("Client is already connected.")
            
        else:
            st[client_key] = GHClient(server_address, server_port)
            client = st[client_key]
            client.connect_to_server()
            client.start()
"""
else:
    if client_key in st:
        # we need a timer to ask if we have something on the rcv queue
        client = st[client_key]
        #if client.running:
        #    #client.run_inner_while()
        #    gh_component_timer(ghenv, True, 1000)
"""

if disconnect:
    if client_key in st:
        client = st[client_key]
        if client.running:
            client.close()

if client_key in st:
    connected =  st[client_key].running
    client = st[client_key]
    print st[client_key].rcv_queue.qsize()
    print st[client_key].snd_queue.qsize()
else:
    connected = False
# ---------- end client ----------
panel_14 = Panel(client.connected)

curves = Curve(sort_on_z)
flat_pt_list = Point(python_5.flat_pt_list)
division = Division(A=layer_height, B=len)
polyline_full = Curve(python_5.polyline_full)
polyline_layers = Curve(python_5.polyline_layers)
interp_layers = Curve(python_5.interp_layers)
tie_support_pt_list = Point(python_5.tie_support_list)
item = ListItem(List=polyline_layers, Index=0, Wrap=True)

bang_2 = Button()
receive = PythonScript(client=client.client, bang=bang_2)  # -> qsize, client
# ---------- receive: Python ----------
from ur_online_control.communication.msg_identifiers import *
from ur_online_control.utilities.lists import flatten_list
from Rhino.RhinoApp import WriteLine


if client:
    if not client.ghenv:
        client.ghenv = ghenv
    qsize = client.rcv_queue.qsize()
# ---------- end receive ----------
panel_15 = Panel(receive.qsize)

acos = ArcCosine(Value=division)
move_linear_axis = BooleanToggle(True)

move_filament_loading_pt = BooleanToggle(True)
continue_fabrication = BooleanToggle(True)
# 3
panel_16 = Panel("Send a message")
send = Button()
commands = Data(python_4)
send_2 = PythonScript(
    client=client.client,
    send=send,
    continue_fabrication=continue_fabrication,
    commands=commands,
    move_filament_loading_pt=move_filament_loading_pt,
    move_linear_axis=move_linear_axis)  # -> out; inputs continue_fabrication: Int32, commands: list, move_filament_loading_pt: Boolean
# ---------- send_2: Python ----------
from ur_online_control.communication.msg_identifiers import *
from ur_online_control.utilities.lists import flatten_list

len_command = len(commands[0])
commands_flattened = flatten_list(commands)

print len(commands_flattened)/8, "commands"

if move_filament_loading_pt:
    print "Moving to safe point"
else:
    print "Skipping safe point"

if move_linear_axis:
    print "Moving the linear axis"
else:
    print "Skipping the linear axis"

#picking_pose_cmd, savety_pose_cmd = picking_commands

#print picking_pose_cmd
#print savety_pose_cmd

if send and client:
    client.send(MSG_INT, int(continue_fabrication))
 #   client.send(MSG_FLOAT_LIST, picking_pose_cmd)
 #   client.send(MSG_FLOAT_LIST, savety_pose_cmd)
    client.send(MSG_INT, len_command)
    client.send(MSG_FLOAT_LIST, commands_flattened)
    client.send(MSG_INT, int(move_filament_loading_pt))
    client.send(MSG_INT, int(move_linear_axis))
# ---------- end send_2 ----------

deg = Degrees(Radians=acos)
python_6 = GhPythonScript(deg=deg, show_curve_type=list_5, max_angle=Slider(30, range=0..100))  # -> out, a, b; inputs deg: list
# ---------- python_6: Python ----------
__author__ = "Joris"
__version__ = "2018.10.31"

import rhinoscriptsyntax as rs

a = []
highest = max(deg)

if show_curve_type == "gradient":
    for i in range(len(deg)):
        if deg[i] < 400:
            red = deg[i] * (255/highest)
            green = 0
            blue = 0
            colour = rs.CreateColor(red, green, blue)
            a.append(colour)
elif show_curve_type == "invalid":
    for i in range(len(deg)):
        if deg[i] > max_angle:
            red = 200
            green = 0
            blue = 0
        else:
            red = 0
            green = 175
            blue = 0
        colour = rs.CreateColor(red, green, blue)
        a.append(colour)
# ---------- end python_6 ----------
panel_17 = Panel(python_6.b)
panel_18 = Panel(python_6.a)
preview_2 = CustomPreview(Geometry=polyline_layers, Material=python_6.a)
panel_19 = Panel(deg)
panel_20 = Panel("""0, 100, 100
0, 230, 255""")
send_3 = PythonScript(client=receive.client)  # -> out
# ---------- send_3: Python ----------
from ur_online_control.communication.msg_identifiers import *
from ur_online_control.utilities.lists import flatten_list

if client:
    qsize = client.rcv_queue.qsize()
    if qsize:
        msg = client.rcv_queue.get()
        print msg
# ---------- end send_3 ----------
pline = PolyLine(Vertices=tie_support_pt_list, Closed=False)
panel_21 = Panel(send_2)
panel_22 = Panel(send_3)

# ---- group: Printing time
len_2 = Length(Curve=polyline_layers)
ma = MassAddition(Input=len_2)  # -> Result, PartialResults
python_7 = GhPythonScript(tot_length=ma.Result, density="1.3", extrusion_diameter="1.5", print_speed=Slider(40, range=0..100))  # -> simplify(out), a
# ---------- python_7: Python ----------
__author__ = "joburger"
__version__ = "2018.09.06"

import math

def calculate_weight(tot_length, density, extrusion_diameter, print_speed):
    area = math.pi * (extrusion_diameter/2) ** 2
    volume = tot_length * area
    weight = volume * density / 1000000
    print_time = tot_length / print_speed
    
    print "Area of extrusion:", area, "mm2"
    print "Total volume of print:", volume, " mm3"
    print "Total weight of print:", weight, " kg"
    print "Total printing time:", print_time, "sec /", round(print_time/60), "min /", round(print_time/3600, 2), "hr"

calculate_weight(tot_length, density, extrusion_diameter, print_speed)
# ---------- end python_7 ----------

# ----
loft = Loft(Curves=polyline_layers, Options={Adjust=False, Closed=False, LoftEnds=0, LoftSimp=0, LoftType=5, Rebuild=10, Refit=0.01})  # disabled
cap = CapHoles(Brep=loft)
sdiff = SolidDifference(BrepsA=cap)
preview_3 = CustomPreview(
    Geometry=sdiff,
    Material={diffuse=RGB(221, 160, 221), emission=RGB(66, 48, 66), shine=0.5, specular=RGB(255, 255, 255), transparency=0})  # disabled

# ---- group: Orient for printing
item_2 = ListItem(List=polyline_layers, Index=-1, Wrap=True)
area = Area(Geometry=item_2)  # -> Area, Centroid
xy_4 = XYPlane(Origin=area.Centroid)
xy_5 = XYPlane(Origin=orientpt)

# ----
# Direct UR control
get = Button()
get_2 = Button()
pose = PythonScript(get=get_2)  # -> pose_joints
# ---------- pose: Python ----------
from scriptcontext import sticky as st
from ur_online_control.ur_direct import get_current_pose_joints
from ur_online_control.ur.robot import BaseConfiguration

server_address = st["server_address"]
server_port = 30005
ur_ip = st["ur_ip"]
robot = st["robot"]
tool_angle_axis = list(robot.tool.tcp_frame.point) + robot.tool.tcp_frame.axis_angle_vector
print tool_angle_axis

guid = str(ghenv.Component.InstanceGuid)
pose_joints_key = "pose_joints" + guid


if get:
    st[pose_joints_key] = get_current_pose_joints(server_address, server_port, ur_ip, tool_angle_axis)
    
if pose_joints_key not in st:
    pose_joints = []
else:
    pose_joints = BaseConfiguration.from_joints(st[pose_joints_key])
# ---------- end pose ----------
pose_2 = PythonScript(get=get)  # -> pose_cartesian
# ---------- pose_2: Python ----------
from scriptcontext import sticky as st
from ur_online_control.ur_direct import get_current_pose_cartesian

server_address = st["server_address"]
server_port = 30005
ur_ip = st["ur_ip"]
robot = st["robot"]
tool_angle_axis = list(robot.tool.tcp_frame.point) + robot.tool.tcp_frame.axis_angle_vector
print tool_angle_axis

guid = str(ghenv.Component.InstanceGuid)
pose_cartesian_key = "pose_cartesian" + guid


if get:
    st[pose_cartesian_key] = get_current_pose_cartesian(server_address, server_port, ur_ip, tool_angle_axis)

if pose_cartesian_key not in st:
    pose_cartesian = []
else:
    pose_cartesian = st[pose_cartesian_key]
# ---------- end pose_2 ----------
stop = Button()
stop_2 = PythonScript(stop=stop)
# ---------- stop_2: Python ----------
from scriptcontext import sticky as st
from ur_online_control.ur_direct import stop as stop_robot

ur_ip = st["ur_ip"]

if stop:
    stop_robot(ur_ip)
# ---------- end stop_2 ----------
panel_23 = Panel(pose)
panel_24 = Panel(pose_2)

# ----
# Visualisation
robot_2 = Data(robot)
pose_joints = Data(pose)
planes_wcs_2 = Plane(planes_wcs)

vertical_pose = Number([-152.427, -780.635, 855.229, -1.1958, -1.22046, -1.20201])

# ---- group: Oriented curves
orient = Orient(Geometry=polyline_layers, Source=xy_4, Target=xy_5)  # -> Geometry, Transform

# ---- group: Oriented points
orient_2 = Orient(Geometry=flat_pt_list, Source=xy_4, Target=xy_5)  # -> Geometry, Transform

# ----
panel_25 = Panel(python_7.out)

# ---- group: Define plane in WCS, calculate joint positions
pt_4 = Point(Point(-283.8412985, -342.877576, 297.4189147))
select_configuration = Slider(1, range=0..7)
xy_6 = XYPlane(Origin=pt_4)
plane_wcs = Plane(xy_6)
inverse = PythonScript(robot=robot_2, plane_WCS=plane_wcs, idx=select_configuration)  # -> configuration; inputs plane_WCS: Plane, idx: Int32
# ---------- inverse: Python ----------
import Rhino.Geometry as rg
from compas.geometry import Frame, Transformation
from compas_ghpython import xdraw_frame

tcp_WCS = Frame(plane_WCS.Origin, plane_WCS.XAxis, plane_WCS.YAxis)

# transform frame to robot coordinate system
tcp_RCS = robot.get_frame_in_RCS(tcp_WCS)

# get the frame of tool0
tool0_RCS = robot.get_tool0_frame_from_tcp_frame(tcp_RCS)

# calculate solutions to frame
solutions = robot.inverse_kinematics(tool0_RCS)

if not len(solutions):
    q = [0,0,0,0,0,0]
else:
    idx = min(len(solutions) - 1, idx)
    q = solutions[idx]
    
print q

configuration = q
# ---------- end inverse ----------

# ----
xy_7 = XYPlane(Origin=orient_2.Geometry)
dom_9 = ConstructDomain(DomainStart=Slider(0, range=0..100), DomainEnd=Slider(700, range=0..1000))
pln_2 = Plane(flatten(xy_7))
back = Button()
reset = Button()

# ---- group: Calculate joint positions for path
# Add init joint states
joint_states = Data([-0.1728179112, -1.415058186, 1.813991282, -1.971940356, -1.571654205, -3.308720436])
init_configuration = Slider(0, range=0..7)
py_3 = PythonScript(robot=robot_2, planes_WCS=planes_wcs_2, configuration_idx=init_configuration, init_configuration=joint_states)  # -> configurations; inputs planes_WCS: list, configuration_idx: Int32, init_configuration: list
# ---------- py_3: Python ----------
from compas_ghpython import unload_modules
unload_modules('ur_online_control')
import Rhino.Geometry as rg
from compas.geometry import Frame 
from compas.geometry.xforms import Transformation
from compas_ghpython import xdraw_frame
from ur_online_control.ur.kinematics import calculate_configurations_for_path, format_joint_positions


# TODO this must be optimized! matrix multiplication!
frames_tool0_RCS = []
for plane_WCS in planes_WCS:
    tcp_WCS = Frame(plane_WCS.Origin, plane_WCS.XAxis, plane_WCS.YAxis)
    tcp_RCS = robot.get_frame_in_RCS(tcp_WCS)
    frames_tool0_RCS.append(robot.get_tool0_frame_from_tcp_frame(tcp_RCS))
    

#configurations = calculate_configurations_for_path(frames_tool0_RCS, robot.params, init_configuration)
configurations = calculate_configurations_for_path(frames_tool0_RCS, robot, init_configuration)
print configurations
configurations = configurations[min([configuration_idx, len(configurations) - 1])]

def format(numbers, k=4):
    #numbers = format_joint_positions(numbers)
    return "[" + ", ".join([("%." + str(k) + "f") % n for n in numbers]) + "]"
# ---------- end py_3 ----------
start_2 = Button()
stop_3 = Button()
step = Button()
counter = CountThroughList(L=py_3, start=start_2, stop=stop_3, step=step, step_back=back, reset=reset, interval=50)  # -> item; inputs L: list, start: Boolean, stop: Boolean, step_back: Boolean
# ---------- counter: Python ----------
from scriptcontext import sticky as st
from compas_ghpython import update_component


# store data in component
guid = str(ghenv.Component.InstanceGuid)
counter_key = "counter_" + guid
running_key = "running_" + guid

if counter_key not in st:
    st[counter_key] = 0

if running_key not in st:
    st[running_key] = False

if start:
    st[running_key] = True

if stop:
    st[running_key] = False

if step:
    if st[counter_key] < len(L) - 1:
        st[counter_key] += 1

if step_back:
    if st[counter_key] < len(L) - 1:
        st[counter_key] -= 1

if reset:
    st[counter_key] = 0

if len(L):
    item = L[st[counter_key]]

if st[running_key]:
    if st[counter_key] < len(L) - 1:
        st[counter_key] += 1
        update_component(ghenv, interval)
    else:
        st[counter_key] = 0
        st[running_key] = False
# ---------- end counter ----------

# ---- group: Calculate joint positions for path / Shows joint positions along path
flip = BooleanToggle(True)
l2t = PythonScript(L=py_3, flip=flip)  # -> T; inputs L: list, flip: Boolean
# ---------- l2t: Python ----------
from compas_ghpython import list_to_ghtree
L = [l.joint_values for l in L]

if flip:
    L = zip(*L)
T = list_to_ghtree(L)
# ---------- end l2t ----------
graph_6 = QuickGraph(l2t, SortOrder=0)

# ---- group: Define joint positions
base_2 = Slider(90.163, range=-360..360)
elbow = Slider(-102.857, range=-360..360)
wrist2 = Slider(0, range=-360..360)
wrist3 = Slider(0, range=-360..360)
shoulder = Slider(0, range=-360..360)
wrist1 = Slider(0, range=-360..360)
ur1_q1_q6 = Data([base_2, shoulder, elbow, wrist1, wrist2, wrist3])

# ----
rev = ReverseList(List=pln_2)
subset_2 = SubList(List=rev, Domain=dom_9, Wrap=True)  # -> List, Index
py_4 = GhPythonScript(joint_values=ur1_q1_q6)  # -> configuration; inputs joint_values: list
# ---------- py_4: Python ----------
import math
from ur_online_control.ur.robot import BaseConfiguration

configuration = BaseConfiguration.from_joints([math.radians(d) for d in joint_values])
# ---------- end py_4 ----------
pline_2 = PolyLine(Vertices=subset_2.List, Closed=False)

# ----
# Calculate basis
# Measure basis:
# 1. Clear the recorded poses
# 2. Move robot to origin and press "get pose"
# 3. Move robot to point in positive x-axis and press "get pose"
# 4. Move robot to an other point in your basis and press "get pose"
# (The farer away these positions are, the better)
# 
# 5. Alternatively change the order in the component calc base
# 6. Copy output into base component
list_6 = ValueList({"origin, pt on positive x-axis, pt in xy plane": 0, "origin, pt on positive y-axis, pt in xy plane": 1}, selected="origin, pt on positive x-axis, pt in xy plane")
clear = Button()
rec = PythonScript(msg=pose_2, rec=get, clear=clear)  # -> rec; inputs msg: list
# ---------- rec: Python ----------
from scriptcontext import sticky as st

guid = str(ghenv.Component.InstanceGuid)
recorded_key =  "recorded_" + guid
just_cleared_key = "just_cleared_" + guid

if recorded_key not in st:
    st[recorded_key] = []

if just_cleared_key not in st:
    st[just_cleared_key] = False

if clear:
    st[recorded_key] = []
    st[just_cleared_key] = True
else:
    if len(msg):
        if msg != [None] and not st[just_cleared_key] and rec:
            st[recorded_key].append(msg)
    st[just_cleared_key] = False
        


rec = st[recorded_key]

print rec
# ---------- end rec ----------
calc_base = PythonScript(poses=rec, input_type=list_6)  # -> out; inputs poses: list
# ---------- calc_base: Python ----------
import Rhino.Geometry as rg
import math


if len(poses) > 2:
    
    O = poses[0]
    P1 = poses[1]
    P2 = poses[2]
    
    if input_type == 0:
        # origin, pt on positive x-axis, pt in xy plane
        origin = rg.Point3d(O[0], O[1], O[2])
        pt_on_xaxis = rg.Point3d(P1[0], P1[1], P1[2])
        pt_in_xyplane = rg.Point3d(P2[0], P2[1], P2[2])
        
        xaxis = pt_on_xaxis - origin
        xaxis.Unitize()
        
        v = pt_in_xyplane - origin
        zaxis = rg.Vector3d.CrossProduct(v, xaxis)
        zaxis.Unitize()
        
        # zaxis must look up!
        if math.acos(rg.Vector3d.ZAxis * zaxis) > math.acos(rg.Vector3d.ZAxis * -zaxis):
            zaxis = -zaxis
        
        yaxis = rg.Vector3d.CrossProduct(zaxis, xaxis)
    
    elif input_type == 1:
        # origin, pt on positive y-axis, pt in xy plane
        origin = rg.Point3d(O[0], O[1], O[2])
        pt_on_yaxis = rg.Point3d(P1[0], P1[1], P1[2])
        pt_in_xyplane = rg.Point3d(P2[0], P2[1], P2[2])
        
        yaxis = pt_on_yaxis - origin
        yaxis.Unitize()
        
        v = pt_in_xyplane - origin
        zaxis = rg.Vector3d.CrossProduct(v, yaxis)
        zaxis.Unitize()
        
        # zaxis must look up!
        if math.acos(rg.Vector3d.ZAxis * zaxis) > math.acos(rg.Vector3d.ZAxis * -zaxis):
            zaxis = -zaxis
        
        xaxis = rg.Vector3d.CrossProduct(yaxis, zaxis)
        
        
    print "Copy the following into base component:"
    print " "
    print "origin = [%.2f, %.2f, %.2f]" % tuple(list(origin))
    print "xaxis = [%.5f, %.5f, %.5f]" % tuple(list(xaxis))
    print "yaxis = [%.5f, %.5f, %.5f]" % tuple(list(yaxis))
    

#print rg.Vector3d.CrossProduct(rg.Vector3d.YAxis, rg.Vector3d.ZAxis)
#print rg.Vector3d.CrossProduct(rg.Vector3d.ZAxis, rg.Vector3d.XAxis)
# ---------- end calc_base ----------
panel_26 = Panel(rec)
panel_27 = Panel(calc_base)

# ---- group: Visualise / robot model brep
py_5 = PythonScript(model=list_3)  # -> n
# ---------- py_5: Python ----------
if model == "UR5":
    n = 0
if model == "UR10":
    n = 1

print n
# ---------- end py_5 ----------
ur10_brep = UR10Brep([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])
ur5_brep = UR5Brep([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])
show_brep = BooleanToggle(False)
filter = StreamFilter(Gate=py_5, Stream0=ur5_brep, Stream1=ur10_brep)

# ---- group: Visualise
list_7 = ValueList({"0 forward, from angles": 0, "1 inverse, from one plane": 1, "2 inverse, from multiple planes": 2, "3 forward, from robot": 3}, selected="2 inverse, from multiple planes")
filter_2 = StreamFilter(Gate=list_7, Stream0=py_4, Stream1=inverse, Stream2=counter, Stream3=pose_joints)
configuration = Panel(filter_2)
mesh = Mesh(filter)
draw = PythonScript(robot=robot_2, configuration=filter_2, mesh=mesh, brep=filter, show_brep=show_brep)  # -> meshes, tool0_plane, tcp_plane, robot_brep; inputs mesh: list, brep: list
# ---------- draw: Python ----------
from compas_ghpython import unload_modules
unload_modules("ur_online_control")

from compas_ghpython import xdraw_frame
from compas_ghpython import mesh_draw
from compas_ghpython.geometry.xforms import xform_from_transformation
from compas.geometry import Frame
from compas.geometry.xforms import Transformation
from ur_online_control.ur.robot import BaseConfiguration

import Rhino.Geometry as rg
import Rhino

def mesh_update_vertices(mesh, vertices):
    for i in range(len(vertices)):
        mesh.vertex[i].update({'x': vertices[i][0], 'y': vertices[i][1], 'z': vertices[i][2]})

if configuration:
    #print configuration
    #q = BaseConfiguration.from_joints(configuration)
    q = configuration
    print q
    print q.joint_values
    
    print robot.get_forward_transformations(q)
    R0, R1, R2, R3, R4, R5 = robot.get_forward_transformations(q)
    
    tool0_frame2 = robot.tool0_frame.transformed(R5)
    tcp_frame2 = Frame.from_transformation(Transformation.from_frame(tool0_frame2) * robot.transformation_tool0_tcp)
    
    print robot.transformation_tool0_tcp
    print robot.transformation_tcp_tool0
    print robot.transformation_tool0_tcp * robot.transformation_tcp_tool0
    print tcp_frame2
    tcp_frame2 = Frame.from_transformation(Transformation.from_frame(tool0_frame2) * robot.transformation_tcp_tool0)
    print tcp_frame2
    
    tool0_frame, tcp_frame = robot.get_transformed_tool_frames(R5)
    
    tool0_frame = tool0_frame2
    tcp_frame = tcp_frame2
    
    m0, m1, m2, m3, m4, m5 = mesh
    for i in range(6):
        exec("R%drg = xform_from_transformation(R%d)" % (i, i))
        exec("m%d.Transform(R%drg)" % (i, i))
    meshes = [m0, m1, m2, m3, m4, m5]
    print meshes
    mt = robot.tool.get_transformed_model(Transformation.from_frame(tool0_frame))
    
    if mt:
        meshes.extend(map(mesh_draw, mt))
    
    """
    m0, m1, m2, m3, m4, m5, tool0_frame, tcp_frame = robot.get_transformed_model(q)
    mt = robot.get_transformed_tool_model(tcp_frame)
    
    meshes = []
    meshes.append(mesh_draw(m0))
    meshes.append(mesh_draw(m1))
    meshes.append(mesh_draw(m2))
    meshes.append(mesh_draw(m3))
    meshes.append(mesh_draw(m4))
    meshes.append(mesh_draw(m5))
    if mt:
        meshes.append(mesh_draw(mt))
    
    """
    
    tool0_plane = xdraw_frame(tool0_frame)
    tcp_plane = xdraw_frame(tcp_frame)
    
    if show_brep:
        
        b0, b1, b2, b3, b4, b5 = brep
        
        b0.Transform(R0rg)
        b1.Transform(R1rg)
        b2.Transform(R2rg)
        b3.Transform(R3rg)
        b4.Transform(R4rg)
        b5.Transform(R5rg)
        
        robot_brep = [b0, b1, b2, b3, b4, b5]
# ---------- end draw ----------
tool0_plane = Plane(draw.tool0_plane)
tcp_plane = Plane(draw.tcp_plane)
robot_brep = Brep(draw.robot_brep)
draw_2 = RepresentPlaneAsLines(plane=tcp_plane, size=100)  # -> G, C
# ---------- draw_2: Python ----------
import Rhino.Geometry as rg
from System.Drawing import Color

if plane:

    G = []
    G.append(rg.Line(plane.Origin, size * plane.XAxis))
    G.append(rg.Line(plane.Origin, size * plane.YAxis))
    G.append(rg.Line(plane.Origin, size * plane.ZAxis))
    
    C = []
    C.append(Color.FromArgb(255, 0, 0))
    C.append(Color.FromArgb(0, 255, 0))
    C.append(Color.FromArgb(0, 0, 255))
# ---------- end draw_2 ----------
preview_4 = CustomPreview(Geometry=draw_2.G, Shader=draw_2.C)
preview_5 = CustomPreview(Geometry=draw.meshes, Shader=ColourSwatch(SwatchColor=RGBA(99, 94, 94, 96)))

# ---- group: Send joint position directly to robot
panel_28 = Panel("move cartesian")
idx = Slider(0, range=0..100)
commands_2 = Data(python_4)
item_3 = ListItem(List=commands_2, Index=idx, Wrap=True)
list_8 = ValueList({"send all positions": 0, "send only one position": 1}, selected="send only one position")
filter_3 = StreamFilter(Gate=list_8, Stream0=commands_2, Stream1=item_3)
movel = PythonScript(commands=filter_3, velocity=Slider(100, range=0..100))  # -> script; inputs commands: list
# ---------- movel: Python ----------
from scriptcontext import sticky as st

script_lines = []
for cmd in commands:
    #q, a=1.4, v=1.05, t=0, r=0)
    x, y, z, ax, ay, az, speed, radius = cmd
    script_lines.append("movel(p%s, v=%f, r=%f)" % (str([x/1000., y/1000., z/1000, ax, ay, az]), speed/1000., radius/1000.))

robot = st["robot"]
tool_angle_axis = list(robot.tool.tcp_frame.point) + robot.tool.tcp_frame.axis_angle_vector
x, y, z, ax, ay, az = tool_angle_axis

script = "def prog():\n"
script += "\ttextmsg(\">> program start\")\n"
script += "\tset_tcp(p%s)\n" % str([x/1000., y/1000., z/1000, ax, ay, az])
script += "".join(["\t%s\n" % line for line in script_lines])
script += "\ttextmsg(\"<< program end\")\n"
script += "end\n"
script += "prog()\n\n"

print script
# ---------- end movel ----------
send_4 = Button()
send_5 = Send(script=movel, send=send_4)
panel_29 = Panel(send_5)

# ----
panel_30 = Panel("move vertical")
movel_2 = PythonScript()  # -> script
# ---------- movel_2: Python ----------
from scriptcontext import sticky as st

robot = st["robot"]
tool_angle_axis = list(robot.tool.tcp_frame.point) + robot.tool.tcp_frame.axis_angle_vector
x, y, z, ax, ay, az = tool_angle_axis

script = "def prog():\n"
script += "\ttextmsg(\">> program start\")\n"
script += "\tset_tcp(p%s)\n" % str([x/1000., y/1000., z/1000, ax, ay, az])
script += "\tcurrent_pose = get_forward_kin()\n"
script += "\tmovel(p[current_pose[0], current_pose[1], current_pose[2], 0, 0, 0], a=0.1, v=0.1)\n"
script += "\ttextmsg(\"<< program end\")\n"
script += "end\n"
script += "prog()\n\n"

print script
# ---------- end movel_2 ----------
send_6 = Button()
send_7 = Send(script=movel_2, send=send_6)
panel_31 = Panel(send_7)

panel_32 = Panel("set digital out")
number = Slider(2, range=0..10)
value = BooleanToggle(False)
digital_out = PythonScript(number=number, value=value)  # -> script; inputs number: Int32, value: Boolean
# ---------- digital_out: Python ----------
script = "def prog():\n"
script += "\ttextmsg(\">> program start\")\n"
script += "\tset_digital_out(%i, %s)\n" % (int(number), str(value))
script += "\ttextmsg(\"<< program end\")\n"
script += "end\n"
script += "prog()\n\n"

print script
# ---------- end digital_out ----------
send_8 = Button()
send_9 = Send(script=digital_out, send=send_8)
panel_33 = Panel(send_9)

# ----
# move incremental in WCS
number_slider_11 = Slider(5, range=-10..10)
list_9 = ValueList({"xaxis", "yaxis", "zaxis"}, selected="zaxis")
movel_3 = PythonScript(step_size=number_slider_11, direction=list_9)  # -> script
# ---------- movel_3: Python ----------
from scriptcontext import sticky as st

robot = st["robot"]
tool_angle_axis = list(robot.tool.tcp_frame.point) + robot.tool.tcp_frame.axis_angle_vector
x, y, z, ax, ay, az = tool_angle_axis

script = "def prog():\n"
script += "\ttextmsg(\">> program start\")\n"
script += "\tset_tcp(p%s)\n" % str([x/1000., y/1000., z/1000, ax, ay, az])
script += "\tcurrent_pose = get_forward_kin()\n"


if direction == "xaxis":
    script += "\tmovel(p[current_pose[0] + %f, current_pose[1], current_pose[2], current_pose[3], current_pose[4], current_pose[5]], t=%f)\n" % (step_size/1000., step_size * 0.1)

elif direction == "yaxis":
    script += "\tmovel(p[current_pose[0], current_pose[1] + %f, current_pose[2], current_pose[3], current_pose[4], current_pose[5]], t=%f)\n" % (step_size/1000., step_size * 0.1)

else: # direction == "zaxis":
    script += "\tmovel(p[current_pose[0], current_pose[1], current_pose[2] + %f, current_pose[3], current_pose[4], current_pose[5]], t=%f)\n" % (step_size/1000., step_size * 0.1)

script += "\ttextmsg(\"<< program end\")\n"
script += "end\n"
script += "prog()\n\n"

print script
# ---------- end movel_3 ----------
send_10 = Button()
send_11 = Send(script=movel_3, send=send_10)
panel_34 = Panel(send_11)

# ----
# move incremental in TCS
get_current_pose = Button()
list_10 = ValueList({"xaxis", "yaxis", "zaxis"}, selected="zaxis")
movel_4 = PythonScript(get=get_current_pose, step_size=Slider(5, range=-10..10), direction=list_10)  # -> script; inputs get: list
# ---------- movel_4: Python ----------
from scriptcontext import sticky as st
from compas.geometry import Frame
from compas.geometry import Point, Vector
from ur_online_control.ur_direct import get_current_pose_cartesian

server_address = st["server_address"]
server_port = 30005
ur_ip = st["ur_ip"]
robot = st["robot"]
tool_angle_axis = list(robot.tool.tcp_frame.point) + robot.tool.tcp_frame.axis_angle_vector
print tool_angle_axis

guid = str(ghenv.Component.InstanceGuid)
pose_cartesian_key = "pose_cartesian" + guid

if get:
    st[pose_cartesian_key] = get_current_pose_cartesian(server_address, server_port, ur_ip, tool_angle_axis)

if pose_cartesian_key not in st:
    pose_cartesian = []
    script = ""
else:
    pose_cartesian = st[pose_cartesian_key]

    robot = st["robot"]
    tool_angle_axis = list(robot.tool.tcp_frame.point) + robot.tool.tcp_frame.axis_angle_vector
    x, y, z, ax, ay, az = tool_angle_axis
    
    script = "def prog():\n"
    script += "\ttextmsg(\">> program start\")\n"
    script += "\tset_tcp(p%s)\n" % str([x/1000., y/1000., z/1000, ax, ay, az])
    script += "\tcurrent_pose = get_forward_kin()\n"
    
#    frame = Frame.from_pose_axis_angle_vector(pose_cartesian)
    frame = Frame.from_axis_angle_vector([ax, ay, az])
    frame.point = [x, y, z]

    if direction == "xaxis":
        next_vector = Vector(*frame.xaxis) * step_size
    elif direction == "yaxis":
        next_vector = Vector(*frame.yaxis) * step_size
    else: # direction == "zaxis":
        next_vector = Vector(*frame.zaxis) * step_size
    
    x, y, z = next_vector
    script += "\tmovel(p[current_pose[0] + %f, current_pose[1] + %f, current_pose[2] + %f, current_pose[3], current_pose[4], current_pose[5]], t=%f)\n" % (x/1000., y/1000., z/1000., step_size * 0.1)
    
    script += "\ttextmsg(\"<< program end\")\n"
    script += "end\n"
    script += "prog()\n\n"
    
    print script
# ---------- end movel_4 ----------
send_12 = Button()
send_13 = Send(script=movel_4, send=send_12)
panel_35 = Panel(send_13)

# ---- group: Send joint position directly to robot
idx_2 = Slider(0, range=0..100)
panel_36 = Panel("move joints")
joint_positions = Data(py_3)
item_4 = ListItem(List=joint_positions, Index=idx_2, Wrap=True)
list_11 = ValueList({"send all positions": 0, "send only one position": 1}, selected="send only one position")
filter_4 = StreamFilter(Gate=list_11, Stream0=joint_positions, Stream1=item_4)
movej = PythonScript(joint_positions=filter_4, velocity=Slider(153, range=0..200))  # -> script; inputs joint_positions: list
# ---------- movej: Python ----------
script_lines = []

for position in joint_positions:
    script_lines.append("movej(%s, v=%f)" % (str(position), velocity/1000.))


script = "def prog():\n"
script += "\ttextmsg(\">> program start\")\n"
script += "".join(["\t%s\n" % line for line in script_lines])
script += "\ttextmsg(\"<< program end\")\n"
script += "end\n"
script += "prog()\n\n"


print script

#script = ""
# ---------- end movej ----------
send_14 = Button()

# ----
send_15 = Send(script=movej, send=send_14)

# ---- group: Send joint position directly to robot (continued)
panel_37 = Panel(send_15)

# ==== cluster Tools
brep = Brep([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])
tool_id = ClusterInput()

# ---- group: extruder
yaxis_line = Curve(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)
xaxis_line = Curve(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)
test_geometry = Geometry(brep)
brep_2 = Brep(test_geometry)
mesh = Mesh(test_geometry)
tool = Tool(meshes=mesh, breps=brep_2, xline=xaxis_line, yline=yaxis_line)

# ---- group: measurement tool
measurement_tool_geo = Geometry([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])
mesh_2 = Mesh(measurement_tool_geo)
mjoin = MeshJoin(Meshes=mesh_2)
tool_2 = PythonScript(meshes=mjoin, brep=measurement_tool_geo)  # -> tool; inputs meshes: list, brep: list
# ---------- tool_2: Python ----------
from ur_online_control.ur.tools import MeasurementTool
from compas.datastructures import Mesh
from compas_rhino.helpers import mesh_from_guid


tool = MeasurementTool()
tool.model = [mesh_from_guid(Mesh, mesh) for mesh in meshes]
#tool.model_xyz = tool.model.xyz
tool.brep = brep
# ---------- end tool_2 ----------

# ----
tool_id_2 = Integer(tool_id)
filter = StreamFilter(Gate=tool_id_2, Stream1=tool_2, Stream2=tool)
py = PythonScript(tool=filter)  # -> tcp_frame, model
# ---------- py: Python ----------
from compas_ghpython import mesh_draw 

tcp_frame = tool.tcp_frame
model = map(mesh_draw, tool.model)
# ---------- end py ----------
tool_3 = Data(filter)
draw = PythonScript(frame=py.tcp_frame)  # -> G, C
# ---------- draw: Python ----------
import Rhino.Geometry as rg
from System.Drawing import Color

if not size:
    size = 100

if frame:
    plane = rg.Plane(rg.Point3d(*list(frame.point)), rg.Vector3d(*list(frame.xaxis)), rg.Vector3d(*list(frame.yaxis)))

    G = []
    G.append(rg.Line(plane.Origin, size * plane.XAxis))
    G.append(rg.Line(plane.Origin, size * plane.YAxis))
    G.append(rg.Line(plane.Origin, size * plane.ZAxis))
    
    C = []
    C.append(Color.FromArgb(255, 0, 0))
    C.append(Color.FromArgb(0, 255, 0))
    C.append(Color.FromArgb(0, 0, 255))
# ---------- end draw ----------
tool_4 = ClusterOutput(tool_3)
preview = CustomPreview(Geometry=draw.G, Shader=draw.C)
preview_2 = CustomPreview(Geometry=py.model, Shader=ColourSwatch(SwatchColor=RGB(141, 170, 178)))

# ==== cluster Send
script = ClusterInput()
send = ClusterInput()
send_2 = PythonScript(script=script, send=send)  # -> out
# ---------- send_2: Python ----------
import socket
from scriptcontext import sticky as st

ur_ip = st["ur_ip"]
ur_port = 30002

if send:
    s = socket.create_connection((ur_ip, ur_port), timeout=0.5) 
    s.send(script)
    s.close()
# ---------- end send_2 ----------
out = ClusterOutput(send_2)

# ==== cluster Tools_2

# ---- group: spray_gun
brep = Brep([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])
yaxis_line = Curve(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)
xaxis_line = Curve(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)
test_geometry = Geometry(brep)
mesh = Mesh(test_geometry)
brep_2 = Brep(test_geometry)
tool = Tool_2(meshes=mesh, breps=brep_2, xline=xaxis_line, yline=yaxis_line)

# ----
brep_3 = Brep([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])
tool_id = ClusterInput()
yaxis_line_2 = Curve(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)
xaxis_line_2 = Curve(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)

# ---- group: extruder
test_geometry_2 = Geometry(brep_3)
mesh_2 = Mesh(test_geometry_2)
brep_4 = Brep(test_geometry_2)
tool_2 = Tool_2(meshes=mesh_2, breps=brep_4, xline=xaxis_line_2, yline=yaxis_line_2)

# ----
tool_id_2 = Integer(tool_id)
tool_3 = PythonScript()  # -> tool
# ---------- tool_3: Python ----------
from compas_fab.fab.geometry import Frame
from compas_fab.fab.robots import Tool
import Rhino.Geometry as rg
import math

startPlane = rg.Plane.WorldXY
startPlane2 = rg.Plane.WorldXY
rg.Plane.Rotate(startPlane2, math.radians(180), rg.Vector3d.XAxis, rg.Point3d(0.0, 0.0, 0.0))

xform = rg.Transform.ChangeBasis(startPlane, startPlane2)

print startPlane
print startPlane2
Frame([0,0,0],[1,0,0],[0,-1,0])
#tcp_frame = Frame.worldXY()
tcp_frame = Frame([0,0,0],[1,0,0],[0,-1,0])

tool = Tool(tcp_frame)
tool.model = []
tool.breps = []
# ---------- end tool_3 ----------
filter = StreamFilter(Gate=tool_id_2, Stream0=tool_3, Stream1=tool, Stream2=tool_2)
py = PythonScript(tool=filter)  # -> tcp_frame, model
# ---------- py: Python ----------
tcp_frame = tool.tcp_frame
model = tool.model
# ---------- end py ----------
draw = PythonScript(frame=py.tcp_frame)  # -> G, C
# ---------- draw: Python ----------
import Rhino.Geometry as rg
from System.Drawing import Color

if not size:
    size = 100

if frame:
    
    plane = rg.Plane(rg.Point3d(*frame.point), rg.Vector3d(*frame.xaxis), rg.Vector3d(*frame.yaxis))

    G = []
    G.append(rg.Line(plane.Origin, size * plane.XAxis))
    G.append(rg.Line(plane.Origin, size * plane.YAxis))
    G.append(rg.Line(plane.Origin, size * plane.ZAxis))
    
    C = []
    C.append(Color.FromArgb(255, 0, 0))
    C.append(Color.FromArgb(0, 255, 0))
    C.append(Color.FromArgb(0, 0, 255))
# ---------- end draw ----------
tool_4 = Data(filter)
tool_5 = ClusterOutput(tool_4)
preview = CustomPreview(Geometry=draw.G, Shader=draw.C)
preview_2 = CustomPreview(Geometry=py.model, Shader=ColourSwatch(SwatchColor=RGB(141, 170, 178)))

# ==== cluster SortOnZ
A = ClusterInput()
curvepoint = PointOnCurve(A, parameter=0)
pdecon = Deconstruct(Point=curvepoint)  # -> XComponent, YComponent, ZComponent
sort = SortList(Keys=pdecon.ZComponent, ValuesA=A)  # -> Keys, ValuesA
A_2 = ClusterOutput(sort.ValuesA)

# ==== cluster Tool
breps = ClusterInput()
meshes = ClusterInput()
meshes_2 = Mesh(meshes)
mjoin = MeshJoin(Meshes=meshes_2)
xline = ClusterInput()
yline = ClusterInput()
tool = PythonScript(meshes=mjoin, breps=breps, xline=xline, yline=yline)  # -> tool; inputs meshes: list of Mesh, breps: list of Brep
# ---------- tool: Python ----------
import Rhino.Geometry as rg
from compas.geometry import Frame
from ur_online_control.ur.tool import Tool
from compas.datastructures import Mesh
from compas_rhino.helpers import mesh_from_guid

xaxis = rg.Line(xline.PointAtStart, xline.PointAtEnd)
yaxis = rg.Line(yline.PointAtStart, yline.PointAtEnd)

if xaxis.From.DistanceTo(yaxis.From) < 0.01:
    origin = xaxis.From
    xaxis = xaxis.Direction
    yaxis = yaxis.Direction
elif xaxis.To.DistanceTo(yaxis.To) < 0.01:
    origin = xaxis.To
    xaxis = -xaxis.Direction
    yaxis = -yaxis.Direction
elif xaxis.From.DistanceTo(yaxis.To) < 0.01:
    origin = xaxis.From
    xaxis = xaxis.Direction
    yaxis = -yaxis.Direction
elif xaxis.To.DistanceTo(yaxis.From) < 0.01:
    origin = xaxis.To
    xaxis = -xaxis.Direction
    yaxis = yaxis.Direction

xaxis.Unitize()
yaxis.Unitize()

print origin
print xaxis
print yaxis

tcp_frame = Frame(origin, xaxis, yaxis)

tool = Tool(tcp_frame)
tool.model = [mesh_from_guid(Mesh, mesh) for mesh in meshes]
#tool.model_xyz = tool.model.xyz
tool.breps = breps
# ---------- end tool ----------
tool_2 = ClusterOutput(tool)

# ==== cluster Tool_2
breps = ClusterInput()
meshes = ClusterInput()
meshes_2 = Mesh(meshes)
mjoin = MeshJoin(Meshes=meshes_2)
xline = ClusterInput()
yline = ClusterInput()
tool = PythonScript(meshes=mjoin, breps=breps, xline=xline, yline=yline)  # -> tool; inputs meshes: list of Mesh, breps: list of Brep
# ---------- tool: Python ----------
import Rhino.Geometry as rg
from compas_fab.fab.geometry import Frame
from compas_fab.fab.robots import Tool
from compas.datastructures.mesh import Mesh

xaxis = rg.Line(xline.PointAtStart, xline.PointAtEnd)
yaxis = rg.Line(yline.PointAtStart, yline.PointAtEnd)

if xaxis.From.DistanceTo(yaxis.From) < 0.01:
    origin = xaxis.From
    xaxis = xaxis.Direction
    yaxis = yaxis.Direction
elif xaxis.To.DistanceTo(yaxis.To) < 0.01:
    origin = xaxis.To
    xaxis = -xaxis.Direction
    yaxis = -yaxis.Direction
elif xaxis.From.DistanceTo(yaxis.To) < 0.01:
    origin = xaxis.From
    xaxis = xaxis.Direction
    yaxis = -yaxis.Direction
elif xaxis.To.DistanceTo(yaxis.From) < 0.01:
    origin = xaxis.To
    xaxis = -xaxis.Direction
    yaxis = yaxis.Direction

xaxis.Unitize()
yaxis.Unitize()

print origin
print xaxis
print yaxis

tcp_frame = Frame(origin, xaxis, yaxis)

tool = Tool(tcp_frame)
tool.model = meshes
tool.breps = breps
# ---------- end tool ----------
tool_2 = ClusterOutput(tool)
