# Grasshopper definition 190307_linear_axis_setup.gh (Grasshopper 1.0.7)

# ---- group: Ref surface circle
crv = Curve(<curve referenced from the Rhino model>)

# ----
area = Area(Geometry=crv)  # -> Area, Centroid

# ---- group: midPt setout top
pt = Point(area.Centroid)

# ----
pdecon = Deconstruct(Point=pt)  # -> XComponent, YComponent, ZComponent

# ---- group: MID TOP SECTION
panel = Panel(pdecon.ZComponent)
pt_2 = Point(pt)

# ---- group: Scale factor
# original curve control points 0,13
# curve interpolated points -0.5,11.5
minimum_radius = Slider(330, range=0..1000)
subtraction = Subtraction(A="1000", B=minimum_radius)
division = Division(A=subtraction, B=2)
dom = ConstructDomain(DomainStart=division, DomainEnd="0")

# ---- group: Robot
# 0a
# Settings
# Check your IP address and set UR IP address
server_address = ValueList({"192.168.10.2", "192.168.10.11", "127.0.0.1"}, selected="192.168.10.2")
ur_ip = ValueList({"192.168.10.13", "192.168.10.11", "192.168.10.10", "127.0.0.1"}, selected="192.168.10.13")
server_port = Integer(30003)
globals = PythonScript(server_address=server_address, server_port=server_port, ur_ip=ur_ip)  # inputs server_port: Int32
# ---------- globals: Python ----------
from scriptcontext import sticky as st

st["server_address"] = server_address
st["server_port"] = server_port

st["ur_ip"] = ur_ip
# ---------- end globals ----------

# Check if UR is available
ping = Button()
py = PythonScript(ip=ur_ip, ping=ping)  # -> out
# ---------- py: Python ----------
from scriptcontext import sticky as st
from ur_online_control.communication import is_available


guid = str(ghenv.Component.InstanceGuid)
txt_key = "txt_" + guid
if txt_key not in st:
    st[txt_key] = ""

if ping:
    
    available = is_available(ip)
    
    if available:
        st[txt_key] = "%s is up!" % ip
    else:
        st[txt_key] = "%s is down!" % ip

print st[txt_key]
# ---------- end py ----------
panel_2 = Panel(py)

# ----
# original curve control points 0-25
# curve interpolated points 0-23
tangent_rotation_start_height = Slider(600, range=0..2010)

times_pattern_is_repeated = Slider(14, range=0..100)

# ---- group: Undulations style
# original column 20, new 22
list = ValueList({"Curve undulations original": 0, "Curve undulations grid": 1}, selected="Curve undulations grid")
number_slider = Slider(20, range=0..100)

# ---- group: Layers
layer_selection_end = Slider(200, range=0..2011)
# original column 1800, new 2011
# for total height of 2110 (2010 + 100)
layer_count = Slider(2011, range=0..2011)
layer_selection_start = Slider(0, range=0..2100)
layer_height = Slider(1, range=0..100)

# ---- group: Curve offset
amount_not_affected_layers = Slider(0, range=0..120)
# original curve control points 265,320
number_slider_2 = Slider(265, range=-300..500)
# curve interpolated points 273,320
number_slider_3 = Slider(400, range=0..500)
list_2 = ValueList({"Control point curve": 0, "Interpolated curve": 1, "Blend curve": 2}, selected="Control point curve")
dom_2 = ConstructDomain(DomainStart=number_slider_2, DomainEnd=number_slider_3)

# ---- group: short_edge (timber 190307)
crv_2 = Curve([<curve referenced from the Rhino model> x8])

# ---- group: crown_beams (selected as shortedges order)
brep = Brep([<brep referenced from the Rhino model> x8])

# ---- group: orient_pt
orientpt = Point(<point referenced from the Rhino model>)

# ---- group: Div point offset
dom_3 = ConstructDomain(DomainStart=Slider(-0.5, range=-30..30), DomainEnd=Slider(11.5, range=0..100))

# ---- group: crv_interpolated_tangent_rotation_angle
dom_4 = ConstructDomain(DomainStart=Slider(0, range=0..90), DomainEnd=Slider(90, range=0..90))

# ---- group: Rib offset
dom_5 = ConstructDomain(DomainStart=Slider(0, range=0..30), DomainEnd=Slider(23, range=0..100))

# ----
top_extra_layers = Slider(100, range=0..200)
number_slider_4 = Slider(500, range=0..1000)
move_to_pos = Button()
get_pos = Button()
# Disconnect planes_wcs input after moving axis!
# [to make sure robot base is updated within gh]
close = Button()
pos_z = Slider(500, range=0..1500)

# ---- group: Equalize height of all short_edges (0.3mm tolerance)
end = EndPoints(Curve=crv_2)  # -> Start, End
pdecon_2 = Deconstruct(Point=end.End)  # -> XComponent, YComponent, ZComponent
pdecon_3 = Deconstruct(Point=end.Start)  # -> XComponent, YComponent, ZComponent
pt_3 = ConstructPoint(XCoordinate=pdecon_3.XComponent, YCoordinate=pdecon_3.YComponent, ZCoordinate="1800")
pt_4 = ConstructPoint(XCoordinate=pdecon_2.XComponent, YCoordinate=pdecon_2.YComponent, ZCoordinate="1800")
ln = Line(StartPoint=pt_3, EndPoint=pt_4)

# ---- group: Robot
panel_3 = Panel("Unload libraries")
bang = Button()
unload = PythonScript(bang=bang)
# ---------- unload: Python ----------
from compas_ghpython import unload_modules

unload_modules("compas")
unload_modules("ur_online_control")
# ---------- end unload ----------

# ----
number_slider_5 = Slider(27.5, range=0..100)

panel_4 = Panel("ORIGIN")

python = GhPythonScript(pattern_repetition=times_pattern_is_repeated, amount_of_steps=Slider(6, range=0..100))  # -> out, value_list; inputs pattern_repetition: Int32, amount_of_steps: Int32
# ---------- python: Python ----------
__author__ = "Joris"
__version__ = "2018.10.19"

value_list = []

max_value = 2

for i in range(int(pattern_repetition)):
    if i != 0 and i != 1 and i != 2:
        # calculate amount of steps based on i
        step_amount = amount_of_steps * i * 2
        print "Height of one pattern repetition", step_amount * 2, "mm"
        print i
        # calculate step size
        step_size = max_value / step_amount
        for j in range(int(2/step_size*2)):
            if step_size*j < 2:
                value = j * step_size
            else:
                value = max_value*2 - j*step_size
            value_list.append(value)
# ---------- end python ----------
addition = Addition(A=layer_selection_end, B=top_extra_layers)
linear_axis = GhPythonScript(move_to_pos=move_to_pos, pos_x=number_slider_4, pos_z=pos_z, close=close)  # -> out
# ---------- linear_axis: Python ----------
__author__ = "joburger"
__version__ = "2018.09.20"

from linear_axis import siemens as s

if move_to_pos:
    p = s.SiemensPortal(2)
    
    try:
         p.set_x(pos_x)
         p.set_z(pos_z)
         # p.wait_ext_axis()
    
    finally:
         p.close()

if close:
    try:
        p.close()
        p = s.SiemensPortal(2)
    finally:
        p.close()

#position_data = None

"""
if get_pos:
    try:
        p = s.SiemensPortal(1)
        position_data = "NO DATA"
        position_data = "AXIS POSITION \nX:" + str(p.get_x()) + " Z:" + str(p.get_z())
        print "hmm"
    finally:
        p.close()

try:
    print position_data
except RuntimeError:
    print "Something did not work"
"""
# ---------- end linear_axis ----------
layer_count_2 = Number(layer_count)
subtraction_2 = Subtraction(A=addition, B=tangent_rotation_start_height)

subtraction_3 = Subtraction(A=number_slider_4, B="500")
subtraction_4 = Subtraction(A="750", B=pos_z)
neg = Negative(Value=subtraction_3)
neg_2 = Negative(Value=subtraction_4)
linear_axis_x_axis = Brep(<brep referenced from the Rhino model>)
linear_axis_plates = Brep([<brep referenced from the Rhino model> x2])
X = UnitX(Factor=neg)
Z = UnitZ(Factor=neg_2)
move = Move(Geometry=linear_axis_x_axis, Motion=X)  # -> Geometry, Transform
move_2 = Move(Geometry=[move.Geometry, linear_axis_plates], Motion=Z)  # -> Geometry, Transform
preview = CustomPreview(Geometry=move_2.Geometry, Shader=ColourSwatch(SwatchColor=RGBA(99, 94, 94, 96)))

# ---- group: Robot
# 1. load robot model
# 2. set tool
# 3. set basis
# 1. load robot model
# 2. set tool
# 3. set basis
list_3 = ValueList({"no_tool": 0, "measurement_tool": 1, "extruder": 2}, selected="extruder")
base = PythonScript(x=subtraction_3, z=subtraction_4)  # -> base_frame, base
# ---------- base: Python ----------
from compas.geometry import Frame

"""
origin = [0, 0, 0]
xaxis = [1, 0, 0]
yaxis = [0, 1, 0]


origin = [-313.92, -147.58, 13.79]
xaxis = [0.00000, -1.00000, 0.00000]
yaxis = [1.00000, 0.00000, 0.00000]
"""


linear_axis_x = x
linear_axis_z = z 
#axis    Y         Z                        X
origin = [155.98, -806.21 + linear_axis_z, 343.76 + linear_axis_x]
xaxis = [0, 0, 1]
yaxis = [1, 0, 0]

base_frame = Frame(list(origin), list(xaxis), list(yaxis))

base = "base = " + str(origin) + "\n" + "change in linear_axis_x = " + str(linear_axis_x) + "\n" + "change in linear_axis_z = " + str(linear_axis_z)
# ---------- end base ----------
tools = Tools(tool_id=list_3)
list_4 = ValueList({"UR5", "UR10"}, selected="UR10")
robot = PythonScript(model=list_4, tool=tools, base_frame=base.base_frame)  # -> robot
# ---------- robot: Python ----------
from ur_online_control.ur.ur10 import UR10
from ur_online_control.ur.ur5 import UR5
from scriptcontext import sticky as st

if model == "UR5":
    robot = UR5()
elif model == "UR10":
    robot = UR10()

if tool:
    robot.set_tool(tool)
if base_frame:
    robot.set_base(base_frame)

st["robot"] = robot
# ---------- end robot ----------

# ---- group: Threaded rods top
length_of_threaded_rod = Slider(349, range=0..1000)
threaded_rod_depth_into_column = Slider(200, range=0..300)
diameter_threaded_rod_top = Slider(14, range=0..100)

# ----
position_of_small_rebars_distance_from_t = Panel("""80
180
240
340
400
500""")  # "Position of small rebars (distance from top)"
distance_between_transversal_stirrups = Slider(200, range=0..1000)

z_height_cage = Slider(2050, range=0..2500)
x_radius_cage = Slider(100, range=0..1000)
x_stirrup_distance_from_top = Slider(373, range=0..2000)
z_middle_height_stirrup = Slider(1450, range=0..2000)

# ---- group: Bar diameter
diameter_stirrup = Slider(10, range=0..30)
diameter_vertical = Slider(20, range=0..30)
diameter_diagonal = Slider(14, range=0..30)
diameter_transversal_stirrup = Slider(10, range=0..30)

# ----
extension_top_large_stirrup = Slider(50, range=0..1000)
extension_bottom_large_stirrup = Slider(-400, range=-500..0)

# ---- group: Fillet radii
fillet_radius_large_stirrup_vertical = Slider(20, range=0..100)
fillet_radius_large_stirrup_diagonal = Slider(20, range=0..150)
fillet_radius_large_stirrup_middle_secti = Slider(0, range=0..500)  # "Fillet radius large stirrup middle section"
fillet_radius_stirrups = Slider(20, range=0..1000)

# ----
amount_of_bars = Slider(8, range=0..30)
offset_for_stirrup_diagonal_intersection = Slider(0, range=0..100)
offset_for_stirrup_vertical_intersection = Slider(14, range=0..100)
list_5 = ValueList({"no_tool": 0, "spray_gun": 1, "extruder": 2}, selected="extruder")
panel_5 = Panel(linear_axis)
lng = ListLength(List=python.value_list)

# ---- group: Scale factor
range = Range(Domain=Domain(0, 1), Steps=expr("x-1", layer_count_2))
graph = GraphMapper(
    range,
    x0=0,
    x1=1,
    y0=0,
    y1=1,
    container_name="Bezier",
    cpx=[0, 0.2461866289, 0.5236688256, 1],
    cpy=[0.7384505868, 0.1078018546, 0.01457560062, 0.1922056079])
bnd = Bounds(Numbers=graph)
remap = RemapNumbers(Value=graph, Source=bnd, Target=dom)  # -> Mapped, Clipped

# ---- group: Div point offset
range_2 = Range(Domain=Domain(0, 1), Steps=expr("x-1", layer_count_2))
graph_2 = GraphMapper(
    range_2,
    x0=0,
    x1=1,
    y0=0,
    y1=1,
    container_name="Bezier",
    cpx=[0, 0.5091154575, 0.05710413679, 1],
    cpy=[0.2446190715, 0.4540976286, 0.07733350992, 0])
bnd_2 = Bounds(Numbers=graph_2)
remap_2 = RemapNumbers(Value=graph_2, Source=bnd_2, Target=dom_3)  # -> Mapped, Clipped

# ---- group: Rib offset
range_3 = Range(Domain=dom_5, Steps=expr("x-1", layer_count_2))

# ---- group: tangent_rotation_angle
range_4 = Range(Domain=dom_4, Steps=expr("x-1", subtraction_2))

# ----
graph_3 = GraphMapper(
    range_2,
    x0=0,
    x1=1,
    y0=0,
    y1=1,
    A=-1.006428972,
    B=1.006428972,
    container_name="Linear",
    Graph_x0=0.006387904286,
    Graph_x1=1,
    Graph_y0=1,
    Graph_y1=0)
tools_2 = Tools_2(tool_id=list_5)
panel_6 = Panel(lng)
panel_7 = Panel(base.base)
addition_2 = Addition(A=layer_count_2, B=top_extra_layers)

# ---- group: Curve offset
data = Data(graph_3)
bnd_3 = Bounds(Numbers=data)
subtraction_5 = Subtraction(A=layer_count_2, B=amount_not_affected_layers)
range_5 = Range(Domain=Domain(0, 1), Steps=expr("x-1", subtraction_5))
remap_3 = RemapNumbers(Value=data, Source=bnd_3, Target=dom_2)  # -> Mapped, Clipped
dup = DuplicateData(Data=number_slider_2, Number=amount_not_affected_layers, Order=True)
ins = InsertItems(List=remap_3.Mapped, Item=dup, Indices=subtraction_5, Wrap=False)

# ----
subtraction_6 = Subtraction(A=lng, B=addition_2)
number_slider_6 = Slider(73, range=0..100)
division_2 = Division(A=diameter_diagonal, B=2)
division_3 = Division(A=diameter_vertical, B=2)
dom_6 = ConstructDomain(DomainStart=expr("x+1", subtraction_6), DomainEnd=lng)
X_2 = UnitX(Factor=x_radius_cage)
Z_2 = UnitZ(Factor=z_height_cage)
series = Series(Start=0, Step=expr("360/x", amount_of_bars), Count=amount_of_bars)
addition_3 = Addition(A=division_3, B=diameter_stirrup, C=division_2)
addition_4 = Addition(A=x_radius_cage, B=addition_3)
subset = SubList(List=python.value_list, Domain=dom_6, Wrap=True)  # -> List, Index

start = Button()
py_2 = PythonScript()  # -> path
# ---------- py_2: Python ----------
import sys
import os

ghComp = ghenv.Component
ghDoc = ghComp.OnPingDocument()

# the full path of the gh file
path = ghDoc.FilePath
# the directory of the gh file
path = os.path.dirname(path)

path = os.path.abspath(os.path.join(path, ".."))

print path
# ---------- end py_2 ----------
# 1
# Executing
panel_8 = Panel("Start communication server")
panel_9 = Panel(py_2)
server = PythonScript(path=panel_9, start=start)
# ---------- server: Python ----------
import os
import threading
from scriptcontext import sticky as st

server_address = st["server_address"]
server_port = st["server_port"]
ur_ip = st["ur_ip"]

"""
Change main!!!!
"""
main = os.path.join(path, "communication", "main.py")

if os.path.isfile(main):
        
    def myfunc():
        syscall = "python %s %s %s %s" % (main, server_address, server_port, ur_ip)
        os.system(syscall)
    
    if start:
        t = threading.Thread(target=myfunc)
        t.start()
# ---------- end server ----------

X_3 = UnitX(Factor=addition_4)

radius = Slider(100, range=0..500)
rotation = Slider(22.5, range=0..360)
stirrup_distance = Slider(225, range=0..2500)
barheight = Slider(1770, range=0..2500)
stirrup_size = Slider(8, range=0..30)

division_4 = Division(A=diameter_threaded_rod_top, B=2)
subtraction_7 = Subtraction(A=x_radius_cage, B=division_4, C=division_3)
X_4 = UnitX(Factor=subtraction_7)
Z_3 = UnitZ(Factor=z_middle_height_stirrup)

# ---- group: test_pt
pt_5 = Point(<point referenced from the Rhino model>)
xy = XYPlane(Origin=pt_5)
rotate = Rotate(Geometry=xy, Angle=-1.570796327, Plane=xy)  # -> Geometry, Transform

# ----
X_5 = UnitX(Factor=x_stirrup_distance_from_top)

# ---- group: filament_loading_pt
pt_6 = Point(<point referenced from the Rhino model>)
xy_2 = XYPlane(Origin=pt_6)
rotate_2 = Rotate(Geometry=xy_2, Angle=-1.570796327, Plane=xy_2)  # -> Geometry, Transform

# ----
graph_4 = QuickGraph(subset.List, SortOrder=0)
addition_5 = Addition(A=X_3, B=Z_3)

panel_10 = Panel("Get UR connected")
ur = PythonScript(send=start)  # -> out, a
# ---------- ur: Python ----------
from scriptcontext import sticky as st
from ur_online_control.ur_driver import URDriver

server_address = st["server_address"]
server_port = st["server_port"]
ur_ip = st["ur_ip"]
robot = st["robot"]

tool_angle_axis = list(robot.tool.tcp_frame.point) + robot.tool.tcp_frame.axis_angle_vector
#robot.tool.tcp_frame.pose_axis_angle_vector
print tool_angle_axis

ur_driver = URDriver(server_address, server_port, tool_angle_axis, ur_ip, "UR")
print ur_driver

if send:
    ur_driver.send()
# ---------- end ur ----------

panel_11 = Panel(ur.out)
python_2 = GhPythonScript(
    short_edges=ln,
    curve_offset=ins,
    tan_rot_angle=range_4,
    tan_rot_start_layer=tangent_rotation_start_height,
    rib_offset=range_3,
    layer_height=layer_height,
    div_pt_count=number_slider,
    div_pt_offset=remap_2.Mapped,
    scale_factor=remap.Mapped,
    layer_selection_start=layer_selection_start,
    layer_selection_end=layer_selection_end,
    offset_x=subset.List,
    undulations_type=list,
    curve_type=list_2,
    extra_layers=top_extra_layers)  # -> out, total_curves, polyline_layers, flat_pt_list, angle_lines, axis_moving_pts, axis_moving_pts_indices, lines, curves, crown_short_edges_pts; inputs short_edges: list of Curve, curve_offset: list, tan_rot_angle: list, rib_offset: list, div_pt_count: Int32, div_pt_offset: list, scale_factor: list, layer_selection_start: Int32, layer_selection_end: Int32, offset_x: list, extra_layers: Int32
# ---------- python_2: Python ----------
__author__ = "joburger&niztaha"
__version__ = "2019.02.27"

import Rhino.Geometry as rg
import math
import imp

from design import curve_undulation as cu
from design import generate_column as gc

imp.reload(cu)
imp.reload(gc)

curves = []
total_curves = []
pt_list = []
angle_lines = []
polyline_layers = []
lines = []
line1 = []
line2 = []
curve_list = []
polyline_pt_list = []
lAxis_pt_list = []
crown_short_edges_pts = []

axis_moving_pts_indices = []

# Column top crown addition
if layer_selection_start == 0 :
    layer_selection_end = layer_selection_end + extra_layers
    # move initial edges as much as the extra layers
    
    for i in range(len(short_edges)):
        short_edges[i].Transform(rg.Transform.Translation(rg.Vector3d(0,0,extra_layers)))

    curve_offset = gc.reverse_extend_list_at_index(curve_offset,extra_layers,1)

    # rib_offset = gc.reverse_extend_list_at_index(rib_offset,extra_layers,1)
    rib_offset_0 = [0 for i in range (extra_layers)]
    rib_offset_0.reverse()
    rib_offset[0:0] = rib_offset_0

    div_pt_offset = gc.reverse_extend_list_at_index(div_pt_offset,extra_layers,1)

    scale_45 = [i+1 for i in range (extra_layers)]
    scale_45.reverse()
    scale_factor[0:0] = scale_45

# generate tangent rotation from column shortest curves
shortest_tan_rot_angles = gc.generate_increment_from_shortest_curve(scale_factor, 10)
# reduce bump starting from column shortest curves
shortest_curve_offsets = gc.generate_increment_from_shortest_curve(scale_factor, 25)
new_curve_offset = []
for i in range(len(curve_offset)-1):
    crvOff = curve_offset[i] + shortest_curve_offsets[i]
    new_curve_offset.append(crvOff)
# reduce pattern div pt offset from top
longest_div_pt_offset = gc.generate_increment_from_shortest_curve(scale_factor, -9, "top")
new_div_pt_offset = []
for i in range(len(div_pt_offset)):
    divPtOff = div_pt_offset[i] + longest_div_pt_offset[i]
    new_div_pt_offset.append(divPtOff)

print curve_offset[2000]

# column generation
n = len(short_edges)
for i in range(layer_selection_start, layer_selection_end):
    for j in range(n):
        pt1, moved_pt1 = gc.create_rib(short_edges,i,j, rib_offset, -1, scale_factor)
        pt2, moved_pt2 = gc.create_rib(short_edges,i,(j-(n-1)), rib_offset, 1, scale_factor)
        # create curve
        if curve_type == 0:
            # OPTION 1: create control point curve
            curve, curve_list = gc.create_cp_crv(curve_offset, i, pt1, pt2, moved_pt1, moved_pt2)
        elif curve_type == 1:
            # OPTION 2: create interpolated curve
            vect_tangent_1 = gc.get_edge_tanget(short_edges,i,j, -1)
            vect_tangent_2 = gc.get_edge_tanget(short_edges,i,(j-(n-1)), 1)
            vect_tan_Tr_10 = gc.transform_edge_tangent(vect_tangent_1, i, tan_rot_angle, -1, tan_rot_start_layer)
            vect_tan_Tr_20 = gc.transform_edge_tangent(vect_tangent_2, i, tan_rot_angle, 1, tan_rot_start_layer)
            # if above generate_increment_from_shortest_curve is used
            vect_tan_Tr_11 = gc.transform_edge_tangent(vect_tan_Tr_10, i, shortest_tan_rot_angles, -1)
            vect_tan_Tr_21 = gc.transform_edge_tangent(vect_tan_Tr_20, i, shortest_tan_rot_angles, 1)

            curve, curve_list = gc.create_inter_crv(new_curve_offset, i, pt1, pt2, moved_pt1, moved_pt2, vect_tan_Tr_11, vect_tan_Tr_21)
        
        elif curve_type == 2:
            # OPTION 3: create blend curve
            curve, curve_list = gc.create_blend_crv(short_edges,j, curve_offset, i, pt1, pt2, moved_pt1, moved_pt2, 200)

        copy_curve = gc.create_column(layer_height, curve, i)

        # append curves
        curves.append(copy_curve)

        # connect curves with straight lines and append
        line_pt1 = copy_curve.PointAtEnd
        line_pt2 = copy_curve.PointAtStart
        line1.append(line_pt1)
        line2.append(line_pt2)


        if j > 0:
            line = rg.Line(line1[j-1], line2[j])
            lines.append(line)
            if i == 0:
                crown_short_edges_pts.append(line1[j-1])
                crown_short_edges_pts.append(line2[j])
        if j == n-1:
            line = rg.Line(line1[-1], line2[0])
            lines.append(line)
            if i == 0:
                crown_short_edges_pts.append(line1[-1])
                crown_short_edges_pts.append(line2[0])
                
        # create undulations
        if undulations_type == 0:
            unds = cu.Curve_undulation(copy_curve, div_pt_count, new_div_pt_offset[i])
            undulated_divpts = unds.curve_undulation_original()
        else:
            unds = cu.Curve_undulation(copy_curve, div_pt_count, new_div_pt_offset[i], offset_x[i])
            undulated_divpts = unds.curve_undulation_grid()

        # append to lists
        pt_list.append(undulated_divpts)
        polyline_pt_list.append(undulated_divpts)


    # flatten list and create polyline per layer
    flat_polyline_list = gc.flatten_list(polyline_pt_list)
    polyline_layer = rg.PolylineCurve(flat_polyline_list + [flat_polyline_list[0]])
    polyline_layers.append(polyline_layer)

    angle_lines = gc.create_angleLines(pt_list, flat_polyline_list, div_pt_count, n)

    # first pt in every layer for axis movement WIP
    flat_lAxis_pt_list = gc.flatten_list(pt_list)
    axis_moving_pts_indices.append(len(flat_lAxis_pt_list))

    #visualize axis moving pts
    lAxis_pt_list.append(flat_lAxis_pt_list[-1])

    # reset lists
    polyline_pt_list = []
    line1 = []
    line2 = []


flat_pt_list = gc.flatten_list(pt_list)

axis_moving_pts = set(flat_pt_list).intersection(lAxis_pt_list)

total_curves = gc.flatten_list([curves, lines])
# ---------- end python_2 ----------

disconnect = Button()
panel_12 = Panel("Get Grasshopper connected")
client = PythonScript(connect=start, disconnect=disconnect)  # -> connected, client
# ---------- client: Python ----------
import time
from scriptcontext import sticky as st
from Rhino.RhinoApp import WriteLine
from ur_online_control.grasshopper import GHClient, gh_component_timer
import time

server_address = st["server_address"]
server_port = st["server_port"]

guid = str(ghenv.Component.InstanceGuid)

client_key = "client_" + guid
run_key = "run_" + guid

if connect:
    if client_key not in st:
        st[client_key] = GHClient(server_address, server_port)
        client = st[client_key]
        client.connect_to_server()
        client.start()
        
    else:
        if st[client_key].running:
            WriteLine("Client is already connected.")
            
        else:
            st[client_key] = GHClient(server_address, server_port)
            client = st[client_key]
            client.connect_to_server()
            client.start()
"""
else:
    if client_key in st:
        # we need a timer to ask if we have something on the rcv queue
        client = st[client_key]
        #if client.running:
        #    #client.run_inner_while()
        #    gh_component_timer(ghenv, True, 1000)
"""

if disconnect:
    if client_key in st:
        client = st[client_key]
        if client.running:
            client.close()

if client_key in st:
    connected =  st[client_key].running
    client = st[client_key]
    print st[client_key].rcv_queue.qsize()
    print st[client_key].snd_queue.qsize()
else:
    connected = False
# ---------- end client ----------
panel_13 = Panel(client.connected)

join = JoinCurves(Curves=python_2.total_curves, Preserve=False)

bang_2 = Button()
receive = PythonScript(client=client.client, bang=bang_2)  # -> qsize, client
# ---------- receive: Python ----------
from ur_online_control.communication.msg_identifiers import *
from ur_online_control.utilities.lists import flatten_list
from Rhino.RhinoApp import WriteLine


if client:
    if not client.ghenv:
        client.ghenv = ghenv
    qsize = client.rcv_queue.qsize()
# ---------- end receive ----------
panel_14 = Panel(receive.qsize)

sort_on_z = SortOnZ(A=join)
crv_3 = Curve(python_2.curves)
polyline_layers = Curve(python_2.polyline_layers)  # disabled
flat_pt_list = Point(python_2.flat_pt_list)

# ---- group: axis_moving_pts
pt_7 = Point(python_2.axis_moving_pts)

# ----
crv_4 = Curve(python_2.lines)
curves = Curve(sort_on_z)

# ---- group: Simplify column for baking
dom_7 = ConstructDomain(DomainStart=layer_selection_start, DomainEnd=layer_selection_end)
num = Number(expr("x+99", layer_selection_end))
range_6 = Range(Domain=dom_7, Steps=Slider(10, range=0..10))
item = ListItem(List=curves, Index=range_6, Wrap=True)
item_2 = ListItem(List=curves, Index=[layer_selection_end, num], Wrap=True)
loft = Loft(Curves=item_2, Options={Adjust=False, Closed=False, LoftEnds=0, LoftSimp=0, LoftType=0, Rebuild=10, Refit=0.01})
loft_2 = Loft(Curves=item, Options={Adjust=False, Closed=False, LoftEnds=0, LoftSimp=0, LoftType=0, Rebuild=10, Refit=0.01})
join_2 = BrepJoin(Breps=[loft_2, loft])  # -> Breps, Closed

# ----
loft_3 = Loft(Curves=curves, Options={Adjust=False, Closed=False, LoftEnds=0, LoftSimp=0, LoftType=0, Rebuild=18, Refit=0.01})
loft_4 = Loft(Curves=polyline_layers, Options={Adjust=False, Closed=False, LoftEnds=0, LoftSimp=0, LoftType=0, Rebuild=18, Refit=0.01})  # disabled
send = PythonScript(client=receive.client)  # -> out
# ---------- send: Python ----------
from ur_online_control.communication.msg_identifiers import *
from ur_online_control.utilities.lists import flatten_list

if client:
    qsize = client.rcv_queue.qsize()
    if qsize:
        msg = client.rcv_queue.get()
        print msg
# ---------- end send ----------
Z_4 = UnitZ(Factor=extension_bottom_large_stirrup)
panel_15 = Panel(send)

# ---- group: Printing time
len = Length(Curve=polyline_layers)
ma = MassAddition(Input=len)  # -> Result, PartialResults
python_3 = GhPythonScript(tot_length=ma.Result, print_speed=Slider(40, range=0..100))  # -> simplify(out), a
# ---------- python_3: Python ----------
__author__ = "joburger"
__version__ = "2018.09.06"

import imp
from design import generate_column as gc

imp.reload(gc)

gc.calculate_weight(tot_length, print_speed)
# ---------- end python_3 ----------

# ----
crv_5 = Curve(python_2.angle_lines)
null = NullItem(Item=crv_5)  # -> NullFlags, InvalidFlags, Description
not = GateNot(A=null.InvalidFlags)
cull = CullPattern(List=crv_5, CullPattern=not)
len_2 = Length(Curve=cull)
division_5 = Division(A=layer_height, B=len_2)
list_6 = ValueList({"Show curve gradient": "gradient", "Show invalid curves": "invalid"}, selected="Show invalid curves")
acos = ArcCosine(Value=division_5)
deg = Degrees(Radians=acos)
python_4 = GhPythonScript(deg=deg, show_curve_type=list_6, max_angle=Slider(43, range=0..100))  # -> out, a, b; inputs deg: list
# ---------- python_4: Python ----------
__author__ = "Joris"
__version__ = "2018.10.31"

import rhinoscriptsyntax as rs

a = []
highest = max(deg)

if show_curve_type == "gradient":
    for i in range(len(deg)):
        if deg[i] < 400:
            red = deg[i] * (255/highest)
            green = 0
            blue = 0
            colour = rs.CreateColor(red, green, blue)
            a.append(colour)
elif show_curve_type == "invalid":
    for i in range(len(deg)):
        if deg[i] > max_angle:
            red = 200
            green = 0
            blue = 0
        else:
            red = 0
            green = 175
            blue = 0
        colour = rs.CreateColor(red, green, blue)
        a.append(colour)
# ---------- end python_4 ----------
panel_16 = Panel(deg)
preview_2 = CustomPreview(Geometry=polyline_layers, Material=python_4.a)

# ---- group: Orient for printing
item_3 = ListItem(List=polyline_layers, Index=-1, Wrap=True)
area_2 = Area(Geometry=item_3)  # -> Area, Centroid
xy_3 = XYPlane(Origin=orientpt)
xy_4 = XYPlane(Origin=area_2.Centroid)
orient = Orient(Geometry=polyline_layers, Source=xy_4, Target=xy_3)  # -> Geometry, Transform
orient_2 = Orient(Geometry=flat_pt_list, Source=xy_4, Target=xy_3)  # -> Geometry, Transform

# ----
line = Line(ln)
crv_6 = Curve(crv_3)
crv_7 = Curve(crv_4)
python_5 = GhPythonScript(short_edges=line, curves=crv_6, lines=crv_7)  # -> crown_curves, crown_short_edges, beamSurfaces, cornerPts; inputs short_edges: list, curves: list, lines: list
# ---------- python_5: Python ----------
__author__ = "nizart"
__version__ = "2019.02.15"

import Rhino.Geometry as rg
import rhinoscriptsyntax as rs

crown_curves = curves[:len(short_edges)]
crown_short_edges = lines[:len(short_edges)]
print crown_short_edges

# shift crown short edges pts list twice to match with short edges list
crown_short_edges.insert(0,crown_short_edges.pop())

# generate top steel plate

beamSurfaces=[]
cornerPts=[]

#beamSurfacesNormals = []
#beamSurfacesPlanes =[]

for i in range(len(crown_short_edges)):
    #short edge
    short_edgeStart = rs.CurveStartPoint(short_edges[i])
    short_edgeEnd = rs.CurveEndPoint(short_edges[i])
    #crown short edge
    crown_short_edgeStart = rs.CurveStartPoint(crown_short_edges[i])
    crown_short_edgeEnd = rs.CurveEndPoint(crown_short_edges[i])
    #corner pts list
    cornerVertices = [short_edgeStart ,crown_short_edgeStart, crown_short_edgeEnd, short_edgeEnd]
    cornerPts.extend(cornerVertices)
    # create surface
    beamSurface = rs.AddSrfPt(cornerVertices)
    beamSurfaces.append(beamSurface)
    
#    # create plane nad find surface normal
#    srfPlane = rs.PlaneFitFromPoints(cornerPts)
#    # move plane to surface center
#    srfCentroid = rs.SurfaceAreaCentroid(beamSurface)
#    xform = rs.XformTranslation(srfCentroid[0])
##    srfPlaneMoved = rs.MovePlane(srfPlane,srfCentroid[0])
#    srfPlaneMoved = rs.PlaneTransform(srfPlane, xform)
#    beamSurfacesPlanes.append(srfPlaneMoved)
#    # find surface normal
#    srfParameter = rs.SurfaceParameter(beamSurface,[0.5,0.5])
#    beamSurfaceNormal = rs.SurfaceNormal(beamSurface,srfParameter)
#    beamSurfacesNormals.append(beamSurfaceNormal)
# ---------- end python_5 ----------
partition = PartitionList(List=python_5.cornerPts, Size="4")
item_4 = ListItem(List=partition, Index=0, Wrap=True)  # -> flatten(Item1), flatten(Item), flatten(Item1_2), flatten(Item2)

# ---- group: steelPlate to beam gap
panel_17 = Panel("-5")

# ----
# Direct UR control
get = Button()
get_2 = Button()
pose = PythonScript(get=get_2)  # -> pose_joints
# ---------- pose: Python ----------
from scriptcontext import sticky as st
from ur_online_control.ur_direct import get_current_pose_joints
from ur_online_control.ur.robot import BaseConfiguration

server_address = st["server_address"]
server_port = 30005
ur_ip = st["ur_ip"]
robot = st["robot"]
tool_angle_axis = list(robot.tool.tcp_frame.point) + robot.tool.tcp_frame.axis_angle_vector
print tool_angle_axis

guid = str(ghenv.Component.InstanceGuid)
pose_joints_key = "pose_joints" + guid


if get:
    st[pose_joints_key] = get_current_pose_joints(server_address, server_port, ur_ip, tool_angle_axis)
    
if pose_joints_key not in st:
    pose_joints = []
else:
    pose_joints = BaseConfiguration.from_joints(st[pose_joints_key])
# ---------- end pose ----------
pose_2 = PythonScript(get=get)  # -> pose_cartesian
# ---------- pose_2: Python ----------
from scriptcontext import sticky as st
from ur_online_control.ur_direct import get_current_pose_cartesian

server_address = st["server_address"]
server_port = 30005
ur_ip = st["ur_ip"]
robot = st["robot"]
tool_angle_axis = list(robot.tool.tcp_frame.point) + robot.tool.tcp_frame.axis_angle_vector
print tool_angle_axis

guid = str(ghenv.Component.InstanceGuid)
pose_cartesian_key = "pose_cartesian" + guid


if get:
    st[pose_cartesian_key] = get_current_pose_cartesian(server_address, server_port, ur_ip, tool_angle_axis)

if pose_cartesian_key not in st:
    pose_cartesian = []
else:
    pose_cartesian = st[pose_cartesian_key]
# ---------- end pose_2 ----------
stop = Button()
stop_2 = PythonScript(stop=stop)
# ---------- stop_2: Python ----------
from scriptcontext import sticky as st
from ur_online_control.ur_direct import stop as stop_robot

ur_ip = st["ur_ip"]

if stop:
    stop_robot(ur_ip)
# ---------- end stop_2 ----------
panel_18 = Panel(pose)
panel_19 = Panel(pose_2)

srf = Surface(python_5.beamSurfaces)
item_5 = ListItem(List=srf, Index=Slider(4, range=0..10), Wrap=True)
pln = Plane(item_5)
line_2 = Line(python_5.crown_short_edges)
crv_8 = Curve(python_5.crown_curves)

# ---- group: steelPlate thickness
panel_20 = Panel("-8")

# ---- group: steelFIn height
panel_21 = Panel("157")

# ----
vertical_pose = Number([-152.427, -780.635, 855.229, -1.1958, -1.22046, -1.20201])
panel_22 = Panel(python_3.out)
addition_6 = Addition(A=panel_20, B=panel_17)

# ---- group: short edges
pt_8 = Point(item_4.Item1)
pt_9 = Point(item_4.Item)

# ---- group: crown short edges
pt_10 = Point(item_4.Item1_2)
pt_11 = Point(item_4.Item2)

# ----
ln_2 = Line(StartPoint=pt_11, EndPoint=pt_8)
ln_3 = Line(StartPoint=pt_9, EndPoint=pt_10)
ln_4 = Line(StartPoint=pt_8, EndPoint=pt_9)
back = Button()
reset = Button()

# ---- group: Define joint positions
base_2 = Slider(90.163, range=-360..360)
shoulder = Slider(0, range=-360..360)
elbow = Slider(-102.857, range=-360..360)
wrist1 = Slider(0, range=-360..360)
wrist2 = Slider(0, range=-360..360)
wrist3 = Slider(0, range=-360..360)
ur1_q1_q6 = Data([base_2, shoulder, elbow, wrist1, wrist2, wrist3])

# ---- group: Crown Curve
join_3 = JoinCurves(Curves=flatten([ln_2, ln_4, ln_3, crv_8]), Preserve=False)
crv_9 = Curve(join_3)

# ---- group: Oriented curves
crv_10 = Curve(orient.Geometry)

# ---- group: Oriented points
pt_12 = Point(orient_2.Geometry)

# ----
py_3 = GhPythonScript(joint_values=ur1_q1_q6)  # -> configuration; inputs joint_values: list
# ---------- py_3: Python ----------
import math
from ur_online_control.ur.robot import BaseConfiguration

configuration = BaseConfiguration.from_joints([math.radians(d) for d in joint_values])
# ---------- end py_3 ----------
loft_5 = Loft(Curves=crv_10, Options={Adjust=False, Closed=False, LoftEnds=0, LoftSimp=0, LoftType=0, Rebuild=10, Refit=0.01})  # disabled

# ----
# Calculate basis
# Measure basis:
# 1. Clear the recorded poses
# 2. Move robot to origin and press "get pose"
# 3. Move robot to point in positive x-axis and press "get pose"
# 4. Move robot to an other point in your basis and press "get pose"
# (The farer away these positions are, the better)
# 
# 5. Alternatively change the order in the component calc base
# 6. Copy output into base component
list_7 = ValueList({"origin, pt on positive x-axis, pt in xy plane": 0, "origin, pt on positive y-axis, pt in xy plane": 1}, selected="origin, pt on positive x-axis, pt in xy plane")
clear = Button()
rec = PythonScript(msg=pose_2, rec=get, clear=clear)  # -> rec; inputs msg: list
# ---------- rec: Python ----------
from scriptcontext import sticky as st

guid = str(ghenv.Component.InstanceGuid)
recorded_key =  "recorded_" + guid
just_cleared_key = "just_cleared_" + guid

if recorded_key not in st:
    st[recorded_key] = []

if just_cleared_key not in st:
    st[just_cleared_key] = False

if clear:
    st[recorded_key] = []
    st[just_cleared_key] = True
else:
    if len(msg):
        if msg != [None] and not st[just_cleared_key] and rec:
            st[recorded_key].append(msg)
    st[just_cleared_key] = False
        


rec = st[recorded_key]

print rec
# ---------- end rec ----------
calc_base = PythonScript(poses=rec, input_type=list_7)  # -> out; inputs poses: list
# ---------- calc_base: Python ----------
import Rhino.Geometry as rg
import math


if len(poses) > 2:
    
    O = poses[0]
    P1 = poses[1]
    P2 = poses[2]
    
    if input_type == 0:
        # origin, pt on positive x-axis, pt in xy plane
        origin = rg.Point3d(O[0], O[1], O[2])
        pt_on_xaxis = rg.Point3d(P1[0], P1[1], P1[2])
        pt_in_xyplane = rg.Point3d(P2[0], P2[1], P2[2])
        
        xaxis = pt_on_xaxis - origin
        xaxis.Unitize()
        
        v = pt_in_xyplane - origin
        zaxis = rg.Vector3d.CrossProduct(v, xaxis)
        zaxis.Unitize()
        
        # zaxis must look up!
        if math.acos(rg.Vector3d.ZAxis * zaxis) > math.acos(rg.Vector3d.ZAxis * -zaxis):
            zaxis = -zaxis
        
        yaxis = rg.Vector3d.CrossProduct(zaxis, xaxis)
    
    elif input_type == 1:
        # origin, pt on positive y-axis, pt in xy plane
        origin = rg.Point3d(O[0], O[1], O[2])
        pt_on_yaxis = rg.Point3d(P1[0], P1[1], P1[2])
        pt_in_xyplane = rg.Point3d(P2[0], P2[1], P2[2])
        
        yaxis = pt_on_yaxis - origin
        yaxis.Unitize()
        
        v = pt_in_xyplane - origin
        zaxis = rg.Vector3d.CrossProduct(v, yaxis)
        zaxis.Unitize()
        
        # zaxis must look up!
        if math.acos(rg.Vector3d.ZAxis * zaxis) > math.acos(rg.Vector3d.ZAxis * -zaxis):
            zaxis = -zaxis
        
        xaxis = rg.Vector3d.CrossProduct(yaxis, zaxis)
        
        
    print "Copy the following into base component:"
    print " "
    print "origin = [%.2f, %.2f, %.2f]" % tuple(list(origin))
    print "xaxis = [%.5f, %.5f, %.5f]" % tuple(list(xaxis))
    print "yaxis = [%.5f, %.5f, %.5f]" % tuple(list(yaxis))
    

#print rg.Vector3d.CrossProduct(rg.Vector3d.YAxis, rg.Vector3d.ZAxis)
#print rg.Vector3d.CrossProduct(rg.Vector3d.ZAxis, rg.Vector3d.XAxis)
# ---------- end calc_base ----------
panel_23 = Panel(rec)
panel_24 = Panel(calc_base)

list_8 = ValueList({"Print with UR": 0, "Print with Linear Axis": 1}, selected="Print with Linear Axis")
extra_tolerance_hole = Slider(2, range=0..100)

# ---- group: Visualise / robot model brep
py_4 = PythonScript(model=list_4)  # -> n
# ---------- py_4: Python ----------
if model == "UR5":
    n = 0
if model == "UR10":
    n = 1

print n
# ---------- end py_4 ----------
ur10_brep = UR10Brep([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])
ur5_brep = UR5Brep([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])
show_brep = BooleanToggle(False)
filter = StreamFilter(Gate=py_4, Stream0=ur5_brep, Stream1=ur10_brep)

# ----
pdecon_4 = Deconstruct(Point=pt_12)  # -> XComponent, YComponent, ZComponent
pdecon_5 = Deconstruct(Point=orientpt)  # -> XComponent, YComponent, ZComponent
addition_7 = Addition(A=division_4, B=extra_tolerance_hole)
filter_2 = StreamFilter(Gate=list_8, Stream0=pdecon_4.ZComponent, Stream1=pdecon_5.ZComponent)
pt_13 = ConstructPoint(XCoordinate=pdecon_4.XComponent, YCoordinate=pdecon_4.YComponent, ZCoordinate=filter_2)
xy_5 = XYPlane(Origin=pt_13)
pln_2 = Plane(flatten(xy_5))
data_2 = Data(python_2.axis_moving_pts_indices)

# ---- group: Fabrication planes
rev = ReverseList(List=pln_2)

# ----
pln_3 = Plane(flatten(rev))
rotate_3 = Rotate(Geometry=pln_3, Angle=-1.570796327, Plane=pln_3)  # -> Geometry, Transform

# ---- group: Define commands
safe_speed = Slider(25, range=0..300)
# 2
number_slider_7 = Slider(8, range=0..100)
speed = Slider(45, range=0..300)
planes_wcs = Plane(rotate_3.Geometry)
python_6 = PythonScript(planes_WCS=planes_wcs, dfillet=number_slider_7, speed=speed, safe_speed=safe_speed, safe_pt=rotate_2.Geometry)  # -> commands; inputs planes_WCS: list of Plane, speed: Int32, safe_pt: Plane
# ---------- python_6: Python ----------
import imp
from design import generate_commands as gcmds

imp.reload(gcmds)

commands = gcmds.generate_cmds(planes_WCS, dfillet, speed, safe_speed, safe_pt)

print commands[0]
# ---------- end python_6 ----------

# ----
item_6 = ListItem(List=planes_wcs, Index=0, Wrap=True)  # -> Item1, Item
pln_4 = Plane([item_6.Item1, item_6.Item])

# ----
# Visualisation
robot_2 = Data(robot)
pose_joints = Data(pose)
planes_wcs_2 = Plane(pln_4)

# ---- group: Calculate joint positions for path
# Add init joint states
joint_states = Data([-0.1728179112, -1.415058186, 1.813991282, -1.971940356, -1.571654205, -3.308720436])
init_configuration = Slider(0, range=0..7)
py_5 = PythonScript(robot=robot_2, planes_WCS=planes_wcs_2, configuration_idx=init_configuration, init_configuration=joint_states)  # -> configurations; inputs planes_WCS: list, configuration_idx: Int32, init_configuration: list
# ---------- py_5: Python ----------
from compas_ghpython import unload_modules
unload_modules('ur_online_control')
import Rhino.Geometry as rg
from compas.geometry import Frame 
from compas.geometry.xforms import Transformation
from compas_ghpython import xdraw_frame
from ur_online_control.ur.kinematics import calculate_configurations_for_path, format_joint_positions


# TODO this must be optimized! matrix multiplication!
frames_tool0_RCS = []
for plane_WCS in planes_WCS:
    tcp_WCS = Frame(plane_WCS.Origin, plane_WCS.XAxis, plane_WCS.YAxis)
    tcp_RCS = robot.get_frame_in_RCS(tcp_WCS)
    frames_tool0_RCS.append(robot.get_tool0_frame_from_tcp_frame(tcp_RCS))
    

#configurations = calculate_configurations_for_path(frames_tool0_RCS, robot.params, init_configuration)
configurations = calculate_configurations_for_path(frames_tool0_RCS, robot, init_configuration)
print configurations
configurations = configurations[min([configuration_idx, len(configurations) - 1])]

def format(numbers, k=4):
    #numbers = format_joint_positions(numbers)
    return "[" + ", ".join([("%." + str(k) + "f") % n for n in numbers]) + "]"
# ---------- end py_5 ----------
start_2 = Button()
stop_3 = Button()
step = Button()
counter = CountThroughList(L=py_5, start=start_2, stop=stop_3, step=step, step_back=back, reset=reset, interval=50)  # -> item; inputs L: list, start: Boolean, stop: Boolean, step_back: Boolean
# ---------- counter: Python ----------
from scriptcontext import sticky as st
from compas_ghpython import update_component


# store data in component
guid = str(ghenv.Component.InstanceGuid)
counter_key = "counter_" + guid
running_key = "running_" + guid

if counter_key not in st:
    st[counter_key] = 0

if running_key not in st:
    st[running_key] = False

if start:
    st[running_key] = True

if stop:
    st[running_key] = False

if step:
    if st[counter_key] < len(L) - 1:
        st[counter_key] += 1

if step_back:
    if st[counter_key] < len(L) - 1:
        st[counter_key] -= 1

if reset:
    st[counter_key] = 0

if len(L):
    item = L[st[counter_key]]

if st[running_key]:
    if st[counter_key] < len(L) - 1:
        st[counter_key] += 1
        update_component(ghenv, interval)
    else:
        st[counter_key] = 0
        st[running_key] = False
# ---------- end counter ----------

# ---- group: Define plane in WCS, calculate joint positions
pt_14 = Point(Point(-283.8412985, -342.877576, 297.4189147))
select_configuration = Slider(1, range=0..7)
xy_6 = XYPlane(Origin=pt_14)
plane_wcs = Plane(xy_6)
inverse = PythonScript(robot=robot_2, plane_WCS=plane_wcs, idx=select_configuration)  # -> configuration; inputs plane_WCS: Plane, idx: Int32
# ---------- inverse: Python ----------
import Rhino.Geometry as rg
from compas.geometry import Frame, Transformation
from compas_ghpython import xdraw_frame

tcp_WCS = Frame(plane_WCS.Origin, plane_WCS.XAxis, plane_WCS.YAxis)

# transform frame to robot coordinate system
tcp_RCS = robot.get_frame_in_RCS(tcp_WCS)

# get the frame of tool0
tool0_RCS = robot.get_tool0_frame_from_tcp_frame(tcp_RCS)

# calculate solutions to frame
solutions = robot.inverse_kinematics(tool0_RCS)

if not len(solutions):
    q = [0,0,0,0,0,0]
else:
    idx = min(len(solutions) - 1, idx)
    q = solutions[idx]
    
print q

configuration = q
# ---------- end inverse ----------

# ---- group: Calculate joint positions for path / Shows joint positions along path
flip = BooleanToggle(True)
l2t = PythonScript(L=py_5, flip=flip)  # -> T; inputs L: list, flip: Boolean
# ---------- l2t: Python ----------
from compas_ghpython import list_to_ghtree
L = [l.joint_values for l in L]

if flip:
    L = zip(*L)
T = list_to_ghtree(L)
# ---------- end l2t ----------
graph_5 = QuickGraph(l2t, SortOrder=0)

# ---- group: Visualise
list_9 = ValueList({"0 forward, from angles": 0, "1 inverse, from one plane": 1, "2 inverse, from multiple planes": 2, "3 forward, from robot": 3}, selected="2 inverse, from multiple planes")
filter_3 = StreamFilter(Gate=list_9, Stream0=py_3, Stream1=inverse, Stream2=counter, Stream3=pose_joints)
configuration = Panel(filter_3)
mesh = Mesh(filter)
draw = PythonScript(robot=robot_2, configuration=filter_3, mesh=mesh, brep=filter, show_brep=show_brep)  # -> meshes, tool0_plane, tcp_plane, robot_brep; inputs mesh: list, brep: list
# ---------- draw: Python ----------
from compas_ghpython import unload_modules
unload_modules("ur_online_control")

from compas_ghpython import xdraw_frame
from compas_ghpython import mesh_draw
from compas_ghpython.geometry.xforms import xform_from_transformation
from compas.geometry import Frame
from compas.geometry.xforms import Transformation
from ur_online_control.ur.robot import BaseConfiguration

import Rhino.Geometry as rg
import Rhino

def mesh_update_vertices(mesh, vertices):
    for i in range(len(vertices)):
        mesh.vertex[i].update({'x': vertices[i][0], 'y': vertices[i][1], 'z': vertices[i][2]})

if configuration:
    #print configuration
    #q = BaseConfiguration.from_joints(configuration)
    q = configuration
    print q
    print q.joint_values
    
    print robot.get_forward_transformations(q)
    R0, R1, R2, R3, R4, R5 = robot.get_forward_transformations(q)
    
    tool0_frame2 = robot.tool0_frame.transformed(R5)
    tcp_frame2 = Frame.from_transformation(Transformation.from_frame(tool0_frame2) * robot.transformation_tool0_tcp)
    
    print robot.transformation_tool0_tcp
    print robot.transformation_tcp_tool0
    print robot.transformation_tool0_tcp * robot.transformation_tcp_tool0
    print tcp_frame2
    tcp_frame2 = Frame.from_transformation(Transformation.from_frame(tool0_frame2) * robot.transformation_tcp_tool0)
    print tcp_frame2
    
    tool0_frame, tcp_frame = robot.get_transformed_tool_frames(R5)
    
    tool0_frame = tool0_frame2
    tcp_frame = tcp_frame2
    
    m0, m1, m2, m3, m4, m5 = mesh
    for i in range(6):
        exec("R%drg = xform_from_transformation(R%d)" % (i, i))
        exec("m%d.Transform(R%drg)" % (i, i))
    meshes = [m0, m1, m2, m3, m4, m5]
    print meshes
    mt = robot.tool.get_transformed_model(Transformation.from_frame(tool0_frame))
    
    if mt:
        meshes.extend(map(mesh_draw, mt))
    
    """
    m0, m1, m2, m3, m4, m5, tool0_frame, tcp_frame = robot.get_transformed_model(q)
    mt = robot.get_transformed_tool_model(tcp_frame)
    
    meshes = []
    meshes.append(mesh_draw(m0))
    meshes.append(mesh_draw(m1))
    meshes.append(mesh_draw(m2))
    meshes.append(mesh_draw(m3))
    meshes.append(mesh_draw(m4))
    meshes.append(mesh_draw(m5))
    if mt:
        meshes.append(mesh_draw(mt))
    
    """
    
    tool0_plane = xdraw_frame(tool0_frame)
    tcp_plane = xdraw_frame(tcp_frame)
    
    if show_brep:
        
        b0, b1, b2, b3, b4, b5 = brep
        
        b0.Transform(R0rg)
        b1.Transform(R1rg)
        b2.Transform(R2rg)
        b3.Transform(R3rg)
        b4.Transform(R4rg)
        b5.Transform(R5rg)
        
        robot_brep = [b0, b1, b2, b3, b4, b5]
# ---------- end draw ----------
tool0_plane = Plane(draw.tool0_plane)
tcp_plane = Plane(draw.tcp_plane)
robot_brep = Brep(draw.robot_brep)
draw_2 = RepresentPlaneAsLines(plane=tcp_plane, size=100)  # -> G, C
# ---------- draw_2: Python ----------
import Rhino.Geometry as rg
from System.Drawing import Color

if plane:

    G = []
    G.append(rg.Line(plane.Origin, size * plane.XAxis))
    G.append(rg.Line(plane.Origin, size * plane.YAxis))
    G.append(rg.Line(plane.Origin, size * plane.ZAxis))
    
    C = []
    C.append(Color.FromArgb(255, 0, 0))
    C.append(Color.FromArgb(0, 255, 0))
    C.append(Color.FromArgb(0, 0, 255))
# ---------- end draw_2 ----------
preview_3 = CustomPreview(Geometry=draw_2.G, Shader=draw_2.C)
preview_4 = CustomPreview(Geometry=draw.meshes, Shader=ColourSwatch(SwatchColor=RGBA(99, 94, 94, 96)))

# ---- group: Linear axis indices
rev_2 = ReverseList(List=data_2)

# ----
move_filament_loading_pt = BooleanToggle(False)
continue_fabrication = BooleanToggle(True)
# 3
panel_25 = Panel("Send a message")
move_linear_axis = BooleanToggle(True)
send_2 = Button()
commands = Data(python_6)
data_3 = Data(rev_2)
send_3 = PythonScript(
    client=client.client,
    send=send_2,
    continue_fabrication=continue_fabrication,
    commands=commands,
    move_filament_loading_pt=move_filament_loading_pt,
    move_linear_axis=move_linear_axis,
    axis_moving_pts_indices=data_3)  # -> out, all_batches; inputs continue_fabrication: Int32, commands: list, move_filament_loading_pt: Boolean, axis_moving_pts_indices: list
# ---------- send_3: Python ----------
from ur_online_control.communication.msg_identifiers import *
from ur_online_control.utilities.lists import flatten_list
from time import sleep


def chunks(inputList, n):
    """Yield successive n-sized chunks from inputList """
    for i in xrange(0, len(inputList), n):
        yield inputList[i:i + n]

#number of values per command to be formatted 
len_command = len(commands[0])
commands_flattened = flatten_list(commands)


#set the desired batch length
commandsPerBatch = 200 
batchLen = len_command*commandsPerBatch

all_chunks = chunks(commands_flattened,batchLen)

all_batches = [item for item in all_chunks]

##check if batching returns the same list
#all_batches_f = flatten_list(all_batches)
#print all_batches_f == commands_flattened

numOfBatches = len(all_batches)
lastBatchLen = len(all_batches[-1])
numOfCommands = len(commands_flattened)/len_command


#to print in gh panel
print len_command, "values each command"
print numOfCommands, "commands." , len(commands_flattened), "values"
print "%d batches. each batch has %d commands and %d values"%(numOfBatches,batchLen/len_command,batchLen)
print "including last batch which has %d commands and %d values"%(lastBatchLen/len_command,lastBatchLen)


if move_filament_loading_pt:
    print "Moving to filament loading point"
else:
    print "Skipping filament loading point"

if move_linear_axis:
    print "Moving the linear axis"
else:
    print "Skipping the linear axis"


if send and client:
    client.send(MSG_INT, int(continue_fabrication))
    client.send(MSG_INT, int(move_filament_loading_pt))
    client.send(MSG_INT, int(move_linear_axis))
    client.send(MSG_FLOAT_LIST, axis_moving_pts_indices)
    client.send(MSG_INT, len_command)
    client.send(MSG_INT, numOfBatches)
    for i in range(numOfBatches):
        print i
        client.send(MSG_FLOAT_LIST, all_batches[i])
# ---------- end send_3 ----------

panel_26 = Panel(send_3.out)
X_6 = UnitX(Factor=offset_for_stirrup_vertical_intersection)

# ---- group: Send joint position directly to robot
panel_27 = Panel("move cartesian")
idx = Slider(0, range=0..100)
commands_2 = Data(python_6)
item_7 = ListItem(List=commands_2, Index=idx, Wrap=True)
list_10 = ValueList({"send all positions": 0, "send only one position": 1}, selected="send only one position")
filter_4 = StreamFilter(Gate=list_10, Stream0=commands_2, Stream1=item_7)
movel = PythonScript(commands=filter_4, velocity=Slider(100, range=0..100))  # -> script; inputs commands: list
# ---------- movel: Python ----------
from scriptcontext import sticky as st

script_lines = []
for cmd in commands:
    #q, a=1.4, v=1.05, t=0, r=0)
    x, y, z, ax, ay, az, speed, radius = cmd
    script_lines.append("movel(p%s, v=%f, r=%f)" % (str([x/1000., y/1000., z/1000, ax, ay, az]), speed/1000., radius/1000.))

robot = st["robot"]
tool_angle_axis = list(robot.tool.tcp_frame.point) + robot.tool.tcp_frame.axis_angle_vector
x, y, z, ax, ay, az = tool_angle_axis

script = "def prog():\n"
script += "\ttextmsg(\">> program start\")\n"
script += "\tset_tcp(p%s)\n" % str([x/1000., y/1000., z/1000, ax, ay, az])
script += "".join(["\t%s\n" % line for line in script_lines])
script += "\ttextmsg(\"<< program end\")\n"
script += "end\n"
script += "prog()\n\n"

print script
# ---------- end movel ----------
send_4 = Button()
send_5 = Send(script=movel, send=send_4)
panel_28 = Panel(send_5)

# ----
panel_29 = Panel("set digital out")
number = Slider(2, range=0..10)
value = BooleanToggle(False)
digital_out = PythonScript(number=number, value=value)  # -> script; inputs number: Int32, value: Boolean
# ---------- digital_out: Python ----------
script = "def prog():\n"
script += "\ttextmsg(\">> program start\")\n"
script += "\tset_digital_out(%i, %s)\n" % (int(number), str(value))
script += "\ttextmsg(\"<< program end\")\n"
script += "end\n"
script += "prog()\n\n"

print script
# ---------- end digital_out ----------
send_6 = Button()
send_7 = Send(script=digital_out, send=send_6)
panel_30 = Panel(send_7)

panel_31 = Panel("move vertical")
movel_2 = PythonScript()  # -> script
# ---------- movel_2: Python ----------
from scriptcontext import sticky as st

robot = st["robot"]
tool_angle_axis = list(robot.tool.tcp_frame.point) + robot.tool.tcp_frame.axis_angle_vector
x, y, z, ax, ay, az = tool_angle_axis

script = "def prog():\n"
script += "\ttextmsg(\">> program start\")\n"
script += "\tset_tcp(p%s)\n" % str([x/1000., y/1000., z/1000, ax, ay, az])
script += "\tcurrent_pose = get_forward_kin()\n"
script += "\tmovel(p[current_pose[0], current_pose[1], current_pose[2], 0, 0, 0], a=0.1, v=0.1)\n"
script += "\ttextmsg(\"<< program end\")\n"
script += "end\n"
script += "prog()\n\n"

print script
# ---------- end movel_2 ----------
send_8 = Button()
send_9 = Send(script=movel_2, send=send_8)
panel_32 = Panel(send_9)

X_7 = UnitX(Factor=1)
X_8 = UnitX(Factor=expr("-x", offset_for_stirrup_diagonal_intersection))
Z_5 = UnitZ(Factor=Slider(70, range=0..1000))

# ----
# move incremental in TCS
get_current_pose = Button()
list_11 = ValueList({"xaxis", "yaxis", "zaxis"}, selected="zaxis")
movel_3 = PythonScript(get=get_current_pose, step_size=Slider(5, range=-10..10), direction=list_11)  # -> script; inputs get: list
# ---------- movel_3: Python ----------
from scriptcontext import sticky as st
from compas.geometry import Frame
from compas.geometry import Point, Vector
from ur_online_control.ur_direct import get_current_pose_cartesian

server_address = st["server_address"]
server_port = 30005
ur_ip = st["ur_ip"]
robot = st["robot"]
tool_angle_axis = list(robot.tool.tcp_frame.point) + robot.tool.tcp_frame.axis_angle_vector
print tool_angle_axis

guid = str(ghenv.Component.InstanceGuid)
pose_cartesian_key = "pose_cartesian" + guid

if get:
    st[pose_cartesian_key] = get_current_pose_cartesian(server_address, server_port, ur_ip, tool_angle_axis)

if pose_cartesian_key not in st:
    pose_cartesian = []
    script = ""
else:
    pose_cartesian = st[pose_cartesian_key]

    robot = st["robot"]
    tool_angle_axis = list(robot.tool.tcp_frame.point) + robot.tool.tcp_frame.axis_angle_vector
    x, y, z, ax, ay, az = tool_angle_axis
    
    script = "def prog():\n"
    script += "\ttextmsg(\">> program start\")\n"
    script += "\tset_tcp(p%s)\n" % str([x/1000., y/1000., z/1000, ax, ay, az])
    script += "\tcurrent_pose = get_forward_kin()\n"
    
#    frame = Frame.from_pose_axis_angle_vector(pose_cartesian)
    frame = Frame.from_axis_angle_vector([ax, ay, az])
    frame.point = [x, y, z]

    if direction == "xaxis":
        next_vector = Vector(*frame.xaxis) * step_size
    elif direction == "yaxis":
        next_vector = Vector(*frame.yaxis) * step_size
    else: # direction == "zaxis":
        next_vector = Vector(*frame.zaxis) * step_size
    
    x, y, z = next_vector
    script += "\tmovel(p[current_pose[0] + %f, current_pose[1] + %f, current_pose[2] + %f, current_pose[3], current_pose[4], current_pose[5]], t=%f)\n" % (x/1000., y/1000., z/1000., step_size * 0.1)
    
    script += "\ttextmsg(\"<< program end\")\n"
    script += "end\n"
    script += "prog()\n\n"
    
    print script
# ---------- end movel_3 ----------
send_10 = Button()
send_11 = Send(script=movel_3, send=send_10)
panel_33 = Panel(send_11)

# ----
# move incremental in WCS
number_slider_8 = Slider(5, range=-10..10)
list_12 = ValueList({"xaxis", "yaxis", "zaxis"}, selected="zaxis")
movel_4 = PythonScript(step_size=number_slider_8, direction=list_12)  # -> script
# ---------- movel_4: Python ----------
from scriptcontext import sticky as st

robot = st["robot"]
tool_angle_axis = list(robot.tool.tcp_frame.point) + robot.tool.tcp_frame.axis_angle_vector
x, y, z, ax, ay, az = tool_angle_axis

script = "def prog():\n"
script += "\ttextmsg(\">> program start\")\n"
script += "\tset_tcp(p%s)\n" % str([x/1000., y/1000., z/1000, ax, ay, az])
script += "\tcurrent_pose = get_forward_kin()\n"


if direction == "xaxis":
    script += "\tmovel(p[current_pose[0] + %f, current_pose[1], current_pose[2], current_pose[3], current_pose[4], current_pose[5]], t=%f)\n" % (step_size/1000., step_size * 0.1)

elif direction == "yaxis":
    script += "\tmovel(p[current_pose[0], current_pose[1] + %f, current_pose[2], current_pose[3], current_pose[4], current_pose[5]], t=%f)\n" % (step_size/1000., step_size * 0.1)

else: # direction == "zaxis":
    script += "\tmovel(p[current_pose[0], current_pose[1], current_pose[2] + %f, current_pose[3], current_pose[4], current_pose[5]], t=%f)\n" % (step_size/1000., step_size * 0.1)

script += "\ttextmsg(\"<< program end\")\n"
script += "end\n"
script += "prog()\n\n"

print script
# ---------- end movel_4 ----------
send_12 = Button()
send_13 = Send(script=movel_4, send=send_12)
panel_34 = Panel(send_13)

addition_8 = Addition(A=diameter_vertical, B=diameter_stirrup)
X_9 = UnitX(Factor=addition_8)
Z_6 = UnitZ(Factor=Slider(0, range=0..10))
X_10 = UnitX(Factor=Slider(14, range=0..100))
X_11 = UnitX(Factor=Slider(90, range=0..1000))
subtraction_8 = Subtraction(A=addition_8, B=Slider(28, range=-11..50))
X_12 = UnitX(Factor=subtraction_8)
number_slider_9 = Slider(5, range=0..100)
number_slider_10 = Slider(35, range=0..100)
X_13 = UnitX(Factor=Slider(15, range=0..100))
pt_15 = Point(<point referenced from the Rhino model>)
pt_16 = Point(<point referenced from the Rhino model>)
pt_17 = Point(<point referenced from the Rhino model>)
pt_18 = Point(<point referenced from the Rhino model>)
pt_19 = Point(<point referenced from the Rhino model>)
pt_20 = Point(<point referenced from the Rhino model>)
xz = XZPlane(Origin=Point(0, 0, 0))
xy_7 = XYPlane(Origin=pt_15)
xy_8 = XYPlane(Origin=pt_17)
xy_9 = XYPlane(Origin=pt_16)
xy_10 = XYPlane(Origin=pt_18)
xy_11 = XYPlane(Origin=pt_19)
xy_12 = XYPlane(Origin=pt_20)
rotate_4 = Rotate(Geometry=xy_7, Angle=degrees(90), Plane=xy_7)  # -> Geometry, Transform
rotate_5 = Rotate(Geometry=xy_12, Angle=degrees(90), Plane=xy_12)  # -> Geometry, Transform
pt_21 = Point(<point referenced from the Rhino model>)
panel_35 = Panel("15.000")
xy_13 = XYPlane(Origin=Point(0, 0, 0))
addition_9 = Addition(A=diameter_vertical, B=diameter_transversal_stirrup)
cp = ControlPoints()  # -> Points, Weights, Knots
rebar_radius = Slider(7, range=0..10)
rebar_radius_2 = Slider(5, range=0..10)
tolerance = Slider(5, range=0..10)
concrete_cover = Slider(30, range=0..40)
rebar_radius_3 = Slider(9, range=0..10)
addition_10 = Addition(A=rebar_radius_3, B=tolerance, C=concrete_cover)
addition_11 = Addition(A=rebar_radius, B=tolerance, C=concrete_cover)
addition_12 = Addition(A=rebar_radius_2, B=tolerance, C=concrete_cover)

# ---- group: TOP COLUMN
panel_36 = Panel("1900")

# ----
pt_22 = ConstructPoint(XCoordinate=pdecon.XComponent, YCoordinate=pdecon.YComponent, ZCoordinate=panel_36)

# ---- group: TOP COLUMN (continued)
pt_23 = Point(pt_22)

# ---- group: BOTTOM COLUMN
panel_37 = Panel("-210")

# ----
pt_24 = ConstructPoint(XCoordinate=pdecon.XComponent, YCoordinate=pdecon.YComponent, ZCoordinate=panel_37)

# ---- group: BOTTOM COLUMN (continued)
pt_25 = Point(pt_24)

# ---- group: BOTTOM OF COLUMN
pt_26 = Point(pt_25)

# ----
circle = CircleCNR(Center=pt_26, Normal=Vector(0, 0, 1), Radius=Slider(200, range=0..1000))
move_3 = Move(Geometry=pt_26, Motion=X_4)  # -> Geometry, Transform
pdecon_6 = Deconstruct(Point=move_3.Geometry)  # -> XComponent, YComponent, ZComponent
move_4 = Move(Geometry=pt_26, Motion=X_2)  # -> Geometry, Transform
addition_13 = Addition(A=pdecon_6.ZComponent, B=z_height_cage)
subtraction_9 = Subtraction(A=addition_13, B=threaded_rod_depth_into_column)
move_5 = Move(Geometry=pt_26, Motion=X_3)  # -> Geometry, Transform
cage_bottompt = Point(move_4.Geometry)
pt_27 = ConstructPoint(XCoordinate=pdecon_6.XComponent, YCoordinate=pdecon_6.YComponent, ZCoordinate=subtraction_9)
move_6 = Move(Geometry=cage_bottompt, Motion=Z_2)  # -> Geometry, Transform
move_7 = Move(Geometry=move_5.Geometry, Motion=Z_2)  # -> Geometry, Transform
move_8 = Move(Geometry=pt_26, Motion=addition_5)  # -> Geometry, Transform
rebar = PythonScript(
    start_pt=pt_26,
    u_bars=amount_of_bars,
    bar_size=Slider(18, range=0..30),
    radius=radius,
    rotation=rotation,
    bar_height=barheight,
    stirrup_distance=stirrup_distance,
    stirrup_size=stirrup_size)  # -> out, lines, bars, base, stirrups; inputs start_pt: Point3d, bar_height: Int32, stirrup_distance: Int32
# ---------- rebar: Python ----------
import Rhino.Geometry as rg
import math

bar_pipes = []
bar_lines = []
stirrup_pipes = []

start_circle = rg.Circle(start_pt, radius)
start_curve = start_circle.ToNurbsCurve()
xform = rg.Transform.Rotation(math.radians(rotation), start_pt)
start_curve.Transform(xform)
params = rg.Curve.DivideByCount(start_curve, u_bars, True)

for param in params:
    # inner rebar generation
    bar_pt = rg.Curve.PointAt(start_curve, param)
    bar_line = rg.Line(bar_pt, rg.Vector3d.ZAxis, bar_height)
    bar_lines.append(bar_line)
    bar_curve = rg.Line.ToNurbsCurve(bar_line)

    # create pipe
    bar_pipe = rg.Brep.CreatePipe(bar_curve, bar_size / 2, False, 0, True, 0.01, 0.01)
    for pipe in bar_pipe:
        bar_pipes.append(pipe)

stirrup_no = bar_height / stirrup_distance
print stirrup_distance

for j in range(int(stirrup_no+1)):
    print j
    stirrup = rg.Circle(rg.Point3d(start_pt[0], start_pt[1], start_pt[2] + stirrup_distance * j), radius + bar_size/2 + stirrup_size / 2)
    
    stirrup_curve = rg.Circle.ToNurbsCurve(stirrup)
    stirrup_pipe = rg.Brep.CreatePipe(stirrup_curve, stirrup_size / 2, False, 0, True, 0.01, 0.01)
    for pipe in stirrup_pipe:
        stirrup_pipes.append(pipe)
    
    

start_pt_adjusted = rg.Point3d(start_pt[0] - 125, start_pt[1] - 125, start_pt[2])
start_plane = rg.Plane(start_pt_adjusted, rg.Vector3d.ZAxis)
base = rg.Rectangle3d(start_plane, 250, 250)
lines = bar_lines
bars = bar_pipes
stirrups = stirrup_pipes
# ---------- end rebar ----------

addition_14 = Addition(A=layer_count, B=top_extra_layers)
Z_7 = UnitZ(Factor=1)
pt_28 = Point(pt_25)
_110_pipe_radius = Slider(55, range=0..100)
line_3 = LineSDL(Start=pt_28, Direction=Z_7, Length=addition_14)

cage_toppt = Point(move_6.Geometry)
stirrup_top_insidept = Point(move_7.Geometry)
stirrup_midpt = Point(move_8.Geometry)
line_4 = LineSDL(Start=pt_27, Direction=Vector(0, 0, 1), Length=length_of_threaded_rod)
move_9 = Move(Geometry=cage_toppt, Motion=X_5)  # -> Geometry, Transform
stirrup_top_outsidept = Point(move_9.Geometry)

# ---- group: waterPipe
pipe = Pipe(Curve=line_3, Radius=_110_pipe_radius, Caps=0)

# ----
ln_5 = Line(StartPoint=stirrup_top_insidept, EndPoint=stirrup_top_outsidept)
ln_6 = Line(StartPoint=stirrup_midpt, EndPoint=stirrup_top_outsidept)
ln_7 = Line(StartPoint=stirrup_top_insidept, EndPoint=stirrup_midpt)
ln_8 = Line(StartPoint=cage_bottompt, EndPoint=cage_toppt)
move_10 = Move(Geometry=stirrup_midpt, Motion=Z_4)  # -> Geometry, Transform
eval = EvaluateLength(Curve=ln_7, Length=extension_top_large_stirrup, Normalized=False)  # -> Point, Tangent, Parameter
ln_9 = Line(StartPoint=stirrup_midpt, EndPoint=stirrup_top_outsidept)
ln_10 = Line(StartPoint=stirrup_top_insidept, EndPoint=eval.Point)
bottom_stirruppt = Point(move_10.Geometry)
end_2 = EndPoints(Curve=ln_10)  # -> Start, End
end_3 = EndPoints(Curve=ln_9)  # -> Start, End

# ---- group: pipe
brep_2 = Brep(pipe)

# ----
pt_29 = Point(end_2.End)
pt_30 = Point(end_2.Start)
pt_31 = Point(end_3.End)
pt_32 = Point(end_3.Start)
join_4 = JoinCurves(Curves=[ln_10, ln_5], Preserve=False)
ln_11 = Line(StartPoint=stirrup_midpt, EndPoint=bottom_stirruppt)
end_4 = EndPoints(Curve=ln_11)  # -> Start, End
pt_33 = Point(end_4.End)
pline = PolyLine(Vertices=[pt_29, pt_30, pt_31, pt_32, pt_33], Closed=False)
fillet = Fillet(Curve=pline, Radius=Slider(42, range=0..100))
crv_11 = Curve(line_4)
fillet_2 = Fillet(Curve=join_4, Radius=fillet_radius_large_stirrup_vertical)
join_5 = JoinCurves(Curves=flatten([fillet_2, ln_9]), Preserve=False)
fillet_3 = Fillet(Curve=join_5, Radius=fillet_radius_large_stirrup_diagonal)
join_6 = JoinCurves(Curves=flatten([fillet_3, ln_11]), Preserve=False)
disc = Discontinuity(Curve=join_6, Level=1)  # -> Points, Parameters
item_8 = ListItem(List=disc.Parameters, Index=0, Wrap=True)
rotate_6 = Rotate(Geometry=graft(crv_11), Angle=degrees(series), Plane=pt_26)  # -> simplify(Geometry), Transform
fillet_4 = Fillet(Curve=join_6, Parameter=item_8, Radius=fillet_radius_large_stirrup_middle_secti)  # -> Curve, Parameter
rotate_7 = Rotate(Geometry=rotate_6.Geometry, Angle=degrees(number_slider_5), Plane=pt_26)  # -> Geometry, Transform
pipe_2 = Pipe(Curve=rotate_7.Geometry, Radius=addition_7, Caps=0)
cage_vertical = Curve(ln_8)
flip_2 = FlipCurve(Curve=cage_vertical)  # -> Curve, Flag
eval_2 = EvaluateLength(Curve=flip_2.Curve, Length=position_of_small_rebars_distance_from_t, Normalized=False)  # -> Point, Tangent, Parameter
move_11 = Move(Geometry=eval_2.Point, Motion=X_6)  # -> Geometry, Transform
line_5 = LineSDL(Start=eval_2.Point, Direction=X_7, Length=1)
llx = LineLine(Line1=ln_9, Line2=line_5)  # -> ParamA, ParamB, PointA, PointB
move_12 = Move(Geometry=llx.PointA, Motion=X_8)  # -> Geometry, Transform
cull_2 = CullPattern(List=eval_2.Point, CullPattern=[False, True])  # -> graft(List)
cull_3 = CullPattern(List=eval_2.Point, CullPattern=[True, False])  # -> graft(List)
cull_4 = CullPattern(List=move_12.Geometry, CullPattern=[True, False])  # -> graft(List)
cull_5 = CullPattern(List=move_12.Geometry, CullPattern=[False, True])  # -> graft(List)
cull_6 = CullPattern(List=move_11.Geometry, CullPattern=[False, True])  # -> graft(List)
cull_7 = CullPattern(List=move_11.Geometry, CullPattern=[True, False])  # -> graft(List)
move_13 = Move(Geometry=cull_7, Motion=expr("-x", Z_5))  # -> Geometry, Transform
move_14 = Move(Geometry=cull_3, Motion=Z_6)  # -> Geometry, Transform
move_15 = Move(Geometry=move_14.Geometry, Motion=X_11)  # -> Geometry, Transform
pt3 = Point(cull_4)
pt4 = Point(cull_5)
move_16 = Move(Geometry=pt4, Motion=expr("-x", X_10))  # -> Geometry, Transform
move_17 = Move(Geometry=pt3, Motion=expr("-x", X_10))  # -> Geometry, Transform
pt2 = Point(cull_7)
pt1 = Point(move_13.Geometry)
pt5 = Point(cull_2)
pt6 = Point(move_14.Geometry)
move_18 = Move(Geometry=pt6, Motion=X_13)  # -> Geometry, Transform
move_19 = Move(Geometry=pt5, Motion=X_13)  # -> Geometry, Transform
pt7 = Point(move_15.Geometry)
move_20 = Move(Geometry=pt1, Motion=expr("x/2", X_12))  # -> Geometry, Transform
move_21 = Move(Geometry=pt6, Motion=expr("x/2", X_9))  # -> Geometry, Transform
move_22 = Move(Geometry=pt5, Motion=expr("x/2", X_9))  # -> Geometry, Transform
move_23 = Move(Geometry=pt2, Motion=expr("x/2", X_12))  # -> Geometry, Transform
pt1_2 = Point(move_20.Geometry)
pt2_2 = Point(move_23.Geometry)
pt3_2 = Point(move_17.Geometry)
pt4_2 = Point(move_16.Geometry)
pt5_2 = Point(move_19.Geometry)
pt6_2 = Point(move_18.Geometry)
pt7_2 = Point(pt7)
xz_2 = XZPlane(Origin=pt1_2)
xz_3 = XZPlane(Origin=pt_29)
pline_2 = PolyLine(Vertices=[pt1_2, pt2_2, pt3_2, pt4_2, pt5_2, pt6_2, pt7_2], Closed=False)
orient_3 = Orient(Geometry=pline_2, Source=xz_2, Target=graft([xy_8, xy_9, xy_10]))  # -> Geometry, Transform
disc_2 = Discontinuity(Curve=orient_3.Geometry, Level=1)  # -> Points, Parameters
orient_4 = Orient(Geometry=[pt_29, pt_30, pt_31, pt_32, pt_33], Source=xz_3, Target=rotate_5.Geometry)  # -> Geometry, Transform
fillet_5 = Fillet(Curve=flatten(pline_2), Radius=fillet_radius_stirrups)
item_9 = ListItem(List=orient_4.Geometry, Index=0, Wrap=True)  # -> Item, Item1, Item2, Item3, Item4

small_stirrups = Curve(simplify(fillet_5))
large_stirrup = Curve(fillet)
cage_vertical_2 = Curve(cage_vertical)

end_5 = EndPoints(Curve=cage_vertical_2)  # -> Start, End
orient_5 = Orient(Geometry=[end_5.Start, end_5.End], Source=xz_3, Target=rotate_4.Geometry)  # -> Geometry, Transform
item_10 = ListItem(List=orient_5.Geometry, Index=0, Wrap=True)  # -> Item, Item1
item_11 = ListItem(List=disc_2.Points, Index=0, Wrap=True)  # -> Item, Item1, Item2, Item3, Item4, Item5, Item6
pt_34 = Point(item_11.Item1)
pt_35 = Point(item_11.Item)
len_3 = Length(Curve=cage_vertical_2)
len_4 = Length(Curve=large_stirrup)
len_5 = Length(Curve=small_stirrups)

# ---- group: Threaded rods
pipe_3 = Pipe(Curve=line_4, Radius=expr("x/2", diameter_threaded_rod_top), Caps=1)

# ---- group: Diagonal bars
pipe_4 = Pipe(Curve=large_stirrup, Radius=expr("x/2", diameter_diagonal), Caps=1)

# ----
geo = Geometry(pipe_4)

# ---- group: Vertical bars
pipe_5 = Pipe(Curve=cage_vertical_2, Radius=expr("x/2", diameter_vertical), Caps=1)

# ---- group: Stirrups
pipe_6 = Pipe(Curve=small_stirrups, Radius=expr("x/2", diameter_stirrup), Caps=1)

# ----
ln_12 = Line(StartPoint=item_10.Item, EndPoint=item_10.Item1)
panel_38 = Panel(len_4)
panel_39 = Panel(len_3)
panel_40 = Panel(len_5)
pline_3 = PolyLine(
    Vertices=[item_11.Item, item_11.Item1, item_11.Item2, item_11.Item3, item_11.Item4, item_11.Item5, item_11.Item6],
    Closed=False)
geo_2 = Geometry(flatten([cage_vertical_2, large_stirrup, small_stirrups, line_4]))

# ---- group: Unrotated cage lines
geo_3 = Geometry(geo_2)

# ----
geo_4 = Geometry(flatten([pipe_5, pipe_4, pipe_6, pipe_3]))

# ---- group: Unrotated cage pipes
geo_5 = Geometry(geo_4)

# ----
fillet_6 = Fillet(Curve=flatten(pline_3), Radius=fillet_radius_stirrups)
len_6 = Length(Curve=fillet_6)
panel_41 = Panel(len_6)
rotate_8 = Rotate(Geometry=graft(geo_2), Angle=degrees(series), Plane=pt_26)  # -> simplify(Geometry), Transform
rotate_9 = Rotate(Geometry=graft(geo_4), Angle=degrees(series), Plane=pt_26)  # -> simplify(Geometry), Transform
pipe_7 = Pipe(Curve=ln_12, Radius=expr("x/2", diameter_vertical), Caps=0)
orient_6 = Orient(Geometry=geo, Source=xz_3, Target=rotate_5.Geometry)  # -> Geometry, Transform
pipe_8 = Pipe(Curve=fillet_6, Radius=expr("x/2", diameter_stirrup), Caps=0)

bang_3 = ExplodeTree(Data=rotate_8.Geometry)
flip_3 = FlipCurve(Curve=bang_3)  # -> Curve, Flag
divdist = DivideDistance(Curve=flip_3.Curve, Distance=distance_between_transversal_stirrups)  # -> Points, Tangents, Parameters
flip_4 = FlipMatrix(Data=divdist.Points)
intcrv = Interpolate(Vertices=flip_4, Degree=3, Periodic=True, KnotStyle=1)  # -> Curve, Length, Domain
offset = OffsetCurve(Curve=flatten(intcrv.Curve), Distance=expr("x/2", addition_9), Plane=PlaneXY(0, 0, 0), Corners=1)
pipe_9 = Pipe(Curve=flatten(offset), Radius=expr("x/2", diameter_transversal_stirrup), Caps=0)

bang_4 = ExplodeTree(Data=offset)
orient_7 = Orient(Geometry=bang_4, Source=pt_26, Target=pt_21)  # -> Geometry, Transform
curvepoint = PointOnCurve(orient_7.Geometry, parameter=0.5)
end_6 = EndPoints(Curve=orient_7.Geometry)  # -> Start, End
len_7 = Length(Curve=orient_7.Geometry)
panel_42 = Panel(len_7)
pipe_10 = Pipe(Curve=flatten(orient_7.Geometry), Radius=expr("x/2", diameter_transversal_stirrup), Caps=0)
geo_6 = Geometry([pipe_7, pipe_10, orient_6.Geometry, pipe_8])

# ---- group: BAKE THIS
aligndim = AlignedDimension(Plane=xy_13, PointA=item_10.Item, PointB=item_10.Item1, Offset=number_slider_10, Text="{0:0.00}", Size=number_slider_9)
aligndim_2 = AlignedDimension(Plane=xy_13, PointA=item_11.Item, PointB=item_11.Item1, Offset=number_slider_10, Text="{0:0.00}", Size=number_slider_9)
aligndim_3 = AlignedDimension(Plane=xy_13, PointA=item_9.Item, PointB=item_9.Item1, Offset=number_slider_10, Text="{0:0.00}", Size=number_slider_9)
aligndim_4 = AlignedDimension(Plane=xy_13, PointA=item_11.Item1, PointB=item_11.Item2, Offset=number_slider_10, Text="{0:0.00}", Size=number_slider_9)
aligndim_5 = AlignedDimension(Plane=xy_13, PointA=item_9.Item1, PointB=item_9.Item2, Offset=number_slider_10, Text="{0:0.00}", Size=number_slider_9)
aligndim_6 = AlignedDimension(Plane=xy_13, PointA=item_11.Item2, PointB=item_11.Item3, Offset=number_slider_10, Text="{0:0.00}", Size=number_slider_9)
aligndim_7 = AlignedDimension(Plane=xy_13, PointA=item_9.Item2, PointB=item_9.Item3, Offset=number_slider_10, Text="{0:0.00}", Size=number_slider_9)
aligndim_8 = AlignedDimension(Plane=xy_13, PointA=item_11.Item3, PointB=item_11.Item4, Offset=number_slider_10, Text="{0:0.00}", Size=number_slider_9)
aligndim_9 = AlignedDimension(Plane=xy_13, PointA=item_9.Item3, PointB=item_9.Item4, Offset=number_slider_10, Text="{0:0.00}", Size=number_slider_9)
aligndim_10 = AlignedDimension(
    Plane=xy_13,
    PointA=end_6.Start,
    PointB=curvepoint,
    Offset=Slider(165, range=0..1000),
    Text="{0:0.00}",
    Size=number_slider_9)
aligndim_11 = AlignedDimension(Plane=xy_13, PointA=item_11.Item4, PointB=item_11.Item5, Offset=number_slider_10, Text="{0:0.00}", Size=number_slider_9)
aligndim_12 = AlignedDimension(Plane=xy_13, PointA=item_11.Item5, PointB=item_11.Item6, Offset=number_slider_10, Text="{0:0.00}", Size=number_slider_9)
angledim = AngularDimension(Center=item_11.Item3, PointA=item_11.Item2, PointB=item_11.Item4, Reflex=False, Text="{0:0.0}°", Size=number_slider_9)

# ---- group: CURVES
crv_12 = Curve([rotate_8.Geometry, offset])

# ---- group: Full cage lines
rotate_10 = Rotate(Geometry=crv_12, Angle=degrees(number_slider_5), Plane=pt_26)  # -> Geometry, Transform
geo_7 = Geometry(rotate_10.Geometry)

# ---- group: GEOMETRY
geo_8 = Geometry([rotate_9.Geometry, pipe_9])

# ---- group: Full cage pipes
rotate_11 = Rotate(Geometry=geo_8, Angle=degrees(number_slider_5), Plane=pt_26)  # -> Geometry, Transform
geo_9 = Geometry(rotate_11.Geometry)

# ----
unrotated_geomery = Geometry(geo_4)
angledim_2 = AngularDimension(Center=item_9.Item2, PointA=item_9.Item1, PointB=item_9.Item3, Reflex=False, Text="{0:0.0}°", Size=number_slider_9)
angledim_3 = AngularDimension(Center=item_9.Item3, PointA=item_9.Item2, PointB=item_9.Item4, Reflex=False, Text="{0:0.0}°", Size=number_slider_9)
rotate_12 = Rotate(Geometry=graft(cage_vertical_2), Angle=degrees(series), Plane=pt_26)  # -> simplify(Geometry), Transform
rotate_13 = Rotate(Geometry=graft(large_stirrup), Angle=degrees(series), Plane=pt_26)  # -> simplify(Geometry), Transform
rotate_14 = Rotate(Geometry=graft(small_stirrups), Angle=degrees(series), Plane=pt_26)  # -> simplify(Geometry), Transform
rotate_15 = Rotate(Geometry=rotate_12.Geometry, Angle=degrees(number_slider_5), Plane=pt_26)  # -> Geometry, Transform
rotate_16 = Rotate(Geometry=rotate_13.Geometry, Angle=degrees(number_slider_5), Plane=pt_26)  # -> Geometry, Transform
rotate_17 = Rotate(Geometry=rotate_14.Geometry, Angle=degrees(number_slider_5), Plane=pt_26)  # -> Geometry, Transform
pipe_11 = Pipe(Curve=rotate_15.Geometry, Radius=addition_10, Caps=0)
pipe_12 = Pipe(Curve=rotate_16.Geometry, Radius=addition_11, Caps=0)
pipe_13 = Pipe(Curve=[rotate_17.Geometry, offset], Radius=addition_12, Caps=0)

# ---- group: POINT 0
panel_43 = Panel("0")

# ----
pt_36 = ConstructPoint(XCoordinate=pdecon.XComponent, YCoordinate=pdecon.YComponent, ZCoordinate=panel_43)

# ---- group: POINT 0 (continued)
pt_37 = Point(pt_36)

# ---- group: TOP OF ORIGINAL COLUMN
panel_44 = Panel("1800")

# ----
pt_38 = ConstructPoint(XCoordinate=pdecon.XComponent, YCoordinate=pdecon.YComponent, ZCoordinate=panel_44)

# ---- group: TOP OF ORIGINAL COLUMN (continued)
pt_39 = Point(pt_38)

# ---- group: Steel Fins
debrep = DeconstructBrep(Brep=brep)  # -> Faces, Edges, Vertices
item_12 = ListItem(List=debrep.Vertices, Index=0, Wrap=True)  # -> Item, Item1, Item2, Item3, Item4
addition_15 = Addition(A=panel_21, B=1)
vec2pt = Vector2Pt(PointA=item_12.Item4, PointB=item_12.Item, Unitize=False)  # -> Vector, Length
amp = Amplitude(Vector=vec2pt.Vector, Amplitude=panel_21)  # -> flatten(Vector)
amp_2 = Amplitude(Vector=vec2pt.Vector, Amplitude=addition_15)  # -> flatten(Vector)
curvepoint_2 = PointOnCurve(ln_2, parameter=0.5)
scale = Scale(Geometry=ln_2, Center=curvepoint_2, Factor=0.85)  # -> Geometry, Transform
scale_2 = Scale(Geometry=ln_2, Center=curvepoint_2, Factor=2)  # -> Geometry, Transform
vec2pt_2 = Vector2Pt(PointA=pt_8, PointB=pt_9, Unitize=False)  # -> Vector, Length
amp_3 = Amplitude(Vector=vec2pt_2.Vector, Amplitude="28.5")
amp_4 = Amplitude(Vector=vec2pt_2.Vector, Amplitude="27.5")
amp_5 = Amplitude(Vector=vec2pt_2.Vector, Amplitude="10")
amp_6 = Amplitude(Vector=vec2pt_2.Vector, Amplitude="8")

# ---- group: Steel Plate
simplify = SimplifyCurve(Curve=crv_8)  # -> Curve, Simplified
join_7 = JoinCurves(Curves=flatten([simplify.Curve, line_2]), Preserve=False)
boundary = BoundarySurfaces(Edges=join_7)
neg_3 = Negative(Value=panel_20)
Z_8 = UnitZ(Factor=neg_3)
move_24 = Move(Geometry=brep_2, Motion=Z_8)  # -> Geometry, Transform
extr = Extrude(Base=boundary, Direction=Z_8)
sdiff = SolidDifference(BrepsA=extr, BrepsB=move_24.Geometry)

# ----
sdiff_2 = SolidDifference(BrepsA=sdiff, BrepsB=flatten(pipe_2))

# ---- group: top plate with holes
geo_10 = Geometry(sdiff_2)

# ---- group: Crown Beams
pt_40 = Point(pt_10)
pln_5 = Plane(srf)
area_3 = Area(Geometry=srf)  # -> Area, Centroid
vec2pt_3 = Vector2Pt(PointA=pt_40, PointB=area_3.Centroid, Unitize=False)  # -> Vector, Length
move_25 = Move(Geometry=pln_5, Motion=vec2pt_3.Vector)  # -> Geometry, Transform
pl_offset = PlaneOffset(BasePlane=move_25.Geometry, Offset=addition_6)
pl_offset_2 = PlaneOffset(BasePlane=move_25.Geometry, Offset=panel_20)
vec2pt_4 = Vector2Pt(PointA=move_25.Geometry, PointB=pl_offset_2, Unitize=False)  # -> Vector, Length
vec2pt_5 = Vector2Pt(PointA=move_25.Geometry, PointB=pl_offset, Unitize=False)  # -> Vector, Length
number_slider_11 = Slider(1.5, range=0..10)
move_26 = Move(Geometry=srf, Motion=vec2pt_5.Vector)  # -> Geometry, Transform
scale_nu = ScaleNU(Geometry=move_26.Geometry, Plane=pl_offset, ScaleX=number_slider_11, ScaleY=number_slider_11, ScaleZ=number_slider_11)  # -> Geometry, Transform
split = SplitBrep(Brep=brep, Cutter=scale_nu.Geometry)
pshift = ShiftPaths(Data=split, Offset=-1)
dispatch = Dispatch(List=pshift, DispatchPattern=[True, False])  # -> ListA, ListB
cap = CapHoles(Brep=dispatch.ListB)

# ---- group: Steel Plate (continued)
extr_2 = Extrude(Base=srf, Direction=vec2pt_4.Vector)
merge = Merge(Data1=sdiff, Data2=extr_2)
brep_3 = Brep(merge)

# ---- group: Steel Fins (continued)
move_27 = Move(Geometry=scale.Geometry, Motion=vec2pt_4.Vector)  # -> Geometry, Transform
move_28 = Move(Geometry=scale_2.Geometry, Motion=vec2pt_4.Vector)  # -> Geometry, Transform
move_29 = Move(Geometry=move_28.Geometry, Motion=amp_4)  # -> Geometry, Transform
move_30 = Move(Geometry=move_27.Geometry, Motion=amp_3)  # -> Geometry, Transform
extr_3 = Extrude(Base=move_29.Geometry, Direction=amp_2)
extr_4 = Extrude(Base=move_30.Geometry, Direction=amp)

# ---- group: Steel Fins / gap
extr_5 = Extrude(Base=extr_3, Direction=amp_5)

# ---- group: Crown Beams (continued)
sdiff_3 = SolidDifference(BrepsA=cap, BrepsB=extr_5)
brep_4 = Brep(sdiff_3)

# ---- group: Steel Fins / Fin
extr_6 = Extrude(Base=extr_4, Direction=amp_6)

# ---- group: Steel Fins (continued)
brep_5 = Brep(extr_6)

# ---- group: screws
debrep_2 = DeconstructBrep(Brep=extr_4)  # -> Faces, Edges, Vertices
debrep_3 = DeconstructBrep(Brep=brep_5)  # -> Faces, Edges, Vertices
item_13 = ListItem(List=debrep_2.Vertices, Index=0, Wrap=True)  # -> Item, Item1, Item2
item_14 = ListItem(List=debrep_3.Edges, Index=0, Wrap=True)  # -> Item2, Item1, Item
vec2pt_6 = Vector2Pt(PointA=item_13.Item2, PointB=item_13.Item1, Unitize=False)  # -> Vector, Length
amp_7 = Amplitude(Vector=vec2pt_6.Vector, Amplitude="12")
vec2pt_7 = Vector2Pt(PointA=item_13.Item, PointB=item_13.Item1, Unitize=False)  # -> Vector, Length
amp_8 = Amplitude(Vector=vec2pt_6.Vector, Amplitude="24")
move_31 = Move(Geometry=item_14.Item2, Motion=amp_7)  # -> Geometry, Transform
amp_9 = Amplitude(Vector=vec2pt_6.Vector, Amplitude="24")
move_32 = Move(Geometry=move_31.Geometry, Motion=amp_8)  # -> Geometry, Transform
amp_10 = Amplitude(Vector=vec2pt_6.Vector, Amplitude="24")
move_33 = Move(Geometry=move_32.Geometry, Motion=amp_9)  # -> Geometry, Transform
amp_11 = Amplitude(Vector=vec2pt_6.Vector, Amplitude="24")
move_34 = Move(Geometry=move_33.Geometry, Motion=amp_10)  # -> Geometry, Transform
move_35 = Move(Geometry=move_34.Geometry, Motion=amp_11)  # -> Geometry, Transform
amp_12 = Amplitude(Vector=vec2pt_7.Vector, Amplitude="20")  # -> flatten(Vector)
amp_13 = Amplitude(Vector=vec2pt_7.Vector, Amplitude="56")  # -> flatten(Vector)
amp_14 = Amplitude(Vector=vec2pt_7.Vector, Amplitude="56")  # -> flatten(Vector)

# ----
entwine = Entwine(
    Branch00=move_31.Geometry,
    Branch01=move_32.Geometry,
    Branch02=move_33.Geometry,
    Branch03=move_34.Geometry,
    Branch04=move_35.Geometry,
    FlattenInputs=True)

# ---- group: screws (continued)
move_36 = Move(Geometry=entwine, Motion=amp_12)  # -> Geometry, Transform
move_37 = Move(Geometry=move_36.Geometry, Motion=amp_13)  # -> Geometry, Transform
move_38 = Move(Geometry=move_37.Geometry, Motion=amp_14)  # -> Geometry, Transform
curvepoint_3 = PointOnCurve([move_36.Geometry, move_37.Geometry, move_38.Geometry], parameter=0.5)
scale_3 = Scale(Geometry=[move_36.Geometry, move_37.Geometry, move_38.Geometry], Center=curvepoint_3, Factor=Slider(10, range=0..10))  # -> Geometry, Transform
pipe_14 = Pipe(Curve=scale_3.Geometry, Radius="4", Caps=1)

# ----
pshift_2 = ShiftPaths(Data=pipe_14, Offset=-1)
flip_5 = FlipMatrix(Data=pshift_2)
bang_5 = ExplodeTree(Data=flip_5)  # -> Branch0, Branch1, Branch2, Branch3, Branch4, Branch5, Branch6, Branch7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
brep_6 = Brep(bang_5.Branch16)
brep_7 = Brep(bang_5.Branch17)
brep_8 = Brep(bang_5.Branch18)
brep_9 = Brep(bang_5.Branch20)
brep_10 = Brep(bang_5.Branch21)
brep_11 = Brep(bang_5.Branch19)
brep_12 = Brep(bang_5.Branch22)
brep_13 = Brep(bang_5.Branch23)
brep_14 = Brep(bang_5.Branch8)
brep_15 = Brep(bang_5.Branch9)
brep_16 = Brep(bang_5.Branch10)
brep_17 = Brep(bang_5.Branch11)
brep_18 = Brep(bang_5.Branch12)
brep_19 = Brep(bang_5.Branch13)
brep_20 = Brep(bang_5.Branch14)
brep_21 = Brep(bang_5.Branch15)
brep_22 = Brep(bang_5.Branch0)
brep_23 = Brep(bang_5.Branch1)
brep_24 = Brep(bang_5.Branch2)
brep_25 = Brep(bang_5.Branch3)
brep_26 = Brep(bang_5.Branch4)
brep_27 = Brep(bang_5.Branch5)
brep_28 = Brep(bang_5.Branch6)
brep_29 = Brep(bang_5.Branch7)
brep_30 = Brep(simplify(flatten([brep_22, brep_6, brep_14])))
brep_31 = Brep(simplify(flatten([brep_23, brep_7, brep_15])))
brep_32 = Brep(simplify(flatten([brep_24, brep_8, brep_16])))
brep_33 = Brep(simplify(flatten([brep_25, brep_11, brep_17])))
brep_34 = Brep(simplify(flatten([brep_26, brep_9, brep_18])))
brep_35 = Brep(simplify(flatten([brep_27, brep_10, brep_19])))
brep_36 = Brep(simplify(flatten([brep_28, brep_12, brep_20])))
brep_37 = Brep(simplify(flatten([brep_29, brep_13, brep_21])))

# ---- group: crown beam with screws
sdiff_4 = SolidDifference(BrepsA=brep_4, BrepsB=[brep_30, brep_31, brep_32, brep_33, brep_34, brep_35, brep_36, brep_37])

# ---- group: fins with screws
sdiff_5 = SolidDifference(BrepsA=brep_5, BrepsB=[brep_30, brep_31, brep_32, brep_33, brep_34, brep_35, brep_36, brep_37])

# ---- group: Send joint position directly to robot
idx_2 = Slider(0, range=0..100)
panel_45 = Panel("move joints")
joint_positions = Data(py_5)
item_15 = ListItem(List=joint_positions, Index=idx_2, Wrap=True)
list_13 = ValueList({"send all positions": 0, "send only one position": 1}, selected="send only one position")
filter_5 = StreamFilter(Gate=list_13, Stream0=joint_positions, Stream1=item_15)
movej = PythonScript(joint_positions=filter_5, velocity=Slider(153, range=0..200))  # -> script; inputs joint_positions: list
# ---------- movej: Python ----------
script_lines = []

for position in joint_positions:
    script_lines.append("movej(%s, v=%f)" % (str(position), velocity/1000.))


script = "def prog():\n"
script += "\ttextmsg(\">> program start\")\n"
script += "".join(["\t%s\n" % line for line in script_lines])
script += "\ttextmsg(\"<< program end\")\n"
script += "end\n"
script += "prog()\n\n"


print script

#script = ""
# ---------- end movej ----------
send_14 = Button()

# ----
send_15 = Send(script=movej, send=send_14)

# ---- group: Send joint position directly to robot (continued)
panel_46 = Panel(send_15)

# ==== cluster Tools
brep = Brep([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])
tool_id = ClusterInput()

# ---- group: extruder
yaxis_line = Curve(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)
xaxis_line = Curve(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)
test_geometry = Geometry(brep)
brep_2 = Brep(test_geometry)
mesh = Mesh(test_geometry)
tool = Tool(meshes=mesh, breps=brep_2, xline=xaxis_line, yline=yaxis_line)

# ---- group: measurement tool
measurement_tool_geo = Geometry([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])
mesh_2 = Mesh(measurement_tool_geo)
mjoin = MeshJoin(Meshes=mesh_2)
tool_2 = PythonScript(meshes=mjoin, brep=measurement_tool_geo)  # -> tool; inputs meshes: list, brep: list
# ---------- tool_2: Python ----------
from ur_online_control.ur.tools import MeasurementTool
from compas.datastructures import Mesh
from compas_rhino.helpers import mesh_from_guid


tool = MeasurementTool()
tool.model = [mesh_from_guid(Mesh, mesh) for mesh in meshes]
#tool.model_xyz = tool.model.xyz
tool.brep = brep
# ---------- end tool_2 ----------

# ----
tool_id_2 = Integer(tool_id)
filter = StreamFilter(Gate=tool_id_2, Stream1=tool_2, Stream2=tool)
py = PythonScript(tool=filter)  # -> tcp_frame, model
# ---------- py: Python ----------
from compas_ghpython import mesh_draw 

tcp_frame = tool.tcp_frame
model = map(mesh_draw, tool.model)
# ---------- end py ----------
tool_3 = Data(filter)
draw = PythonScript(frame=py.tcp_frame)  # -> G, C
# ---------- draw: Python ----------
import Rhino.Geometry as rg
from System.Drawing import Color

if not size:
    size = 100

if frame:
    plane = rg.Plane(rg.Point3d(*list(frame.point)), rg.Vector3d(*list(frame.xaxis)), rg.Vector3d(*list(frame.yaxis)))

    G = []
    G.append(rg.Line(plane.Origin, size * plane.XAxis))
    G.append(rg.Line(plane.Origin, size * plane.YAxis))
    G.append(rg.Line(plane.Origin, size * plane.ZAxis))
    
    C = []
    C.append(Color.FromArgb(255, 0, 0))
    C.append(Color.FromArgb(0, 255, 0))
    C.append(Color.FromArgb(0, 0, 255))
# ---------- end draw ----------
tool_4 = ClusterOutput(tool_3)
preview = CustomPreview(Geometry=draw.G, Shader=draw.C)
preview_2 = CustomPreview(Geometry=py.model, Shader=ColourSwatch(SwatchColor=RGB(141, 170, 178)))

# ==== cluster Send
script = ClusterInput()
send = ClusterInput()
send_2 = PythonScript(script=script, send=send)  # -> out
# ---------- send_2: Python ----------
import socket
from scriptcontext import sticky as st

ur_ip = st["ur_ip"]
ur_port = 30002

if send:
    s = socket.create_connection((ur_ip, ur_port), timeout=0.5) 
    s.send(script)
    s.close()
# ---------- end send_2 ----------
out = ClusterOutput(send_2)

# ==== cluster Tools_2

# ---- group: spray_gun
brep = Brep([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])
yaxis_line = Curve(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)
xaxis_line = Curve(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)
test_geometry = Geometry(brep)
mesh = Mesh(test_geometry)
brep_2 = Brep(test_geometry)
tool = Tool_2(meshes=mesh, breps=brep_2, xline=xaxis_line, yline=yaxis_line)

# ----
brep_3 = Brep([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])
tool_id = ClusterInput()
yaxis_line_2 = Curve(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)
xaxis_line_2 = Curve(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)

# ---- group: extruder
test_geometry_2 = Geometry(brep_3)
mesh_2 = Mesh(test_geometry_2)
brep_4 = Brep(test_geometry_2)
tool_2 = Tool_2(meshes=mesh_2, breps=brep_4, xline=xaxis_line_2, yline=yaxis_line_2)

# ----
tool_id_2 = Integer(tool_id)
tool_3 = PythonScript()  # -> tool
# ---------- tool_3: Python ----------
from compas_fab.fab.geometry import Frame
from compas_fab.fab.robots import Tool
import Rhino.Geometry as rg
import math

startPlane = rg.Plane.WorldXY
startPlane2 = rg.Plane.WorldXY
rg.Plane.Rotate(startPlane2, math.radians(180), rg.Vector3d.XAxis, rg.Point3d(0.0, 0.0, 0.0))

xform = rg.Transform.ChangeBasis(startPlane, startPlane2)

print startPlane
print startPlane2
Frame([0,0,0],[1,0,0],[0,-1,0])
#tcp_frame = Frame.worldXY()
tcp_frame = Frame([0,0,0],[1,0,0],[0,-1,0])

tool = Tool(tcp_frame)
tool.model = []
tool.breps = []
# ---------- end tool_3 ----------
filter = StreamFilter(Gate=tool_id_2, Stream0=tool_3, Stream1=tool, Stream2=tool_2)
py = PythonScript(tool=filter)  # -> tcp_frame, model
# ---------- py: Python ----------
tcp_frame = tool.tcp_frame
model = tool.model
# ---------- end py ----------
draw = PythonScript(frame=py.tcp_frame)  # -> G, C
# ---------- draw: Python ----------
import Rhino.Geometry as rg
from System.Drawing import Color

if not size:
    size = 100

if frame:
    
    plane = rg.Plane(rg.Point3d(*frame.point), rg.Vector3d(*frame.xaxis), rg.Vector3d(*frame.yaxis))

    G = []
    G.append(rg.Line(plane.Origin, size * plane.XAxis))
    G.append(rg.Line(plane.Origin, size * plane.YAxis))
    G.append(rg.Line(plane.Origin, size * plane.ZAxis))
    
    C = []
    C.append(Color.FromArgb(255, 0, 0))
    C.append(Color.FromArgb(0, 255, 0))
    C.append(Color.FromArgb(0, 0, 255))
# ---------- end draw ----------
tool_4 = Data(filter)
tool_5 = ClusterOutput(tool_4)
preview = CustomPreview(Geometry=draw.G, Shader=draw.C)
preview_2 = CustomPreview(Geometry=py.model, Shader=ColourSwatch(SwatchColor=RGB(141, 170, 178)))

# ==== cluster SortOnZ
A = ClusterInput()
curvepoint = PointOnCurve(A, parameter=0)
pdecon = Deconstruct(Point=curvepoint)  # -> XComponent, YComponent, ZComponent
sort = SortList(Keys=pdecon.ZComponent, ValuesA=A)  # -> Keys, ValuesA
A_2 = ClusterOutput(sort.ValuesA)

# ==== cluster Tool
breps = ClusterInput()
meshes = ClusterInput()
meshes_2 = Mesh(meshes)
mjoin = MeshJoin(Meshes=meshes_2)
xline = ClusterInput()
yline = ClusterInput()
tool = PythonScript(meshes=mjoin, breps=breps, xline=xline, yline=yline)  # -> tool; inputs meshes: list of Mesh, breps: list of Brep
# ---------- tool: Python ----------
import Rhino.Geometry as rg
from compas.geometry import Frame
from ur_online_control.ur.tool import Tool
from compas.datastructures import Mesh
from compas_rhino.helpers import mesh_from_guid

xaxis = rg.Line(xline.PointAtStart, xline.PointAtEnd)
yaxis = rg.Line(yline.PointAtStart, yline.PointAtEnd)

if xaxis.From.DistanceTo(yaxis.From) < 0.01:
    origin = xaxis.From
    xaxis = xaxis.Direction
    yaxis = yaxis.Direction
elif xaxis.To.DistanceTo(yaxis.To) < 0.01:
    origin = xaxis.To
    xaxis = -xaxis.Direction
    yaxis = -yaxis.Direction
elif xaxis.From.DistanceTo(yaxis.To) < 0.01:
    origin = xaxis.From
    xaxis = xaxis.Direction
    yaxis = -yaxis.Direction
elif xaxis.To.DistanceTo(yaxis.From) < 0.01:
    origin = xaxis.To
    xaxis = -xaxis.Direction
    yaxis = yaxis.Direction

xaxis.Unitize()
yaxis.Unitize()

print origin
print xaxis
print yaxis

tcp_frame = Frame(origin, xaxis, yaxis)

tool = Tool(tcp_frame)
tool.model = [mesh_from_guid(Mesh, mesh) for mesh in meshes]
#tool.model_xyz = tool.model.xyz
tool.breps = breps
# ---------- end tool ----------
tool_2 = ClusterOutput(tool)

# ==== cluster Tool_2
breps = ClusterInput()
meshes = ClusterInput()
meshes_2 = Mesh(meshes)
mjoin = MeshJoin(Meshes=meshes_2)
xline = ClusterInput()
yline = ClusterInput()
tool = PythonScript(meshes=mjoin, breps=breps, xline=xline, yline=yline)  # -> tool; inputs meshes: list of Mesh, breps: list of Brep
# ---------- tool: Python ----------
import Rhino.Geometry as rg
from compas_fab.fab.geometry import Frame
from compas_fab.fab.robots import Tool
from compas.datastructures.mesh import Mesh

xaxis = rg.Line(xline.PointAtStart, xline.PointAtEnd)
yaxis = rg.Line(yline.PointAtStart, yline.PointAtEnd)

if xaxis.From.DistanceTo(yaxis.From) < 0.01:
    origin = xaxis.From
    xaxis = xaxis.Direction
    yaxis = yaxis.Direction
elif xaxis.To.DistanceTo(yaxis.To) < 0.01:
    origin = xaxis.To
    xaxis = -xaxis.Direction
    yaxis = -yaxis.Direction
elif xaxis.From.DistanceTo(yaxis.To) < 0.01:
    origin = xaxis.From
    xaxis = xaxis.Direction
    yaxis = -yaxis.Direction
elif xaxis.To.DistanceTo(yaxis.From) < 0.01:
    origin = xaxis.To
    xaxis = -xaxis.Direction
    yaxis = yaxis.Direction

xaxis.Unitize()
yaxis.Unitize()

print origin
print xaxis
print yaxis

tcp_frame = Frame(origin, xaxis, yaxis)

tool = Tool(tcp_frame)
tool.model = meshes
tool.breps = breps
# ---------- end tool ----------
tool_2 = ClusterOutput(tool)
