# Grasshopper definition 190617_linear_axis_setup_json_woodenSheets.gh (Grasshopper 1.0.7)
# plug-ins: Human

# ---- group: sheet size
panel = Panel("900")
panel_2 = Panel("600")

# ---- group: BASE POINTS / Ref surface circle
crv = Curve(<curve referenced from the Rhino model>)

# ---- group: REBAR
number_slider = Slider(27.5, range=0..100)  # disabled

# ----
panel_3 = Panel("0,0,-75")  # disabled

# ---- group: Threaded rods top
length_of_threaded_rod = Slider(600, range=0..1000)  # disabled
threaded_rod_depth_into_column = Slider(400, range=0..500)  # disabled
diameter_threaded_rod_top = Slider(14, range=0..100)  # disabled

# ----
position_of_small_rebars_distance_from_t = Panel("""80
180
240
340
400
500""")  # "Position of small rebars (distance from top)"; disabled
distance_between_transversal_stirrups = Slider(200, range=0..1000)  # disabled

z_height_cage = Slider(2050, range=0..2500)  # disabled
x_radius_cage = Slider(100, range=0..1000)  # disabled
x_stirrup_distance_from_top = Slider(350, range=0..2000)  # disabled
z_middle_height_stirrup = Slider(1450, range=0..2000)  # disabled

# ---- group: Bar diameter
diameter_stirrup = Slider(10, range=0..30)  # disabled
diameter_vertical = Slider(20, range=0..30)  # disabled
diameter_diagonal = Slider(14, range=0..30)  # disabled
diameter_transversal_stirrup = Slider(10, range=0..30)  # disabled

# ----
extension_top_large_stirrup = Slider(70, range=0..1000)  # disabled
extension_bottom_large_stirrup = Slider(-400, range=-500..0)  # disabled

# ---- group: Fillet radii
fillet_radius_large_stirrup_vertical = Slider(20, range=0..100)  # disabled
fillet_radius_large_stirrup_diagonal = Slider(20, range=0..150)  # disabled
fillet_radius_large_stirrup_middle_secti = Slider(0, range=0..500)  # "Fillet radius large stirrup middle section"; disabled
fillet_radius_stirrups = Slider(20, range=0..1000)  # disabled

# ----
amount_of_bars = Slider(8, range=0..30)  # disabled
offset_for_stirrup_diagonal_intersection = Slider(0, range=0..100)  # disabled
offset_for_stirrup_vertical_intersection = Slider(14, range=0..100)  # disabled

# ---- group: Robot
# 0a
# Settings
# Check your IP address and set UR IP address
server_address = ValueList({"192.168.10.2", "192.168.10.11", "127.0.0.1"}, selected="192.168.10.2")
ur_ip = ValueList({"192.168.10.13", "192.168.10.11", "192.168.10.10", "127.0.0.1"}, selected="192.168.10.13")
server_port = Integer(30003)
globals = PythonScript(server_address=server_address, server_port=server_port, ur_ip=ur_ip)  # inputs server_port: Int32
# ---------- globals: Python ----------
from scriptcontext import sticky as st

st["server_address"] = server_address
st["server_port"] = server_port

st["ur_ip"] = ur_ip
# ---------- end globals ----------

# Check if UR is available
ping = Button()
py = PythonScript(ip=ur_ip, ping=ping)  # -> out
# ---------- py: Python ----------
from scriptcontext import sticky as st
from ur_online_control.communication import is_available


guid = str(ghenv.Component.InstanceGuid)
txt_key = "txt_" + guid
if txt_key not in st:
    st[txt_key] = ""

if ping:
    
    available = is_available(ip)
    
    if available:
        st[txt_key] = "%s is up!" % ip
    else:
        st[txt_key] = "%s is down!" % ip

print st[txt_key]
# ---------- end py ----------
panel_4 = Panel(py)

# ---- group: Scale factor
# control point curve
# casted 30.04 = 330
minimum_radius = Slider(340, range=0..1000)
subtraction = Subtraction(A="1000", B=minimum_radius)
division = Division(A=subtraction, B=2)
dom = ConstructDomain(DomainStart=division, DomainEnd="0")

# ---- group: Pattern height and reduction
pattern_height_bottom_mm = Slider(125, range=0..1000)
pattern_height_reduction_mm = Slider(2, range=0..10)

# ---- group: offset_pattern_sides
dom_2 = ConstructDomain(DomainStart=Slider(0.8, range=0..1), DomainEnd=Slider(0.9, range=0..3))

# ----
number_slider_2 = Slider(4, range=0..10)  # disabled

# ---- group: Curve offset
# control point curve
# casted 30.04 = 259, 420
# control point curve
# casted 30.04 = 0-16
crown_top_curve_offset_mm = Slider(200, range=0..500)
bottom_offset_mm = Slider(0, range=-300..500)
top_offset_mm = Slider(320, range=0..500)
list = ValueList({"Control point curve": 0, "Interpolated curve": 1, "Blend curve": 2}, selected="Control point curve")
dom_3 = ConstructDomain(DomainStart=bottom_offset_mm, DomainEnd=top_offset_mm)

# ----
number_slider_3 = Slider(500, range=0..1000)
move_to_pos = Button()
get_pos = Button()
# Disconnect planes_wcs input after moving axis!
# [to make sure robot base is updated within gh]
close = Button()
pos_z = Slider(600, range=0..1500)

# ---- group: short_edge (timber190311
crv_2 = Curve([<curve referenced from the Rhino model> x8])

# ---- group: crown_beams (timber 190311)
brep = Brep([<brep referenced from the Rhino model> x8])

# ---- group: Undulations style
# original column 20, new 22
list_2 = ValueList({"Curve undulations original": 0, "Curve undulations grid": 1}, selected="Curve undulations grid")
number_slider_4 = Slider(14, range=0..100)

# ---- group: Layers
# original column 1800, new 2011
# for total height of 2110 (2010 + 100)
layer_count = Slider(2011, range=0..2011)
layer_selection_start = Slider(0, range=0..2100)
layer_selection_end = Slider(500, range=0..2011)
layer_height = Slider(1, range=0..100)
# original curve control points 0-25
top_extra_layers = Slider(100, range=0..200)

# ---- group: orient_pt
orientpt = Point(<point referenced from the Rhino model>)

# ---- group: Div point offset
dom_4 = ConstructDomain(DomainStart=Slider(0, range=-30..30), DomainEnd=Slider(18, range=0..100))

# ---- group: Rib offset
# curve interpolated points 0-23
number_slider_5 = Slider(23, range=0..100)
dom_5 = ConstructDomain(DomainStart=Slider(0, range=0..30), DomainEnd=number_slider_5)

# ---- group: Robot
panel_5 = Panel("Unload libraries")
bang = Button()
unload = PythonScript(bang=bang)
# ---------- unload: Python ----------
from compas_ghpython import unload_modules

unload_modules("compas")
unload_modules("ur_online_control")
# ---------- end unload ----------

# ----
panel_6 = Panel("4")  # disabled

panel_7 = Panel("ORIGIN")

linear_axis = GhPythonScript(move_to_pos=move_to_pos, pos_x=number_slider_3, pos_z=pos_z, close=close)  # -> out
# ---------- linear_axis: Python ----------
__author__ = "joburger"
__version__ = "2018.09.20"

from linear_axis import siemens as s

if move_to_pos:
    p = s.SiemensPortal(2)
    
    try:
         p.set_x(pos_x)
         p.set_z(pos_z)
         # p.wait_ext_axis()
    
    finally:
         p.close()

if close:
    try:
        p.close()
        p = s.SiemensPortal(2)
    finally:
        p.close()

#position_data = None

"""
if get_pos:
    try:
        p = s.SiemensPortal(1)
        position_data = "NO DATA"
        position_data = "AXIS POSITION \nX:" + str(p.get_x()) + " Z:" + str(p.get_z())
        print "hmm"
    finally:
        p.close()

try:
    print position_data
except RuntimeError:
    print "Something did not work"
"""
# ---------- end linear_axis ----------

# ---- group: Create centroid
pt = Point(<point referenced from the Rhino model>)
pdecon = Deconstruct(Point=pt)  # -> XComponent, YComponent, ZComponent
pt_2 = ConstructPoint(XCoordinate=pdecon.XComponent, YCoordinate=pdecon.YComponent, ZCoordinate="1800")

# ---- group: centroid
pt_3 = Point(pt)

# ---- group: Equalize height of all short_edges (0.3mm tolerance)
end = EndPoints(Curve=crv_2)  # -> Start, End
pdecon_2 = Deconstruct(Point=end.End)  # -> XComponent, YComponent, ZComponent
pdecon_3 = Deconstruct(Point=end.Start)  # -> XComponent, YComponent, ZComponent
pt_4 = ConstructPoint(XCoordinate=pdecon_3.XComponent, YCoordinate=pdecon_3.YComponent, ZCoordinate="1800")
pt_5 = ConstructPoint(XCoordinate=pdecon_2.XComponent, YCoordinate=pdecon_2.YComponent, ZCoordinate="1800")
ln = Line(StartPoint=pt_4, EndPoint=pt_5)

# ---- group: short edge end pts
pt_6 = Point(end.End)

# ----
line = Line(ln)  # disabled

subtraction_2 = Subtraction(A=number_slider_3, B="500")
subtraction_3 = Subtraction(A="750", B=pos_z)
neg = Negative(Value=subtraction_2)
neg_2 = Negative(Value=subtraction_3)
linear_axis_x_axis = Brep(<brep referenced from the Rhino model>)
linear_axis_plates = Brep([<brep referenced from the Rhino model> x2])
X = UnitX(Factor=neg)
Z = UnitZ(Factor=neg_2)
move = Move(Geometry=linear_axis_x_axis, Motion=X)  # -> Geometry, Transform
move_2 = Move(Geometry=[move.Geometry, linear_axis_plates], Motion=Z)  # -> Geometry, Transform
preview = CustomPreview(Geometry=move_2.Geometry, Shader=ColourSwatch(SwatchColor=RGBA(99, 94, 94, 96)))

# ---- group: Robot
# 1. load robot model
# 2. set tool
# 3. set basis
# 1. load robot model
# 2. set tool
# 3. set basis
list_3 = ValueList({"no_tool": 0, "measurement_tool": 1, "extruder": 2}, selected="extruder")
base = PythonScript(x=subtraction_2, z=subtraction_3)  # -> base_frame, base
# ---------- base: Python ----------
from compas.geometry import Frame

"""
origin = [0, 0, 0]
xaxis = [1, 0, 0]
yaxis = [0, 1, 0]


origin = [-313.92, -147.58, 13.79]
xaxis = [0.00000, -1.00000, 0.00000]
yaxis = [1.00000, 0.00000, 0.00000]
"""


linear_axis_x = x
linear_axis_z = z 
#axis    Y         Z                        X
origin = [155.98, -806.21 + linear_axis_z, 343.76 + linear_axis_x]
xaxis = [0, 0, 1]
yaxis = [1, 0, 0]

base_frame = Frame(list(origin), list(xaxis), list(yaxis))

base = "base = " + str(origin) + "\n" + "change in linear_axis_x = " + str(linear_axis_x) + "\n" + "change in linear_axis_z = " + str(linear_axis_z)
# ---------- end base ----------
tools = Tools(tool_id=list_3)
list_4 = ValueList({"UR5", "UR10"}, selected="UR10")
robot = PythonScript(model=list_4, tool=tools, base_frame=base.base_frame)  # -> robot
# ---------- robot: Python ----------
from ur_online_control.ur.ur10 import UR10
#from ur_online_control.ur.ur5 import UR5
from scriptcontext import sticky as st

if model == "UR5":
    robot = UR5()
elif model == "UR10":
    robot = UR10()

if tool:
    robot.set_tool(tool)
if base_frame:
    robot.set_base(base_frame)

st["robot"] = robot
# ---------- end robot ----------

# ---- group: steelPlate to beam gap
panel_8 = Panel("-5")  # disabled

# ---- group: steelPlate thickness
panel_9 = Panel("-15")  # disabled

# ---- group: steelFIn height
panel_10 = Panel("157")  # disabled

# ----
list_5 = ValueList({"no_tool": 0, "spray_gun": 1, "extruder": 2}, selected="extruder")
extra_tolerance_hole = Slider(2, range=0..100)  # disabled
panel_11 = Panel(linear_axis)
offset_curve_distance = Slider(0, range=0..10)  # disabled
addition = Addition(A=top_extra_layers, B=layer_count)
addition_2 = Addition(A=panel_9, B=panel_8)  # disabled
layer_count_2 = Number(layer_count)
tools_2 = Tools_2(tool_id=list_5)
number_slider_6 = Slider(75, range=0..100)  # disabled

python = GhPythonScript(pattern_height_bottom=pattern_height_bottom_mm, pattern_height_reduction=pattern_height_reduction_mm)  # -> out, value_list; inputs pattern_height_bottom: Int32
# ---------- python: Python ----------
__author__ = "Joris"
__version__ = "2019.06.12"

# PARAMETERS
amount_of_layers = 2110
threshold = 0
max_value = 2

# CONSTANTS
begin_value = pattern_height_bottom / 2
reduce = pattern_height_reduction / 2
sum = 0
count = 0
pattern_number_list = []
value_list = []

# NUMBER GENERATION
for i in range(200):
    if sum*2 > amount_of_layers + threshold:
        print "value above amount of layers"
        break
    if begin_value < reduce:
        print "value below zero"
        break
    pattern_number_list.append(begin_value)
    begin_value = begin_value - reduce
    sum += begin_value 
    count += 1

print "Amount of pattern repetitions", count
print "Sum of values", sum*2
#print pattern_number_list

for i in range(count):
    # calculate amount of steps based on i
    step_amount = pattern_number_list[i]
    print "Height of one pattern repetition", step_amount*2, "mm"
    print i+1
    # calculate step size
    step_size = max_value / step_amount
    for j in range(int(2/step_size*2)):
        if step_size*j < 2:
            value = j * step_size
        else:
            value = max_value*2 - j*step_size
        value_list.append(value)
# ---------- end python ----------
lng = ListLength(List=python.value_list)
split = SplitList(List=python.value_list, Index=addition)  # -> ListA, ListB
data = Data(split.ListA)

panel_12 = Panel(python.out)
graph = QuickGraph(python.value_list, SortOrder=0)

# ---- group: Rib offset
range = Range(Domain=dom_5, Steps=expr("x-1", layer_count_2))
data_2 = Data(range)

# ---- group: Curve offset
range_2 = Range(Domain=Domain(0, 1), Steps=expr("x-1", addition))
graph_2 = GraphMapper(
    range_2,
    x0=0,
    x1=1,
    y0=0,
    y1=1,
    container_name="Bezier",
    cpx=[0, 0.244080022, 0.3763449192, 1],
    cpy=[0.8935507536, 0.512445271, 0.2412503362, 0.2308565974])
data_3 = Data(graph_2)
bnd = Bounds(Numbers=data_3)
remap = RemapNumbers(Value=data_3, Source=bnd, Target=dom_3)  # -> Mapped, Clipped

# ---- group: Scale factor
range_3 = Range(Domain=Domain(0, 1), Steps=expr("x-1", layer_count_2))
graph_3 = GraphMapper(
    range_3,
    x0=0,
    x1=1,
    y0=0,
    y1=1,
    container_name="Bezier",
    cpx=[0, 0.2461866289, 0.5236688256, 1],
    cpy=[0.7384505868, 0.1078018546, 0.01457560062, 0.1922056079])
data_4 = Data(graph_3)
bnd_2 = Bounds(Numbers=data_4)
remap_2 = RemapNumbers(Value=data_4, Source=bnd_2, Target=dom)  # -> Mapped, Clipped

# ----
panel_13 = Panel(base.base)
neg_3 = Negative(Value=number_slider_6)  # disabled
Z_2 = UnitZ(Factor=neg_3)  # disabled

start = Button()
py_2 = PythonScript()  # -> path
# ---------- py_2: Python ----------
import sys
import os

ghComp = ghenv.Component
ghDoc = ghComp.OnPingDocument()

# the full path of the gh file
path = ghDoc.FilePath
# the directory of the gh file
path = os.path.dirname(path)

path = os.path.abspath(os.path.join(path, ".."))

print path
# ---------- end py_2 ----------
# 1
# Executing
panel_14 = Panel("Start communication server")
panel_15 = Panel(py_2)
server = PythonScript(path=panel_15, start=start)
# ---------- server: Python ----------
import os
import threading
from scriptcontext import sticky as st

server_address = st["server_address"]
server_port = st["server_port"]
ur_ip = st["ur_ip"]

"""
Change main!!!!
"""
main = os.path.join(path, "communication", "main_json.py")
syscall = "python %s %s %s %s" % (main, server_address, server_port, ur_ip)
print syscall

if os.path.isfile(main):
        
    def myfunc():
        
        os.system(syscall)
    
    if start:
        t = threading.Thread(target=myfunc)
        t.start()
# ---------- end server ----------

# ---- group: test_pt
pt_7 = Point(<point referenced from the Rhino model>)
xy = XYPlane(Origin=pt_7)
rotate = Rotate(Geometry=xy, Angle=-1.570796327, Plane=xy)  # -> Geometry, Transform

# ---- group: filament_loading_pt
pt_8 = Point(<point referenced from the Rhino model>)
xy_2 = XYPlane(Origin=pt_8)
rotate_2 = Rotate(Geometry=xy_2, Angle=-1.570796327, Plane=xy_2)  # -> Geometry, Transform

# ----
start_2 = Button()

panel_16 = Panel("Get UR connected")
ur = PythonScript(send=start_2)  # -> out, a
# ---------- ur: Python ----------
from scriptcontext import sticky as st
from ur_online_control.ur_driver import URDriver

server_address = st["server_address"]
server_port = st["server_port"]
ur_ip = st["ur_ip"]
robot = st["robot"]

print ("server_address = ", server_address)
print ("server_port = ", server_port)
print ("ur_ip =", ur_ip)

tool_angle_axis = list(robot.tool.tcp_frame.point) + robot.tool.tcp_frame.axis_angle_vector
#robot.tool.tcp_frame.pose_axis_angle_vector
print "tool_angle_axis =", tool_angle_axis

ur_driver = URDriver(server_address, server_port, tool_angle_axis, ur_ip, "UR")
print ur_driver

if send:
    ur_driver.send()
# ---------- end ur ----------

panel_17 = Panel(ur.out)
start_3 = Button()

disconnect = Button()
panel_18 = Panel("Get Grasshopper connected")
client = PythonScript(connect=start_3, disconnect=disconnect)  # -> connected, client
# ---------- client: Python ----------
import time
from scriptcontext import sticky as st
from Rhino.RhinoApp import WriteLine
from ur_online_control.grasshopper import GHClient, gh_component_timer
import time

server_address = st["server_address"]
server_port = st["server_port"]

guid = str(ghenv.Component.InstanceGuid)

client_key = "client_" + guid
run_key = "run_" + guid

if connect:
    if client_key not in st:
        st[client_key] = GHClient(server_address, server_port)
        client = st[client_key]
        client.connect_to_server()
        client.start()
        
    else:
        if st[client_key].running:
            WriteLine("Client is already connected.")
            
        else:
            st[client_key] = GHClient(server_address, server_port)
            client = st[client_key]
            client.connect_to_server()
            client.start()
"""
else:
    if client_key in st:
        # we need a timer to ask if we have something on the rcv queue
        client = st[client_key]
        #if client.running:
        #    #client.run_inner_while()
        #    gh_component_timer(ghenv, True, 1000)
"""

if disconnect:
    if client_key in st:
        client = st[client_key]
        if client.running:
            client.close()

if client_key in st:
    connected =  st[client_key].running
    client = st[client_key]
    print st[client_key].rcv_queue.qsize()
    print st[client_key].snd_queue.qsize()
else:
    connected = False
# ---------- end client ----------
panel_19 = Panel(client.connected)

panel_20 = Panel("commands_00.json")
panel_21 = Panel("commands_01.json")
panel_22 = Panel("commands_02.json")
panel_23 = Panel("commands_03.json")

bang_2 = Button()
receive = PythonScript(client=client.client, bang=bang_2)  # -> qsize, client
# ---------- receive: Python ----------
from ur_online_control.communication.msg_identifiers import *
from ur_online_control.utilities.lists import flatten_list
from Rhino.RhinoApp import WriteLine


if client:
    if not client.ghenv:
        client.ghenv = ghenv
    qsize = client.rcv_queue.qsize()
# ---------- end receive ----------
panel_24 = Panel(receive.qsize)

save_json = Button()
send = PythonScript(client=receive.client)  # -> out
# ---------- send: Python ----------
from ur_online_control.communication.msg_identifiers import *
from ur_online_control.utilities.lists import flatten_list

if client:
    qsize = client.rcv_queue.qsize()
    if qsize:
        msg = client.rcv_queue.get()
        print msg
# ---------- end send ----------
panel_25 = Panel(send)

# ----
# Direct UR control
get = Button()
get_2 = Button()
pose = PythonScript(get=get_2)  # -> pose_joints
# ---------- pose: Python ----------
from scriptcontext import sticky as st
from ur_online_control.ur_direct import get_current_pose_joints
from ur_online_control.ur.robot import BaseConfiguration

server_address = st["server_address"]
server_port = 30005
ur_ip = st["ur_ip"]
robot = st["robot"]
tool_angle_axis = list(robot.tool.tcp_frame.point) + robot.tool.tcp_frame.axis_angle_vector
print tool_angle_axis

guid = str(ghenv.Component.InstanceGuid)
pose_joints_key = "pose_joints" + guid


if get:
    st[pose_joints_key] = get_current_pose_joints(server_address, server_port, ur_ip, tool_angle_axis)
    
if pose_joints_key not in st:
    pose_joints = []
else:
    pose_joints = BaseConfiguration.from_joints(st[pose_joints_key])
# ---------- end pose ----------
pose_2 = PythonScript(get=get)  # -> pose_cartesian
# ---------- pose_2: Python ----------
from scriptcontext import sticky as st
from ur_online_control.ur_direct import get_current_pose_cartesian

server_address = st["server_address"]
server_port = 30005
ur_ip = st["ur_ip"]
robot = st["robot"]
tool_angle_axis = list(robot.tool.tcp_frame.point) + robot.tool.tcp_frame.axis_angle_vector
print tool_angle_axis

guid = str(ghenv.Component.InstanceGuid)
pose_cartesian_key = "pose_cartesian" + guid


if get:
    st[pose_cartesian_key] = get_current_pose_cartesian(server_address, server_port, ur_ip, tool_angle_axis)

if pose_cartesian_key not in st:
    pose_cartesian = []
else:
    pose_cartesian = st[pose_cartesian_key]
# ---------- end pose_2 ----------
stop = Button()
stop_2 = PythonScript(stop=stop)
# ---------- stop_2: Python ----------
from scriptcontext import sticky as st
from ur_online_control.ur_direct import stop as stop_robot

ur_ip = st["ur_ip"]

if stop:
    stop_robot(ur_ip)
# ---------- end stop_2 ----------
panel_26 = Panel(pose)
panel_27 = Panel(pose_2)

vertical_pose = Number([-152.427, -780.635, 855.229, -1.1958, -1.22046, -1.20201])
back = Button()
reset = Button()

# ---- group: Define joint positions
base_2 = Slider(90.163, range=-360..360)
shoulder = Slider(0, range=-360..360)
elbow = Slider(-102.857, range=-360..360)
wrist1 = Slider(0, range=-360..360)
wrist2 = Slider(0, range=-360..360)
wrist3 = Slider(0, range=-360..360)
ur1_q1_q6 = Data([base_2, shoulder, elbow, wrist1, wrist2, wrist3])

# ----
# Calculate basis
# Measure basis:
# 1. Clear the recorded poses
# 2. Move robot to origin and press "get pose"
# 3. Move robot to point in positive x-axis and press "get pose"
# 4. Move robot to an other point in your basis and press "get pose"
# (The farer away these positions are, the better)
# 
# 5. Alternatively change the order in the component calc base
# 6. Copy output into base component
list_6 = ValueList({"origin, pt on positive x-axis, pt in xy plane": 0, "origin, pt on positive y-axis, pt in xy plane": 1}, selected="origin, pt on positive x-axis, pt in xy plane")
clear = Button()
rec = PythonScript(msg=pose_2, rec=get, clear=clear)  # -> rec; inputs msg: list
# ---------- rec: Python ----------
from scriptcontext import sticky as st

guid = str(ghenv.Component.InstanceGuid)
recorded_key =  "recorded_" + guid
just_cleared_key = "just_cleared_" + guid

if recorded_key not in st:
    st[recorded_key] = []

if just_cleared_key not in st:
    st[just_cleared_key] = False

if clear:
    st[recorded_key] = []
    st[just_cleared_key] = True
else:
    if len(msg):
        if msg != [None] and not st[just_cleared_key] and rec:
            st[recorded_key].append(msg)
    st[just_cleared_key] = False
        


rec = st[recorded_key]

print rec
# ---------- end rec ----------
calc_base = PythonScript(poses=rec, input_type=list_6)  # -> out; inputs poses: list
# ---------- calc_base: Python ----------
import Rhino.Geometry as rg
import math


if len(poses) > 2:
    
    O = poses[0]
    P1 = poses[1]
    P2 = poses[2]
    
    if input_type == 0:
        # origin, pt on positive x-axis, pt in xy plane
        origin = rg.Point3d(O[0], O[1], O[2])
        pt_on_xaxis = rg.Point3d(P1[0], P1[1], P1[2])
        pt_in_xyplane = rg.Point3d(P2[0], P2[1], P2[2])
        
        xaxis = pt_on_xaxis - origin
        xaxis.Unitize()
        
        v = pt_in_xyplane - origin
        zaxis = rg.Vector3d.CrossProduct(v, xaxis)
        zaxis.Unitize()
        
        # zaxis must look up!
        if math.acos(rg.Vector3d.ZAxis * zaxis) > math.acos(rg.Vector3d.ZAxis * -zaxis):
            zaxis = -zaxis
        
        yaxis = rg.Vector3d.CrossProduct(zaxis, xaxis)
    
    elif input_type == 1:
        # origin, pt on positive y-axis, pt in xy plane
        origin = rg.Point3d(O[0], O[1], O[2])
        pt_on_yaxis = rg.Point3d(P1[0], P1[1], P1[2])
        pt_in_xyplane = rg.Point3d(P2[0], P2[1], P2[2])
        
        yaxis = pt_on_yaxis - origin
        yaxis.Unitize()
        
        v = pt_in_xyplane - origin
        zaxis = rg.Vector3d.CrossProduct(v, yaxis)
        zaxis.Unitize()
        
        # zaxis must look up!
        if math.acos(rg.Vector3d.ZAxis * zaxis) > math.acos(rg.Vector3d.ZAxis * -zaxis):
            zaxis = -zaxis
        
        xaxis = rg.Vector3d.CrossProduct(yaxis, zaxis)
        
        
    print "Copy the following into base component:"
    print " "
    print "origin = [%.2f, %.2f, %.2f]" % tuple(list(origin))
    print "xaxis = [%.5f, %.5f, %.5f]" % tuple(list(xaxis))
    print "yaxis = [%.5f, %.5f, %.5f]" % tuple(list(yaxis))
    

#print rg.Vector3d.CrossProduct(rg.Vector3d.YAxis, rg.Vector3d.ZAxis)
#print rg.Vector3d.CrossProduct(rg.Vector3d.ZAxis, rg.Vector3d.XAxis)
# ---------- end calc_base ----------
panel_28 = Panel(rec)
panel_29 = Panel(calc_base)

py_3 = GhPythonScript(joint_values=ur1_q1_q6)  # -> configuration; inputs joint_values: list
# ---------- py_3: Python ----------
import math
from ur_online_control.ur.robot import BaseConfiguration

configuration = BaseConfiguration.from_joints([math.radians(d) for d in joint_values])
# ---------- end py_3 ----------
list_7 = ValueList({"Print with UR": 0, "Print with Linear Axis": 1}, selected="Print with UR")  # disabled

# ---- group: Visualise / robot model brep
py_4 = PythonScript(model=list_4)  # -> n
# ---------- py_4: Python ----------
if model == "UR5":
    n = 0
if model == "UR10":
    n = 1

print n
# ---------- end py_4 ----------
ur10_brep = UR10Brep([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])
ur5_brep = UR5Brep([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])
show_brep = BooleanToggle(False)
filter = StreamFilter(Gate=py_4, Stream0=ur5_brep, Stream1=ur10_brep)

# ----
pdecon_4 = Deconstruct(Point=orientpt)  # -> XComponent, YComponent, ZComponent; disabled
panel_30 = Panel("-1")  # disabled

panel_31 = Panel("set digital out")
number = Slider(2, range=0..10)
value = BooleanToggle(False)
digital_out = PythonScript(number=number, value=value)  # -> script; inputs number: Int32, value: Boolean
# ---------- digital_out: Python ----------
script = "def prog():\n"
script += "\ttextmsg(\">> program start\")\n"
script += "\tset_digital_out(%i, %s)\n" % (int(number), str(value))
script += "\ttextmsg(\"<< program end\")\n"
script += "end\n"
script += "prog()\n\n"

print script
# ---------- end digital_out ----------
send_2 = Button()
send_3 = Send(script=digital_out, send=send_2)
panel_32 = Panel(send_3)

panel_33 = Panel("move vertical")
movel = PythonScript()  # -> script
# ---------- movel: Python ----------
from scriptcontext import sticky as st

robot = st["robot"]
tool_angle_axis = list(robot.tool.tcp_frame.point) + robot.tool.tcp_frame.axis_angle_vector
x, y, z, ax, ay, az = tool_angle_axis

script = "def prog():\n"
script += "\ttextmsg(\">> program start\")\n"
script += "\tset_tcp(p%s)\n" % str([x/1000., y/1000., z/1000, ax, ay, az])
script += "\tcurrent_pose = get_forward_kin()\n"
script += "\tmovel(p[current_pose[0], current_pose[1], current_pose[2], 0, 0, 0], a=0.1, v=0.1)\n"
script += "\ttextmsg(\"<< program end\")\n"
script += "end\n"
script += "prog()\n\n"

print script
# ---------- end movel ----------
send_4 = Button()
send_5 = Send(script=movel, send=send_4)
panel_34 = Panel(send_5)

# ----
# move incremental in TCS
get_current_pose = Button()
list_8 = ValueList({"xaxis", "yaxis", "zaxis"}, selected="zaxis")
movel_2 = PythonScript(get=get_current_pose, step_size=Slider(5, range=-10..10), direction=list_8)  # -> script; inputs get: list
# ---------- movel_2: Python ----------
from scriptcontext import sticky as st
from compas.geometry import Frame
from compas.geometry import Point, Vector
from ur_online_control.ur_direct import get_current_pose_cartesian

server_address = st["server_address"]
server_port = 30005
ur_ip = st["ur_ip"]
robot = st["robot"]
tool_angle_axis = list(robot.tool.tcp_frame.point) + robot.tool.tcp_frame.axis_angle_vector
print tool_angle_axis

guid = str(ghenv.Component.InstanceGuid)
pose_cartesian_key = "pose_cartesian" + guid

if get:
    st[pose_cartesian_key] = get_current_pose_cartesian(server_address, server_port, ur_ip, tool_angle_axis)

if pose_cartesian_key not in st:
    pose_cartesian = []
    script = ""
else:
    pose_cartesian = st[pose_cartesian_key]

    robot = st["robot"]
    tool_angle_axis = list(robot.tool.tcp_frame.point) + robot.tool.tcp_frame.axis_angle_vector
    x, y, z, ax, ay, az = tool_angle_axis
    
    script = "def prog():\n"
    script += "\ttextmsg(\">> program start\")\n"
    script += "\tset_tcp(p%s)\n" % str([x/1000., y/1000., z/1000, ax, ay, az])
    script += "\tcurrent_pose = get_forward_kin()\n"
    
#    frame = Frame.from_pose_axis_angle_vector(pose_cartesian)
    frame = Frame.from_axis_angle_vector([ax, ay, az])
    frame.point = [x, y, z]

    if direction == "xaxis":
        next_vector = Vector(*frame.xaxis) * step_size
    elif direction == "yaxis":
        next_vector = Vector(*frame.yaxis) * step_size
    else: # direction == "zaxis":
        next_vector = Vector(*frame.zaxis) * step_size
    
    x, y, z = next_vector
    script += "\tmovel(p[current_pose[0] + %f, current_pose[1] + %f, current_pose[2] + %f, current_pose[3], current_pose[4], current_pose[5]], t=%f)\n" % (x/1000., y/1000., z/1000., step_size * 0.1)
    
    script += "\ttextmsg(\"<< program end\")\n"
    script += "end\n"
    script += "prog()\n\n"
    
    print script
# ---------- end movel_2 ----------
send_6 = Button()
send_7 = Send(script=movel_2, send=send_6)
panel_35 = Panel(send_7)

# ----
# move incremental in WCS
number_slider_7 = Slider(5, range=-10..10)
list_9 = ValueList({"xaxis", "yaxis", "zaxis"}, selected="zaxis")
movel_3 = PythonScript(step_size=number_slider_7, direction=list_9)  # -> script
# ---------- movel_3: Python ----------
from scriptcontext import sticky as st

robot = st["robot"]
tool_angle_axis = list(robot.tool.tcp_frame.point) + robot.tool.tcp_frame.axis_angle_vector
x, y, z, ax, ay, az = tool_angle_axis

script = "def prog():\n"
script += "\ttextmsg(\">> program start\")\n"
script += "\tset_tcp(p%s)\n" % str([x/1000., y/1000., z/1000, ax, ay, az])
script += "\tcurrent_pose = get_forward_kin()\n"


if direction == "xaxis":
    script += "\tmovel(p[current_pose[0] + %f, current_pose[1], current_pose[2], current_pose[3], current_pose[4], current_pose[5]], t=%f)\n" % (step_size/1000., step_size * 0.1)

elif direction == "yaxis":
    script += "\tmovel(p[current_pose[0], current_pose[1] + %f, current_pose[2], current_pose[3], current_pose[4], current_pose[5]], t=%f)\n" % (step_size/1000., step_size * 0.1)

else: # direction == "zaxis":
    script += "\tmovel(p[current_pose[0], current_pose[1], current_pose[2] + %f, current_pose[3], current_pose[4], current_pose[5]], t=%f)\n" % (step_size/1000., step_size * 0.1)

script += "\ttextmsg(\"<< program end\")\n"
script += "end\n"
script += "prog()\n\n"

print script
# ---------- end movel_3 ----------
send_8 = Button()
send_9 = Send(script=movel_3, send=send_8)
panel_36 = Panel(send_9)

c100_amount_g_l = Panel("25.75")
concrete_density_kg_m3 = Panel("2.3")
pipe_diameter_mm = Panel("110")
xceed_amount_g_l = Panel("27.13")
accelerator_mixing_time_min = Slider(3, range=0..10)

generate_excel = BooleanToggle(True)
print_output = BooleanToggle(True)

alu_amount_g_l = Panel("27.13")

batch_height_mm = Slider(15, range=0..100)
layers_per_batch_number = Slider(1, range=0..10)

batch_split_value_layer = Slider(1500, range=0..2500)

hydration_time_min = Slider(60, range=0..120)
start_layer_number = Slider(0, range=0..2000)

column_divide_1_layer = Slider(0, range=0..2500)
maximum_height_unhydrated_concrete_in_bo = Slider(400, range=0..1000)  # "maximum height unhydrated concrete in bottom (mm)"
maximum_height_unhydrated_concrete_in_mi = Slider(260, range=0..1000)  # "maximum height unhydrated concrete in middle (mm)"
maximum_height_unhydrated_concrete_in_to = Slider(140, range=0..1000)  # "maximum height unhydrated concrete in top (mm)"
column_divide_2_layer = Slider(0, range=0..2500)

number_slider_8 = Slider(18, range=0..100)
Z_3 = UnitZ(Factor=1)
Z_4 = UnitZ(Factor=1)
amp = Amplitude(Vector=Z_3, Amplitude=Slider(90, range=0..100))
amp_2 = Amplitude(Vector=Z_4, Amplitude=Slider(45, range=0..100))
number_slider_9 = Slider(24000, range=0..100000)
number_slider_10 = Slider(35, range=0..100)

# ---- group: BOTTOM_PLATE
offset_to_middle = Slider(22, range=0..40)  # disabled
diameter_bottom_plate_connectors = Slider(14, range=0..100)  # disabled
height_bottom_plate_connectors = Slider(600, range=0..1000)  # disabled
size_steel_bottom_plate = Slider(600, range=0..1000)  # disabled
thickness_steel_plate = Slider(15, range=0..100)  # disabled
neg_4 = Negative(Value=diameter_bottom_plate_connectors)  # disabled
subtraction_4 = Subtraction(A=neg_4, B=offset_to_middle)  # disabled
X_2 = UnitX(Factor=offset_to_middle)  # disabled
neg_5 = Negative(Value=X_2)  # disabled
number_slider_11 = Slider(27.5, range=0..100)  # disabled
dom_6 = ConstructDomain(DomainStart=expr("x/2", size_steel_bottom_plate), DomainEnd=expr("-x/2", size_steel_bottom_plate))  # disabled
Z_5 = UnitZ(Factor=expr("-x", thickness_steel_plate))  # disabled
panel_37 = Panel("""{75,150,0}
{300,30,0}
{525,150,0}
{525,450,0}
{300,570,0}
{75,450,0}""")  # disabled
number_slider_12 = Slider(10, range=0..10)  # disabled
number_slider_13 = Slider(18, range=0..100)  # disabled
number_slider_14 = Slider(40, range=0..100)  # disabled
dom_7 = ConstructDomain(DomainStart=expr("x/2", number_slider_14), DomainEnd=expr("-x/2", number_slider_14))  # disabled
dom_8 = ConstructDomain(DomainStart=expr("x/2", number_slider_13), DomainEnd=expr("-x/2", number_slider_13))  # disabled

# ---- group: REBAR DISTANCE
distance_threshold_surface_rebar = Slider(20, range=0..100)  # disabled
resolution_of_calculation = Slider(100, range=0..100)  # disabled
panel_38 = Panel("7")  # disabled
panel_39 = Panel("5")  # disabled

# ----
# Bake Text then explode in Rhino
number_slider_15 = Slider(3, range=0..10)
shift = ShiftList(List=pt_6, Shift=number_slider_15, Wrap=True)
vec2pt = Vector2Pt(PointA=pt_6, PointB=shift, Unitize=False)  # -> Vector, Length
amp_3 = Amplitude(Vector=vec2pt.Vector, Amplitude=Slider(100, range=0..200))
move_3 = Move(Geometry=pt_6, Motion=amp_3)  # -> Geometry, Transform
pdecon_5 = Deconstruct(Point=move_3.Geometry)  # -> XComponent, YComponent, ZComponent
panel_40 = Panel("""1
2
3
4
5
6
7
8""")

# ---- group: Extra tolerance holes in bottom plate for vertical staves
number_slider_16 = Slider(5, range=0..10)  # disabled
addition_3 = Addition(A=diameter_vertical, B=number_slider_16)  # disabled
panel_41 = Panel("0,0,-100")  # disabled

# ----
rectangle = Rectangle(Plane=pt_3, XSize=panel, YSize=panel_2, Radius=0)  # -> Rectangle, Length
division_2 = Division(A=panel, B=2)
X_3 = UnitX(Factor=1)
neg_6 = Negative(Value=division_2)
Y = UnitY(Factor=1)
neg_7 = Negative(Value=panel_2)
amp_4 = Amplitude(Vector=X_3, Amplitude=neg_6)
amp_5 = Amplitude(Vector=Y, Amplitude=neg_7)
sheets_layer = Slider(436, range=0..1000)
move_4 = Move(Geometry=rectangle.Rectangle, Motion=amp_4)  # -> Geometry, Transform
move_5 = Move(Geometry=move_4.Geometry, Motion=amp_5)  # -> Geometry, Transform

# ---- group: BASE POINTS
area = Area(Geometry=crv)  # -> Area, Centroid

# ---- group: BASE POINTS / midPt setout top
pt_9 = Point(area.Centroid)

# ---- group: BASE POINTS (continued)
pdecon_6 = Deconstruct(Point=pt_9)  # -> XComponent, YComponent, ZComponent

# ---- group: BASE POINTS / MID TOP SECTION
panel_42 = Panel(pdecon_6.ZComponent)
pt_10 = Point(pt_9)

# ---- group: Pipe
number_slider_17 = Slider(56, range=0..100)  # disabled
number_slider_18 = Slider(2185, range=2000..2300)  # disabled

# ---- group: BASE POINTS / TOP COLUMN
panel_43 = Panel("1900")

# ---- group: BASE POINTS (continued)
pt_11 = ConstructPoint(XCoordinate=pdecon_6.XComponent, YCoordinate=pdecon_6.YComponent, ZCoordinate=panel_43)

# ---- group: BASE POINTS / TOP COLUMN (continued)
pt_12 = Point(pt_11)

# ---- group: BASE POINTS / BOTTOM COLUMN
panel_44 = Panel("-210")

# ---- group: BASE POINTS (continued)
pt_13 = ConstructPoint(XCoordinate=pdecon_6.XComponent, YCoordinate=pdecon_6.YComponent, ZCoordinate=panel_44)

# ---- group: BASE POINTS / BOTTOM COLUMN (continued)
pt_14 = Point(pt_13)

# ----
move_6 = Move(Geometry=pt_14, Motion=panel_3)  # -> Geometry, Transform; disabled

# ---- group: Pipe (continued)
cyl = Cylinder(Base=move_6.Geometry, Radius=number_slider_17, Length=number_slider_18)  # disabled

# ---- group: BOTTOM OF COLUMN
pt_15 = Point(pt_14)  # disabled

# ----
addition_4 = Addition(A=layer_count, B=top_extra_layers)
_110_pipe_radius_1mm_tolerance = Slider(55, range=0..100)
Z_6 = UnitZ(Factor=1)
pt_16 = Point(pt_14)
line_2 = LineSDL(Start=pt_16, Direction=Z_6, Length=addition_4)

# ---- group: waterPipe
pipe = Pipe(Curve=line_2, Radius=_110_pipe_radius_1mm_tolerance, Caps=0)

# ---- group: pipe
brep_2 = Brep(pipe)  # disabled

# ---- group: BOTTOM_PLATE (continued)
rectangle_2 = Rectangle(Plane=pt_15, XSize=dom_6, YSize=dom_6, Radius=0)  # -> Rectangle, Length; disabled
extr = Extrude(Base=rectangle_2.Rectangle, Direction=Z_5)  # disabled
cap = CapHoles(Brep=extr)  # disabled
disc = Discontinuity(Curve=rectangle_2.Rectangle, Level=1)  # -> Points, Parameters; disabled
item = ListItem(List=disc.Points, Index=0, Wrap=True)  # disabled
move_7 = Move(Geometry=item, Motion=panel_37)  # -> Geometry, Transform; disabled
vec2pt_2 = Vector2Pt(PointA=move_7.Geometry, PointB=pt_14, Unitize=False)  # -> Vector, Length; disabled
xy_3 = XYPlane(Origin=move_7.Geometry)  # disabled
align = AlignPlane(Plane=xy_3, Direction=vec2pt_2.Vector)  # -> Plane, Angle; disabled
rectangle_3 = Rectangle(Plane=align.Plane, XSize=dom_8, YSize=dom_7, Radius=0)  # -> Rectangle, Length; disabled
fillet = Fillet(Curve=rectangle_3.Rectangle, Radius=number_slider_12)  # disabled
extr_2 = Extrude(Base=fillet, Direction=Vector(0, 0, 100))  # disabled
move_8 = Move(Geometry=extr_2, Motion=Vector(0, 0, -77.06609237))  # -> Geometry, Transform; disabled
cap_2 = CapHoles(Brep=move_8.Geometry)  # disabled
sdiff = SolidDifference(BrepsA=cap, BrepsB=cap_2)  # disabled

# ----
sdiff_2 = SolidDifference(BrepsA=sdiff, BrepsB=cyl)  # disabled

# ---- group: BASE POINTS / POINT 0
panel_45 = Panel("0")

# ---- group: BASE POINTS (continued)
pt_17 = ConstructPoint(XCoordinate=pdecon_6.XComponent, YCoordinate=pdecon_6.YComponent, ZCoordinate=panel_45)

# ---- group: BASE POINTS / POINT 0 (continued)
pt_18 = Point(pt_17)

# ---- group: BASE POINTS / TOP OF ORIGINAL COLUMN
panel_46 = Panel("1800")

# ---- group: BASE POINTS (continued)
pt_19 = ConstructPoint(XCoordinate=pdecon_6.XComponent, YCoordinate=pdecon_6.YComponent, ZCoordinate=panel_46)

# ---- group: BASE POINTS / TOP OF ORIGINAL COLUMN (continued)
pt_20 = Point(pt_19)

# ----
pt_21 = Point(pt_12)  # disabled
number_slider_19 = Slider(300, range=0..1000)  # disabled
X_4 = UnitX(Factor=number_slider_19)  # disabled
move_9 = Move(Geometry=pt_21, Motion=X_4)  # -> Geometry, Transform; disabled
rotate_3 = Rotate(Geometry=move_9.Geometry, Angle=degrees(number_slider), Plane=pt_21)  # -> Geometry, Transform; disabled
number_slider_20 = Slider(22, range=0..1000)  # disabled
Z_7 = UnitZ(Factor=number_slider_20)  # disabled
number_slider_21 = Slider(270, range=0..1000)  # disabled
number_slider_22 = Slider(7, range=0..10)  # disabled
panel_47 = Panel("8")  # disabled
Z_8 = UnitZ(Factor=panel_47)  # disabled
number_slider_23 = Slider(3, range=0..10)  # disabled
number_slider_24 = Slider(141, range=0..200)  # disabled
Z_9 = UnitZ(Factor=expr("-x", 1))  # disabled
panel_48 = Panel("3")  # disabled
panel_49 = Panel("100")  # disabled
panel_50 = Panel("8")  # disabled

division_3 = Division(A=diameter_diagonal, B=2)  # disabled
division_4 = Division(A=diameter_vertical, B=2)  # disabled
Z_10 = UnitZ(Factor=z_height_cage)  # disabled
X_5 = UnitX(Factor=x_radius_cage)  # disabled
series = Series(Start=0, Step=expr("360/x", amount_of_bars), Count=amount_of_bars)  # disabled
addition_5 = Addition(A=division_4, B=diameter_stirrup, C=division_3)  # disabled
addition_6 = Addition(A=x_radius_cage, B=addition_5)  # disabled
X_6 = UnitX(Factor=addition_6)  # disabled
division_5 = Division(A=diameter_threaded_rod_top, B=2)  # disabled
subtraction_5 = Subtraction(A=x_radius_cage, B=division_5, C=division_4)  # disabled
X_7 = UnitX(Factor=subtraction_5)  # disabled
move_10 = Move(Geometry=pt_15, Motion=X_7)  # -> Geometry, Transform; disabled
pdecon_7 = Deconstruct(Point=move_10.Geometry)  # -> XComponent, YComponent, ZComponent; disabled
Z_11 = UnitZ(Factor=z_middle_height_stirrup)  # disabled
X_8 = UnitX(Factor=x_stirrup_distance_from_top)  # disabled
move_11 = Move(Geometry=pt_15, Motion=X_5)  # -> Geometry, Transform; disabled
addition_7 = Addition(A=pdecon_7.ZComponent, B=z_height_cage)  # disabled
move_12 = Move(Geometry=pt_15, Motion=X_6)  # -> Geometry, Transform; disabled
subtraction_6 = Subtraction(A=addition_7, B=threaded_rod_depth_into_column)  # disabled
addition_8 = Addition(A=X_6, B=Z_11)  # disabled
cage_bottompt = Point(move_11.Geometry)  # disabled
pt_22 = ConstructPoint(XCoordinate=pdecon_7.XComponent, YCoordinate=pdecon_7.YComponent, ZCoordinate=subtraction_6)  # disabled
move_13 = Move(Geometry=cage_bottompt, Motion=Z_10)  # -> Geometry, Transform; disabled
move_14 = Move(Geometry=move_12.Geometry, Motion=Z_10)  # -> Geometry, Transform; disabled
move_15 = Move(Geometry=pt_15, Motion=addition_8)  # -> Geometry, Transform; disabled
cage_toppt = Point(move_13.Geometry)  # disabled
stirrup_top_insidept = Point(move_14.Geometry)  # disabled
stirrup_midpt = Point(move_15.Geometry)  # disabled
line_3 = LineSDL(Start=pt_22, Direction=Vector(0, 0, 1), Length=length_of_threaded_rod)  # disabled
move_16 = Move(Geometry=cage_toppt, Motion=X_8)  # -> Geometry, Transform; disabled
stirrup_top_outsidept = Point(move_16.Geometry)  # disabled
ln_2 = Line(StartPoint=stirrup_top_insidept, EndPoint=stirrup_top_outsidept)  # disabled
ln_3 = Line(StartPoint=stirrup_midpt, EndPoint=stirrup_top_outsidept)  # disabled
ln_4 = Line(StartPoint=stirrup_top_insidept, EndPoint=stirrup_midpt)  # disabled
Z_12 = UnitZ(Factor=extension_bottom_large_stirrup)  # disabled
move_17 = Move(Geometry=stirrup_midpt, Motion=Z_12)  # -> Geometry, Transform; disabled
eval = EvaluateLength(Curve=ln_4, Length=extension_top_large_stirrup, Normalized=False)  # -> Point, Tangent, Parameter; disabled
ln_5 = Line(StartPoint=stirrup_midpt, EndPoint=stirrup_top_outsidept)  # disabled
ln_6 = Line(StartPoint=stirrup_top_insidept, EndPoint=eval.Point)  # disabled
bottom_stirruppt = Point(move_17.Geometry)  # disabled
end_2 = EndPoints(Curve=ln_6)  # -> Start, End; disabled
end_3 = EndPoints(Curve=ln_5)  # -> Start, End; disabled
pt_23 = Point(end_2.End)  # disabled
pt_24 = Point(end_2.Start)  # disabled
pt_25 = Point(end_3.Start)  # disabled
pt_26 = Point(end_3.End)  # disabled
number_slider_25 = Slider(42, range=0..100)  # disabled
join = JoinCurves(Curves=[ln_6, ln_2], Preserve=False)  # disabled
ln_7 = Line(StartPoint=stirrup_midpt, EndPoint=bottom_stirruppt)  # disabled
end_4 = EndPoints(Curve=ln_7)  # -> Start, End; disabled
pt_27 = Point(end_4.End)  # disabled
pline = PolyLine(Vertices=[pt_23, pt_24, pt_26, pt_25, pt_27], Closed=False)  # disabled
fillet_2 = Fillet(Curve=pline, Radius=number_slider_25)  # disabled
fillet_3 = Fillet(Curve=join, Radius=fillet_radius_large_stirrup_vertical)  # disabled
join_2 = JoinCurves(Curves=flatten([fillet_3, ln_5]), Preserve=False)  # disabled
fillet_4 = Fillet(Curve=join_2, Radius=fillet_radius_large_stirrup_diagonal)  # disabled
join_3 = JoinCurves(Curves=flatten([fillet_4, ln_7]), Preserve=False)  # disabled
disc_2 = Discontinuity(Curve=join_3, Level=1)  # -> Points, Parameters; disabled
item_2 = ListItem(List=disc_2.Parameters, Index=0, Wrap=True)  # disabled
fillet_5 = Fillet(Curve=join_3, Parameter=item_2, Radius=fillet_radius_large_stirrup_middle_secti)  # -> Curve, Parameter; disabled
X_9 = UnitX(Factor=offset_for_stirrup_vertical_intersection)  # disabled
X_10 = UnitX(Factor=1)  # disabled
X_11 = UnitX(Factor=expr("-x", offset_for_stirrup_diagonal_intersection))  # disabled
number_slider_26 = Slider(70, range=0..1000)  # disabled
Z_13 = UnitZ(Factor=number_slider_26)  # disabled
addition_9 = Addition(A=diameter_vertical, B=diameter_stirrup)  # disabled
number_slider_27 = Slider(0, range=0..10)  # disabled
X_12 = UnitX(Factor=addition_9)  # disabled
number_slider_28 = Slider(90, range=0..1000)  # disabled
Z_14 = UnitZ(Factor=number_slider_27)  # disabled
number_slider_29 = Slider(28, range=-11..50)  # disabled
number_slider_30 = Slider(14, range=0..100)  # disabled
X_13 = UnitX(Factor=number_slider_30)  # disabled
X_14 = UnitX(Factor=number_slider_28)  # disabled
subtraction_7 = Subtraction(A=addition_9, B=number_slider_29)  # disabled
X_15 = UnitX(Factor=subtraction_7)  # disabled
number_slider_31 = Slider(15, range=0..100)  # disabled
X_16 = UnitX(Factor=number_slider_31)  # disabled
addition_10 = Addition(A=diameter_vertical, B=diameter_transversal_stirrup)  # disabled

move_18 = Move(Geometry=cage_bottompt, Motion=Z_2)  # -> Geometry, Transform; disabled

rotate_4 = Rotate(Geometry=graft(rotate_3.Geometry), Angle=degrees(series), Plane=pt_15)  # -> simplify(Geometry), Transform; disabled
vec2pt_3 = Vector2Pt(PointA=rotate_4.Geometry, PointB=pt_21, Unitize=False)  # -> Vector, Length; disabled
move_19 = Move(Geometry=rotate_4.Geometry, Motion=expr("-x", Z_7))  # -> Geometry, Transform; disabled
xy_4 = XYPlane(Origin=move_19.Geometry)  # disabled
cyl_2 = Cylinder(Base=move_19.Geometry, Radius=number_slider_22, Length=number_slider_21)  # disabled
align_2 = AlignPlane(Plane=xy_4, Direction=vec2pt_3.Vector)  # -> Plane, Angle; disabled
deplane = DeconstructPlane(Plane=align_2.Plane)  # -> Origin, XAxis, YAxis, ZAxis; disabled
rectangle_4 = Rectangle(Plane=align_2.Plane, XSize=Domain(-17.5, 17.5), YSize=Domain(-17.5, 17.5), Radius=0)  # -> Rectangle, Length; disabled
debrep = DeconstructBrep(Brep=rectangle_4.Rectangle)  # -> Faces, Edges, Vertices; disabled
unit = UnitVector(Vector=deplane.YAxis)  # disabled
extr_3 = Extrude(Base=rectangle_4.Rectangle, Direction=Z_8)  # disabled
item_3 = ListItem(List=debrep.Vertices, Index=0, Wrap=True)  # -> Item, Item1, Item2, Item3; disabled
multiplication = Multiplication(A=unit, B=number_slider_23)  # disabled
pt_28 = Point(item_3.Item1)  # disabled
pt_29 = Point(item_3.Item2)  # disabled
pt_30 = Point(item_3.Item3)  # disabled
pt_31 = Point(item_3.Item)  # disabled
move_20 = Move(Geometry=flatten(pt_31), Motion=multiplication)  # -> Geometry, Transform; disabled
move_21 = Move(Geometry=flatten(pt_28), Motion=multiplication)  # -> Geometry, Transform; disabled
ln_8 = Line(StartPoint=pt_29, EndPoint=pt_30)  # disabled
curvepoint = PointOnCurve(ln_8, parameter=0.5)  # disabled
move_22 = Move(Geometry=flatten(curvepoint), Motion=expr("-x", multiplication))  # -> Geometry, Transform; disabled
line_4 = LineSDL(Start=[move_20.Geometry, move_21.Geometry, move_22.Geometry], Direction=Z_9, Length=number_slider_24)  # disabled
cyl_3 = Cylinder(Base=xy_4, Radius=panel_50, Length=panel_49)  # disabled
pipe_2 = Pipe(Curve=line_4, Radius=panel_48, Caps=0)  # disabled
cap_3 = CapHoles(Brep=extr_3)  # disabled

# ---- group: Small plates
geo = Geometry([cap_3, pipe_2])  # disabled

# ----
geo_2 = Geometry(cyl_3)  # disabled

# ---- group: Threaded rods
pipe_3 = Pipe(Curve=line_3, Radius=expr("x/2", diameter_threaded_rod_top), Caps=1)  # disabled

# ---- group: BOTTOM_PLATE (continued)
move_23 = Move(Geometry=cage_bottompt, Motion=neg_5)  # -> Geometry, Transform; disabled
rotate_5 = Rotate(Geometry=graft(move_23.Geometry), Angle=degrees(series), Plane=pt_15)  # -> simplify(Geometry), Transform; disabled
rotate_6 = Rotate(Geometry=rotate_5.Geometry, Angle=degrees(number_slider_11), Plane=pt_15)  # -> Geometry, Transform; disabled
cyl_4 = Cylinder(Base=rotate_6.Geometry, Radius=expr("x/2", diameter_bottom_plate_connectors), Length=height_bottom_plate_connectors)  # disabled
cap_4 = CapHoles(Brep=cyl_4)  # disabled

# ----
int = Integer(number_slider_4)
division_6 = Division(A=int, B=2)

# ---- group: offset_pattern_sides
range_4 = Range(Domain=dom_2, Steps=expr("x-1", division_6))

# ----
graph_4 = GraphMapper(range_4, x0=0, x1=1, y0=0, y1=1, Cx=0.256539166, Cy=0.7374838591, container_name="Conic")

graph_5 = GraphMapper(range_4, x0=0, x1=1, y0=0, y1=1, Gx=0.5, Gy=0.5, container_name="Power", power=1)
data_5 = Data(graph_4)
bnd_3 = Bounds(Numbers=data_5)
remap_3 = RemapNumbers(Value=data_5, Source=bnd_3, Target=dom_2)  # -> Mapped, Clipped
rev = ReverseList(List=remap_3.Mapped)
merge = Merge(Data1=remap_3.Mapped, Data2=rev)  # -> flatten(Result)

lng_2 = ListLength(List=remap_3.Mapped)
split_2 = SplitList(List=remap_3.Mapped, Index=expr("x-1", lng_2))  # -> ListA, ListB
panel_51 = Panel(graph_4)
graph_6 = QuickGraph(merge, SortOrder=0)

# ---- group: Div point offset
range_5 = Range(Domain=Domain(0, 1), Steps=expr("x-1", layer_count_2))

# ---- group: Div point offset / new
graph_7 = GraphMapper(
    range_5,
    x0=0,
    x1=1,
    y0=0,
    y1=1,
    container_name="Bezier",
    cpx=[0, 0.09421224892, 0.1995768547, 1],
    cpy=[0.3467151523, 0.4708094597, 0.008040904999, 0])

# ---- group: old graph
graph_8 = GraphMapper(
    range_5,
    x0=0,
    x1=1,
    y0=0,
    y1=1,
    container_name="Bezier",
    cpx=[0, 0.5091154575, 0.05710413679, 1],
    cpy=[0.2446190715, 0.4540976286, 0.07733350992, 0])

# ---- group: Div point offset (continued)
data_6 = Data(graph_7)
bnd_4 = Bounds(Numbers=data_6)
remap_4 = RemapNumbers(Value=data_6, Source=bnd_4, Target=dom_4)  # -> Mapped, Clipped

# ----
python_2 = GhPythonScript(
    short_edges=ln,
    centroid=pt_2,
    curve_offset=remap.Mapped,
    crown_top_curve_offset=crown_top_curve_offset_mm,
    rib_offset=data_2,
    layer_height=layer_height,
    div_pt_count=number_slider_4,
    div_pt_offset=remap_4.Mapped,
    scale_factor=remap_2.Mapped,
    layer_selection_start=layer_selection_start,
    layer_selection_end=layer_selection_end,
    offset_x=data,
    undulations_type=list_2,
    curve_type=list,
    extra_layers=top_extra_layers,
    offset_pattern_sides=merge)  # -> out, total_curves, polyline_layers, flat_pt_list, angle_lines, axis_moving_pts, axis_moving_pts_indices, lines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; inputs short_edges: list of Curve, centroid: Point3d, curve_offset: list, crown_top_curve_offset: Int32, tan_rot_angle: list, rib_offset: list, div_pt_count: Int32, div_pt_offset: list, scale_factor: list, layer_selection_start: Int32, layer_selection_end: Int32, offset_x: list, extra_layers: Int32, offset_pattern_sides: list
# ---------- python_2: Python ----------
__author__ = "joburger&niztaha"
__version__ = "2019.06.12"

import Rhino.Geometry as rg
import math
import imp

from design import curve_undulation as cu
from design import generate_column as gc

imp.reload(cu)
imp.reload(gc)

curves = []
total_curves = []
pt_list = []
angle_lines = []
polyline_layers = []
lines = []
line1 = []
line2 = []
curve_list = []
polyline_pt_list = []
lAxis_pt_list = []
crown_short_edges_pts = []

#axis_moving_pts_indices = []

div_pt_offset_at_column_top = div_pt_offset[100]

# Column top crown addition
if layer_selection_start == 0 :
    layer_selection_end = layer_selection_end + extra_layers
    # move initial edges as much as the extra layers
    
    for i in range(len(short_edges)):
        short_edges[i].Transform(rg.Transform.Translation(rg.Vector3d(0,0,extra_layers)))

    #curve_offset = gc.reverse_extend_list_at_index(curve_offset,extra_layers,1)
    offset_x = gc.reverse_extend_list_at_index(offset_x,extra_layers,1)

    # rib_offset = gc.reverse_extend_list_at_index(rib_offset,extra_layers,1)
    rib_offset_0 = [0 for i in range (extra_layers)]
    rib_offset_0.reverse()
    rib_offset[0:0] = rib_offset_0

    div_pt_offset = gc.reverse_extend_list_at_index(div_pt_offset,extra_layers,1)

    scale_45 = [i+1 for i in range (extra_layers)]
    scale_45.reverse()
    scale_factor[0:0] = scale_45
    
    check_layer = 100
    print "div_pt_offset", div_pt_offset[check_layer-3:check_layer+3]
    print "offset_x", offset_x[check_layer-3:check_layer+3]

new_div_pt_offset = []

# column generation
n = len(short_edges)
for i in range(layer_selection_start, layer_selection_end):
    
    for j in range(n):
        pt1, moved_pt1 = gc.create_rib(short_edges,i,j, rib_offset, -1, scale_factor, centroid)
        pt2, moved_pt2 = gc.create_rib(short_edges,i,(j-(n-1)), rib_offset, 1, scale_factor, centroid)
        # create curve
        if curve_type == 0:
            # OPTION 1: create control point curve
            curve, curve_list = gc.create_cp_crv(curve_offset, i, moved_pt1, moved_pt2, extra_layers, crown_top_curve_offset)
        elif curve_type == 1:
            # OPTION 2: create interpolated curve
            vect_tangent_1 = gc.get_edge_tanget(short_edges,i,j, -1)
            vect_tangent_2 = gc.get_edge_tanget(short_edges,i,(j-(n-1)), 1)
            vect_tan_Tr_10 = gc.transform_edge_tangent(vect_tangent_1, i, tan_rot_angle, -1, tan_rot_start_layer)
            vect_tan_Tr_20 = gc.transform_edge_tangent(vect_tangent_2, i, tan_rot_angle, 1, tan_rot_start_layer)
            # if above generate_increment_from_shortest_curve is used
            vect_tan_Tr_11 = gc.transform_edge_tangent(vect_tan_Tr_10, i, shortest_tan_rot_angles, -1)
            vect_tan_Tr_21 = gc.transform_edge_tangent(vect_tan_Tr_20, i, shortest_tan_rot_angles, 1)

            curve, curve_list = gc.create_inter_crv(new_curve_offset, i, pt1, pt2, moved_pt1, moved_pt2, vect_tan_Tr_11, vect_tan_Tr_21)
        
        elif curve_type == 2:
            # OPTION 3: create blend curve
            curve, curve_list = gc.create_blend_crv(short_edges,j, curve_offset, i, pt1, pt2, moved_pt1, moved_pt2, 200)

        copy_curve = gc.create_column(layer_height, curve, i)

        # append curves
        curves.append(copy_curve)

        # connect curves with straight lines and append
        line_pt1 = copy_curve.PointAtEnd
        line_pt2 = copy_curve.PointAtStart
        line1.append(line_pt1)
        line2.append(line_pt2)
        
        if j > 0:
            line = rg.Line(line1[j-1], line2[j])
            lines.append(line)
            if i == 0:
                crown_short_edges_pts.append(line1[j-1])
                crown_short_edges_pts.append(line2[j])
        if j == n-1:
            line = rg.Line(line1[-1], line2[0])
            lines.append(line)
            if i == 0:
                crown_short_edges_pts.append(line1[-1])
                crown_short_edges_pts.append(line2[0])
                
        # create undulations
        if undulations_type == 0:
            unds = cu.Curve_undulation(copy_curve, div_pt_count, div_pt_offset[i])
            undulated_divpts = unds.curve_undulation_original()
        else:
            unds = cu.Curve_undulation(i, copy_curve, div_pt_count, div_pt_offset[i], div_pt_offset_at_column_top, offset_pattern_sides, offset_x[i])
            undulated_divpts = unds.curve_undulation_grid()

        # append to lists
        pt_list.append(undulated_divpts)
        polyline_pt_list.append(undulated_divpts)


    # flatten list and create polyline per layer
    flat_polyline_list = gc.flatten_list(polyline_pt_list)
    polyline_layer = rg.PolylineCurve(flat_polyline_list + [flat_polyline_list[0]])
    polyline_layers.append(polyline_layer)

    angle_lines = gc.create_angleLines(pt_list, flat_polyline_list, div_pt_count, n)

    # reset lists
    polyline_pt_list = []
    line1 = []
    line2 = []


flat_pt_list = gc.flatten_list(pt_list)

total_curves = gc.flatten_list([curves, lines])
# ---------- end python_2 ----------
join_4 = JoinCurves(Curves=python_2.total_curves, Preserve=False)
geo_3 = Geometry(python_2.test_edges)
geo_4 = Geometry(python_2.test_ribs)
sort_on_z = SortOnZ(A=join_4)
crv_3 = Curve(python_2.curves)
crv_4 = Curve(crv_3)  # disabled
flat_pt_list = Point(python_2.flat_pt_list)

# ---- group: axis_moving_pts
pt_32 = Point(python_2.axis_moving_pts)

# ----
crv_5 = Curve(python_2.lines)
crv_6 = Curve(crv_5)  # disabled
python_3 = GhPythonScript(short_edges=line, curves=crv_4, lines=crv_6)  # -> crown_curves, crown_short_edges, beamSurfaces, cornerPts; inputs short_edges: list, curves: list, lines: list; disabled
# ---------- python_3: Python ----------
__author__ = "nizart"
__version__ = "2019.02.15"

import Rhino.Geometry as rg
import rhinoscriptsyntax as rs

crown_curves = curves[:len(short_edges)]
crown_short_edges = lines[:len(short_edges)]
print crown_short_edges

# shift crown short edges pts list twice to match with short edges list
crown_short_edges.insert(0,crown_short_edges.pop())

# generate top steel plate

beamSurfaces=[]
cornerPts=[]

#beamSurfacesNormals = []
#beamSurfacesPlanes =[]

for i in range(len(crown_short_edges)):
    #short edge
    short_edgeStart = rs.CurveStartPoint(short_edges[i])
    short_edgeEnd = rs.CurveEndPoint(short_edges[i])
    #crown short edge
    crown_short_edgeStart = rs.CurveStartPoint(crown_short_edges[i])
    crown_short_edgeEnd = rs.CurveEndPoint(crown_short_edges[i])
    #corner pts list
    cornerVertices = [short_edgeStart ,crown_short_edgeStart, crown_short_edgeEnd, short_edgeEnd]
    cornerPts.extend(cornerVertices)
    # create surface
    beamSurface = rs.AddSrfPt(cornerVertices)
    beamSurfaces.append(beamSurface)
    
#    # create plane nad find surface normal
#    srfPlane = rs.PlaneFitFromPoints(cornerPts)
#    # move plane to surface center
#    srfCentroid = rs.SurfaceAreaCentroid(beamSurface)
#    xform = rs.XformTranslation(srfCentroid[0])
##    srfPlaneMoved = rs.MovePlane(srfPlane,srfCentroid[0])
#    srfPlaneMoved = rs.PlaneTransform(srfPlane, xform)
#    beamSurfacesPlanes.append(srfPlaneMoved)
#    # find surface normal
#    srfParameter = rs.SurfaceParameter(beamSurface,[0.5,0.5])
#    beamSurfaceNormal = rs.SurfaceNormal(beamSurface,srfParameter)
#    beamSurfacesNormals.append(beamSurfaceNormal)
# ---------- end python_3 ----------
partition = PartitionList(List=python_3.cornerPts, Size=panel_6)  # disabled
item_4 = ListItem(List=partition, Index=0, Wrap=True)  # -> flatten(Item1), flatten(Item), flatten(Item1_2), flatten(Item2); disabled
srf = Surface(python_3.beamSurfaces)  # disabled
item_5 = ListItem(List=srf, Index=number_slider_2, Wrap=True)  # disabled
pln = Plane(item_5)  # disabled
line_5 = Line(python_3.crown_short_edges)  # disabled
crv_7 = Curve(python_3.crown_curves)  # disabled

# ---- group: short edges
pt_33 = Point(item_4.Item1)  # disabled
pt_34 = Point(item_4.Item)  # disabled

# ---- group: crown short edges
pt_35 = Point(item_4.Item1_2)  # disabled
pt_36 = Point(item_4.Item2)  # disabled

# ----
ln_9 = Line(StartPoint=pt_36, EndPoint=pt_33)  # disabled
ln_10 = Line(StartPoint=pt_34, EndPoint=pt_35)  # disabled
ln_11 = Line(StartPoint=pt_33, EndPoint=pt_34)  # disabled

# ---- group: Crown Curve
join_5 = JoinCurves(Curves=flatten([ln_9, ln_11, ln_10, crv_7]), Preserve=False)  # disabled
crv_8 = Curve(join_5)  # disabled

# ----
polyline_layers = Curve(python_2.polyline_layers)

item_6 = ListItem(List=polyline_layers, Index=sheets_layer, Wrap=True)
curvepoint_2 = PointOnCurve(item_6, parameter=0.5)
movetoplane = MoveToPlane(Geometry=move_5.Geometry, Plane=curvepoint_2, Above=True, Below=True)  # -> Geometry, Transform
movetoplane_2 = MoveToPlane(Geometry=move_4.Geometry, Plane=curvepoint_2, Above=True, Below=True)  # -> Geometry, Transform
rdiff = RegionDifference(CurvesA=movetoplane.Geometry, CurvesB=item_6)
rdiff_2 = RegionDifference(CurvesA=movetoplane_2.Geometry, CurvesB=item_6)
crv_9 = Curve([rdiff, rdiff_2])
previewlw = CustomPreviewLineweights(Geometry=crv_9, Shader=ColourSwatch(SwatchColor=RGB(255, 0, 0)), Thickness=Slider(3, range=0..10), Absolute=False)

pdecon_8 = Deconstruct(Point=curvepoint_2)  # -> XComponent, YComponent, ZComponent
pt_37 = ConstructPoint(XCoordinate=pdecon_5.XComponent, YCoordinate=pdecon_5.YComponent, ZCoordinate=pdecon_8.ZComponent)
pt_38 = Point(pt_37)

# ---- group: Engraving
tag = TextTag3D(
    Location=pt_38,
    Text=panel_40,
    Size=Slider(20, range=0..100),
    Colour=ColourSwatch(SwatchColor=RGB(255, 0, 0)),
    Justification=5)

# ----
curves = Curve(sort_on_z)
loft = Loft(Curves=curves, Options={Adjust=False, Closed=False, LoftEnds=0, LoftSimp=0, LoftType=0, Rebuild=18, Refit=0.01})  # disabled
cap_5 = CapHoles(Brep=loft)
loft_2 = Loft(Curves=polyline_layers, Options={Adjust=False, Closed=False, LoftEnds=0, LoftSimp=0, LoftType=0, Rebuild=10, Refit=0.01})
item_7 = ListItem(List=polyline_layers, Index=Slider(293, range=0..1000), Wrap=True)
volume = Volume(Geometry=cap_5)  # -> Volume, Centroid

# ---- group: Printing time
len = Length(Curve=polyline_layers)  # disabled
number_slider_32 = Slider(40, range=0..100)  # disabled
ma = MassAddition(Input=len)  # -> Result, PartialResults; disabled
python_4 = GhPythonScript(tot_length=ma.Result, print_speed=number_slider_32)  # -> simplify(out), a; disabled
# ---------- python_4: Python ----------
__author__ = "joburger"
__version__ = "2018.09.06"

import imp
from design import generate_column as gc

imp.reload(gc)

gc.calculate_weight(tot_length, print_speed)
# ---------- end python_4 ----------

# ----
crv_10 = Curve(python_2.angle_lines)  # disabled
null = NullItem(Item=crv_10)  # -> NullFlags, InvalidFlags, Description; disabled
not = GateNot(A=null.InvalidFlags)  # disabled
cull = CullPattern(List=crv_10, CullPattern=not)  # disabled
len_2 = Length(Curve=cull)  # disabled
division_7 = Division(A=layer_height, B=len_2)  # disabled
list_10 = ValueList({"Show curve gradient": "gradient", "Show invalid curves": "invalid"}, selected="Show invalid curves")  # disabled
number_slider_33 = Slider(43, range=0..100)  # disabled
acos = ArcCosine(Value=division_7)  # disabled
deg = Degrees(Radians=acos)  # disabled
python_5 = GhPythonScript(deg=deg, show_curve_type=list_10, max_angle=number_slider_33)  # -> out, a, b; inputs deg: list; disabled
# ---------- python_5: Python ----------
__author__ = "Joris"
__version__ = "2018.10.31"

import rhinoscriptsyntax as rs

a = []
highest = max(deg)

if show_curve_type == "gradient":
    for i in range(len(deg)):
        if deg[i] < 400:
            red = deg[i] * (255/highest)
            green = 0
            blue = 0
            colour = rs.CreateColor(red, green, blue)
            a.append(colour)
elif show_curve_type == "invalid":
    for i in range(len(deg)):
        if deg[i] > max_angle:
            red = 200
            green = 0
            blue = 0
        else:
            red = 0
            green = 175
            blue = 0
        colour = rs.CreateColor(red, green, blue)
        a.append(colour)
# ---------- end python_5 ----------
panel_52 = Panel(deg)  # disabled
preview_2 = CustomPreview(Geometry=polyline_layers, Material=python_5.a)  # disabled

# ---- group: Orient for printing
item_8 = ListItem(List=polyline_layers, Index=-1, Wrap=True)  # disabled
area_2 = Area(Geometry=item_8)  # -> Area, Centroid; disabled
xy_5 = XYPlane(Origin=orientpt)  # disabled
xy_6 = XYPlane(Origin=area_2.Centroid)  # disabled
orient = Orient(Geometry=polyline_layers, Source=xy_6, Target=xy_5)  # -> Geometry, Transform; disabled
orient_2 = Orient(Geometry=flat_pt_list, Source=xy_6, Target=xy_5)  # -> Geometry, Transform; disabled

# ----
panel_53 = Panel(python_4.out)  # disabled

# ---- group: Oriented curves
crv_11 = Curve(orient.Geometry)  # disabled

# ---- group: Oriented points
pt_39 = Point(orient_2.Geometry)  # disabled

# ----
loft_3 = Loft(Curves=crv_11, Options={Adjust=False, Closed=False, LoftEnds=0, LoftSimp=0, LoftType=0, Rebuild=10, Refit=0.01})  # disabled
pdecon_9 = Deconstruct(Point=pt_39)  # -> XComponent, YComponent, ZComponent; disabled
filter_2 = StreamFilter(Gate=list_7, Stream0=pdecon_9.ZComponent, Stream1=pdecon_4.ZComponent)  # disabled
pt_40 = ConstructPoint(XCoordinate=pdecon_9.XComponent, YCoordinate=pdecon_9.YComponent, ZCoordinate=filter_2)  # disabled
xy_7 = XYPlane(Origin=pt_40)  # disabled
pln_2 = Plane(flatten(xy_7))  # disabled
data_7 = Data(python_2.axis_moving_pts_indices)  # disabled

# ---- group: Fabrication planes
rev_2 = ReverseList(List=pln_2)  # disabled

# ----
pln_3 = Plane(flatten(rev_2))  # disabled
rotate_7 = Rotate(Geometry=pln_3, Angle=-1.570796327, Plane=pln_3)  # -> Geometry, Transform

# ---- group: Define commands
safe_speed = Slider(25, range=0..300)
# 2
number_slider_34 = Slider(4, range=0..100)
speed = Slider(45, range=0..300)
planes_wcs = Plane(rotate_7.Geometry)
python_6 = PythonScript(planes_WCS=planes_wcs, dfillet=number_slider_34, speed=speed, safe_speed=safe_speed, safe_pt=rotate_2.Geometry)  # -> commands; inputs planes_WCS: list of Plane, speed: Int32, safe_pt: Plane
# ---------- python_6: Python ----------
import imp
from design import generate_commands as gcmds

imp.reload(gcmds)

commands = gcmds.generate_cmds(planes_WCS, dfillet, speed, safe_speed, safe_pt)

print commands[0]
# ---------- end python_6 ----------

# ----
item_9 = ListItem(List=planes_wcs, Index=0, Wrap=True)  # -> Item1, Item
pln_4 = Plane([item_9.Item1, item_9.Item])

# ----
# Visualisation
robot_2 = Data(robot)
pose_joints = Data(pose)
planes_wcs_2 = Plane(pln_4)

# ---- group: Calculate joint positions for path
# Add init joint states
joint_states = Data([-0.1728179112, -1.415058186, 1.813991282, -1.971940356, -1.571654205, -3.308720436])
init_configuration = Slider(0, range=0..7)
py_5 = PythonScript(robot=robot_2, planes_WCS=planes_wcs_2, configuration_idx=init_configuration, init_configuration=joint_states)  # -> configurations; inputs planes_WCS: list, configuration_idx: Int32, init_configuration: list
# ---------- py_5: Python ----------
from compas_ghpython import unload_modules
unload_modules('ur_online_control')
import Rhino.Geometry as rg
from compas.geometry import Frame 
from compas.geometry.xforms import Transformation
from compas_ghpython import xdraw_frame
from ur_online_control.ur.kinematics import calculate_configurations_for_path, format_joint_positions


# TODO this must be optimized! matrix multiplication!
frames_tool0_RCS = []
for plane_WCS in planes_WCS:
    tcp_WCS = Frame(plane_WCS.Origin, plane_WCS.XAxis, plane_WCS.YAxis)
    tcp_RCS = robot.get_frame_in_RCS(tcp_WCS)
    frames_tool0_RCS.append(robot.get_tool0_frame_from_tcp_frame(tcp_RCS))
    

#configurations = calculate_configurations_for_path(frames_tool0_RCS, robot.params, init_configuration)
configurations = calculate_configurations_for_path(frames_tool0_RCS, robot, init_configuration)
print configurations
configurations = configurations[min([configuration_idx, len(configurations) - 1])]

def format(numbers, k=4):
    #numbers = format_joint_positions(numbers)
    return "[" + ", ".join([("%." + str(k) + "f") % n for n in numbers]) + "]"
# ---------- end py_5 ----------
start_4 = Button()
stop_3 = Button()
step = Button()
counter = CountThroughList(L=py_5, start=start_4, stop=stop_3, step=step, step_back=back, reset=reset, interval=50)  # -> item; inputs L: list, start: Boolean, stop: Boolean, step_back: Boolean
# ---------- counter: Python ----------
from scriptcontext import sticky as st
from compas_ghpython import update_component


# store data in component
guid = str(ghenv.Component.InstanceGuid)
counter_key = "counter_" + guid
running_key = "running_" + guid

if counter_key not in st:
    st[counter_key] = 0

if running_key not in st:
    st[running_key] = False

if start:
    st[running_key] = True

if stop:
    st[running_key] = False

if step:
    if st[counter_key] < len(L) - 1:
        st[counter_key] += 1

if step_back:
    if st[counter_key] < len(L) - 1:
        st[counter_key] -= 1

if reset:
    st[counter_key] = 0

if len(L):
    item = L[st[counter_key]]

if st[running_key]:
    if st[counter_key] < len(L) - 1:
        st[counter_key] += 1
        update_component(ghenv, interval)
    else:
        st[counter_key] = 0
        st[running_key] = False
# ---------- end counter ----------

# ---- group: Define plane in WCS, calculate joint positions
pt_41 = Point(Point(-283.8412985, -342.877576, 297.4189147))
select_configuration = Slider(1, range=0..7)
xy_8 = XYPlane(Origin=pt_41)
plane_wcs = Plane(xy_8)
inverse = PythonScript(robot=robot_2, plane_WCS=plane_wcs, idx=select_configuration)  # -> configuration; inputs plane_WCS: Plane, idx: Int32
# ---------- inverse: Python ----------
import Rhino.Geometry as rg
from compas.geometry import Frame, Transformation
from compas_ghpython import xdraw_frame

tcp_WCS = Frame(plane_WCS.Origin, plane_WCS.XAxis, plane_WCS.YAxis)

# transform frame to robot coordinate system
tcp_RCS = robot.get_frame_in_RCS(tcp_WCS)

# get the frame of tool0
tool0_RCS = robot.get_tool0_frame_from_tcp_frame(tcp_RCS)

# calculate solutions to frame
solutions = robot.inverse_kinematics(tool0_RCS)

if not len(solutions):
    q = [0,0,0,0,0,0]
else:
    idx = min(len(solutions) - 1, idx)
    q = solutions[idx]
    
print q

configuration = q
# ---------- end inverse ----------

# ---- group: Calculate joint positions for path / Shows joint positions along path
flip = BooleanToggle(True)
l2t = PythonScript(L=py_5, flip=flip)  # -> T; inputs L: list, flip: Boolean
# ---------- l2t: Python ----------
from compas_ghpython import list_to_ghtree
L = [l.joint_values for l in L]

if flip:
    L = zip(*L)
T = list_to_ghtree(L)
# ---------- end l2t ----------
graph_9 = QuickGraph(l2t, SortOrder=0)

# ---- group: Visualise
list_11 = ValueList({"0 forward, from angles": 0, "1 inverse, from one plane": 1, "2 inverse, from multiple planes": 2, "3 forward, from robot": 3}, selected="2 inverse, from multiple planes")
filter_3 = StreamFilter(Gate=list_11, Stream0=py_3, Stream1=inverse, Stream2=counter, Stream3=pose_joints)
configuration = Panel(filter_3)
mesh = Mesh(filter)
draw = PythonScript(robot=robot_2, configuration=filter_3, mesh=mesh, brep=filter, show_brep=show_brep)  # -> meshes, tool0_plane, tcp_plane, robot_brep; inputs mesh: list, brep: list
# ---------- draw: Python ----------
from compas_ghpython import unload_modules
unload_modules("ur_online_control")

from compas_ghpython import xdraw_frame
from compas_ghpython import mesh_draw
from compas_ghpython.geometry.xforms import xform_from_transformation
from compas.geometry import Frame
from compas.geometry.xforms import Transformation
from ur_online_control.ur.robot import BaseConfiguration

import Rhino.Geometry as rg
import Rhino

def mesh_update_vertices(mesh, vertices):
    for i in range(len(vertices)):
        mesh.vertex[i].update({'x': vertices[i][0], 'y': vertices[i][1], 'z': vertices[i][2]})

if configuration:
    #print configuration
    #q = BaseConfiguration.from_joints(configuration)
    q = configuration
    print q
    print q.joint_values
    
    print robot.get_forward_transformations(q)
    R0, R1, R2, R3, R4, R5 = robot.get_forward_transformations(q)
    
    tool0_frame2 = robot.tool0_frame.transformed(R5)
    tcp_frame2 = Frame.from_transformation(Transformation.from_frame(tool0_frame2) * robot.transformation_tool0_tcp)
    
    print robot.transformation_tool0_tcp
    print robot.transformation_tcp_tool0
    print robot.transformation_tool0_tcp * robot.transformation_tcp_tool0
    print tcp_frame2
    tcp_frame2 = Frame.from_transformation(Transformation.from_frame(tool0_frame2) * robot.transformation_tcp_tool0)
    print tcp_frame2
    
    tool0_frame, tcp_frame = robot.get_transformed_tool_frames(R5)
    
    tool0_frame = tool0_frame2
    tcp_frame = tcp_frame2
    
    m0, m1, m2, m3, m4, m5 = mesh
    for i in range(6):
        exec("R%drg = xform_from_transformation(R%d)" % (i, i))
        exec("m%d.Transform(R%drg)" % (i, i))
    meshes = [m0, m1, m2, m3, m4, m5]
    print meshes
    mt = robot.tool.get_transformed_model(Transformation.from_frame(tool0_frame))
    
    if mt:
        meshes.extend(map(mesh_draw, mt))
    
    """
    m0, m1, m2, m3, m4, m5, tool0_frame, tcp_frame = robot.get_transformed_model(q)
    mt = robot.get_transformed_tool_model(tcp_frame)
    
    meshes = []
    meshes.append(mesh_draw(m0))
    meshes.append(mesh_draw(m1))
    meshes.append(mesh_draw(m2))
    meshes.append(mesh_draw(m3))
    meshes.append(mesh_draw(m4))
    meshes.append(mesh_draw(m5))
    if mt:
        meshes.append(mesh_draw(mt))
    
    """
    
    tool0_plane = xdraw_frame(tool0_frame)
    tcp_plane = xdraw_frame(tcp_frame)
    
    if show_brep:
        
        b0, b1, b2, b3, b4, b5 = brep
        
        b0.Transform(R0rg)
        b1.Transform(R1rg)
        b2.Transform(R2rg)
        b3.Transform(R3rg)
        b4.Transform(R4rg)
        b5.Transform(R5rg)
        
        robot_brep = [b0, b1, b2, b3, b4, b5]
# ---------- end draw ----------
tool0_plane = Plane(draw.tool0_plane)
tcp_plane = Plane(draw.tcp_plane)
robot_brep = Brep(draw.robot_brep)
draw_2 = RepresentPlaneAsLines(plane=tcp_plane, size=100)  # -> G, C
# ---------- draw_2: Python ----------
import Rhino.Geometry as rg
from System.Drawing import Color

if plane:

    G = []
    G.append(rg.Line(plane.Origin, size * plane.XAxis))
    G.append(rg.Line(plane.Origin, size * plane.YAxis))
    G.append(rg.Line(plane.Origin, size * plane.ZAxis))
    
    C = []
    C.append(Color.FromArgb(255, 0, 0))
    C.append(Color.FromArgb(0, 255, 0))
    C.append(Color.FromArgb(0, 0, 255))
# ---------- end draw_2 ----------
preview_3 = CustomPreview(Geometry=draw_2.G, Shader=draw_2.C)
preview_4 = CustomPreview(Geometry=draw.meshes, Shader=ColourSwatch(SwatchColor=RGBA(99, 94, 94, 96)))

# ---- group: Linear axis indices
rev_3 = ReverseList(List=data_7)  # disabled

# ----
cull_i = CullIndex(List=rev_3, Indices=panel_30, Wrap=True)  # disabled

move_filament_loading_pt = BooleanToggle(True)
continue_fabrication = BooleanToggle(True)
# 3
panel_54 = Panel("Send a message")
move_linear_axis = BooleanToggle(False)
send_10 = Button()
data_8 = Data(cull_i)
commands = Data(python_6)
send_11 = PythonScript(
    client=client.client,
    send=send_10,
    continue_fabrication=continue_fabrication,
    commands=commands,
    move_filament_loading_pt=move_filament_loading_pt,
    move_linear_axis=move_linear_axis,
    axis_moving_pts_indices=data_8,
    path=py_2,
    save_json=save_json,
    name_json="commands.json")  # -> out, all_batches; inputs continue_fabrication: Int32, commands: list, move_filament_loading_pt: Boolean, axis_moving_pts_indices: list
# ---------- send_11: Python ----------
import json
import os

from ur_online_control.communication.msg_identifiers import *
from ur_online_control.utilities.lists import flatten_list
from time import sleep


def chunks(inputList, n):
    """Yield successive n-sized chunks from inputList """
    for i in xrange(0, len(inputList), n):
        yield inputList[i:i + n]

#number of values per command to be formatted 
len_command = len(commands[0])
gh_commands = flatten_list(commands)


#set the desired batch length
commandsPerBatch = 30
batchLen = len_command*commandsPerBatch

#all_chunks = chunks(commands_flattened,batchLen)

#all_batches = [item for item in all_chunks]

##check if batching returns the same list
#all_batches_f = flatten_list(all_batches)
#print all_batches_f == commands_flattened

#numOfBatches = len(all_batches)
#lastBatchLen = len(all_batches[-1])
numOfCommands = len(gh_commands)/len_command


#to print in gh panel
print len_command, "values each command"
print numOfCommands, "commands." , len(gh_commands), "values"
#print "%d batches. each batch has %d commands and %d values"%(numOfBatches,batchLen/len_command,batchLen)
#print "including last batch which has %d commands and %d values"%(lastBatchLen/len_command,lastBatchLen)


if move_filament_loading_pt:
    print "Moving to filament loading point"
else:
    print "Skipping filament loading point"

if move_linear_axis:
    print "Moving the linear axis"
else:
    print "Skipping the linear axis"


if send and client:
    client.send(MSG_INT, int(continue_fabrication))
    client.send(MSG_INT, int(move_filament_loading_pt))
    client.send(MSG_INT, int(move_linear_axis))
    client.send(MSG_FLOAT_LIST, axis_moving_pts_indices)
    client.send(MSG_INT, len_command)
    client.send(MSG_INT, numOfBatches)
    for i in range(numOfBatches):
        print i
        client.send(MSG_FLOAT_LIST, all_batches[i])

data = {}
data['move_filament_loading_pt'] = move_filament_loading_pt
data['move_linear_axis'] = move_linear_axis
data['axis_moving_pts_indices'] = axis_moving_pts_indices
data['len_command'] = len_command
data['gh_commands'] = gh_commands


filename = os.path.join(path, name_json)
if save_json:
    with open(filename, 'w') as f:
        json.dump(data, f)
# ---------- end send_11 ----------

lng_3 = ListLength(List=send_11.all_batches)
panel_55 = Panel(send_11.out)

# ---- group: Send joint position directly to robot
panel_56 = Panel("move cartesian")
idx = Slider(0, range=0..100)
commands_2 = Data(python_6)
item_10 = ListItem(List=commands_2, Index=idx, Wrap=True)
list_12 = ValueList({"send all positions": 0, "send only one position": 1}, selected="send only one position")
filter_4 = StreamFilter(Gate=list_12, Stream0=commands_2, Stream1=item_10)
movel_4 = PythonScript(commands=filter_4, velocity=Slider(100, range=0..100))  # -> script; inputs commands: list
# ---------- movel_4: Python ----------
from scriptcontext import sticky as st

script_lines = []
for cmd in commands:
    #q, a=1.4, v=1.05, t=0, r=0)
    x, y, z, ax, ay, az, speed, radius = cmd
    script_lines.append("movel(p%s, v=%f, r=%f)" % (str([x/1000., y/1000., z/1000, ax, ay, az]), speed/1000., radius/1000.))

robot = st["robot"]
tool_angle_axis = list(robot.tool.tcp_frame.point) + robot.tool.tcp_frame.axis_angle_vector
x, y, z, ax, ay, az = tool_angle_axis

script = "def prog():\n"
script += "\ttextmsg(\">> program start\")\n"
script += "\tset_tcp(p%s)\n" % str([x/1000., y/1000., z/1000, ax, ay, az])
script += "".join(["\t%s\n" % line for line in script_lines])
script += "\ttextmsg(\"<< program end\")\n"
script += "end\n"
script += "prog()\n\n"

print script
# ---------- end movel_4 ----------
send_12 = Button()
send_13 = Send(script=movel_4, send=send_12)
panel_57 = Panel(send_13)

# ----
crv_12 = Curve(polyline_layers)  # disabled
python_7 = GhPythonScript(
    input_curves=crv_12,
    batch_height=batch_height_mm,
    layers_per_batch=layers_per_batch_number,
    batch_split_value=batch_split_value_layer,
    column_divide_layer_2=column_divide_2_layer,
    column_divide_layer_1=column_divide_1_layer,
    max_filling_height_bottom=maximum_height_unhydrated_concrete_in_bo,
    max_filling_height_middle=maximum_height_unhydrated_concrete_in_mi,
    max_filling_height_top=maximum_height_unhydrated_concrete_in_to,
    hydration_time=hydration_time_min,
    start_layer=start_layer_number,
    concrete_density=concrete_density_kg_m3,
    pipe_diameter=pipe_diameter_mm,
    accelerator_amount=c100_amount_g_l,
    alu_amount=alu_amount_g_l,
    accelerator_mixing_time=accelerator_mixing_time_min,
    generate_excel=generate_excel,
    print_output=print_output)  # -> out, division_curves, batch_curves, batch_volume_list; inputs input_curves: list of Curve, batch_height: Int32, layers_per_batch: Int32, column_divide_layer_2: Int32, column_divide_layer_1: Int32, hydration_time: Int32, start_layer: Int32, pipe_diameter: Int32, accelerator_mixing_time: Int32
# ---------- python_7: Python ----------
__author__ = "Joris Burger"
__version__ = "2019.04.26"

import rhinoscriptsyntax as rs
import math
import xlwt
import datetime

now = datetime.datetime.now()
date_format = now.strftime("%Y%m%d_%Hh%Mm%Ss")

# function for using float range
def frange(start, stop=None, step=None):
    #Use float number in range() function
    # if stop and step argument is null set start=0.0 and step = 1.0
    if stop == None:
        stop = start + 0.0
        start = 0.0
    if step == None:
        step = 1.0
    while True:
        if step > 0 and start >= stop:
            break
        elif step < 0 and start <= stop:
            break
        yield ("%g" % start) # return float number
        start = start + step

#================================================================
# FIXED PARAMETERS
#================================================================
batch_volume_list = []
layer_volume_list = []
filling_rate_list = []
batch_height_list = []
layer_height_list = []
batch_curves = []

normal_batch_count = 0
half_batch_count = 0
normal_layer_count = 0
half_layer_count = 0

total_filled_in = start_layer

filling_rate_top = max_filling_height_top / hydration_time
filling_rate_middle = max_filling_height_middle / hydration_time
filling_rate_bottom = max_filling_height_bottom / hydration_time

column_divide_pt1 = column_divide_layer_1 / len(input_curves)
column_divide_pt2 = column_divide_layer_2 / len(input_curves)

#division_curves = input_curves[len(input_curves) - column_divide_layer_1], input_curves[len(input_curves) - column_divide_layer_2]

total_volume = 0
total_time = 0
current_time = 0
pipe_area = math.pi * (pipe_diameter / 2) ** 2

# reverse input curves
input_curves.reverse()

#================================================================
# VOLUME PER BATCH
#================================================================
for i, crv in enumerate(input_curves):
    half_batch_height = batch_height / 2
    if i < batch_split_value:
        # normal batch list
        if i % batch_height == 0:
            # calculate area
            area = rs.CurveArea(crv)
            # batch volume in L - pipe area
            batch_volume = ((area[0] * batch_height) - (pipe_area * batch_height)) / 1000000
            
            total_volume = total_volume + batch_volume
            batch_volume_list.append(batch_volume)
            
            #print i, "Normal batch", batch_height
            normal_batch_count += 1
            batch_curves.append(crv)
            
            for j in range(layers_per_batch):
                normal_layer_count += 1
                layer_volume_list.append(batch_volume/layers_per_batch)
                batch_height_list.append(batch_height)
                layer_height_list.append(batch_height/layers_per_batch)
    else:
        # half batch list
        if i % (half_batch_height) == 0:
            area = rs.CurveArea(crv)
            
            # batch volume in L - pipe area
            batch_volume = ((area[0] * half_batch_height) - (pipe_area * half_batch_height)) / 1000000
    
            total_volume = total_volume + batch_volume
            batch_volume_list.append(batch_volume)
            
            #print i, "Half batch", half_batch_height
            half_batch_count += 1
            
            batch_curves.append(crv)
            
            for j in range(layers_per_batch):
                half_layer_count += 1
                layer_volume_list.append(batch_volume/layers_per_batch)
                batch_height_list.append(half_batch_height)
                layer_height_list.append(half_batch_height/layers_per_batch)

no_of_batches = len(batch_volume_list)
no_of_layers = no_of_batches * layers_per_batch
step_size = (filling_rate_bottom - filling_rate_top) / no_of_batches
start_layer = int(start_layer / len(input_curves) * no_of_layers)

#================================================================
# GENERATE EXCEL
#================================================================
if generate_excel == True:
    # initialize xlwt
    wb = xlwt.Workbook()
    ws = wb.add_sheet('Filling plan')
    
    # EXCEL STYLES
    # header style
    style_header = xlwt.easyxf('font: name Arial, bold on')
    header_row = 10
    # colour styles
    xlwt.add_palette_colour("custom_colour", 0x21)
    wb.set_colour_RGB(0x21, 0, 0, 255)
    style_coloured = xlwt.easyxf('pattern: pattern solid, fore_colour custom_colour')
    
    # EXCEL HEADERS
    ws.write(header_row,0, "Time (hh:mm)", style_header)
    ws.write(header_row,1, "Total filled in (mm)", style_header)
    ws.write(header_row,2, "Batch (#)", style_header)
    ws.write(header_row,3, "Batch height (mm)", style_header)
    ws.write(header_row,4, "Layer (#)", style_header)
    ws.write(header_row,5, "Layer height (mm)", style_header)
    ws.write(header_row,6, "Filling rate (mm/min)", style_header)
    ws.write(header_row,7, "Time per batch (min)", style_header)
    ws.write(header_row,8, "Time per layer (min)", style_header)
    ws.write(header_row,9, "Time to start acceleration (hh:mm)", style_header)
    ws.write(header_row,10, "Batch volume (L)", style_header)
    ws.write(header_row,11, "Batch weight (kg)", style_header)
    ws.write(header_row,12, "Accelerator amount (g)", style_header)
    ws.write(header_row,13, "Layer volume (L)", style_header)
    ws.write(header_row,14, "Layer weight (kg)", style_header)
    ws.write(header_row,15, "Unhydrated concrete (mm)", style_coloured)

for i in range(int(start_layer), int(no_of_layers)): 
    # divide into different filling rates for column sections
    if total_filled_in < column_divide_layer_1:
        filling_rate = filling_rate_bottom
    elif total_filled_in > column_divide_layer_1 and total_filled_in < column_divide_layer_2:
        filling_rate = filling_rate_middle
    else:
        filling_rate = filling_rate_top
    
    # calculate time per batch
    time_per_batch = batch_height_list[i] / float(filling_rate)
    time_per_layer = time_per_batch / layers_per_batch
    time_per_batch_adjusted = round(time_per_layer) * layers_per_batch
    
    # convert to readable 
    volume_per_batch = layer_volume_list[i]*layers_per_batch
    volume_per_layer = layer_volume_list[i]
    
    # print information
    if print_output:
        print \
        "Time: ", '{:02d}:{:02d}'.format(*divmod(int(current_time), 60)), "h ", \
        "Total filled in: ", total_filled_in, "mm " \
        "Batch: ", int(i/layers_per_batch), "/", int(no_of_layers/layers_per_batch), \
        "Batch height: ", batch_height_list[i], "mm " \
        "Layer: ", i, "/", int(no_of_layers), \
        "Layer height: ", layer_height_list[i], "mm " \
        "Filling rate: ", round(float(filling_rate),2), "mm/min ", \
        "Time per batch: ", round(time_per_batch_adjusted), "min ", \
        "Time per layer: ", round(time_per_batch / layers_per_batch), "min ", \
        "Time to start acceleration: ", '{:02d}:{:02d}'.format(*divmod(int(current_time-accelerator_mixing_time), 60)), "h ", \
        "Batch volume: ", round(volume_per_batch,2), "L ", \
        "Batch weight: ", round(volume_per_batch * concrete_density, 2), "kg ", \
        "Accelerator amount: ", round(volume_per_batch * accelerator_amount,2), "g ", \
        "Layer volume: ", round(volume_per_layer,2), "L ", \
        "Layer weight: ", round(volume_per_layer * concrete_density, 2), "kg ",  \
        "Height of unhydrated concrete: ", float(filling_rate) * hydration_time, "mm "

    # calculate current time
    total_time = total_time + round(time_per_layer)
    current_time = current_time + round(time_per_layer)
    
    if generate_excel == True:
        # EXCEL DATA
        ws.write(int(i+header_row+1-start_layer), 0, '{:02d}:{:02d}'.format(*divmod(int(current_time), 60)))    # time 
        ws.write(i+header_row+1-start_layer, 1, total_filled_in            )                                    # total filled in
        if i % layers_per_batch == 0:
            ws.write(i+header_row+1-start_layer, 2, int(i/layers_per_batch))                                    # batch no
            ws.write(i+header_row+1-start_layer, 3, int(batch_height_list[i]))                                  # batch height
        ws.write(i+header_row+1-start_layer, 4, i)                                                              # layer no
        ws.write(i+header_row+1-start_layer, 5, int(layer_height_list[i]))                                      # layer height
        ws.write(i+header_row+1-start_layer, 6, round(float(filling_rate),2))                                   # filling rate
        ws.write(i+header_row+1-start_layer, 7, round(time_per_batch_adjusted))                                 # time per batch
        ws.write(i+header_row+1-start_layer, 8, round(time_per_batch / layers_per_batch))                       # time per layer
        if i % layers_per_batch == 0:
            ws.write(int(i+header_row+1-start_layer), 9, '{:02d}:{:02d}'.format(*divmod(int(current_time-accelerator_mixing_time), 60)))    # time to start acceleration
            ws.write(i+header_row+1-start_layer, 10, round(volume_per_batch,2))                                  # batch volume
            ws.write(i+header_row+1-start_layer, 11, round(volume_per_batch * concrete_density, 2))              # batch weight
            ws.write(i+header_row+1-start_layer, 12, round(volume_per_batch * accelerator_amount,2))             # accelerator amount
        ws.write(i+header_row+1-start_layer, 13, round(volume_per_layer,2))                                      # layer volume
        ws.write(i+header_row+1-start_layer, 14, round(volume_per_layer * concrete_density, 2))                 # layer weight
        ws.write(i+header_row+1-start_layer, 15, float(filling_rate) * hydration_time)                          # height of unhydrated concrete
    
    # increment total filled in
    total_filled_in += layer_height_list[i]

if generate_excel == True:
    # EXCEL FIRST ROW
    ws.write(0,0, "Basler & Hofmann Filling Plan")
    ws.write(1,0, "11.06.2019 / JB")
    ws.write(2,0, "Total time:")
    ws.write(2,1, str(total_time/60) + " hours")
    #ws.write(3,0, str(no_of_batches) + " batches of " + str(batch_height) + "mm")
    #ws.write(4,0, str(no_of_layers) + " layers of " + str(layer_height) + "mm")
    ws.write(5,0, "Filling rate at top: ")
    ws.write(5,1,  str(round(filling_rate_top, 2)) + " mm/s")
    ws.write(6,0, "Filling rate in middle: ")
    ws.write(6,1,  str(round(filling_rate_middle, 2)) + " mm/s")
    ws.write(7,0, "Filling rate in bottom: ")
    ws.write(7,1,  str(round(filling_rate_bottom, 2)) + " mm/s")
    
    
    wb.save("C:\\Temp\\239_BH_Fillingplan_%s.xls" %date_format)
    print "Excel file generated in: C:\\Temp\\239_BH_Fillingplan_%s.xls" %date_format
    
#================================================================
# PRINT OUTS
#================================================================
print "Amount of batches:", len(batch_volume_list), "batches"
print "Normal batches:", normal_batch_count, "of", batch_height, "mm"
print "Half batches:", half_batch_count, "of", half_batch_height, "mm"

print "Amount of layers:", no_of_layers
print "Normal layers:", normal_layer_count, "of", batch_height/layers_per_batch, "mm"
print "Half layers:", half_layer_count, "of", half_batch_height/layers_per_batch, "mm"

print "Filling rate at top: ", filling_rate_top, "mm/min"
print "Filling rate in middle: ", filling_rate_middle, "mm/min"
print "Filling rate at bottom: ", filling_rate_bottom, "mm/min"

print "Total time: ", total_time/60, "hours"
print "Total volume: ", round(total_volume), "L"
#================================================================
# ---------- end python_7 ----------
panel_58 = Panel(python_7.out)
crv_13 = Curve(python_7.batch_curves)
crv_14 = Curve(python_7.division_curves)
preview_5 = CustomPreview(Geometry=crv_14, Material=ColourSwatch(SwatchColor=RGB(255, 255, 255)))
split_3 = SplitList(List=crv_13, Index=number_slider_8)  # -> ListA, ListB
crv_15 = Curve(split_3.ListA)
crv_16 = Curve(split_3.ListB)
extr_4 = Extrude(Base=crv_15, Direction=amp)
extr_5 = Extrude(Base=crv_16, Direction=amp_2)
curvepoint_3 = PointOnCurve(crv_16, parameter=0.5)
curvepoint_4 = PointOnCurve(crv_15, parameter=0.5)
pdecon_10 = Deconstruct(Point=curvepoint_4)  # -> XComponent, YComponent, ZComponent
pdecon_11 = Deconstruct(Point=curvepoint_3)  # -> XComponent, YComponent, ZComponent
pt_42 = ConstructPoint(XCoordinate=pdecon_10.XComponent, YCoordinate=number_slider_9, ZCoordinate=pdecon_10.ZComponent)
pt_43 = ConstructPoint(XCoordinate=pdecon_11.XComponent, YCoordinate=number_slider_9, ZCoordinate=pdecon_11.ZComponent)
split_4 = SplitList(List=python_7.batch_volume_list, Index=number_slider_8)  # -> ListA, ListB
python_8 = GhPythonScript(x=split_4.ListA, y=split_4.ListB)  # -> x_rounded, y_rounded; inputs x: list, y: list
# ---------- python_8: Python ----------
__author__ = "Joris"
__version__ = "2019.04.27"

import rhinoscriptsyntax as rs

x_rounded = []
y_rounded = []

for i in x:
    x_r = str(round(i, 2)) + " L"
    x_rounded.append(x_r)

for j in y:
    y_r = str(round(j, 2)) + " L"
    y_rounded.append(y_r)
# ---------- end python_8 ----------
yz = YZPlane(Origin=pt_42)
yz_2 = YZPlane(Origin=pt_43)
tag_2 = TextTag3D(Location=yz, Text=python_8.x_rounded, Size=number_slider_10, Justification=7)
tag_3 = TextTag3D(Location=yz_2, Text=python_8.y_rounded, Size=number_slider_10, Justification=7)
ln_12 = Line(StartPoint=curvepoint_3, EndPoint=pt_43)
ln_13 = Line(StartPoint=curvepoint_4, EndPoint=pt_42)

# ---- group: Steel Fins
debrep_2 = DeconstructBrep(Brep=brep)  # -> Faces, Edges, Vertices; disabled
item_11 = ListItem(List=debrep_2.Vertices, Index=0, Wrap=True)  # -> Item, Item1, Item2, Item3, Item4; disabled
addition_11 = Addition(A=panel_10, B=1)  # disabled
vec2pt_4 = Vector2Pt(PointA=item_11.Item4, PointB=item_11.Item, Unitize=False)  # -> Vector, Length; disabled
amp_6 = Amplitude(Vector=vec2pt_4.Vector, Amplitude=panel_10)  # -> flatten(Vector); disabled
amp_7 = Amplitude(Vector=vec2pt_4.Vector, Amplitude=addition_11)  # -> flatten(Vector); disabled
curvepoint_5 = PointOnCurve(ln_9, parameter=0.5)  # disabled
scale = Scale(Geometry=ln_9, Center=curvepoint_5, Factor=0.85)  # -> Geometry, Transform; disabled
scale_2 = Scale(Geometry=ln_9, Center=curvepoint_5, Factor=2)  # -> Geometry, Transform; disabled
vec2pt_5 = Vector2Pt(PointA=pt_33, PointB=pt_34, Unitize=False)  # -> Vector, Length; disabled
panel_59 = Panel("28.5")  # disabled
panel_60 = Panel("27.5")  # disabled
amp_8 = Amplitude(Vector=vec2pt_5.Vector, Amplitude=panel_59)  # disabled
amp_9 = Amplitude(Vector=vec2pt_5.Vector, Amplitude=panel_60)  # disabled
panel_61 = Panel("10")  # disabled
panel_62 = Panel("8")  # disabled
amp_10 = Amplitude(Vector=vec2pt_5.Vector, Amplitude=panel_61)  # disabled
amp_11 = Amplitude(Vector=vec2pt_5.Vector, Amplitude=panel_62)  # disabled

# ---- group: Steel Plate
simplify = SimplifyCurve(Curve=crv_7)  # -> Curve, Simplified; disabled
neg_8 = Negative(Value=panel_9)  # disabled
Z_15 = UnitZ(Factor=neg_8)  # disabled
move_24 = Move(Geometry=brep_2, Motion=Z_15)  # -> Geometry, Transform; disabled

# ---- group: Offset
offset = OffsetCurve(Curve=simplify.Curve, Distance=expr("-x", offset_curve_distance), Plane=PlaneXY(0, 0, 0), Corners=1)  # -> flatten(Curve); disabled
end_5 = EndPoints(Curve=offset)  # -> Start, End; disabled
shift_2 = ShiftList(List=end_5.Start, Shift=1, Wrap=True)  # disabled
ln_14 = Line(StartPoint=shift_2, EndPoint=end_5.End)  # disabled

# ---- group: Curve no offset
join_6 = JoinCurves(Curves=flatten([simplify.Curve, line_5]), Preserve=False)  # disabled

# ---- group: Curve with offset
join_7 = JoinCurves(Curves=flatten([offset, ln_14]), Preserve=False)  # disabled

# ---- group: Crown Beams
pt_44 = Point(pt_35)  # disabled
pln_5 = Plane(srf)  # disabled
area_3 = Area(Geometry=srf)  # -> Area, Centroid; disabled
vec2pt_6 = Vector2Pt(PointA=pt_44, PointB=area_3.Centroid, Unitize=False)  # -> Vector, Length; disabled
move_25 = Move(Geometry=pln_5, Motion=vec2pt_6.Vector)  # -> Geometry, Transform; disabled
pl_offset = PlaneOffset(BasePlane=move_25.Geometry, Offset=addition_2)  # disabled
pl_offset_2 = PlaneOffset(BasePlane=move_25.Geometry, Offset=panel_9)  # disabled
vec2pt_7 = Vector2Pt(PointA=move_25.Geometry, PointB=pl_offset_2, Unitize=False)  # -> Vector, Length; disabled
vec2pt_8 = Vector2Pt(PointA=move_25.Geometry, PointB=pl_offset, Unitize=False)  # -> Vector, Length; disabled
number_slider_35 = Slider(1.5, range=0..10)  # disabled
move_26 = Move(Geometry=srf, Motion=vec2pt_8.Vector)  # -> Geometry, Transform; disabled
scale_nu = ScaleNU(Geometry=move_26.Geometry, Plane=pl_offset, ScaleX=number_slider_35, ScaleY=number_slider_35, ScaleZ=number_slider_35)  # -> Geometry, Transform; disabled
split_5 = SplitBrep(Brep=brep, Cutter=scale_nu.Geometry)  # disabled
pshift = ShiftPaths(Data=split_5, Offset=-1)  # disabled
dispatch = Dispatch(List=pshift, DispatchPattern=[True, False])  # -> ListA, ListB; disabled
cap_6 = CapHoles(Brep=dispatch.ListB)  # disabled

# ---- group: Holes top plate
crv_17 = Curve(line_3)  # disabled
rotate_8 = Rotate(Geometry=graft(crv_17), Angle=degrees(series), Plane=pt_15)  # -> simplify(Geometry), Transform; disabled
rotate_9 = Rotate(Geometry=rotate_8.Geometry, Angle=degrees(number_slider), Plane=pt_15)  # -> Geometry, Transform; disabled
addition_12 = Addition(A=division_5, B=extra_tolerance_hole)  # disabled
pipe_4 = Pipe(Curve=rotate_9.Geometry, Radius=addition_12, Caps=0)  # disabled

# ---- group: Steel Plate (continued)
boundary = BoundarySurfaces(Edges=join_7)  # disabled
extr_6 = Extrude(Base=boundary, Direction=Z_15)  # disabled
sdiff_3 = SolidDifference(BrepsA=extr_6, BrepsB=move_24.Geometry)  # disabled
extr_7 = Extrude(Base=srf, Direction=vec2pt_7.Vector)  # disabled

# ---- group: Holes top plate (continued)
sdiff_4 = SolidDifference(BrepsA=sdiff_3, BrepsB=flatten(pipe_4))  # disabled

# ----
sdiff_5 = SolidDifference(BrepsA=sdiff_4, BrepsB=flatten(geo_2))  # disabled

# ---- group: Steel Plate (continued)
merge_2 = Merge(Data1=sdiff_5, Data2=extr_7)  # disabled
brep_3 = Brep(merge_2)  # disabled

# ---- group: STEEL PLATE / top plate with holes
geo_5 = Geometry(brep_3)  # disabled

# ---- group: Steel Fins (continued)
move_27 = Move(Geometry=scale.Geometry, Motion=vec2pt_7.Vector)  # -> Geometry, Transform; disabled
move_28 = Move(Geometry=scale_2.Geometry, Motion=vec2pt_7.Vector)  # -> Geometry, Transform; disabled
move_29 = Move(Geometry=move_28.Geometry, Motion=amp_9)  # -> Geometry, Transform; disabled
move_30 = Move(Geometry=move_27.Geometry, Motion=amp_8)  # -> Geometry, Transform; disabled
extr_8 = Extrude(Base=move_29.Geometry, Direction=amp_7)  # disabled
extr_9 = Extrude(Base=move_30.Geometry, Direction=amp_6)  # disabled

# ---- group: Steel Fins / gap
extr_10 = Extrude(Base=extr_8, Direction=amp_10)  # disabled

# ---- group: Crown Beams (continued)
sdiff_6 = SolidDifference(BrepsA=cap_6, BrepsB=extr_10)  # disabled
brep_4 = Brep(sdiff_6)  # disabled

# ---- group: Steel Fins / Fin
extr_11 = Extrude(Base=extr_9, Direction=amp_11)  # disabled

# ---- group: Steel Fins (continued)
brep_5 = Brep(extr_11)  # disabled

# ----
ln_15 = Line(StartPoint=move_18.Geometry, EndPoint=cage_toppt)  # disabled
cage_vertical = Curve(ln_15)  # disabled
flip_2 = FlipCurve(Curve=cage_vertical)  # -> Curve, Flag; disabled
eval_2 = EvaluateLength(Curve=flip_2.Curve, Length=position_of_small_rebars_distance_from_t, Normalized=False)  # -> Point, Tangent, Parameter; disabled
move_31 = Move(Geometry=eval_2.Point, Motion=X_9)  # -> Geometry, Transform; disabled
line_6 = LineSDL(Start=eval_2.Point, Direction=X_10, Length=1)  # disabled
llx = LineLine(Line1=ln_5, Line2=line_6)  # -> ParamA, ParamB, PointA, PointB; disabled
move_32 = Move(Geometry=llx.PointA, Motion=X_11)  # -> Geometry, Transform; disabled
cull_2 = CullPattern(List=eval_2.Point, CullPattern=[False, True])  # -> graft(List); disabled
cull_3 = CullPattern(List=eval_2.Point, CullPattern=[True, False])  # -> graft(List); disabled
cull_4 = CullPattern(List=move_32.Geometry, CullPattern=[True, False])  # -> graft(List); disabled
cull_5 = CullPattern(List=move_32.Geometry, CullPattern=[False, True])  # -> graft(List); disabled
cull_6 = CullPattern(List=move_31.Geometry, CullPattern=[False, True])  # -> graft(List); disabled
cull_7 = CullPattern(List=move_31.Geometry, CullPattern=[True, False])  # -> graft(List); disabled
move_33 = Move(Geometry=cull_7, Motion=expr("-x", Z_13))  # -> Geometry, Transform; disabled
move_34 = Move(Geometry=cull_3, Motion=Z_14)  # -> Geometry, Transform; disabled
move_35 = Move(Geometry=move_34.Geometry, Motion=X_14)  # -> Geometry, Transform; disabled
pt3 = Point(cull_4)  # disabled
pt4 = Point(cull_5)  # disabled
move_36 = Move(Geometry=pt4, Motion=expr("-x", X_13))  # -> Geometry, Transform; disabled
move_37 = Move(Geometry=pt3, Motion=expr("-x", X_13))  # -> Geometry, Transform; disabled
pt2 = Point(cull_7)  # disabled
pt1 = Point(move_33.Geometry)  # disabled
pt5 = Point(cull_2)  # disabled
pt6 = Point(move_34.Geometry)  # disabled
move_38 = Move(Geometry=pt6, Motion=X_16)  # -> Geometry, Transform; disabled
move_39 = Move(Geometry=pt5, Motion=X_16)  # -> Geometry, Transform; disabled
pt7 = Point(move_35.Geometry)  # disabled
move_40 = Move(Geometry=pt1, Motion=expr("x/2", X_15))  # -> Geometry, Transform; disabled
move_41 = Move(Geometry=pt6, Motion=expr("x/2", X_12))  # -> Geometry, Transform; disabled
move_42 = Move(Geometry=pt5, Motion=expr("x/2", X_12))  # -> Geometry, Transform; disabled
move_43 = Move(Geometry=pt2, Motion=expr("x/2", X_15))  # -> Geometry, Transform; disabled
pt1_2 = Point(move_40.Geometry)  # disabled
pt2_2 = Point(move_43.Geometry)  # disabled
pt3_2 = Point(move_37.Geometry)  # disabled
pt4_2 = Point(move_36.Geometry)  # disabled
pt5_2 = Point(move_39.Geometry)  # disabled
pt6_2 = Point(move_38.Geometry)  # disabled
pt7_2 = Point(pt7)  # disabled
pline_2 = PolyLine(Vertices=[pt1_2, pt2_2, pt3_2, pt4_2, pt5_2, pt6_2, pt7_2], Closed=False)  # disabled
fillet_6 = Fillet(Curve=flatten(pline_2), Radius=fillet_radius_stirrups)  # disabled

small_stirrups = Curve(simplify(fillet_6))  # disabled
large_stirrup = Curve(fillet_2)  # disabled
cage_vertical_2 = Curve(cage_vertical)  # disabled

# ---- group: Diagonal bars
pipe_5 = Pipe(Curve=large_stirrup, Radius=expr("x/2", diameter_diagonal), Caps=1)  # disabled

# ---- group: Vertical bars
pipe_6 = Pipe(Curve=cage_vertical_2, Radius=expr("x/2", diameter_vertical), Caps=1)  # disabled

# ---- group: Stirrups
pipe_7 = Pipe(Curve=small_stirrups, Radius=expr("x/2", diameter_stirrup), Caps=1)  # disabled

# ----
geo_6 = Geometry(flatten([cage_vertical_2, large_stirrup, small_stirrups, line_3]))  # disabled
geo_7 = Geometry(flatten([pipe_6, pipe_5, pipe_7, pipe_3]))  # disabled
rotate_10 = Rotate(Geometry=graft(geo_6), Angle=degrees(series), Plane=pt_15)  # -> simplify(Geometry), Transform; disabled
rotate_11 = Rotate(Geometry=graft(geo_7), Angle=degrees(series), Plane=pt_15)  # -> simplify(Geometry), Transform; disabled
unrotated_geomery = Geometry(geo_7)  # disabled

# ---- group: REBAR / Unrotated cage lines
geo_8 = Geometry(geo_6)  # disabled

# ---- group: REBAR / Unrotated cage pipes
geo_9 = Geometry(geo_7)  # disabled

# ----
bang_3 = ExplodeTree(Data=rotate_10.Geometry)  # disabled
flip_3 = FlipCurve(Curve=bang_3)  # -> Curve, Flag; disabled
divdist = DivideDistance(Curve=flip_3.Curve, Distance=distance_between_transversal_stirrups)  # -> Points, Tangents, Parameters; disabled
flip_4 = FlipMatrix(Data=divdist.Points)  # disabled
intcrv = Interpolate(Vertices=flip_4, Degree=3, Periodic=True, KnotStyle=1)  # -> Curve, Length, Domain; disabled
offset_2 = OffsetCurve(Curve=flatten(intcrv.Curve), Distance=expr("x/2", addition_10), Plane=PlaneXY(0, 0, 0), Corners=1)  # disabled
bang_4 = ExplodeTree(Data=offset_2)  # disabled
pipe_8 = Pipe(Curve=flatten(offset_2), Radius=expr("x/2", diameter_transversal_stirrup), Caps=0)  # disabled

pt_45 = Point(<point referenced from the Rhino model>)  # disabled
end_6 = EndPoints(Curve=cage_vertical_2)  # -> Start, End; disabled
pt_46 = Point(<point referenced from the Rhino model>)  # disabled
pt_47 = Point(<point referenced from the Rhino model>)  # disabled
pt_48 = Point(<point referenced from the Rhino model>)  # disabled
pt_49 = Point(<point referenced from the Rhino model>)  # disabled
pt_50 = Point(<point referenced from the Rhino model>)  # disabled
xy_9 = XYPlane(Origin=pt_45)  # disabled
xy_10 = XYPlane(Origin=pt_47)  # disabled
xy_11 = XYPlane(Origin=pt_46)  # disabled
xy_12 = XYPlane(Origin=pt_48)  # disabled
xy_13 = XYPlane(Origin=pt_49)  # disabled
xy_14 = XYPlane(Origin=pt_50)  # disabled
rotate_12 = Rotate(Geometry=xy_9, Angle=degrees(90), Plane=xy_9)  # -> Geometry, Transform; disabled
rotate_13 = Rotate(Geometry=xy_14, Angle=degrees(90), Plane=xy_14)  # -> Geometry, Transform; disabled
xz = XZPlane(Origin=pt1_2)  # disabled
xz_2 = XZPlane(Origin=pt_23)  # disabled
geo_10 = Geometry(pipe_5)  # disabled
orient_3 = Orient(Geometry=pline_2, Source=xz, Target=graft([xy_10, xy_11, xy_12]))  # -> Geometry, Transform; disabled
pt_51 = Point(<point referenced from the Rhino model>)  # disabled
number_slider_36 = Slider(165, range=0..1000)  # disabled
orient_4 = Orient(Geometry=[end_6.Start, end_6.End], Source=xz_2, Target=rotate_12.Geometry)  # -> Geometry, Transform; disabled
orient_5 = Orient(Geometry=bang_4, Source=pt_15, Target=pt_51)  # -> Geometry, Transform; disabled
disc_3 = Discontinuity(Curve=orient_3.Geometry, Level=1)  # -> Points, Parameters; disabled
orient_6 = Orient(Geometry=[pt_23, pt_24, pt_26, pt_25, pt_27], Source=xz_2, Target=rotate_13.Geometry)  # -> Geometry, Transform; disabled
curvepoint_6 = PointOnCurve(orient_5.Geometry, parameter=0.5)  # disabled
end_7 = EndPoints(Curve=orient_5.Geometry)  # -> Start, End; disabled
item_12 = ListItem(List=orient_6.Geometry, Index=0, Wrap=True)  # -> Item, Item1, Item2, Item3, Item4; disabled
item_13 = ListItem(List=orient_4.Geometry, Index=0, Wrap=True)  # -> Item, Item1; disabled
item_14 = ListItem(List=disc_3.Points, Index=0, Wrap=True)  # -> Item, Item1, Item2, Item3, Item4, Item5, Item6; disabled
pt_52 = Point(item_14.Item1)  # disabled
pt_53 = Point(item_14.Item)  # disabled
len_3 = Length(Curve=orient_5.Geometry)  # disabled
xy_15 = XYPlane(Origin=Point(0, 0, 0))  # disabled
panel_63 = Panel(len_3)  # disabled
ln_16 = Line(StartPoint=item_13.Item, EndPoint=item_13.Item1)  # disabled
pline_3 = PolyLine(
    Vertices=[item_14.Item, item_14.Item1, item_14.Item2, item_14.Item3, item_14.Item4, item_14.Item5, item_14.Item6],
    Closed=False)  # disabled
fillet_7 = Fillet(Curve=flatten(pline_3), Radius=fillet_radius_stirrups)  # disabled
len_4 = Length(Curve=fillet_7)  # disabled
panel_64 = Panel(len_4)  # disabled
number_slider_37 = Slider(5, range=0..100)  # disabled
pipe_9 = Pipe(Curve=ln_16, Radius=expr("x/2", diameter_vertical), Caps=0)  # disabled
orient_7 = Orient(Geometry=geo_10, Source=xz_2, Target=rotate_13.Geometry)  # -> Geometry, Transform; disabled
pipe_10 = Pipe(Curve=fillet_7, Radius=expr("x/2", diameter_stirrup), Caps=0)  # disabled
pipe_11 = Pipe(Curve=flatten(orient_5.Geometry), Radius=expr("x/2", diameter_transversal_stirrup), Caps=0)  # disabled
number_slider_38 = Slider(35, range=0..100)  # disabled

# ---- group: GEOMETRY
geo_11 = Geometry([rotate_11.Geometry, pipe_8])  # disabled

# ---- group: REBAR / Full cage pipes
rotate_14 = Rotate(Geometry=geo_11, Angle=degrees(number_slider), Plane=pt_15)  # -> Geometry, Transform; disabled
geo_12 = Geometry(rotate_14.Geometry)  # disabled

# ---- group: CURVES
crv_18 = Curve([rotate_10.Geometry, offset_2])  # disabled

# ---- group: REBAR / Full cage lines
rotate_15 = Rotate(Geometry=crv_18, Angle=degrees(number_slider), Plane=pt_15)  # -> Geometry, Transform; disabled
geo_13 = Geometry(rotate_15.Geometry)  # disabled

# ----
geo_14 = Geometry([pipe_9, pipe_11, orient_7.Geometry, pipe_10])  # disabled

aligndim = AlignedDimension(Plane=xy_15, PointA=item_13.Item, PointB=item_13.Item1, Offset=number_slider_38, Text="{0:0.00}", Size=number_slider_37)  # disabled
aligndim_2 = AlignedDimension(Plane=xy_15, PointA=item_14.Item, PointB=item_14.Item1, Offset=number_slider_38, Text="{0:0.00}", Size=number_slider_37)  # disabled
aligndim_3 = AlignedDimension(Plane=xy_15, PointA=item_12.Item, PointB=item_12.Item1, Offset=number_slider_38, Text="{0:0.00}", Size=number_slider_37)  # disabled
aligndim_4 = AlignedDimension(Plane=xy_15, PointA=item_14.Item1, PointB=item_14.Item2, Offset=number_slider_38, Text="{0:0.00}", Size=number_slider_37)  # disabled
aligndim_5 = AlignedDimension(Plane=xy_15, PointA=item_12.Item1, PointB=item_12.Item2, Offset=number_slider_38, Text="{0:0.00}", Size=number_slider_37)  # disabled
aligndim_6 = AlignedDimension(Plane=xy_15, PointA=item_14.Item2, PointB=item_14.Item3, Offset=number_slider_38, Text="{0:0.00}", Size=number_slider_37)  # disabled
aligndim_7 = AlignedDimension(Plane=xy_15, PointA=item_12.Item2, PointB=item_12.Item3, Offset=number_slider_38, Text="{0:0.00}", Size=number_slider_37)  # disabled
aligndim_8 = AlignedDimension(Plane=xy_15, PointA=item_14.Item3, PointB=item_14.Item4, Offset=number_slider_38, Text="{0:0.00}", Size=number_slider_37)  # disabled
aligndim_9 = AlignedDimension(Plane=xy_15, PointA=item_12.Item3, PointB=item_12.Item4, Offset=number_slider_38, Text="{0:0.00}", Size=number_slider_37)  # disabled
aligndim_10 = AlignedDimension(Plane=xy_15, PointA=end_7.Start, PointB=curvepoint_6, Offset=number_slider_36, Text="{0:0.00}", Size=number_slider_37)  # disabled
aligndim_11 = AlignedDimension(Plane=xy_15, PointA=item_14.Item4, PointB=item_14.Item5, Offset=number_slider_38, Text="{0:0.00}", Size=number_slider_37)  # disabled
aligndim_12 = AlignedDimension(Plane=xy_15, PointA=item_14.Item5, PointB=item_14.Item6, Offset=number_slider_38, Text="{0:0.00}", Size=number_slider_37)  # disabled
angledim = AngularDimension(Center=item_12.Item2, PointA=item_12.Item1, PointB=item_12.Item3, Reflex=False, Text="{0:0.0}°", Size=number_slider_37)  # disabled
angledim_2 = AngularDimension(Center=item_12.Item3, PointA=item_12.Item2, PointB=item_12.Item4, Reflex=False, Text="{0:0.0}°", Size=number_slider_37)  # disabled
angledim_3 = AngularDimension(Center=item_14.Item3, PointA=item_14.Item2, PointB=item_14.Item4, Reflex=False, Text="{0:0.0}°", Size=number_slider_37)  # disabled

# ---- group: vert bars
rotate_16 = Rotate(Geometry=graft(cage_vertical_2), Angle=degrees(series), Plane=pt_15)  # -> simplify(Geometry), Transform; disabled
rotate_17 = Rotate(Geometry=rotate_16.Geometry, Angle=degrees(number_slider), Plane=pt_15)  # -> Geometry, Transform; disabled

# ---- group: Extra tolerance holes in bottom plate for vertical staves (continued)
pipe_12 = Pipe(Curve=rotate_17.Geometry, Radius=expr("x/2", addition_3), Caps=0)  # disabled
move_44 = Move(Geometry=flatten(pipe_12), Motion=panel_41)  # -> Geometry, Transform; disabled

# ----
sdiff_7 = SolidDifference(BrepsA=sdiff_2, BrepsB=move_44.Geometry)  # disabled

# ---- group: BOTTOM_PLATE (continued)
geo_15 = Geometry([cap_4, sdiff_7])  # disabled

# ---- group: diagonals
rotate_18 = Rotate(Geometry=graft(large_stirrup), Angle=degrees(series), Plane=pt_15)  # -> simplify(Geometry), Transform; disabled
rotate_19 = Rotate(Geometry=rotate_18.Geometry, Angle=degrees(number_slider), Plane=pt_15)  # -> Geometry, Transform; disabled

# ---- group: REBAR DISTANCE / diag
crv_19 = Curve(rotate_19.Geometry)  # disabled

# ---- group: stirrups
rotate_20 = Rotate(Geometry=graft(small_stirrups), Angle=degrees(series), Plane=pt_15)  # -> simplify(Geometry), Transform; disabled
rotate_21 = Rotate(Geometry=rotate_20.Geometry, Angle=degrees(number_slider), Plane=pt_15)  # -> Geometry, Transform; disabled

# ---- group: REBAR DISTANCE / stirrups
crv_20 = Curve(rotate_21.Geometry)  # disabled

# ---- group: REBAR DISTANCE (continued)
divdist_2 = DivideDistance(Curve=crv_20, Distance=resolution_of_calculation)  # -> flatten(Points), Tangents, Parameters; disabled
divdist_3 = DivideDistance(Curve=crv_19, Distance=resolution_of_calculation)  # -> flatten(Points), Tangents, Parameters; disabled
brep_cp = BrepClosestPoint(Point=divdist_3.Points, Brep=loft)  # -> Point, Normal, Distance; disabled
brep_cp_2 = BrepClosestPoint(Point=divdist_2.Points, Brep=loft)  # -> Point, Normal, Distance; disabled
ln_17 = Line(StartPoint=divdist_3.Points, EndPoint=brep_cp.Point)  # disabled
ln_18 = Line(StartPoint=divdist_2.Points, EndPoint=brep_cp_2.Point)  # disabled
len_5 = Length(Curve=ln_17)  # disabled
len_6 = Length(Curve=ln_18)  # disabled
subtraction_8 = Subtraction(A=len_5, B=panel_38)  # disabled
subtraction_9 = Subtraction(A=len_6, B=panel_39)  # disabled
python_9 = GhPythonScript(threshold=distance_threshold_surface_rebar, adjusted_length=subtraction_8)  # -> out, colour_list; inputs adjusted_length: list; disabled
# ---------- python_9: Python ----------
__author__ = "Joris"
__version__ = "2019.03.11"

import rhinoscriptsyntax as rs

colour_list =[]

for i in adjusted_length:
    if i < threshold:
        red = 255
        green = 0
        blue = 0
    else:
        red = 0
        green = 255
        blue = 0
    colour = rs.CreateColor(red, green, blue)
    colour_list.append(colour)
# ---------- end python_9 ----------
python_10 = GhPythonScript(threshold=distance_threshold_surface_rebar, adjusted_length=subtraction_9)  # -> out, colour_list; inputs adjusted_length: list; disabled; same code as python_9
preview_6 = CustomPreview(Geometry=ln_17, Material=python_9.colour_list)  # disabled
preview_7 = CustomPreview(Geometry=ln_18, Material=python_10.colour_list)  # disabled

# ----
rebar_radius = Slider(7, range=0..10)  # disabled
concrete_cover = Slider(30, range=0..40)  # disabled
rebar_radius_2 = Slider(5, range=0..10)  # disabled
tolerance = Slider(5, range=0..10)  # disabled
rebar_radius_3 = Slider(9, range=0..10)  # disabled
addition_13 = Addition(A=rebar_radius_3, B=tolerance, C=concrete_cover)  # disabled
addition_14 = Addition(A=rebar_radius, B=tolerance, C=concrete_cover)  # disabled
addition_15 = Addition(A=rebar_radius_2, B=tolerance, C=concrete_cover)  # disabled
pipe_13 = Pipe(Curve=rotate_17.Geometry, Radius=addition_13, Caps=0)  # disabled
pipe_14 = Pipe(Curve=rotate_19.Geometry, Radius=addition_14, Caps=0)  # disabled
pipe_15 = Pipe(Curve=[rotate_21.Geometry, offset_2], Radius=addition_15, Caps=0)  # disabled

pipe_16 = Pipe(Curve=rotate_17.Geometry, Radius=addition_13, Caps=0)  # disabled

# ---- group: screws
debrep_3 = DeconstructBrep(Brep=extr_9)  # -> Faces, Edges, Vertices; disabled
debrep_4 = DeconstructBrep(Brep=brep_5)  # -> Faces, Edges, Vertices; disabled
item_15 = ListItem(List=debrep_3.Vertices, Index=0, Wrap=True)  # -> Item, Item1, Item2; disabled
item_16 = ListItem(List=debrep_4.Edges, Index=0, Wrap=True)  # -> Item2, Item1, Item; disabled
vec2pt_9 = Vector2Pt(PointA=item_15.Item2, PointB=item_15.Item1, Unitize=False)  # -> Vector, Length; disabled
panel_65 = Panel("12")  # disabled
amp_12 = Amplitude(Vector=vec2pt_9.Vector, Amplitude=panel_65)  # disabled
panel_66 = Panel("24")  # disabled
vec2pt_10 = Vector2Pt(PointA=item_15.Item, PointB=item_15.Item1, Unitize=False)  # -> Vector, Length; disabled
amp_13 = Amplitude(Vector=vec2pt_9.Vector, Amplitude=panel_66)  # disabled
panel_67 = Panel("24")  # disabled
move_45 = Move(Geometry=item_16.Item2, Motion=amp_12)  # -> Geometry, Transform; disabled
amp_14 = Amplitude(Vector=vec2pt_9.Vector, Amplitude=panel_67)  # disabled
panel_68 = Panel("24")  # disabled
move_46 = Move(Geometry=move_45.Geometry, Motion=amp_13)  # -> Geometry, Transform; disabled
amp_15 = Amplitude(Vector=vec2pt_9.Vector, Amplitude=panel_68)  # disabled
panel_69 = Panel("24")  # disabled
move_47 = Move(Geometry=move_46.Geometry, Motion=amp_14)  # -> Geometry, Transform; disabled
amp_16 = Amplitude(Vector=vec2pt_9.Vector, Amplitude=panel_69)  # disabled
move_48 = Move(Geometry=move_47.Geometry, Motion=amp_15)  # -> Geometry, Transform; disabled
move_49 = Move(Geometry=move_48.Geometry, Motion=amp_16)  # -> Geometry, Transform; disabled
panel_70 = Panel("20")  # disabled
amp_17 = Amplitude(Vector=vec2pt_10.Vector, Amplitude=panel_70)  # -> flatten(Vector); disabled
panel_71 = Panel("56")  # disabled
amp_18 = Amplitude(Vector=vec2pt_10.Vector, Amplitude=panel_71)  # -> flatten(Vector); disabled
panel_72 = Panel("56")  # disabled
amp_19 = Amplitude(Vector=vec2pt_10.Vector, Amplitude=panel_72)  # -> flatten(Vector); disabled
number_slider_39 = Slider(10, range=0..10)  # disabled
panel_73 = Panel("4")  # disabled

# ----
entwine = Entwine(
    Branch00=move_45.Geometry,
    Branch01=move_46.Geometry,
    Branch02=move_47.Geometry,
    Branch03=move_48.Geometry,
    Branch04=move_49.Geometry,
    FlattenInputs=True)  # disabled

# ---- group: screws (continued)
move_50 = Move(Geometry=entwine, Motion=amp_17)  # -> Geometry, Transform; disabled
move_51 = Move(Geometry=move_50.Geometry, Motion=amp_18)  # -> Geometry, Transform; disabled
move_52 = Move(Geometry=move_51.Geometry, Motion=amp_19)  # -> Geometry, Transform; disabled
curvepoint_7 = PointOnCurve([move_50.Geometry, move_51.Geometry, move_52.Geometry], parameter=0.5)  # disabled
scale_3 = Scale(Geometry=[move_50.Geometry, move_51.Geometry, move_52.Geometry], Center=curvepoint_7, Factor=number_slider_39)  # -> Geometry, Transform; disabled
pipe_17 = Pipe(Curve=scale_3.Geometry, Radius=panel_73, Caps=1)  # disabled

# ----
pshift_2 = ShiftPaths(Data=pipe_17, Offset=-1)  # disabled
flip_5 = FlipMatrix(Data=pshift_2)  # disabled
bang_5 = ExplodeTree(Data=flip_5)  # -> Branch0, Branch1, Branch2, Branch3, Branch4, Branch5, Branch6, Branch7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; disabled
brep_6 = Brep(bang_5.Branch16)  # disabled
brep_7 = Brep(bang_5.Branch17)  # disabled
brep_8 = Brep(bang_5.Branch18)  # disabled
brep_9 = Brep(bang_5.Branch20)  # disabled
brep_10 = Brep(bang_5.Branch21)  # disabled
brep_11 = Brep(bang_5.Branch19)  # disabled
brep_12 = Brep(bang_5.Branch22)  # disabled
brep_13 = Brep(bang_5.Branch23)  # disabled
brep_14 = Brep(bang_5.Branch8)  # disabled
brep_15 = Brep(bang_5.Branch9)  # disabled
brep_16 = Brep(bang_5.Branch10)  # disabled
brep_17 = Brep(bang_5.Branch11)  # disabled
brep_18 = Brep(bang_5.Branch12)  # disabled
brep_19 = Brep(bang_5.Branch13)  # disabled
brep_20 = Brep(bang_5.Branch14)  # disabled
brep_21 = Brep(bang_5.Branch15)  # disabled
brep_22 = Brep(bang_5.Branch0)  # disabled
brep_23 = Brep(bang_5.Branch1)  # disabled
brep_24 = Brep(bang_5.Branch2)  # disabled
brep_25 = Brep(bang_5.Branch3)  # disabled
brep_26 = Brep(bang_5.Branch4)  # disabled
brep_27 = Brep(bang_5.Branch5)  # disabled
brep_28 = Brep(bang_5.Branch6)  # disabled
brep_29 = Brep(bang_5.Branch7)  # disabled
brep_30 = Brep(simplify(flatten([brep_22, brep_6, brep_14])))  # disabled
brep_31 = Brep(simplify(flatten([brep_23, brep_7, brep_15])))  # disabled
brep_32 = Brep(simplify(flatten([brep_24, brep_8, brep_16])))  # disabled
brep_33 = Brep(simplify(flatten([brep_25, brep_11, brep_17])))  # disabled
brep_34 = Brep(simplify(flatten([brep_26, brep_9, brep_18])))  # disabled
brep_35 = Brep(simplify(flatten([brep_27, brep_10, brep_19])))  # disabled
brep_36 = Brep(simplify(flatten([brep_28, brep_12, brep_20])))  # disabled
brep_37 = Brep(simplify(flatten([brep_29, brep_13, brep_21])))  # disabled

# ---- group: STEEL PLATE / crown beam with screws
sdiff_8 = SolidDifference(BrepsA=brep_4, BrepsB=[brep_30, brep_31, brep_32, brep_33, brep_34, brep_35, brep_36, brep_37])  # disabled

# ---- group: STEEL PLATE / fins with screws
sdiff_9 = SolidDifference(BrepsA=brep_5, BrepsB=[brep_30, brep_31, brep_32, brep_33, brep_34, brep_35, brep_36, brep_37])  # disabled

# ---- group: Send joint position directly to robot
idx_2 = Slider(0, range=0..100)
panel_74 = Panel("move joints")
joint_positions = Data(py_5)
item_17 = ListItem(List=joint_positions, Index=idx_2, Wrap=True)
list_13 = ValueList({"send all positions": 0, "send only one position": 1}, selected="send only one position")
filter_5 = StreamFilter(Gate=list_13, Stream0=joint_positions, Stream1=item_17)
movej = PythonScript(joint_positions=filter_5, velocity=Slider(153, range=0..200))  # -> script; inputs joint_positions: list
# ---------- movej: Python ----------
script_lines = []

for position in joint_positions:
    script_lines.append("movej(%s, v=%f)" % (str(position), velocity/1000.))


script = "def prog():\n"
script += "\ttextmsg(\">> program start\")\n"
script += "".join(["\t%s\n" % line for line in script_lines])
script += "\ttextmsg(\"<< program end\")\n"
script += "end\n"
script += "prog()\n\n"


print script

#script = ""
# ---------- end movej ----------
send_14 = Button()

# ----
send_15 = Send(script=movej, send=send_14)

# ---- group: Send joint position directly to robot (continued)
panel_75 = Panel(send_15)

# ==== cluster Tools
brep = Brep([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])
tool_id = ClusterInput()

# ---- group: extruder
yaxis_line = Curve(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)
xaxis_line = Curve(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)
test_geometry = Geometry(brep)
brep_2 = Brep(test_geometry)
mesh = Mesh(test_geometry)
tool = Tool(meshes=mesh, breps=brep_2, xline=xaxis_line, yline=yaxis_line)

# ---- group: measurement tool
measurement_tool_geo = Geometry([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])
mesh_2 = Mesh(measurement_tool_geo)
mjoin = MeshJoin(Meshes=mesh_2)
tool_2 = PythonScript(meshes=mjoin, brep=measurement_tool_geo)  # -> tool; inputs meshes: list, brep: list
# ---------- tool_2: Python ----------
from ur_online_control.ur.tools import MeasurementTool
from compas.datastructures import Mesh
from compas_rhino.helpers import mesh_from_guid


tool = MeasurementTool()
tool.model = [mesh_from_guid(Mesh, mesh) for mesh in meshes]
#tool.model_xyz = tool.model.xyz
tool.brep = brep
# ---------- end tool_2 ----------

# ----
tool_id_2 = Integer(tool_id)
filter = StreamFilter(Gate=tool_id_2, Stream1=tool_2, Stream2=tool)
py = PythonScript(tool=filter)  # -> tcp_frame, model
# ---------- py: Python ----------
from compas_ghpython import mesh_draw 

tcp_frame = tool.tcp_frame
model = map(mesh_draw, tool.model)
# ---------- end py ----------
tool_3 = Data(filter)
draw = PythonScript(frame=py.tcp_frame)  # -> G, C
# ---------- draw: Python ----------
import Rhino.Geometry as rg
from System.Drawing import Color

if not size:
    size = 100

if frame:
    plane = rg.Plane(rg.Point3d(*list(frame.point)), rg.Vector3d(*list(frame.xaxis)), rg.Vector3d(*list(frame.yaxis)))

    G = []
    G.append(rg.Line(plane.Origin, size * plane.XAxis))
    G.append(rg.Line(plane.Origin, size * plane.YAxis))
    G.append(rg.Line(plane.Origin, size * plane.ZAxis))
    
    C = []
    C.append(Color.FromArgb(255, 0, 0))
    C.append(Color.FromArgb(0, 255, 0))
    C.append(Color.FromArgb(0, 0, 255))
# ---------- end draw ----------
tool_4 = ClusterOutput(tool_3)
preview = CustomPreview(Geometry=draw.G, Shader=draw.C)
preview_2 = CustomPreview(Geometry=py.model, Shader=ColourSwatch(SwatchColor=RGB(141, 170, 178)))

# ==== cluster Send
script = ClusterInput()
send = ClusterInput()
send_2 = PythonScript(script=script, send=send)  # -> out
# ---------- send_2: Python ----------
import socket
from scriptcontext import sticky as st

ur_ip = st["ur_ip"]
ur_port = 30002

if send:
    s = socket.create_connection((ur_ip, ur_port), timeout=0.5) 
    s.send(script)
    s.close()
# ---------- end send_2 ----------
out = ClusterOutput(send_2)

# ==== cluster Tools_2

# ---- group: spray_gun
brep = Brep([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])
yaxis_line = Curve(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)
xaxis_line = Curve(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)
test_geometry = Geometry(brep)
mesh = Mesh(test_geometry)
brep_2 = Brep(test_geometry)
tool = Tool_2(meshes=mesh, breps=brep_2, xline=xaxis_line, yline=yaxis_line)

# ----
brep_3 = Brep([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])
tool_id = ClusterInput()
yaxis_line_2 = Curve(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)
xaxis_line_2 = Curve(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)

# ---- group: extruder
test_geometry_2 = Geometry(brep_3)
mesh_2 = Mesh(test_geometry_2)
brep_4 = Brep(test_geometry_2)
tool_2 = Tool_2(meshes=mesh_2, breps=brep_4, xline=xaxis_line_2, yline=yaxis_line_2)

# ----
tool_id_2 = Integer(tool_id)
tool_3 = PythonScript()  # -> tool
# ---------- tool_3: Python ----------
from compas_fab.fab.geometry import Frame
from compas_fab.fab.robots import Tool
import Rhino.Geometry as rg
import math

startPlane = rg.Plane.WorldXY
startPlane2 = rg.Plane.WorldXY
rg.Plane.Rotate(startPlane2, math.radians(180), rg.Vector3d.XAxis, rg.Point3d(0.0, 0.0, 0.0))

xform = rg.Transform.ChangeBasis(startPlane, startPlane2)

print startPlane
print startPlane2
Frame([0,0,0],[1,0,0],[0,-1,0])
#tcp_frame = Frame.worldXY()
tcp_frame = Frame([0,0,0],[1,0,0],[0,-1,0])

tool = Tool(tcp_frame)
tool.model = []
tool.breps = []
# ---------- end tool_3 ----------
filter = StreamFilter(Gate=tool_id_2, Stream0=tool_3, Stream1=tool, Stream2=tool_2)
py = PythonScript(tool=filter)  # -> tcp_frame, model
# ---------- py: Python ----------
tcp_frame = tool.tcp_frame
model = tool.model
# ---------- end py ----------
draw = PythonScript(frame=py.tcp_frame)  # -> G, C
# ---------- draw: Python ----------
import Rhino.Geometry as rg
from System.Drawing import Color

if not size:
    size = 100

if frame:
    
    plane = rg.Plane(rg.Point3d(*frame.point), rg.Vector3d(*frame.xaxis), rg.Vector3d(*frame.yaxis))

    G = []
    G.append(rg.Line(plane.Origin, size * plane.XAxis))
    G.append(rg.Line(plane.Origin, size * plane.YAxis))
    G.append(rg.Line(plane.Origin, size * plane.ZAxis))
    
    C = []
    C.append(Color.FromArgb(255, 0, 0))
    C.append(Color.FromArgb(0, 255, 0))
    C.append(Color.FromArgb(0, 0, 255))
# ---------- end draw ----------
tool_4 = Data(filter)
tool_5 = ClusterOutput(tool_4)
preview = CustomPreview(Geometry=draw.G, Shader=draw.C)
preview_2 = CustomPreview(Geometry=py.model, Shader=ColourSwatch(SwatchColor=RGB(141, 170, 178)))

# ==== cluster SortOnZ
A = ClusterInput()
curvepoint = PointOnCurve(A, parameter=0)
pdecon = Deconstruct(Point=curvepoint)  # -> XComponent, YComponent, ZComponent
sort = SortList(Keys=pdecon.ZComponent, ValuesA=A)  # -> Keys, ValuesA
A_2 = ClusterOutput(sort.ValuesA)

# ==== cluster Tool
breps = ClusterInput()
meshes = ClusterInput()
meshes_2 = Mesh(meshes)
mjoin = MeshJoin(Meshes=meshes_2)
xline = ClusterInput()
yline = ClusterInput()
tool = PythonScript(meshes=mjoin, breps=breps, xline=xline, yline=yline)  # -> tool; inputs meshes: list of Mesh, breps: list of Brep
# ---------- tool: Python ----------
import Rhino.Geometry as rg
from compas.geometry import Frame
from ur_online_control.ur.tool import Tool
from compas.datastructures import Mesh
from compas_rhino.helpers import mesh_from_guid

xaxis = rg.Line(xline.PointAtStart, xline.PointAtEnd)
yaxis = rg.Line(yline.PointAtStart, yline.PointAtEnd)

if xaxis.From.DistanceTo(yaxis.From) < 0.01:
    origin = xaxis.From
    xaxis = xaxis.Direction
    yaxis = yaxis.Direction
elif xaxis.To.DistanceTo(yaxis.To) < 0.01:
    origin = xaxis.To
    xaxis = -xaxis.Direction
    yaxis = -yaxis.Direction
elif xaxis.From.DistanceTo(yaxis.To) < 0.01:
    origin = xaxis.From
    xaxis = xaxis.Direction
    yaxis = -yaxis.Direction
elif xaxis.To.DistanceTo(yaxis.From) < 0.01:
    origin = xaxis.To
    xaxis = -xaxis.Direction
    yaxis = yaxis.Direction

xaxis.Unitize()
yaxis.Unitize()

print origin
print xaxis
print yaxis

tcp_frame = Frame(origin, xaxis, yaxis)

tool = Tool(tcp_frame)
tool.model = [mesh_from_guid(Mesh, mesh) for mesh in meshes]
#tool.model_xyz = tool.model.xyz
tool.breps = breps
# ---------- end tool ----------
tool_2 = ClusterOutput(tool)

# ==== cluster Tool_2
breps = ClusterInput()
meshes = ClusterInput()
meshes_2 = Mesh(meshes)
mjoin = MeshJoin(Meshes=meshes_2)
xline = ClusterInput()
yline = ClusterInput()
tool = PythonScript(meshes=mjoin, breps=breps, xline=xline, yline=yline)  # -> tool; inputs meshes: list of Mesh, breps: list of Brep
# ---------- tool: Python ----------
import Rhino.Geometry as rg
from compas_fab.fab.geometry import Frame
from compas_fab.fab.robots import Tool
from compas.datastructures.mesh import Mesh

xaxis = rg.Line(xline.PointAtStart, xline.PointAtEnd)
yaxis = rg.Line(yline.PointAtStart, yline.PointAtEnd)

if xaxis.From.DistanceTo(yaxis.From) < 0.01:
    origin = xaxis.From
    xaxis = xaxis.Direction
    yaxis = yaxis.Direction
elif xaxis.To.DistanceTo(yaxis.To) < 0.01:
    origin = xaxis.To
    xaxis = -xaxis.Direction
    yaxis = -yaxis.Direction
elif xaxis.From.DistanceTo(yaxis.To) < 0.01:
    origin = xaxis.From
    xaxis = xaxis.Direction
    yaxis = -yaxis.Direction
elif xaxis.To.DistanceTo(yaxis.From) < 0.01:
    origin = xaxis.To
    xaxis = -xaxis.Direction
    yaxis = yaxis.Direction

xaxis.Unitize()
yaxis.Unitize()

print origin
print xaxis
print yaxis

tcp_frame = Frame(origin, xaxis, yaxis)

tool = Tool(tcp_frame)
tool.model = meshes
tool.breps = breps
# ---------- end tool ----------
tool_2 = ClusterOutput(tool)
