# Grasshopper definition 190717_linear_axis_setup_json_top_extra_layers.gh (Grasshopper 1.0.7)

half_filament_width = Slider(1.5, range=0..10)

# ---- group: wooden sheet info
sheet_thickness = Panel("4")
sheets_no = Panel("2")
length = Panel("1000")
width = Panel("500")
multiplication = Multiplication(A=sheet_thickness, B=sheets_no)

# ----
width_2 = Panel("500")
length_2 = Panel("1000")
division = Division(A=length, B=2)
bottom_layers = Slider(1, range=0..1)
X = UnitX(Factor=1)
neg = Negative(Value=division)
Y = UnitY(Factor=1)
neg_2 = Negative(Value=width)
division_2 = Division(A=length_2, B=2)
Y_2 = UnitY(Factor=1)
X_2 = UnitX(Factor=1)
neg_3 = Negative(Value=division_2)
amp = Amplitude(Vector=X, Amplitude=neg)
amp_2 = Amplitude(Vector=Y, Amplitude=neg_2)
neg_4 = Negative(Value=width_2)
amp_3 = Amplitude(Vector=Y_2, Amplitude=neg_3)
amp_4 = Amplitude(Vector=X_2, Amplitude=neg_4)
sheets_layer = Slider(2111, range=0..10000)
sheets_layer_2 = Slider(1441, range=0..10000)
sheets_layer_3 = Slider(781, range=0..10000)
sheets_layer_4 = Slider(121, range=0..10000)
subtraction = Subtraction(A=sheets_layer, B=sheet_thickness)
subtraction_2 = Subtraction(A=sheets_layer_3, B=multiplication)
subtraction_3 = Subtraction(A=sheets_layer_2, B=multiplication)
subtraction_4 = Subtraction(A=sheets_layer_4, B=multiplication)
subtraction_5 = Subtraction(A=sheets_layer_4, B=sheet_thickness)
subtraction_6 = Subtraction(A=subtraction, B=bottom_layers)
subtraction_7 = Subtraction(A=sheets_layer_2, B=sheet_thickness)
subtraction_8 = Subtraction(A=sheets_layer_3, B=sheet_thickness)
subtraction_9 = Subtraction(A=sheets_layer, B=bottom_layers)
panel = Panel(subtraction)
panel_2 = Panel(subtraction_2)
panel_3 = Panel(subtraction_3)
panel_4 = Panel(subtraction_4)
panel_5 = Panel(subtraction_5)
panel_6 = Panel(subtraction_7)
panel_7 = Panel(subtraction_8)
panel_8 = Panel(subtraction_9)
Z = UnitZ(Factor=sheet_thickness)
Z_2 = UnitZ(Factor=sheet_thickness)
Z_3 = UnitZ(Factor=sheet_thickness)
Z_4 = UnitZ(Factor=sheet_thickness)
Z_5 = UnitZ(Factor=sheet_thickness)
Z_6 = UnitZ(Factor=sheet_thickness)
Z_7 = UnitZ(Factor=sheet_thickness)
number_slider = Slider(3, range=0..10)
number_slider_2 = Slider(3, range=0..10)
number_slider_3 = Slider(3, range=0..10)
number_slider_4 = Slider(3, range=0..10)
Z_8 = UnitZ(Factor=sheet_thickness)
neg_5 = Negative(Value=Z)
neg_6 = Negative(Value=Z_2)
neg_7 = Negative(Value=Z_3)
neg_8 = Negative(Value=Z_4)
swatch = ColourSwatch(SwatchColor=RGB(255, 0, 0))
swatch_2 = ColourSwatch(SwatchColor=RGB(255, 0, 0))
swatch_3 = ColourSwatch(SwatchColor=RGB(255, 0, 0))
swatch_4 = ColourSwatch(SwatchColor=RGB(255, 0, 0))
number_slider_5 = Slider(3, range=0..10)
number_slider_6 = Slider(3, range=0..10)
number_slider_7 = Slider(3, range=0..10)
neg_9 = Negative(Value=Z_5)
neg_10 = Negative(Value=Z_6)
number_slider_8 = Slider(3, range=0..10)
neg_11 = Negative(Value=Z_7)
neg_12 = Negative(Value=Z_8)
swatch_5 = ColourSwatch(SwatchColor=RGB(255, 0, 0))
swatch_6 = ColourSwatch(SwatchColor=RGB(255, 0, 0))
swatch_7 = ColourSwatch(SwatchColor=RGB(255, 0, 0))
swatch_8 = ColourSwatch(SwatchColor=RGB(255, 0, 0))

# ---- group: REBAR
number_slider_9 = Slider(27.5, range=0..100)

# ---- group: Threaded rods top
length_of_threaded_rod = Slider(600, range=0..1000)
diameter_threaded_rod_top = Slider(14, range=0..100)
threaded_rod_depth_into_column = Slider(400, range=0..500)

# ----
position_of_small_rebars_distance_from_t = Panel("""80
180
240
340
400
500""")  # "Position of small rebars (distance from top)"
distance_between_transversal_stirrups = Slider(200, range=0..1000)

x_radius_cage = Slider(100, range=0..1000)
x_stirrup_distance_from_top = Slider(350, range=0..2000)
z_middle_height_stirrup = Slider(1450, range=0..2000)
z_height_cage = Slider(2050, range=0..2500)

extension_bottom_large_stirrup = Slider(-400, range=-500..0)
extension_top_large_stirrup = Slider(70, range=0..1000)

# ---- group: Fillet radii
fillet_radius_large_stirrup_vertical = Slider(20, range=0..100)
fillet_radius_large_stirrup_diagonal = Slider(20, range=0..150)
fillet_radius_large_stirrup_middle_secti = Slider(0, range=0..500)  # "Fillet radius large stirrup middle section"
fillet_radius_stirrups = Slider(20, range=0..1000)

# ----
amount_of_bars = Slider(8, range=0..30)

# ---- group: Bar diameter
diameter_vertical = Slider(20, range=0..30)
diameter_diagonal = Slider(14, range=0..30)
diameter_stirrup = Slider(10, range=0..30)
diameter_transversal_stirrup = Slider(10, range=0..30)

# ----
offset_for_stirrup_diagonal_intersection = Slider(0, range=0..100)
offset_for_stirrup_vertical_intersection = Slider(14, range=0..100)

# ---- group: Robot
# 0a
# Settings
# Check your IP address and set UR IP address
server_address = ValueList({"192.168.10.2", "192.168.10.11", "127.0.0.1"}, selected="192.168.10.2")
ur_ip = ValueList({"192.168.10.13", "192.168.10.11", "192.168.10.10", "127.0.0.1"}, selected="192.168.10.13")
server_port = Integer(30003)
globals = PythonScript(server_address=server_address, server_port=server_port, ur_ip=ur_ip)  # inputs server_port: Int32; disabled
# ---------- globals: Python ----------
from scriptcontext import sticky as st

st["server_address"] = server_address
st["server_port"] = server_port

st["ur_ip"] = ur_ip
# ---------- end globals ----------

# Check if UR is available
ping = Button()
py = PythonScript(ip=ur_ip, ping=ping)  # -> out; disabled
# ---------- py: Python ----------
from scriptcontext import sticky as st
from ur_online_control.communication import is_available


guid = str(ghenv.Component.InstanceGuid)
txt_key = "txt_" + guid
if txt_key not in st:
    st[txt_key] = ""

if ping:
    
    available = is_available(ip)
    
    if available:
        st[txt_key] = "%s is up!" % ip
    else:
        st[txt_key] = "%s is down!" % ip

print st[txt_key]
# ---------- end py ----------
panel_9 = Panel(py)

# ---- group: Scale factor
minimum_radius = Slider(350, range=0..1000)
subtraction_10 = Subtraction(A="1000", B=minimum_radius)
division_3 = Division(A=subtraction_10, B=2)
dom = ConstructDomain(DomainStart=division_3, DomainEnd="0")

# ---- group: Pattern height and reduction
pattern_height_bottom_mm = Slider(115, range=0..1000)
pattern_height_reduction_mm = Slider(2, range=0..10)

# ---- group: offset_pattern_sides
dom_2 = ConstructDomain(DomainStart=Slider(0.1, range=0..1), DomainEnd=Slider(0.7, range=0..3))

# ----
number_slider_10 = Slider(0.77, range=0..3)

# ---- group: short_edge (timber 190613)
crv = Curve([<curve referenced from the Rhino model> x8])

# ---- group: crown_beams (timber 190613)
brep = Brep([<brep referenced from the Rhino model> x8])

# ----
number_slider_11 = Slider(500, range=0..1000)
move_to_pos = Button()
get_pos = Button()
# Disconnect planes_wcs input after moving axis!
# [to make sure robot base is updated within gh]
close = Button()
pos_z = Slider(500, range=0..1500)

# ---- group: round
bottom_offset_mm = Slider(-29, range=-300..500)

# ---- group: Curve offset
crown_top_curve_offset_mm = Slider(75, range=0..500)
bottom_offset_mm_2 = Slider(15, range=-300..500)
top_offset_mm = Slider(290, range=0..500)
list = ValueList({"Control point curve": 0, "Interpolated curve": 1, "Blend curve": 2}, selected="Control point curve")
dom_3 = ConstructDomain(DomainStart=bottom_offset_mm, DomainEnd=top_offset_mm)

# ---- group: Layers
reduce_pattern_layer = Slider(150, range=0..1000)
layer_count = Slider(2011, range=0..2011)
layer_selection_start = Slider(0, range=0..2011)
layer_selection_end = Slider(2011, range=0..2011)
layer_height = Slider(1, range=0..100)
top_extra_layers = Slider(100, range=0..200)

# ---- group: Undulations style
# original column 20, new 22
list_2 = ValueList({"Curve undulations original": 0, "Curve undulations grid": 1}, selected="Curve undulations grid")
number_slider_12 = Slider(16, range=0..100)

# ---- group: orient_pt
orientpt = Point(<point referenced from the Rhino model>)

# ---- group: Div point offset
dom_4 = ConstructDomain(DomainStart=Slider(0, range=-30..30), DomainEnd=Slider(17, range=0..100))

# ---- group: Rib offset
dom_5 = ConstructDomain(DomainStart=Slider(0, range=0..30), DomainEnd=Slider(23, range=0..100))

# ---- group: Robot
panel_10 = Panel("Unload libraries")
bang = Button()
unload = PythonScript(bang=bang)
# ---------- unload: Python ----------
from compas_ghpython import unload_modules

unload_modules("compas")
unload_modules("ur_online_control")
# ---------- end unload ----------

# ----
panel_11 = Panel("ORIGIN")

cir = Circle(Plane=orientpt, Radius=Slider(210, range=0..1000))
linear_axis = GhPythonScript(move_to_pos=move_to_pos, pos_x=number_slider_11, pos_z=pos_z, close=close)  # -> out
# ---------- linear_axis: Python ----------
__author__ = "joburger"
__version__ = "2018.09.20"

from linear_axis import siemens as s

if move_to_pos:
    p = s.SiemensPortal(2)
    
    try:
         p.set_x(pos_x)
         p.set_z(pos_z)
         # p.wait_ext_axis()
    
    finally:
         p.close()

if close:
    try:
        p.close()
        p = s.SiemensPortal(2)
    finally:
        p.close()

#position_data = None

"""
if get_pos:
    try:
        p = s.SiemensPortal(1)
        position_data = "NO DATA"
        position_data = "AXIS POSITION \nX:" + str(p.get_x()) + " Z:" + str(p.get_z())
        print "hmm"
    finally:
        p.close()

try:
    print position_data
except RuntimeError:
    print "Something did not work"
"""
# ---------- end linear_axis ----------

subtraction_11 = Subtraction(A=number_slider_11, B="500")
subtraction_12 = Subtraction(A="750", B=pos_z)
neg_13 = Negative(Value=subtraction_11)
neg_14 = Negative(Value=subtraction_12)
linear_axis_x_axis = Brep(<brep referenced from the Rhino model>)
linear_axis_plates = Brep([<brep referenced from the Rhino model> x2])
X_3 = UnitX(Factor=neg_13)
Z_9 = UnitZ(Factor=neg_14)
move = Move(Geometry=linear_axis_x_axis, Motion=X_3)  # -> Geometry, Transform
move_2 = Move(Geometry=[move.Geometry, linear_axis_plates], Motion=Z_9)  # -> Geometry, Transform
preview = CustomPreview(Geometry=move_2.Geometry, Shader=ColourSwatch(SwatchColor=RGBA(99, 94, 94, 96)))

# ---- group: Robot
# 1. load robot model
# 2. set tool
# 3. set basis
# 1. load robot model
# 2. set tool
# 3. set basis
list_3 = ValueList({"no_tool": 0, "measurement_tool": 1, "extruder": 2}, selected="extruder")
base = PythonScript(x=subtraction_11, z=subtraction_12)  # -> base_frame, base
# ---------- base: Python ----------
from compas.geometry import Frame

"""
origin = [0, 0, 0]
xaxis = [1, 0, 0]
yaxis = [0, 1, 0]


origin = [-313.92, -147.58, 13.79]
xaxis = [0.00000, -1.00000, 0.00000]
yaxis = [1.00000, 0.00000, 0.00000]
"""


linear_axis_x = x
linear_axis_z = z 
#axis    Y         Z                        X
origin = [155.98, -806.21 + linear_axis_z, 343.76 + linear_axis_x]
xaxis = [0, 0, 1]
yaxis = [1, 0, 0]

base_frame = Frame(list(origin), list(xaxis), list(yaxis))

base = "base = " + str(origin) + "\n" + "change in linear_axis_x = " + str(linear_axis_x) + "\n" + "change in linear_axis_z = " + str(linear_axis_z)
# ---------- end base ----------
tools = Tools(tool_id=list_3)
list_4 = ValueList({"UR5", "UR10"}, selected="UR10")
robot = PythonScript(model=list_4, tool=tools, base_frame=base.base_frame)  # -> robot
# ---------- robot: Python ----------
from ur_online_control.ur.ur10 import UR10
#from ur_online_control.ur.ur5 import UR5
from scriptcontext import sticky as st

if model == "UR5":
    robot = UR5()
elif model == "UR10":
    robot = UR10()

if tool:
    robot.set_tool(tool)
if base_frame:
    robot.set_base(base_frame)

st["robot"] = robot
# ---------- end robot ----------

# ---- group: steelPlate to beam gap
panel_12 = Panel("-5")

# ---- group: steelPlate thickness
panel_13 = Panel("-15")

# ---- group: steelFIn height
panel_14 = Panel("157")

# ---- group: Create centroid
pt = Point(<point referenced from the Rhino model>)
pdecon = Deconstruct(Point=pt)  # -> XComponent, YComponent, ZComponent
pt_2 = ConstructPoint(XCoordinate=pdecon.XComponent, YCoordinate=pdecon.YComponent, ZCoordinate="1801")

# ---- group: centroid
pt_3 = Point(pt)

# ----
rectangle = Rectangle(Plane=pt_3, XSize=length, YSize=width, Radius=0)  # -> Rectangle, Length
rectangle_2 = Rectangle(Plane=pt_3, XSize=width_2, YSize=length_2, Radius=0)  # -> Rectangle, Length
move_3 = Move(Geometry=rectangle.Rectangle, Motion=amp)  # -> Geometry, Transform
move_4 = Move(Geometry=move_3.Geometry, Motion=amp_2)  # -> Geometry, Transform
move_5 = Move(Geometry=rectangle_2.Rectangle, Motion=amp_3)  # -> Geometry, Transform
move_6 = Move(Geometry=move_5.Geometry, Motion=amp_4)  # -> Geometry, Transform

# ---- group: Equalize height of all short_edges (0.3mm tolerance)
end = EndPoints(Curve=crv)  # -> Start, End
pdecon_2 = Deconstruct(Point=end.End)  # -> XComponent, YComponent, ZComponent
pdecon_3 = Deconstruct(Point=end.Start)  # -> XComponent, YComponent, ZComponent
pt_4 = ConstructPoint(XCoordinate=pdecon_3.XComponent, YCoordinate=pdecon_3.YComponent, ZCoordinate="1801")
pt_5 = ConstructPoint(XCoordinate=pdecon_2.XComponent, YCoordinate=pdecon_2.YComponent, ZCoordinate="1801")
ln = Line(StartPoint=pt_4, EndPoint=pt_5)

# ---- group: short edge end pts
pt_6 = Point(end.End)

# ----
line = Line(ln)
list_5 = ValueList({"no_tool": 0, "spray_gun": 1, "extruder": 2}, selected="extruder")
extra_tolerance_hole = Slider(2, range=0..100)
panel_15 = Panel(linear_axis)
offset_curve_distance = Slider(0, range=0..10)
addition = Addition(A=panel_13, B=panel_12)
addition_2 = Addition(A=top_extra_layers, B=layer_count)
layer_count_2 = Number(layer_count)
tools_2 = Tools_2(tool_id=list_5)

python = GhPythonScript(pattern_height_bottom=pattern_height_bottom_mm, pattern_height_reduction=pattern_height_reduction_mm)  # -> out, value_list; inputs pattern_height_bottom: Int32
# ---------- python: Python ----------
__author__ = "Joris"
__version__ = "2019.06.12"

import math

# PARAMETERS
amount_of_layers = 2110
threshold = 0
max_value = 2

# CONSTANTS
begin_value = pattern_height_bottom / 2
reduce = pattern_height_reduction / 2
sum = 0
count = 0
pattern_number_list = []
value_list = []

# NUMBER GENERATION
for i in range(200):
    if sum*2 > amount_of_layers + threshold:
        print "value above amount of layers"
        break
    if begin_value < reduce:
        print "value below zero"
        break
    pattern_number_list.append(begin_value)
    begin_value = begin_value - reduce
    sum += begin_value 
    count += 1

print "Amount of pattern repetitions", count
print "Sum of values", sum*2
#print pattern_number_list

for i in range(count):
    # calculate amount of steps based on i
    step_amount = pattern_number_list[i]
    print "Height of one pattern repetition", step_amount*2, "mm"
    print i+1
    # calculate step size
    step_size = max_value / step_amount
    for j in range(int(2/step_size*2)):
        if step_size*j < 2:
            value = j * step_size
        else:
            value = max_value*2 - j*step_size
        value_list.append(value)
# ---------- end python ----------
lng = ListLength(List=python.value_list)
split = SplitList(List=python.value_list, Index=addition_2)  # -> ListA, ListB
data = Data(split.ListA)

panel_16 = Panel(python.out)
graph = QuickGraph(python.value_list, SortOrder=0)

# ---- group: Rib offset
range = Range(Domain=dom_5, Steps=expr("x-1", layer_count_2))
data_2 = Data(range)

# ---- group: Curve offset
range_2 = Range(Domain=Domain(0, 1), Steps=expr("x-1", addition_2))
graph_2 = GraphMapper(
    range_2,
    x0=0,
    x1=1,
    y0=0,
    y1=1,
    container_name="Bezier",
    cpx=[0, 0.244080022, 0.369446218, 1],
    cpy=[0.8935507536, 0.512445271, 0.3293339014, 0.2308565974])
data_3 = Data(graph_2)
bnd = Bounds(Numbers=data_3)
remap = RemapNumbers(Value=data_3, Source=bnd, Target=dom_3)  # -> Mapped, Clipped

# ---- group: Scale factor
range_3 = Range(Domain=Domain(0, 1), Steps=expr("x-1", layer_count_2))
graph_3 = GraphMapper(
    range_3,
    x0=0,
    x1=1,
    y0=0,
    y1=1,
    container_name="Bezier",
    cpx=[0, 0.152763918, 0.5236688256, 1],
    cpy=[0.7384505868, 0.2008233666, 0.01457560062, 0.1922056079])
data_4 = Data(graph_3)
bnd_2 = Bounds(Numbers=data_4)
remap_2 = RemapNumbers(Value=data_4, Source=bnd_2, Target=dom)  # -> Mapped, Clipped

# ----
panel_17 = Panel(base.base)
panel_18 = Panel("NEW (21.06.2019)")
neg_15 = Negative(Value=Slider(75, range=0..100))
number_slider_13 = Slider(90, range=0..100)
Z_10 = UnitZ(Factor=neg_15)
graph_4 = GraphMapper(
    range_2,
    x0=0,
    x1=1,
    y0=0,
    y1=1,
    container_name="Bezier",
    cpx=[0, 0.06204159558, 0.3763449192, 1],
    cpy=[0.8935507536, 0.2369463444, 0.2412503362, 0.2308565974])

# ---- group: top_extra_layers_loading_pt
pt_7 = Point(<point referenced from the Rhino model>)

# ----
start = Button()
py_2 = PythonScript()  # -> path
# ---------- py_2: Python ----------
import sys
import os

ghComp = ghenv.Component
ghDoc = ghComp.OnPingDocument()

# the full path of the gh file
path = ghDoc.FilePath
# the directory of the gh file
path = os.path.dirname(path)

path = os.path.abspath(os.path.join(path, ".."))

print path
# ---------- end py_2 ----------
# 1
# Executing
panel_19 = Panel("Start communication server")
panel_20 = Panel(py_2)
server = PythonScript(path=panel_20, start=start)
# ---------- server: Python ----------
import os
import threading
from scriptcontext import sticky as st

server_address = st["server_address"]
server_port = st["server_port"]
ur_ip = st["ur_ip"]

"""
Change main!!!!
"""
main = os.path.join(path, "communication", "main_json.py")
syscall = "python %s %s %s %s" % (main, server_address, server_port, ur_ip)
print syscall

if os.path.isfile(main):
        
    def myfunc():
        
        os.system(syscall)
    
    if start:
        t = threading.Thread(target=myfunc)
        t.start()
# ---------- end server ----------

# ---- group: test_pt
pt_8 = Point(<point referenced from the Rhino model>)
xy = XYPlane(Origin=pt_8)
rotate = Rotate(Geometry=xy, Angle=degrees(number_slider_13), Plane=xy)  # -> Geometry, Transform

# ----
graph_5 = GraphMapper(
    range_3,
    x0=0,
    x1=1,
    y0=0,
    y1=1,
    container_name="Bezier",
    cpx=[0, 0.2461866289, 0.5236688256, 1],
    cpy=[0.7384505868, 0.1078018546, 0.01457560062, 0.1922056079])
panel_21 = Panel("OLD")
start_2 = Button()

panel_22 = Panel("Get UR connected")
ur = PythonScript(send=start_2)  # -> out, a
# ---------- ur: Python ----------
from scriptcontext import sticky as st
from ur_online_control.ur_driver import URDriver

server_address = st["server_address"]
server_port = st["server_port"]
ur_ip = st["ur_ip"]
robot = st["robot"]

print ("server_address = ", server_address)
print ("server_port = ", server_port)
print ("ur_ip =", ur_ip)

tool_angle_axis = list(robot.tool.tcp_frame.point) + robot.tool.tcp_frame.axis_angle_vector
#robot.tool.tcp_frame.pose_axis_angle_vector
print "tool_angle_axis =", tool_angle_axis

ur_driver = URDriver(server_address, server_port, tool_angle_axis, ur_ip, "UR")
print ur_driver

if send:
    ur_driver.send()
# ---------- end ur ----------

panel_23 = Panel(ur.out)
start_3 = Button()

disconnect = Button()
panel_24 = Panel("Get Grasshopper connected")
client = PythonScript(connect=start_3, disconnect=disconnect)  # -> connected, client
# ---------- client: Python ----------
import time
from scriptcontext import sticky as st
from Rhino.RhinoApp import WriteLine
from ur_online_control.grasshopper import GHClient, gh_component_timer
import time

server_address = st["server_address"]
server_port = st["server_port"]

guid = str(ghenv.Component.InstanceGuid)

client_key = "client_" + guid
run_key = "run_" + guid

if connect:
    if client_key not in st:
        st[client_key] = GHClient(server_address, server_port)
        client = st[client_key]
        client.connect_to_server()
        client.start()
        
    else:
        if st[client_key].running:
            WriteLine("Client is already connected.")
            
        else:
            st[client_key] = GHClient(server_address, server_port)
            client = st[client_key]
            client.connect_to_server()
            client.start()
"""
else:
    if client_key in st:
        # we need a timer to ask if we have something on the rcv queue
        client = st[client_key]
        #if client.running:
        #    #client.run_inner_while()
        #    gh_component_timer(ghenv, True, 1000)
"""

if disconnect:
    if client_key in st:
        client = st[client_key]
        if client.running:
            client.close()

if client_key in st:
    connected =  st[client_key].running
    client = st[client_key]
    print st[client_key].rcv_queue.qsize()
    print st[client_key].snd_queue.qsize()
else:
    connected = False
# ---------- end client ----------
panel_25 = Panel(client.connected)

bang_2 = Button()
receive = PythonScript(client=client.client, bang=bang_2)  # -> qsize, client
# ---------- receive: Python ----------
from ur_online_control.communication.msg_identifiers import *
from ur_online_control.utilities.lists import flatten_list
from Rhino.RhinoApp import WriteLine


if client:
    if not client.ghenv:
        client.ghenv = ghenv
    qsize = client.rcv_queue.qsize()
# ---------- end receive ----------
panel_26 = Panel(receive.qsize)

number_slider_14 = Slider(500, range=0..1000)
dom_6 = ConstructDomain(DomainStart=expr("-x", number_slider_14), DomainEnd=number_slider_14)
send = PythonScript(client=receive.client)  # -> out
# ---------- send: Python ----------
from ur_online_control.communication.msg_identifiers import *
from ur_online_control.utilities.lists import flatten_list

if client:
    qsize = client.rcv_queue.qsize()
    if qsize:
        msg = client.rcv_queue.get()
        print msg
# ---------- end send ----------
panel_27 = Panel(send)

# ----
# Direct UR control
get = Button()
get_2 = Button()
pose = PythonScript(get=get_2)  # -> pose_joints
# ---------- pose: Python ----------
from scriptcontext import sticky as st
from ur_online_control.ur_direct import get_current_pose_joints
from ur_online_control.ur.robot import BaseConfiguration

server_address = st["server_address"]
server_port = 30005
ur_ip = st["ur_ip"]
robot = st["robot"]
tool_angle_axis = list(robot.tool.tcp_frame.point) + robot.tool.tcp_frame.axis_angle_vector
print tool_angle_axis

guid = str(ghenv.Component.InstanceGuid)
pose_joints_key = "pose_joints" + guid


if get:
    st[pose_joints_key] = get_current_pose_joints(server_address, server_port, ur_ip, tool_angle_axis)
    
if pose_joints_key not in st:
    pose_joints = []
else:
    pose_joints = BaseConfiguration.from_joints(st[pose_joints_key])
# ---------- end pose ----------
pose_2 = PythonScript(get=get)  # -> pose_cartesian
# ---------- pose_2: Python ----------
from scriptcontext import sticky as st
from ur_online_control.ur_direct import get_current_pose_cartesian

server_address = st["server_address"]
server_port = 30005
ur_ip = st["ur_ip"]
robot = st["robot"]
tool_angle_axis = list(robot.tool.tcp_frame.point) + robot.tool.tcp_frame.axis_angle_vector
print tool_angle_axis

guid = str(ghenv.Component.InstanceGuid)
pose_cartesian_key = "pose_cartesian" + guid


if get:
    st[pose_cartesian_key] = get_current_pose_cartesian(server_address, server_port, ur_ip, tool_angle_axis)

if pose_cartesian_key not in st:
    pose_cartesian = []
else:
    pose_cartesian = st[pose_cartesian_key]
# ---------- end pose_2 ----------
stop = Button()
stop_2 = PythonScript(stop=stop)
# ---------- stop_2: Python ----------
from scriptcontext import sticky as st
from ur_online_control.ur_direct import stop as stop_robot

ur_ip = st["ur_ip"]

if stop:
    stop_robot(ur_ip)
# ---------- end stop_2 ----------
panel_28 = Panel(pose)
panel_29 = Panel(pose_2)

vertical_pose = Number([-152.427, -780.635, 855.229, -1.1958, -1.22046, -1.20201])
back = Button()
reset = Button()

# ---- group: Define joint positions
base_2 = Slider(90.163, range=-360..360)
shoulder = Slider(0, range=-360..360)
elbow = Slider(-102.857, range=-360..360)
wrist1 = Slider(0, range=-360..360)
wrist2 = Slider(0, range=-360..360)
wrist3 = Slider(0, range=-360..360)
ur1_q1_q6 = Data([base_2, shoulder, elbow, wrist1, wrist2, wrist3])

# ----
# Calculate basis
# Measure basis:
# 1. Clear the recorded poses
# 2. Move robot to origin and press "get pose"
# 3. Move robot to point in positive x-axis and press "get pose"
# 4. Move robot to an other point in your basis and press "get pose"
# (The farer away these positions are, the better)
# 
# 5. Alternatively change the order in the component calc base
# 6. Copy output into base component
list_6 = ValueList({"origin, pt on positive x-axis, pt in xy plane": 0, "origin, pt on positive y-axis, pt in xy plane": 1}, selected="origin, pt on positive x-axis, pt in xy plane")
clear = Button()
rec = PythonScript(msg=pose_2, rec=get, clear=clear)  # -> rec; inputs msg: list
# ---------- rec: Python ----------
from scriptcontext import sticky as st

guid = str(ghenv.Component.InstanceGuid)
recorded_key =  "recorded_" + guid
just_cleared_key = "just_cleared_" + guid

if recorded_key not in st:
    st[recorded_key] = []

if just_cleared_key not in st:
    st[just_cleared_key] = False

if clear:
    st[recorded_key] = []
    st[just_cleared_key] = True
else:
    if len(msg):
        if msg != [None] and not st[just_cleared_key] and rec:
            st[recorded_key].append(msg)
    st[just_cleared_key] = False
        


rec = st[recorded_key]

print rec
# ---------- end rec ----------
calc_base = PythonScript(poses=rec, input_type=list_6)  # -> out; inputs poses: list
# ---------- calc_base: Python ----------
import Rhino.Geometry as rg
import math


if len(poses) > 2:
    
    O = poses[0]
    P1 = poses[1]
    P2 = poses[2]
    
    if input_type == 0:
        # origin, pt on positive x-axis, pt in xy plane
        origin = rg.Point3d(O[0], O[1], O[2])
        pt_on_xaxis = rg.Point3d(P1[0], P1[1], P1[2])
        pt_in_xyplane = rg.Point3d(P2[0], P2[1], P2[2])
        
        xaxis = pt_on_xaxis - origin
        xaxis.Unitize()
        
        v = pt_in_xyplane - origin
        zaxis = rg.Vector3d.CrossProduct(v, xaxis)
        zaxis.Unitize()
        
        # zaxis must look up!
        if math.acos(rg.Vector3d.ZAxis * zaxis) > math.acos(rg.Vector3d.ZAxis * -zaxis):
            zaxis = -zaxis
        
        yaxis = rg.Vector3d.CrossProduct(zaxis, xaxis)
    
    elif input_type == 1:
        # origin, pt on positive y-axis, pt in xy plane
        origin = rg.Point3d(O[0], O[1], O[2])
        pt_on_yaxis = rg.Point3d(P1[0], P1[1], P1[2])
        pt_in_xyplane = rg.Point3d(P2[0], P2[1], P2[2])
        
        yaxis = pt_on_yaxis - origin
        yaxis.Unitize()
        
        v = pt_in_xyplane - origin
        zaxis = rg.Vector3d.CrossProduct(v, yaxis)
        zaxis.Unitize()
        
        # zaxis must look up!
        if math.acos(rg.Vector3d.ZAxis * zaxis) > math.acos(rg.Vector3d.ZAxis * -zaxis):
            zaxis = -zaxis
        
        xaxis = rg.Vector3d.CrossProduct(yaxis, zaxis)
        
        
    print "Copy the following into base component:"
    print " "
    print "origin = [%.2f, %.2f, %.2f]" % tuple(list(origin))
    print "xaxis = [%.5f, %.5f, %.5f]" % tuple(list(xaxis))
    print "yaxis = [%.5f, %.5f, %.5f]" % tuple(list(yaxis))
    

#print rg.Vector3d.CrossProduct(rg.Vector3d.YAxis, rg.Vector3d.ZAxis)
#print rg.Vector3d.CrossProduct(rg.Vector3d.ZAxis, rg.Vector3d.XAxis)
# ---------- end calc_base ----------
panel_30 = Panel(rec)
panel_31 = Panel(calc_base)

py_3 = GhPythonScript(joint_values=ur1_q1_q6)  # -> configuration; inputs joint_values: list
# ---------- py_3: Python ----------
import math
from ur_online_control.ur.robot import BaseConfiguration

configuration = BaseConfiguration.from_joints([math.radians(d) for d in joint_values])
# ---------- end py_3 ----------

list_7 = ValueList({"Print with UR": 0, "Print with UR and Linear Axis": 1}, selected="Print with UR and Linear Axis")
printing_top_extra_layers = BooleanToggle(True)

# ---- group: Visualise / robot model brep
py_4 = PythonScript(model=list_4)  # -> n
# ---------- py_4: Python ----------
if model == "UR5":
    n = 0
if model == "UR10":
    n = 1

print n
# ---------- end py_4 ----------
ur10_brep = UR10Brep([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])
ur5_brep = UR5Brep([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])
show_brep = BooleanToggle(False)
filter = StreamFilter(Gate=py_4, Stream0=ur5_brep, Stream1=ur10_brep)

# ----
panel_32 = Panel("set digital out")
number = Slider(2, range=0..10)
value = BooleanToggle(False)
digital_out = PythonScript(number=number, value=value)  # -> script; inputs number: Int32, value: Boolean
# ---------- digital_out: Python ----------
script = "def prog():\n"
script += "\ttextmsg(\">> program start\")\n"
script += "\tset_digital_out(%i, %s)\n" % (int(number), str(value))
script += "\ttextmsg(\"<< program end\")\n"
script += "end\n"
script += "prog()\n\n"

print script
# ---------- end digital_out ----------
send_2 = Button()
send_3 = Send(script=digital_out, send=send_2)
panel_33 = Panel(send_3)

panel_34 = Panel("move vertical")
movel = PythonScript()  # -> script
# ---------- movel: Python ----------
from scriptcontext import sticky as st

robot = st["robot"]
tool_angle_axis = list(robot.tool.tcp_frame.point) + robot.tool.tcp_frame.axis_angle_vector
x, y, z, ax, ay, az = tool_angle_axis

script = "def prog():\n"
script += "\ttextmsg(\">> program start\")\n"
script += "\tset_tcp(p%s)\n" % str([x/1000., y/1000., z/1000, ax, ay, az])
script += "\tcurrent_pose = get_forward_kin()\n"
script += "\tmovel(p[current_pose[0], current_pose[1], current_pose[2], 0, 0, 0], a=0.1, v=0.1)\n"
script += "\ttextmsg(\"<< program end\")\n"
script += "end\n"
script += "prog()\n\n"

print script
# ---------- end movel ----------
send_4 = Button()
send_5 = Send(script=movel, send=send_4)
panel_35 = Panel(send_5)

number_slider_15 = Slider(0, range=0..100000)
dom_7 = ConstructDomain(DomainStart=Slider(0, range=0..10000), DomainEnd=Slider(438098, range=0..1000000))

# ----
# move incremental in TCS
get_current_pose = Button()
list_8 = ValueList({"xaxis", "yaxis", "zaxis"}, selected="zaxis")
movel_2 = PythonScript(get=get_current_pose, step_size=Slider(5, range=-10..10), direction=list_8)  # -> script; inputs get: list
# ---------- movel_2: Python ----------
from scriptcontext import sticky as st
from compas.geometry import Frame
from compas.geometry import Point, Vector
from ur_online_control.ur_direct import get_current_pose_cartesian

server_address = st["server_address"]
server_port = 30005
ur_ip = st["ur_ip"]
robot = st["robot"]
tool_angle_axis = list(robot.tool.tcp_frame.point) + robot.tool.tcp_frame.axis_angle_vector
print tool_angle_axis

guid = str(ghenv.Component.InstanceGuid)
pose_cartesian_key = "pose_cartesian" + guid

if get:
    st[pose_cartesian_key] = get_current_pose_cartesian(server_address, server_port, ur_ip, tool_angle_axis)

if pose_cartesian_key not in st:
    pose_cartesian = []
    script = ""
else:
    pose_cartesian = st[pose_cartesian_key]

    robot = st["robot"]
    tool_angle_axis = list(robot.tool.tcp_frame.point) + robot.tool.tcp_frame.axis_angle_vector
    x, y, z, ax, ay, az = tool_angle_axis
    
    script = "def prog():\n"
    script += "\ttextmsg(\">> program start\")\n"
    script += "\tset_tcp(p%s)\n" % str([x/1000., y/1000., z/1000, ax, ay, az])
    script += "\tcurrent_pose = get_forward_kin()\n"
    
#    frame = Frame.from_pose_axis_angle_vector(pose_cartesian)
    frame = Frame.from_axis_angle_vector([ax, ay, az])
    frame.point = [x, y, z]

    if direction == "xaxis":
        next_vector = Vector(*frame.xaxis) * step_size
    elif direction == "yaxis":
        next_vector = Vector(*frame.yaxis) * step_size
    else: # direction == "zaxis":
        next_vector = Vector(*frame.zaxis) * step_size
    
    x, y, z = next_vector
    script += "\tmovel(p[current_pose[0] + %f, current_pose[1] + %f, current_pose[2] + %f, current_pose[3], current_pose[4], current_pose[5]], t=%f)\n" % (x/1000., y/1000., z/1000., step_size * 0.1)
    
    script += "\ttextmsg(\"<< program end\")\n"
    script += "end\n"
    script += "prog()\n\n"
    
    print script
# ---------- end movel_2 ----------
send_6 = Button()
send_7 = Send(script=movel_2, send=send_6)
panel_36 = Panel(send_7)

# ----
# move incremental in WCS
number_slider_16 = Slider(5, range=-10..10)
list_9 = ValueList({"xaxis", "yaxis", "zaxis"}, selected="zaxis")
movel_3 = PythonScript(step_size=number_slider_16, direction=list_9)  # -> script
# ---------- movel_3: Python ----------
from scriptcontext import sticky as st

robot = st["robot"]
tool_angle_axis = list(robot.tool.tcp_frame.point) + robot.tool.tcp_frame.axis_angle_vector
x, y, z, ax, ay, az = tool_angle_axis

script = "def prog():\n"
script += "\ttextmsg(\">> program start\")\n"
script += "\tset_tcp(p%s)\n" % str([x/1000., y/1000., z/1000, ax, ay, az])
script += "\tcurrent_pose = get_forward_kin()\n"


if direction == "xaxis":
    script += "\tmovel(p[current_pose[0] + %f, current_pose[1], current_pose[2], current_pose[3], current_pose[4], current_pose[5]], t=%f)\n" % (step_size/1000., step_size * 0.1)

elif direction == "yaxis":
    script += "\tmovel(p[current_pose[0], current_pose[1] + %f, current_pose[2], current_pose[3], current_pose[4], current_pose[5]], t=%f)\n" % (step_size/1000., step_size * 0.1)

else: # direction == "zaxis":
    script += "\tmovel(p[current_pose[0], current_pose[1], current_pose[2] + %f, current_pose[3], current_pose[4], current_pose[5]], t=%f)\n" % (step_size/1000., step_size * 0.1)

script += "\ttextmsg(\"<< program end\")\n"
script += "end\n"
script += "prog()\n\n"

print script
# ---------- end movel_3 ----------
send_8 = Button()
send_9 = Send(script=movel_3, send=send_8)
panel_37 = Panel(send_9)

number_slider_17 = Slider(0, range=0..10000)
dom_8 = ConstructDomain(DomainStart=Slider(0, range=0..100000), DomainEnd=Slider(59512, range=0..100000))
crv_2 = Curve([<curve referenced from the Rhino model> x500])  # disabled
c100_amount_g_l = Panel("25.75")  # disabled
xceed_amount_g_l = Panel("27.13")  # disabled
concrete_density_kg_m3 = Panel("2.3")  # disabled
pipe_diameter_mm = Panel("110")  # disabled

generate_excel = BooleanToggle(True)  # disabled
print_output = BooleanToggle(True)  # disabled

alu_amount_g_l = Panel("27.13")  # disabled
accelerator_mixing_time_min = Slider(3, range=0..10)  # disabled

batch_height_mm = Slider(10, range=0..100)  # disabled
layers_per_batch_number = Slider(1, range=0..10)  # disabled

batch_split_value_layer = Slider(1500, range=0..2500)  # disabled

maximum_height_unhydrated_concrete_in_bo = Slider(400, range=0..1000)  # "maximum height unhydrated concrete in bottom (mm)"; disabled
maximum_height_unhydrated_concrete_in_mi = Slider(260, range=0..1000)  # "maximum height unhydrated concrete in middle (mm)"; disabled
maximum_height_unhydrated_concrete_in_to = Slider(140, range=0..1000)  # "maximum height unhydrated concrete in top (mm)"; disabled
column_divide_1_layer = Slider(0, range=0..2500)  # disabled
column_divide_2_layer = Slider(0, range=0..2500)  # disabled

start_layer_number = Slider(0, range=0..2000)  # disabled
hydration_time_min = Slider(95, range=0..120)  # disabled

button = Button()  # disabled
python_2 = GhPythonScript(
    input_curves=crv_2,
    batch_height=batch_height_mm,
    layers_per_batch=layers_per_batch_number,
    batch_split_value=batch_split_value_layer,
    column_divide_layer_2=column_divide_2_layer,
    column_divide_layer_1=column_divide_1_layer,
    max_filling_height_bottom=maximum_height_unhydrated_concrete_in_bo,
    max_filling_height_middle=maximum_height_unhydrated_concrete_in_mi,
    max_filling_height_top=maximum_height_unhydrated_concrete_in_to,
    hydration_time=hydration_time_min,
    start_layer=start_layer_number,
    concrete_density=concrete_density_kg_m3,
    pipe_diameter=pipe_diameter_mm,
    accelerator_amount=c100_amount_g_l,
    alu_amount=alu_amount_g_l,
    accelerator_mixing_time=accelerator_mixing_time_min,
    generate_excel=button,
    print_output=print_output)  # -> out, division_curves, batch_curves, batch_volume_list; inputs input_curves: list of Curve, batch_height: Int32, layers_per_batch: Int32, column_divide_layer_2: Int32, column_divide_layer_1: Int32, hydration_time: Int32, start_layer: Int32, pipe_diameter: Int32, accelerator_mixing_time: Int32; disabled
# ---------- python_2: Python ----------
__author__ = "Joris Burger"
__version__ = "2019.04.26"

import rhinoscriptsyntax as rs
import math
import xlwt
import datetime

now = datetime.datetime.now()
date_format = now.strftime("%Y%m%d_%Hh%Mm%Ss")

# function for using float range
def frange(start, stop=None, step=None):
    #Use float number in range() function
    # if stop and step argument is null set start=0.0 and step = 1.0
    if stop == None:
        stop = start + 0.0
        start = 0.0
    if step == None:
        step = 1.0
    while True:
        if step > 0 and start >= stop:
            break
        elif step < 0 and start <= stop:
            break
        yield ("%g" % start) # return float number
        start = start + step

#================================================================
# FIXED PARAMETERS
#================================================================
batch_volume_list = []
layer_volume_list = []
filling_rate_list = []
batch_height_list = []
layer_height_list = []
batch_curves = []

normal_batch_count = 0
half_batch_count = 0
normal_layer_count = 0
half_layer_count = 0

total_filled_in = start_layer

filling_rate_top = max_filling_height_top / hydration_time
filling_rate_middle = max_filling_height_middle / hydration_time
filling_rate_bottom = max_filling_height_bottom / hydration_time

column_divide_pt1 = column_divide_layer_1 / len(input_curves)
column_divide_pt2 = column_divide_layer_2 / len(input_curves)

#division_curves = input_curves[len(input_curves) - column_divide_layer_1], input_curves[len(input_curves) - column_divide_layer_2]

total_volume = 0
total_time = 0
current_time = 0
pipe_area = math.pi * (pipe_diameter / 2) ** 2

# reverse input curves
input_curves.reverse()

#================================================================
# VOLUME PER BATCH
#================================================================
for i, crv in enumerate(input_curves):
    half_batch_height = batch_height / 2
    if i < batch_split_value:
        # normal batch list
        if i % batch_height == 0:
            # calculate area
            area = rs.CurveArea(crv)
            # batch volume in L - pipe area
            batch_volume = ((area[0] * batch_height) - (pipe_area * batch_height)) / 1000000
            
            total_volume = total_volume + batch_volume
            batch_volume_list.append(batch_volume)
            
            #print i, "Normal batch", batch_height
            normal_batch_count += 1
            batch_curves.append(crv)
            
            for j in range(layers_per_batch):
                normal_layer_count += 1
                layer_volume_list.append(batch_volume/layers_per_batch)
                batch_height_list.append(batch_height)
                layer_height_list.append(batch_height/layers_per_batch)
    else:
        # half batch list
        if i % (half_batch_height) == 0:
            area = rs.CurveArea(crv)
            
            # batch volume in L - pipe area
            batch_volume = ((area[0] * half_batch_height) - (pipe_area * half_batch_height)) / 1000000
    
            total_volume = total_volume + batch_volume
            batch_volume_list.append(batch_volume)
            
            #print i, "Half batch", half_batch_height
            half_batch_count += 1
            
            batch_curves.append(crv)
            
            for j in range(layers_per_batch):
                half_layer_count += 1
                layer_volume_list.append(batch_volume/layers_per_batch)
                batch_height_list.append(half_batch_height)
                layer_height_list.append(half_batch_height/layers_per_batch)

no_of_batches = len(batch_volume_list)
no_of_layers = no_of_batches * layers_per_batch
step_size = (filling_rate_bottom - filling_rate_top) / no_of_batches
start_layer = int(start_layer / len(input_curves) * no_of_layers)

#================================================================
# GENERATE EXCEL
#================================================================
if generate_excel == True:
    # initialize xlwt
    wb = xlwt.Workbook()
    ws = wb.add_sheet('Filling plan')
    
    # EXCEL STYLES
    # header style
    style_header = xlwt.easyxf('font: name Arial, bold on')
    header_row = 10
    # colour styles
    xlwt.add_palette_colour("light_orange", 0x34)
    xlwt.add_palette_colour("light_green", 0x2A)
    
    light_orange = xlwt.easyxf('pattern: pattern solid, fore_colour light_orange')
    light_green = xlwt.easyxf('pattern: pattern solid, fore_colour light_green')
    
    border_style = xlwt.easyxf('font: bold off, color black;\
                     borders: top_color gray25, bottom_color gray25, right_color white, left_color white,\
                              left thin, right thin, top thin, bottom thin;\
                     pattern: pattern solid, fore_color white;')
    
    # EXCEL HEADERS
    ws.write(header_row,0, "Time (hh:mm)", style_header)
    ws.write(header_row,1, "Total filled in (mm)", style_header)
    ws.write(header_row,2, "Batch (#)", style_header)
    ws.write(header_row,3, "Batch height (mm)", style_header)
    ws.write(header_row,4, "Layer (#)", style_header)
    ws.write(header_row,5, "Layer height (mm)", style_header)
    ws.write(header_row,6, "Filling rate (mm/min)", style_header)
    ws.write(header_row,7, "Time per batch (min)", style_header)
    ws.write(header_row,8, "Time per layer (min)", style_header)
    ws.write(header_row,9, "Time to start acceleration (hh:mm)", style_header)
    ws.write(header_row,10, "Batch volume (L)", style_header)
    ws.write(header_row,11, "Batch weight (kg)", style_header)
    ws.write(header_row,12, "Accelerator amount (g)", style_header)
    ws.write(header_row,13, "Layer volume (L)", style_header)
    ws.write(header_row,14, "Layer weight (kg)", style_header)
    ws.write(header_row,15, "Unhydrated concrete (mm)", style_header)

for i in range(int(start_layer), int(no_of_layers)): 
    # divide into different filling rates for column sections
    if total_filled_in < column_divide_layer_1:
        filling_rate = filling_rate_bottom
    elif total_filled_in > column_divide_layer_1 and total_filled_in < column_divide_layer_2:
        filling_rate = filling_rate_middle
    else:
        filling_rate = filling_rate_top
    
    # calculate time per batch
    time_per_batch = batch_height_list[i] / float(filling_rate)
    time_per_layer = time_per_batch / layers_per_batch
    time_per_batch_adjusted = round(time_per_layer) * layers_per_batch
    
    # convert to readable 
    volume_per_batch = layer_volume_list[i]*layers_per_batch
    volume_per_layer = layer_volume_list[i]
    
    # print information
    if print_output:
        print \
        "Time: ", '{:02d}:{:02d}'.format(*divmod(int(current_time), 60)), "h ", \
        "Total filled in: ", total_filled_in, "mm " \
        "Batch: ", int(i/layers_per_batch), "/", int(no_of_layers/layers_per_batch), \
        "Batch height: ", batch_height_list[i], "mm " \
        "Layer: ", i, "/", int(no_of_layers), \
        "Layer height: ", layer_height_list[i], "mm " \
        "Filling rate: ", round(float(filling_rate),2), "mm/min ", \
        "Time per batch: ", round(time_per_batch_adjusted), "min ", \
        "Time per layer: ", round(time_per_batch / layers_per_batch), "min ", \
        "Time to start acceleration: ", '{:02d}:{:02d}'.format(*divmod(int(current_time-accelerator_mixing_time), 60)), "h ", \
        "Batch volume: ", round(volume_per_batch,2), "L ", \
        "Batch weight: ", round(volume_per_batch * concrete_density, 2), "kg ", \
        "Accelerator amount: ", round(volume_per_batch * accelerator_amount,2), "g ", \
        "Layer volume: ", round(volume_per_layer,2), "L ", \
        "Layer weight: ", round(volume_per_layer * concrete_density, 2), "kg ",  \
        "Height of unhydrated concrete: ", float(filling_rate) * hydration_time, "mm "

    # calculate current time
    total_time = total_time + round(time_per_layer)
    current_time = current_time + round(time_per_layer)
    
    if generate_excel == True:
        # EXCEL DATA
        ws.write(int(i+header_row+1-start_layer), 0, '{:02d}:{:02d}'.format(*divmod(int(current_time), 60)),border_style)    # time 
        ws.write(i+header_row+1-start_layer, 1, total_filled_in, border_style)                                               # total filled in
        if i % layers_per_batch == 0:
            ws.write(i+header_row+1-start_layer, 2, int(i/layers_per_batch),border_style)                                    # batch no
            ws.write(i+header_row+1-start_layer, 3, int(batch_height_list[i]),border_style)                                  # batch height
        ws.write(i+header_row+1-start_layer, 4, i,border_style)                                                              # layer no
        ws.write(i+header_row+1-start_layer, 5, int(layer_height_list[i]),border_style)                                      # layer height
        ws.write(i+header_row+1-start_layer, 6, round(float(filling_rate),2),border_style)                                   # filling rate
        ws.write(i+header_row+1-start_layer, 7, round(time_per_batch_adjusted),border_style)                                 # time per batch
        ws.write(i+header_row+1-start_layer, 8, round(time_per_batch / layers_per_batch),border_style)                       # time per layer
        if i % layers_per_batch == 0:
            ws.write(int(i+header_row+1-start_layer), 9, '{:02d}:{:02d}'.format(*divmod(int(current_time-accelerator_mixing_time), 60)),light_green)    # time to start acceleration
            ws.write(i+header_row+1-start_layer, 10, round(volume_per_batch,2),border_style)                                 # batch volume
            ws.write(i+header_row+1-start_layer, 11, round(volume_per_batch * concrete_density, 2),light_orange)             # batch weight
            ws.write(i+header_row+1-start_layer, 12, round(volume_per_batch * accelerator_amount,2),border_style)            # accelerator amount
        ws.write(i+header_row+1-start_layer, 13, round(volume_per_layer,2),border_style)                                     # layer volume
        ws.write(i+header_row+1-start_layer, 14, round(volume_per_layer * concrete_density, 2),border_style)                 # layer weight
        ws.write(i+header_row+1-start_layer, 15, float(filling_rate) * hydration_time,border_style)                          # height of unhydrated concrete
    
    # increment total filled in
    total_filled_in += layer_height_list[i]

if generate_excel == True:
    # EXCEL FIRST ROW
    ws.write(0,0, "Basler & Hofmann Filling Plan")
    ws.write(1,0, date_format)
    ws.write(2,0, "Total time:")
    ws.write(2,1, str(total_time/60) + " hours")
    #ws.write(3,0, str(no_of_batches) + " batches of " + str(batch_height) + "mm")
    #ws.write(4,0, str(no_of_layers) + " layers of " + str(layer_height) + "mm")
    ws.write(5,0, "Filling rate at top: ")
    ws.write(5,1,  str(round(filling_rate_top, 2)) + " mm/s")
    ws.write(6,0, "Filling rate in middle: ")
    ws.write(6,1,  str(round(filling_rate_middle, 2)) + " mm/s")
    ws.write(7,0, "Filling rate in bottom: ")
    ws.write(7,1,  str(round(filling_rate_bottom, 2)) + " mm/s")
    
    
    wb.save("C:\\Temp\\239_BH_Fillingplan_%s.xls" %date_format)
    print "Excel file generated in: C:\\Temp\\239_BH_Fillingplan_%s.xls" %date_format
    
#================================================================
# PRINT OUTS
#================================================================
print "Amount of batches:", len(batch_volume_list), "batches"
print "Normal batches:", normal_batch_count, "of", batch_height, "mm"
print "Half batches:", half_batch_count, "of", half_batch_height, "mm"

print "Amount of layers:", no_of_layers
print "Normal layers:", normal_layer_count, "of", batch_height/layers_per_batch, "mm"
print "Half layers:", half_layer_count, "of", half_batch_height/layers_per_batch, "mm"

print "Filling rate at top: ", filling_rate_top, "mm/min"
print "Filling rate in middle: ", filling_rate_middle, "mm/min"
print "Filling rate at bottom: ", filling_rate_bottom, "mm/min"

print "Total time: ", total_time/60, "hours"
print "Total volume: ", round(total_volume), "L"
#================================================================
# ---------- end python_2 ----------
number_slider_18 = Slider(18, range=0..100)  # disabled
crv_3 = Curve(python_2.batch_curves)  # disabled
swatch_9 = ColourSwatch(SwatchColor=RGB(255, 255, 255))  # disabled
panel_38 = Panel(python_2.out)  # disabled
crv_4 = Curve(python_2.division_curves)  # disabled
preview_2 = CustomPreview(Geometry=crv_4, Material=swatch_9)  # disabled
split_2 = SplitList(List=crv_3, Index=number_slider_18)  # -> ListA, ListB; disabled
crv_5 = Curve(split_2.ListA)  # disabled
crv_6 = Curve(split_2.ListB)  # disabled
number_slider_19 = Slider(90, range=0..100)  # disabled
number_slider_20 = Slider(45, range=0..100)  # disabled
Z_11 = UnitZ(Factor=1)  # disabled
Z_12 = UnitZ(Factor=1)  # disabled
amp_5 = Amplitude(Vector=Z_11, Amplitude=number_slider_19)  # disabled
amp_6 = Amplitude(Vector=Z_12, Amplitude=number_slider_20)  # disabled
extr = Extrude(Base=crv_5, Direction=amp_5)  # disabled
extr_2 = Extrude(Base=crv_6, Direction=amp_6)  # disabled
curvepoint = PointOnCurve(crv_6, parameter=0.5)  # disabled
curvepoint_2 = PointOnCurve(crv_5, parameter=0.5)  # disabled
number_slider_21 = Slider(24000, range=0..100000)  # disabled
pdecon_4 = Deconstruct(Point=curvepoint_2)  # -> XComponent, YComponent, ZComponent; disabled
pdecon_5 = Deconstruct(Point=curvepoint)  # -> XComponent, YComponent, ZComponent; disabled
pt_9 = ConstructPoint(XCoordinate=pdecon_4.XComponent, YCoordinate=number_slider_21, ZCoordinate=pdecon_4.ZComponent)  # disabled
pt_10 = ConstructPoint(XCoordinate=pdecon_5.XComponent, YCoordinate=number_slider_21, ZCoordinate=pdecon_5.ZComponent)  # disabled
split_3 = SplitList(List=python_2.batch_volume_list, Index=number_slider_18)  # -> ListA, ListB; disabled
python_3 = GhPythonScript(x=split_3.ListA, y=split_3.ListB)  # -> x_rounded, y_rounded; inputs x: list, y: list; disabled
# ---------- python_3: Python ----------
__author__ = "Joris"
__version__ = "2019.04.27"

import rhinoscriptsyntax as rs

x_rounded = []
y_rounded = []

for i in x:
    x_r = str(round(i, 2)) + " L"
    x_rounded.append(x_r)

for j in y:
    y_r = str(round(j, 2)) + " L"
    y_rounded.append(y_r)
# ---------- end python_3 ----------
yz = YZPlane(Origin=pt_9)  # disabled
yz_2 = YZPlane(Origin=pt_10)  # disabled
number_slider_22 = Slider(35, range=0..100)  # disabled
tag = TextTag3D(Location=yz, Text=python_3.x_rounded, Size=number_slider_22, Justification=7)  # disabled
tag_2 = TextTag3D(Location=yz_2, Text=python_3.y_rounded, Size=number_slider_22, Justification=7)  # disabled
ln_2 = Line(StartPoint=curvepoint, EndPoint=pt_10)  # disabled
ln_3 = Line(StartPoint=curvepoint_2, EndPoint=pt_9)  # disabled

# ---- group: BOTTOM_PLATE
offset_to_middle = Slider(22, range=0..40)
diameter_bottom_plate_connectors = Slider(14, range=0..100)
height_bottom_plate_connectors = Slider(600, range=0..1000)
size_steel_bottom_plate = Slider(600, range=0..1000)
thickness_steel_plate = Slider(15, range=0..100)
neg_16 = Negative(Value=diameter_bottom_plate_connectors)
subtraction_13 = Subtraction(A=neg_16, B=offset_to_middle)
X_4 = UnitX(Factor=offset_to_middle)
neg_17 = Negative(Value=X_4)
dom_9 = ConstructDomain(DomainStart=expr("x/2", size_steel_bottom_plate), DomainEnd=expr("-x/2", size_steel_bottom_plate))
Z_13 = UnitZ(Factor=expr("-x", thickness_steel_plate))
panel_39 = Panel("""{75,150,0}
{300,30,0}
{525,150,0}
{525,450,0}
{300,570,0}
{75,450,0}""")
number_slider_23 = Slider(18, range=0..100)
number_slider_24 = Slider(40, range=0..100)
dom_10 = ConstructDomain(DomainStart=expr("x/2", number_slider_24), DomainEnd=expr("-x/2", number_slider_24))
dom_11 = ConstructDomain(DomainStart=expr("x/2", number_slider_23), DomainEnd=expr("-x/2", number_slider_23))

# ----
# Bake Text then explode in Rhino
number_slider_25 = Slider(2, range=0..10)
shift = ShiftList(List=pt_6, Shift=number_slider_25, Wrap=True)
vec2pt = Vector2Pt(PointA=pt_6, PointB=shift, Unitize=False)  # -> Vector, Length
amp_7 = Amplitude(Vector=vec2pt.Vector, Amplitude=Slider(48, range=0..200))
move_7 = Move(Geometry=pt_6, Motion=amp_7)  # -> Geometry, Transform
pdecon_6 = Deconstruct(Point=move_7.Geometry)  # -> XComponent, YComponent, ZComponent
panel_40 = Panel("""1
2
3
4
5
6
7
8""")

# ---- group: REBAR DISTANCE
distance_threshold_surface_rebar = Slider(20, range=0..100)
resolution_of_calculation = Slider(30, range=0..200)

# ---- group: Extra tolerance holes in bottom plate for vertical staves
addition_3 = Addition(A=diameter_vertical, B=Slider(5, range=0..10))

# ---- group: BASE POINTS / TOP COLUMN
panel_41 = Panel("1901")

# ---- group: BASE POINTS / BOTTOM COLUMN
panel_42 = Panel("-210")

# ---- group: BASE POINTS / POINT 0
panel_43 = Panel("0")

# ---- group: BASE POINTS / TOP OF ORIGINAL COLUMN
panel_44 = Panel("1801")

# ----
division_4 = Division(A=diameter_diagonal, B=2)
division_5 = Division(A=diameter_vertical, B=2)
Z_14 = UnitZ(Factor=z_height_cage)
X_5 = UnitX(Factor=x_radius_cage)
series = Series(Start=0, Step=expr("360/x", amount_of_bars), Count=amount_of_bars)
addition_4 = Addition(A=division_5, B=diameter_stirrup, C=division_4)
addition_5 = Addition(A=x_radius_cage, B=addition_4)
X_6 = UnitX(Factor=addition_5)
division_6 = Division(A=diameter_threaded_rod_top, B=2)
subtraction_14 = Subtraction(A=x_radius_cage, B=division_6, C=division_5)
X_7 = UnitX(Factor=subtraction_14)
Z_15 = UnitZ(Factor=z_middle_height_stirrup)
X_8 = UnitX(Factor=x_stirrup_distance_from_top)
addition_6 = Addition(A=X_6, B=Z_15)
Z_16 = UnitZ(Factor=extension_bottom_large_stirrup)
X_9 = UnitX(Factor=offset_for_stirrup_vertical_intersection)
X_10 = UnitX(Factor=1)
X_11 = UnitX(Factor=expr("-x", offset_for_stirrup_diagonal_intersection))
Z_17 = UnitZ(Factor=Slider(70, range=0..1000))
addition_7 = Addition(A=diameter_vertical, B=diameter_stirrup)
X_12 = UnitX(Factor=addition_7)
Z_18 = UnitZ(Factor=Slider(0, range=0..10))
X_13 = UnitX(Factor=Slider(14, range=0..100))
X_14 = UnitX(Factor=Slider(90, range=0..1000))
subtraction_15 = Subtraction(A=addition_7, B=Slider(28, range=-11..50))
X_15 = UnitX(Factor=subtraction_15)
X_16 = UnitX(Factor=Slider(15, range=0..100))
addition_8 = Addition(A=diameter_vertical, B=diameter_transversal_stirrup)

X_17 = UnitX(Factor=Slider(300, range=0..1000))
Z_19 = UnitZ(Factor=Slider(22, range=0..1000))
Z_20 = UnitZ(Factor="8")
Z_21 = UnitZ(Factor=expr("-x", 1))

# ---- group: offset_pattern_sides
int = Integer(number_slider_12)
division_7 = Division(A=int, B=2)

# ---- group: distance_offset
subtraction_16 = Subtraction(A=division_7, B=1)
range_4 = Range(Domain=Domain(0, 1), Steps=expr("x-1", subtraction_16))
graph_6 = GraphMapper(range_4, x0=0, x1=1, y0=0, y1=1, Cx=0.4770171642, Cy=0.857262373, container_name="Conic")
data_5 = Data(graph_6)
rev = ReverseList(List=data_5)
item = ListItem(List=rev, Index=0, Wrap=True)
merge = Merge(Data1=data_5, Data2=item, Data3=rev)  # -> flatten(Result)
graph_7 = QuickGraph(merge, SortOrder=0)

# ---- group: offset_pattern_sides
range_5 = Range(Domain=dom_2, Steps=expr("x-1", division_7))

graph_8 = GraphMapper(range_5, x0=0, x1=1, y0=0, y1=1, Cx=0.256539166, Cy=0.7374838591, container_name="Conic")
data_6 = Data(graph_8)
bnd_3 = Bounds(Numbers=data_6)
remap_3 = RemapNumbers(Value=data_6, Source=bnd_3, Target=dom_2)  # -> Mapped, Clipped
rev_2 = ReverseList(List=remap_3.Mapped)

# ----
item_2 = ListItem(List=rev_2, Index=0, Wrap=True)

# ---- group: offset_pattern_sides (continued)
merge_2 = Merge(Data1=remap_3.Mapped, Data2=item_2, Data3=rev_2)  # -> flatten(Result)
graph_9 = QuickGraph(merge_2, SortOrder=0)

# ---- group: Div point offset
range_6 = Range(Domain=Domain(0, 1), Steps=expr("x-1", addition_2))

# ---- group: old graph
graph_10 = GraphMapper(
    range_6,
    x0=0,
    x1=1,
    y0=0,
    y1=1,
    container_name="Bezier",
    cpx=[0, 0.5091154575, 0.05710413679, 1],
    cpy=[0.2446190715, 0.4540976286, 0.07733350992, 0])

# ---- group: Div point offset / new
graph_11 = GraphMapper(
    range_6,
    x0=0,
    x1=1,
    y0=0,
    y1=1,
    container_name="Bezier",
    cpx=[0, 0.03761899844, 0, 1],
    cpy=[0.3467151523, 0.5217344165, 0, 0])

# ---- group: Div point offset (continued)
data_7 = Data(graph_11)
bnd_4 = Bounds(Numbers=data_7)
remap_4 = RemapNumbers(Value=data_7, Source=bnd_4, Target=dom_4)  # -> Mapped, Clipped

# ---- group: new graph inspired by old
graph_12 = GraphMapper(
    range_6,
    x0=0,
    x1=1,
    y0=0,
    y1=1,
    container_name="Bezier",
    cpx=[0, 0.1971223205, 0.05710413679, 1],
    cpy=[0.2446190715, 0.3938401937, 0.07733350992, 0])

# ----
item_3 = ListItem(List=remap_4.Mapped, Index=reduce_pattern_layer, Wrap=True)
dom_12 = ConstructDomain(DomainStart=0, DomainEnd=item_3)
range_7 = Range(Domain=dom_12, Steps=reduce_pattern_layer)
split_4 = SplitList(List=range_7, Index=reduce_pattern_layer)  # -> ListA, ListB
split_5 = SplitList(List=remap_4.Mapped, Index=reduce_pattern_layer)  # -> ListA, ListB
merge_3 = Merge(Data1=flatten(split_4.ListA), Data2=flatten(split_5.ListB))  # -> flatten(Result)
python_4 = GhPythonScript(
    short_edges=ln,
    centroid=pt_2,
    curve_offset=remap.Mapped,
    crown_top_curve_offset=crown_top_curve_offset_mm,
    rib_offset=data_2,
    layer_height=layer_height,
    div_pt_count=number_slider_12,
    div_pt_offset=merge_3,
    scale_factor=remap_2.Mapped,
    layer_selection_start=layer_selection_start,
    layer_selection_end=layer_selection_end,
    offset_x=data,
    undulations_type=list_2,
    curve_type=list,
    extra_layers=top_extra_layers,
    offset_pattern_sides=merge_2,
    reduce_pattern_layer=reduce_pattern_layer,
    distance_offset=merge)  # -> out, total_curves, polyline_layers, flat_pt_list, angle_lines, lines, curves; inputs short_edges: list of Curve, centroid: Point3d, curve_offset: list, crown_top_curve_offset: Int32, tan_rot_angle: list, rib_offset: list, div_pt_count: Int32, div_pt_offset: list, scale_factor: list, layer_selection_start: Int32, layer_selection_end: Int32, offset_x: list, extra_layers: Int32, offset_pattern_sides: list, reduce_pattern_layer: Int32, distance_offset: list
# ---------- python_4: Python ----------
__author__ = "joburger&niztaha"
__version__ = "2019.06.12"

import Rhino.Geometry as rg
import math
import imp

from design import curve_undulation as cu
from design import generate_column as gc

imp.reload(cu)
imp.reload(gc)

curves = []
total_curves = []
pt_list = []
angle_lines = []
polyline_layers = []
lines = []
line1 = []
line2 = []
curve_list = []
polyline_pt_list = []
lAxis_pt_list = []
crown_short_edges_pts = []

#axis_moving_pts_indices = []

div_pt_offset_at_column_top = div_pt_offset[reduce_pattern_layer]

# Column top crown addition
if layer_selection_start == 0 :
    layer_selection_end = layer_selection_end + extra_layers
    
    # move initial edges as much as the extra layers
    for i in range(len(short_edges)):
        short_edges[i].Transform(rg.Transform.Translation(rg.Vector3d(0,0,extra_layers)))
    
    offset_x = gc.reverse_extend_list_at_index(offset_x,extra_layers,1)
    
    # change offset_x to go with one diamond to the top part 
    for i in range(extra_layers):
        if i <= 50:
            offset_x[i] = i *4/extra_layers
        else:
            offset_x[i] = i * -4/extra_layers + 4
        print i, offset_x[i]
    
    
    rib_offset_0 = [0 for i in range (extra_layers)]
    rib_offset_0.reverse()
    rib_offset[0:0] = rib_offset_0

    #div_pt_offset = gc.reverse_extend_list_at_index(div_pt_offset,extra_layers,1)

    scale_45 = [i+1 for i in range (extra_layers)]
    scale_45.reverse()
    scale_factor[0:0] = scale_45

new_div_pt_offset = []

# column generation
n = len(short_edges)
for i in range(layer_selection_start, layer_selection_end):
    
    for j in range(n):
        pt1, moved_pt1 = gc.create_rib(short_edges,i,j, rib_offset, -1, scale_factor, centroid, extra_layers)
        pt2, moved_pt2 = gc.create_rib(short_edges,i,(j-(n-1)), rib_offset, 1, scale_factor, centroid, extra_layers)
        # create curve
        if curve_type == 0:
            # OPTION 1: create control point curve
            curve, curve_list = gc.create_cp_crv(curve_offset, i, moved_pt1, moved_pt2, extra_layers, crown_top_curve_offset)
            
        copy_curve = gc.create_column(layer_height, curve, i)

        # append curves
        curves.append(copy_curve)

        # connect curves with straight lines and append
        line_pt1 = copy_curve.PointAtEnd
        line_pt2 = copy_curve.PointAtStart
        line1.append(line_pt1)
        line2.append(line_pt2)
        
        if j > 0:
            line = rg.Line(line1[j-1], line2[j])
            lines.append(line)
            if i == 0:
                crown_short_edges_pts.append(line1[j-1])
                crown_short_edges_pts.append(line2[j])
        if j == n-1:
            line = rg.Line(line1[-1], line2[0])
            lines.append(line)
            if i == 0:
                crown_short_edges_pts.append(line1[-1])
                crown_short_edges_pts.append(line2[0])
                
        # create undulations
        if undulations_type == 0:
            unds = cu.Curve_undulation(copy_curve, div_pt_count, div_pt_offset[i])
            undulated_divpts = unds.curve_undulation_original()
        else:
            unds = cu.Curve_undulation(i, copy_curve, div_pt_count, div_pt_offset[i], div_pt_offset_at_column_top, offset_pattern_sides, extra_layers, reduce_pattern_layer, distance_offset, offset_x[i])
            undulated_divpts = unds.curve_undulation_grid()

        # append to lists
        pt_list.append(undulated_divpts)
        polyline_pt_list.append(undulated_divpts)


    # flatten list and create polyline per layer
    flat_polyline_list = gc.flatten_list(polyline_pt_list)
    polyline_layer = rg.PolylineCurve(flat_polyline_list + [flat_polyline_list[0]])
    polyline_layers.append(polyline_layer)

    angle_lines = gc.create_angleLines(pt_list, flat_polyline_list, div_pt_count, n)

    # reset lists
    polyline_pt_list = []
    line1 = []
    line2 = []


flat_pt_list = gc.flatten_list(pt_list)

total_curves = gc.flatten_list([curves, lines])
# ---------- end python_4 ----------
join = JoinCurves(Curves=python_4.total_curves, Preserve=False)
sort_on_z = SortOnZ(A=join)
crv_7 = Curve(python_4.curves)
crv_8 = Curve(crv_7)
flat_pt_list = Point(python_4.flat_pt_list)
crv_9 = Curve(python_4.lines)
crv_10 = Curve(crv_9)
python_5 = GhPythonScript(short_edges=line, curves=crv_8, lines=crv_10)  # -> crown_curves, crown_short_edges, beamSurfaces, cornerPts; inputs short_edges: list, curves: list, lines: list; disabled
# ---------- python_5: Python ----------
__author__ = "nizart"
__version__ = "2019.02.15"

import Rhino.Geometry as rg
import rhinoscriptsyntax as rs

crown_curves = curves[:len(short_edges)]
crown_short_edges = lines[:len(short_edges)]
print crown_short_edges

# shift crown short edges pts list twice to match with short edges list
crown_short_edges.insert(0,crown_short_edges.pop())

# generate top steel plate

beamSurfaces=[]
cornerPts=[]

#beamSurfacesNormals = []
#beamSurfacesPlanes =[]

for i in range(len(crown_short_edges)):
    #short edge
    short_edgeStart = rs.CurveStartPoint(short_edges[i])
    short_edgeEnd = rs.CurveEndPoint(short_edges[i])
    #crown short edge
    crown_short_edgeStart = rs.CurveStartPoint(crown_short_edges[i])
    crown_short_edgeEnd = rs.CurveEndPoint(crown_short_edges[i])
    #corner pts list
    cornerVertices = [short_edgeStart ,crown_short_edgeStart, crown_short_edgeEnd, short_edgeEnd]
    cornerPts.extend(cornerVertices)
    # create surface
    beamSurface = rs.AddSrfPt(cornerVertices)
    beamSurfaces.append(beamSurface)
    
#    # create plane nad find surface normal
#    srfPlane = rs.PlaneFitFromPoints(cornerPts)
#    # move plane to surface center
#    srfCentroid = rs.SurfaceAreaCentroid(beamSurface)
#    xform = rs.XformTranslation(srfCentroid[0])
##    srfPlaneMoved = rs.MovePlane(srfPlane,srfCentroid[0])
#    srfPlaneMoved = rs.PlaneTransform(srfPlane, xform)
#    beamSurfacesPlanes.append(srfPlaneMoved)
#    # find surface normal
#    srfParameter = rs.SurfaceParameter(beamSurface,[0.5,0.5])
#    beamSurfaceNormal = rs.SurfaceNormal(beamSurface,srfParameter)
#    beamSurfacesNormals.append(beamSurfaceNormal)
# ---------- end python_5 ----------
partition = PartitionList(List=python_5.cornerPts, Size="4")
item_4 = ListItem(List=partition, Index=0, Wrap=True)  # -> flatten(Item1), flatten(Item), flatten(Item1_2), flatten(Item2)
srf = Surface(python_5.beamSurfaces)
item_5 = ListItem(List=srf, Index=Slider(4, range=0..10), Wrap=True)
pln = Plane(item_5)
line_2 = Line(python_5.crown_short_edges)
crv_11 = Curve(python_5.crown_curves)

# ---- group: short edges
pt_11 = Point(item_4.Item1)
pt_12 = Point(item_4.Item)

# ---- group: crown short edges
pt_13 = Point(item_4.Item1_2)
pt_14 = Point(item_4.Item2)

# ----
ln_4 = Line(StartPoint=pt_14, EndPoint=pt_11)
ln_5 = Line(StartPoint=pt_12, EndPoint=pt_13)
ln_6 = Line(StartPoint=pt_11, EndPoint=pt_12)

# ---- group: Crown Curve
join_2 = JoinCurves(Curves=flatten([ln_4, ln_6, ln_5, crv_11]), Preserve=False)
crv_12 = Curve(join_2)

# ----
polyline_layers = Curve(python_4.polyline_layers)
crv_13 = Curve(polyline_layers)
item_6 = ListItem(List=crv_13, Index=subtraction_6, Wrap=True)
item_7 = ListItem(List=crv_13, Index=subtraction_2, Wrap=True)
item_8 = ListItem(List=crv_13, Index=subtraction_3, Wrap=True)
item_9 = ListItem(List=crv_13, Index=subtraction_4, Wrap=True)
item_10 = ListItem(List=crv_13, Index=subtraction_5, Wrap=True)
item_11 = ListItem(List=crv_13, Index=subtraction_7, Wrap=True)
item_12 = ListItem(List=crv_13, Index=subtraction_8, Wrap=True)
item_13 = ListItem(List=crv_13, Index=subtraction_9, Wrap=True)
offset = OffsetCurve(Curve=item_6, Distance=half_filament_width, Plane=PlaneXY(0, 0, 0), Corners=1)
curvepoint_3 = PointOnCurve(offset, parameter=0.5)

pdecon_7 = Deconstruct(Point=curvepoint_3)  # -> XComponent, YComponent, ZComponent
pt_15 = ConstructPoint(XCoordinate=pdecon_6.XComponent, YCoordinate=pdecon_6.YComponent, ZCoordinate=pdecon_7.ZComponent)
pt_16 = Point(pt_15)

movetoplane = MoveToPlane(Geometry=move_4.Geometry, Plane=curvepoint_3, Above=True, Below=True)  # -> Geometry, Transform
movetoplane_2 = MoveToPlane(Geometry=move_3.Geometry, Plane=curvepoint_3, Above=True, Below=True)  # -> Geometry, Transform
offset_2 = OffsetCurve(Curve=item_7, Distance=half_filament_width, Plane=PlaneXY(0, 0, 0), Corners=1)
curvepoint_4 = PointOnCurve(offset_2, parameter=0.5)
movetoplane_3 = MoveToPlane(Geometry=move_4.Geometry, Plane=curvepoint_4, Above=True, Below=True)  # -> Geometry, Transform
movetoplane_4 = MoveToPlane(Geometry=move_3.Geometry, Plane=curvepoint_4, Above=True, Below=True)  # -> Geometry, Transform
offset_3 = OffsetCurve(Curve=item_8, Distance=half_filament_width, Plane=PlaneXY(0, 0, 0), Corners=1)
curvepoint_5 = PointOnCurve(offset_3, parameter=0.5)
movetoplane_5 = MoveToPlane(Geometry=move_4.Geometry, Plane=curvepoint_5, Above=True, Below=True)  # -> Geometry, Transform
movetoplane_6 = MoveToPlane(Geometry=move_3.Geometry, Plane=curvepoint_5, Above=True, Below=True)  # -> Geometry, Transform
offset_4 = OffsetCurve(Curve=item_9, Distance=half_filament_width, Plane=PlaneXY(0, 0, 0), Corners=1)
curvepoint_6 = PointOnCurve(offset_4, parameter=0.5)
movetoplane_7 = MoveToPlane(Geometry=move_4.Geometry, Plane=curvepoint_6, Above=True, Below=True)  # -> Geometry, Transform
movetoplane_8 = MoveToPlane(Geometry=move_3.Geometry, Plane=curvepoint_6, Above=True, Below=True)  # -> Geometry, Transform
offset_5 = OffsetCurve(Curve=item_10, Distance=half_filament_width, Plane=PlaneXY(0, 0, 0), Corners=1)
curvepoint_7 = PointOnCurve(offset_5, parameter=0.5)
offset_6 = OffsetCurve(Curve=item_11, Distance=half_filament_width, Plane=PlaneXY(0, 0, 0), Corners=1)
curvepoint_8 = PointOnCurve(offset_6, parameter=0.5)
offset_7 = OffsetCurve(Curve=item_12, Distance=half_filament_width, Plane=PlaneXY(0, 0, 0), Corners=1)
curvepoint_9 = PointOnCurve(offset_7, parameter=0.5)
movetoplane_9 = MoveToPlane(Geometry=move_5.Geometry, Plane=curvepoint_7, Above=True, Below=True)  # -> Geometry, Transform
movetoplane_10 = MoveToPlane(Geometry=move_6.Geometry, Plane=curvepoint_7, Above=True, Below=True)  # -> Geometry, Transform
movetoplane_11 = MoveToPlane(Geometry=move_5.Geometry, Plane=curvepoint_8, Above=True, Below=True)  # -> Geometry, Transform
movetoplane_12 = MoveToPlane(Geometry=move_6.Geometry, Plane=curvepoint_8, Above=True, Below=True)  # -> Geometry, Transform
movetoplane_13 = MoveToPlane(Geometry=move_5.Geometry, Plane=curvepoint_9, Above=True, Below=True)  # -> Geometry, Transform
movetoplane_14 = MoveToPlane(Geometry=move_6.Geometry, Plane=curvepoint_9, Above=True, Below=True)  # -> Geometry, Transform
offset_8 = OffsetCurve(Curve=item_13, Distance=half_filament_width, Plane=PlaneXY(0, 0, 0), Corners=1)
curvepoint_10 = PointOnCurve(offset_8, parameter=0.5)
movetoplane_15 = MoveToPlane(Geometry=move_5.Geometry, Plane=curvepoint_10, Above=True, Below=True)  # -> Geometry, Transform
movetoplane_16 = MoveToPlane(Geometry=move_6.Geometry, Plane=curvepoint_10, Above=True, Below=True)  # -> Geometry, Transform
rdiff = RegionDifference(CurvesA=movetoplane.Geometry, CurvesB=offset)
rdiff_2 = RegionDifference(CurvesA=movetoplane_2.Geometry, CurvesB=offset)
rdiff_3 = RegionDifference(CurvesA=movetoplane_3.Geometry, CurvesB=offset_2)
rdiff_4 = RegionDifference(CurvesA=movetoplane_4.Geometry, CurvesB=offset_2)
rdiff_5 = RegionDifference(CurvesA=movetoplane_5.Geometry, CurvesB=offset_3)
rdiff_6 = RegionDifference(CurvesA=movetoplane_6.Geometry, CurvesB=offset_3)
rdiff_7 = RegionDifference(CurvesA=movetoplane_7.Geometry, CurvesB=offset_4)
rdiff_8 = RegionDifference(CurvesA=movetoplane_8.Geometry, CurvesB=offset_4)
rdiff_9 = RegionDifference(CurvesA=movetoplane_9.Geometry, CurvesB=offset_5)
rdiff_10 = RegionDifference(CurvesA=movetoplane_10.Geometry, CurvesB=offset_5)
rdiff_11 = RegionDifference(CurvesA=movetoplane_11.Geometry, CurvesB=offset_6)
rdiff_12 = RegionDifference(CurvesA=movetoplane_12.Geometry, CurvesB=offset_6)
rdiff_13 = RegionDifference(CurvesA=movetoplane_13.Geometry, CurvesB=offset_7)
rdiff_14 = RegionDifference(CurvesA=movetoplane_14.Geometry, CurvesB=offset_7)
rdiff_15 = RegionDifference(CurvesA=movetoplane_15.Geometry, CurvesB=offset_8)
rdiff_16 = RegionDifference(CurvesA=movetoplane_16.Geometry, CurvesB=offset_8)
crv_14 = Curve(rdiff_7)
crv_15 = Curve(rdiff)
crv_16 = Curve(rdiff_2)
extr_3 = Extrude(Base=[crv_16, crv_15], Direction=neg_5)
crv_17 = Curve(rdiff_8)
extr_4 = Extrude(Base=[crv_17, crv_14], Direction=neg_8)
crv_18 = Curve(rdiff_6)
crv_19 = Curve(rdiff_3)
crv_20 = Curve(rdiff_4)
extr_5 = Extrude(Base=[crv_20, crv_19], Direction=neg_6)
crv_21 = Curve(rdiff_5)
extr_6 = Extrude(Base=[crv_18, crv_21], Direction=neg_7)

# ---- group: Engraving
tag_3 = TextTag3D(
    Location=pt_16,
    Text=panel_40,
    Size=Slider(20, range=0..100),
    Colour=ColourSwatch(SwatchColor=RGB(255, 0, 0)),
    Justification=5)

# ----
cap = CapHoles(Brep=extr_3)
cap_2 = CapHoles(Brep=extr_5)
cap_3 = CapHoles(Brep=extr_6)
cap_4 = CapHoles(Brep=extr_4)
crv_22 = Curve(rdiff_9)
crv_23 = Curve(rdiff_10)
extr_7 = Extrude(Base=[crv_23, crv_22], Direction=neg_9)
crv_24 = Curve(rdiff_11)
crv_25 = Curve(rdiff_12)
extr_8 = Extrude(Base=[crv_25, crv_24], Direction=neg_10)
crv_26 = Curve(rdiff_13)
crv_27 = Curve(rdiff_14)
extr_9 = Extrude(Base=[crv_27, crv_26], Direction=neg_11)
cap_5 = CapHoles(Brep=extr_7)
crv_28 = Curve(rdiff_15)
crv_29 = Curve(rdiff_16)
extr_10 = Extrude(Base=[crv_29, crv_28], Direction=neg_12)
cap_6 = CapHoles(Brep=extr_8)
cap_7 = CapHoles(Brep=extr_9)
cap_8 = CapHoles(Brep=extr_10)
merge_4 = Merge(
    Data1=crv_15,
    Data2=crv_16,
    Data3=crv_21,
    Data4=crv_18,
    Data5=crv_19,
    Data6=crv_20,
    Data7=crv_14,
    Data8=crv_17,
    Data9=crv_28,
    Data10=crv_29,
    Data11=crv_24,
    Data12=crv_25,
    Data13=crv_26,
    Data14=crv_27,
    Data15=crv_22,
    Data16=crv_23)
crv_30 = Curve(merge_4)

# ---- group: select top curve
item_14 = ListItem(List=polyline_layers, Index=0, Wrap=True)
boundary = BoundarySurfaces(Edges=item_14)
area = Area(Geometry=boundary)  # -> Area, Centroid

# ---- group: BASE POINTS / midPt setout top
pt_17 = Point(area.Centroid)

# ---- group: BASE POINTS
pdecon_8 = Deconstruct(Point=pt_17)  # -> XComponent, YComponent, ZComponent
pt_18 = ConstructPoint(XCoordinate=pdecon_8.XComponent, YCoordinate=pdecon_8.YComponent, ZCoordinate=panel_41)
pt_19 = ConstructPoint(XCoordinate=pdecon_8.XComponent, YCoordinate=pdecon_8.YComponent, ZCoordinate=panel_44)
pt_20 = ConstructPoint(XCoordinate=pdecon_8.XComponent, YCoordinate=pdecon_8.YComponent, ZCoordinate=panel_43)
pt_21 = ConstructPoint(XCoordinate=pdecon_8.XComponent, YCoordinate=pdecon_8.YComponent, ZCoordinate=panel_42)

# ---- group: BASE POINTS / BOTTOM COLUMN (continued)
pt_22 = Point(pt_21)

# ----
move_8 = Move(Geometry=pt_22, Motion="0,0,-75")  # -> Geometry, Transform

# ---- group: BASE POINTS / TOP COLUMN (continued)
pt_23 = Point(pt_18)

# ---- group: BASE POINTS / POINT 0 (continued)
pt_24 = Point(pt_20)

# ---- group: BASE POINTS / TOP OF ORIGINAL COLUMN (continued)
pt_25 = Point(pt_19)

# ---- group: Pipe
cyl = Cylinder(Base=move_8.Geometry, Radius=Slider(56, range=0..100), Length=Slider(2186, range=2000..2300))

# ---- group: BOTTOM OF COLUMN
pt_26 = Point(pt_22)

# ----
pt_27 = Point(pt_23)
move_9 = Move(Geometry=pt_27, Motion=X_17)  # -> Geometry, Transform
rotate_2 = Rotate(Geometry=move_9.Geometry, Angle=degrees(number_slider_9), Plane=pt_27)  # -> Geometry, Transform
rotate_3 = Rotate(Geometry=graft(rotate_2.Geometry), Angle=degrees(series), Plane=pt_26)  # -> simplify(Geometry), Transform
vec2pt_2 = Vector2Pt(PointA=rotate_3.Geometry, PointB=pt_27, Unitize=False)  # -> Vector, Length
move_10 = Move(Geometry=rotate_3.Geometry, Motion=expr("-x", Z_19))  # -> Geometry, Transform
xy_2 = XYPlane(Origin=move_10.Geometry)
cyl_2 = Cylinder(Base=move_10.Geometry, Radius=Slider(7, range=0..10), Length=Slider(270, range=0..1000))
align = AlignPlane(Plane=xy_2, Direction=vec2pt_2.Vector)  # -> Plane, Angle
deplane = DeconstructPlane(Plane=align.Plane)  # -> Origin, XAxis, YAxis, ZAxis
rectangle_3 = Rectangle(Plane=align.Plane, XSize=Domain(-17.5, 17.5), YSize=Domain(-17.5, 17.5), Radius=0)  # -> Rectangle, Length
debrep = DeconstructBrep(Brep=rectangle_3.Rectangle)  # -> Faces, Edges, Vertices
unit = UnitVector(Vector=deplane.YAxis)
extr_11 = Extrude(Base=rectangle_3.Rectangle, Direction=Z_20)
item_15 = ListItem(List=debrep.Vertices, Index=0, Wrap=True)  # -> Item, Item1, Item2, Item3
multiplication_2 = Multiplication(A=unit, B=Slider(3, range=0..10))
pt_28 = Point(item_15.Item1)
pt_29 = Point(item_15.Item2)
pt_30 = Point(item_15.Item3)
pt_31 = Point(item_15.Item)
move_11 = Move(Geometry=flatten(pt_31), Motion=multiplication_2)  # -> Geometry, Transform
move_12 = Move(Geometry=flatten(pt_28), Motion=multiplication_2)  # -> Geometry, Transform
ln_7 = Line(StartPoint=pt_29, EndPoint=pt_30)
curvepoint_11 = PointOnCurve(ln_7, parameter=0.5)
move_13 = Move(Geometry=flatten(curvepoint_11), Motion=expr("-x", multiplication_2))  # -> Geometry, Transform
line_3 = LineSDL(Start=[move_11.Geometry, move_12.Geometry, move_13.Geometry], Direction=Z_21, Length=Slider(141, range=0..200))
cyl_3 = Cylinder(Base=xy_2, Radius="7.25", Length="100")
pipe = Pipe(Curve=line_3, Radius="3", Caps=0)
cap_9 = CapHoles(Brep=extr_11)

# ---- group: Small plates
geo = Geometry([cap_9, pipe])

# ---- group: pipe
brep_2 = Brep(cyl)

# ----
geo_2 = Geometry(cyl_3)
item_16 = ListItem(
    List=polyline_layers,
    Index=[Slider(100, range=0..2200), Slider(1000, range=0..2200), Slider(1677, range=0..2200), Slider(2110, range=0..2200)],
    Wrap=True)
curves = Curve(sort_on_z)
area_2 = Area(Geometry=item_16)  # -> Area, Centroid
loft = Loft(Curves=curves, Options={Adjust=False, Closed=False, LoftEnds=0, LoftSimp=0, LoftType=0, Rebuild=18, Refit=0.01})  # disabled
rectangle_4 = Rectangle(Plane=area_2.Centroid, XSize=dom_6, YSize=dom_6, Radius=0)  # -> Rectangle, Length
loft_2 = Loft(Curves=polyline_layers, Options={Adjust=False, Closed=False, LoftEnds=0, LoftSimp=0, LoftType=0, Rebuild=10, Refit=0.01})  # disabled

# ---- group: Printing time
len = Length(Curve=polyline_layers)
ma = MassAddition(Input=len)  # -> Result, PartialResults
python_6 = GhPythonScript(tot_length=ma.Result, print_speed=Slider(40, range=0..100))  # -> simplify(out), a
# ---------- python_6: Python ----------
__author__ = "joburger"
__version__ = "2018.09.06"

import imp
from design import generate_column as gc

imp.reload(gc)

gc.calculate_weight(tot_length, print_speed)
# ---------- end python_6 ----------

# ----
crv_31 = Curve(python_4.angle_lines)
null = NullItem(Item=crv_31)  # -> NullFlags, InvalidFlags, Description
not = GateNot(A=null.InvalidFlags)
cull = CullPattern(List=crv_31, CullPattern=not)
len_2 = Length(Curve=cull)
division_8 = Division(A=layer_height, B=len_2)
list_10 = ValueList({"Show curve gradient": "gradient", "Show invalid curves": "invalid"}, selected="Show invalid curves")
acos = ArcCosine(Value=division_8)
deg = Degrees(Radians=acos)
python_7 = GhPythonScript(deg=deg, show_curve_type=list_10, max_angle=Slider(42, range=0..100))  # -> out, a, b; inputs deg: list
# ---------- python_7: Python ----------
__author__ = "Joris"
__version__ = "2018.10.31"

import rhinoscriptsyntax as rs

a = []
highest = max(deg)

if show_curve_type == "gradient":
    for i in range(len(deg)):
        if deg[i] < 400:
            red = deg[i] * (255/highest)
            green = 0
            blue = 0
            colour = rs.CreateColor(red, green, blue)
            a.append(colour)
elif show_curve_type == "invalid":
    for i in range(len(deg)):
        if deg[i] > max_angle:
            red = 200
            green = 0
            blue = 0
        else:
            red = 0
            green = 175
            blue = 0
        colour = rs.CreateColor(red, green, blue)
        a.append(colour)
# ---------- end python_7 ----------
panel_45 = Panel(deg)
preview_3 = CustomPreview(Geometry=polyline_layers, Material=python_7.a)

# ---- group: Orient for printing
item_17 = ListItem(List=polyline_layers, Index=-1, Wrap=True)
area_3 = Area(Geometry=item_17)  # -> Area, Centroid
xy_3 = XYPlane(Origin=orientpt)
xy_4 = XYPlane(Origin=area_3.Centroid)
orient = Orient(Geometry=polyline_layers, Source=xy_4, Target=xy_3)  # -> Geometry, Transform
orient_2 = Orient(Geometry=flat_pt_list, Source=xy_4, Target=xy_3)  # -> Geometry, Transform

# ----
panel_46 = Panel(python_6.out)

# ---- group: Oriented curves
crv_32 = Curve(orient.Geometry)

# ---- group: Oriented points
pt_32 = Point(orient_2.Geometry)

# ----
loft_3 = Loft(Curves=crv_32, Options={Adjust=False, Closed=False, LoftEnds=0, LoftSimp=0, LoftType=0, Rebuild=10, Refit=0.01})  # disabled

# ---- group: Print with UR
rev_3 = ReverseList(List=pt_32)
pdecon_9 = Deconstruct(Point=rev_3)  # -> XComponent, YComponent, ZComponent
pt_33 = ConstructPoint(XCoordinate=pdecon_9.XComponent, YCoordinate=pdecon_9.YComponent, ZCoordinate=pdecon_9.ZComponent)

# ---- group: Print with both / itll be sent to main python
layers_to_move_linear_axis = Slider(14, range=0..100)
lng_2 = ListLength(List=flat_pt_list)
lng_3 = ListLength(List=polyline_layers)
division_9 = Division(A=lng_2, B=lng_3)
# removed adding the first point in every list temorary for top printing
points_per_layer = Panel(division_9)

# ----
point = Integer(points_per_layer)

# ---- group: Print with UR
amount_of_layers = Panel(lng_3)
pt_34 = Point(pt_33)
points_per_layer_2 = Panel(division_9)
python_8 = GhPythonScript(input_pts=pt_34, pts_per_layer=points_per_layer_2, amount_of_layers=amount_of_layers, shift_value=Slider(5, range=0..10))  # -> flat_pt_list; inputs input_pts: list of Point3d, pts_per_layer: Int32, amount_of_layers: Int32, shift_value: Int32
# ---------- python_8: Python ----------
__author__ = "joburger"
__version__ = "2019.07.04"

def flatten_list(array):
    return [item for sublist in array for item in sublist]

output_pts = []

for i in range(amount_of_layers):
    print "layer index:" , i*pts_per_layer+shift_value, i*pts_per_layer+pts_per_layer
    layer = input_pts[i*pts_per_layer+shift_value:i*pts_per_layer+pts_per_layer]
    print "extra_pt_index:" , i*pts_per_layer, i*pts_per_layer+shift_value
    extra_pts = input_pts[i*pts_per_layer:i*pts_per_layer+shift_value]
    output_pts.append(layer)
    output_pts.append(extra_pts)

flat_pt_list = flatten_list(output_pts)
# ---------- end python_8 ----------

# ---- group: Print with both
python_9 = GhPythonScript(
    pts_per_layer=points_per_layer,
    layers_to_move_linear_axis=layers_to_move_linear_axis,
    x=pdecon_9.XComponent,
    y=pdecon_9.YComponent,
    z=pdecon_9.ZComponent,
    printing_top_extra_layers=printing_top_extra_layers)  # -> out, new_pts, z_last_partition, z_all_pts_partitions; inputs pts_per_layer: Int32, layers_to_move_linear_axis: Int32, x: list, y: list, z: list
# ---------- python_9: Python ----------
__author__ = "nizart"
__version__ = "2019.07.03"

import Rhino.Geometry as rg

new_pts = []

n = pts_per_layer*layers_to_move_linear_axis

x1 = [x[i:i + n] for i in range(0, len(x), n)]
y1 = [y[i:i + n] for i in range(0, len(y), n)]

z1 = [z[i:i + n] for i in range(0, len(z), n)]

z_all_pts_partitions = z1[0]
z_last_partition = z1[-1]

print ("z branch 0 length",len(z_all_pts_partitions))
print ("z last branch length",len(z_last_partition))
print ("x branches length",len(x1))

for i,x in enumerate(x1):
    # in case last branch is an odd number
    if i == len(x1)-1:
        for j in range(len(x)):
            # new pt (x,y,z)
            new_pt = rg.Point3d(x1[i][j], y1[i][j], z_all_pts_partitions[j])
            new_pts.append(new_pt)
    else:
        for j in range(len(x)):
            # new pt (x,y,z)
            new_pt = rg.Point3d(x1[i][j], y1[i][j], z_all_pts_partitions[j])
            new_pts.append(new_pt)
            # append first pt of next batch before the linear axis moves
            if not printing_top_extra_layers:
                if j == len(x)-1:
                    var_z = 1 # mm
                    first_pt = rg.Point3d(x1[i+1][0], y1[i+1][0], z_all_pts_partitions[j]+var_z)
                    new_pts.append(first_pt)
# ---------- end python_9 ----------

# ----
panel_47 = Panel(python_9.out)
pt_35 = Point(python_8)
pt_36 = Point(python_9.new_pts)
filter_2 = StreamFilter(Gate=list_7, Stream0=pt_35, Stream1=pt_36)
pt_37 = Point(filter_2)

# ---- group: remove top 100
multiplication_3 = Multiplication(A=top_extra_layers, B=division_9)
integer_division = IntegerDivision(A=top_extra_layers, B=layers_to_move_linear_axis)  # disabled
addition_9 = Addition(A=multiplication_3, B=integer_division)
filter_3 = StreamFilter(Gate=list_7, Stream0=multiplication_3, Stream1=addition_9)
python_10 = GhPythonScript(pts_list=pt_37, split_index=filter_3, layer_selection_start=layer_selection_start)  # -> new_pts_list, top_100; inputs pts_list: list, split_index: Int32
# ---------- python_10: Python ----------
__author__ = "dfab"
__version__ = "2019.07.01"

import rhinoscriptsyntax as rs

if layer_selection_start == 0 :
    l = len(pts_list)
    new_pts_list = pts_list[:l-split_index]
    top_100 = pts_list[l-split_index:]
else:
    new_pts_list = pts_list
# ---------- end python_10 ----------

# ---- group: to be oriented to bed
pt_38 = Point(python_10.top_100)

# ----
pt_39 = Point(python_10.new_pts_list)
pt_40 = Point(pt_38)

# ---- group: create_water_extra_layers
lng_4 = ListLength(List=pt_40)
int_2 = Integer(division_9)
subtraction_17 = Subtraction(A=lng_4, B=int_2)
split_6 = SplitList(List=pt_40, Index=subtraction_17)  # -> ListA, ListB
extra_layers_for_water = Slider(20, range=0..100)
pt_41 = Point(split_6.ListB)
series_2 = Series(Start=0, Step=1, Count=extra_layers_for_water)
Z_22 = UnitZ(Factor=series_2)
move_14 = Move(Geometry=graft(pt_41), Motion=Z_22)  # -> Geometry, Transform
flip = FlipMatrix(Data=move_14.Geometry)  # -> flatten(Data)
split_7 = SplitList(List=flip, Index=int_2)  # -> ListA, ListB

# ---- group: split at layer selection
layer_selection = Slider(1505, range=0..10000)
integer_division_2 = IntegerDivision(A=layer_selection, B=layers_to_move_linear_axis)
multiplication_4 = Multiplication(A=layer_selection, B=division_9)
addition_10 = Addition(A=multiplication_4, B=integer_division_2)
split_8 = SplitList(List=pt_39, Index=addition_10)  # -> ListA, ListB
pt_42 = Point(split_8.ListB)
xy_5 = XYPlane(Origin=pt_42)
pln_2 = Plane(flatten(xy_5))

# ----
subset = SubList(List=pt_42, Domain=dom_7, Wrap=True)  # -> List, Index
pline = PolyLine(Vertices=subset.List, Closed=False)

# ---- group: add_water_layers_to_top
python_11 = GhPythonScript(list1=pt_40, list2=split_7.ListB)  # -> out, list1; inputs list1: list, list2: list
# ---------- python_11: Python ----------
__author__ = "dfab"
__version__ = "2019.06.11"

list1[-1:] = list2
# ---------- end python_11 ----------
pt_43 = Point(python_11.list1)

# ---- group: align to printing bed
rotation_angle = Panel("180")
deplane_2 = DeconstructPlane(Plane=orientpt)  # -> Origin, XAxis, YAxis, ZAxis
rot3d = Rotate3D(Geometry=pt_43, Angle=degrees(rotation_angle), Center=deplane_2.Origin, Axis=deplane_2.XAxis)  # -> Geometry, Transform
rot3d_2 = Rotate3D(Geometry=crv_32, Angle=degrees(rotation_angle), Center=deplane_2.Origin, Axis=deplane_2.XAxis)  # -> Geometry, Transform
print_with_ur = Slider(2129, range=0..10000)
print_with_linear_axis_till_2011 = Slider(29, range=0..10000)
print_with_linear_axis_top_extra_layer = Slider(13, range=0..10000)
filter_4 = StreamFilter(Gate=list_7, Stream0=print_with_ur, Stream1=print_with_linear_axis_top_extra_layer)
Z_23 = UnitZ(Factor=filter_4)
move_15 = Move(Geometry=rot3d.Geometry, Motion=Z_23)  # -> Geometry, Transform
pt_44 = Point(move_15.Geometry)

# ----
rev_4 = ReverseList(List=pt_44)
pdecon_10 = Deconstruct(Point=rev_4)  # -> XComponent, YComponent, ZComponent
python_12 = GhPythonScript(
    pts_per_layer=points_per_layer,
    layers_to_move_linear_axis=layers_to_move_linear_axis,
    x=pdecon_10.XComponent,
    y=pdecon_10.YComponent,
    z_all_pts_partitions=python_9.z_all_pts_partitions)  # -> out, new_pts; inputs pts_per_layer: Int32, layers_to_move_linear_axis: Int32, x: list, y: list, z_all_pts_partitions: list
# ---------- python_12: Python ----------
__author__ = "nizart"
__version__ = "2019.07.03"

import Rhino.Geometry as rg

new_pts = []

n = pts_per_layer*layers_to_move_linear_axis

x1 = [x[i:i + n] for i in range(0, len(x), n)]
y1 = [y[i:i + n] for i in range(0, len(y), n)]

#z1 = [z[i:i + n] for i in range(0, len(z), n)]

#z_all_pts_partitions = z1[0]
#z_last_partition = z1[-1]

#print ("z branch 0 length",len(z_all_pts_partitions))
#print ("z last branch length",len(z_last_partition))
print ("x branches length",len(x1))

for i,x in enumerate(x1):
    # in case last branch is an odd number
    if i == len(x1)-1:
        for j in range(len(x)):
            # new pt (x,y,z)
            new_pt = rg.Point3d(x1[i][j], y1[i][j], z_all_pts_partitions[j])
            new_pts.append(new_pt)
    else:
        for j in range(len(x)):
            # new pt (x,y,z)
            new_pt = rg.Point3d(x1[i][j], y1[i][j], z_all_pts_partitions[j])
            new_pts.append(new_pt)
            # append first pt of next batch before the linear axis moves
            if j == len(x)-1:
                var_z = 1 # mm
                first_pt = rg.Point3d(x1[i+1][0], y1[i+1][0], z_all_pts_partitions[j]+var_z)
                new_pts.append(first_pt)
# ---------- end python_12 ----------
subset_2 = SubList(List=python_12.new_pts, Domain=dom_8, Wrap=True)  # -> List, Index
pt_45 = Point(python_12.new_pts)
pline_2 = PolyLine(Vertices=subset_2.List, Closed=False)
xy_6 = XYPlane(Origin=pt_39)
xy_7 = XYPlane(Origin=pt_45)

# ---- group: Fabrication planes
pln_3 = Plane(flatten(xy_6))

pln_4 = Plane(flatten(xy_7))

# ----
pln_5 = Plane(flatten(pln_4))
rotate_4 = Rotate(Geometry=pln_5, Angle=degrees(number_slider_13), Plane=pln_5)  # -> Geometry, Transform
crv_33 = Curve(polyline_layers)  # disabled

# ---- group: BOTTOM_PLATE (continued)
rectangle_5 = Rectangle(Plane=pt_26, XSize=dom_9, YSize=dom_9, Radius=0)  # -> Rectangle, Length
extr_12 = Extrude(Base=rectangle_5.Rectangle, Direction=Z_13)
cap_10 = CapHoles(Brep=extr_12)
disc = Discontinuity(Curve=rectangle_5.Rectangle, Level=1)  # -> Points, Parameters
item_18 = ListItem(List=disc.Points, Index=0, Wrap=True)
move_16 = Move(Geometry=item_18, Motion=panel_39)  # -> Geometry, Transform
vec2pt_3 = Vector2Pt(PointA=move_16.Geometry, PointB=pt_22, Unitize=False)  # -> Vector, Length
xy_8 = XYPlane(Origin=move_16.Geometry)
align_2 = AlignPlane(Plane=xy_8, Direction=vec2pt_3.Vector)  # -> Plane, Angle
rectangle_6 = Rectangle(Plane=align_2.Plane, XSize=dom_11, YSize=dom_10, Radius=0)  # -> Rectangle, Length
fillet = Fillet(Curve=rectangle_6.Rectangle, Radius=Slider(10, range=0..10))
extr_13 = Extrude(Base=fillet, Direction=Vector(0, 0, 100))
move_17 = Move(Geometry=extr_13, Motion=Vector(0, 0, -77.06609237))  # -> Geometry, Transform
cap_11 = CapHoles(Brep=move_17.Geometry)
sdiff = SolidDifference(BrepsA=cap_10, BrepsB=cap_11)

# ----
sdiff_2 = SolidDifference(BrepsA=sdiff, BrepsB=cyl)

move_18 = Move(Geometry=pt_26, Motion=X_7)  # -> Geometry, Transform
pdecon_11 = Deconstruct(Point=move_18.Geometry)  # -> XComponent, YComponent, ZComponent
move_19 = Move(Geometry=pt_26, Motion=X_5)  # -> Geometry, Transform
addition_11 = Addition(A=pdecon_11.ZComponent, B=z_height_cage)
move_20 = Move(Geometry=pt_26, Motion=X_6)  # -> Geometry, Transform
subtraction_18 = Subtraction(A=addition_11, B=threaded_rod_depth_into_column)
cage_bottompt = Point(move_19.Geometry)
pt_46 = ConstructPoint(XCoordinate=pdecon_11.XComponent, YCoordinate=pdecon_11.YComponent, ZCoordinate=subtraction_18)
move_21 = Move(Geometry=cage_bottompt, Motion=Z_14)  # -> Geometry, Transform
move_22 = Move(Geometry=move_20.Geometry, Motion=Z_14)  # -> Geometry, Transform
move_23 = Move(Geometry=pt_26, Motion=addition_6)  # -> Geometry, Transform
cage_toppt = Point(move_21.Geometry)
stirrup_top_insidept = Point(move_22.Geometry)
stirrup_midpt = Point(move_23.Geometry)
line_4 = LineSDL(Start=pt_46, Direction=Vector(0, 0, 1), Length=length_of_threaded_rod)
move_24 = Move(Geometry=cage_toppt, Motion=X_8)  # -> Geometry, Transform
stirrup_top_outsidept = Point(move_24.Geometry)
ln_8 = Line(StartPoint=stirrup_top_insidept, EndPoint=stirrup_top_outsidept)
ln_9 = Line(StartPoint=stirrup_midpt, EndPoint=stirrup_top_outsidept)
ln_10 = Line(StartPoint=stirrup_top_insidept, EndPoint=stirrup_midpt)
move_25 = Move(Geometry=stirrup_midpt, Motion=Z_16)  # -> Geometry, Transform
eval = EvaluateLength(Curve=ln_10, Length=extension_top_large_stirrup, Normalized=False)  # -> Point, Tangent, Parameter
ln_11 = Line(StartPoint=stirrup_midpt, EndPoint=stirrup_top_outsidept)
ln_12 = Line(StartPoint=stirrup_top_insidept, EndPoint=eval.Point)
bottom_stirruppt = Point(move_25.Geometry)
end_2 = EndPoints(Curve=ln_12)  # -> Start, End
end_3 = EndPoints(Curve=ln_11)  # -> Start, End
pt_47 = Point(end_2.End)
pt_48 = Point(end_2.Start)
pt_49 = Point(end_3.Start)
pt_50 = Point(end_3.End)
join_3 = JoinCurves(Curves=[ln_12, ln_8], Preserve=False)
ln_13 = Line(StartPoint=stirrup_midpt, EndPoint=bottom_stirruppt)
end_4 = EndPoints(Curve=ln_13)  # -> Start, End
pt_51 = Point(end_4.End)
pline_3 = PolyLine(Vertices=[pt_47, pt_48, pt_50, pt_49, pt_51], Closed=False)
fillet_2 = Fillet(Curve=pline_3, Radius=Slider(42, range=0..100))
fillet_3 = Fillet(Curve=join_3, Radius=fillet_radius_large_stirrup_vertical)
join_4 = JoinCurves(Curves=flatten([fillet_3, ln_11]), Preserve=False)
fillet_4 = Fillet(Curve=join_4, Radius=fillet_radius_large_stirrup_diagonal)
join_5 = JoinCurves(Curves=flatten([fillet_4, ln_13]), Preserve=False)
disc_2 = Discontinuity(Curve=join_5, Level=1)  # -> Points, Parameters
item_19 = ListItem(List=disc_2.Parameters, Index=0, Wrap=True)
fillet_5 = Fillet(Curve=join_5, Parameter=item_19, Radius=fillet_radius_large_stirrup_middle_secti)  # -> Curve, Parameter

move_26 = Move(Geometry=cage_bottompt, Motion=Z_10)  # -> Geometry, Transform

# ---- group: Threaded rods
pipe_2 = Pipe(Curve=line_4, Radius=expr("x/2", diameter_threaded_rod_top), Caps=1)

# ---- group: BOTTOM_PLATE (continued)
move_27 = Move(Geometry=cage_bottompt, Motion=neg_17)  # -> Geometry, Transform
rotate_5 = Rotate(Geometry=graft(move_27.Geometry), Angle=degrees(series), Plane=pt_26)  # -> simplify(Geometry), Transform
rotate_6 = Rotate(Geometry=rotate_5.Geometry, Angle=degrees(Slider(27.5, range=0..100)), Plane=pt_26)  # -> Geometry, Transform
cyl_4 = Cylinder(Base=rotate_6.Geometry, Radius=expr("x/2", diameter_bottom_plate_connectors), Length=height_bottom_plate_connectors)
cap_12 = CapHoles(Brep=cyl_4)

# ---- group: Steel Fins
debrep_2 = DeconstructBrep(Brep=brep)  # -> Faces, Edges, Vertices
item_20 = ListItem(List=debrep_2.Vertices, Index=0, Wrap=True)  # -> Item, Item1, Item2, Item3, Item4
addition_12 = Addition(A=panel_14, B=1)
vec2pt_4 = Vector2Pt(PointA=item_20.Item4, PointB=item_20.Item, Unitize=False)  # -> Vector, Length
amp_8 = Amplitude(Vector=vec2pt_4.Vector, Amplitude=panel_14)  # -> flatten(Vector)
amp_9 = Amplitude(Vector=vec2pt_4.Vector, Amplitude=addition_12)  # -> flatten(Vector)
curvepoint_12 = PointOnCurve(ln_4, parameter=0.5)
scale = Scale(Geometry=ln_4, Center=curvepoint_12, Factor=0.85)  # -> Geometry, Transform
scale_2 = Scale(Geometry=ln_4, Center=curvepoint_12, Factor=2)  # -> Geometry, Transform
vec2pt_5 = Vector2Pt(PointA=pt_11, PointB=pt_12, Unitize=False)  # -> Vector, Length
amp_10 = Amplitude(Vector=vec2pt_5.Vector, Amplitude="28.5")
amp_11 = Amplitude(Vector=vec2pt_5.Vector, Amplitude="27.5")
amp_12 = Amplitude(Vector=vec2pt_5.Vector, Amplitude="10")
amp_13 = Amplitude(Vector=vec2pt_5.Vector, Amplitude="8")

# ---- group: Steel Plate
simplify = SimplifyCurve(Curve=crv_11)  # -> Curve, Simplified
neg_18 = Negative(Value=panel_13)
Z_24 = UnitZ(Factor=neg_18)
move_28 = Move(Geometry=brep_2, Motion=Z_24)  # -> Geometry, Transform

# ---- group: Offset
offset_9 = OffsetCurve(Curve=simplify.Curve, Distance=expr("-x", offset_curve_distance), Plane=PlaneXY(0, 0, 0), Corners=1)  # -> flatten(Curve)
end_5 = EndPoints(Curve=offset_9)  # -> Start, End
shift_2 = ShiftList(List=end_5.Start, Shift=1, Wrap=True)
ln_14 = Line(StartPoint=shift_2, EndPoint=end_5.End)

# ---- group: Curve no offset
join_6 = JoinCurves(Curves=flatten([simplify.Curve, line_2]), Preserve=False)

# ---- group: Curve with offset
join_7 = JoinCurves(Curves=flatten([offset_9, ln_14]), Preserve=False)

# ---- group: Crown Beams
pt_52 = Point(pt_13)
pln_6 = Plane(srf)
area_4 = Area(Geometry=srf)  # -> Area, Centroid
vec2pt_6 = Vector2Pt(PointA=pt_52, PointB=area_4.Centroid, Unitize=False)  # -> Vector, Length
move_29 = Move(Geometry=pln_6, Motion=vec2pt_6.Vector)  # -> Geometry, Transform
pl_offset = PlaneOffset(BasePlane=move_29.Geometry, Offset=addition)
pl_offset_2 = PlaneOffset(BasePlane=move_29.Geometry, Offset=panel_13)
vec2pt_7 = Vector2Pt(PointA=move_29.Geometry, PointB=pl_offset_2, Unitize=False)  # -> Vector, Length
vec2pt_8 = Vector2Pt(PointA=move_29.Geometry, PointB=pl_offset, Unitize=False)  # -> Vector, Length
number_slider_26 = Slider(1.5, range=0..10)
move_30 = Move(Geometry=srf, Motion=vec2pt_8.Vector)  # -> Geometry, Transform
scale_nu = ScaleNU(Geometry=move_30.Geometry, Plane=pl_offset, ScaleX=number_slider_26, ScaleY=number_slider_26, ScaleZ=number_slider_26)  # -> Geometry, Transform
split_9 = SplitBrep(Brep=brep, Cutter=scale_nu.Geometry)
pshift = ShiftPaths(Data=split_9, Offset=-1)
dispatch = Dispatch(List=pshift, DispatchPattern=[True, False])  # -> ListA, ListB
cap_13 = CapHoles(Brep=dispatch.ListB)

# ---- group: Holes top plate
crv_34 = Curve(line_4)
rotate_7 = Rotate(Geometry=graft(crv_34), Angle=degrees(series), Plane=pt_26)  # -> simplify(Geometry), Transform
rotate_8 = Rotate(Geometry=rotate_7.Geometry, Angle=degrees(number_slider_9), Plane=pt_26)  # -> Geometry, Transform
addition_13 = Addition(A=division_6, B=extra_tolerance_hole)
pipe_3 = Pipe(Curve=rotate_8.Geometry, Radius=addition_13, Caps=0)

# ---- group: Steel Plate (continued)
boundary_2 = BoundarySurfaces(Edges=join_7)
extr_14 = Extrude(Base=boundary_2, Direction=Z_24)
sdiff_3 = SolidDifference(BrepsA=extr_14, BrepsB=move_28.Geometry)
extr_15 = Extrude(Base=srf, Direction=vec2pt_7.Vector)

# ---- group: Holes top plate (continued)
sdiff_4 = SolidDifference(BrepsA=sdiff_3, BrepsB=flatten(pipe_3))

# ----
sdiff_5 = SolidDifference(BrepsA=sdiff_4, BrepsB=flatten(geo_2))

# ---- group: Steel Plate (continued)
merge_5 = Merge(Data1=sdiff_5, Data2=extr_15)
brep_3 = Brep(merge_5)

# ---- group: STEEL PLATE / top plate with holes
geo_3 = Geometry(brep_3)

# ---- group: filament_loading_pt
pt_53 = Point(<point referenced from the Rhino model>)

# ----
python_13 = GhPythonScript(printing_top_extra_layers=printing_top_extra_layers, pt_all=pt_53, pt_top=pt_7)  # -> pt
# ---------- python_13: Python ----------
__author__ = "dfab"
__version__ = "2019.07.24"

if printing_top_extra_layers:
    pt = pt_top
else:
    pt = pt_all
# ---------- end python_13 ----------

# ---- group: filament_loading_pt (continued)
xy_9 = XYPlane(Origin=python_13)
rotate_9 = Rotate(Geometry=xy_9, Angle=degrees(number_slider_13), Plane=xy_9)  # -> Geometry, Transform

# ---- group: Define commands
safe_speed = Slider(25, range=0..300)
# 2
number_slider_27 = Slider(4, range=0..100)
speed = Slider(45, range=0..300)
planes_wcs = Plane(rotate_4.Geometry)
python_14 = PythonScript(planes_WCS=planes_wcs, dfillet=number_slider_27, speed=speed, safe_speed=safe_speed, safe_pt=rotate_9.Geometry)  # -> commands; inputs planes_WCS: list of Plane, speed: Int32, safe_pt: Plane
# ---------- python_14: Python ----------
import imp
from design import generate_commands as gcmds

imp.reload(gcmds)

commands = gcmds.generate_cmds(planes_WCS, dfillet, speed, safe_speed, safe_pt)

print commands[0]
# ---------- end python_14 ----------

# ----
move_filament_loading_pt = BooleanToggle(True)
continue_fabrication = BooleanToggle(True)
# 3
panel_48 = Panel("Send a message")
move_linear_axis = BooleanToggle(True)
save_json = Button()
send_10 = Button()
int_3 = Integer(layers_to_move_linear_axis)
commands = Data(python_14)
send_11 = PythonScript(
    client=client.client,
    send=send_10,
    continue_fabrication=continue_fabrication,
    commands=commands,
    move_filament_loading_pt=move_filament_loading_pt,
    move_linear_axis=move_linear_axis,
    path=py_2,
    points_per_layer=point,
    layers_to_move_linear_axis=int_3,
    save_json=save_json,
    name_json="commands.json")  # -> out, all_batches; inputs continue_fabrication: Int32, commands: list, move_filament_loading_pt: Boolean
# ---------- send_11: Python ----------
import json
import os

from ur_online_control.communication.msg_identifiers import *
from ur_online_control.utilities.lists import flatten_list
from time import sleep


#number of values per command to be formatted 
len_command = len(commands[0])
gh_commands = flatten_list(commands)


#set the desired batch length
commandsPerBatch = 30
batchLen = len_command*commandsPerBatch

numOfCommands = len(gh_commands)/len_command


#to print in gh panel
print len_command, "values each command"
print numOfCommands, "commands." , len(gh_commands), "values"


if move_filament_loading_pt:
    print "Moving to filament loading point"
else:
    print "Skipping filament loading point"

if move_linear_axis:
    print "Moving the linear axis"
else:
    print "Skipping the linear axis"


if send and client:
    client.send(MSG_INT, int(continue_fabrication))
    client.send(MSG_INT, int(move_filament_loading_pt))
    client.send(MSG_INT, int(move_linear_axis))
    client.send(MSG_INT, points_per_layer)
    client.send(MSG_INT, len_command)

data = {}
data['move_filament_loading_pt'] = move_filament_loading_pt
data['move_linear_axis'] = move_linear_axis
data['points_per_layer'] = points_per_layer
data['layers_to_move_linear_axis'] = layers_to_move_linear_axis
data['len_command'] = len_command
data['gh_commands'] = gh_commands


filename = os.path.join(path, name_json)
if save_json:
    with open(filename, 'w') as f:
        json.dump(data, f)
# ---------- end send_11 ----------

lng_5 = ListLength(List=send_11.all_batches)
panel_49 = Panel(send_11.out)
item_21 = ListItem(List=planes_wcs, Index=0, Wrap=True)  # -> Item1, Item
pln_7 = Plane([item_21.Item1, item_21.Item])

# ----
# Visualisation
robot_2 = Data(robot)
pose_joints = Data(pose)
planes_wcs_2 = Plane(pln_7)

# ---- group: Calculate joint positions for path
# Add init joint states
joint_states = Data([-0.1728179112, -1.415058186, 1.813991282, -1.971940356, -1.571654205, -3.308720436])
init_configuration = Slider(0, range=0..7)
py_5 = PythonScript(robot=robot_2, planes_WCS=planes_wcs_2, configuration_idx=init_configuration, init_configuration=joint_states)  # -> configurations; inputs planes_WCS: list, configuration_idx: Int32, init_configuration: list
# ---------- py_5: Python ----------
from compas_ghpython import unload_modules
unload_modules('ur_online_control')
import Rhino.Geometry as rg
from compas.geometry import Frame 
from compas.geometry.xforms import Transformation
from compas_ghpython import xdraw_frame
from ur_online_control.ur.kinematics import calculate_configurations_for_path, format_joint_positions


# TODO this must be optimized! matrix multiplication!
frames_tool0_RCS = []
for plane_WCS in planes_WCS:
    tcp_WCS = Frame(plane_WCS.Origin, plane_WCS.XAxis, plane_WCS.YAxis)
    tcp_RCS = robot.get_frame_in_RCS(tcp_WCS)
    frames_tool0_RCS.append(robot.get_tool0_frame_from_tcp_frame(tcp_RCS))
    

#configurations = calculate_configurations_for_path(frames_tool0_RCS, robot.params, init_configuration)
configurations = calculate_configurations_for_path(frames_tool0_RCS, robot, init_configuration)
print configurations
configurations = configurations[min([configuration_idx, len(configurations) - 1])]

def format(numbers, k=4):
    #numbers = format_joint_positions(numbers)
    return "[" + ", ".join([("%." + str(k) + "f") % n for n in numbers]) + "]"
# ---------- end py_5 ----------
start_4 = Button()
stop_3 = Button()
step = Button()
counter = CountThroughList(L=py_5, start=start_4, stop=stop_3, step=step, step_back=back, reset=reset, interval=50)  # -> item; inputs L: list, start: Boolean, stop: Boolean, step_back: Boolean
# ---------- counter: Python ----------
from scriptcontext import sticky as st
from compas_ghpython import update_component


# store data in component
guid = str(ghenv.Component.InstanceGuid)
counter_key = "counter_" + guid
running_key = "running_" + guid

if counter_key not in st:
    st[counter_key] = 0

if running_key not in st:
    st[running_key] = False

if start:
    st[running_key] = True

if stop:
    st[running_key] = False

if step:
    if st[counter_key] < len(L) - 1:
        st[counter_key] += 1

if step_back:
    if st[counter_key] < len(L) - 1:
        st[counter_key] -= 1

if reset:
    st[counter_key] = 0

if len(L):
    item = L[st[counter_key]]

if st[running_key]:
    if st[counter_key] < len(L) - 1:
        st[counter_key] += 1
        update_component(ghenv, interval)
    else:
        st[counter_key] = 0
        st[running_key] = False
# ---------- end counter ----------

# ---- group: Define plane in WCS, calculate joint positions
pt_54 = Point(Point(-283.8412985, -342.877576, 297.4189147))
select_configuration = Slider(1, range=0..7)
xy_10 = XYPlane(Origin=pt_54)
plane_wcs = Plane(xy_10)
inverse = PythonScript(robot=robot_2, plane_WCS=plane_wcs, idx=select_configuration)  # -> configuration; inputs plane_WCS: Plane, idx: Int32
# ---------- inverse: Python ----------
import Rhino.Geometry as rg
from compas.geometry import Frame, Transformation
from compas_ghpython import xdraw_frame

tcp_WCS = Frame(plane_WCS.Origin, plane_WCS.XAxis, plane_WCS.YAxis)

# transform frame to robot coordinate system
tcp_RCS = robot.get_frame_in_RCS(tcp_WCS)

# get the frame of tool0
tool0_RCS = robot.get_tool0_frame_from_tcp_frame(tcp_RCS)

# calculate solutions to frame
solutions = robot.inverse_kinematics(tool0_RCS)

if not len(solutions):
    q = [0,0,0,0,0,0]
else:
    idx = min(len(solutions) - 1, idx)
    q = solutions[idx]
    
print q

configuration = q
# ---------- end inverse ----------

# ---- group: Calculate joint positions for path / Shows joint positions along path
flip_2 = BooleanToggle(True)
l2t = PythonScript(L=py_5, flip=flip_2)  # -> T; inputs L: list, flip: Boolean
# ---------- l2t: Python ----------
from compas_ghpython import list_to_ghtree
L = [l.joint_values for l in L]

if flip:
    L = zip(*L)
T = list_to_ghtree(L)
# ---------- end l2t ----------
graph_13 = QuickGraph(l2t, SortOrder=0)

# ---- group: Visualise
list_11 = ValueList({"0 forward, from angles": 0, "1 inverse, from one plane": 1, "2 inverse, from multiple planes": 2, "3 forward, from robot": 3}, selected="2 inverse, from multiple planes")
filter_5 = StreamFilter(Gate=list_11, Stream0=py_3, Stream1=inverse, Stream2=counter, Stream3=pose_joints)
configuration = Panel(filter_5)
mesh = Mesh(filter)
draw = PythonScript(robot=robot_2, configuration=filter_5, mesh=mesh, brep=filter, show_brep=show_brep)  # -> meshes, tool0_plane, tcp_plane, robot_brep; inputs mesh: list, brep: list
# ---------- draw: Python ----------
from compas_ghpython import unload_modules
unload_modules("ur_online_control")

from compas_ghpython import xdraw_frame
from compas_ghpython import mesh_draw
from compas_ghpython.geometry.xforms import xform_from_transformation
from compas.geometry import Frame
from compas.geometry.xforms import Transformation
from ur_online_control.ur.robot import BaseConfiguration

import Rhino.Geometry as rg
import Rhino

def mesh_update_vertices(mesh, vertices):
    for i in range(len(vertices)):
        mesh.vertex[i].update({'x': vertices[i][0], 'y': vertices[i][1], 'z': vertices[i][2]})

if configuration:
    #print configuration
    #q = BaseConfiguration.from_joints(configuration)
    q = configuration
    print q
    print q.joint_values
    
    print robot.get_forward_transformations(q)
    R0, R1, R2, R3, R4, R5 = robot.get_forward_transformations(q)
    
    tool0_frame2 = robot.tool0_frame.transformed(R5)
    tcp_frame2 = Frame.from_transformation(Transformation.from_frame(tool0_frame2) * robot.transformation_tool0_tcp)
    
    print robot.transformation_tool0_tcp
    print robot.transformation_tcp_tool0
    print robot.transformation_tool0_tcp * robot.transformation_tcp_tool0
    print tcp_frame2
    tcp_frame2 = Frame.from_transformation(Transformation.from_frame(tool0_frame2) * robot.transformation_tcp_tool0)
    print tcp_frame2
    
    tool0_frame, tcp_frame = robot.get_transformed_tool_frames(R5)
    
    tool0_frame = tool0_frame2
    tcp_frame = tcp_frame2
    
    m0, m1, m2, m3, m4, m5 = mesh
    for i in range(6):
        exec("R%drg = xform_from_transformation(R%d)" % (i, i))
        exec("m%d.Transform(R%drg)" % (i, i))
    meshes = [m0, m1, m2, m3, m4, m5]
    print meshes
    mt = robot.tool.get_transformed_model(Transformation.from_frame(tool0_frame))
    
    if mt:
        meshes.extend(map(mesh_draw, mt))
    
    """
    m0, m1, m2, m3, m4, m5, tool0_frame, tcp_frame = robot.get_transformed_model(q)
    mt = robot.get_transformed_tool_model(tcp_frame)
    
    meshes = []
    meshes.append(mesh_draw(m0))
    meshes.append(mesh_draw(m1))
    meshes.append(mesh_draw(m2))
    meshes.append(mesh_draw(m3))
    meshes.append(mesh_draw(m4))
    meshes.append(mesh_draw(m5))
    if mt:
        meshes.append(mesh_draw(mt))
    
    """
    
    tool0_plane = xdraw_frame(tool0_frame)
    tcp_plane = xdraw_frame(tcp_frame)
    
    if show_brep:
        
        b0, b1, b2, b3, b4, b5 = brep
        
        b0.Transform(R0rg)
        b1.Transform(R1rg)
        b2.Transform(R2rg)
        b3.Transform(R3rg)
        b4.Transform(R4rg)
        b5.Transform(R5rg)
        
        robot_brep = [b0, b1, b2, b3, b4, b5]
# ---------- end draw ----------
tool0_plane = Plane(draw.tool0_plane)
tcp_plane = Plane(draw.tcp_plane)
robot_brep = Brep(draw.robot_brep)
draw_2 = RepresentPlaneAsLines(plane=tcp_plane, size=100)  # -> G, C
# ---------- draw_2: Python ----------
import Rhino.Geometry as rg
from System.Drawing import Color

if plane:

    G = []
    G.append(rg.Line(plane.Origin, size * plane.XAxis))
    G.append(rg.Line(plane.Origin, size * plane.YAxis))
    G.append(rg.Line(plane.Origin, size * plane.ZAxis))
    
    C = []
    C.append(Color.FromArgb(255, 0, 0))
    C.append(Color.FromArgb(0, 255, 0))
    C.append(Color.FromArgb(0, 0, 255))
# ---------- end draw_2 ----------
preview_4 = CustomPreview(Geometry=draw_2.G, Shader=draw_2.C)
preview_5 = CustomPreview(Geometry=draw.meshes, Shader=ColourSwatch(SwatchColor=RGBA(99, 94, 94, 96)))

# ---- group: Send joint position directly to robot
panel_50 = Panel("move cartesian")
idx = Slider(0, range=0..100)
commands_2 = Data(python_14)
item_22 = ListItem(List=commands_2, Index=idx, Wrap=True)
list_12 = ValueList({"send all positions": 0, "send only one position": 1}, selected="send only one position")
filter_6 = StreamFilter(Gate=list_12, Stream0=commands_2, Stream1=item_22)
movel_4 = PythonScript(commands=filter_6, velocity=Slider(100, range=0..100))  # -> script; inputs commands: list
# ---------- movel_4: Python ----------
from scriptcontext import sticky as st

script_lines = []
for cmd in commands:
    #q, a=1.4, v=1.05, t=0, r=0)
    x, y, z, ax, ay, az, speed, radius = cmd
    script_lines.append("movel(p%s, v=%f, r=%f)" % (str([x/1000., y/1000., z/1000, ax, ay, az]), speed/1000., radius/1000.))

robot = st["robot"]
tool_angle_axis = list(robot.tool.tcp_frame.point) + robot.tool.tcp_frame.axis_angle_vector
x, y, z, ax, ay, az = tool_angle_axis

script = "def prog():\n"
script += "\ttextmsg(\">> program start\")\n"
script += "\tset_tcp(p%s)\n" % str([x/1000., y/1000., z/1000, ax, ay, az])
script += "".join(["\t%s\n" % line for line in script_lines])
script += "\ttextmsg(\"<< program end\")\n"
script += "end\n"
script += "prog()\n\n"

print script
# ---------- end movel_4 ----------
send_12 = Button()
send_13 = Send(script=movel_4, send=send_12)
panel_51 = Panel(send_13)

# ---- group: Steel Fins (continued)
move_31 = Move(Geometry=scale.Geometry, Motion=vec2pt_7.Vector)  # -> Geometry, Transform
move_32 = Move(Geometry=scale_2.Geometry, Motion=vec2pt_7.Vector)  # -> Geometry, Transform
move_33 = Move(Geometry=move_32.Geometry, Motion=amp_11)  # -> Geometry, Transform
move_34 = Move(Geometry=move_31.Geometry, Motion=amp_10)  # -> Geometry, Transform
extr_16 = Extrude(Base=move_33.Geometry, Direction=amp_9)
extr_17 = Extrude(Base=move_34.Geometry, Direction=amp_8)

# ---- group: Steel Fins / gap
extr_18 = Extrude(Base=extr_16, Direction=amp_12)

# ---- group: Crown Beams (continued)
sdiff_6 = SolidDifference(BrepsA=cap_13, BrepsB=extr_18)
brep_4 = Brep(sdiff_6)

# ---- group: Steel Fins / Fin
extr_19 = Extrude(Base=extr_17, Direction=amp_13)

# ---- group: Steel Fins (continued)
brep_5 = Brep(extr_19)

# ----
ln_15 = Line(StartPoint=move_26.Geometry, EndPoint=cage_toppt)
cage_vertical = Curve(ln_15)
flip_3 = FlipCurve(Curve=cage_vertical)  # -> Curve, Flag
eval_2 = EvaluateLength(Curve=flip_3.Curve, Length=position_of_small_rebars_distance_from_t, Normalized=False)  # -> Point, Tangent, Parameter
move_35 = Move(Geometry=eval_2.Point, Motion=X_9)  # -> Geometry, Transform
line_5 = LineSDL(Start=eval_2.Point, Direction=X_10, Length=1)
llx = LineLine(Line1=ln_11, Line2=line_5)  # -> ParamA, ParamB, PointA, PointB
move_36 = Move(Geometry=llx.PointA, Motion=X_11)  # -> Geometry, Transform
cull_2 = CullPattern(List=eval_2.Point, CullPattern=[False, True])  # -> graft(List)
cull_3 = CullPattern(List=eval_2.Point, CullPattern=[True, False])  # -> graft(List)
cull_4 = CullPattern(List=move_36.Geometry, CullPattern=[True, False])  # -> graft(List)
cull_5 = CullPattern(List=move_36.Geometry, CullPattern=[False, True])  # -> graft(List)
cull_6 = CullPattern(List=move_35.Geometry, CullPattern=[False, True])  # -> graft(List)
cull_7 = CullPattern(List=move_35.Geometry, CullPattern=[True, False])  # -> graft(List)
move_37 = Move(Geometry=cull_7, Motion=expr("-x", Z_17))  # -> Geometry, Transform
move_38 = Move(Geometry=cull_3, Motion=Z_18)  # -> Geometry, Transform
move_39 = Move(Geometry=move_38.Geometry, Motion=X_14)  # -> Geometry, Transform
pt3 = Point(cull_4)
pt4 = Point(cull_5)
move_40 = Move(Geometry=pt4, Motion=expr("-x", X_13))  # -> Geometry, Transform
move_41 = Move(Geometry=pt3, Motion=expr("-x", X_13))  # -> Geometry, Transform
pt2 = Point(cull_7)
pt1 = Point(move_37.Geometry)
pt5 = Point(cull_2)
pt6 = Point(move_38.Geometry)
move_42 = Move(Geometry=pt6, Motion=X_16)  # -> Geometry, Transform
move_43 = Move(Geometry=pt5, Motion=X_16)  # -> Geometry, Transform
pt7 = Point(move_39.Geometry)
move_44 = Move(Geometry=pt1, Motion=expr("x/2", X_15))  # -> Geometry, Transform
move_45 = Move(Geometry=pt6, Motion=expr("x/2", X_12))  # -> Geometry, Transform
move_46 = Move(Geometry=pt5, Motion=expr("x/2", X_12))  # -> Geometry, Transform
move_47 = Move(Geometry=pt2, Motion=expr("x/2", X_15))  # -> Geometry, Transform
pt1_2 = Point(move_44.Geometry)
pt2_2 = Point(move_47.Geometry)
pt3_2 = Point(move_41.Geometry)
pt4_2 = Point(move_40.Geometry)
pt5_2 = Point(move_43.Geometry)
pt6_2 = Point(move_42.Geometry)
pt7_2 = Point(pt7)
pline_4 = PolyLine(Vertices=[pt1_2, pt2_2, pt3_2, pt4_2, pt5_2, pt6_2, pt7_2], Closed=False)
fillet_6 = Fillet(Curve=flatten(pline_4), Radius=fillet_radius_stirrups)

small_stirrups = Curve(simplify(fillet_6))
large_stirrup = Curve(fillet_2)
cage_vertical_2 = Curve(cage_vertical)

# ---- group: Diagonal bars
pipe_4 = Pipe(Curve=large_stirrup, Radius=expr("x/2", diameter_diagonal), Caps=1)

# ---- group: Vertical bars
pipe_5 = Pipe(Curve=cage_vertical_2, Radius=expr("x/2", diameter_vertical), Caps=1)

# ---- group: Stirrups
pipe_6 = Pipe(Curve=small_stirrups, Radius=expr("x/2", diameter_stirrup), Caps=1)

# ----
geo_4 = Geometry(flatten([cage_vertical_2, large_stirrup, small_stirrups, line_4]))
geo_5 = Geometry(flatten([pipe_5, pipe_4, pipe_6, pipe_2]))
rotate_10 = Rotate(Geometry=graft(geo_4), Angle=degrees(series), Plane=pt_26)  # -> simplify(Geometry), Transform
rotate_11 = Rotate(Geometry=graft(geo_5), Angle=degrees(series), Plane=pt_26)  # -> simplify(Geometry), Transform
unrotated_geomery = Geometry(geo_5)

# ---- group: REBAR / Unrotated cage lines
geo_6 = Geometry(geo_4)

# ---- group: REBAR / Unrotated cage pipes
geo_7 = Geometry(geo_5)

# ----
bang_3 = ExplodeTree(Data=rotate_10.Geometry)
flip_4 = FlipCurve(Curve=bang_3)  # -> Curve, Flag
divdist = DivideDistance(Curve=flip_4.Curve, Distance=distance_between_transversal_stirrups)  # -> Points, Tangents, Parameters
flip_5 = FlipMatrix(Data=divdist.Points)
intcrv = Interpolate(Vertices=flip_5, Degree=3, Periodic=True, KnotStyle=1)  # -> Curve, Length, Domain
offset_10 = OffsetCurve(Curve=flatten(intcrv.Curve), Distance=expr("x/2", addition_8), Plane=PlaneXY(0, 0, 0), Corners=1)
bang_4 = ExplodeTree(Data=offset_10)
pipe_7 = Pipe(Curve=flatten(offset_10), Radius=expr("x/2", diameter_transversal_stirrup), Caps=0)

pt_55 = Point(<point referenced from the Rhino model>)
end_6 = EndPoints(Curve=cage_vertical_2)  # -> Start, End
pt_56 = Point(<point referenced from the Rhino model>)
pt_57 = Point(<point referenced from the Rhino model>)
pt_58 = Point(<point referenced from the Rhino model>)
pt_59 = Point(<point referenced from the Rhino model>)
pt_60 = Point(<point referenced from the Rhino model>)
xy_11 = XYPlane(Origin=pt_55)
xy_12 = XYPlane(Origin=pt_58)
xy_13 = XYPlane(Origin=pt_56)
xy_14 = XYPlane(Origin=pt_57)
xy_15 = XYPlane(Origin=pt_59)
xy_16 = XYPlane(Origin=pt_60)
rotate_12 = Rotate(Geometry=xy_11, Angle=degrees(90), Plane=xy_11)  # -> Geometry, Transform
rotate_13 = Rotate(Geometry=xy_16, Angle=degrees(90), Plane=xy_16)  # -> Geometry, Transform
xz = XZPlane(Origin=pt1_2)
xz_2 = XZPlane(Origin=pt_47)
geo_8 = Geometry(pipe_4)
orient_3 = Orient(Geometry=pline_4, Source=xz, Target=graft([xy_12, xy_13, xy_14]))  # -> Geometry, Transform
pt_61 = Point(<point referenced from the Rhino model>)
orient_4 = Orient(Geometry=[end_6.Start, end_6.End], Source=xz_2, Target=rotate_12.Geometry)  # -> Geometry, Transform
orient_5 = Orient(Geometry=bang_4, Source=pt_26, Target=pt_61)  # -> Geometry, Transform
disc_3 = Discontinuity(Curve=orient_3.Geometry, Level=1)  # -> Points, Parameters
orient_6 = Orient(Geometry=[pt_47, pt_48, pt_50, pt_49, pt_51], Source=xz_2, Target=rotate_13.Geometry)  # -> Geometry, Transform
curvepoint_13 = PointOnCurve(orient_5.Geometry, parameter=0.5)
end_7 = EndPoints(Curve=orient_5.Geometry)  # -> Start, End
item_23 = ListItem(List=orient_6.Geometry, Index=0, Wrap=True)  # -> Item, Item1, Item2, Item3, Item4
item_24 = ListItem(List=orient_4.Geometry, Index=0, Wrap=True)  # -> Item, Item1
item_25 = ListItem(List=disc_3.Points, Index=0, Wrap=True)  # -> Item, Item1, Item2, Item3, Item4, Item5, Item6
pt_62 = Point(item_25.Item)
pt_63 = Point(item_25.Item1)
len_3 = Length(Curve=orient_5.Geometry)
xy_17 = XYPlane(Origin=Point(0, 0, 0))
panel_52 = Panel(len_3)
ln_16 = Line(StartPoint=item_24.Item, EndPoint=item_24.Item1)
pline_5 = PolyLine(
    Vertices=[item_25.Item, item_25.Item1, item_25.Item2, item_25.Item3, item_25.Item4, item_25.Item5, item_25.Item6],
    Closed=False)
fillet_7 = Fillet(Curve=flatten(pline_5), Radius=fillet_radius_stirrups)
len_4 = Length(Curve=fillet_7)
panel_53 = Panel(len_4)
number_slider_28 = Slider(5, range=0..100)
pipe_8 = Pipe(Curve=ln_16, Radius=expr("x/2", diameter_vertical), Caps=0)
orient_7 = Orient(Geometry=geo_8, Source=xz_2, Target=rotate_13.Geometry)  # -> Geometry, Transform
pipe_9 = Pipe(Curve=fillet_7, Radius=expr("x/2", diameter_stirrup), Caps=0)
pipe_10 = Pipe(Curve=flatten(orient_5.Geometry), Radius=expr("x/2", diameter_transversal_stirrup), Caps=0)
number_slider_29 = Slider(35, range=0..100)

# ---- group: GEOMETRY
geo_9 = Geometry([rotate_11.Geometry, pipe_7])

# ---- group: REBAR / Full cage pipes
rotate_14 = Rotate(Geometry=geo_9, Angle=degrees(number_slider_9), Plane=pt_26)  # -> Geometry, Transform
geo_10 = Geometry(rotate_14.Geometry)

# ---- group: CURVES
crv_35 = Curve([rotate_10.Geometry, offset_10])

# ---- group: REBAR / Full cage lines
rotate_15 = Rotate(Geometry=crv_35, Angle=degrees(number_slider_9), Plane=pt_26)  # -> Geometry, Transform
geo_11 = Geometry(rotate_15.Geometry)

# ----
geo_12 = Geometry([pipe_8, pipe_10, orient_7.Geometry, pipe_9])

aligndim = AlignedDimension(Plane=xy_17, PointA=item_24.Item, PointB=item_24.Item1, Offset=number_slider_29, Text="{0:0.00}", Size=number_slider_28)
aligndim_2 = AlignedDimension(Plane=xy_17, PointA=item_25.Item, PointB=item_25.Item1, Offset=number_slider_29, Text="{0:0.00}", Size=number_slider_28)
aligndim_3 = AlignedDimension(Plane=xy_17, PointA=item_23.Item, PointB=item_23.Item1, Offset=number_slider_29, Text="{0:0.00}", Size=number_slider_28)
aligndim_4 = AlignedDimension(Plane=xy_17, PointA=item_25.Item1, PointB=item_25.Item2, Offset=number_slider_29, Text="{0:0.00}", Size=number_slider_28)
aligndim_5 = AlignedDimension(Plane=xy_17, PointA=item_23.Item1, PointB=item_23.Item2, Offset=number_slider_29, Text="{0:0.00}", Size=number_slider_28)
aligndim_6 = AlignedDimension(Plane=xy_17, PointA=item_25.Item2, PointB=item_25.Item3, Offset=number_slider_29, Text="{0:0.00}", Size=number_slider_28)
aligndim_7 = AlignedDimension(Plane=xy_17, PointA=item_23.Item2, PointB=item_23.Item3, Offset=number_slider_29, Text="{0:0.00}", Size=number_slider_28)
aligndim_8 = AlignedDimension(Plane=xy_17, PointA=item_25.Item3, PointB=item_25.Item4, Offset=number_slider_29, Text="{0:0.00}", Size=number_slider_28)
aligndim_9 = AlignedDimension(Plane=xy_17, PointA=item_23.Item3, PointB=item_23.Item4, Offset=number_slider_29, Text="{0:0.00}", Size=number_slider_28)
aligndim_10 = AlignedDimension(
    Plane=xy_17,
    PointA=end_7.Start,
    PointB=curvepoint_13,
    Offset=Slider(165, range=0..1000),
    Text="{0:0.00}",
    Size=number_slider_28)
aligndim_11 = AlignedDimension(Plane=xy_17, PointA=item_25.Item4, PointB=item_25.Item5, Offset=number_slider_29, Text="{0:0.00}", Size=number_slider_28)
aligndim_12 = AlignedDimension(Plane=xy_17, PointA=item_25.Item5, PointB=item_25.Item6, Offset=number_slider_29, Text="{0:0.00}", Size=number_slider_28)
angledim = AngularDimension(Center=item_23.Item2, PointA=item_23.Item1, PointB=item_23.Item3, Reflex=False, Text="{0:0.0}°", Size=number_slider_28)
angledim_2 = AngularDimension(Center=item_23.Item3, PointA=item_23.Item2, PointB=item_23.Item4, Reflex=False, Text="{0:0.0}°", Size=number_slider_28)
angledim_3 = AngularDimension(Center=item_25.Item3, PointA=item_25.Item2, PointB=item_25.Item4, Reflex=False, Text="{0:0.0}°", Size=number_slider_28)

# ---- group: vert bars
rotate_16 = Rotate(Geometry=graft(cage_vertical_2), Angle=degrees(series), Plane=pt_26)  # -> simplify(Geometry), Transform
rotate_17 = Rotate(Geometry=rotate_16.Geometry, Angle=degrees(number_slider_9), Plane=pt_26)  # -> Geometry, Transform

# ---- group: Extra tolerance holes in bottom plate for vertical staves (continued)
pipe_11 = Pipe(Curve=rotate_17.Geometry, Radius=expr("x/2", addition_3), Caps=0)
move_48 = Move(Geometry=flatten(pipe_11), Motion="0,0,-100")  # -> Geometry, Transform

# ----
sdiff_7 = SolidDifference(BrepsA=sdiff_2, BrepsB=move_48.Geometry)

# ---- group: BOTTOM_PLATE (continued)
geo_13 = Geometry([cap_12, sdiff_7])

# ---- group: diagonals
rotate_18 = Rotate(Geometry=graft(large_stirrup), Angle=degrees(series), Plane=pt_26)  # -> simplify(Geometry), Transform
rotate_19 = Rotate(Geometry=rotate_18.Geometry, Angle=degrees(number_slider_9), Plane=pt_26)  # -> Geometry, Transform

# ---- group: REBAR DISTANCE / diag
crv_36 = Curve(rotate_19.Geometry)

# ---- group: stirrups
rotate_20 = Rotate(Geometry=graft(small_stirrups), Angle=degrees(series), Plane=pt_26)  # -> simplify(Geometry), Transform
rotate_21 = Rotate(Geometry=rotate_20.Geometry, Angle=degrees(number_slider_9), Plane=pt_26)  # -> Geometry, Transform

# ---- group: REBAR DISTANCE / stirrups
crv_37 = Curve(rotate_21.Geometry)

# ---- group: REBAR DISTANCE (continued)
divdist_2 = DivideDistance(Curve=crv_37, Distance=resolution_of_calculation)  # -> flatten(Points), Tangents, Parameters
divdist_3 = DivideDistance(Curve=crv_36, Distance=resolution_of_calculation)  # -> flatten(Points), Tangents, Parameters
brep_cp = BrepClosestPoint(Point=divdist_3.Points, Brep=loft)  # -> Point, Normal, Distance
brep_cp_2 = BrepClosestPoint(Point=divdist_2.Points, Brep=loft)  # -> Point, Normal, Distance
ln_17 = Line(StartPoint=divdist_3.Points, EndPoint=brep_cp.Point)
ln_18 = Line(StartPoint=divdist_2.Points, EndPoint=brep_cp_2.Point)
len_5 = Length(Curve=ln_17)
len_6 = Length(Curve=ln_18)
subtraction_19 = Subtraction(A=len_5, B="7")
subtraction_20 = Subtraction(A=len_6, B="5")
python_15 = GhPythonScript(threshold=distance_threshold_surface_rebar, adjusted_length=subtraction_19)  # -> out, colour_list; inputs adjusted_length: list
# ---------- python_15: Python ----------
__author__ = "Joris"
__version__ = "2019.03.11"

import rhinoscriptsyntax as rs

colour_list =[]

for i in adjusted_length:
    if i < threshold:
        red = 255
        green = 0
        blue = 0
    else:
        red = 0
        green = 255
        blue = 0
    colour = rs.CreateColor(red, green, blue)
    colour_list.append(colour)
# ---------- end python_15 ----------
python_16 = GhPythonScript(threshold=distance_threshold_surface_rebar, adjusted_length=subtraction_20)  # -> out, colour_list; inputs adjusted_length: list; same code as python_15
preview_6 = CustomPreview(Geometry=ln_17, Material=python_15.colour_list)
preview_7 = CustomPreview(Geometry=ln_18, Material=python_16.colour_list)

# ----
rebar_radius = Slider(7, range=0..10)
rebar_radius_2 = Slider(5, range=0..10)
concrete_cover = Slider(30, range=0..40)
tolerance = Slider(5, range=0..10)
rebar_radius_3 = Slider(9, range=0..10)
addition_14 = Addition(A=rebar_radius_3, B=tolerance, C=concrete_cover)
addition_15 = Addition(A=rebar_radius, B=tolerance, C=concrete_cover)
addition_16 = Addition(A=rebar_radius_2, B=tolerance, C=concrete_cover)
pipe_12 = Pipe(Curve=rotate_17.Geometry, Radius=addition_14, Caps=0)
pipe_13 = Pipe(Curve=rotate_19.Geometry, Radius=addition_15, Caps=0)
pipe_14 = Pipe(Curve=[rotate_21.Geometry, offset_10], Radius=addition_16, Caps=0)

pipe_15 = Pipe(Curve=rotate_17.Geometry, Radius=addition_14, Caps=0)

# ---- group: screws
debrep_3 = DeconstructBrep(Brep=extr_17)  # -> Faces, Edges, Vertices
debrep_4 = DeconstructBrep(Brep=brep_5)  # -> Faces, Edges, Vertices
item_26 = ListItem(List=debrep_3.Vertices, Index=0, Wrap=True)  # -> Item, Item1, Item2
item_27 = ListItem(List=debrep_4.Edges, Index=0, Wrap=True)  # -> Item2, Item1, Item
vec2pt_9 = Vector2Pt(PointA=item_26.Item2, PointB=item_26.Item1, Unitize=False)  # -> Vector, Length
amp_14 = Amplitude(Vector=vec2pt_9.Vector, Amplitude="12")
vec2pt_10 = Vector2Pt(PointA=item_26.Item, PointB=item_26.Item1, Unitize=False)  # -> Vector, Length
amp_15 = Amplitude(Vector=vec2pt_9.Vector, Amplitude="24")
move_49 = Move(Geometry=item_27.Item2, Motion=amp_14)  # -> Geometry, Transform
amp_16 = Amplitude(Vector=vec2pt_9.Vector, Amplitude="24")
move_50 = Move(Geometry=move_49.Geometry, Motion=amp_15)  # -> Geometry, Transform
amp_17 = Amplitude(Vector=vec2pt_9.Vector, Amplitude="24")
move_51 = Move(Geometry=move_50.Geometry, Motion=amp_16)  # -> Geometry, Transform
amp_18 = Amplitude(Vector=vec2pt_9.Vector, Amplitude="24")
move_52 = Move(Geometry=move_51.Geometry, Motion=amp_17)  # -> Geometry, Transform
move_53 = Move(Geometry=move_52.Geometry, Motion=amp_18)  # -> Geometry, Transform
amp_19 = Amplitude(Vector=vec2pt_10.Vector, Amplitude="20")  # -> flatten(Vector)
amp_20 = Amplitude(Vector=vec2pt_10.Vector, Amplitude="56")  # -> flatten(Vector)
amp_21 = Amplitude(Vector=vec2pt_10.Vector, Amplitude="56")  # -> flatten(Vector)

# ----
entwine = Entwine(
    Branch00=move_49.Geometry,
    Branch01=move_50.Geometry,
    Branch02=move_51.Geometry,
    Branch03=move_52.Geometry,
    Branch04=move_53.Geometry,
    FlattenInputs=True)

# ---- group: screws (continued)
move_54 = Move(Geometry=entwine, Motion=amp_19)  # -> Geometry, Transform
move_55 = Move(Geometry=move_54.Geometry, Motion=amp_20)  # -> Geometry, Transform
move_56 = Move(Geometry=move_55.Geometry, Motion=amp_21)  # -> Geometry, Transform
curvepoint_14 = PointOnCurve([move_54.Geometry, move_55.Geometry, move_56.Geometry], parameter=0.5)
scale_3 = Scale(Geometry=[move_54.Geometry, move_55.Geometry, move_56.Geometry], Center=curvepoint_14, Factor=Slider(10, range=0..10))  # -> Geometry, Transform
pipe_16 = Pipe(Curve=scale_3.Geometry, Radius="4", Caps=1)

# ----
pshift_2 = ShiftPaths(Data=pipe_16, Offset=-1)
flip_6 = FlipMatrix(Data=pshift_2)
bang_5 = ExplodeTree(Data=flip_6)  # -> Branch0, Branch1, Branch2, Branch3, Branch4, Branch5, Branch6, Branch7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
brep_6 = Brep(bang_5.Branch16)
brep_7 = Brep(bang_5.Branch17)
brep_8 = Brep(bang_5.Branch18)
brep_9 = Brep(bang_5.Branch20)
brep_10 = Brep(bang_5.Branch21)
brep_11 = Brep(bang_5.Branch19)
brep_12 = Brep(bang_5.Branch22)
brep_13 = Brep(bang_5.Branch23)
brep_14 = Brep(bang_5.Branch8)
brep_15 = Brep(bang_5.Branch9)
brep_16 = Brep(bang_5.Branch10)
brep_17 = Brep(bang_5.Branch11)
brep_18 = Brep(bang_5.Branch12)
brep_19 = Brep(bang_5.Branch13)
brep_20 = Brep(bang_5.Branch14)
brep_21 = Brep(bang_5.Branch15)
brep_22 = Brep(bang_5.Branch0)
brep_23 = Brep(bang_5.Branch1)
brep_24 = Brep(bang_5.Branch2)
brep_25 = Brep(bang_5.Branch3)
brep_26 = Brep(bang_5.Branch4)
brep_27 = Brep(bang_5.Branch5)
brep_28 = Brep(bang_5.Branch6)
brep_29 = Brep(bang_5.Branch7)
brep_30 = Brep(simplify(flatten([brep_22, brep_6, brep_14])))
brep_31 = Brep(simplify(flatten([brep_23, brep_7, brep_15])))
brep_32 = Brep(simplify(flatten([brep_24, brep_8, brep_16])))
brep_33 = Brep(simplify(flatten([brep_25, brep_11, brep_17])))
brep_34 = Brep(simplify(flatten([brep_26, brep_9, brep_18])))
brep_35 = Brep(simplify(flatten([brep_27, brep_10, brep_19])))
brep_36 = Brep(simplify(flatten([brep_28, brep_12, brep_20])))
brep_37 = Brep(simplify(flatten([brep_29, brep_13, brep_21])))

# ---- group: STEEL PLATE / crown beam with screws
sdiff_8 = SolidDifference(BrepsA=brep_4, BrepsB=[brep_30, brep_31, brep_32, brep_33, brep_34, brep_35, brep_36, brep_37])

# ---- group: STEEL PLATE / fins with screws
sdiff_9 = SolidDifference(BrepsA=brep_5, BrepsB=[brep_30, brep_31, brep_32, brep_33, brep_34, brep_35, brep_36, brep_37])

# ---- group: Send joint position directly to robot
idx_2 = Slider(0, range=0..100)
panel_54 = Panel("move joints")
joint_positions = Data(py_5)
list_13 = ValueList({"send all positions": 0, "send only one position": 1}, selected="send only one position")
item_28 = ListItem(List=joint_positions, Index=idx_2, Wrap=True)
filter_7 = StreamFilter(Gate=list_13, Stream0=joint_positions, Stream1=item_28)
movej = PythonScript(joint_positions=filter_7, velocity=Slider(153, range=0..200))  # -> script; inputs joint_positions: list
# ---------- movej: Python ----------
script_lines = []

for position in joint_positions:
    script_lines.append("movej(%s, v=%f)" % (str(position), velocity/1000.))


script = "def prog():\n"
script += "\ttextmsg(\">> program start\")\n"
script += "".join(["\t%s\n" % line for line in script_lines])
script += "\ttextmsg(\"<< program end\")\n"
script += "end\n"
script += "prog()\n\n"


print script

#script = ""
# ---------- end movej ----------
send_14 = Button()

# ----
send_15 = Send(script=movej, send=send_14)

# ---- group: Send joint position directly to robot (continued)
panel_55 = Panel(send_15)

# ==== cluster Tools
brep = Brep([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])
tool_id = ClusterInput()

# ---- group: extruder
yaxis_line = Curve(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)
xaxis_line = Curve(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)
test_geometry = Geometry(brep)
brep_2 = Brep(test_geometry)
mesh = Mesh(test_geometry)
tool = Tool(meshes=mesh, breps=brep_2, xline=xaxis_line, yline=yaxis_line)

# ---- group: measurement tool
measurement_tool_geo = Geometry([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])
mesh_2 = Mesh(measurement_tool_geo)
mjoin = MeshJoin(Meshes=mesh_2)
tool_2 = PythonScript(meshes=mjoin, brep=measurement_tool_geo)  # -> tool; inputs meshes: list, brep: list
# ---------- tool_2: Python ----------
from ur_online_control.ur.tools import MeasurementTool
from compas.datastructures import Mesh
from compas_rhino.helpers import mesh_from_guid


tool = MeasurementTool()
tool.model = [mesh_from_guid(Mesh, mesh) for mesh in meshes]
#tool.model_xyz = tool.model.xyz
tool.brep = brep
# ---------- end tool_2 ----------

# ----
tool_id_2 = Integer(tool_id)
filter = StreamFilter(Gate=tool_id_2, Stream1=tool_2, Stream2=tool)
py = PythonScript(tool=filter)  # -> tcp_frame, model
# ---------- py: Python ----------
from compas_ghpython import mesh_draw 

tcp_frame = tool.tcp_frame
model = map(mesh_draw, tool.model)
# ---------- end py ----------
tool_3 = Data(filter)
draw = PythonScript(frame=py.tcp_frame)  # -> G, C
# ---------- draw: Python ----------
import Rhino.Geometry as rg
from System.Drawing import Color

if not size:
    size = 100

if frame:
    plane = rg.Plane(rg.Point3d(*list(frame.point)), rg.Vector3d(*list(frame.xaxis)), rg.Vector3d(*list(frame.yaxis)))

    G = []
    G.append(rg.Line(plane.Origin, size * plane.XAxis))
    G.append(rg.Line(plane.Origin, size * plane.YAxis))
    G.append(rg.Line(plane.Origin, size * plane.ZAxis))
    
    C = []
    C.append(Color.FromArgb(255, 0, 0))
    C.append(Color.FromArgb(0, 255, 0))
    C.append(Color.FromArgb(0, 0, 255))
# ---------- end draw ----------
tool_4 = ClusterOutput(tool_3)
preview = CustomPreview(Geometry=draw.G, Shader=draw.C)
preview_2 = CustomPreview(Geometry=py.model, Shader=ColourSwatch(SwatchColor=RGB(141, 170, 178)))

# ==== cluster Send
script = ClusterInput()
send = ClusterInput()
send_2 = PythonScript(script=script, send=send)  # -> out
# ---------- send_2: Python ----------
import socket
from scriptcontext import sticky as st

ur_ip = st["ur_ip"]
ur_port = 30002

if send:
    s = socket.create_connection((ur_ip, ur_port), timeout=0.5) 
    s.send(script)
    s.close()
# ---------- end send_2 ----------
out = ClusterOutput(send_2)

# ==== cluster Tools_2

# ---- group: spray_gun
brep = Brep([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])
yaxis_line = Curve(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)
xaxis_line = Curve(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)
test_geometry = Geometry(brep)
mesh = Mesh(test_geometry)
brep_2 = Brep(test_geometry)
tool = Tool_2(meshes=mesh, breps=brep_2, xline=xaxis_line, yline=yaxis_line)

# ----
brep_3 = Brep([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])
tool_id = ClusterInput()
yaxis_line_2 = Curve(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)
xaxis_line_2 = Curve(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)

# ---- group: extruder
test_geometry_2 = Geometry(brep_3)
mesh_2 = Mesh(test_geometry_2)
brep_4 = Brep(test_geometry_2)
tool_2 = Tool_2(meshes=mesh_2, breps=brep_4, xline=xaxis_line_2, yline=yaxis_line_2)

# ----
tool_id_2 = Integer(tool_id)
tool_3 = PythonScript()  # -> tool
# ---------- tool_3: Python ----------
from compas_fab.fab.geometry import Frame
from compas_fab.fab.robots import Tool
import Rhino.Geometry as rg
import math

startPlane = rg.Plane.WorldXY
startPlane2 = rg.Plane.WorldXY
rg.Plane.Rotate(startPlane2, math.radians(180), rg.Vector3d.XAxis, rg.Point3d(0.0, 0.0, 0.0))

xform = rg.Transform.ChangeBasis(startPlane, startPlane2)

print startPlane
print startPlane2
Frame([0,0,0],[1,0,0],[0,-1,0])
#tcp_frame = Frame.worldXY()
tcp_frame = Frame([0,0,0],[1,0,0],[0,-1,0])

tool = Tool(tcp_frame)
tool.model = []
tool.breps = []
# ---------- end tool_3 ----------
filter = StreamFilter(Gate=tool_id_2, Stream0=tool_3, Stream1=tool, Stream2=tool_2)
py = PythonScript(tool=filter)  # -> tcp_frame, model
# ---------- py: Python ----------
tcp_frame = tool.tcp_frame
model = tool.model
# ---------- end py ----------
draw = PythonScript(frame=py.tcp_frame)  # -> G, C
# ---------- draw: Python ----------
import Rhino.Geometry as rg
from System.Drawing import Color

if not size:
    size = 100

if frame:
    
    plane = rg.Plane(rg.Point3d(*frame.point), rg.Vector3d(*frame.xaxis), rg.Vector3d(*frame.yaxis))

    G = []
    G.append(rg.Line(plane.Origin, size * plane.XAxis))
    G.append(rg.Line(plane.Origin, size * plane.YAxis))
    G.append(rg.Line(plane.Origin, size * plane.ZAxis))
    
    C = []
    C.append(Color.FromArgb(255, 0, 0))
    C.append(Color.FromArgb(0, 255, 0))
    C.append(Color.FromArgb(0, 0, 255))
# ---------- end draw ----------
tool_4 = Data(filter)
tool_5 = ClusterOutput(tool_4)
preview = CustomPreview(Geometry=draw.G, Shader=draw.C)
preview_2 = CustomPreview(Geometry=py.model, Shader=ColourSwatch(SwatchColor=RGB(141, 170, 178)))

# ==== cluster SortOnZ
A = ClusterInput()
curvepoint = PointOnCurve(A, parameter=0)
pdecon = Deconstruct(Point=curvepoint)  # -> XComponent, YComponent, ZComponent
sort = SortList(Keys=pdecon.ZComponent, ValuesA=A)  # -> Keys, ValuesA
A_2 = ClusterOutput(sort.ValuesA)

# ==== cluster Tool
breps = ClusterInput()
meshes = ClusterInput()
meshes_2 = Mesh(meshes)
mjoin = MeshJoin(Meshes=meshes_2)
xline = ClusterInput()
yline = ClusterInput()
tool = PythonScript(meshes=mjoin, breps=breps, xline=xline, yline=yline)  # -> tool; inputs meshes: list of Mesh, breps: list of Brep
# ---------- tool: Python ----------
import Rhino.Geometry as rg
from compas.geometry import Frame
from ur_online_control.ur.tool import Tool
from compas.datastructures import Mesh
from compas_rhino.helpers import mesh_from_guid

xaxis = rg.Line(xline.PointAtStart, xline.PointAtEnd)
yaxis = rg.Line(yline.PointAtStart, yline.PointAtEnd)

if xaxis.From.DistanceTo(yaxis.From) < 0.01:
    origin = xaxis.From
    xaxis = xaxis.Direction
    yaxis = yaxis.Direction
elif xaxis.To.DistanceTo(yaxis.To) < 0.01:
    origin = xaxis.To
    xaxis = -xaxis.Direction
    yaxis = -yaxis.Direction
elif xaxis.From.DistanceTo(yaxis.To) < 0.01:
    origin = xaxis.From
    xaxis = xaxis.Direction
    yaxis = -yaxis.Direction
elif xaxis.To.DistanceTo(yaxis.From) < 0.01:
    origin = xaxis.To
    xaxis = -xaxis.Direction
    yaxis = yaxis.Direction

xaxis.Unitize()
yaxis.Unitize()

print origin
print xaxis
print yaxis

tcp_frame = Frame(origin, xaxis, yaxis)

tool = Tool(tcp_frame)
tool.model = [mesh_from_guid(Mesh, mesh) for mesh in meshes]
#tool.model_xyz = tool.model.xyz
tool.breps = breps
# ---------- end tool ----------
tool_2 = ClusterOutput(tool)

# ==== cluster Tool_2
breps = ClusterInput()
meshes = ClusterInput()
meshes_2 = Mesh(meshes)
mjoin = MeshJoin(Meshes=meshes_2)
xline = ClusterInput()
yline = ClusterInput()
tool = PythonScript(meshes=mjoin, breps=breps, xline=xline, yline=yline)  # -> tool; inputs meshes: list of Mesh, breps: list of Brep
# ---------- tool: Python ----------
import Rhino.Geometry as rg
from compas_fab.fab.geometry import Frame
from compas_fab.fab.robots import Tool
from compas.datastructures.mesh import Mesh

xaxis = rg.Line(xline.PointAtStart, xline.PointAtEnd)
yaxis = rg.Line(yline.PointAtStart, yline.PointAtEnd)

if xaxis.From.DistanceTo(yaxis.From) < 0.01:
    origin = xaxis.From
    xaxis = xaxis.Direction
    yaxis = yaxis.Direction
elif xaxis.To.DistanceTo(yaxis.To) < 0.01:
    origin = xaxis.To
    xaxis = -xaxis.Direction
    yaxis = -yaxis.Direction
elif xaxis.From.DistanceTo(yaxis.To) < 0.01:
    origin = xaxis.From
    xaxis = xaxis.Direction
    yaxis = -yaxis.Direction
elif xaxis.To.DistanceTo(yaxis.From) < 0.01:
    origin = xaxis.To
    xaxis = -xaxis.Direction
    yaxis = yaxis.Direction

xaxis.Unitize()
yaxis.Unitize()

print origin
print xaxis
print yaxis

tcp_frame = Frame(origin, xaxis, yaxis)

tool = Tool(tcp_frame)
tool.model = meshes
tool.breps = breps
# ---------- end tool ----------
tool_2 = ClusterOutput(tool)
