# Grasshopper definition 190815_linear_axis_setup_json_FOLDED_JB.gh (Grasshopper 1.0.7)

# ---- group: BOTTOM OF COLUMN
pt = Point(<point referenced from the Rhino model>)

# ---- group: Threaded rods top
length_of_threaded_rod = Slider(600, range=0..1000)
diameter_threaded_rod_top = Slider(14, range=0..100)
threaded_rod_depth_into_column = Slider(400, range=0..500)

# ----
position_of_small_rebars_distance_from_t = Panel("""80
180
240
340
400
500""")  # "Position of small rebars (distance from top)"
distance_between_transversal_stirrups = Slider(200, range=0..1000)

x_radius_cage = Slider(100, range=0..1000)
x_stirrup_distance_from_top = Slider(350, range=0..2000)
z_middle_height_stirrup = Slider(1450, range=0..2000)
z_height_cage = Slider(2050, range=0..2500)

extension_bottom_large_stirrup = Slider(-400, range=-500..0)
extension_top_large_stirrup = Slider(70, range=0..1000)

# ---- group: Fillet radii
fillet_radius_large_stirrup_vertical = Slider(20, range=0..100)
fillet_radius_large_stirrup_diagonal = Slider(20, range=0..150)
fillet_radius_large_stirrup_middle_secti = Slider(0, range=0..500)  # "Fillet radius large stirrup middle section"
fillet_radius_stirrups = Slider(20, range=0..1000)

# ----
amount_of_bars = Slider(8, range=0..30)

# ---- group: Bar diameter
diameter_vertical = Slider(20, range=0..30)
diameter_diagonal = Slider(14, range=0..30)
diameter_stirrup = Slider(10, range=0..30)
diameter_transversal_stirrup = Slider(10, range=0..30)

# ----
offset_for_stirrup_diagonal_intersection = Slider(0, range=0..100)
offset_for_stirrup_vertical_intersection = Slider(14, range=0..100)

# ---- group: Div point offset
dom = ConstructDomain(DomainStart=Slider(2.5, range=0..30), DomainEnd=Slider(12.5, range=0..30))

# ---- group: Generate profile curve
python = GhPythonScript(length=Slider(350, range=0..1000), width=Slider(50, range=0..1000))  # -> out, polyline, lines; inputs length: Int32, width: Int32
# ---------- python: Python ----------
__author__ = "joburger"
__version__ = "2019.08.12"

def flatten_list(array):
    return [item for sublist in array for item in sublist]

import Rhino.Geometry as rg

pt0 = rg.Point3d(0,0,0)
pt1 = rg.Point3d(0, length, 0)
pt2 = rg.Point3d(width, length, 0)
pt3 = rg.Point3d(width, width, 0)
pt4 = rg.Point3d(length, width, 0)
pt5 = rg.Point3d(length, 0, 0)

pts = []
pts.extend([pt0, pt1, pt2, pt3, pt4, pt5, pt0])

crvA = rg.Line(pt0, pt1)
crvB = rg.Line(pt2, pt3)
crvC = rg.Line(pt3, pt4)
crvD = rg.Line(pt5, pt0)

lines = []
lines.extend([crvA, crvB, crvC, crvD])

polyline = rg.PolylineCurve(pts)
# ---------- end python ----------

# ---- group: Pattern height and reduction
pattern_height_reduction_mm = Slider(3, range=0..10)
pattern_height_bottom_mm = Slider(100, range=0..1000)

# ---- group: offset_pattern_sides
dom_2 = ConstructDomain(DomainStart=Slider(0.8, range=0..1), DomainEnd=Slider(1, range=0..1))

# ---- group: height_reduction_factor
dom_3 = ConstructDomain(DomainStart=Slider(0.8, range=0..1), DomainEnd=Slider(1, range=0..1))

# ---- group: Create pattern and extrusion
div_pt_count = Slider(4, range=0..100)
layer_count = Slider(1000, range=0..1000)
layer_height = Slider(1, range=0..10)

# ---- group: distance_offset
dom_4 = ConstructDomain(DomainStart=Slider(0.8, range=0..1), DomainEnd=Slider(1, range=0..1))

# ---- group: orient_pt
pt_2 = Point(<point referenced from the Rhino model>)

# ----
layer_count_2 = Number(layer_count)

# ---- group: Robot
# 0a
# Settings
# Check your IP address and set UR IP address
server_address = ValueList({"192.168.10.2", "192.168.10.11", "127.0.0.1"}, selected="192.168.10.2")
ur_ip = ValueList({"192.168.10.13", "192.168.10.11", "192.168.10.10", "127.0.0.1"}, selected="192.168.10.13")
server_port = Integer(30003)
globals = PythonScript(server_address=server_address, server_port=server_port, ur_ip=ur_ip)  # inputs server_port: Int32; disabled
# ---------- globals: Python ----------
from scriptcontext import sticky as st

st["server_address"] = server_address
st["server_port"] = server_port

st["ur_ip"] = ur_ip
# ---------- end globals ----------

# Check if UR is available
ping = Button()
py = PythonScript(ip=ur_ip, ping=ping)  # -> out; disabled
# ---------- py: Python ----------
from scriptcontext import sticky as st
from ur_online_control.communication import is_available


guid = str(ghenv.Component.InstanceGuid)
txt_key = "txt_" + guid
if txt_key not in st:
    st[txt_key] = ""

if ping:
    
    available = is_available(ip)
    
    if available:
        st[txt_key] = "%s is up!" % ip
    else:
        st[txt_key] = "%s is down!" % ip

print st[txt_key]
# ---------- end py ----------
panel = Panel(py)

# ---- group: height_reduction_factor
layer_count_3 = Number(layer_count)
range = Range(Domain=Domain(0, 1), Steps=expr("x-1", layer_count_3))
graph = GraphMapper(range, x0=0, x1=1, y0=0, y1=1, Ox=0.5051235557, Oy=0.5507389307, Px=1, Py=0.1906216741, container_name="Parabola")
data = Data(graph)
bnd = Bounds(Numbers=data)
remap = RemapNumbers(Value=data, Source=bnd, Target=dom_3)  # -> Mapped, Clipped

# ----
python_2 = GhPythonScript(pattern_height_bottom=pattern_height_bottom_mm, pattern_height_reduction=pattern_height_reduction_mm)  # -> out, value_list; inputs pattern_height_bottom: Int32
# ---------- python_2: Python ----------
__author__ = "Joris"
__version__ = "2019.06.12"

import math

# PARAMETERS
amount_of_layers = 2110
threshold = 0
max_value = 2

# CONSTANTS
begin_value = pattern_height_bottom / 2
reduce = pattern_height_reduction / 2
sum = 0
count = 0
pattern_number_list = []
value_list = []

# NUMBER GENERATION
for i in range(200):
    if sum*2 > amount_of_layers + threshold:
        print "value above amount of layers"
        break
    if begin_value < reduce:
        print "value below zero"
        break
    pattern_number_list.append(begin_value)
    begin_value = begin_value - reduce
    sum += begin_value 
    count += 1

print "Amount of pattern repetitions", count
print "Sum of values", sum*2
#print pattern_number_list

for i in range(count):
    # calculate amount of steps based on i
    step_amount = pattern_number_list[i]
    print "Height of one pattern repetition", step_amount*2, "mm"
    print i+1
    # calculate step size
    step_size = max_value / step_amount
    for j in range(int(2/step_size*2)):
        if step_size*j < 2:
            value = j * step_size
        else:
            value = max_value*2 - j*step_size
        value_list.append(value)
# ---------- end python_2 ----------
lng = ListLength(List=python_2.value_list)
split = SplitList(List=python_2.value_list, Index=layer_count_2)  # -> ListA, ListB
data_2 = Data(split.ListA)

number_slider = Slider(500, range=0..1000)
move_to_pos = Button()
get_pos = Button()
# Disconnect planes_wcs input after moving axis!
# [to make sure robot base is updated within gh]
close = Button()
pos_z = Slider(500, range=0..1500)

# ---- group: Robot
panel_2 = Panel("Unload libraries")
bang = Button()
unload = PythonScript(bang=bang)
# ---------- unload: Python ----------
from compas_ghpython import unload_modules

unload_modules("compas")
unload_modules("ur_online_control")
# ---------- end unload ----------

# ----
panel_3 = Panel("ORIGIN")

linear_axis = GhPythonScript(move_to_pos=move_to_pos, pos_x=number_slider, pos_z=pos_z, close=close)  # -> out
# ---------- linear_axis: Python ----------
__author__ = "joburger"
__version__ = "2018.09.20"

from linear_axis import siemens as s

if move_to_pos:
    p = s.SiemensPortal(2)
    
    try:
         p.set_x(pos_x)
         p.set_z(pos_z)
         # p.wait_ext_axis()
    
    finally:
         p.close()

if close:
    try:
        p.close()
        p = s.SiemensPortal(2)
    finally:
        p.close()

#position_data = None

"""
if get_pos:
    try:
        p = s.SiemensPortal(1)
        position_data = "NO DATA"
        position_data = "AXIS POSITION \nX:" + str(p.get_x()) + " Z:" + str(p.get_z())
        print "hmm"
    finally:
        p.close()

try:
    print position_data
except RuntimeError:
    print "Something did not work"
"""
# ---------- end linear_axis ----------

subtraction = Subtraction(A=number_slider, B="500")
subtraction_2 = Subtraction(A="750", B=pos_z)
neg = Negative(Value=subtraction)
neg_2 = Negative(Value=subtraction_2)
linear_axis_x_axis = Brep(<brep referenced from the Rhino model>)
linear_axis_plates = Brep([<brep referenced from the Rhino model> x2])
X = UnitX(Factor=neg)
Z = UnitZ(Factor=neg_2)
move = Move(Geometry=linear_axis_x_axis, Motion=X)  # -> Geometry, Transform
move_2 = Move(Geometry=[move.Geometry, linear_axis_plates], Motion=Z)  # -> Geometry, Transform
preview = CustomPreview(Geometry=move_2.Geometry, Shader=ColourSwatch(SwatchColor=RGBA(99, 94, 94, 96)))

# ---- group: Robot
# 1. load robot model
# 2. set tool
# 3. set basis
# 1. load robot model
# 2. set tool
# 3. set basis
list = ValueList({"no_tool": 0, "measurement_tool": 1, "extruder": 2}, selected="extruder")
base = PythonScript(x=subtraction, z=subtraction_2)  # -> base_frame, base
# ---------- base: Python ----------
from compas.geometry import Frame

"""
origin = [0, 0, 0]
xaxis = [1, 0, 0]
yaxis = [0, 1, 0]


origin = [-313.92, -147.58, 13.79]
xaxis = [0.00000, -1.00000, 0.00000]
yaxis = [1.00000, 0.00000, 0.00000]
"""


linear_axis_x = x
linear_axis_z = z 
#axis    Y         Z                        X
origin = [155.98, -806.21 + linear_axis_z, 343.76 + linear_axis_x]
xaxis = [0, 0, 1]
yaxis = [1, 0, 0]

base_frame = Frame(list(origin), list(xaxis), list(yaxis))

base = "base = " + str(origin) + "\n" + "change in linear_axis_x = " + str(linear_axis_x) + "\n" + "change in linear_axis_z = " + str(linear_axis_z)
# ---------- end base ----------
tools = Tools(tool_id=list)
list_2 = ValueList({"UR5", "UR10"}, selected="UR10")
robot = PythonScript(model=list_2, tool=tools, base_frame=base.base_frame)  # -> robot
# ---------- robot: Python ----------
from ur_online_control.ur.ur10 import UR10
#from ur_online_control.ur.ur5 import UR5
from scriptcontext import sticky as st

if model == "UR5":
    robot = UR5()
elif model == "UR10":
    robot = UR10()

if tool:
    robot.set_tool(tool)
if base_frame:
    robot.set_base(base_frame)

st["robot"] = robot
# ---------- end robot ----------

# ----
list_3 = ValueList({"no_tool": 0, "spray_gun": 1, "extruder": 2}, selected="extruder")
panel_4 = Panel(linear_axis)
tools_2 = Tools_2(tool_id=list_3)
panel_5 = Panel(base.base)
neg_3 = Negative(Value=Slider(75, range=0..100))
number_slider_2 = Slider(90, range=0..100)
number_slider_3 = Slider(0, range=0..1)
Z_2 = UnitZ(Factor=neg_3)

start = Button()
py_2 = PythonScript()  # -> path
# ---------- py_2: Python ----------
import sys
import os

ghComp = ghenv.Component
ghDoc = ghComp.OnPingDocument()

# the full path of the gh file
path = ghDoc.FilePath
# the directory of the gh file
path = os.path.dirname(path)

path = os.path.abspath(os.path.join(path, ".."))

print path
# ---------- end py_2 ----------
# 1
# Executing
panel_6 = Panel("Start communication server")
panel_7 = Panel(py_2)
server = PythonScript(path=panel_7, start=start)
# ---------- server: Python ----------
import os
import threading
from scriptcontext import sticky as st

server_address = st["server_address"]
server_port = st["server_port"]
ur_ip = st["ur_ip"]

"""
Change main!!!!
"""
main = os.path.join(path, "communication", "main_json.py")
syscall = "python %s %s %s %s" % (main, server_address, server_port, ur_ip)
print syscall

if os.path.isfile(main):
        
    def myfunc():
        
        os.system(syscall)
    
    if start:
        t = threading.Thread(target=myfunc)
        t.start()
# ---------- end server ----------

# ---- group: rotated_top_extra_layers_loading_pt
pt_3 = Point(<point referenced from the Rhino model>)

# ---- group: test_pt
pt_4 = Point(<point referenced from the Rhino model>)
xy = XYPlane(Origin=pt_4)
rotate = Rotate(Geometry=xy, Angle=degrees(number_slider_2), Plane=xy)  # -> Geometry, Transform

# ----
start_2 = Button()

panel_8 = Panel("Get UR connected")
ur = PythonScript(send=start_2)  # -> out, a
# ---------- ur: Python ----------
from scriptcontext import sticky as st
from ur_online_control.ur_driver import URDriver

server_address = st["server_address"]
server_port = st["server_port"]
ur_ip = st["ur_ip"]
robot = st["robot"]

print ("server_address = ", server_address)
print ("server_port = ", server_port)
print ("ur_ip =", ur_ip)

tool_angle_axis = list(robot.tool.tcp_frame.point) + robot.tool.tcp_frame.axis_angle_vector
#robot.tool.tcp_frame.pose_axis_angle_vector
print "tool_angle_axis =", tool_angle_axis

ur_driver = URDriver(server_address, server_port, tool_angle_axis, ur_ip, "UR")
print ur_driver

if send:
    ur_driver.send()
# ---------- end ur ----------

panel_9 = Panel(ur.out)
start_3 = Button()

disconnect = Button()
panel_10 = Panel("Get Grasshopper connected")
client = PythonScript(connect=start_3, disconnect=disconnect)  # -> connected, client
# ---------- client: Python ----------
import time
from scriptcontext import sticky as st
from Rhino.RhinoApp import WriteLine
from ur_online_control.grasshopper import GHClient, gh_component_timer
import time

server_address = st["server_address"]
server_port = st["server_port"]

guid = str(ghenv.Component.InstanceGuid)

client_key = "client_" + guid
run_key = "run_" + guid

if connect:
    if client_key not in st:
        st[client_key] = GHClient(server_address, server_port)
        client = st[client_key]
        client.connect_to_server()
        client.start()
        
    else:
        if st[client_key].running:
            WriteLine("Client is already connected.")
            
        else:
            st[client_key] = GHClient(server_address, server_port)
            client = st[client_key]
            client.connect_to_server()
            client.start()
"""
else:
    if client_key in st:
        # we need a timer to ask if we have something on the rcv queue
        client = st[client_key]
        #if client.running:
        #    #client.run_inner_while()
        #    gh_component_timer(ghenv, True, 1000)
"""

if disconnect:
    if client_key in st:
        client = st[client_key]
        if client.running:
            client.close()

if client_key in st:
    connected =  st[client_key].running
    client = st[client_key]
    print st[client_key].rcv_queue.qsize()
    print st[client_key].snd_queue.qsize()
else:
    connected = False
# ---------- end client ----------
panel_11 = Panel(client.connected)

bang_2 = Button()
receive = PythonScript(client=client.client, bang=bang_2)  # -> qsize, client
# ---------- receive: Python ----------
from ur_online_control.communication.msg_identifiers import *
from ur_online_control.utilities.lists import flatten_list
from Rhino.RhinoApp import WriteLine


if client:
    if not client.ghenv:
        client.ghenv = ghenv
    qsize = client.rcv_queue.qsize()
# ---------- end receive ----------
panel_12 = Panel(receive.qsize)

send = PythonScript(client=receive.client)  # -> out
# ---------- send: Python ----------
from ur_online_control.communication.msg_identifiers import *
from ur_online_control.utilities.lists import flatten_list

if client:
    qsize = client.rcv_queue.qsize()
    if qsize:
        msg = client.rcv_queue.get()
        print msg
# ---------- end send ----------
panel_13 = Panel(send)
visualize_layer = Slider(528, range=0..1000)

# ----
# Direct UR control
get = Button()
get_2 = Button()
pose = PythonScript(get=get_2)  # -> pose_joints
# ---------- pose: Python ----------
from scriptcontext import sticky as st
from ur_online_control.ur_direct import get_current_pose_joints
from ur_online_control.ur.robot import BaseConfiguration

server_address = st["server_address"]
server_port = 30005
ur_ip = st["ur_ip"]
robot = st["robot"]
tool_angle_axis = list(robot.tool.tcp_frame.point) + robot.tool.tcp_frame.axis_angle_vector
print tool_angle_axis

guid = str(ghenv.Component.InstanceGuid)
pose_joints_key = "pose_joints" + guid


if get:
    st[pose_joints_key] = get_current_pose_joints(server_address, server_port, ur_ip, tool_angle_axis)
    
if pose_joints_key not in st:
    pose_joints = []
else:
    pose_joints = BaseConfiguration.from_joints(st[pose_joints_key])
# ---------- end pose ----------
pose_2 = PythonScript(get=get)  # -> pose_cartesian
# ---------- pose_2: Python ----------
from scriptcontext import sticky as st
from ur_online_control.ur_direct import get_current_pose_cartesian

server_address = st["server_address"]
server_port = 30005
ur_ip = st["ur_ip"]
robot = st["robot"]
tool_angle_axis = list(robot.tool.tcp_frame.point) + robot.tool.tcp_frame.axis_angle_vector
print tool_angle_axis

guid = str(ghenv.Component.InstanceGuid)
pose_cartesian_key = "pose_cartesian" + guid


if get:
    st[pose_cartesian_key] = get_current_pose_cartesian(server_address, server_port, ur_ip, tool_angle_axis)

if pose_cartesian_key not in st:
    pose_cartesian = []
else:
    pose_cartesian = st[pose_cartesian_key]
# ---------- end pose_2 ----------
stop = Button()
stop_2 = PythonScript(stop=stop)
# ---------- stop_2: Python ----------
from scriptcontext import sticky as st
from ur_online_control.ur_direct import stop as stop_robot

ur_ip = st["ur_ip"]

if stop:
    stop_robot(ur_ip)
# ---------- end stop_2 ----------
panel_14 = Panel(pose)
panel_15 = Panel(pose_2)

vertical_pose = Number([-152.427, -780.635, 855.229, -1.1958, -1.22046, -1.20201])
back = Button()
reset = Button()
dom_5 = ConstructDomain(DomainStart=Slider(0, range=0..10000), DomainEnd=Slider(10000, range=0..10000))

# ---- group: Define joint positions
base_2 = Slider(90.163, range=-360..360)
shoulder = Slider(0, range=-360..360)
elbow = Slider(-102.857, range=-360..360)
wrist1 = Slider(0, range=-360..360)
wrist2 = Slider(0, range=-360..360)
wrist3 = Slider(0, range=-360..360)
ur1_q1_q6 = Data([base_2, shoulder, elbow, wrist1, wrist2, wrist3])

# ----
# Calculate basis
# Measure basis:
# 1. Clear the recorded poses
# 2. Move robot to origin and press "get pose"
# 3. Move robot to point in positive x-axis and press "get pose"
# 4. Move robot to an other point in your basis and press "get pose"
# (The farer away these positions are, the better)
# 
# 5. Alternatively change the order in the component calc base
# 6. Copy output into base component
list_4 = ValueList({"origin, pt on positive x-axis, pt in xy plane": 0, "origin, pt on positive y-axis, pt in xy plane": 1}, selected="origin, pt on positive x-axis, pt in xy plane")
clear = Button()
rec = PythonScript(msg=pose_2, rec=get, clear=clear)  # -> rec; inputs msg: list
# ---------- rec: Python ----------
from scriptcontext import sticky as st

guid = str(ghenv.Component.InstanceGuid)
recorded_key =  "recorded_" + guid
just_cleared_key = "just_cleared_" + guid

if recorded_key not in st:
    st[recorded_key] = []

if just_cleared_key not in st:
    st[just_cleared_key] = False

if clear:
    st[recorded_key] = []
    st[just_cleared_key] = True
else:
    if len(msg):
        if msg != [None] and not st[just_cleared_key] and rec:
            st[recorded_key].append(msg)
    st[just_cleared_key] = False
        


rec = st[recorded_key]

print rec
# ---------- end rec ----------
calc_base = PythonScript(poses=rec, input_type=list_4)  # -> out; inputs poses: list
# ---------- calc_base: Python ----------
import Rhino.Geometry as rg
import math


if len(poses) > 2:
    
    O = poses[0]
    P1 = poses[1]
    P2 = poses[2]
    
    if input_type == 0:
        # origin, pt on positive x-axis, pt in xy plane
        origin = rg.Point3d(O[0], O[1], O[2])
        pt_on_xaxis = rg.Point3d(P1[0], P1[1], P1[2])
        pt_in_xyplane = rg.Point3d(P2[0], P2[1], P2[2])
        
        xaxis = pt_on_xaxis - origin
        xaxis.Unitize()
        
        v = pt_in_xyplane - origin
        zaxis = rg.Vector3d.CrossProduct(v, xaxis)
        zaxis.Unitize()
        
        # zaxis must look up!
        if math.acos(rg.Vector3d.ZAxis * zaxis) > math.acos(rg.Vector3d.ZAxis * -zaxis):
            zaxis = -zaxis
        
        yaxis = rg.Vector3d.CrossProduct(zaxis, xaxis)
    
    elif input_type == 1:
        # origin, pt on positive y-axis, pt in xy plane
        origin = rg.Point3d(O[0], O[1], O[2])
        pt_on_yaxis = rg.Point3d(P1[0], P1[1], P1[2])
        pt_in_xyplane = rg.Point3d(P2[0], P2[1], P2[2])
        
        yaxis = pt_on_yaxis - origin
        yaxis.Unitize()
        
        v = pt_in_xyplane - origin
        zaxis = rg.Vector3d.CrossProduct(v, yaxis)
        zaxis.Unitize()
        
        # zaxis must look up!
        if math.acos(rg.Vector3d.ZAxis * zaxis) > math.acos(rg.Vector3d.ZAxis * -zaxis):
            zaxis = -zaxis
        
        xaxis = rg.Vector3d.CrossProduct(yaxis, zaxis)
        
        
    print "Copy the following into base component:"
    print " "
    print "origin = [%.2f, %.2f, %.2f]" % tuple(list(origin))
    print "xaxis = [%.5f, %.5f, %.5f]" % tuple(list(xaxis))
    print "yaxis = [%.5f, %.5f, %.5f]" % tuple(list(yaxis))
    

#print rg.Vector3d.CrossProduct(rg.Vector3d.YAxis, rg.Vector3d.ZAxis)
#print rg.Vector3d.CrossProduct(rg.Vector3d.ZAxis, rg.Vector3d.XAxis)
# ---------- end calc_base ----------
panel_16 = Panel(rec)
panel_17 = Panel(calc_base)

py_3 = GhPythonScript(joint_values=ur1_q1_q6)  # -> configuration; inputs joint_values: list
# ---------- py_3: Python ----------
import math
from ur_online_control.ur.robot import BaseConfiguration

configuration = BaseConfiguration.from_joints([math.radians(d) for d in joint_values])
# ---------- end py_3 ----------

list_5 = ValueList({"Print with UR": 0, "Print with UR and Linear Axis": 1}, selected="Print with UR and Linear Axis")
list_6 = ValueList({"printing_full_column": 0, "printing_top_extra_layers": 1, "printing_splitted_parts": 2}, selected="printing_splitted_parts")

# ---- group: Visualise / robot model brep
py_4 = PythonScript(model=list_2)  # -> n
# ---------- py_4: Python ----------
if model == "UR5":
    n = 0
if model == "UR10":
    n = 1

print n
# ---------- end py_4 ----------
ur10_brep = UR10Brep([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])
ur5_brep = UR5Brep([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])
show_brep = BooleanToggle(False)
filter = StreamFilter(Gate=py_4, Stream0=ur5_brep, Stream1=ur10_brep)

# ----
# temporary .....
# to split where it failed . should be back to 100
number_slider_4 = Slider(17, range=0..100)
addition = Addition(B=number_slider_4)

panel_18 = Panel("set digital out")
number = Slider(2, range=0..10)
value = BooleanToggle(False)
digital_out = PythonScript(number=number, value=value)  # -> script; inputs number: Int32, value: Boolean
# ---------- digital_out: Python ----------
script = "def prog():\n"
script += "\ttextmsg(\">> program start\")\n"
script += "\tset_digital_out(%i, %s)\n" % (int(number), str(value))
script += "\ttextmsg(\"<< program end\")\n"
script += "end\n"
script += "prog()\n\n"

print script
# ---------- end digital_out ----------
send_2 = Button()
send_3 = Send(script=digital_out, send=send_2)
panel_19 = Panel(send_3)

panel_20 = Panel("move vertical")
movel = PythonScript()  # -> script
# ---------- movel: Python ----------
from scriptcontext import sticky as st

robot = st["robot"]
tool_angle_axis = list(robot.tool.tcp_frame.point) + robot.tool.tcp_frame.axis_angle_vector
x, y, z, ax, ay, az = tool_angle_axis

script = "def prog():\n"
script += "\ttextmsg(\">> program start\")\n"
script += "\tset_tcp(p%s)\n" % str([x/1000., y/1000., z/1000, ax, ay, az])
script += "\tcurrent_pose = get_forward_kin()\n"
script += "\tmovel(p[current_pose[0], current_pose[1], current_pose[2], 0, 0, 0], a=0.1, v=0.1)\n"
script += "\ttextmsg(\"<< program end\")\n"
script += "end\n"
script += "prog()\n\n"

print script
# ---------- end movel ----------
send_4 = Button()
send_5 = Send(script=movel, send=send_4)
panel_21 = Panel(send_5)

# ----
# move incremental in TCS
get_current_pose = Button()
list_7 = ValueList({"xaxis", "yaxis", "zaxis"}, selected="zaxis")
movel_2 = PythonScript(get=get_current_pose, step_size=Slider(5, range=-10..10), direction=list_7)  # -> script; inputs get: list
# ---------- movel_2: Python ----------
from scriptcontext import sticky as st
from compas.geometry import Frame
from compas.geometry import Point, Vector
from ur_online_control.ur_direct import get_current_pose_cartesian

server_address = st["server_address"]
server_port = 30005
ur_ip = st["ur_ip"]
robot = st["robot"]
tool_angle_axis = list(robot.tool.tcp_frame.point) + robot.tool.tcp_frame.axis_angle_vector
print tool_angle_axis

guid = str(ghenv.Component.InstanceGuid)
pose_cartesian_key = "pose_cartesian" + guid

if get:
    st[pose_cartesian_key] = get_current_pose_cartesian(server_address, server_port, ur_ip, tool_angle_axis)

if pose_cartesian_key not in st:
    pose_cartesian = []
    script = ""
else:
    pose_cartesian = st[pose_cartesian_key]

    robot = st["robot"]
    tool_angle_axis = list(robot.tool.tcp_frame.point) + robot.tool.tcp_frame.axis_angle_vector
    x, y, z, ax, ay, az = tool_angle_axis
    
    script = "def prog():\n"
    script += "\ttextmsg(\">> program start\")\n"
    script += "\tset_tcp(p%s)\n" % str([x/1000., y/1000., z/1000, ax, ay, az])
    script += "\tcurrent_pose = get_forward_kin()\n"
    
#    frame = Frame.from_pose_axis_angle_vector(pose_cartesian)
    frame = Frame.from_axis_angle_vector([ax, ay, az])
    frame.point = [x, y, z]

    if direction == "xaxis":
        next_vector = Vector(*frame.xaxis) * step_size
    elif direction == "yaxis":
        next_vector = Vector(*frame.yaxis) * step_size
    else: # direction == "zaxis":
        next_vector = Vector(*frame.zaxis) * step_size
    
    x, y, z = next_vector
    script += "\tmovel(p[current_pose[0] + %f, current_pose[1] + %f, current_pose[2] + %f, current_pose[3], current_pose[4], current_pose[5]], t=%f)\n" % (x/1000., y/1000., z/1000., step_size * 0.1)
    
    script += "\ttextmsg(\"<< program end\")\n"
    script += "end\n"
    script += "prog()\n\n"
    
    print script
# ---------- end movel_2 ----------
send_6 = Button()
send_7 = Send(script=movel_2, send=send_6)
panel_22 = Panel(send_7)

# ----
# move incremental in WCS
number_slider_5 = Slider(5, range=-10..10)
list_8 = ValueList({"xaxis", "yaxis", "zaxis"}, selected="zaxis")
movel_3 = PythonScript(step_size=number_slider_5, direction=list_8)  # -> script
# ---------- movel_3: Python ----------
from scriptcontext import sticky as st

robot = st["robot"]
tool_angle_axis = list(robot.tool.tcp_frame.point) + robot.tool.tcp_frame.axis_angle_vector
x, y, z, ax, ay, az = tool_angle_axis

script = "def prog():\n"
script += "\ttextmsg(\">> program start\")\n"
script += "\tset_tcp(p%s)\n" % str([x/1000., y/1000., z/1000, ax, ay, az])
script += "\tcurrent_pose = get_forward_kin()\n"


if direction == "xaxis":
    script += "\tmovel(p[current_pose[0] + %f, current_pose[1], current_pose[2], current_pose[3], current_pose[4], current_pose[5]], t=%f)\n" % (step_size/1000., step_size * 0.1)

elif direction == "yaxis":
    script += "\tmovel(p[current_pose[0], current_pose[1] + %f, current_pose[2], current_pose[3], current_pose[4], current_pose[5]], t=%f)\n" % (step_size/1000., step_size * 0.1)

else: # direction == "zaxis":
    script += "\tmovel(p[current_pose[0], current_pose[1], current_pose[2] + %f, current_pose[3], current_pose[4], current_pose[5]], t=%f)\n" % (step_size/1000., step_size * 0.1)

script += "\ttextmsg(\"<< program end\")\n"
script += "end\n"
script += "prog()\n\n"

print script
# ---------- end movel_3 ----------
send_8 = Button()
send_9 = Send(script=movel_3, send=send_8)
panel_23 = Panel(send_9)

dom_6 = ConstructDomain(DomainStart=Slider(0, range=0..68000), DomainEnd=Slider(304, range=0..68000))

# ---- group: offset_pattern_sides
int = Integer(div_pt_count)
division = Division(A=int, B=2)

# ---- group: distance_offset
range_2 = Range(Domain=dom_4, Steps=expr("x-1", division))
graph_2 = GraphMapper(range_2, x0=0, x1=1, y0=0, y1=1, Cx=0.5664730072, Cy=0.5583181381, container_name="Conic")
data_3 = Data(graph_2)
rev = ReverseList(List=data_3)
item = ListItem(List=rev, Index=0, Wrap=True)
merge = Merge(Data1=data_3, Data2=item, Data3=rev)  # -> flatten(Result)

# ---- group: offset_pattern_sides
range_3 = Range(Domain=dom_2, Steps=int)

graph_3 = GraphMapper(range_3, x0=0, x1=1, y0=0, y1=1, Cx=0.6014492512, Cy=0.5289256573, container_name="Conic")
data_4 = Data(graph_3)
bnd_2 = Bounds(Numbers=data_4)
remap_2 = RemapNumbers(Value=data_4, Source=bnd_2, Target=dom_2)  # -> Mapped, Clipped

# ----
number_slider_6 = Slider(1, range=0..1)
dup = DuplicateData(Data=number_slider_6, Number=Slider(10, range=0..10), Order=True)
dup_2 = DuplicateData(Data=number_slider_6, Number=layer_count_2, Order=True)
filter_2 = StreamFilter(Gate=number_slider_3, Stream0=remap_2.Mapped, Stream1=dup)
filter_3 = StreamFilter(Gate=number_slider_3, Stream0=merge, Stream1=dup)
filter_4 = StreamFilter(Gate=number_slider_3, Stream0=remap.Mapped, Stream1=dup_2)

# ---- group: Div point offset
range_4 = Range(Domain=Domain(0, 1), Steps=expr("x-1", layer_count_2))

# ---- group: Div point offset / new
graph_4 = GraphMapper(range_4, x0=0, x1=1, y0=0, y1=1, Ox=0.5051235557, Oy=0.5507389307, Px=1, Py=0.1906216741, container_name="Parabola")

# ---- group: Div point offset (continued)
data_5 = Data(graph_4)
bnd_3 = Bounds(Numbers=data_5)
remap_3 = RemapNumbers(Value=data_5, Source=bnd_3, Target=dom)  # -> Mapped, Clipped

# ----
python_3 = GhPythonScript(
    input_lines=python.lines,
    number_of_layers=layer_count,
    layer_height=layer_height,
    div_pt_count=div_pt_count,
    div_pt_offset=remap_3.Mapped,
    offset_pattern_sides=filter_2,
    distance_offset=filter_3,
    height_reduction_factor=filter_4,
    offset_x=data_2)  # -> out, flat_pt_list, flattened_list, polyline_layers, undulated_divpts, test_pts, test_line_list, pt1_right_list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; inputs input_curves: list of Curve, input_lines: list of Curve, number_of_layers: Int32, div_pt_offset: list, offset_pattern_sides: list, distance_offset: list, height_reduction_factor: list, offset_x: list
# ---------- python_3: Python ----------
__author__ = "joburger"
__version__ = "2019.08.12"

import Rhino.Geometry as rg
import imp
from eggshell.surface import curve_undulations_new

imp.reload(curve_undulations_new)

def flatten_list(array):
    return [item for sublist in array for item in sublist]

pt_list = []
polyline_layers = []
polyline_pt_list = []

for i in range(number_of_layers):
    # i = layer
    # j = line within layer
    
    polyline_pt_list = []
    
    for j in range(len(input_lines)):
        line = input_lines[j]
        # create move z vector
        move_vect = rg.Vector3d(0.0, 0.0, layer_height * i)
        move_xform = rg.Transform.Translation(move_vect)
        
        # copy and move curve
        moved_line = rg.Curve.Duplicate(line)
        moved_line.Transform(move_xform)
        
        if j == 0 or j == 2:
            print "j = 2 or j = 3"
            offset_pattern_sides.reverse()
        else:
            print "j = 1 or 0"
        print offset_pattern_sides
        
        # divide points of every line
        if j == 0 or j == 3:
            # longer side
            div_pt_value = div_pt_offset[i]
        else:
            # shorter side
            div_pt_value = -div_pt_offset[i]
        
        unds = curve_undulations_new.Curve_undulations(i, moved_line, div_pt_count, div_pt_value, offset_pattern_sides, distance_offset, height_reduction_factor[i], offset_x[i])
        undulated_divpts = unds.curve_undulations_grid()
        
        
        pt_list.append(undulated_divpts)
        polyline_pt_list.append(undulated_divpts)
       
    # create polyline per layer
    flat_polyline_list = flatten_list(polyline_pt_list)
    polyline_layer = rg.PolylineCurve(flat_polyline_list + [flat_polyline_list[0]])
    polyline_layers.append(polyline_layer)

flat_pt_list = flatten_list(pt_list)
# ---------- end python_3 ----------
pt_5 = Point(python_3.flat_pt_list)
crv = Curve(python_3.polyline_layers)
len = Length(Curve=python_3.polyline_layers)
lng_2 = ListLength(List=python_3.polyline_layers)
lng_3 = ListLength(List=pt_5)
ma = MassAddition(Input=len)  # -> Result, PartialResults
division_2 = Division(A=lng_3, B=lng_2)
division_3 = Division(A=ma.Result, B=Slider(40, range=0..100))
division_4 = Division(A=division_3, B=3600)
printing_time_hours = Panel(division_4)

addition_2 = Addition(A=visualize_layer, B=1)
multiplication = Multiplication(A=division_2, B=visualize_layer)
multiplication_2 = Multiplication(A=division_2, B=addition_2)
dom_7 = ConstructDomain(DomainStart=multiplication, DomainEnd=multiplication_2)
subset = SubList(List=pt_5, Domain=dom_7, Wrap=True)  # -> List, Index
item_2 = ListItem(List=crv, Index=visualize_layer, Wrap=True)

# ---- group: loft
loft = Loft(Curves=crv, Options={Adjust=False, Closed=False, LoftEnds=0, LoftSimp=0, LoftType=0, Rebuild=10, Refit=0.01})

# ---- group: polylines
crv_2 = Curve(python_3.polyline_layers)

# ----
polyline_layers = Curve(crv_2)

# ---- group: Printing time
len_2 = Length(Curve=crv_2)
ma_2 = MassAddition(Input=len_2)  # -> Result, PartialResults
python_4 = GhPythonScript(tot_length=ma_2.Result, print_speed=Slider(40, range=0..100))  # -> simplify(out), a
# ---------- python_4: Python ----------
__author__ = "joburger"
__version__ = "2018.09.06"

import imp
from design import generate_column as gc

imp.reload(gc)

gc.calculate_weight(tot_length, print_speed)
# ---------- end python_4 ----------

# ---- group: layer
crv_3 = Curve(item_2)

# ---- group: flat_point_list
pt_6 = Point(pt_5)

# ----
flat_pt_list = Point(pt_6)

# ---- group: Orient for printing
item_3 = ListItem(List=polyline_layers, Index=0, Wrap=True)
area = Area(Geometry=item_3)  # -> Area, Centroid
xy_2 = XYPlane(Origin=pt_2)
xy_3 = XYPlane(Origin=area.Centroid)
orient = Orient(Geometry=polyline_layers, Source=xy_3, Target=xy_2)  # -> Geometry, Transform
orient_2 = Orient(Geometry=flat_pt_list, Source=xy_3, Target=xy_2)  # -> Geometry, Transform

# ---- group: points_per_layer
pt_7 = Point(subset.List)

# ----
panel_24 = Panel(python_4.out)
item_4 = ListItem(List=crv_2, Index=Slider(870, range=0..1000), Wrap=True)

# ---- group: Oriented curves
crv_4 = Curve(orient.Geometry)

# ----
subset_2 = SubList(List=pt_6, Domain=dom_5, Wrap=True)  # -> List, Index

# ---- group: Oriented points
pt_8 = Point(orient_2.Geometry)

# ----
pline = PolyLine(Vertices=subset_2.List, Closed=False)

# ---- group: Print with UR
rev_2 = ReverseList(List=pt_8)
pdecon = Deconstruct(Point=pt_8)  # -> XComponent, YComponent, ZComponent
pt_9 = ConstructPoint(XCoordinate=pdecon.XComponent, YCoordinate=pdecon.YComponent, ZCoordinate=pdecon.ZComponent)

# ---- group: Print with both / itll be sent to main python
layers_to_move_linear_axis = Slider(15, range=0..200)
lng_4 = ListLength(List=flat_pt_list)
lng_5 = ListLength(List=polyline_layers)
division_5 = Division(A=lng_4, B=lng_5)
# removed adding the first point in every list temorary for top printing
points_per_layer = Panel(division_5)

# ----
point = Integer(points_per_layer)

# ---- group: Print with UR
amount_of_layers = Panel(lng_5)
pt_10 = Point(pt_9)
points_per_layer_2 = Panel(division_5)
python_5 = GhPythonScript(input_pts=pt_10, pts_per_layer=points_per_layer_2, amount_of_layers=amount_of_layers, shift_value=Slider(5, range=0..10))  # -> flat_pt_list; inputs input_pts: list of Point3d, pts_per_layer: Int32, amount_of_layers: Int32, shift_value: Int32
# ---------- python_5: Python ----------
__author__ = "joburger"
__version__ = "2019.07.04"

def flatten_list(array):
    return [item for sublist in array for item in sublist]

output_pts = []

for i in range(amount_of_layers):
    print "layer index:" , i*pts_per_layer+shift_value, i*pts_per_layer+pts_per_layer
    layer = input_pts[i*pts_per_layer+shift_value:i*pts_per_layer+pts_per_layer]
    print "extra_pt_index:" , i*pts_per_layer, i*pts_per_layer+shift_value
    extra_pts = input_pts[i*pts_per_layer:i*pts_per_layer+shift_value]
    output_pts.append(layer)
    output_pts.append(extra_pts)

flat_pt_list = flatten_list(output_pts)
# ---------- end python_5 ----------

# ---- group: Print with both
python_6 = GhPythonScript(
    pts_per_layer=points_per_layer,
    layers_to_move_linear_axis=layers_to_move_linear_axis,
    x=pdecon.XComponent,
    y=pdecon.YComponent,
    z=pdecon.ZComponent,
    printing_part=list_6)  # -> out, new_pts, z_last_partition, z_all_pts_partitions; inputs pts_per_layer: Int32, layers_to_move_linear_axis: Int32, x: list, y: list, z: list
# ---------- python_6: Python ----------
__author__ = "nizart"
__version__ = "2019.07.03"

import Rhino.Geometry as rg

new_pts = []

n = pts_per_layer*layers_to_move_linear_axis

x1 = [x[i:i + n] for i in range(0, len(x), n)]
y1 = [y[i:i + n] for i in range(0, len(y), n)]

z1 = [z[i:i + n] for i in range(0, len(z), n)]

z_all_pts_partitions = z1[0]
z_last_partition = z1[-1]

print ("z branch 0 length",len(z_all_pts_partitions))
print ("z last branch length",len(z_last_partition))
print ("x branches length",len(x1))

for i,x in enumerate(x1):
    # in case last branch is an odd number
    if i == len(x1)-1:
        for j in range(len(x)):
            # new pt (x,y,z)
            new_pt = rg.Point3d(x1[i][j], y1[i][j], z_all_pts_partitions[j])
            new_pts.append(new_pt)
    else:
        for j in range(len(x)):
            # new pt (x,y,z)
            new_pt = rg.Point3d(x1[i][j], y1[i][j], z_all_pts_partitions[j])
            new_pts.append(new_pt)
            # append first pt of next batch before the linear axis moves
            if printing_part == 0:
                if j == len(x)-1:
                    var_z = 1 # mm
                    first_pt = rg.Point3d(x1[i+1][0], y1[i+1][0], z_all_pts_partitions[j]+var_z)
                    new_pts.append(first_pt)
# ---------- end python_6 ----------

# ----
panel_25 = Panel(python_6.out)
pt_11 = Point(python_5)
pt_12 = Point(python_6.new_pts)
filter_5 = StreamFilter(Gate=list_5, Stream0=pt_11, Stream1=pt_12)
pt_13 = Point(filter_5)
xy_4 = XYPlane(Origin=pt_13)

# ---- group: split at layer selection
layer_selection = Slider(1904, range=0..10000)
multiplication_3 = Multiplication(A=layer_selection, B=division_5)
split_2 = SplitList(Index=multiplication_3)  # -> ListA, ListB
pt_14 = Point(split_2.ListB)

# ----
lng_6 = ListLength(List=xy_4)
subset_3 = SubList(List=xy_4, Domain=dom_6, Wrap=True)  # -> List, Index
pline_2 = PolyLine(Vertices=subset_3.List, Closed=False)

pt_15 = Point()
X_2 = UnitX(Factor=Slider(300, range=0..1000))
move_3 = Move(Geometry=pt_15, Motion=X_2)  # -> Geometry, Transform
rotate_2 = Rotate(Geometry=move_3.Geometry, Angle=degrees(1.570796327), Plane=pt_15)  # -> Geometry, Transform
Z_3 = UnitZ(Factor=Slider(22, range=0..1000))
Z_4 = UnitZ(Factor="8")
Z_5 = UnitZ(Factor=expr("-x", 1))

division_6 = Division(A=diameter_diagonal, B=2)
division_7 = Division(A=diameter_vertical, B=2)
Z_6 = UnitZ(Factor=z_height_cage)
X_3 = UnitX(Factor=x_radius_cage)
series = Series(Start=0, Step=expr("360/x", amount_of_bars), Count=amount_of_bars)
addition_3 = Addition(A=division_7, B=diameter_stirrup, C=division_6)
addition_4 = Addition(A=x_radius_cage, B=addition_3)
X_4 = UnitX(Factor=addition_4)
division_8 = Division(A=diameter_threaded_rod_top, B=2)
subtraction_3 = Subtraction(A=x_radius_cage, B=division_8, C=division_7)
X_5 = UnitX(Factor=subtraction_3)
move_4 = Move(Geometry=pt, Motion=X_5)  # -> Geometry, Transform
pdecon_2 = Deconstruct(Point=move_4.Geometry)  # -> XComponent, YComponent, ZComponent
Z_7 = UnitZ(Factor=z_middle_height_stirrup)
X_6 = UnitX(Factor=x_stirrup_distance_from_top)
move_5 = Move(Geometry=pt, Motion=X_3)  # -> Geometry, Transform
addition_5 = Addition(A=pdecon_2.ZComponent, B=z_height_cage)
move_6 = Move(Geometry=pt, Motion=X_4)  # -> Geometry, Transform
subtraction_4 = Subtraction(A=addition_5, B=threaded_rod_depth_into_column)
addition_6 = Addition(A=X_4, B=Z_7)
cage_bottompt = Point(move_5.Geometry)
pt_16 = ConstructPoint(XCoordinate=pdecon_2.XComponent, YCoordinate=pdecon_2.YComponent, ZCoordinate=subtraction_4)
move_7 = Move(Geometry=cage_bottompt, Motion=Z_6)  # -> Geometry, Transform
move_8 = Move(Geometry=move_6.Geometry, Motion=Z_6)  # -> Geometry, Transform
move_9 = Move(Geometry=pt, Motion=addition_6)  # -> Geometry, Transform
cage_toppt = Point(move_7.Geometry)
stirrup_top_insidept = Point(move_8.Geometry)
stirrup_midpt = Point(move_9.Geometry)
line = LineSDL(Start=pt_16, Direction=Vector(0, 0, 1), Length=length_of_threaded_rod)
move_10 = Move(Geometry=cage_toppt, Motion=X_6)  # -> Geometry, Transform
stirrup_top_outsidept = Point(move_10.Geometry)
ln = Line(StartPoint=stirrup_top_insidept, EndPoint=stirrup_top_outsidept)
ln_2 = Line(StartPoint=stirrup_midpt, EndPoint=stirrup_top_outsidept)
ln_3 = Line(StartPoint=stirrup_top_insidept, EndPoint=stirrup_midpt)
Z_8 = UnitZ(Factor=extension_bottom_large_stirrup)
move_11 = Move(Geometry=stirrup_midpt, Motion=Z_8)  # -> Geometry, Transform
eval = EvaluateLength(Curve=ln_3, Length=extension_top_large_stirrup, Normalized=False)  # -> Point, Tangent, Parameter
ln_4 = Line(StartPoint=stirrup_midpt, EndPoint=stirrup_top_outsidept)
ln_5 = Line(StartPoint=stirrup_top_insidept, EndPoint=eval.Point)
bottom_stirruppt = Point(move_11.Geometry)
end = EndPoints(Curve=ln_5)  # -> Start, End
end_2 = EndPoints(Curve=ln_4)  # -> Start, End
pt_17 = Point(end.End)
pt_18 = Point(end.Start)
pt_19 = Point(end_2.Start)
pt_20 = Point(end_2.End)
join = JoinCurves(Curves=[ln_5, ln], Preserve=False)
ln_6 = Line(StartPoint=stirrup_midpt, EndPoint=bottom_stirruppt)
end_3 = EndPoints(Curve=ln_6)  # -> Start, End
pt_21 = Point(end_3.End)
pline_3 = PolyLine(Vertices=[pt_17, pt_18, pt_20, pt_19, pt_21], Closed=False)
fillet = Fillet(Curve=pline_3, Radius=Slider(42, range=0..100))
fillet_2 = Fillet(Curve=join, Radius=fillet_radius_large_stirrup_vertical)
join_2 = JoinCurves(Curves=flatten([fillet_2, ln_4]), Preserve=False)
fillet_3 = Fillet(Curve=join_2, Radius=fillet_radius_large_stirrup_diagonal)
join_3 = JoinCurves(Curves=flatten([fillet_3, ln_6]), Preserve=False)
disc = Discontinuity(Curve=join_3, Level=1)  # -> Points, Parameters
item_5 = ListItem(List=disc.Parameters, Index=0, Wrap=True)
fillet_4 = Fillet(Curve=join_3, Parameter=item_5, Radius=fillet_radius_large_stirrup_middle_secti)  # -> Curve, Parameter
X_7 = UnitX(Factor=offset_for_stirrup_vertical_intersection)
X_8 = UnitX(Factor=1)
X_9 = UnitX(Factor=expr("-x", offset_for_stirrup_diagonal_intersection))
Z_9 = UnitZ(Factor=Slider(70, range=0..1000))
addition_7 = Addition(A=diameter_vertical, B=diameter_stirrup)
X_10 = UnitX(Factor=addition_7)
Z_10 = UnitZ(Factor=Slider(0, range=0..10))
X_11 = UnitX(Factor=Slider(14, range=0..100))
X_12 = UnitX(Factor=Slider(90, range=0..1000))
subtraction_5 = Subtraction(A=addition_7, B=Slider(28, range=-11..50))
X_13 = UnitX(Factor=subtraction_5)
X_14 = UnitX(Factor=Slider(15, range=0..100))
addition_8 = Addition(A=diameter_vertical, B=diameter_transversal_stirrup)

move_12 = Move(Geometry=cage_bottompt, Motion=Z_2)  # -> Geometry, Transform

rotate_3 = Rotate(Geometry=graft(rotate_2.Geometry), Angle=degrees(series), Plane=pt)  # -> simplify(Geometry), Transform
vec2pt = Vector2Pt(PointA=rotate_3.Geometry, PointB=pt_15, Unitize=False)  # -> Vector, Length
move_13 = Move(Geometry=rotate_3.Geometry, Motion=expr("-x", Z_3))  # -> Geometry, Transform
xy_5 = XYPlane(Origin=move_13.Geometry)
cyl = Cylinder(Base=move_13.Geometry, Radius=Slider(7, range=0..10), Length=Slider(270, range=0..1000))
align = AlignPlane(Plane=xy_5, Direction=vec2pt.Vector)  # -> Plane, Angle
deplane = DeconstructPlane(Plane=align.Plane)  # -> Origin, XAxis, YAxis, ZAxis
rectangle = Rectangle(Plane=align.Plane, XSize=Domain(-17.5, 17.5), YSize=Domain(-17.5, 17.5), Radius=0)  # -> Rectangle, Length
debrep = DeconstructBrep(Brep=rectangle.Rectangle)  # -> Faces, Edges, Vertices
unit = UnitVector(Vector=deplane.YAxis)
extr = Extrude(Base=rectangle.Rectangle, Direction=Z_4)
item_6 = ListItem(List=debrep.Vertices, Index=0, Wrap=True)  # -> Item, Item1, Item2, Item3
multiplication_4 = Multiplication(A=unit, B=Slider(3, range=0..10))
pt_22 = Point(item_6.Item1)
pt_23 = Point(item_6.Item2)
pt_24 = Point(item_6.Item3)
pt_25 = Point(item_6.Item)
move_14 = Move(Geometry=flatten(pt_25), Motion=multiplication_4)  # -> Geometry, Transform
move_15 = Move(Geometry=flatten(pt_22), Motion=multiplication_4)  # -> Geometry, Transform
ln_7 = Line(StartPoint=pt_23, EndPoint=pt_24)
curvepoint = PointOnCurve(ln_7, parameter=0.5)
move_16 = Move(Geometry=flatten(curvepoint), Motion=expr("-x", multiplication_4))  # -> Geometry, Transform
line_2 = LineSDL(Start=[move_14.Geometry, move_15.Geometry, move_16.Geometry], Direction=Z_5, Length=Slider(141, range=0..200))
cyl_2 = Cylinder(Base=xy_5, Radius="7.25", Length="100")
pipe = Pipe(Curve=line_2, Radius="3", Caps=0)
cap = CapHoles(Brep=extr)

# ---- group: Threaded rods
pipe_2 = Pipe(Curve=line, Radius=expr("x/2", diameter_threaded_rod_top), Caps=1)

# ---- group: filament_loading_pt
pt_26 = Point(<point referenced from the Rhino model>)

# ----
python_7 = GhPythonScript(printing_part=list_6, pt_all=pt_26, pt_top=pt_3)  # -> pt
# ---------- python_7: Python ----------
__author__ = "dfab"
__version__ = "2019.07.24"

if printing_part == 1 :
    pt = pt_top
else:
    pt = pt_all
# ---------- end python_7 ----------

# ---- group: filament_loading_pt (continued)
xy_6 = XYPlane(Origin=python_7)
rotate_4 = Rotate(Geometry=xy_6, Angle=degrees(number_slider_2), Plane=xy_6)  # -> Geometry, Transform

# ---- group: Define commands
safe_speed = Slider(25, range=0..300)
# 2
number_slider_7 = Slider(4, range=0..100)
speed = Slider(45, range=0..300)

# ----
ln_8 = Line(StartPoint=move_12.Geometry, EndPoint=cage_toppt)
cage_vertical = Curve(ln_8)
flip = FlipCurve(Curve=cage_vertical)  # -> Curve, Flag
eval_2 = EvaluateLength(Curve=flip.Curve, Length=position_of_small_rebars_distance_from_t, Normalized=False)  # -> Point, Tangent, Parameter
move_17 = Move(Geometry=eval_2.Point, Motion=X_7)  # -> Geometry, Transform
line_3 = LineSDL(Start=eval_2.Point, Direction=X_8, Length=1)
llx = LineLine(Line1=ln_4, Line2=line_3)  # -> ParamA, ParamB, PointA, PointB
move_18 = Move(Geometry=llx.PointA, Motion=X_9)  # -> Geometry, Transform
cull = CullPattern(List=eval_2.Point, CullPattern=[False, True])  # -> graft(List)
cull_2 = CullPattern(List=eval_2.Point, CullPattern=[True, False])  # -> graft(List)
cull_3 = CullPattern(List=move_18.Geometry, CullPattern=[True, False])  # -> graft(List)
cull_4 = CullPattern(List=move_18.Geometry, CullPattern=[False, True])  # -> graft(List)
cull_5 = CullPattern(List=move_17.Geometry, CullPattern=[False, True])  # -> graft(List)
cull_6 = CullPattern(List=move_17.Geometry, CullPattern=[True, False])  # -> graft(List)
move_19 = Move(Geometry=cull_6, Motion=expr("-x", Z_9))  # -> Geometry, Transform
move_20 = Move(Geometry=cull_2, Motion=Z_10)  # -> Geometry, Transform
move_21 = Move(Geometry=move_20.Geometry, Motion=X_12)  # -> Geometry, Transform
pt3 = Point(cull_3)
pt4 = Point(cull_4)
move_22 = Move(Geometry=pt4, Motion=expr("-x", X_11))  # -> Geometry, Transform
move_23 = Move(Geometry=pt3, Motion=expr("-x", X_11))  # -> Geometry, Transform
pt2 = Point(cull_6)
pt1 = Point(move_19.Geometry)
pt5 = Point(cull)
pt6 = Point(move_20.Geometry)
move_24 = Move(Geometry=pt6, Motion=X_14)  # -> Geometry, Transform
move_25 = Move(Geometry=pt5, Motion=X_14)  # -> Geometry, Transform
pt7 = Point(move_21.Geometry)
move_26 = Move(Geometry=pt1, Motion=expr("x/2", X_13))  # -> Geometry, Transform
move_27 = Move(Geometry=pt6, Motion=expr("x/2", X_10))  # -> Geometry, Transform
move_28 = Move(Geometry=pt5, Motion=expr("x/2", X_10))  # -> Geometry, Transform
move_29 = Move(Geometry=pt2, Motion=expr("x/2", X_13))  # -> Geometry, Transform
pt1_2 = Point(move_26.Geometry)
pt2_2 = Point(move_29.Geometry)
pt3_2 = Point(move_23.Geometry)
pt4_2 = Point(move_22.Geometry)
pt5_2 = Point(move_25.Geometry)
pt6_2 = Point(move_24.Geometry)
pt7_2 = Point(pt7)
pline_4 = PolyLine(Vertices=[pt1_2, pt2_2, pt3_2, pt4_2, pt5_2, pt6_2, pt7_2], Closed=False)
fillet_5 = Fillet(Curve=flatten(pline_4), Radius=fillet_radius_stirrups)

small_stirrups = Curve(simplify(fillet_5))
large_stirrup = Curve(fillet)
cage_vertical_2 = Curve(cage_vertical)

# ---- group: Diagonal bars
pipe_3 = Pipe(Curve=large_stirrup, Radius=expr("x/2", diameter_diagonal), Caps=1)

# ---- group: Vertical bars
pipe_4 = Pipe(Curve=cage_vertical_2, Radius=expr("x/2", diameter_vertical), Caps=1)

# ---- group: Stirrups
pipe_5 = Pipe(Curve=small_stirrups, Radius=expr("x/2", diameter_stirrup), Caps=1)

# ----
geo = Geometry(flatten([cage_vertical_2, large_stirrup, small_stirrups, line]))
geo_2 = Geometry(flatten([pipe_4, pipe_3, pipe_5, pipe_2]))
rotate_5 = Rotate(Geometry=graft(geo), Angle=degrees(series), Plane=pt)  # -> simplify(Geometry), Transform
rotate_6 = Rotate(Geometry=graft(geo_2), Angle=degrees(series), Plane=pt)  # -> simplify(Geometry), Transform
unrotated_geomery = Geometry(geo_2)

bang_3 = ExplodeTree(Data=rotate_5.Geometry)
flip_2 = FlipCurve(Curve=bang_3)  # -> Curve, Flag
divdist = DivideDistance(Curve=flip_2.Curve, Distance=distance_between_transversal_stirrups)  # -> Points, Tangents, Parameters
flip_3 = FlipMatrix(Data=divdist.Points)
intcrv = Interpolate(Vertices=flip_3, Degree=3, Periodic=True, KnotStyle=1)  # -> Curve, Length, Domain
offset = OffsetCurve(Curve=flatten(intcrv.Curve), Distance=expr("x/2", addition_8), Plane=PlaneXY(0, 0, 0), Corners=1)
bang_4 = ExplodeTree(Data=offset)
pipe_6 = Pipe(Curve=flatten(offset), Radius=expr("x/2", diameter_transversal_stirrup), Caps=0)

pt_27 = Point(<point referenced from the Rhino model>)
end_4 = EndPoints(Curve=cage_vertical_2)  # -> Start, End
pt_28 = Point(<point referenced from the Rhino model>)
pt_29 = Point(<point referenced from the Rhino model>)
pt_30 = Point(<point referenced from the Rhino model>)
pt_31 = Point(<point referenced from the Rhino model>)
pt_32 = Point(<point referenced from the Rhino model>)
xy_7 = XYPlane(Origin=pt_27)
xy_8 = XYPlane(Origin=pt_30)
xy_9 = XYPlane(Origin=pt_28)
xy_10 = XYPlane(Origin=pt_29)
xy_11 = XYPlane(Origin=pt_31)
xy_12 = XYPlane(Origin=pt_32)
rotate_7 = Rotate(Geometry=xy_7, Angle=degrees(90), Plane=xy_7)  # -> Geometry, Transform
rotate_8 = Rotate(Geometry=xy_12, Angle=degrees(90), Plane=xy_12)  # -> Geometry, Transform
xz = XZPlane(Origin=pt1_2)
xz_2 = XZPlane(Origin=pt_17)
geo_3 = Geometry(pipe_3)
orient_3 = Orient(Geometry=pline_4, Source=xz, Target=graft([xy_8, xy_9, xy_10]))  # -> Geometry, Transform
pt_33 = Point(<point referenced from the Rhino model>)
orient_4 = Orient(Geometry=[end_4.Start, end_4.End], Source=xz_2, Target=rotate_7.Geometry)  # -> Geometry, Transform
orient_5 = Orient(Geometry=bang_4, Source=pt, Target=pt_33)  # -> Geometry, Transform
disc_2 = Discontinuity(Curve=orient_3.Geometry, Level=1)  # -> Points, Parameters
orient_6 = Orient(Geometry=[pt_17, pt_18, pt_20, pt_19, pt_21], Source=xz_2, Target=rotate_8.Geometry)  # -> Geometry, Transform
curvepoint_2 = PointOnCurve(orient_5.Geometry, parameter=0.5)
end_5 = EndPoints(Curve=orient_5.Geometry)  # -> Start, End
item_7 = ListItem(List=orient_6.Geometry, Index=0, Wrap=True)  # -> Item, Item1, Item2, Item3, Item4
item_8 = ListItem(List=orient_4.Geometry, Index=0, Wrap=True)  # -> Item, Item1
item_9 = ListItem(List=disc_2.Points, Index=0, Wrap=True)  # -> Item, Item1, Item2, Item3, Item4, Item5, Item6
pt_34 = Point(item_9.Item)
pt_35 = Point(item_9.Item1)
len_3 = Length(Curve=orient_5.Geometry)
xy_13 = XYPlane(Origin=Point(0, 0, 0))
panel_26 = Panel(len_3)
ln_9 = Line(StartPoint=item_8.Item, EndPoint=item_8.Item1)
pline_5 = PolyLine(Vertices=[item_9.Item, item_9.Item1, item_9.Item2, item_9.Item3, item_9.Item4, item_9.Item5, item_9.Item6], Closed=False)
fillet_6 = Fillet(Curve=flatten(pline_5), Radius=fillet_radius_stirrups)
len_4 = Length(Curve=fillet_6)
panel_27 = Panel(len_4)
number_slider_8 = Slider(5, range=0..100)
pipe_7 = Pipe(Curve=ln_9, Radius=expr("x/2", diameter_vertical), Caps=0)
orient_7 = Orient(Geometry=geo_3, Source=xz_2, Target=rotate_8.Geometry)  # -> Geometry, Transform
pipe_8 = Pipe(Curve=fillet_6, Radius=expr("x/2", diameter_stirrup), Caps=0)
pipe_9 = Pipe(Curve=flatten(orient_5.Geometry), Radius=expr("x/2", diameter_transversal_stirrup), Caps=0)
number_slider_9 = Slider(35, range=0..100)

# ---- group: GEOMETRY
geo_4 = Geometry([rotate_6.Geometry, pipe_6])

# ---- group: CURVES
crv_5 = Curve([rotate_5.Geometry, offset])

# ----
geo_5 = Geometry([pipe_7, pipe_9, orient_7.Geometry, pipe_8])

aligndim = AlignedDimension(Plane=xy_13, PointA=item_8.Item, PointB=item_8.Item1, Offset=number_slider_9, Text="{0:0.00}", Size=number_slider_8)
aligndim_2 = AlignedDimension(Plane=xy_13, PointA=item_9.Item, PointB=item_9.Item1, Offset=number_slider_9, Text="{0:0.00}", Size=number_slider_8)
aligndim_3 = AlignedDimension(Plane=xy_13, PointA=item_7.Item, PointB=item_7.Item1, Offset=number_slider_9, Text="{0:0.00}", Size=number_slider_8)
aligndim_4 = AlignedDimension(Plane=xy_13, PointA=item_9.Item1, PointB=item_9.Item2, Offset=number_slider_9, Text="{0:0.00}", Size=number_slider_8)
aligndim_5 = AlignedDimension(Plane=xy_13, PointA=item_7.Item1, PointB=item_7.Item2, Offset=number_slider_9, Text="{0:0.00}", Size=number_slider_8)
aligndim_6 = AlignedDimension(Plane=xy_13, PointA=item_9.Item2, PointB=item_9.Item3, Offset=number_slider_9, Text="{0:0.00}", Size=number_slider_8)
aligndim_7 = AlignedDimension(Plane=xy_13, PointA=item_7.Item2, PointB=item_7.Item3, Offset=number_slider_9, Text="{0:0.00}", Size=number_slider_8)
aligndim_8 = AlignedDimension(Plane=xy_13, PointA=item_9.Item3, PointB=item_9.Item4, Offset=number_slider_9, Text="{0:0.00}", Size=number_slider_8)
aligndim_9 = AlignedDimension(Plane=xy_13, PointA=item_7.Item3, PointB=item_7.Item4, Offset=number_slider_9, Text="{0:0.00}", Size=number_slider_8)
aligndim_10 = AlignedDimension(
    Plane=xy_13,
    PointA=end_5.Start,
    PointB=curvepoint_2,
    Offset=Slider(165, range=0..1000),
    Text="{0:0.00}",
    Size=number_slider_8)
aligndim_11 = AlignedDimension(Plane=xy_13, PointA=item_9.Item4, PointB=item_9.Item5, Offset=number_slider_9, Text="{0:0.00}", Size=number_slider_8)
aligndim_12 = AlignedDimension(Plane=xy_13, PointA=item_9.Item5, PointB=item_9.Item6, Offset=number_slider_9, Text="{0:0.00}", Size=number_slider_8)
angledim = AngularDimension(Center=item_7.Item2, PointA=item_7.Item1, PointB=item_7.Item3, Reflex=False, Text="{0:0.0}°", Size=number_slider_8)
angledim_2 = AngularDimension(Center=item_7.Item3, PointA=item_7.Item2, PointB=item_7.Item4, Reflex=False, Text="{0:0.0}°", Size=number_slider_8)
angledim_3 = AngularDimension(Center=item_9.Item3, PointA=item_9.Item2, PointB=item_9.Item4, Reflex=False, Text="{0:0.0}°", Size=number_slider_8)

# ---- group: vert bars
rotate_9 = Rotate(Geometry=graft(cage_vertical_2), Angle=degrees(series), Plane=pt)  # -> simplify(Geometry), Transform
rotate_10 = Rotate(Geometry=rotate_9.Geometry, Angle=degrees(1.570796327), Plane=pt)  # -> Geometry, Transform

# ---- group: diagonals
rotate_11 = Rotate(Geometry=graft(large_stirrup), Angle=degrees(series), Plane=pt)  # -> simplify(Geometry), Transform
rotate_12 = Rotate(Geometry=rotate_11.Geometry, Angle=degrees(1.570796327), Plane=pt)  # -> Geometry, Transform

# ---- group: stirrups
rotate_13 = Rotate(Geometry=graft(small_stirrups), Angle=degrees(series), Plane=pt)  # -> simplify(Geometry), Transform
rotate_14 = Rotate(Geometry=rotate_13.Geometry, Angle=degrees(1.570796327), Plane=pt)  # -> Geometry, Transform

# ----
rebar_radius = Slider(7, range=0..10)
rebar_radius_2 = Slider(5, range=0..10)
concrete_cover = Slider(30, range=0..40)
rebar_radius_3 = Slider(9, range=0..10)
tolerance = Slider(5, range=0..10)
addition_9 = Addition(A=rebar_radius_3, B=tolerance, C=concrete_cover)
addition_10 = Addition(A=rebar_radius, B=tolerance, C=concrete_cover)
addition_11 = Addition(A=rebar_radius_2, B=tolerance, C=concrete_cover)
pipe_10 = Pipe(Curve=rotate_10.Geometry, Radius=addition_9, Caps=0)
pipe_11 = Pipe(Curve=rotate_12.Geometry, Radius=addition_10, Caps=0)
pipe_12 = Pipe(Curve=[rotate_14.Geometry, offset], Radius=addition_11, Caps=0)

pipe_13 = Pipe(Curve=rotate_10.Geometry, Radius=addition_9, Caps=0)

move_filament_loading_pt = BooleanToggle(True)
continue_fabrication = BooleanToggle(True)
# 3
panel_28 = Panel("Send a message")
move_linear_axis = BooleanToggle(True)
save_json = Button()
send_10 = Button()
int_2 = Integer(layers_to_move_linear_axis)

# ----
# Visualisation
robot_2 = Data(robot)
pose_joints = Data(pose)

# ---- group: Define plane in WCS, calculate joint positions
pt_36 = Point(Point(-283.8412985, -342.877576, 297.4189147))
select_configuration = Slider(1, range=0..7)
xy_14 = XYPlane(Origin=pt_36)
plane_wcs = Plane(xy_14)
inverse = PythonScript(robot=robot_2, plane_WCS=plane_wcs, idx=select_configuration)  # -> configuration; inputs plane_WCS: Plane, idx: Int32
# ---------- inverse: Python ----------
import Rhino.Geometry as rg
from compas.geometry import Frame, Transformation
from compas_ghpython import xdraw_frame

tcp_WCS = Frame(plane_WCS.Origin, plane_WCS.XAxis, plane_WCS.YAxis)

# transform frame to robot coordinate system
tcp_RCS = robot.get_frame_in_RCS(tcp_WCS)

# get the frame of tool0
tool0_RCS = robot.get_tool0_frame_from_tcp_frame(tcp_RCS)

# calculate solutions to frame
solutions = robot.inverse_kinematics(tool0_RCS)

if not len(solutions):
    q = [0,0,0,0,0,0]
else:
    idx = min(len(solutions) - 1, idx)
    q = solutions[idx]
    
print q

configuration = q
# ---------- end inverse ----------

# ---- group: Calculate joint positions for path
# Add init joint states
joint_states = Data([-0.1728179112, -1.415058186, 1.813991282, -1.971940356, -1.571654205, -3.308720436])
init_configuration = Slider(0, range=0..7)
start_4 = Button()
stop_3 = Button()
step = Button()

# ---- group: Calculate joint positions for path / Shows joint positions along path
flip_4 = BooleanToggle(True)

# ---- group: Visualise
list_9 = ValueList({"0 forward, from angles": 0, "1 inverse, from one plane": 1, "2 inverse, from multiple planes": 2, "3 forward, from robot": 3}, selected="2 inverse, from multiple planes")
mesh = Mesh(filter)

# ---- group: Send joint position directly to robot
idx = Slider(0, range=0..100)
panel_29 = Panel("move joints")
list_10 = ValueList({"send all positions": 0, "send only one position": 1}, selected="send only one position")
send_11 = Button()

panel_30 = Panel("move cartesian")
idx_2 = Slider(0, range=0..100)
list_11 = ValueList({"send all positions": 0, "send only one position": 1}, selected="send only one position")
send_12 = Button()

# ----
pdecon_3 = Deconstruct(Point=pt_14)  # -> XComponent, YComponent, ZComponent
python_8 = GhPythonScript(
    pts_per_layer=points_per_layer,
    layers_to_move_linear_axis=layers_to_move_linear_axis,
    x=pdecon_3.XComponent,
    y=pdecon_3.YComponent,
    z_all_pts_partitions=python_6.z_all_pts_partitions)  # -> out, new_pts; inputs pts_per_layer: Int32, layers_to_move_linear_axis: Int32, x: list, y: list, z_all_pts_partitions: list
# ---------- python_8: Python ----------
__author__ = "nizart"
__version__ = "2019.07.03"

import Rhino.Geometry as rg

new_pts = []

n = pts_per_layer*layers_to_move_linear_axis

x1 = [x[i:i + n] for i in range(0, len(x), n)]
y1 = [y[i:i + n] for i in range(0, len(y), n)]

#z1 = [z[i:i + n] for i in range(0, len(z), n)]

#z_all_pts_partitions = z1[0]
#z_last_partition = z1[-1]

#print ("z branch 0 length",len(z_all_pts_partitions))
#print ("z last branch length",len(z_last_partition))
print ("x branches length",len(x1))

for i,x in enumerate(x1):
    # in case last branch is an odd number
    if i == len(x1)-1:
        for j in range(len(x)):
            # new pt (x,y,z)
            new_pt = rg.Point3d(x1[i][j], y1[i][j], z_all_pts_partitions[j])
            new_pts.append(new_pt)
    else:
        for j in range(len(x)):
            # new pt (x,y,z)
            new_pt = rg.Point3d(x1[i][j], y1[i][j], z_all_pts_partitions[j])
            new_pts.append(new_pt)
            # append first pt of next batch before the linear axis moves
            if j == len(x)-1:
                var_z = 1 # mm
                first_pt = rg.Point3d(x1[i+1][0], y1[i+1][0], z_all_pts_partitions[j]+var_z)
                new_pts.append(first_pt)
# ---------- end python_8 ----------
number_slider_10 = Slider(0, range=0..100000)
pt_37 = Point(python_8.new_pts)
dom_8 = ConstructDomain(DomainStart=Slider(0, range=0..10000), DomainEnd=Slider(41840, range=0..1000000))
subset_4 = SubList(List=pt_37, Domain=dom_8, Wrap=True)  # -> List, Index
pline_6 = PolyLine(Vertices=subset_4.List, Closed=False)

filter_6 = StreamFilter(Gate=list_5, Stream0=pt_14, Stream1=pt_37)

pt_38 = Point(filter_6)

filter_7 = StreamFilter(Gate=list_6, Stream2=pt_38)

xy_15 = XYPlane(Origin=filter_7)

# ---- group: Fabrication planes
pln = Plane(flatten(xy_15))

# ----
pln_2 = Plane(flatten(pln))
rotate_15 = Rotate(Geometry=pln_2, Angle=degrees(number_slider_2), Plane=pln_2)  # -> Geometry, Transform

# ---- group: Define commands (continued)
planes_wcs = Plane(rotate_15.Geometry)
python_9 = PythonScript(planes_WCS=planes_wcs, dfillet=number_slider_7, speed=speed, safe_speed=safe_speed, safe_pt=rotate_4.Geometry)  # -> commands; inputs planes_WCS: list of Plane, speed: Int32, safe_pt: Plane
# ---------- python_9: Python ----------
import imp
from design import generate_commands as gcmds

imp.reload(gcmds)

commands = gcmds.generate_cmds(planes_WCS, dfillet, speed, safe_speed, safe_pt)

print commands[0]
# ---------- end python_9 ----------

# ----
commands = Data(python_9)
send_13 = PythonScript(
    client=client.client,
    send=send_10,
    continue_fabrication=continue_fabrication,
    commands=commands,
    move_filament_loading_pt=move_filament_loading_pt,
    move_linear_axis=move_linear_axis,
    path=py_2,
    points_per_layer=point,
    layers_to_move_linear_axis=int_2,
    save_json=save_json,
    name_json="commands_test.json")  # -> out, all_batches; inputs continue_fabrication: Int32, commands: list, move_filament_loading_pt: Boolean
# ---------- send_13: Python ----------
import json
import os

from ur_online_control.communication.msg_identifiers import *
from ur_online_control.utilities.lists import flatten_list
from time import sleep


#number of values per command to be formatted 
len_command = len(commands[0])
gh_commands = flatten_list(commands)


#set the desired batch length
commandsPerBatch = 30
batchLen = len_command*commandsPerBatch

numOfCommands = len(gh_commands)/len_command


#to print in gh panel
print len_command, "values each command"
print numOfCommands, "commands." , len(gh_commands), "values"


if move_filament_loading_pt:
    print "Moving to filament loading point"
else:
    print "Skipping filament loading point"

if move_linear_axis:
    print "Moving the linear axis"
else:
    print "Skipping the linear axis"


if send and client:
    client.send(MSG_INT, int(continue_fabrication))
    client.send(MSG_INT, int(move_filament_loading_pt))
    client.send(MSG_INT, int(move_linear_axis))
    client.send(MSG_INT, points_per_layer)
    client.send(MSG_INT, len_command)

data = {}
data['move_filament_loading_pt'] = move_filament_loading_pt
data['move_linear_axis'] = move_linear_axis
data['points_per_layer'] = points_per_layer
data['layers_to_move_linear_axis'] = layers_to_move_linear_axis
data['len_command'] = len_command
data['gh_commands'] = gh_commands


filename = os.path.join(path, name_json)
if save_json:
    with open(filename, 'w') as f:
        json.dump(data, f)
# ---------- end send_13 ----------

lng_7 = ListLength(List=send_13.all_batches)
panel_31 = Panel(send_13.out)
item_10 = ListItem(List=planes_wcs, Index=0, Wrap=True)  # -> Item1, Item
pln_3 = Plane([item_10.Item1, item_10.Item])

planes_wcs_2 = Plane(pln_3)

# ---- group: Calculate joint positions for path (continued)
py_5 = PythonScript(robot=robot_2, planes_WCS=planes_wcs_2, configuration_idx=init_configuration, init_configuration=joint_states)  # -> configurations; inputs planes_WCS: list, configuration_idx: Int32, init_configuration: list
# ---------- py_5: Python ----------
from compas_ghpython import unload_modules
unload_modules('ur_online_control')
import Rhino.Geometry as rg
from compas.geometry import Frame 
from compas.geometry.xforms import Transformation
from compas_ghpython import xdraw_frame
from ur_online_control.ur.kinematics import calculate_configurations_for_path, format_joint_positions


# TODO this must be optimized! matrix multiplication!
frames_tool0_RCS = []
for plane_WCS in planes_WCS:
    tcp_WCS = Frame(plane_WCS.Origin, plane_WCS.XAxis, plane_WCS.YAxis)
    tcp_RCS = robot.get_frame_in_RCS(tcp_WCS)
    frames_tool0_RCS.append(robot.get_tool0_frame_from_tcp_frame(tcp_RCS))
    

#configurations = calculate_configurations_for_path(frames_tool0_RCS, robot.params, init_configuration)
configurations = calculate_configurations_for_path(frames_tool0_RCS, robot, init_configuration)
print configurations
configurations = configurations[min([configuration_idx, len(configurations) - 1])]

def format(numbers, k=4):
    #numbers = format_joint_positions(numbers)
    return "[" + ", ".join([("%." + str(k) + "f") % n for n in numbers]) + "]"
# ---------- end py_5 ----------
counter = CountThroughList(L=py_5, start=start_4, stop=stop_3, step=step, step_back=back, reset=reset, interval=50)  # -> item; inputs L: list, start: Boolean, stop: Boolean, step_back: Boolean
# ---------- counter: Python ----------
from scriptcontext import sticky as st
from compas_ghpython import update_component


# store data in component
guid = str(ghenv.Component.InstanceGuid)
counter_key = "counter_" + guid
running_key = "running_" + guid

if counter_key not in st:
    st[counter_key] = 0

if running_key not in st:
    st[running_key] = False

if start:
    st[running_key] = True

if stop:
    st[running_key] = False

if step:
    if st[counter_key] < len(L) - 1:
        st[counter_key] += 1

if step_back:
    if st[counter_key] < len(L) - 1:
        st[counter_key] -= 1

if reset:
    st[counter_key] = 0

if len(L):
    item = L[st[counter_key]]

if st[running_key]:
    if st[counter_key] < len(L) - 1:
        st[counter_key] += 1
        update_component(ghenv, interval)
    else:
        st[counter_key] = 0
        st[running_key] = False
# ---------- end counter ----------

# ---- group: Calculate joint positions for path / Shows joint positions along path (continued)
l2t = PythonScript(L=py_5, flip=flip_4)  # -> T; inputs L: list, flip: Boolean
# ---------- l2t: Python ----------
from compas_ghpython import list_to_ghtree
L = [l.joint_values for l in L]

if flip:
    L = zip(*L)
T = list_to_ghtree(L)
# ---------- end l2t ----------
graph_5 = QuickGraph(l2t, SortOrder=0)

# ---- group: Visualise (continued)
filter_8 = StreamFilter(Gate=list_9, Stream0=py_3, Stream1=inverse, Stream2=counter, Stream3=pose_joints)
configuration = Panel(filter_8)
draw = PythonScript(robot=robot_2, configuration=filter_8, mesh=mesh, brep=filter, show_brep=show_brep)  # -> meshes, tool0_plane, tcp_plane, robot_brep; inputs mesh: list, brep: list
# ---------- draw: Python ----------
from compas_ghpython import unload_modules
unload_modules("ur_online_control")

from compas_ghpython import xdraw_frame
from compas_ghpython import mesh_draw
from compas_ghpython.geometry.xforms import xform_from_transformation
from compas.geometry import Frame
from compas.geometry.xforms import Transformation
from ur_online_control.ur.robot import BaseConfiguration

import Rhino.Geometry as rg
import Rhino

def mesh_update_vertices(mesh, vertices):
    for i in range(len(vertices)):
        mesh.vertex[i].update({'x': vertices[i][0], 'y': vertices[i][1], 'z': vertices[i][2]})

if configuration:
    #print configuration
    #q = BaseConfiguration.from_joints(configuration)
    q = configuration
    print q
    print q.joint_values
    
    print robot.get_forward_transformations(q)
    R0, R1, R2, R3, R4, R5 = robot.get_forward_transformations(q)
    
    tool0_frame2 = robot.tool0_frame.transformed(R5)
    tcp_frame2 = Frame.from_transformation(Transformation.from_frame(tool0_frame2) * robot.transformation_tool0_tcp)
    
    print robot.transformation_tool0_tcp
    print robot.transformation_tcp_tool0
    print robot.transformation_tool0_tcp * robot.transformation_tcp_tool0
    print tcp_frame2
    tcp_frame2 = Frame.from_transformation(Transformation.from_frame(tool0_frame2) * robot.transformation_tcp_tool0)
    print tcp_frame2
    
    tool0_frame, tcp_frame = robot.get_transformed_tool_frames(R5)
    
    tool0_frame = tool0_frame2
    tcp_frame = tcp_frame2
    
    m0, m1, m2, m3, m4, m5 = mesh
    for i in range(6):
        exec("R%drg = xform_from_transformation(R%d)" % (i, i))
        exec("m%d.Transform(R%drg)" % (i, i))
    meshes = [m0, m1, m2, m3, m4, m5]
    print meshes
    mt = robot.tool.get_transformed_model(Transformation.from_frame(tool0_frame))
    
    if mt:
        meshes.extend(map(mesh_draw, mt))
    
    """
    m0, m1, m2, m3, m4, m5, tool0_frame, tcp_frame = robot.get_transformed_model(q)
    mt = robot.get_transformed_tool_model(tcp_frame)
    
    meshes = []
    meshes.append(mesh_draw(m0))
    meshes.append(mesh_draw(m1))
    meshes.append(mesh_draw(m2))
    meshes.append(mesh_draw(m3))
    meshes.append(mesh_draw(m4))
    meshes.append(mesh_draw(m5))
    if mt:
        meshes.append(mesh_draw(mt))
    
    """
    
    tool0_plane = xdraw_frame(tool0_frame)
    tcp_plane = xdraw_frame(tcp_frame)
    
    if show_brep:
        
        b0, b1, b2, b3, b4, b5 = brep
        
        b0.Transform(R0rg)
        b1.Transform(R1rg)
        b2.Transform(R2rg)
        b3.Transform(R3rg)
        b4.Transform(R4rg)
        b5.Transform(R5rg)
        
        robot_brep = [b0, b1, b2, b3, b4, b5]
# ---------- end draw ----------
tool0_plane = Plane(draw.tool0_plane)
tcp_plane = Plane(draw.tcp_plane)
robot_brep = Brep(draw.robot_brep)
draw_2 = RepresentPlaneAsLines(plane=tcp_plane, size=100)  # -> G, C
# ---------- draw_2: Python ----------
import Rhino.Geometry as rg
from System.Drawing import Color

if plane:

    G = []
    G.append(rg.Line(plane.Origin, size * plane.XAxis))
    G.append(rg.Line(plane.Origin, size * plane.YAxis))
    G.append(rg.Line(plane.Origin, size * plane.ZAxis))
    
    C = []
    C.append(Color.FromArgb(255, 0, 0))
    C.append(Color.FromArgb(0, 255, 0))
    C.append(Color.FromArgb(0, 0, 255))
# ---------- end draw_2 ----------
preview_2 = CustomPreview(Geometry=draw_2.G, Shader=draw_2.C)
preview_3 = CustomPreview(Geometry=draw.meshes, Shader=ColourSwatch(SwatchColor=RGBA(99, 94, 94, 96)))

# ---- group: Send joint position directly to robot (continued)
commands_2 = Data(python_9)
item_11 = ListItem(List=commands_2, Index=idx_2, Wrap=True)
filter_9 = StreamFilter(Gate=list_11, Stream0=commands_2, Stream1=item_11)
movel_4 = PythonScript(commands=filter_9, velocity=Slider(100, range=0..100))  # -> script; inputs commands: list
# ---------- movel_4: Python ----------
from scriptcontext import sticky as st

script_lines = []
for cmd in commands:
    #q, a=1.4, v=1.05, t=0, r=0)
    x, y, z, ax, ay, az, speed, radius = cmd
    script_lines.append("movel(p%s, v=%f, r=%f)" % (str([x/1000., y/1000., z/1000, ax, ay, az]), speed/1000., radius/1000.))

robot = st["robot"]
tool_angle_axis = list(robot.tool.tcp_frame.point) + robot.tool.tcp_frame.axis_angle_vector
x, y, z, ax, ay, az = tool_angle_axis

script = "def prog():\n"
script += "\ttextmsg(\">> program start\")\n"
script += "\tset_tcp(p%s)\n" % str([x/1000., y/1000., z/1000, ax, ay, az])
script += "".join(["\t%s\n" % line for line in script_lines])
script += "\ttextmsg(\"<< program end\")\n"
script += "end\n"
script += "prog()\n\n"

print script
# ---------- end movel_4 ----------
send_14 = Send(script=movel_4, send=send_12)
panel_32 = Panel(send_14)

joint_positions = Data(py_5)
item_12 = ListItem(List=joint_positions, Index=idx, Wrap=True)
filter_10 = StreamFilter(Gate=list_10, Stream0=joint_positions, Stream1=item_12)
movej = PythonScript(joint_positions=filter_10, velocity=Slider(153, range=0..200))  # -> script; inputs joint_positions: list
# ---------- movej: Python ----------
script_lines = []

for position in joint_positions:
    script_lines.append("movej(%s, v=%f)" % (str(position), velocity/1000.))


script = "def prog():\n"
script += "\ttextmsg(\">> program start\")\n"
script += "".join(["\t%s\n" % line for line in script_lines])
script += "\ttextmsg(\"<< program end\")\n"
script += "end\n"
script += "prog()\n\n"


print script

#script = ""
# ---------- end movej ----------

# ----
send_15 = Send(script=movej, send=send_11)

# ---- group: Send joint position directly to robot (continued)
panel_33 = Panel(send_15)

# ==== cluster Tools
brep = Brep([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])
tool_id = ClusterInput()

# ---- group: extruder
yaxis_line = Curve(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)
xaxis_line = Curve(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)
test_geometry = Geometry(brep)
brep_2 = Brep(test_geometry)
mesh = Mesh(test_geometry)
tool = Tool(meshes=mesh, breps=brep_2, xline=xaxis_line, yline=yaxis_line)

# ---- group: measurement tool
measurement_tool_geo = Geometry([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])
mesh_2 = Mesh(measurement_tool_geo)
mjoin = MeshJoin(Meshes=mesh_2)
tool_2 = PythonScript(meshes=mjoin, brep=measurement_tool_geo)  # -> tool; inputs meshes: list, brep: list
# ---------- tool_2: Python ----------
from ur_online_control.ur.tools import MeasurementTool
from compas.datastructures import Mesh
from compas_rhino.helpers import mesh_from_guid


tool = MeasurementTool()
tool.model = [mesh_from_guid(Mesh, mesh) for mesh in meshes]
#tool.model_xyz = tool.model.xyz
tool.brep = brep
# ---------- end tool_2 ----------

# ----
tool_id_2 = Integer(tool_id)
filter = StreamFilter(Gate=tool_id_2, Stream1=tool_2, Stream2=tool)
py = PythonScript(tool=filter)  # -> tcp_frame, model
# ---------- py: Python ----------
from compas_ghpython import mesh_draw 

tcp_frame = tool.tcp_frame
model = map(mesh_draw, tool.model)
# ---------- end py ----------
tool_3 = Data(filter)
draw = PythonScript(frame=py.tcp_frame)  # -> G, C
# ---------- draw: Python ----------
import Rhino.Geometry as rg
from System.Drawing import Color

if not size:
    size = 100

if frame:
    plane = rg.Plane(rg.Point3d(*list(frame.point)), rg.Vector3d(*list(frame.xaxis)), rg.Vector3d(*list(frame.yaxis)))

    G = []
    G.append(rg.Line(plane.Origin, size * plane.XAxis))
    G.append(rg.Line(plane.Origin, size * plane.YAxis))
    G.append(rg.Line(plane.Origin, size * plane.ZAxis))
    
    C = []
    C.append(Color.FromArgb(255, 0, 0))
    C.append(Color.FromArgb(0, 255, 0))
    C.append(Color.FromArgb(0, 0, 255))
# ---------- end draw ----------
tool_4 = ClusterOutput(tool_3)
preview = CustomPreview(Geometry=draw.G, Shader=draw.C)
preview_2 = CustomPreview(Geometry=py.model, Shader=ColourSwatch(SwatchColor=RGB(141, 170, 178)))

# ==== cluster Send
script = ClusterInput()
send = ClusterInput()
send_2 = PythonScript(script=script, send=send)  # -> out
# ---------- send_2: Python ----------
import socket
from scriptcontext import sticky as st

ur_ip = st["ur_ip"]
ur_port = 30002

if send:
    s = socket.create_connection((ur_ip, ur_port), timeout=0.5) 
    s.send(script)
    s.close()
# ---------- end send_2 ----------
out = ClusterOutput(send_2)

# ==== cluster Tools_2

# ---- group: spray_gun
brep = Brep([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])
yaxis_line = Curve(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)
xaxis_line = Curve(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)
test_geometry = Geometry(brep)
mesh = Mesh(test_geometry)
brep_2 = Brep(test_geometry)
tool = Tool_2(meshes=mesh, breps=brep_2, xline=xaxis_line, yline=yaxis_line)

# ----
brep_3 = Brep([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])
tool_id = ClusterInput()
yaxis_line_2 = Curve(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)
xaxis_line_2 = Curve(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)

# ---- group: extruder
test_geometry_2 = Geometry(brep_3)
mesh_2 = Mesh(test_geometry_2)
brep_4 = Brep(test_geometry_2)
tool_2 = Tool_2(meshes=mesh_2, breps=brep_4, xline=xaxis_line_2, yline=yaxis_line_2)

# ----
tool_id_2 = Integer(tool_id)
tool_3 = PythonScript()  # -> tool
# ---------- tool_3: Python ----------
from compas_fab.fab.geometry import Frame
from compas_fab.fab.robots import Tool
import Rhino.Geometry as rg
import math

startPlane = rg.Plane.WorldXY
startPlane2 = rg.Plane.WorldXY
rg.Plane.Rotate(startPlane2, math.radians(180), rg.Vector3d.XAxis, rg.Point3d(0.0, 0.0, 0.0))

xform = rg.Transform.ChangeBasis(startPlane, startPlane2)

print startPlane
print startPlane2
Frame([0,0,0],[1,0,0],[0,-1,0])
#tcp_frame = Frame.worldXY()
tcp_frame = Frame([0,0,0],[1,0,0],[0,-1,0])

tool = Tool(tcp_frame)
tool.model = []
tool.breps = []
# ---------- end tool_3 ----------
filter = StreamFilter(Gate=tool_id_2, Stream0=tool_3, Stream1=tool, Stream2=tool_2)
py = PythonScript(tool=filter)  # -> tcp_frame, model
# ---------- py: Python ----------
tcp_frame = tool.tcp_frame
model = tool.model
# ---------- end py ----------
draw = PythonScript(frame=py.tcp_frame)  # -> G, C
# ---------- draw: Python ----------
import Rhino.Geometry as rg
from System.Drawing import Color

if not size:
    size = 100

if frame:
    
    plane = rg.Plane(rg.Point3d(*frame.point), rg.Vector3d(*frame.xaxis), rg.Vector3d(*frame.yaxis))

    G = []
    G.append(rg.Line(plane.Origin, size * plane.XAxis))
    G.append(rg.Line(plane.Origin, size * plane.YAxis))
    G.append(rg.Line(plane.Origin, size * plane.ZAxis))
    
    C = []
    C.append(Color.FromArgb(255, 0, 0))
    C.append(Color.FromArgb(0, 255, 0))
    C.append(Color.FromArgb(0, 0, 255))
# ---------- end draw ----------
tool_4 = Data(filter)
tool_5 = ClusterOutput(tool_4)
preview = CustomPreview(Geometry=draw.G, Shader=draw.C)
preview_2 = CustomPreview(Geometry=py.model, Shader=ColourSwatch(SwatchColor=RGB(141, 170, 178)))

# ==== cluster Tool
breps = ClusterInput()
meshes = ClusterInput()
meshes_2 = Mesh(meshes)
mjoin = MeshJoin(Meshes=meshes_2)
xline = ClusterInput()
yline = ClusterInput()
tool = PythonScript(meshes=mjoin, breps=breps, xline=xline, yline=yline)  # -> tool; inputs meshes: list of Mesh, breps: list of Brep
# ---------- tool: Python ----------
import Rhino.Geometry as rg
from compas.geometry import Frame
from ur_online_control.ur.tool import Tool
from compas.datastructures import Mesh
from compas_rhino.helpers import mesh_from_guid

xaxis = rg.Line(xline.PointAtStart, xline.PointAtEnd)
yaxis = rg.Line(yline.PointAtStart, yline.PointAtEnd)

if xaxis.From.DistanceTo(yaxis.From) < 0.01:
    origin = xaxis.From
    xaxis = xaxis.Direction
    yaxis = yaxis.Direction
elif xaxis.To.DistanceTo(yaxis.To) < 0.01:
    origin = xaxis.To
    xaxis = -xaxis.Direction
    yaxis = -yaxis.Direction
elif xaxis.From.DistanceTo(yaxis.To) < 0.01:
    origin = xaxis.From
    xaxis = xaxis.Direction
    yaxis = -yaxis.Direction
elif xaxis.To.DistanceTo(yaxis.From) < 0.01:
    origin = xaxis.To
    xaxis = -xaxis.Direction
    yaxis = yaxis.Direction

xaxis.Unitize()
yaxis.Unitize()

print origin
print xaxis
print yaxis

tcp_frame = Frame(origin, xaxis, yaxis)

tool = Tool(tcp_frame)
tool.model = [mesh_from_guid(Mesh, mesh) for mesh in meshes]
#tool.model_xyz = tool.model.xyz
tool.breps = breps
# ---------- end tool ----------
tool_2 = ClusterOutput(tool)

# ==== cluster Tool_2
breps = ClusterInput()
meshes = ClusterInput()
meshes_2 = Mesh(meshes)
mjoin = MeshJoin(Meshes=meshes_2)
xline = ClusterInput()
yline = ClusterInput()
tool = PythonScript(meshes=mjoin, breps=breps, xline=xline, yline=yline)  # -> tool; inputs meshes: list of Mesh, breps: list of Brep
# ---------- tool: Python ----------
import Rhino.Geometry as rg
from compas_fab.fab.geometry import Frame
from compas_fab.fab.robots import Tool
from compas.datastructures.mesh import Mesh

xaxis = rg.Line(xline.PointAtStart, xline.PointAtEnd)
yaxis = rg.Line(yline.PointAtStart, yline.PointAtEnd)

if xaxis.From.DistanceTo(yaxis.From) < 0.01:
    origin = xaxis.From
    xaxis = xaxis.Direction
    yaxis = yaxis.Direction
elif xaxis.To.DistanceTo(yaxis.To) < 0.01:
    origin = xaxis.To
    xaxis = -xaxis.Direction
    yaxis = -yaxis.Direction
elif xaxis.From.DistanceTo(yaxis.To) < 0.01:
    origin = xaxis.From
    xaxis = xaxis.Direction
    yaxis = -yaxis.Direction
elif xaxis.To.DistanceTo(yaxis.From) < 0.01:
    origin = xaxis.To
    xaxis = -xaxis.Direction
    yaxis = yaxis.Direction

xaxis.Unitize()
yaxis.Unitize()

print origin
print xaxis
print yaxis

tcp_frame = Frame(origin, xaxis, yaxis)

tool = Tool(tcp_frame)
tool.model = meshes
tool.breps = breps
# ---------- end tool ----------
tool_2 = ClusterOutput(tool)
