# Grasshopper definition ur_online_control.ghx (Grasshopper 1.0.7)

# ----
# 1.
# Settings
# --> Set your IP address
# --> Set robot IP address
server_ip = ValueList({"192.168.10.44", "192.168.10.12", "192.168.10.11", "192.168.10.10", "192.168.10.2", "127.0.0.1"}, selected="192.168.10.44")
ur_ip = ValueList({"192.168.10.10", "192.168.10.11", "192.168.10.12", "127.0.0.1"}, selected="192.168.10.12")
server_port = Integer(30003)
globals = PythonScript(server_address=server_ip, server_port=server_port, ur_ip=ur_ip)  # inputs server_port: Int32
# ---------- globals: Python ----------
from scriptcontext import sticky as st

st["server_address"] = server_address
st["server_port"] = server_port

st["ur_ip"] = ur_ip
print st["ur_ip"]
# ---------- end globals ----------

# ----
# Check if UR is available
ping = Button()
py = PythonScript(ip=ur_ip, ping=ping)  # -> out, trigger
# ---------- py: Python ----------
from scriptcontext import sticky as st
from ur_online_control_py3.communication import is_available

guid = str(ghenv.Component.InstanceGuid)
txt_key = "txt_" + guid
if txt_key not in st:
    st[txt_key] = ""

if ping:
    
    available = is_available(ip)
    
    if available:
        st[txt_key] = "%s is up!" % ip
        trigger = True
    else:
        st[txt_key] = "%s is down!" % ip
        trigger = False

print(st[txt_key])
# ---------- end py ----------
panel = Panel(py.out)

bang = Button()
panel_2 = Panel("Unload libraries")
unload = PythonScript(bang=bang)
# ---------- unload: Python ----------
from compas_rhino.utilities.misc import get_tolerance
from compas_rhino.utilities.misc import unload_modules

unload_modules("compas")
unload_modules("compas_fab")
unload_modules("ur_online_control_py3")
# ---------- end unload ----------

# ----
# Here, you can set the basis for your robot
list = ValueList({"robot 1": "robot_1", "robot 2": "robot_2", "robot 3": "robot_3"}, selected="robot 1")

# ---- group: Robot
# 1. load robot model
# 2. set tool
# 3. set basis
list_2 = ValueList({"no_tool": 0, "measurement_tool": 1, "sand_deposition_tool": 2, "earth_deposition_tool": 3, "clay_subtraction_tool": 4, "pack_tool": 5}, selected="earth_deposition_tool")
base = PythonScript(rnum=list)  # -> base_frame
# ---------- base: Python ----------
from compas.geometry import Frame
#from compas.geometry import Transformation, Rotation
#from compas_ghpython import xdraw_frame
#import math
#import Rhino.Geometry as rg




# for robots 1 and 2

if rnum == "robot_1":
    origin = [-468.74, -100.60, 161.23]
    xaxis = [0.71376, 0.70037, 0.00520]
    yaxis = [-0.70037, 0.71364, 0.01408]
    

if rnum == "robot_2":
    origin = [-468.74, -100.60, 161.23]
    xaxis = [0.71376, 0.70037, 0.00520]
    yaxis = [-0.70037, 0.71364, 0.01408]


if rnum == "robot_3":
    origin = [-110.14, 465.76, 167.41]
    xaxis = [0.71228, -0.70189, -0.00042]
    yaxis = [0.70182, 0.71220, 0.01506]


base_frame = Frame(list(origin), list(xaxis), list(yaxis))
# ---------- end base ----------
tools = Tools(tool_id=list_2)
list_3 = ValueList({"UR10e"}, selected="UR10e")
robot = PythonScript(model=list_3)  # -> robot
# ---------- robot: Python ----------
from ur_online_control_py3.ur.ur10e import UR10e
from scriptcontext import sticky as st

if model == "UR10e":
    robot = UR10e()
# ---------- end robot ----------
set_params = PythonScript(robot=robot, tool=tools, base_frame=base)  # -> robot
# ---------- set_params: Python ----------
from ur_online_control_py3.ur.ur10e import UR10e
from scriptcontext import sticky as st
from ur_online_control_py3.ur.tool import Tool
from compas.geometry import Frame


if tool:
    robot.set_tool(tool)
else:
    robot.set_tool(Tool(Frame.worldXY()))  
if base_frame:
    robot.set_base(base_frame)

st["robot"] = robot
# ---------- end set_params ----------

# ----
# Fabrication process example #3 (Continuous Drive)
acceleration = Slider(100, range=0..100)

# ----
# The planes, speed-values, acceleration-values, and wait-time-values that are sent to the robot
number_slider = Slider(25, range=0..50)
distance = Number(100)
curve = Curve(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)
plane_generation = GhPythonScript(
    crv=curve,
    div_num=number_slider,
    speed=Slider(50, range=0..100),
    acceleration=acceleration,
    wait_time=Slider(0, range=0..10))  # -> out, planes_WCS, speed_values, acceleration_values, wait_time_values; inputs crv: Curve, div_num: Int32
# ---------- plane_generation: Python ----------
import Rhino.Geometry as rg
import ghpythonlib.components as ghcomp
from compas.geometry import Frame
from compas.geometry import Transformation
from compas_ghpython import draw_frame
import math


plane_WCS = rg.Plane.WorldXY
#plane_WCS.Rotate(math.radians(90), plane_WCS.ZAxis, plane_WCS.Origin)

div_pts, tangents, parmas = ghcomp.DivideCurve(crv, div_num, False)
planes_WCS_simple = [rg.Plane(pt, plane_WCS.XAxis, plane_WCS.YAxis) for pt in div_pts]


planes_WCS = []
speed_values = []
acceleration_values = []
wait_time_values = []

for i, p in enumerate(planes_WCS_simple):
    
    p_down = rg.Plane(p)
    p_down.Translate(rg.Vector3d(0,0, (math.sin(i)*10)-30))
    
    planes_WCS += [p, p_down]
    
    speed_values += [speed, speed]
    acceleration_values  += [acceleration, acceleration]
    wait_time_values  += [wait_time, wait_time]
# ---------- end plane_generation ----------
safe = PythonScript(planes_WCS=plane_generation.planes_WCS, safety_distance=distance)  # -> safety_planes_WCS; inputs planes_WCS: list
# ---------- safe: Python ----------
import Rhino.Geometry as rg
planes = planes_WCS
safety_planes_WCS = [rg.Plane(planes[-1].Origin + rg.Vector3d.ZAxis * safety_distance, planes[-1].XAxis, planes[-1].YAxis)]
# ---------- end safe ----------
command_gen = PythonScript(
    planes_WCS=plane_generation.planes_WCS,
    safety_planes_WCS=safe,
    speed_values=plane_generation.speed_values,
    acceleration_values=plane_generation.acceleration_values,
    wait_time_values=plane_generation.wait_time_values)  # -> out, commands, safety_commands; inputs planes_WCS: list of Plane, safety_planes_WCS: list of Plane, speed_values: list, acceleration_values: list, wait_time_values: list
# ---------- command_gen: Python ----------
import os
import Rhino.Geometry as rg
from scriptcontext import sticky as st
from ur_online_control_py3.communication.msg_identifiers import *
from ur_online_control_py3.utilities.lists import flatten_list
from compas.geometry import Frame, Transformation
from compas_ghpython import draw_frame
import json

robot = st["robot"]
tool = robot.tool
tool_pose = list(tool.tcp_frame.point) + list(tool.tcp_frame.axis_angle_vector)

#format planes into commands
commands = []
for i, plane_WCS in enumerate(planes_WCS):
    tcp_WCS = Frame(plane_WCS.Origin, plane_WCS.XAxis, plane_WCS.YAxis)
    
    #pose = robot.get_pose_angle_axis_in_RCS(tcp_WCS)
    tcp_RCS = robot.get_frame_in_RCS(tcp_WCS) 
    pose = list(tcp_RCS.point) + list(tcp_RCS.axis_angle_vector)

    speed = speed_values[i]
    acceleration = acceleration_values[i]
    wait_time_value = wait_time_values[i]
    cmd = pose + [acceleration, speed, wait_time_value]
    commands.append(cmd)

#format safety planes into commands
safety_commands = []
for i, plane_WCS in enumerate(safety_planes_WCS):
    tcp_WCS = Frame(plane_WCS.Origin, plane_WCS.XAxis, plane_WCS.YAxis)
    
    #pose = robot.get_pose_angle_axis_in_RCS(tcp_WCS)
    tcp_RCS = robot.get_frame_in_RCS(tcp_WCS) 
    pose = list(tcp_RCS.point) + list(tcp_RCS.axis_angle_vector)
    
    speed = 30
    acceleration = 50
    wait_time_value = 0
    cmd = pose + [acceleration, speed, wait_time_value]
    safety_commands.append(cmd)
# ---------- end command_gen ----------

# ----
# Fabrication process example #1 (Deposition)
acceleration_2 = Slider(80, range=0..100)

# ----
# 4.
# The planes, speed-values, acceleration-values, and wait-time-values that are sent to the robot
number_slider_2 = Slider(10, range=0..50)
distance_2 = Number(100)
curve_2 = Curve(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)
plane_generation_2 = GhPythonScript(
    crv=curve_2,
    div_num=number_slider_2,
    speed=Slider(30, range=0..100),
    acceleration=acceleration_2,
    wait_time=Slider(2, range=0..10))  # -> out, planes_WCS, speed_values, acceleration_values, wait_time_values; inputs crv: Curve, div_num: Int32
# ---------- plane_generation_2: Python ----------
import Rhino.Geometry as rg
import ghpythonlib.components as ghcomp
from compas.geometry import Frame
from compas.geometry import Transformation
from compas_ghpython import draw_frame
import math


plane_WCS = rg.Plane.WorldXY
#plane_WCS.Rotate(math.radians(90), plane_WCS.ZAxis, plane_WCS.Origin)

div_pts, tangents, parmas = ghcomp.DivideCurve(crv, div_num, False)
planes_WCS = [rg.Plane(pt, plane_WCS.XAxis, plane_WCS.YAxis) for pt in div_pts]


speed_values = []
acceleration_values = []
wait_time_values = []

for i, p in enumerate(planes_WCS):
    if i%2==0:
        speed_values.append(speed)
        acceleration_values.append(acceleration)
        wait_time_values.append(wait_time)
    else:
        speed_values.append(speed)
        acceleration_values.append(acceleration)
        wait_time_values.append(wait_time*2)
# ---------- end plane_generation_2 ----------
safe_2 = PythonScript(planes_WCS=plane_generation_2.planes_WCS, safety_distance=distance_2)  # -> safety_planes_WCS; inputs planes_WCS: list; same code as safe
command_gen_2 = PythonScript(
    planes_WCS=plane_generation_2.planes_WCS,
    safety_planes_WCS=safe_2,
    speed_values=plane_generation_2.speed_values,
    acceleration_values=plane_generation_2.acceleration_values,
    wait_time_values=plane_generation_2.wait_time_values)  # -> out, commands, safety_commands; inputs planes_WCS: list of Plane, safety_planes_WCS: list of Plane, speed_values: list, acceleration_values: list, wait_time_values: list
# ---------- command_gen_2: Python ----------
import os
import Rhino.Geometry as rg
from scriptcontext import sticky as st
from ur_online_control_py3.communication.msg_identifiers import *
from ur_online_control_py3.utilities.lists import flatten_list
from compas.geometry import Frame, Transformation
from compas_ghpython import draw_frame
import json

robot = st["robot"]
tool = robot.tool
tool_pose = list(tool.tcp_frame.point) + list(tool.tcp_frame.axis_angle_vector)

#format planes into commands
commands = []
for i, plane_WCS in enumerate(planes_WCS):
    tcp_WCS = Frame(plane_WCS.Origin, plane_WCS.XAxis, plane_WCS.YAxis)
    #pose = robot.get_pose_angle_axis_in_RCS(tcp_WCS) #tcp_RCS = robot.get_frame_in_RCS(tcp_WCS) #pose = list(tcp_RCS.point) + tcp_RCS.axis_angle_vector
    tcp_RCS = robot.get_frame_in_RCS(tcp_WCS)
    pose = list(tcp_RCS.point) + list(tcp_RCS.axis_angle_vector)
    
    speed = speed_values[i]
    acceleration = acceleration_values[i]
    wait_time_value = wait_time_values[i]
    cmd = pose + [acceleration, speed, wait_time_value]
    commands.append(cmd)

#format safety planes into commands
safety_commands = []
for i, plane_WCS in enumerate(safety_planes_WCS):
    tcp_WCS = Frame(plane_WCS.Origin, plane_WCS.XAxis, plane_WCS.YAxis)
    #pose = robot.get_pose_angle_axis_in_RCS(tcp_WCS) #tcp_RCS = robot.get_frame_in_RCS(tcp_WCS) #pose = list(tcp_RCS.point) + tcp_RCS.axis_angle_vector
    tcp_RCS = robot.get_frame_in_RCS(tcp_WCS)
    pose = list(tcp_RCS.point) + list(tcp_RCS.axis_angle_vector)
    
    speed = 30
    acceleration = 50
    wait_time_value = 0
    cmd = pose + [acceleration, speed, wait_time_value]
    safety_commands.append(cmd)
# ---------- end command_gen_2 ----------

# ----
# 3.
# UR online control
# If the connection is lost, please restart the connection here.
# Press here to send the commands
# to the robot
start = Button()

panel_3 = Panel("Get UR connected")
ur = PythonScript(send=start)
# ---------- ur: Python ----------
from scriptcontext import sticky as st
from ur_online_control_py3.ur_driver import URDriver

server_address = st["server_address"]
server_port = st["server_port"]
ur_ip = st["ur_ip"]
robot = st["robot"]

tool_angle_axis = list(robot.tool.tcp_frame.point) + list(robot.tool.tcp_frame.axis_angle_vector)
#robot.tool.tcp_frame.pose_axis_angle_vector
print tool_angle_axis

ur_driver = URDriver(server_address, server_port, tool_angle_axis, ur_ip, "UR")
print ur_driver

if send:
    ur_driver.send()
# ---------- end ur ----------

connect = Button()

panel_4 = Panel("Get Grasshopper connected")
disconnect = Button()
client = PythonScript(connect=connect, disconnect=disconnect)  # -> connected, client; inputs disconnect: Boolean
# ---------- client: Python ----------
import time
from scriptcontext import sticky as st
from Rhino.RhinoApp import WriteLine
from ur_online_control.ghpython import GHClient, gh_component_timer
import time

server_address = st["server_address"]
server_port = st["server_port"]

guid = str(ghenv.Component.InstanceGuid)

client_key = "client_" + guid
run_key = "run_" + guid

if connect:
    if client_key not in st:
        st[client_key] = GHClient(server_address, server_port)
        client = st[client_key]
        client.connect_to_server()
        client.start()
        
    else:
        if st[client_key].running:
            WriteLine("Client is already connected.")
            
        else:
            st[client_key] = GHClient(server_address, server_port)
            client = st[client_key]
            client.connect_to_server()
            client.start()
"""
else:
    if client_key in st:
        # we need a timer to ask if we have something on the rcv queue
        client = st[client_key]
        #if client.running:
        #    #client.run_inner_while()
        #    gh_component_timer(ghenv, True, 1000)
"""

if disconnect:
    #print "disconnecting"
    if client_key in st:
        client = st[client_key]
        if client.running:
            client.close()

if client_key in st:
    connected =  st[client_key].running
    client = st[client_key]
    print st[client_key].rcv_queue.qsize()
    print st[client_key].snd_queue.qsize()
else:
    connected = False
# ---------- end client ----------
panel_5 = Panel(client.connected)

# ----
# Press here to send the commands
# to the robot
continue_fabrication = BooleanToggle(True)
send = Button()
send_2 = PythonScript(
    client=client.client,
    send=send,
    continue_fabrication=continue_fabrication,
    commands=command_gen.commands,
    safety_commands=command_gen.safety_commands)  # -> out, commands; inputs continue_fabrication: Int32, commands: list, safety_commands: list
# ---------- send_2: Python ----------
import os
import Rhino.Geometry as rg
from scriptcontext import sticky as st
from ur_online_control_py3.communication.msg_identifiers import *
from ur_online_control_py3.utilities.lists import flatten_list
from compas.geometry import Frame, Transformation
from compas_ghpython import draw_frame
import json

robot = st["robot"]
tool = robot.tool
tool_pose = list(tool.tcp_frame.point) + list(tool.tcp_frame.axis_angle_vector)

if "commands_to_execute" not in st:
    st["commands_to_execute"] = 0

commands_flattened = flatten_list(commands)
safety_commands_flattened = flatten_list(safety_commands)

print(safety_commands_flattened)

len_command = len(commands[0])
len_commands = int(len(commands_flattened)/len_command)
print("length of commands: ", len_commands)
print("length of command: ", len_command)

if send and client:
    # 1. send continue fabrication
    client.send(MSG_INT, int(continue_fabrication))
    
    # 2. send tool tcp
    client.send(MSG_FLOAT_LIST, tool_pose) # set tool tcp
    
    # 3. send command length
    client.send(MSG_INT, len_command)
    
    # 4. send commands
    client.send(MSG_FLOAT_LIST, commands_flattened)
    
    # 5. send safety commands
    client.send(MSG_FLOAT_LIST, safety_commands_flattened)
    
    st["commands_to_execute"] = len_commands
    st["current_number"] = 0
# ---------- end send_2 ----------

# ----
# Press here to send the commands
# to the robot
continue_fabrication_2 = BooleanToggle(True)
send_3 = Button()
send_4 = PythonScript(
    client=client.client,
    send=send_3,
    continue_fabrication=continue_fabrication_2,
    commands=command_gen_2.commands,
    safety_commands=command_gen_2.safety_commands)  # -> out, commands; inputs continue_fabrication: Int32, commands: list, safety_commands: list; same code as send_2

# ----
# This component updates on receive
bang_2 = Button()
receive = PythonScript(client=client.client, bang=bang_2)  # -> qsize, client
# ---------- receive: Python ----------
from ur_online_control.communication.msg_identifiers import *
from ur_online_control.utilities.lists import flatten_list
from Rhino.RhinoApp import WriteLine

if client:
    if not client.ghenv:
        client.ghenv = ghenv
    qsize = client.rcv_queue.qsize()
# ---------- end receive ----------
panel_6 = Panel(receive.qsize)

# ----
# This is sent after every pose reached
time = Slider(0, range=0..3)
send_5 = PythonScript(client=receive.client, wait_time=time, pause=Toggle(False), continue_loop=Button())  # -> msg, commands_to_execute, pose_joints, bang; inputs pause: Boolean, continue_loop: Boolean
# ---------- send_5: Python ----------
from ur_online_control.communication.msg_identifiers import *
from ur_online_control.utilities.lists import flatten_list
import os
import json
from compas_fab.robots import Configuration

from scriptcontext import sticky as st

guid = str(ghenv.Component.InstanceGuid)
msg_key = "msg_" + guid

path = st["json_path"]
current_number_file = os.path.join(path, "current_number.txt")

if msg_key not in st:
    st[msg_key] = []

if client:
    qsize = client.rcv_queue.qsize()
    if qsize:
        st["commands_to_execute"] -= 1
        st["current_number"] += 1
        # save data into json file
        with open(current_number_file, 'w') as f:
            json.dump({"current_number": st["current_number"]}, f)
        msg = client.rcv_queue.get()
        st[msg_key] = msg
        client.send(MSG_FLOAT_LIST, [wait_time])
        client.send(MSG_INT, int(pause))

if continue_loop:
    client.send(MSG_INT, int(1))
        

msg = st[msg_key]
bang = True
commands_to_execute = st["commands_to_execute"]

if len(msg) == 6:
    pose_joints = Configuration.from_revolute_values(msg)
else:
    pose_joints = Configuration.from_revolute_values([0,0,0,0,0,0])
# ---------- end send_5 ----------
panel_7 = Panel(send_5.msg)
commands_to_execute = Panel(send_5.commands_to_execute)

get = Button()
pose = PythonScript(get=get, get_init=py.trigger)  # -> pose_joints
# ---------- pose: Python ----------
from scriptcontext import sticky as st
from ur_online_control_py3.ur_direct import get_current_pose_joints
#from compas_fab.robots import Configuration
from ur_online_control_py3.ur.robot import BaseConfiguration





server_address = st["server_address"]
server_port = 30005
ur_ip = st["ur_ip"]
robot = st["robot"]
tool_angle_axis = list(robot.tool.tcp_frame.point) + list(robot.tool.tcp_frame.axis_angle_vector)
print tool_angle_axis

guid = str(ghenv.Component.InstanceGuid)
pose_joints_key = "pose_joints" + guid


if get or get_init:
    st[pose_joints_key] = get_current_pose_joints(server_address, server_port, ur_ip, tool_angle_axis)
    
if pose_joints_key not in st:
    #pose_joints = Configuration.from_revolute_values([0,0,0,0,0,0])
    pose_joints = BaseConfiguration.from_joints([0,0,0,0,0,0])
else:
    #pose_joints = Configuration.from_revolute_values(st[pose_joints_key])
    pose_joints = BaseConfiguration.from_joints(st[pose_joints_key])
# ---------- end pose ----------
panel_8 = Panel("get pose joint")
panel_9 = Panel(pose)

panel_10 = Panel("get pose cartesian")
get_2 = Button()
pose_2 = PythonScript(get=get_2)  # -> pose_cartesian
# ---------- pose_2: Python ----------
from scriptcontext import sticky as st
from ur_online_control_py3.ur_direct import get_current_pose_cartesian

server_address = st["server_address"]
server_port = 30005
ur_ip = st["ur_ip"]
robot = st["robot"]
tool_angle_axis = list(robot.tool.tcp_frame.point) + list(robot.tool.tcp_frame.axis_angle_vector)
print(tool_angle_axis)

guid = str(ghenv.Component.InstanceGuid)
pose_cartesian_key = "pose_cartesian" + guid


if get:
    st[pose_cartesian_key] = get_current_pose_cartesian(server_address, server_port, ur_ip, tool_angle_axis)

if pose_cartesian_key not in st:
    pose_cartesian = []
else:
    pose_cartesian = st[pose_cartesian_key]
# ---------- end pose_2 ----------
py_2 = PythonScript(pose_cartesian=pose_2)  # -> frame_WCS; inputs pose_cartesian: list
# ---------- py_2: Python ----------
import Rhino.Geometry as rg
from scriptcontext import sticky as st
from compas.geometry import Frame
from compas.geometry.xforms import Transformation

robot = st["robot"]

print pose_cartesian
if pose_cartesian:
    #frame_RCS = Frame.from_pose_axis_angle_vector(pose_cartesian)
    frame_RCS = Frame.from_axis_angle_vector(axis_angle_vector=pose_cartesian[3:], point=pose_cartesian[:3])
    frame_WCS = robot.get_frame_in_WCS(frame_RCS)
    
    print frame_RCS
# ---------- end py_2 ----------
panel_11 = Panel(pose_2)
draw = Draw(frame=py_2)  # -> G, C
preview = CustomPreview(Geometry=draw.G, Shader=draw.C)

stop = Button()
stop_2 = PythonScript(stop=stop)
# ---------- stop_2: Python ----------
from scriptcontext import sticky as st
from ur_online_control_py3.ur_direct import stop as stop_robot

ur_ip = st["ur_ip"]

if stop:
    stop_robot(ur_ip)
# ---------- end stop_2 ----------

# ----
# Direct UR control
panel_12 = Panel("stop")

# ----
# Calculate basis
# Measure basis:
# 1. Clear the recorded poses
# 2. Move robot to origin and press "get pose"
# 3. Move robot to point in positive x-axis and press "get pose"
# 4. Move robot to an other point in your basis and press "get pose"
# (The further away these positions are, the better)
# 
# 5. Alternatively change the order in the component calc base
# 6. Copy output into base component
list_4 = ValueList({"origin, pt on positive x-axis, pt in xy plane": 0, "origin, pt on positive y-axis, pt in xy plane": 1}, selected="origin, pt on positive x-axis, pt in xy plane")
clear = Button()
rec = PythonScript(msg=pose_2, rec=get_2, clear=clear)  # -> rec; inputs msg: list
# ---------- rec: Python ----------
from scriptcontext import sticky as st

guid = str(ghenv.Component.InstanceGuid)
recorded_key =  "recorded_" + guid
just_cleared_key = "just_cleared_" + guid


if recorded_key not in st:
    st[recorded_key] = []

if just_cleared_key not in st:
    st[just_cleared_key] = False

if clear:
    st[recorded_key] = []
    st[just_cleared_key] = True
else:
    if len(msg):
        if msg != [None] and not st[just_cleared_key] and rec:
            st[recorded_key].append(msg)
    st[just_cleared_key] = False
        


rec = st[recorded_key]

print rec
# ---------- end rec ----------
calc_base = PythonScript(poses=rec, input_type=list_4)  # -> out; inputs poses: list
# ---------- calc_base: Python ----------
import Rhino.Geometry as rg
import math


if len(poses) > 2:
    
    O = poses[0]
    P1 = poses[1]
    P2 = poses[2]
    
    if input_type == 0:
        # origin, pt on positive x-axis, pt in xy plane
        origin = rg.Point3d(O[0], O[1], O[2])
        pt_on_xaxis = rg.Point3d(P1[0], P1[1], P1[2])
        pt_in_xyplane = rg.Point3d(P2[0], P2[1], P2[2])
        
        xaxis = pt_on_xaxis - origin
        xaxis.Unitize()
        
        v = pt_in_xyplane - origin
        zaxis = rg.Vector3d.CrossProduct(v, xaxis)
        zaxis.Unitize()
        
        # zaxis must look up!
        if math.acos(rg.Vector3d.ZAxis * zaxis) > math.acos(rg.Vector3d.ZAxis * -zaxis):
            zaxis = -zaxis
        
        yaxis = rg.Vector3d.CrossProduct(zaxis, xaxis)
    
    elif input_type == 1:
        # origin, pt on positive y-axis, pt in xy plane
        origin = rg.Point3d(O[0], O[1], O[2])
        pt_on_yaxis = rg.Point3d(P1[0], P1[1], P1[2])
        pt_in_xyplane = rg.Point3d(P2[0], P2[1], P2[2])
        
        yaxis = pt_on_yaxis - origin
        yaxis.Unitize()
        
        v = pt_in_xyplane - origin
        zaxis = rg.Vector3d.CrossProduct(v, yaxis)
        zaxis.Unitize()
        
        # zaxis must look up!
        if math.acos(rg.Vector3d.ZAxis * zaxis) > math.acos(rg.Vector3d.ZAxis * -zaxis):
            zaxis = -zaxis
        
        xaxis = rg.Vector3d.CrossProduct(yaxis, zaxis)
        
        
    print "Copy the following into base component:"
    print " "
    print "origin = [%.2f, %.2f, %.2f]" % tuple(list(origin))
    print "xaxis = [%.5f, %.5f, %.5f]" % tuple(list(xaxis))
    print "yaxis = [%.5f, %.5f, %.5f]" % tuple(list(yaxis))
    

#print rg.Vector3d.CrossProduct(rg.Vector3d.YAxis, rg.Vector3d.ZAxis)
#print rg.Vector3d.CrossProduct(rg.Vector3d.ZAxis, rg.Vector3d.XAxis)
# ---------- end calc_base ----------
panel_13 = Panel(rec)
panel_14 = Panel(calc_base)

# ---- group: Define joint positions
base_2 = Slider(0, range=-360..360)
shoulder = Slider(0, range=-360..360)
elbow = Slider(0, range=-360..360)
wrist1 = Slider(0, range=-360..360)
wrist2 = Slider(0, range=-360..360)
wrist3 = Slider(0, range=-360..360)
ur1_q1_q6 = Data([base_2, shoulder, elbow, wrist1, wrist2, wrist3])

# ----
number = Slider(0, range=0..10)
panel_15 = Panel("set digital out")
value = BooleanToggle(False)
digital_out = PythonScript(number=number, value=value)  # -> script; inputs number: Int32, value: Boolean
# ---------- digital_out: Python ----------
script = "def prog():\n"
script += "\ttextmsg(\">> program start\")\n"
script += "\tset_digital_out(%i, %s)\n" % (int(number), str(value))
script += "\ttextmsg(\"<< program end\")\n"
script += "end\n"
script += "prog()\n\n"

print(script)
# ---------- end digital_out ----------
send_6 = Button()
send_7 = Send(script=digital_out, send=send_6)
panel_16 = Panel(send_7)

# ---- group: Visualise / robot model brep
show_brep = BooleanToggle(False)
ur10_brep = UR10Brep([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])

# ----
# move incremental in WCS
number_slider_3 = Slider(5, range=-10..10)
list_5 = ValueList({"xaxis", "yaxis", "zaxis"}, selected="zaxis")
movel = PythonScript(step_size=number_slider_3, direction=list_5)  # -> script
# ---------- movel: Python ----------
from scriptcontext import sticky as st

robot = st["robot"]
tool_angle_axis = list(robot.tool.tcp_frame.point) + list(robot.tool.tcp_frame.axis_angle_vector)
x, y, z, ax, ay, az = tool_angle_axis

script = "def prog():\n"
script += "\ttextmsg(\">> program start\")\n"
script += "\tset_tcp(p%s)\n" % str([x/1000., y/1000., z/1000, ax, ay, az])
script += "\tcurrent_pose = get_forward_kin()\n"


if direction == "xaxis":
    script += "\tmovel(p[current_pose[0] + %f, current_pose[1], current_pose[2], current_pose[3], current_pose[4], current_pose[5]], t=%f)\n" % (step_size/1000., step_size * 0.1)

elif direction == "yaxis":
    script += "\tmovel(p[current_pose[0], current_pose[1] + %f, current_pose[2], current_pose[3], current_pose[4], current_pose[5]], t=%f)\n" % (step_size/1000., step_size * 0.1)

else: # direction == "zaxis":
    script += "\tmovel(p[current_pose[0], current_pose[1], current_pose[2] + %f, current_pose[3], current_pose[4], current_pose[5]], t=%f)\n" % (step_size/1000., step_size * 0.1)

script += "\ttextmsg(\"<< program end\")\n"
script += "end\n"
script += "prog()\n\n"

print(script)
# ---------- end movel ----------
send_8 = Button()
send_9 = Send(script=movel, send=send_8)
panel_17 = Panel(send_9)

panel_18 = Panel("reorient tool vertical")
movel_2 = PythonScript()  # -> script
# ---------- movel_2: Python ----------
from scriptcontext import sticky as st

robot = st["robot"]
tool_angle_axis = list(robot.tool.tcp_frame.point) + list(robot.tool.tcp_frame.axis_angle_vector)
x, y, z, ax, ay, az = tool_angle_axis

script = "def prog():\n"
script += "\ttextmsg(\">> program start\")\n"
script += "\tset_tcp(p%s)\n" % str([x/1000., y/1000., z/1000, ax, ay, az])
script += "\tcurrent_pose = get_forward_kin()\n"
script += "\tmovel(p[current_pose[0], current_pose[1], current_pose[2], 0, 0, 0], a=0.1, v=0.1)\n"
script += "\ttextmsg(\"<< program end\")\n"
script += "end\n"
script += "prog()\n\n"

print(script)
# ---------- end movel_2 ----------
send_10 = Button()
send_11 = Send(script=movel_2, send=send_10)
panel_19 = Panel(send_11)

# ----
# move incremental in TCS
number_slider_4 = Slider(5, range=-10..10)
get_current_pose = Button()
list_6 = ValueList({"xaxis", "yaxis", "zaxis"}, selected="yaxis")
movel_3 = PythonScript(get=get_current_pose, step_size=number_slider_4, direction=list_6)  # -> script; inputs get: list
# ---------- movel_3: Python ----------
from scriptcontext import sticky as st
from compas.geometry import Frame
from compas.geometry import Point, Vector
from ur_online_control_py3.ur_direct import get_current_pose_cartesian

server_address = st["server_address"]
server_port = 30005
ur_ip = st["ur_ip"]
robot = st["robot"]
tool_angle_axis = list(robot.tool.tcp_frame.point) + list(robot.tool.tcp_frame.axis_angle_vector)
print(tool_angle_axis)

guid = str(ghenv.Component.InstanceGuid)
pose_cartesian_key = "pose_cartesian" + guid

if get:
    st[pose_cartesian_key] = get_current_pose_cartesian(server_address, server_port, ur_ip, tool_angle_axis)

if pose_cartesian_key not in st:
    pose_cartesian = []
    script = ""
else:
    pose_cartesian = st[pose_cartesian_key]

    robot = st["robot"]
    tool_angle_axis = list(robot.tool.tcp_frame.point) + list(robot.tool.tcp_frame.axis_angle_vector)
    x, y, z, ax, ay, az = tool_angle_axis
    
    script = "def prog():\n"
    script += "\ttextmsg(\">> program start\")\n"
    script += "\tset_tcp(p%s)\n" % str([x/1000., y/1000., z/1000, ax, ay, az])
    script += "\tcurrent_pose = get_forward_kin()\n"
    
#    frame = Frame.from_pose_axis_angle_vector(pose_cartesian)
    frame = Frame.from_axis_angle_vector([ax, ay, az])
    frame.point = [x, y, z]

    if direction == "xaxis":
        next_vector = Vector(*frame.xaxis) * step_size
    elif direction == "yaxis":
        next_vector = Vector(*frame.yaxis) * step_size
    else: # direction == "zaxis":
        next_vector = Vector(*frame.zaxis) * step_size
    
    x, y, z = next_vector
    script += "\tmovel(p[current_pose[0] + %f, current_pose[1] + %f, current_pose[2] + %f, current_pose[3], current_pose[4], current_pose[5]], t=%f)\n" % (x/1000., y/1000., z/1000., step_size * 0.1)
    
    script += "\ttextmsg(\"<< program end\")\n"
    script += "end\n"
    script += "prog()\n\n"
    
    print(script)
# ---------- end movel_3 ----------
send_12 = Button()
send_13 = Send(script=movel_3, send=send_12)
panel_20 = Panel(send_13)

# ----
# The planes, speed-values, and io-values that are sent to the robot
c = Slider(20, range=0..100)
s = Slider(38, range=0..100)
s_2 = Slider(40, range=0..100)
acceleration_3 = Slider(100, range=0..100)
geometry = Geometry(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)
geometry_2 = Geometry(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)
populate_2d = Populate2D(Region=geometry, Count=c, Seed=s)
populate_2d_2 = Populate2D(Region=geometry_2, Count=c, Seed=s_2)
distance_3 = Number(100)
crv_gen = GhPythonScript(pts_up=populate_2d, pts_down=populate_2d_2)  # -> out, lines, pts; inputs pts_up: list of Point3d, pts_down: list of Point3d
# ---------- crv_gen: Python ----------
import Rhino.Geometry as rg
import ghpythonlib.components as ghcomp
from compas.geometry import Frame
from compas.geometry import Transformation
from compas_ghpython import draw_frame
import math



def find_closest_point(p, pts_down):
    
    min_dist = 10000   
    cp = pts_down[0]
    
    for pd in pts_down:
        dist = p.DistanceTo(pd)
        if dist < min_dist:
            min_dist = dist
            cp = pd
    
    pts_down.remove(cp)
    return cp, pts_down
    

lines = []
pts = []
for p in pts_up:
    
    neighbor, pts_down = find_closest_point(p, pts_down)
    line = rg.Line(p, neighbor)
    if line.Length < 90:
        lines.append(line)
        pts+=[line.From, line.To]
# ---------- end crv_gen ----------

# ----
# Fabrication process example #2 (Extraction)
lines = Line(crv_gen.lines)

plane_generation_3 = GhPythonScript(lines=lines)  # -> out, planes_WCS, speed_values, io_values; inputs lines: list of Line
# ---------- plane_generation_3: Python ----------
import Rhino.Geometry as rg
import ghpythonlib.components as ghcomp
from compas.geometry import Frame
from compas.geometry import Transformation
from compas_ghpython import draw_frame
import math


plane_WCS = rg.Plane.WorldXY
#plane_WCS.Rotate(math.radians(-90), plane_WCS.ZAxis, plane_WCS.Origin)


planes_WCS = []
speed_values = [] #storing the speeds at each plane
io_values = [] #storing the value of the io at each plane

for line in lines:
    
    start_pt = line.From
    end_pt = line.To
    zaxis = rg.Vector3d(end_pt - start_pt)
    zaxis.Unitize()
    
    yaxis = rg.Vector3d.CrossProduct(plane_WCS.XAxis, zaxis)
    xaxis = -rg.Vector3d.CrossProduct(plane_WCS.YAxis, zaxis)
    
    plane_up = rg.Plane(start_pt, xaxis, yaxis)
    plane_down = rg.Plane(end_pt, xaxis, yaxis)
    
    
    # change this part here
    planes_WCS += [plane_up, plane_down, plane_up]
    speed_values += [30, 5, 20]
    io_values += [0, 1, 0]
# ---------- end plane_generation_3 ----------
safe_3 = PythonScript(planes_WCS=plane_generation_3.planes_WCS, safety_distance=distance_3)  # -> safety_planes_WCS; inputs planes_WCS: list; same code as safe
command_gen_3 = PythonScript(
    planes_WCS=plane_generation_3.planes_WCS,
    safety_planes_WCS=safe_3,
    speed_values=plane_generation_3.speed_values,
    io_values=plane_generation_3.io_values,
    acceleration=acceleration_3)  # -> out, commands, safety_commands; inputs planes_WCS: list of Plane, safety_planes_WCS: list of Plane, speed_values: list, io_values: list of Int32
# ---------- command_gen_3: Python ----------
import os
import Rhino.Geometry as rg
from scriptcontext import sticky as st
from ur_online_control_py3.communication.msg_identifiers import *
from ur_online_control_py3.utilities.lists import flatten_list
from compas.geometry import Frame, Transformation
from compas_ghpython import draw_frame
import json

robot = st["robot"]
tool = robot.tool
tool_pose = list(tool.tcp_frame.point) + list(tool.tcp_frame.axis_angle_vector)

#format planes into commands
commands = []
for i, plane_WCS in enumerate(planes_WCS):
    tcp_WCS = Frame(plane_WCS.Origin, plane_WCS.XAxis, plane_WCS.YAxis)
    
    #pose = robot.get_pose_angle_axis_in_RCS(tcp_WCS) 
    tcp_RCS = robot.get_frame_in_RCS(tcp_WCS) 
    pose = list(tcp_RCS.point) + list(tcp_RCS.axis_angle_vector)

    speed = speed_values[i]
    io_value = io_values[i]
    cmd = pose + [acceleration, speed, io_value]
    commands.append(cmd)

#format safety planes into commands
safety_commands = []
for i, plane_WCS in enumerate(safety_planes_WCS):
    tcp_WCS = Frame(plane_WCS.Origin, plane_WCS.XAxis, plane_WCS.YAxis)
    
    #pose = robot.get_pose_angle_axis_in_RCS(tcp_WCS) 
    tcp_RCS = robot.get_frame_in_RCS(tcp_WCS) 
    pose = list(tcp_RCS.point) + list(tcp_RCS.axis_angle_vector)
    
    speed = 50
    io_value = 0
    cmd = pose + [acceleration, speed, io_value]
    safety_commands.append(cmd)
# ---------- end command_gen_3 ----------

# ----
# Press here to send the commands
# to the robot
continue_fabrication_3 = BooleanToggle(True)
send_14 = Button()
send_15 = PythonScript(
    client=client.client,
    send=send_14,
    continue_fabrication=continue_fabrication_3,
    commands=command_gen_3.commands,
    safety_commands=command_gen_3.safety_commands)  # -> out, commands; inputs continue_fabrication: Int32, commands: list, safety_commands: list; same code as send_2

speed = Slider(20, range=0..300)
list_7 = ValueList({"example #1": 0, "example #2": 1, "example #3": 2}, selected="example #1")
panel_21 = Panel("Choose the example")
stream_filter = StreamFilter(
    Gate=list_7,
    Stream0=plane_generation_2.planes_WCS,
    Stream1=plane_generation_3.planes_WCS,
    Stream2=plane_generation.planes_WCS)
python = PythonScript(planes_WCS=stream_filter, dfillet=Slider(20, range=0..100), speed=speed)  # -> commands; inputs planes_WCS: list, speed: Int32
# ---------- python: Python ----------
import Rhino.Geometry as rg
from compas.geometry import Frame
from compas.geometry import Transformation
from compas_ghpython import draw_frame
from scriptcontext import sticky as st

robot = st["robot"]
buffer = 0.7

# TODO this must be optimized! matrix multiplication!
commands = []
for i, plane_WCS in enumerate(planes_WCS):
    tcp_WCS = Frame(plane_WCS.Origin, plane_WCS.XAxis, plane_WCS.YAxis)
    if i == 0 or i == len(planes_WCS) - 1:
        radius = 0.
        
    else:
        # calculate blend radius
        prev, current, next = planes_WCS[i-1].Origin, planes_WCS[i].Origin, planes_WCS[i+1].Origin
        radius = min((prev - current).Length/2 * buffer, (next - current).Length/2 * buffer, dfillet)
    
    tcp_RCS = robot.get_frame_in_RCS(tcp_WCS)
    
    cmd = list(tcp_RCS.point) + list(tcp_RCS.axis_angle_vector) + [speed, radius]
    #cmd = list(tcp_RCS.point) + tcp_RCS.axis_angle_vector + [time, radius]
    commands.append(cmd)
    
    
    
print (commands)
# ---------- end python ----------
point = Point(stream_filter)
polyline = PolyLine(Vertices=stream_filter, Closed=False)
curve_3 = Curve(polyline)
preview_2 = CustomPreview(Geometry=[curve_3, point], Shader=ColourSwatch(SwatchColor=RGB(255, 94, 94)))
preview_3 = CustomPreview(Geometry=stream_filter, Shader=ColourSwatch(SwatchColor=RGB(194, 195, 191)))

panel_22 = Panel("Start communication server")
py_3 = PythonScript()  # -> path
# ---------- py_3: Python ----------
import sys
import os
from scriptcontext import sticky as st

ghComp = ghenv.Component
ghDoc = ghComp.OnPingDocument()

# the full path of the gh file
path = ghDoc.FilePath
# the directory of the gh file
path = os.path.dirname(path)
st["path"] = path

json_path = os.path.abspath(os.path.join(path, "..", "tmp"))
path = os.path.abspath(os.path.join(path, "..", "communication"))

st["json_path"] = json_path 

print path
print json_path
# ---------- end py_3 ----------
# Checklist before sending a program to the robot:
# 
# 1. correct IP address and ping tested
# 2. correct tool
# 3. correct main file
# 4. correct example chosen
# 
# if your visualisation is showing something unexpected, check if you have chosen the right option fro the dropdown menu.
panel_23 = Panel("main_posearray_continuous.py")
panel_24 = Panel(py_3)
stream_filter_2 = StreamFilter(Gate=list_7, Stream0="main_discrete_deposition.py", Stream1="main_discrete_extraction.py", Stream2=panel_23)
server = PythonScript(path=panel_24, file=stream_filter_2, start=start)
# ---------- server: Python ----------
import os
import threading
from scriptcontext import sticky as st

server_address = st["server_address"]
server_port = st["server_port"]
ur_ip = st["ur_ip"]
 
main = os.path.join(path, file.strip())


if os.path.isfile(main):
        
    def myfunc():
        syscall = "python %s %s %s %s" % (main, server_address, server_port, ur_ip)
        os.system(syscall)
    
    if start:
        t = threading.Thread(target=myfunc)
        t.start()
else:
    
    raise Exception("File does not exist")
# ---------- end server ----------

# ----
# Visualisation
pose_joints = Data(pose)
robot_2 = Data(set_params)
planes_wcs = Plane(stream_filter)
reset = Button()
back = Button()
py_4 = GhPythonScript(joint_values=ur1_q1_q6)  # -> configuration; inputs joint_values: list
# ---------- py_4: Python ----------
import math
#from compas_fab.robots import Configuration
from ur_online_control_py3.ur.robot import BaseConfiguration

#configuration = Configuration.from_revolute_values([math.radians(d) for d in joint_values])
configuration = BaseConfiguration.from_joints([math.radians(d) for d in joint_values])
# ---------- end py_4 ----------

# ---- group: Calculate joint positions for path
# Add init joint states
joint_states = Data([-0.1728179112, -1.415058186, 1.813991282, -1.971940356, -1.571654205, -3.308720436])
init_configuration = Slider(2, range=0..7)
py_5 = PythonScript(robot=robot_2, planes_WCS=planes_wcs, configuration_idx=init_configuration, init_configuration=joint_states)  # -> configurations; inputs planes_WCS: list, configuration_idx: Int32, init_configuration: list
# ---------- py_5: Python ----------
from compas_ghpython import unload_modules
unload_modules('ur_online_control_py3')

import Rhino.Geometry as rg
from compas.geometry import Frame 
from compas.geometry.xforms import Transformation
from compas_ghpython import draw_frame
from ur_online_control_py3.ur.kinematics import calculate_configurations_for_path, format_joint_positions


# TODO this must be optimized! matrix multiplication!
frames_tool0_RCS = []
for plane_WCS in planes_WCS:
    tcp_WCS = Frame(plane_WCS.Origin, plane_WCS.XAxis, plane_WCS.YAxis)
    tcp_RCS = robot.get_frame_in_RCS(tcp_WCS)
    frames_tool0_RCS.append(robot.get_tool0_frame_from_tcp_frame(tcp_RCS))
    

#configurations = calculate_configurations_for_path(frames_tool0_RCS, robot.params, init_configuration)
configurations = calculate_configurations_for_path(frames_tool0_RCS, robot, init_configuration)
#print configurations
configurations = configurations[min([configuration_idx, len(configurations) - 1])]

def format(numbers, k=4):
    #numbers = format_joint_positions(numbers)
    return "[" + ", ".join([("%." + str(k) + "f") % n for n in numbers]) + "]"
# ---------- end py_5 ----------
start_2 = Button()
step = Button()
stop_3 = Button()
counter = CountThroughList(L=py_5, start=start_2, stop=stop_3, step=step, step_back=back, reset=reset, interval=100)  # -> item; inputs L: list, start: Boolean, stop: Boolean, step_back: Boolean
# ---------- counter: Python ----------
from scriptcontext import sticky as st
from compas_ghpython import update_component


# store data in component
guid = str(ghenv.Component.InstanceGuid)
counter_key = "counter_" + guid
running_key = "running_" + guid

if counter_key not in st:
    st[counter_key] = 0

if running_key not in st:
    st[running_key] = False

if start:
    st[running_key] = True

if stop:
    st[running_key] = False

if step:
    if st[counter_key] < len(L) - 1:
        st[counter_key] += 1

if step_back:
    if st[counter_key] < len(L) - 1:
        st[counter_key] -= 1

if reset:
    st[counter_key] = 0

if len(L):
    item = L[st[counter_key]]

if st[running_key]:
    if st[counter_key] < len(L) - 1:
        st[counter_key] += 1
        update_component(ghenv, interval)
    else:
        st[counter_key] = 0
        st[running_key] = False
# ---------- end counter ----------

# ---- group: Define plane in WCS, calculate joint positions
select_configuration = Slider(2, range=0..7)
pt = Point(Point(125, 207.034131, 0))
xy = XYPlane(Origin=pt)
plane_wcs = Plane(xy)
inverse = PythonScript(robot=robot_2, plane_WCS=plane_wcs, idx=select_configuration)  # -> configuration, plane_WCS; inputs plane_WCS: Plane, idx: Int32
# ---------- inverse: Python ----------
import Rhino.Geometry as rg
from compas.geometry import Frame, Transformation
from compas_ghpython import draw_frame
import math


#plane_WCS.Rotate(math.radians(-10), plane_WCS.YAxis, plane_WCS.Origin)
#plane_WCS.Rotate(math.radians(-10), plane_WCS.ZAxis, plane_WCS.Origin)

plane_WCS.Rotate(math.radians(90), plane_WCS.ZAxis, plane_WCS.Origin)
plane_WCS.Rotate(math.radians(180), plane_WCS.XAxis, plane_WCS.Origin)

tcp_WCS = Frame(plane_WCS.Origin, plane_WCS.XAxis, plane_WCS.YAxis)
#print tcp_WCS

# transform frame to robot coordinate system
#tool_plane_in_RCS = self.get_tool_plane_in_RCS(tp_WCS)
tcp_RCS = robot.get_frame_in_RCS(tcp_WCS)

tool0_RCS = robot.get_tool0_frame_from_tcp_frame(tcp_RCS)

# calculate solutions to frame
solutions = robot.inverse_kinematics(tool0_RCS)

if not len(solutions):
    q = [0,0,0,0,0,0]
else:
    idx = min(len(solutions) - 1, idx)
    q = solutions[idx]
    
#print q

configuration = q
print(configuration)
# ---------- end inverse ----------

# ---- group: Calculate joint positions for path / Shows joint positions along path
flip = BooleanToggle(True)
l2t = PythonScript(L=py_5, flip=flip)  # -> T; inputs L: list, flip: Boolean
# ---------- l2t: Python ----------
from compas_ghpython import list_to_ghtree
L = [l.joint_values for l in L]

if flip:
    L = zip(*L)
T = list_to_ghtree(L)
# ---------- end l2t ----------
graph = QuickGraph(l2t, SortOrder=0)

# ----
panel_25 = Panel("move cartesian")
idx = Slider(0, range=0..100)
commands = Data(python)
list_8 = ValueList({"send all positions": 0, "send only one position": 1}, selected="send all positions")
item = ListItem(List=commands, Index=idx, Wrap=True)
filter = StreamFilter(Gate=list_8, Stream0=commands, Stream1=item)
movel_4 = PythonScript(commands=filter)  # -> script; inputs commands: list
# ---------- movel_4: Python ----------
from scriptcontext import sticky as st

script_lines = []
for cmd in commands:
    #q, a=1.4, v=1.05, t=0, r=0)
    x, y, z, ax, ay, az, speed, radius = cmd
    script_lines.append("movel(p%s, v=%f, r=%f)" % (str([x/1000., y/1000., z/1000, ax, ay, az]), speed/1000., radius/1000.))

robot = st["robot"]
tool_angle_axis = list(robot.tool.tcp_frame.point) + list(robot.tool.tcp_frame.axis_angle_vector)
x, y, z, ax, ay, az = tool_angle_axis

script = "def prog():\n"
script += "\ttextmsg(\">> program start\")\n"
script += "\tset_tcp(p%s)\n" % str([x/1000., y/1000., z/1000, ax, ay, az])
script += "".join(["\t%s\n" % line for line in script_lines])
script += "\ttextmsg(\"<< program end\")\n"
script += "end\n"
script += "prog()\n\n"

print(script)
# ---------- end movel_4 ----------
send_16 = Button()
send_17 = Send(script=movel_4, send=send_16)
panel_26 = Panel(send_17)

# ---- group: Visualise
# Choose from different options, which robot configuration to visualise
list_9 = ValueList({"0 forward, from angles": 0, "1 inverse, from one plane": 1, "2 inverse, from multiple planes": 2, "3 forward, from robot": 3, "4 forward, from robot during runtime": 4}, selected="0 forward, from angles")
filter_2 = StreamFilter(
    Gate=list_9,
    Stream0=py_4,
    Stream1=inverse.configuration,
    Stream2=counter,
    Stream3=pose_joints,
    Stream4=send_5.pose_joints)
draw_2 = PythonScript(robot=robot_2, configuration=filter_2, mesh=ur10_brep, brep=ur10_brep, show_brep=show_brep)  # -> meshes, tool0_plane, tcp_plane, robot_brep; inputs mesh: list, brep: list
# ---------- draw_2: Python ----------
from compas_rhino.utilities.misc import unload_modules
unload_modules("ur_online_control_py3")


from compas_ghpython import draw_frame
from compas_ghpython import mesh_draw
from compas_ghpython.geometry.xforms import xform_from_transformation
from compas.geometry import Frame
from compas.geometry.xforms import Transformation
from compas_fab.robots import Configuration

import Rhino.Geometry as rg
import Rhino

def mesh_update_vertices(mesh, vertices):
    for i in range(len(vertices)):
        mesh.vertex[i].update({'x': vertices[i][0], 'y': vertices[i][1], 'z': vertices[i][2]})

if configuration:
    #print configuration
    #q = BaseConfiguration.from_joints(configuration)
    q = configuration
    print(q)
    #print q.joint_values
    
    #print robot.get_forward_transformations(q)
    R0, R1, R2, R3, R4, R5 = robot.get_forward_transformations(q)
    
    tool0_frame2 = robot.tool0_frame.transformed(R5)
    tcp_frame2 = Frame.from_transformation(Transformation.from_frame(tool0_frame2) * robot.transformation_tool0_tcp)
    
    #print robot.transformation_tool0_tcp
    #print robot.transformation_tcp_tool0
    #print robot.transformation_tool0_tcp * robot.transformation_tcp_tool0
    #print tcp_frame2
    tcp_frame2 = Frame.from_transformation(Transformation.from_frame(tool0_frame2) * robot.transformation_tcp_tool0)
    #print tcp_frame2
    
    tool0_frame, tcp_frame = robot.get_transformed_tool_frames(R5)
    
    tool0_frame = tool0_frame2
    tcp_frame = tcp_frame2
    
    m0, m1, m2, m3, m4, m5 = mesh
    for i in range(6):
        exec("R%drg = xform_from_transformation(R%d)" % (i, i))
        exec("m%d.Transform(R%drg)" % (i, i))
    meshes = [m0, m1, m2, m3, m4, m5]
    #print meshes
    mt = robot.tool.get_transformed_model(Transformation.from_frame(tool0_frame))
    
    if mt:
        meshes.extend(map(mesh_draw, mt))
    
    """
    m0, m1, m2, m3, m4, m5, tool0_frame, tcp_frame = robot.get_transformed_model(q)
    mt = robot.get_transformed_tool_model(tcp_frame)
    
    meshes = []
    meshes.append(mesh_draw(m0))
    meshes.append(mesh_draw(m1))
    meshes.append(mesh_draw(m2))
    meshes.append(mesh_draw(m3))
    meshes.append(mesh_draw(m4))
    meshes.append(mesh_draw(m5))
    if mt:
        meshes.append(mesh_draw(mt))
    
    """
    
    tool0_plane = draw_frame(tool0_frame)
    tcp_plane = draw_frame(tcp_frame)
    
    if show_brep:
        
        b0, b1, b2, b3, b4, b5 = brep
        
        b0.Transform(R0rg)
        b1.Transform(R1rg)
        b2.Transform(R2rg)
        b3.Transform(R3rg)
        b4.Transform(R4rg)
        b5.Transform(R5rg)
        
        robot_brep = [b0, b1, b2, b3, b4, b5]
# ---------- end draw_2 ----------
tool0_plane = Plane(draw_2.tool0_plane)
robot_brep = Brep(draw_2.robot_brep)
mesh = Mesh(draw_2.meshes)
preview_4 = CustomPreview(Geometry=mesh, Shader=ColourSwatch(SwatchColor=RGBA(99, 94, 94, 96)))
tcp_plane = Plane(draw_2.tcp_plane)
draw_3 = RepresentPlaneAsLines(plane=[tcp_plane, tool0_plane], size=100)  # -> G, C
# ---------- draw_3: Python ----------
import Rhino.Geometry as rg
from System.Drawing import Color

if plane:

    G = []
    G.append(rg.Line(plane.Origin, size * plane.XAxis))
    G.append(rg.Line(plane.Origin, size * plane.YAxis))
    G.append(rg.Line(plane.Origin, size * plane.ZAxis))
    
    C = []
    C.append(Color.FromArgb(255, 0, 0))
    C.append(Color.FromArgb(0, 255, 0))
    C.append(Color.FromArgb(0, 0, 255))
# ---------- end draw_3 ----------
preview_5 = CustomPreview(Geometry=draw_3.G, Shader=draw_3.C)

# ----
idx_2 = Slider(0, range=0..100)
panel_27 = Panel("move joints")
joint_configurations = Data(filter_2)
list_10 = ValueList({"send all positions": 0, "send only one position": 1}, selected="send only one position")
item_2 = ListItem(List=joint_configurations, Index=idx_2, Wrap=True)
filter_3 = StreamFilter(Gate=list_10, Stream0=joint_configurations, Stream1=item_2)
movej = PythonScript(joint_configurations=filter_3, velocity=Slider(100, range=0..200))  # -> script; inputs joint_configurations: list
# ---------- movej: Python ----------
script_lines = []


for configuration in joint_configurations:
    #print configuration.joint_values
    script_lines.append("movej(%s, v=%f)" % (str(configuration.joint_values), velocity/1000.))


script = "def prog():\n"
script += "\ttextmsg(\">> program start\")\n"
script += "".join(["\t%s\n" % line for line in script_lines])
script += "\ttextmsg(\"<< program end\")\n"
script += "end\n"
script += "prog()\n\n"


print(script)

#script = ""
# ---------- end movej ----------
send_18 = Button()
send_19 = Send(script=movej, send=send_18)
panel_28 = Panel(send_19)

# ==== cluster Tools

# ---- group: sand deposition tool
geo = Geometry([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])
mesh = Mesh(geo)
brep = Brep(geo)
mjoin = MeshJoin(Meshes=mesh)
yaxis_line = Curve(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)
xaxis_line = Curve(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)
tool = PythonScript(meshes=mjoin, breps=brep, xline=xaxis_line, yline=yaxis_line)  # -> tool; inputs meshes: list of Mesh, breps: list of Brep
# ---------- tool: Python ----------
import Rhino.Geometry as rg
from compas.geometry import Frame
from ur_online_control.ur.tool import Tool
from compas.datastructures import Mesh
from compas_rhino.helpers import mesh_from_guid

xaxis = rg.Line(xline.PointAtStart, xline.PointAtEnd)
yaxis = rg.Line(yline.PointAtStart, yline.PointAtEnd)

if xaxis.From.DistanceTo(yaxis.From) < 0.01:
    origin = xaxis.From
    xaxis = xaxis.Direction
    yaxis = yaxis.Direction
elif xaxis.To.DistanceTo(yaxis.To) < 0.01:
    origin = xaxis.To
    xaxis = -xaxis.Direction
    yaxis = -yaxis.Direction
elif xaxis.From.DistanceTo(yaxis.To) < 0.01:
    origin = xaxis.From
    xaxis = xaxis.Direction
    yaxis = -yaxis.Direction
elif xaxis.To.DistanceTo(yaxis.From) < 0.01:
    origin = xaxis.To
    xaxis = -xaxis.Direction
    yaxis = yaxis.Direction

xaxis.Unitize()
yaxis.Unitize()

print origin
print xaxis
print yaxis

tcp_frame = Frame(origin, xaxis, yaxis)

tool = Tool(tcp_frame)
tool.model = [mesh_from_guid(Mesh, mesh) for mesh in meshes]
#tool.model_xyz = tool.model.xyz
tool.breps = breps
# ---------- end tool ----------

# ---- group: earth deposition tool
geo_2 = Geometry([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])
brep_2 = Brep(geo_2)
mesh_2 = Mesh(geo_2)
mjoin_2 = MeshJoin(Meshes=mesh_2)
yaxis_line_2 = Curve(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)
xaxis_line_2 = Curve(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)
tool_2 = PythonScript(meshes=mjoin_2, breps=brep_2, xline=xaxis_line_2, yline=yaxis_line_2)  # -> tool; inputs meshes: list of Mesh, breps: list of Brep; same code as tool

# ---- group: clay subtraction tool
geo_3 = Geometry([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])
brep_3 = Brep(geo_3)
mesh_3 = Mesh(geo_3)
mjoin_3 = MeshJoin(Meshes=mesh_3)
xaxis_line_3 = Curve(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)
yaxis_line_3 = Curve(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)
tool_3 = PythonScript(meshes=mjoin_3, breps=brep_3, xline=xaxis_line_3, yline=yaxis_line_3)  # -> tool; inputs meshes: list of Mesh, breps: list of Brep; same code as tool

# ---- group: pack tool
geo_4 = Geometry([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])
mesh_4 = Mesh(geo_4)
brep_4 = Brep(geo_4)
mjoin_4 = MeshJoin(Meshes=mesh_4)
yaxis_line_4 = Curve(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)
xaxis_line_4 = Curve(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)
tool_4 = PythonScript(meshes=mjoin_4, breps=brep_4, xline=xaxis_line_4, yline=yaxis_line_4)  # -> tool; inputs meshes: list of Mesh, breps: list of Brep; same code as tool

# ----
tool_id = ClusterInput()
tool_id_2 = Integer(tool_id)

# ---- group: measurement tool
geo_5 = Geometry([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])
mesh_5 = Mesh(geo_5)
mjoin_5 = MeshJoin(Meshes=mesh_5)

# ----
brep_5 = Brep(geo_5)

# ---- group: measurement tool (continued)
tool_5 = PythonScript(meshes=mjoin_5, brep=brep_5)  # -> tool; inputs meshes: list, brep: list
# ---------- tool_5: Python ----------
from ur_online_control.ur.tools import MeasurementTool
from compas.datastructures import Mesh
from compas_rhino.helpers import mesh_from_guid


tool = MeasurementTool()
tool.model = [mesh_from_guid(Mesh, mesh) for mesh in meshes]
#tool.model_xyz = tool.model.xyz
tool.brep = brep
# ---------- end tool_5 ----------

# ----
filter = StreamFilter(Gate=tool_id_2, Stream1=tool_5, Stream2=tool, Stream3=tool_2, Stream4=tool_3, Stream5=tool_4)
py = PythonScript(tool=filter)  # -> tcp_frame, model
# ---------- py: Python ----------
from compas_ghpython import mesh_draw 

if tool:
    tcp_frame = tool.tcp_frame
    model = map(mesh_draw, tool.model)
# ---------- end py ----------
tool_6 = Data(filter)
draw = PythonScript(frame=py.tcp_frame)  # -> G, C
# ---------- draw: Python ----------
import Rhino.Geometry as rg
from System.Drawing import Color

if not size:
    size = 100

if frame:
    plane = rg.Plane(rg.Point3d(*list(frame.point)), rg.Vector3d(*list(frame.xaxis)), rg.Vector3d(*list(frame.yaxis)))

    G = []
    G.append(rg.Line(plane.Origin, size * plane.XAxis))
    G.append(rg.Line(plane.Origin, size * plane.YAxis))
    G.append(rg.Line(plane.Origin, size * plane.ZAxis))
    
    C = []
    C.append(Color.FromArgb(255, 0, 0))
    C.append(Color.FromArgb(0, 255, 0))
    C.append(Color.FromArgb(0, 0, 255))
# ---------- end draw ----------
tool_7 = ClusterOutput(tool_6)
preview = CustomPreview(Geometry=py.model, Shader=ColourSwatch(SwatchColor=RGBA(141, 170, 178, 150)))
preview_2 = CustomPreview(Geometry=draw.G, Shader=draw.C)

# ==== cluster Send
script = ClusterInput()
send = ClusterInput()
send_2 = PythonScript(script=script, send=send)  # -> out
# ---------- send_2: Python ----------
import socket
from scriptcontext import sticky as st

ur_ip = st["ur_ip"]
ur_port = 30002

if send:
    s = socket.create_connection((ur_ip, ur_port), timeout=0.5) 
    s.send(script)
    s.close()
# ---------- end send_2 ----------
out = ClusterOutput(send_2)

# ==== cluster Draw
frame = ClusterInput()
size = ClusterInput()
draw = PythonScript(frame=frame, size=size)  # -> G, C
# ---------- draw: Python ----------
import Rhino.Geometry as rg
from System.Drawing import Color

if not size:
    size = 100

if frame:
    
    plane = rg.Plane(rg.Point3d(*list(frame.point)), rg.Vector3d(*list(frame.xaxis)), rg.Vector3d(*list(frame.yaxis)))

    G = []
    G.append(rg.Line(plane.Origin, size * plane.XAxis))
    G.append(rg.Line(plane.Origin, size * plane.YAxis))
    G.append(rg.Line(plane.Origin, size * plane.ZAxis))
    
    C = []
    C.append(Color.FromArgb(255, 0, 0))
    C.append(Color.FromArgb(0, 255, 0))
    C.append(Color.FromArgb(0, 0, 255))
# ---------- end draw ----------
G = ClusterOutput(draw.G)
C = ClusterOutput(draw.C)
