# Grasshopper definition 191011_ExampleBricks_cm.gh (Grasshopper 1.0.7)

# ---- group: Brick Wall / Adjust for Brick Spacing
n = Slider(6, range=0..100)

# ---- group: Brick Wall / Brick Size
x = Slider(132, range=0..1000)
y = Slider(26, range=0..1000)
z = Slider(63, range=0..1000)

# ---- group: Brick Wall
base_thickness = Slider(18, range=0..100)
clearance = Slider(70, range=0..100)

# ----
# 1.
# Settings
# --> Set your IP address
# --> Set robot IP address
server_address = ValueList({"192.168.10.1", "192.168.10.2", "192.168.10.3", "127.0.0.1"}, selected="192.168.10.1")
ur_ip1 = ValueList({"192.168.10.10", "192.168.10.11", "192.168.10.12", "127.0.0.1"}, selected="192.168.10.10")
server_port = Integer(30003)
globals = PythonScript(server_address=server_address, server_port=server_port, ur_ip1=ur_ip1)  # inputs server_port: Int32
# ---------- globals: Python ----------
from scriptcontext import sticky as st

st["server_address"] = server_address
st["server_port"] = server_port

st["ur_ip1"] = ur_ip1
print st["ur_ip1"]
# ---------- end globals ----------

# ----
# Check if UR is available
ping = Button()
py = PythonScript(ip=ur_ip1, ping=ping)  # -> out, trigger
# ---------- py: Python ----------
from scriptcontext import sticky as st
from ur_online_control.communication import is_available

print ip
guid = str(ghenv.Component.InstanceGuid)
txt_key = "txt_" + guid
if txt_key not in st:
    st[txt_key] = ""

if ping:
    
    available = is_available(ip)
    
    if available:
        st[txt_key] = "%s is up!" % ip
        trigger = True
    else:
        st[txt_key] = "%s is down!" % ip
        trigger = False

print st[txt_key]
# ---------- end py ----------
panel = Panel(py.out)

# ---- group: Brick Wall / Pick Up Location
panel_2 = Panel("up_Grab")
panel_3 = Panel("down_Grab")
pt = Point(<point referenced from the Rhino model>)
crv = Curve(<curve referenced from the Rhino model>)
crv_2 = Curve(<curve referenced from the Rhino model>)
pt_2 = Point(<point referenced from the Rhino model>)
crv_3 = Curve(<curve referenced from the Rhino model>)
crv_4 = Curve(<curve referenced from the Rhino model>)
pl = ConstructPlane(Origin=pt_2, XAxis=crv_3, YAxis=crv_4)
pl_2 = ConstructPlane(Origin=pt, XAxis=crv, YAxis=crv_2)

# ---- group: Brick Wall
Z = UnitZ(Factor=1)
srf = Surface(<surface referenced from the Rhino model>)
pt_3 = Point(Point(0, 0, 0))
contour = Contour(Shape=srf, Point=pt_3, Direction=Z, Distance=z)  # -> flatten(Contours)
crv_5 = Curve(contour)
dispatch = Dispatch(List=crv_5, DispatchPattern=[True, False])  # -> ListA, ListB
crv_6 = Curve(dispatch.ListA)
crv_7 = Curve(dispatch.ListB)
hframes = HorizontalFrames(Curve=crv_6, Count=n)  # -> Frames, Parameters
hframes_2 = HorizontalFrames(Curve=crv_7, Count=n)  # -> Frames, Parameters
dispatch_2 = Dispatch(List=hframes.Frames, DispatchPattern=[True, False])  # -> ListA, ListB
dispatch_3 = Dispatch(List=hframes_2.Frames, DispatchPattern=[True, False])  # -> ListA, ListB
pln = Plane(dispatch_2.ListA)
pln_2 = Plane(dispatch_3.ListB)
pln_3 = Plane([pln, pln_2])
Z_2 = UnitZ(Factor=z)
move = Move(Geometry=pln_3, Motion=Z_2)  # -> Geometry, Transform
Z_3 = UnitZ(Factor=base_thickness)
move_2 = Move(Geometry=move.Geometry, Motion=Z_3)  # -> Geometry, Transform
pflip = FlipPlane(Plane=flatten(move_2.Geometry), ReverseX=False, ReverseY=False, SwapAxes=True)
vec = VectorXYZ(XComponent=0, YComponent=0, ZComponent=clearance)  # -> Vector, Length
move_3 = Move(Geometry=pflip, Motion=vec.Vector)  # -> Geometry, Transform
python = GhPythonScript(planes=pflip, planes_off=move_3.Geometry, grab_down=pl, grab_up=pl_2)  # -> out, planes_all; inputs planes: list of Plane, planes_off: list of Plane, grab_down: Plane, grab_up: Plane
# ---------- python: Python ----------
planes_all = []
for i, p in enumerate(planes):
    planes_all.append([])
    planes_all[i].append(grab_up)
    planes_all[i].append(grab_down)
    planes_all[i].append(grab_up)
    planes_all[i].append(planes_off[i])
    planes_all[i].append(p)
    planes_all[i].append(planes_off[i])

#print planes_all


open_gripper = [1, 5]
close_gripper = [2]
# ---------- end python ----------

# ---- group: Brick Wall / Visualization
box = DomainBox(Base=PlaneXY(0, 0, 0), X=x, Y=y, Z=z)
debrep = DeconstructBrep(Brep=box)  # -> Faces, Edges, Vertices
item = ListItem(List=debrep.Faces, Index=Slider(5, range=0..10), Wrap=True)
area = Area(Geometry=item)  # -> Area, Centroid
xy = XYPlane(Origin=area.Centroid)
orient = Orient(Geometry=box, Source=xy, Target=move_2.Geometry)  # -> Geometry, Transform

# ----
bang = Button()
panel_4 = Panel("Unload libraries")
unload = PythonScript(bang=bang)
# ---------- unload: Python ----------
from compas_ghpython import unload_modules

unload_modules("compas")
unload_modules("ur_online_control")
unload_modules("ffw_2018")
# ---------- end unload ----------

list = ValueList({"no_tool": 0, "measurement_tool": 1, "sand_deposition_tool": 2, "earth_deposition_tool": 3, "clay_subtraction_tool": 4, "pack_tool": 5, "arch_2019july_tool3A": 6, "arch_2019july_tool3B": 7}, selected="arch_2019july_tool3A")
# Here, you can set the basis for your robot
list_2 = ValueList({"robot 1": "robot_1", "robot 2": "robot_2", "robot 3": "robot_3"}, selected="robot 1")
tools = Tools(tool_id=list)

# ---- group: Robot1
# 1. load robot model
# 2. set tool
# 3. set basis
list_3 = ValueList({"UR3", "UR5", "UR10"}, selected="UR3")
base = PythonScript(rnum=list_2)  # -> base_frame
# ---------- base: Python ----------
from compas.geometry import Frame
#from compas.geometry import Transformation, Rotation
#from compas_ghpython import xdraw_frame
#import math
#import Rhino.Geometry as rg




# for robots 1 and 2


#if rnum == "robot_1":
#    origin = [0.0, 0.0, 0.0]
#    xaxis = [0.0, -0.5, 0.0]
#    yaxis = [0.5, 0.0, 0.0]
    
if rnum == "robot_1":
    origin = [0.0, 0.0, 0.0]
    xaxis = [0.5, 0.0, 0.0]
    yaxis = [0.0, 0.5, 0.0]

#if rnum == "robot_1":
#    origin = [-468.74, -100.60, 161.23]
#    xaxis = [0.71376, 0.70037, 0.00520]
#    yaxis = [-0.70037, 0.71364, 0.01408]
#    

if rnum == "robot_2":
    origin = [-468.74, -100.60, 161.23]
    xaxis = [0.71376, 0.70037, 0.00520]
    yaxis = [-0.70037, 0.71364, 0.01408]


if rnum == "robot_3":
    origin = [-110.14, 465.76, 167.41]
    xaxis = [0.71228, -0.70189, -0.00042]
    yaxis = [0.70182, 0.71220, 0.01506]


base_frame = Frame(list(origin), list(xaxis), list(yaxis))
print base_frame
# ---------- end base ----------
robot = PythonScript(model=list_3)  # -> robot1
# ---------- robot: Python ----------
from ur_online_control.ur.ur10 import UR10
from ur_online_control.ur.ur5 import UR5
from ur_online_control.ur.ur3 import UR3
from scriptcontext import sticky as st

if model == "UR5":
    robot1 = UR5()
elif model == "UR10":
    robot1 = UR10()
elif model == "UR3":
    robot1 = UR3()
# ---------- end robot ----------
set_params = PythonScript(robot1=robot, tool=tools, base_frame=base)  # -> robot1
# ---------- set_params: Python ----------
from ur_online_control.ur.ur10 import UR10
from ur_online_control.ur.ur5 import UR5
from scriptcontext import sticky as st
from ur_online_control.ur.tool import Tool
from compas.geometry import Frame


if tool:
    robot1.set_tool(tool)
else:
    robot1.set_tool(Tool(Frame.worldXY()))  
if base_frame:
    robot1.set_base(base_frame)

st["robot1"] = robot1
# ---------- end set_params ----------

# ---- group: Brick Number
number_slider = Slider(0, range=0..30)

# ----
pt_4 = Point(<point referenced from the Rhino model>)
crv_8 = Curve(<curve referenced from the Rhino model>)
crv_9 = Curve(<curve referenced from the Rhino model>)
python_2 = GhPythonScript(planes_all=python.planes_all, x=number_slider)  # -> out, planes; inputs planes_all: list, x: Int32
# ---------- python_2: Python ----------
planes = planes_all[x]
# ---------- end python_2 ----------
pl_3 = ConstructPlane(Origin=pt_4, XAxis=crv_8, YAxis=crv_9)

# ----
# Start Code
send_all_at_once = BooleanToggle(False)
send = Button()

# ----
# Select Command Number
number_slider_2 = Slider(0, range=0..50)

# ----
# Commands
movel = BooleanToggle(True)

circle = Circle({Plane=Plane(origin=(2018.848076, -545.262131, 0), x=(0.8459221749, 0.5333063604, 0), y=(-0.5333063604, 0.8459221749, 0)), Radius=83.94869685})
crv_10 = Curve(<curve referenced from the Rhino model>)
divide = DivideCurve(Curve=crv_10, Count=10, Kinks=False)  # -> Points, Tangents, Parameters
pln_4 = Plane(divide.Points)
panel_5 = Panel(pln_4)

# ---- group: Define joint positions
wrist2 = Slider(-82.725, range=-360..360)
base_2 = Slider(-329.599, range=-360..360)
shoulder = Slider(-49.479, range=-360..360)
elbow = Slider(-111.454, range=-360..360)
wrist1 = Slider(-190.504, range=-360..360)
wrist3 = Slider(91.571, range=-360..360)
ur1_q1_q6 = Data([base_2, shoulder, elbow, wrist1, wrist2, wrist3])

# ----
# Visualisation
planes_wcs = Plane(python_2.planes)
robot_2 = Data(set_params)
back = Button()
reset = Button()
py_2 = GhPythonScript(joint_values=ur1_q1_q6)  # -> configuration; inputs joint_values: list
# ---------- py_2: Python ----------
import math
from compas_fab.robots import Configuration

configuration = Configuration.from_revolute_values([math.radians(d) for d in joint_values])
# ---------- end py_2 ----------

item_2 = ListItem(List=planes_wcs, Index=0, Wrap=True)

# ---- group: Define plane in WCS, calculate joint positions
pt_5 = Point(Point(-57.48867812, -568.9400192, 535.0971902))
plane_wcs = Plane(pl_3)
xy_2 = XYPlane(Origin=pt_5)
deplane = DeconstructPlane(Plane=xy_2)  # -> Origin, XAxis, YAxis, ZAxis
multiplication = Multiplication(A=deplane.XAxis, B=-1)
select_configuration = Slider(3, range=0..7)
pl_4 = ConstructPlane(Origin=deplane.Origin, XAxis=multiplication, YAxis=deplane.YAxis)
inverse = PythonScript(robot1=robot_2, plane_WCS=plane_wcs, idx=select_configuration)  # -> configuration, plane_WCS; inputs plane_WCS: Plane, idx: Int32
# ---------- inverse: Python ----------
import Rhino.Geometry as rg
from compas.geometry import Frame, Transformation
from compas_ghpython import xdraw_frame
import math


#plane_WCS.Rotate(math.radians(-10), plane_WCS.YAxis, plane_WCS.Origin)
#plane_WCS.Rotate(math.radians(-10), plane_WCS.ZAxis, plane_WCS.Origin)

plane_WCS.Rotate(math.radians(90), plane_WCS.ZAxis, plane_WCS.Origin)

tcp_WCS = Frame(plane_WCS.Origin, plane_WCS.XAxis, plane_WCS.YAxis)
#print tcp_WCS

# transform frame to robot1 coordinate system
#tool_plane_in_RCS = self.get_tool_plane_in_RCS(tp_WCS)
tcp_RCS = robot1.get_frame_in_RCS(tcp_WCS)

tool0_RCS = robot1.get_tool0_frame_from_tcp_frame(tcp_RCS)

# calculate solutions to frame
solutions = robot1.inverse_kinematics(tool0_RCS)

if not len(solutions):
    q = [0,0,0,0,0,0]
else:
    idx = min(len(solutions) - 1, idx)
    q = solutions[idx]
    
#print q

configuration = q
print configuration
# ---------- end inverse ----------

# ---- group: Calculate joint positions for path
# Add init joint states
init_configuration = Slider(0, range=0..7)
joint_states = Data([-0.1728179112, -1.415058186, 1.813991282, -1.971940356, -1.571654205, -3.308720436])
py_3 = PythonScript(robot1=robot_2, planes_WCS=planes_wcs, configuration_idx=init_configuration, init_configuration=joint_states)  # -> configurations, planes_tool0_RCS; inputs planes_WCS: list, configuration_idx: Int32, init_configuration: list
# ---------- py_3: Python ----------
from compas_ghpython import unload_modules
unload_modules('ur_online_control')
import Rhino.Geometry as rg
from compas.geometry import Frame 
from compas.geometry.xforms import Transformation
from compas_ghpython import xdraw_frame
from ur_online_control.ur.kinematics import calculate_configurations_for_path, format_joint_positions


# TODO this must be optimized! matrix multiplication!
frames_tool0_RCS = []
planes_tool0_RCS = []
for plane_WCS in planes_WCS:
    tcp_WCS = Frame(plane_WCS.Origin, plane_WCS.XAxis, plane_WCS.YAxis)
    tcp_RCS = robot1.get_frame_in_RCS(tcp_WCS)
    frames_tool0_RCS.append(robot1.get_tool0_frame_from_tcp_frame(tcp_RCS))
    planes_tool0_RCS.append(xdraw_frame(frames_tool0_RCS[-1]))

#configurations = calculate_configurations_for_path(frames_tool0_RCS, robot1.params, init_configuration)
configurations = calculate_configurations_for_path(frames_tool0_RCS, robot1, init_configuration)
#print configurations
configurations = configurations[min([configuration_idx, len(configurations) - 1])]

def format(numbers, k=4):
    #numbers = format_joint_positions(numbers)
    return "[" + ", ".join([("%." + str(k) + "f") % n for n in numbers]) + "]"
# ---------- end py_3 ----------
start = Button()
stop = Button()
step = Button()
counter = CountThroughList(L=py_3.configurations, start=start, stop=stop, step=step, step_back=back, reset=reset, interval=100)  # -> item; inputs L: list, start: Boolean, stop: Boolean, step_back: Boolean
# ---------- counter: Python ----------
from scriptcontext import sticky as st
from compas_ghpython import update_component


# store data in component
guid = str(ghenv.Component.InstanceGuid)
counter_key = "counter_" + guid
running_key = "running_" + guid

if counter_key not in st:
    st[counter_key] = 0

if running_key not in st:
    st[running_key] = False

if start:
    st[running_key] = True

if stop:
    st[running_key] = False

if step:
    if st[counter_key] < len(L) - 1:
        st[counter_key] += 1

if step_back:
    if st[counter_key] < len(L) - 1:
        st[counter_key] -= 1

if reset:
    st[counter_key] = 0

if len(L):
    item = L[st[counter_key]]

if st[running_key]:
    if st[counter_key] < len(L) - 1:
        st[counter_key] += 1
        update_component(ghenv, interval)
    else:
        st[counter_key] = 0
        st[running_key] = False
# ---------- end counter ----------

# ----
pln_5 = Plane(py_3.planes_tool0_RCS)

# ---- group: Calculate joint positions for path / Shows joint positions along path
flip = BooleanToggle(False)
l2t = PythonScript(L=py_3.configurations, flip=flip)  # -> T; inputs L: list, flip: Boolean
# ---------- l2t: Python ----------
from compas_ghpython import list_to_ghtree
L = [l.values for l in L]

if flip:
    L = zip(*L)
T = list_to_ghtree(L)
# ---------- end l2t ----------
graph = QuickGraph(l2t, SortOrder=0)

# ----
python_3 = GhPythonScript()  # -> out, joints_rad
# ---------- python_3: Python ----------
import math

joints = []

joints.append([0, -90, 0, 0, -90, 0])
joints.append([0, -90, 10, 10, -90, 10])

joints_rad = []
for degrees in joints:
    radians = [math.radians(d) for d in degrees]
    joints_rad.append(radians)
    
print joints_rad
# ---------- end python_3 ----------
generate_urscript = PythonScript(
    robot1=robot_2,
    bool_all=send_all_at_once,
    pos_nb=number_slider_2,
    joints_list=python_3.joints_rad,
    planes_cartesian=pln_5,
    velocity=Slider(98, range=0..1000),
    acceleration=Slider(96, range=0..5000),
    movel=movel)  # -> script; inputs pos_nb: Int32, joints_list: list, planes_cartesian: list of Plane
# ---------- generate_urscript: Python ----------
from compas.geometry import Frame
from compas_ghpython.utilities import xdraw_frame

script_lines = []

if movel:
    if bool_all == False:
        plane = planes_cartesian[pos_nb]
        f = Frame(plane.Origin, plane.XAxis, plane.YAxis)
        print f.point
#        tcp_WCS = Frame(plane[0], plane[1], plane[2])
        pose = robot1.get_pose_angle_axis_in_RCS(f)
        
        print "plane", plane
        print "pose", pose
        x, y, z, = plane.Origin[0], plane.Origin[1], plane.Origin[2]
        x, y, z, ax, ay, az = pose
        script_lines.append("movel(p%s, a=%f, v=%f, r=%f)" % (str([x/1000., y/1000., z/1000, ax, ay, az]), acceleration/1000., velocity/1000., 0.00))
    else:
        for i,plane in enumerate(planes_cartesian):
            if i == 1 or i == 5:
                script_lines.append("sleep(1)") 
                script_lines.append("set_digital_out(0, False)") 
                script_lines.append("set_digital_out(1, True)") 
                script_lines.append("sleep(1)") 
            if i == 2:
                script_lines.append("sleep(1)") 
                script_lines.append("set_digital_out(1, False)") 
                script_lines.append("set_digital_out(0, True)") 
                script_lines.append("sleep(1)") 
                
            f = Frame(plane.Origin, plane.XAxis, plane.YAxis)
            pose = robot1.get_pose_angle_axis_in_RCS(f)
            
            ax, ay, az = f.axis_angle_vector
            x, y, z, = plane.Origin[0], plane.Origin[1], plane.Origin[2]
            script_lines.append("movel(p%s, a=%f, v=%f, r=%f)" % (str([x/1000., y/1000., z/1000, ax, ay, az]), acceleration/1000., velocity/1000., 0.00))

script = "def prog():\n"
script += "\ttextmsg(\">> program start\")\n"
script += "".join(["\t%s\n" % line for line in script_lines])
script += "\ttextmsg(\"<< program end\")\n"
script += "end\n"
script += "prog()\n\n"


print script

#script = ""
# ---------- end generate_urscript ----------
send_2 = Send(script=generate_urscript, send=send)

ur10_brep = UR10Brep([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])

# ---- group: Visualise / robot model brep
py_4 = PythonScript(model="UR3")  # -> n
# ---------- py_4: Python ----------
if model == "UR5":
    n = 0
if model == "UR10":
    n = 1
if model == "UR3":
    n = 2


#n = 2 
print n
# ---------- end py_4 ----------
ur10_brep_2 = UR10Brep([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])
ur5_brep = UR5Brep([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])
show_brep = BooleanToggle(True)
filter = StreamFilter(Gate=py_4, Stream0=ur5_brep, Stream1=ur10_brep_2, Stream2=ur10_brep)

# ---- group: Visualise
# Choose from different options, which robot configuration to visualise
list_4 = ValueList({"0 forward, from angles": 0, "1 inverse, from one plane": 1, "2 inverse, from multiple planes": 2, "3 forward, from robot": 3, "4 forward, from robot during runtime": 4}, selected="2 inverse, from multiple planes")
filter_2 = StreamFilter(Gate=list_4, Stream0=py_2, Stream1=inverse.configuration, Stream2=counter)
draw = PythonScript(robot1=robot_2, configuration=filter_2, mesh=filter, brep=filter, show_brep=show_brep)  # -> meshes, tool0_plane, tcp_plane, robot_brep, list_degree; inputs mesh: list, brep: list, show_brep: Boolean
# ---------- draw: Python ----------
from compas_ghpython import unload_modules
unload_modules("ur_online_control")

from compas_ghpython import xdraw_frame
from compas_ghpython import mesh_draw
from compas_ghpython.geometry.xforms import xform_from_transformation
from compas.geometry import Frame
from compas.geometry.xforms import Transformation
from compas_fab.robots import Configuration

import Rhino.Geometry as rg
import Rhino
import math

def mesh_update_vertices(mesh, vertices):
    for i in range(len(vertices)):
        mesh.vertex[i].update({'x': vertices[i][0], 'y': vertices[i][1], 'z': vertices[i][2]})

if configuration:
    list_joint_values = configuration.data["values"]
    list_degree = []
    for degree in list_joint_values:
        degree = math.degrees(degree)
        list_degree.append(degree)
    print list_degree
    #q = BaseConfiguration.from_joints(configuration)
    q = configuration
    print q
    #print q.joint_values
    
    #print robot1.get_forward_transformations(q)
    R0, R1, R2, R3, R4, R5 = robot1.get_forward_transformations(q)
    
    tool0_frame2 = robot1.tool0_frame.transformed(R5)
    tcp_frame2 = Frame.from_transformation(Transformation.from_frame(tool0_frame2) * robot1.transformation_tool0_tcp)
    
    #print robot1.transformation_tool0_tcp
    #print robot1.transformation_tcp_tool0
    #print robot1.transformation_tool0_tcp * robot1.transformation_tcp_tool0
    #print tcp_frame2
    tcp_frame2 = Frame.from_transformation(Transformation.from_frame(tool0_frame2) * robot1.transformation_tcp_tool0)
    #print tcp_frame2
    
    tool0_frame, tcp_frame = robot1.get_transformed_tool_frames(R5)
    
    tool0_frame = tool0_frame2
    tcp_frame = tcp_frame2
    
    m0, m1, m2, m3, m4, m5 = mesh
    for i in range(6):
        exec("R%drg = xform_from_transformation(R%d)" % (i, i))
        exec("m%d.Transform(R%drg)" % (i, i))
    meshes = [m0, m1, m2, m3, m4, m5]
    #print meshes
    mt = robot1.tool.get_transformed_model(Transformation.from_frame(tool0_frame))
    
    if mt:
        meshes.extend(map(mesh_draw, mt))
    
    """
    m0, m1, m2, m3, m4, m5, tool0_frame, tcp_frame = robot1.get_transformed_model(q)
    mt = robot1.get_transformed_tool_model(tcp_frame)
    
    meshes = []
    meshes.append(mesh_draw(m0))
    meshes.append(mesh_draw(m1))
    meshes.append(mesh_draw(m2))
    meshes.append(mesh_draw(m3))
    meshes.append(mesh_draw(m4))
    meshes.append(mesh_draw(m5))
    if mt:
        meshes.append(mesh_draw(mt))
    
    """
    
    tool0_plane = xdraw_frame(tool0_frame)
    tcp_plane = xdraw_frame(tcp_frame)
    
    if show_brep:
        
        b0, b1, b2, b3, b4, b5 = brep
        
        b0.Transform(R0rg)
        b1.Transform(R1rg)
        b2.Transform(R2rg)
        b3.Transform(R3rg)
        b4.Transform(R4rg)
        b5.Transform(R5rg)
        
        robot_brep = [b0, b1, b2, b3, b4, b5]
        print robot_brep

#print brep
# ---------- end draw ----------
robot_brep = Brep(draw.robot_brep)
mesh = Mesh(draw.meshes)
preview = CustomPreview(Geometry=mesh, Shader=ColourSwatch(SwatchColor=RGBA(0, 255, 229, 119)))
tcp_plane = Plane(draw.tcp_plane)
tool0_plane = Plane(draw.tool0_plane)
draw_2 = RepresentPlaneAsLines(plane=[tcp_plane, tool0_plane], size=100)  # -> G, C
# ---------- draw_2: Python ----------
import Rhino.Geometry as rg
from System.Drawing import Color

if plane:

    G = []
    G.append(rg.Line(plane.Origin, size * plane.XAxis))
    G.append(rg.Line(plane.Origin, size * plane.YAxis))
    G.append(rg.Line(plane.Origin, size * plane.ZAxis))
    
    C = []
    C.append(Color.FromArgb(255, 0, 0))
    C.append(Color.FromArgb(0, 255, 0))
    C.append(Color.FromArgb(0, 0, 255))
# ---------- end draw_2 ----------
preview_2 = CustomPreview(Geometry=draw_2.G, Shader=draw_2.C)

# ==== cluster Send
script = ClusterInput()
send = ClusterInput()
send_2 = PythonScript(script=script, send=send)  # -> out
# ---------- send_2: Python ----------
import socket
from scriptcontext import sticky as st

ur_ip2 = st["ur_ip1"]
ur_port = 30002

if send:
    s = socket.create_connection((ur_ip2, ur_port), timeout=0.5) 
    s.send(script)
    s.close()
# ---------- end send_2 ----------
out = ClusterOutput(send_2)

# ==== cluster Tools

# ---- group: arch_2019july_tool3A
geo = Geometry([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])
mesh = Mesh(geo)
brep = Brep(geo)
mjoin = MeshJoin(Meshes=mesh)
xaxis_line = Curve(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)
yaxis_line = Curve(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)
tool = PythonScript(meshes=mjoin, breps=brep, xline=xaxis_line, yline=yaxis_line)  # -> tool; inputs meshes: list of Mesh, breps: list of Brep
# ---------- tool: Python ----------
import Rhino.Geometry as rg
from compas.geometry import Frame
from ur_online_control.ur.tool import Tool
from compas.datastructures import Mesh
from compas_rhino.helpers import mesh_from_guid

xaxis = rg.Line(xline.PointAtStart, xline.PointAtEnd)
yaxis = rg.Line(yline.PointAtStart, yline.PointAtEnd)

if xaxis.From.DistanceTo(yaxis.From) < 0.01:
    origin = xaxis.From
    xaxis = xaxis.Direction
    yaxis = yaxis.Direction
elif xaxis.To.DistanceTo(yaxis.To) < 0.01:
    origin = xaxis.To
    xaxis = -xaxis.Direction
    yaxis = -yaxis.Direction
elif xaxis.From.DistanceTo(yaxis.To) < 0.01:
    origin = xaxis.From
    xaxis = xaxis.Direction
    yaxis = -yaxis.Direction
elif xaxis.To.DistanceTo(yaxis.From) < 0.01:
    origin = xaxis.To
    xaxis = -xaxis.Direction
    yaxis = yaxis.Direction

xaxis.Unitize()
yaxis.Unitize()

print origin
print xaxis
print yaxis

tcp_frame = Frame(origin, xaxis, yaxis)

tool = Tool(tcp_frame)
tool.model = [mesh_from_guid(Mesh, mesh) for mesh in meshes]
#tool.model_xyz = tool.model.xyz
tool.breps = breps
# ---------- end tool ----------

# ---- group: arch_2019july_tool3B
geo_2 = Geometry([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])
mesh_2 = Mesh(geo_2)
brep_2 = Brep(geo_2)
mjoin_2 = MeshJoin(Meshes=mesh_2)
xaxis_line_2 = Curve(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)
yaxis_line_2 = Curve(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)
tool_2 = PythonScript(meshes=mjoin_2, breps=brep_2, xline=xaxis_line_2, yline=yaxis_line_2)  # -> tool; inputs meshes: list of Mesh, breps: list of Brep; same code as tool

# ---- group: sand deposition tool
geo_3 = Geometry([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])
mesh_3 = Mesh(geo_3)
brep_3 = Brep(geo_3)
mjoin_3 = MeshJoin(Meshes=mesh_3)
yaxis_line_3 = Curve(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)
xaxis_line_3 = Curve(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)
tool_3 = PythonScript(meshes=mjoin_3, breps=brep_3, xline=xaxis_line_3, yline=yaxis_line_3)  # -> tool; inputs meshes: list of Mesh, breps: list of Brep; same code as tool

# ---- group: earth deposition tool
geo_4 = Geometry([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])
brep_4 = Brep(geo_4)
mesh_4 = Mesh(geo_4)
mjoin_4 = MeshJoin(Meshes=mesh_4)
yaxis_line_4 = Curve(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)
xaxis_line_4 = Curve(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)
tool_4 = PythonScript(meshes=mjoin_4, breps=brep_4, xline=xaxis_line_4, yline=yaxis_line_4)  # -> tool; inputs meshes: list of Mesh, breps: list of Brep; same code as tool

# ---- group: clay subtraction tool
geo_5 = Geometry([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])
brep_5 = Brep(geo_5)
mesh_5 = Mesh(geo_5)
mjoin_5 = MeshJoin(Meshes=mesh_5)
xaxis_line_5 = Curve(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)
yaxis_line_5 = Curve(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)
tool_5 = PythonScript(meshes=mjoin_5, breps=brep_5, xline=xaxis_line_5, yline=yaxis_line_5)  # -> tool; inputs meshes: list of Mesh, breps: list of Brep; same code as tool

# ---- group: pack tool
geo_6 = Geometry([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])
mesh_6 = Mesh(geo_6)
brep_6 = Brep(geo_6)
mjoin_6 = MeshJoin(Meshes=mesh_6)
yaxis_line_6 = Curve(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)
xaxis_line_6 = Curve(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)
tool_6 = PythonScript(meshes=mjoin_6, breps=brep_6, xline=xaxis_line_6, yline=yaxis_line_6)  # -> tool; inputs meshes: list of Mesh, breps: list of Brep; same code as tool

# ----
tool_id = ClusterInput()
tool_id_2 = Integer(tool_id)

# ---- group: measurement tool
geo_7 = Geometry([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])
mesh_7 = Mesh(geo_7)
mjoin_7 = MeshJoin(Meshes=mesh_7)

# ----
brep_7 = Brep(geo_7)

# ---- group: measurement tool (continued)
tool_7 = PythonScript(meshes=mjoin_7, brep=brep_7)  # -> tool; inputs meshes: list, brep: list
# ---------- tool_7: Python ----------
from ur_online_control.ur.tools import MeasurementTool
from compas.datastructures import Mesh
from compas_rhino.helpers import mesh_from_guid


tool = MeasurementTool()
tool.model = [mesh_from_guid(Mesh, mesh) for mesh in meshes]
#tool.model_xyz = tool.model.xyz
tool.brep = brep
# ---------- end tool_7 ----------

# ----
filter = StreamFilter(
    Gate=tool_id_2,
    Stream1=tool_7,
    Stream2=tool_3,
    Stream3=tool_4,
    Stream4=tool_5,
    Stream5=tool_6,
    Stream6=tool,
    Stream7=tool_2)
py = PythonScript(tool=filter)  # -> tcp_frame, model
# ---------- py: Python ----------
from compas_ghpython import mesh_draw 

if tool:
    tcp_frame = tool.tcp_frame
    model = map(mesh_draw, tool.model)
# ---------- end py ----------
tool_8 = Data(filter)
draw = PythonScript(frame=py.tcp_frame)  # -> G, C
# ---------- draw: Python ----------
import Rhino.Geometry as rg
from System.Drawing import Color

if not size:
    size = 100

if frame:
    plane = rg.Plane(rg.Point3d(*list(frame.point)), rg.Vector3d(*list(frame.xaxis)), rg.Vector3d(*list(frame.yaxis)))

    G = []
    G.append(rg.Line(plane.Origin, size * plane.XAxis))
    G.append(rg.Line(plane.Origin, size * plane.YAxis))
    G.append(rg.Line(plane.Origin, size * plane.ZAxis))
    
    C = []
    C.append(Color.FromArgb(255, 0, 0))
    C.append(Color.FromArgb(0, 255, 0))
    C.append(Color.FromArgb(0, 0, 255))
# ---------- end draw ----------
tool_9 = ClusterOutput(tool_8)
preview = CustomPreview(Geometry=py.model, Shader=ColourSwatch(SwatchColor=RGBA(141, 170, 178, 150)))
preview_2 = CustomPreview(Geometry=draw.G, Shader=draw.C)
