# Grasshopper definition ur_simple_speckle_old.gh (Grasshopper 1.0.7)
# plug-ins: UserDataUtils

# ----
# --> Set your IP address
# --> Set robot IP address
ur_ip1 = ValueList({"192.168.10.10", "192.168.10.11", "192.168.10.12", "127.0.0.1"}, selected="192.168.10.10")
# Settings
server_address = ValueList({"192.168.10.1", "192.168.10.2", "192.168.10.3", "192.168.10.20", "127.0.0.1"}, selected="192.168.10.1")
server_port = Integer(30003)
globals = PythonScript(server_address=server_address, server_port=server_port, ur_ip1=ur_ip1)  # inputs server_port: Int32
# ---------- globals: Python ----------
from scriptcontext import sticky as st

st["server_address"] = server_address
st["server_port"] = server_port

st["ur_ip1"] = ur_ip1
print st["ur_ip1"]
# ---------- end globals ----------

# ----
# Select Command Number
number_slider = Slider(15, range=0..50)

# ----
# Commands
movej = BooleanToggle(False)
movel = BooleanToggle(True)

# ----
# Start Code
send_all_at_once = BooleanToggle(True)
send = Button()

send_2 = Button()
gripper_urscript = PythonScript(close=Toggle(False), open=Toggle(True))  # -> script
# ---------- gripper_urscript: Python ----------
from compas.geometry import Frame
from compas_ghpython.utilities import draw_frame

script_lines = []

if close == True:
    script_lines.append("sleep(1)") 
    script_lines.append("set_digital_out(1, False)") 
    script_lines.append("set_digital_out(0, True)") 
    script_lines.append("sleep(1)")
if open == True:
    script_lines.append("sleep(1)") 
    script_lines.append("set_digital_out(0, False)") 
    script_lines.append("set_digital_out(1, True)") 
    script_lines.append("sleep(1)") 


script = "def prog():\n"
script += "\ttextmsg(\">> program start\")\n"
script += "".join(["\t%s\n" % line for line in script_lines])
script += "\ttextmsg(\"<< program end\")\n"
script += "end\n"
script += "prog()\n\n"


print script

#script = ""
# ---------- end gripper_urscript ----------
pt = Point(<point referenced from the Rhino model>)
pt_2 = Point(<point referenced from the Rhino model>)
panel = Panel(gripper_urscript)
python = GhPythonScript()  # -> out, joints_rad
# ---------- python: Python ----------
import math

joints = []

joints.append([0, -90, 0, 0, -90, 0])
joints.append([0, -90, 10, 10, -90, 10])

joints_rad = []
for degrees in joints:
    radians = [math.radians(d) for d in degrees]
    joints_rad.append(radians)
    
print joints_rad
# ---------- end python ----------
xy_plane = XYPlane(Origin=pt)
xy_plane_2 = XYPlane(Origin=pt_2)
send_3 = PythonScript(script=gripper_urscript, send=send_2)  # -> out; same code as send_2
merge = Merge(Data1=xy_plane_2, Data2=xy_plane)
generate_urscript = PythonScript(
    bool_all=send_all_at_once,
    pos_nb=number_slider,
    joints_list=python.joints_rad,
    planes_cartesian=merge,
    velocity=Slider(20, range=0..1000),
    acceleration=Slider(20, range=0..5000),
    movej=movej,
    movel=movel)  # -> script; inputs pos_nb: Int32, joints_list: list, planes_cartesian: list of Plane
# ---------- generate_urscript: Python ----------
from compas.geometry import Frame

script_lines = []


if movej:
    if bool_all == False:
        configuration = joints_list[pos_nb]
        script_lines.append("movej(%s, a=%f, v=%f, r=%f)" % (str(configuration), acceleration/1000., velocity/1000., 0.0))
    else:
        for configuration in joints_list:
            script_lines.append("movej(%s, a=%f, v=%f, r=%f)" % (str(configuration), acceleration/1000., velocity/1000., 0.0))
if movel:
    if bool_all == False:
        plane = planes_cartesian[pos_nb]
        f = Frame(plane.Origin, plane.XAxis, plane.YAxis)
        ax, ay, az = f.axis_angle_vector
        x, y, z, = plane.Origin[0], plane.Origin[1], plane.Origin[2]
        script_lines.append("movel(p%s, a=%f, v=%f, r=%f)" % (str([x/1000., y/1000., z/1000, ax, ay, az]), acceleration/1000., velocity/1000., 0.005))
    else:
        for plane in planes_cartesian:
            f = Frame(plane.Origin, plane.XAxis, plane.YAxis)
            ax, ay, az = f.axis_angle_vector
            x, y, z, = plane.Origin[0], plane.Origin[1], plane.Origin[2]
            script_lines.append("movel(p%s, a=%f, v=%f, r=%f)" % (str([x/1000., y/1000., z/1000, ax, ay, az]), acceleration/1000., velocity/1000., 0.005))

script = "def prog():\n"
script += "\ttextmsg(\">> program start\")\n"
script += "".join(["\t%s\n" % line for line in script_lines])
script += "\ttextmsg(\"<< program end\")\n"
script += "end\n"
script += "prog()\n\n"


print script

#script = ""
# ---------- end generate_urscript ----------
panel_2 = Panel(generate_urscript)
send_4 = Send(script=generate_urscript, send=send)

# ----
# SENDING COMMANDS
panel_3 = Panel(generate_urscript)  # disabled
projects = Projects(Account=<missing>)  # -> Projects, SelectedProject; disabled
streams = Streams(Account=<missing>, History=False)  # disabled
anonymous_stream = DataSender(A=panel_3, DebouncingDisabled=False, manualmode=False, remotecontroller=False)  # -> Log, StreamId
add_streams = AddStreamsToProject(Account=<missing>, Project=projects.SelectedProject, Streams=anonymous_stream.StreamId)  # disabled

# ----
# RECEIVING COMMANDS
streams_2 = Streams(Account=<missing>, History=False)
panel_4 = Panel(streams_2)
item = ListItem(List=streams_2, Index="2", Wrap=True)
eud = ExpandDictionaryOrSpeckleObject(Dictionaries=item)  # -> StreamId, Name, Description, Layers, Tags, Parent, Children, Ancestors
panel_5 = Panel(eud.StreamId)
stream_it = DataReceiver(ID=panel_5, deserialize=True)
panel_6 = Panel(stream_it)
# 1. Change stream in list selector manually (i.e. no slider) to allow the receiving component to update
# 
# 2. If you make a new stream (to upload your info) add users manually per stream on speckle server (so that they can receive the stream.
# 
# 3. Changing the name of the sending stream component in grasshopper will change the name of the stream on speckle server
# 
# 4. Ensure your receiver component has the correct name at the top (i.e. (R) Stream_Edvard). If this is not changing as you change your stream ID/number, then it is frozen. Copy the component and delete old one to reset.
send_5 = Button()
send_6 = Send(script=panel_6, send=send_5)

# ==== cluster Send
script = ClusterInput()
send = ClusterInput()
send_2 = PythonScript(script=script, send=send)  # -> out
# ---------- send_2: Python ----------
import socket
from scriptcontext import sticky as st

ur_ip2 = st["ur_ip1"]
ur_port = 30002

if send:
    s = socket.create_connection((ur_ip2, ur_port), timeout=0.5) 
    s.send(script)
    s.close()
# ---------- end send_2 ----------
out = ClusterOutput(send_2)
